# Grasshopper definition chp.gh (Grasshopper 1.0.7)
# plug-ins: sia380Parameters, sia380, combustion

rooms_existing = RoomsExisting({"1.1 Wohnen Mehrfamilienhaus": {"description": "1.1 Wohnen Mehrfamilienhaus", "Raumlufttemperatur Auslegung Heizen (Winter)": 21.0, "Nettogeschossflaeche": 20.0, "Thermische Gebaeudehuellflaeche": 26.0, "U-Wert Fenster": 1.5, "Waermeeintragsleistung Personen (bei 24.0 deg C, bzw. 70 W)": 2.2999999999999998, "Jaehrliche Vollaststunden der Geraete": 1780.0, "U-Wert opake Bauteile": 0.80000000000000004, "Jaehrliche Vollaststunden der Raumbeleuchtung": 1450.0, "Vollaststunden pro Jahr (Personen)": 4090.0, "Abminderungsfaktor fuer Fensterrahmen": 0.75, "Aussenluft-Volumenstrom durch Infiltration": 0.29999999999999999, "Raumlufttemperatur Auslegung Kuehlung (Sommer)": 26.0, "Glasanteil": 30.0, "Zeitkonstante": 68.0, "Waermeeintragsleistung der Raumbeleuchtung": 2.7000000000000002, "Waermeeintragsleistung der Geraete": 10.0, "Gesamtenergiedurchlassgrad Verglasung": 0.65000000000000002, "Temperatur-Aenderungsgrad der Waermerueckgewinnung": NaN, "Aussenluft-Volumenstrom (pro NGF)": 1.0}, "1.2 Wohnen Einfamilienhaus": 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, "2.1 Hotelzimmer": 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, "2.2 Empfang, Lobby": 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, "3.1 Einzel-, Gruppenbuero": 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, "3.2 Grossraumbuero": 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, "3.3 Sitzungszimmer": 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, "3.4 Schalterhalle, Empfang": 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, "4.1 Schulzimmer": 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, "4.2 Lehrerzimmer": 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}, selected="1.1 Wohnen Mehrfamilienhaus")
number_slider = Slider(1, range=1..12)
python = GhPythonScript(month=number_slider)  # -> out, season; inputs month: Int32
# ---------- python: Python ----------
__author__ = "chwaibel"
__version__ = "2019.11.06"

import rhinoscriptsyntax as rs

summerstart = 3 # summer starts in march
summerend = 9  # summer ends in end of September

if month >= summerstart and month <= summerend:
    season = "summer"
else:
    season = "winter"
# ---------- end python ----------
sia2028 = SIA2028(Month=number_slider)  # -> IHor_Wh_m2, IE_Wh_m2, IS_Wh_m2, IW_Wh_m2, IN_Wh_m2, Θ_e_C
sia2024 = SIA2024(Room=rooms_existing, Month=number_slider, Season=python.season)  # -> Τ_h, Θ_i_C, T_h, A_op_m2, A_w_m2, U_op_W_m2K, U_w_W_m2K, V_e_m3_h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
sia380 = SIA3801(
    Tau=sia2024.Τ_h,
    Theta_e=sia2028.Θ_e_C,
    Theta_i=sia2024.Θ_i_C,
    T=sia2024.T_h,
    A_op=sia2024.A_op_m2,
    A_w=sia2024.A_w_m2,
    U_op=sia2024.U_op_W_m2K,
    U_w=sia2024.U_w_W_m2K,
    Vdot_e=sia2024.V_e_m3_h,
    Vdot_inf=sia2024.V_inf_m3_h,
    Eta_rec=sia2024.Η_rec_,
    Phi_P=sia2024.Φ_P_W,
    Phi_B=sia2024.Φ_L_W,
    Phi_G=sia2024.Φ_G_W,
    T_P=sia2024.T_P_h,
    T_B=sia2024.T_L_h,
    T_G=sia2024.T_A_h,
    G=sia2024.G_,
    F_sh=sia2024.F_sh_,
    I=sia2028.IHor_Wh_m2)  # -> Q_H, Q_T, Q_V, Eta_g, Q_i, Q_s
panel = Panel([sia380.Q_H, sia380.Q_T, sia380.Q_V, sia380.Eta_g, sia380.Q_i, sia380.Q_s])

division = Division(A=sia380.Q_H, B="1000")
chp = Chp(Loads=division, Eta="0.33", Htp="1.57", Fuelcost="0.09", Fuelemissions="0.237")  # -> Total_cost, Total_emissions, Heating_gen, Elec_gen
panel_2 = Panel([chp.Total_cost, chp.Total_emissions, chp.Heating_gen, chp.Elec_gen])

# ---- group: optional. connect to CHP component, "str"
panel_3 = Panel("elec_in")
