# Grasshopper definition epw_reader.gh (Grasshopper 1.0.7)
# plug-ins: epw-reader

# ---- group: put a custom path here
panel = Panel("C:\EnergyPlusV9-1-0\WeatherData\USA_CA_San.Francisco.Intl.AP.724940_TMY3.epw")

# ----
epw_reader = EPWReader(Path=panel)  # -> Latitude, Longitude, CityCountry, DNI, DHI, DryBulb, DewPoint, RH
panel_2 = Panel(epw_reader.RH)
panel_3 = Panel(epw_reader.DewPoint)
panel_4 = Panel(epw_reader.Longitude)
panel_5 = Panel(epw_reader.CityCountry)
panel_6 = Panel(epw_reader.Latitude)
panel_7 = Panel(epw_reader.DHI)
panel_8 = Panel(epw_reader.DryBulb)
panel_9 = Panel(epw_reader.DNI)
