# Grasshopper definition simple_solar_thermal.gh (Grasshopper 1.0.7)
# plug-ins: solar-tech, solar

# ---- group: replace with grasshopper component that reads a surface of a building
number_slider = Slider(99.53, range=0..360)
number_slider_2 = Slider(34.366, range=0..90)

# ----
data = Data([0, 0, 0, 0, 0, 0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])
data_2 = Data([0, 0, 0, 0, 0, 0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])
simplepanel = SimplePanel(Tilt=[Slider(0, range=0..90), number_slider_2], Azimuth=[Slider(180, range=0..360), number_slider], DHI=data, DNI=data_2)
sum_yield = SumYield(Sum_mode="year", Elec=simplepanel)  # -> flatten(Yield)
item = ListItem(List=sum_yield, Index="1", Wrap=True)
item_2 = ListItem(List=sum_yield, Index="0", Wrap=True)
graph = QuickGraph(simplepanel, SortOrder=0)
orfac = OrientationFactor(G_flat=item_2, G_angled=item)
panel = Panel(orfac)
division = Division(A=item_2, B="1000")
simplest = SimpleST(Global_Irradiation=division, FormFactor=panel, SurfaceArea="10")

# ---- group: Total thermal energy generation
panel_2 = Panel(simplest)
