# Grasshopper definition sia380_sia2024.gh (Grasshopper 1.0.7)
# plug-ins: sia380, sia2024

number_slider = Slider(1, range=1..12)
panel = Panel("""mfh
efh
office
school""")
panel_2 = Panel("""standard
ideal
existing""")
item = ListItem(List=panel, Index=Slider(0, range=0..3), Wrap=True)
item_2 = ListItem(List=panel_2, Index=Slider(0, range=0..2), Wrap=True)
python = GhPythonScript(month=number_slider)  # -> out, season; inputs month: Int32
# ---------- python: Python ----------
__author__ = "chwaibel"
__version__ = "2019.11.06"

import rhinoscriptsyntax as rs

summerstart = 3 # summer starts in march
summerend = 9  # summer ends in end of September

if month >= summerstart and month <= summerend:
    season = "summer"
else:
    season = "winter"
# ---------- end python ----------
panel_3 = Panel(item)
panel_4 = Panel(item_2)
sia2024 = SIA2024(Use_case=panel_3, Bldgtype=panel_4, Month=number_slider, Season=python.season)  # -> Τ_h, Θ_i_C, T_h, A_op_m2, A_w_m2, U_op_W_m2K, U_w_W_m2K, V_e_m3_h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

# ---- group: ambient temperature should come from weather file
python_2 = GhPythonScript(month=number_slider)  # -> out, theta_e; inputs month: Int32
# ---------- python_2: Python ----------
__author__ = "chwaibel"
__version__ = "2019.11.07"

theta_list = [0.5, 1.7, 5.8, 8.9, 14.1, 16.5, 18.5, 18.4, 14.2, 10.4, 4.7, 1.7]
theta_e = theta_list[month-1]
# ---------- end python_2 ----------

# ---- group: Irradiation should come from weather file or solar siomulation
python_3 = GhPythonScript(month=number_slider)  # -> out, I; inputs month: Int32
# ---------- python_3: Python ----------
__author__ = "chwaibel"
__version__ = "2019.11.06"

import rhinoscriptsyntax as rs

I_list = [37778.0, 46944.0, 57222.0, 53611.0, 56389.0, 53889.0, 56944.0, 56389.0, 50278.0, 45000.0, 32778.0, 29444.0]
I=I_list[month-1]
# ---------- end python_3 ----------
panel_5 = Panel("0")

# ----
sia380 = SIA3801(
    Tau=sia2024.Τ_h,
    Theta_e=python_2.theta_e,
    Theta_i=sia2024.Θ_i_C,
    T=sia2024.T_h,
    A_op=sia2024.A_op_m2,
    A_w=sia2024.A_w_m2,
    U_op=sia2024.U_op_W_m2K,
    U_w=sia2024.U_w_W_m2K,
    Vdot_e=sia2024.V_e_m3_h,
    Vdot_inf=sia2024.V_inf_m3_h,
    Eta_rec=sia2024.Η_rec_,
    Phi_P=sia2024.Φ_P_W,
    Phi_B=sia2024.Φ_L_W,
    Phi_G=sia2024.Φ_G_W,
    T_P=sia2024.T_P_h,
    T_B=sia2024.T_L_h,
    T_G=sia2024.T_A_h,
    G=sia2024.G_,
    F_sh=sia2024.F_sh_,
    I=panel_5)  # -> Q_H, Q_T, Q_V, Eta_g, Q_i, Q_s
panel_6 = Panel([sia380.Q_H, sia380.Q_T, sia380.Q_V, sia380.Eta_g, sia380.Q_i, sia380.Q_s])
