# Grasshopper definition obstructed_panel.gh (Grasshopper 1.0.7)
# plug-ins: solar

# ---- group: analysis surface
srf = Surface(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)
mesh_uv = MeshSurface(Surface=srf, UCount=Slider(10, range=0..100), VCount=Slider(10, range=0..100), Overhang=True, Equalize=False)
mesh = Mesh(mesh_uv)

# ----
mesh_2 = Mesh(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)

# ---- group: ground
mesh_3 = Mesh(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)

# ----
data = Data([-65.34878984, -62.13426796, -54.95901857, -45.81747693, -35.88714072, -25.78253978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])
data_2 = Data([8.415567703, 33.69912388, 56.58914543, 72.99109311, 85.75265625, 96.74276768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])
data_3 = Data([0, 0, 0, 0, 0, 0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])
data_4 = Data([0, 0, 0, 0, 0, 0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])
obstructedpanel = ObstructedPanel(Mesh_analysis=mesh, Obstructions=[mesh_3, mesh_2], DHI=data_4, DNI=data_3, Solarazi=data_2, Solaralti=data)  # -> AnnualPotential, Mesh_visu
area = Area(Geometry=mesh)  # -> Area, Centroid
division = Division(A=obstructedpanel.AnnualPotential, B=area.Area)

# ---- group: average irradiance on obstructed surface
graph = QuickGraph(division, SortOrder=0)
