# Grasshopper definition simplest_panel.gh (Grasshopper 1.0.7)
# plug-ins: pv-sum, solar, solarParameters

data = Data([0, 0, 0, 0, 0, 0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])
data_2 = Data([0, 0, 0, 0, 0, 0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])

# ---- group: replace with grasshopper component that reads a surface of a building
number_slider = Slider(180.54, range=0..360)
number_slider_2 = Slider(90, range=0..90)
panel = Panel("10")

# ----
simplepanel = SimplePanel(Tilt=[Slider(0, range=0..90), number_slider_2], Azimuth=[Slider(180, range=0..360), number_slider], DHI=data, DNI=data_2)
graph = QuickGraph(simplepanel, SortOrder=0)
pveffl = PVEfficiency({"Silicone": {"PV tech": "Silicone", "efficiency": 0.10000000000000001}, "Monocrystalline": {"PV tech": "Monocrystalline", "efficiency": 0.14999999999999999}, "Polycrystalline": {"PV tech": "Polycrystalline", "efficiency": 0.20000000000000001}, "Super-duper-tech": {"PV tech": "Super-duper-tech", "efficiency": 0.25}}, selected="Super-duper-tech")
prl = PerformanceRatio({"Roof perfect": {"Scenario": "Roof perfect", "performance ratio": 0.84999999999999998}, "Roof normal": {"Scenario": "Roof normal", "performance ratio": 0.75}, "Roof dirty": {"Scenario": "Roof dirty", "performance ratio": 0.69999999999999996}, "Facade perfect": {"Scenario": "Facade perfect", "performance ratio": 0.75}, "Facade normal": {"Scenario": "Facade normal", "performance ratio": 0.69999999999999996}, "Facade shaded": {"Scenario": "Facade shaded", "performance ratio": 0.59999999999999998}}, selected="Roof perfect")
sum_yield = SumYield(Sum_mode="year", Elec=simplepanel)
multiplication = Multiplication(A=sum_yield, B="1")
perfrat = PerformanceRatio(Performance_scenario=prl)
pveff = PVEfficiency(PV_tech=pveffl)

# ---- group: from W to kWh
division = Division(A=multiplication, B="1000")  # -> flatten(Result)

# ----
panel_2 = Panel(division)
item = ListItem(List=panel_2, Index="0", Wrap=True)
item_2 = ListItem(List=panel_2, Index="1", Wrap=True)
orfac = OrientationFactor(G_flat=item, G_angled=item_2)
eacspanel = EaCSPanel(Global_Irradiation=item, FormFactor=orfac, SurfaceArea=panel, PVEfficiency=pveff, PerformanceRatio=perfrat)

# ---- group: Annual PV electricity yield in kWh/m2a
panel_3 = Panel(eacspanel)
