# Grasshopper definition Multiple_PV_surfaces.gh (Grasshopper 1.0.7)
# plug-ins: HiveIO, solar-tech, sia380Parameters, solar, heatpumps, sia380, GHSolar, epw-reader

# ---- group: Pfad zur Wetterdatei (*.epw)
# EuKS2 - Heizwärmebedarf und PV Ertrag (simuliert)
# Berechnungen zur Abschätzung des Wärmebedarfs.
# Basiert auf der Excel Tabelle "Interaktion Struktur, Klima und Wärmebedarf.xlsx"
# 
# Sonneneinstrahlung simuliert gemäss "Waibel, C., Evins, R., Carmeliet, J. 2017. Efficient time-resolved 3D solar potential modelling. Solar Energy 158 (2017) 960–976."
panel = Panel("C:\Users\Christoph\Documents\GitHub\hive\Exercises\HIVE_Zurich.epw")

# ----
rooms_standard = RoomsStandard({"1.1 Wohnen Mehrfamilienhaus": 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, "1.2 Wohnen Einfamilienhaus": {"description": "1.2 Wohnen Einfamilienhaus", "Raumlufttemperatur Auslegung Heizen (Winter)": 21.0, "Nettogeschossflaeche": 20.0, "Thermische Gebaeudehuellflaeche": 38.0, "U-Wert Fenster": 1.2, "Waermeeintragsleistung Personen (bei 24.0 deg C, bzw. 70 W)": 1.3999999999999999, "Jaehrliche Vollaststunden der Geraete": 1780.0, "U-Wert opake Bauteile": 0.20000000000000001, "Jaehrliche Vollaststunden der Raumbeleuchtung": 1450.0, "Vollaststunden pro Jahr (Personen)": 4090.0, "Abminderungsfaktor fuer Fensterrahmen": 0.75, "Aussenluft-Volumenstrom durch Infiltration": 0.14999999999999999, "Raumlufttemperatur Auslegung Kuehlung (Sommer)": 26.0, "Glasanteil": 30.0, "Zeitkonstante": 164.0, "Waermeeintragsleistung der Raumbeleuchtung": 2.7000000000000002, "Waermeeintragsleistung der Geraete": 8.0, "Gesamtenergiedurchlassgrad Verglasung": 0.5, "Temperatur-Aenderungsgrad der Waermerueckgewinnung": 0.69999999999999996, "Aussenluft-Volumenstrom (pro NGF)": 0.59999999999999998}, "2.1 Hotelzimmer": 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, "2.2 Empfang, Lobby": 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, "3.1 Einzel-, Gruppenbuero": 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, "3.2 Grossraumbuero": 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, "3.3 Sitzungszimmer": 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, "3.4 Schalterhalle, Empfang": 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, "4.1 Schulzimmer": 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, "4.2 Lehrerzimmer": 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}, selected="1.2 Wohnen Einfamilienhaus")
rooms_existing = RoomsExisting({"1.1 Wohnen Mehrfamilienhaus": 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, "1.2 Wohnen Einfamilienhaus": {"description": "1.2 Wohnen Einfamilienhaus", "Raumlufttemperatur Auslegung Heizen (Winter)": 21.0, "Nettogeschossflaeche": 20.0, "Thermische Gebaeudehuellflaeche": 38.0, "U-Wert Fenster": 1.5, "Waermeeintragsleistung Personen (bei 24.0 deg C, bzw. 70 W)": 1.3999999999999999, "Jaehrliche Vollaststunden der Geraete": 1780.0, "U-Wert opake Bauteile": 0.80000000000000004, "Jaehrliche Vollaststunden der Raumbeleuchtung": 1450.0, "Vollaststunden pro Jahr (Personen)": 4090.0, "Abminderungsfaktor fuer Fensterrahmen": 0.75, "Aussenluft-Volumenstrom durch Infiltration": 0.29999999999999999, "Raumlufttemperatur Auslegung Kuehlung (Sommer)": 26.0, "Glasanteil": 30.0, "Zeitkonstante": 56.0, "Waermeeintragsleistung der Raumbeleuchtung": 2.7000000000000002, "Waermeeintragsleistung der Geraete": 10.0, "Gesamtenergiedurchlassgrad Verglasung": 0.65000000000000002, "Temperatur-Aenderungsgrad der Waermerueckgewinnung": NaN, "Aussenluft-Volumenstrom (pro NGF)": 0.59999999999999998}, "2.1 Hotelzimmer": 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, "2.2 Empfang, Lobby": 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, "3.1 Einzel-, Gruppenbuero": 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, "3.2 Grossraumbuero": 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, "3.3 Sitzungszimmer": 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, "3.4 Schalterhalle, Empfang": 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, "4.1 Schulzimmer": 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, "4.2 Lehrerzimmer": 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}, selected="1.2 Wohnen Einfamilienhaus")
rooms_ideal = RoomsIdeal({"1.1 Wohnen Mehrfamilienhaus": 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, "1.2 Wohnen Einfamilienhaus": {"description": "1.2 Wohnen Einfamilienhaus", "Raumlufttemperatur Auslegung Heizen (Winter)": 21.0, "Nettogeschossflaeche": 20.0, "Thermische Gebaeudehuellflaeche": 38.0, "U-Wert Fenster": 0.90000000000000002, "Waermeeintragsleistung Personen (bei 24.0 deg C, bzw. 70 W)": 1.3999999999999999, "Jaehrliche Vollaststunden der Geraete": 1780.0, "U-Wert opake Bauteile": 0.10000000000000001, "Jaehrliche Vollaststunden der Raumbeleuchtung": 1110.0, "Vollaststunden pro Jahr (Personen)": 4090.0, "Abminderungsfaktor fuer Fensterrahmen": 0.75, "Aussenluft-Volumenstrom durch Infiltration": 0.14999999999999999, "Raumlufttemperatur Auslegung Kuehlung (Sommer)": 26.0, "Glasanteil": 30.0, "Zeitkonstante": 238.0, "Waermeeintragsleistung der Raumbeleuchtung": 1.7, "Waermeeintragsleistung der Geraete": 4.0, "Gesamtenergiedurchlassgrad Verglasung": 0.5, "Temperatur-Aenderungsgrad der Waermerueckgewinnung": 0.80000000000000004, "Aussenluft-Volumenstrom (pro NGF)": 0.59999999999999998}, "2.1 Hotelzimmer": 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, "2.2 Empfang, Lobby": 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, "3.1 Einzel-, Gruppenbuero": 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, "3.2 Grossraumbuero": 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, "3.3 Sitzungszimmer": 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, "3.4 Schalterhalle, Empfang": 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, "4.1 Schulzimmer": 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, "4.2 Lehrerzimmer": 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}, selected="1.2 Wohnen Einfamilienhaus")

# ---- group: PV Fläche
srf = Surface(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)

# ---- group: Boden
mesh = Mesh(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)

# ---- group: Gebäudevolumen
brep = Brep(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)

# ----
mesh_uv = MeshSurface(Surface=srf, UCount="6", VCount="6", Overhang=True, Equalize=False)

# ---- group: Umgebungsbebauung
mesh_2 = Mesh([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])

# ---- group: Fensterflächen
srf_2 = Surface([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])

# ---- group: DHI and DNI change to EnergyCarrier type
epw_reader = EPWReader(Path=panel)  # -> Latitude, Longitude, CityCountry, GHI, DNI, DHI, DryBulb, DewPoint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

# ----
hiveiosolar = HiveIOSolarTech(Mesh=mesh_uv)
hive_io_bldg = HiveIOBuilding(ZoneBrepGeometries=brep, WindowsSurfaces=srf_2, SIA2024Room=rooms_standard)
hiveiosolar_2 = HiveIOSolarTech(Mesh=mesh_uv)
hive_io_env = HiveIOEnvironment(EPWPath=panel, ObstaclesGeometry=[mesh, mesh_2])
hiveiosolar_3 = HiveIOSolarTech(Mesh=mesh_uv)
adaptcomf = AdaptiveComfort(T_m=epw_reader.DryBulbMonthly)  # -> T_n, T_n80ub, T_n80lb, T_n90ub, T_n90lb
hiveiodistr = HiveIODistributor(HiveInputObjects=[hiveiosolar, hive_io_bldg, hive_io_env, hiveiosolar_2, hiveiosolar_3])  # -> HiveIOBuilding, HiveIOEnergySystemSurfaceBased, HiveIOEnvironment
python = GhPythonScript(Hive_SurfaceBased=hiveiodistr.HiveIOEnergySystemSurfaceBased)  # -> out, a; inputs Hive_SurfaceBased: list
# ---------- python: Python ----------
__author__ = "Christoph"
__version__ = "2020.07.04"

import rhinoscriptsyntax as rs

surface_based_tech_infused = []


for solar_tech in Hive_SurfaceBased:
    if solar_tech.ToString() == "Hive.IO.EnergySystems.Photovoltaic":
        surface_based_tech_infused.append(solar_tech)
    if solar_tech.ToString() == "Hive.IO.EnergySystems.SolarThermal":
        surface_based_tech_infused.append(solar_tech)
    if solar_tech.ToString() == "Hive.IO.EnergySystems.GroundCollector":
        surface_based_tech_infused.append(solar_tech)
    if solar_tech.ToString() == "Hive.IO.EnergySystems.PVT":
        surface_based_tech_infused.append(solar_tech)
        
a = surface_based_tech_infused
# ---------- end python ----------
panel_2 = Panel(python.a)
python_2 = GhPythonScript(pv=hiveiosolar)  # -> out, mesh, a
# ---------- python_2: Python ----------
__author__ = "chwaibel"
__version__ = "2020.07.01"

import rhinoscriptsyntax as rs


"""
import Rhino.Geometry as rg
mass_prop = rg.AreaMassProperties.Compute(pv.SurfaceGeometry)
a=mass_prop.Area
"""

mesh = pv.SurfaceGeometry
a = pv.SurfaceArea
# ---------- end python_2 ----------
distrsolar = HiveIODistributorSolar(
    HiveIOBuilding=hiveiodistr.HiveIOBuilding,
    HiveIOEnergySystemSurfaceBased=hiveiodistr.HiveIOEnergySystemSurfaceBased,
    HiveIOEnvironment=hiveiodistr.HiveIOEnvironment)  # -> EnvironmentMesh, BuildingCentroid, ExternalSurfaces, WindowGeometries, SolarTechMesh
hiveiodistrsupsys = HiveIODistributorSupplySystem(HiveIOEnergySystemPV=hiveiodistr.HiveIOEnergySystemSurfaceBased)  # -> EfficiencyPV, PVAreas, EfficiencyST, STAreas, ElectricEfficiencyPVT, ThermalEfficiencyPVT, PVTAreas
python_3 = GhPythonScript(pv=hiveiosolar, ambT=epw_reader.AmbientTemperatureCarrier)  # -> out, a
# ---------- python_3: Python ----------
from __future__ import division
import System
import Grasshopper as gh
import Hive.IO.EnergySystems as ensys


def pv_electricity(pv, solar_carrier, time_resolution, amb_T_carrier, beta, NOCT, NOCT_ref, NOCT_sol):
    electricity_generated = pv_yield(pv.SurfaceArea, pv.RefEfficiencyElectric, beta, NOCT, NOCT_ref, NOCT_sol, amb_T_carrier.AvailableEnergy, solar_carrier.AvailableEnergy)
    electricity_horizon = []
    if time_resolution == "hourly":
        horizon = 8760
        electricity_horizon = electricity_generated[0]
    else:   # monthly
        horizon = 12
        days_per_month = [31, 28, 31, 30, 31, 30, 31, 31, 30, 31, 30, 31]
        hours_per_day = 24
        total_months = 12
        for month in range(total_months):
            start_hour = int(hours_per_day * sum(days_per_month[0:month]))
            end_hour = int(hours_per_day * sum(days_per_month[0:month + 1]))
            # hours_per_month = days_per_month[month] * hours_per_day # could be used to compute average values
            electricity_horizon.append(sum(electricity_generated[0][start_hour:end_hour]))

    electricity_carrier = ensys.Electricity(horizon, System.Array[float](electricity_horizon), System.Array[float]([0.0] * horizon), System.Array[float]([0.0] * horizon))
    pv.SetInputOutput(solar_carrier, electricity_carrier)
    return pv


def pv_yield(A, eta_PVref, beta, NOCT, NOCT_ref, NOCT_sol, T_amb, I):
    """
    Computes PV electricity yield
    :param A:
    :param eta_PVref:
    :param beta:
    :param NOCT:
    :param NOCT_ref:
    :param NOCT_sol:
    :param T_amb:
    :param I:
    :return:
    """
    eta_pv = pv_efficiency(eta_PVref, beta, NOCT, NOCT_ref, NOCT_sol, T_amb, I)
    pvyield = [0.0] * len(eta_pv)
    for i in range(0, len(eta_pv)):
        pvyield[i] = A * eta_pv[i] * I[i]
    return pvyield, eta_pv


def pv_efficiency(eta_PVref, beta, NOCT, NOCT_ref, NOCT_sol, T_amb, I):
    """
    Calculates time resolved PV efficiency [-]
    :param eta_PVref: Reference PV efficiency under NOCT [-]
    :param beta: Temperature coefficient [-]
    :param NOCT: Nominal operating cell temperature [deg C]
    :param NOCT_ref: Reference temperature [deg C]
    :param NOCT_sol: Reference irradiance [W/m2]
    :param T_amb: Ambient temperature [deg C]
    :param I: Irradiance on panel [W/m2]. 8760 time series
    :return: Time resolved PV efficiency [-], 8760 entries
    """
    horizon = len(T_amb)
    etapv = [0.0] * horizon
    for i in range(0, horizon):
        Tpv = T_amb[i] + ((NOCT - NOCT_ref) / NOCT_sol) * I[i]
        etapv[i] = eta_PVref * (1 - beta * (Tpv - 25))
        print Tpv
    print(NOCT)
    return etapv
    
    

a = pv_electricity(pv, solar, "hourly", ambT, 0.004, 45, 20, 800)
# ---------- end python_3 ----------
python_4 = GhPythonScript(x=epw_reader.AmbientTemperatureCarrier)  # -> out, a
# ---------- python_4: Python ----------
__author__ = "Christoph"
__version__ = "2020.07.02"

import rhinoscriptsyntax as rs

a = x.AvailableEnergy
# ---------- end python_4 ----------
python_5 = GhPythonScript(x=python_3.a)  # -> out, elec, solar
# ---------- python_5: Python ----------
__author__ = "Christoph"
__version__ = "2020.07.02"

import rhinoscriptsyntax as rs

elec = x.OutputCarriers[0].AvailableEnergy
solar = x.InputCarrier.AvailableEnergy
# ---------- end python_5 ----------
distributorsia = DistributorSIA(BuildingObj=hiveiodistr.HiveIOBuilding)  # -> ZoneAreas, WindowsAreas, ExtSrfAreas, SIA2024json
panel_3 = Panel(python_2.a)
distributorepw = DistributorEPW(EnvironmentObj=hiveiodistr.HiveIOEnvironment)
pvelectricity = PVElectricity(Photovoltaic=hiveiosolar, TimeResolution="hourly", AmbientTemperatureCarrier=epw_reader.AmbientTemperatureCarrier)
panel_4 = Panel(python_4.a)
python_6 = GhPythonScript(x=python_5.elec, area=python_2.a)  # -> out, a; inputs x: list
# ---------- python_6: Python ----------
__author__ = "Christoph"
__version__ = "2020.07.02"

import rhinoscriptsyntax as rs

list = []
for b in x:
    list.append(b / area)
    print(b)
    
a = b
# ---------- end python_6 ----------
panel_5 = Panel(python_5.solar)
sia2024 = SIA2024Rooms(
    Room=distributorsia.SIA2024json,
    Area=distributorsia.ZoneAreas,
    Month=[1, 2, 3, 4, 5, 6, 7, 8, 9, 10, 11, 12],
    Season="winter")  # -> Τ_h, Θ_i_C, T_h, A_op_m2, A_w_m2, U_op_W_m2K, U_w_W_m2K, V_e_m3_h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
panel_6 = Panel(python_5.elec)

# ----
# PV Ertrag (simuliert)
data = Data([0.8, 0.8, 0.8, 0.8, 0.8, 0.8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])  # disabled
mesh_3 = Mesh(distrsolar.ExternalSurfaces)  # disabled
obstobj = ObstacleObject(Mesh=distrsolar.SolarTechMesh, Albedo=data, SpecCoeff=data, ReflType=0, Tolerance=0.01, Name="PV", MT=True)  # disabled
obstobj_2 = ObstacleObject(Mesh=distrsolar.EnvironmentMesh, Albedo=data, SpecCoeff=data, ReflType=0, Tolerance=0.01, Name="PV", MT=True)  # disabled
irrmshy = IrradiationMeshYear(
    AnalysisObjects=obstobj,
    ObstacleObjects=obstobj_2,
    Latitude=epw_reader.Latitude,
    Longitude=epw_reader.Longitude,
    Year=2017,
    DNI=epw_reader.DNI,
    DHI=epw_reader.DHI,
    MainSkyRes=1,
    SpecBounces=0,
    DiffIReflSkyRes=0,
    DiffIReflMode=2,
    MT=True)  # disabled
readresults = ReadResults(Mesh=distrsolar.SolarTechMesh, I=irrmshy, Value=7)  # -> Results, SP; disabled
python_7 = GhPythonScript(x=simplify(readresults.Results), month=[0, 1, 2, 3, 4, 5, 6, 7, 8, 9, 10, 11])  # -> out, a; inputs x: list, month: Int32; disabled
# ---------- python_7: Python ----------
__author__ = "chwaibel"
__version__ = "2020.02.25"

import rhinoscriptsyntax as rs

# 8760 time series
# get monthly average...
# how to know how many days a month? somewhere, I have typical year.
# in some honey-badger script

dayspermonth = [31.0, 28.0, 31.0, 30.0, 31.0, 30.0, 31.0, 31.0, 30.0, 31.0, 30.0, 31.0]

hour_per_day = 24
start_hour = int(hour_per_day * sum(dayspermonth[0:month])) 
end_hour = int(hour_per_day * sum(dayspermonth[0:month+1]))

cumulative_data = sum(x[start_hour:end_hour])

a = cumulative_data / 1000
# ---------- end python_7 ----------
c_script = CSharpScript(G=python_7.a, g=hiveiodistrsupsys.EfficiencyPV)  # -> out, Q_s; inputs G: tree of Double, g: list of Double; disabled
# ---------- c_script: C# ----------
    int winCount = G.BranchCount;
    double [] Q_array = new double[12];

    DataTree<double> doubleTree = new DataTree<double>();
    for (int i = 0; i < G.BranchCount; i++)
    {
      for (int j = 0; j < G.Branch(i).Count; ++j) // should be 12, 1 for each month of the year
      {
        GH_Path path = new GH_Path(i, j);
        double irrad = G.Branch(i)[j]  * g[i];
        doubleTree.Add(irrad, path);

        Q_array[j] += irrad;
      }
    }

    Q_s = Q_array;
# ---------- end c_script ----------
ma = MassAddition(Input=c_script.Q_s)  # -> Result, PartialResults; disabled
ma_2 = MassAddition(Input=hiveiodistrsupsys.PVAreas)  # -> Result, PartialResults; disabled
division = Division(A=ma.Result, B=ma_2.Result)  # disabled

# ----
# Solare Wärmeeinträge
mesh_4 = MeshBrep(
    Brep=distrsolar.WindowGeometries,
    Settings={GridMaxCount=0, GridMinCount=16, JaggedSeams=False, MaxEdgeLength=0, MinEdgeLength=0.0001, MinTolerance=0, Refine=True, RefineAngle=0, RelativeTolerance=0.65, SimplePlanes=True, Tolerance=0})  # disabled
# SOLAR
obstobj_3 = ObstacleObject(Mesh=mesh_4, Albedo=data, SpecCoeff=data, ReflType=0, Tolerance=0.01, Name="PV", MT=True)  # disabled
irrmshy_2 = IrradiationMeshYear(
    AnalysisObjects=obstobj_3,
    ObstacleObjects=obstobj_2,
    Latitude=epw_reader.Latitude,
    Longitude=epw_reader.Longitude,
    Year=2017,
    DNI=epw_reader.DNI,
    DHI=epw_reader.DHI,
    MainSkyRes=1,
    SpecBounces=0,
    DiffIReflSkyRes=0,
    DiffIReflMode=2,
    MT=True)  # disabled
readresults_2 = ReadResults(Mesh=mesh_4, I=irrmshy_2, Value=7)  # -> simplify(Results), SP; disabled
python_8 = GhPythonScript(x=simplify(readresults_2.Results), month=[0, 1, 2, 3, 4, 5, 6, 7, 8, 9, 10, 11])  # -> out, a; inputs x: list, month: Int32; disabled; same code as python_7
item = ListItem(List=sia2024.G_, Index=0, Wrap=True)  # disabled
c_script_2 = CSharpScript(G=python_8.a, g=item)  # -> out, Q_s; inputs G: tree of Double, g: Double; disabled
# ---------- c_script_2: C# ----------
    int winCount = G.BranchCount;
    double [] Q_array = new double[12];

    DataTree<double> doubleTree = new DataTree<double>();
    for (int i = 0; i < G.BranchCount; i++)
    {
      for (int j = 0; j < G.Branch(i).Count; ++j) // should be 12, 1 for each month of the year
      {
        GH_Path path = new GH_Path(i, j);
        double irrad = G.Branch(i)[j] *  g;
        doubleTree.Add(irrad, path);

        Q_array[j] += irrad;
      }
    }

    Q_s = Q_array;
# ---------- end c_script_2 ----------
panel_7 = Panel(c_script_2.Q_s)  # disabled

# ----
# Solare Wärmeeinträge
# Q_s = G * F_F * A_w * g
# [Q_s] = kWh
# [G] = kWh/m^2
# [F_F] = -
# [A_w] = m^2
# [g] = -
c_script_3 = CSharpScript(x=distrsolar.WindowGeometries)  # -> out, tilt, azimuth, area; inputs x: Brep; disabled
# ---------- c_script_3: C# ----------
    Surface srf = x.Surfaces[0];

    AreaMassProperties massProp = AreaMassProperties.Compute(srf);
    Point3d cen = massProp.Centroid;
    double u,v;
    srf.ClosestPoint(cen, out u, out v);
    Vector3d normal = srf.NormalAt(u, v);

    if(x.Faces[0].OrientationIsReversed)
      normal.Reverse();

    Vector3d vnormal = new Vector3d(0, 0, 1);
    Vector3d tiltZ0 = new Vector3d(0, 0, 1);

    double tiltValue = Vector3d.VectorAngle(normal, tiltZ0, vnormal);
    tilt = tiltValue * (180.0 / Math.PI);

    double azimuthValue = Vector3d.VectorAngle(new Vector3d(normal.X, normal.Y, 0), new Vector3d(0, 1, 0), vnormal);
    azimuth = azimuthValue * (180 / Math.PI);

//    Line normalLine = new Line(cen, cen + normal);
//    Line azimuthLine = new Line(cen, cen + new Vector3d(0, 1, 0));
//    Line tiltLine = new Line(cen, cen + tiltZ0);
//    A = normalLine;
//    B = azimuthLine;
//    C = tiltLine;


    area = AreaMassProperties.Compute(x.Faces[0]).Area;
# ---------- end c_script_3 ----------
simplepanel = SimplePanel(
    Tilt=c_script_3.tilt,
    Azimuth=c_script_3.azimuth,
    DHI=epw_reader.DHI,
    DNI=epw_reader.DNI,
    Latitude=epw_reader.Latitude,
    Longitude=epw_reader.Longitude)  # disabled
python_9 = GhPythonScript(x=simplify(simplepanel), month=[0, 1, 2, 3, 4, 5, 6, 7, 8, 9, 10, 11])  # -> out, a; inputs x: list, month: Int32; disabled; same code as python_7
c_script_4 = CSharpScript(G=python_9.a, A_w=c_script_3.area, g=item)  # -> out, Q_s; inputs G: tree of Double, A_w: list of Double, g: Double; disabled
# ---------- c_script_4: C# ----------
    int winCount = G.BranchCount;
    double [] Q_array = new double[12];

    DataTree<double> doubleTree = new DataTree<double>();
    for (int i = 0; i < G.BranchCount; i++)
    {
      for (int j = 0; j < G.Branch(i).Count; ++j) // should be 12, 1 for each month of the year
      {
        GH_Path path = new GH_Path(i, j);
        double irrad = G.Branch(i)[j] * A_w[i] * g;
        doubleTree.Add(irrad, path);

        Q_array[j] += irrad;
      }
    }

    Q_s = Q_array;
# ---------- end c_script_4 ----------
panel_8 = Panel(c_script_4.Q_s)  # disabled

# ---- group: NEW SIA 380 COMPONENT / unobstructed
# SIA 380 NEW COMPONENT
c_script_5 = CSharpScript(G=python_9.a, A_w=c_script_3.area, g=item)  # -> out, Q_s; inputs G: tree of Double, A_w: list of Double, g: Double; disabled
# ---------- c_script_5: C# ----------
    int winCount = G.BranchCount;
    double [][] Q_array = new double[12][];
    for(int j = 0; j < G.Branch(0).Count; j++)
      Q_array[j] = new double[G.BranchCount];

    DataTree<double> doubleTree = new DataTree<double>();
    for (int i = 0; i < G.BranchCount; i++)
    {
      for (int j = 0; j < G.Branch(i).Count; ++j) // should be 12, 1 for each month of the year
      {
        GH_Path path = new GH_Path(i, j);
        double irrad = G.Branch(i)[j] * A_w[i] * g;
        doubleTree.Add(irrad, path);

        Q_array[j][i] = irrad*1000;
      }
    }

    jagged output = new jagged();
    output.data = Q_array;
    Q_s = output;
# ---------- c_script_5: C# additional code ----------
  public struct jagged
  {
    public double [][] data;
  }
# ---------- end c_script_5 ----------

# ---- group: NEW SIA 380 COMPONENT / obstructed
c_script_6 = CSharpScript(G=python_8.a, g=item)  # -> out, Q_s; inputs G: tree of Double, g: Double; disabled
# ---------- c_script_6: C# ----------
    int winCount = G.BranchCount;
    double [][] Q_array = new double[12][];
    for(int j = 0; j < G.Branch(0).Count; j++)
      Q_array[j] = new double[G.BranchCount];

    DataTree<double> doubleTree = new DataTree<double>();
    for (int i = 0; i < G.BranchCount; i++)
    {
      for (int j = 0; j < G.Branch(i).Count; ++j) // should be 12, 1 for each month of the year
      {
        GH_Path path = new GH_Path(i, j);
        double irrad = G.Branch(i)[j] * g;
        doubleTree.Add(irrad, path);

        Q_array[j][i] = irrad*1000;
      }
    }
    jagged jag = new jagged();
    jag.data = Q_array;

    Q_s = jag;
# ---------- c_script_6: C# additional code ----------
  public struct jagged
  {
    public double [][] data;
  }
# ---------- end c_script_6 ----------

# ---- group: NEW SIA 380 COMPONENT
# SIA 380
panel_9 = Panel("""transp
transp
transp
transp
transp
opaque""")  # disabled
subtraction = Subtraction(A=distributorsia.ExtSrfAreas, B=distributorsia.WindowsAreas)  # disabled
merge = Merge(Data1=c_script_3.area, Data2=subtraction)  # -> flatten(Result); disabled
sia380 = SIA380(
    Room_properties=distributorsia.SIA2024json,
    Floor_area=distributorsia.ZoneAreas,
    T_e=epw_reader.DryBulbMonthly,
    T_i=sia2024.Θ_i_C,
    Setpoints_ub=adaptcomf.T_n80ub,
    Setpoints_lb=adaptcomf.T_n80lb,
    Surface_areas=merge,
    Surface_type=panel_9,
    Q_s_per_surface=c_script_6.Q_s)  # -> Q_Heat, Q_Cool, Q_Elec, Q_T, Q_V, Q_i, Q_s; disabled
ma_3 = MassAddition(Input=sia380.Q_Heat)  # -> Result, PartialResults; disabled
division_2 = Division(A=ma_3.Result, B=distributorsia.ZoneAreas)  # disabled

# ---- group: NEW SIA 380 COMPONENT / providing heat with heatpump
panel_10 = Panel("3.5")  # disabled
simple_hp = SimpleHp(Q_th=sia380.Q_Heat, COP=panel_10)  # disabled
ma_4 = MassAddition(Input=simple_hp)  # -> Result, PartialResults; disabled
division_3 = Division(A=ma_4.Result, B=distributorsia.ZoneAreas)  # disabled

# ---- group: NEW SIA 380 COMPONENT / Wärmepumpe Strom abzgl. PV Strom
subtraction_2 = Subtraction(A=simple_hp, B=c_script.Q_s)  # disabled

# ---- group: NEW SIA 380 COMPONENT (continued)
python_10 = GhPythonScript(x=sia380.Q_Elec, y=subtraction_2)  # -> out, a; inputs x: list, y: list; disabled
# ---------- python_10: Python ----------
__author__ = "Christoph"
__version__ = "2020.05.20"

import rhinoscriptsyntax as rs
elec = []
for i in range(len(x)):
    elec.append(x[i] + y[i])

a = elec
# ---------- end python_10 ----------
data_2 = Data([ma_3.Result, ma_4.Result, ma.Result, division_2, division_3, division])  # disabled

# ----
hiveioresults = HiveIOResults(CoolingMonthly=sia380.Q_Cool, HeatingMonthly=sia380.Q_Heat, ElectricityMonthly=python_10.a)
hive_io_visualizer = HiveIOVisualizer(hiveioresults)

# ---- group: Heizwärmebedarf, Strombedarf Wärmepumpe und Stromertrag PV
# Jahresheizwärmebedarf in kWh
# Jahresstrombedarf Wärmepumpe in kWh
# Jahresstromertrag PV in kWh
# Jahresheizwärmebedarf in kWh/m^2
# Jahresstrombedarf Wärmepumpe in kWh/m^2
# Jahresstromertrag PV in kWh/m^2 PV
panel_11 = Panel(data_2)
