# Grasshopper definition simple_pv.gh (Grasshopper 1.0.7)
# plug-ins: pv-sum, solar, simple-pv, solarParameters

# ---- group: replace with grasshopper component that reads a surface of a building
number_slider = Slider(99.53, range=0..360)
number_slider_2 = Slider(34.366, range=0..90)

# ----
data = Data([0, 0, 0, 0, 0, 0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])
data_2 = Data([0, 0, 0, 0, 0, 0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])
simplepanel = SimplePanel(Tilt=[Slider(0, range=0..90), number_slider_2], Azimuth=[Slider(180, range=0..360), number_slider], DHI=data, DNI=data_2)
sum_yield = SumYield(Sum_mode="year", Elec=simplepanel)  # -> flatten(Yield)
item = ListItem(List=sum_yield, Index="1", Wrap=True)
item_2 = ListItem(List=sum_yield, Index="0", Wrap=True)
graph = QuickGraph(simplepanel, SortOrder=0)
pveffl = PVEfficiency({"Silicone": {"PV tech": "Silicone", "efficiency": 0.10000000000000001}, "Monocrystalline": {"PV tech": "Monocrystalline", "efficiency": 0.14999999999999999}, "Polycrystalline": {"PV tech": "Polycrystalline", "efficiency": 0.20000000000000001}, "Super-duper-tech": {"PV tech": "Super-duper-tech", "efficiency": 0.25}}, selected="Silicone")
prl = PerformanceRatio({"Roof perfect": {"Scenario": "Roof perfect", "performance ratio": 0.84999999999999998}, "Roof normal": {"Scenario": "Roof normal", "performance ratio": 0.75}, "Roof dirty": {"Scenario": "Roof dirty", "performance ratio": 0.69999999999999996}, "Facade perfect": {"Scenario": "Facade perfect", "performance ratio": 0.75}, "Facade normal": {"Scenario": "Facade normal", "performance ratio": 0.69999999999999996}, "Facade shaded": {"Scenario": "Facade shaded", "performance ratio": 0.59999999999999998}}, selected="Roof perfect")
orfac = OrientationFactor(G_flat=item_2, G_angled=item)
perfrat = PerformanceRatio(Performance_scenario=prl)
pveff = PVEfficiency(PV_tech=pveffl)
panel = Panel(orfac)
division = Division(A=item_2, B="1000")
simplepv = SimplePV(Global_Irradiation=division, FormFactor=panel, SurfaceArea="10", PVEfficiency=pveff, PerformanceRatio=perfrat)

# ---- group: Total PV electricity generation
panel_2 = Panel(simplepv)
