# Grasshopper definition Hive_01_Shoebox.gh (Grasshopper 1.0.7)
# plug-ins: pv-sum, solar, sia380, noct-pv, sia2028, sia2024

# ---- group: Zones
# Building
# Geometry
brep = Brep(<brep referenced from the Rhino model>)

# ---- group: PVST
# Energy System
# Geometry
srf = Surface([<surface referenced from the Rhino model> x2])

# ---- group: Windows
srf_2 = Surface([<surface referenced from the Rhino model> x4])

# ---- group: Door
srf_3 = Surface(<surface referenced from the Rhino model>)

# ---- group: PV
srf_4 = Surface([<surface referenced from the Rhino model> x2])

# ---- group: ST
srf_5 = Surface([<surface referenced from the Rhino model> x2])

# ---- group: obstructions
brep_2 = Brep([<brep referenced from the Rhino model> x8])

# ---- group: ground
mesh = Mesh(<mesh referenced from the Rhino model>)

# ----
# Hive.IO
mesh_2 = Mesh(brep_2)
debrep = DeconstructBrep(Brep=brep)  # -> Faces, Edges, Vertices
mesh_3 = Mesh([srf, srf_5, srf_4])
area = Area(Geometry=srf_2)  # -> Area, Centroid
item = ListItem(List=debrep.Faces, Index="4", Wrap=True)
ma = MassAddition(Input=area.Area)  # -> Result, PartialResults
area_2 = Area(Geometry=item)  # -> Area, Centroid

# ----
# Demand
# SIA380.1
# SIA2028
# SIA2024
panel = Panel("""1
2
3
4
5
6
7
8
9
10
11
12""")
python = GhPythonScript(month=panel)  # -> out, season; inputs month: Int32
# ---------- python: Python ----------
__author__ = "chwaibel"
__version__ = "2019.11.06"

import rhinoscriptsyntax as rs

summerstart = 3 # summer starts in march
summerend = 9  # summer ends in end of September

if month >= summerstart and month <= summerend:
    season = "summer"
else:
    season = "winter"
# ---------- end python ----------
list = ValueList({"standard", "ideal", "existing"}, selected="standard")
list_2 = ValueList({"mfh", "efh", "office", "school"}, selected="efh")
sia2024 = SIA2024(Use_case=list_2, Bldgtype=list, Area=area_2.Area, Month=graft(panel), Season=graft(python.season))  # -> Τ_h, Θ_i_C, T_h, A_op_m2, A_w_m2, U_op_W_m2K, U_w_W_m2K, V_e_m3_h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
sia2028 = SIA2028(Month=graft(panel))  # -> IHor_Wh_m2, IE_Wh_m2, IS_Wh_m2, IW_Wh_m2, IN_Wh_m2, Θ_e_C
sia380 = SIA3801(
    Tau=sia2024.Τ_h,
    Theta_e=sia2028.Θ_e_C,
    Theta_i=sia2024.Θ_i_C,
    T=sia2024.T_h,
    A_op=sia2024.A_op_m2,
    A_w=ma.Result,
    U_op=sia2024.U_op_W_m2K,
    U_w=sia2024.U_w_W_m2K,
    Vdot_e=sia2024.V_e_m3_h,
    Vdot_inf=sia2024.V_inf_m3_h,
    Eta_rec=sia2024.Η_rec_,
    Phi_P=sia2024.Φ_P_W,
    Phi_B=sia2024.Φ_L_W,
    Phi_G=sia2024.Φ_G_W,
    T_P=sia2024.T_P_h,
    T_B=sia2024.T_L_h,
    T_G=sia2024.T_A_h,
    G=sia2024.G_,
    F_sh=sia2024.F_sh_,
    I=sia2028.IHor_Wh_m2)  # -> Q_H, Q_T, Q_V, Eta_g, Q_i, Q_s
panel_2 = Panel([sia380.Q_H, sia380.Q_T, sia380.Q_V, sia380.Eta_g, sia380.Q_i, sia380.Q_s])

# ---- group: average irradiance on obstructed surface
# Solar Potentials Roof Panels
number_slider = Slider(2, range=0..100)
data = Data([0, 0, 0, 0, 0, 0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])
data_2 = Data([0, 0, 0, 0, 0, 0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])
data_3 = Data([8.415567703, 33.69912388, 56.58914543, 72.99109311, 85.75265625, 96.74276768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])
data_4 = Data([-65.34878984, -62.13426796, -54.95901857, -45.81747693, -35.88714072, -25.78253978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])
panel_3 = Panel("""0
1
2
3
4
5""")
item_2 = ListItem(List=[srf_4, srf, srf_5], Index=panel_3, Wrap=True)
panel_4 = Panel("""PV left
PV right
PVT left
PVT right
ST left
ST right""")
srf_6 = Surface(item_2)
mesh_uv = MeshSurface(Surface=srf_6, UCount=number_slider, VCount=Slider(2, range=0..100), Overhang=True, Equalize=False)
panel_5 = Panel("""0;0;0
0;0;1
0;0;2
0;0;3
0;0;4
0;0;5""")
mesh_4 = Mesh(mesh_uv)
obstructedpanel = ObstructedPanel(Mesh_analysis=mesh_4, Obstructions=[mesh, mesh_2], DHI=data, DNI=data_2, Solarazi=data_3, Solaralti=data_4)  # -> AnnualPotential, Mesh_visu
number_slider_2 = Slider(0, range=0..5)
item_3 = ListItem(List=simplify(panel_5), Index=number_slider_2, Wrap=True)
item_4 = ListItem(List=mesh_4, Index=number_slider_2, Wrap=True)
area_3 = Area(Geometry=item_4)  # -> Area, Centroid
item_5 = ListItem(List=panel_4, Index=number_slider_2, Wrap=True)
branch = TreeBranch(Tree=obstructedpanel.AnnualPotential, Path=item_3, MaintainPaths=True)
division = Division(A=branch, B=area_3.Area)
graph = QuickGraph(division, SortOrder=0)
panel_6 = Panel(item_5)

# Solar Potentials Building
number_slider_3 = Slider(6, range=0..100)
data_5 = Data([0, 0, 0, 0, 0, 0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])
data_6 = Data([0, 0, 0, 0, 0, 0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])
data_7 = Data([8.415567703, 33.69912388, 56.58914543, 72.99109311, 85.75265625, 96.74276768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])
data_8 = Data([-65.34878984, -62.13426796, -54.95901857, -45.81747693, -35.88714072, -25.78253978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])
panel_7 = Panel("""0
1
2
3
5""")
item_6 = ListItem(List=debrep.Faces, Index=panel_7, Wrap=True)
srf_7 = Surface(item_6)
mesh_uv_2 = MeshSurface(Surface=srf_7, UCount=number_slider_3, VCount=Slider(3, range=0..100), Overhang=True, Equalize=False)
panel_8 = Panel("""0;0;0
0;0;1
0;0;2
0;0;3
0;0;4""")
mesh_5 = Mesh(mesh_uv_2)
obstructedpanel_2 = ObstructedPanel(Mesh_analysis=mesh_5, Obstructions=[mesh, mesh_2, mesh_3], DHI=data_5, DNI=data_6, Solarazi=data_7, Solaralti=data_8)  # -> AnnualPotential, Mesh_visu
panel_9 = Panel("""South
East
North
West
Roof""")
number_slider_4 = Slider(4, range=0..4)
item_7 = ListItem(List=simplify(panel_8), Index=number_slider_4, Wrap=True)
item_8 = ListItem(List=panel_9, Index=number_slider_4, Wrap=True)
item_9 = ListItem(List=mesh_5, Index=number_slider_4, Wrap=True)
area_4 = Area(Geometry=item_9)  # -> Area, Centroid
branch_2 = TreeBranch(Tree=obstructedpanel_2.AnnualPotential, Path=item_7, MaintainPaths=True)
division_2 = Division(A=branch_2, B=area_4.Area)
graph_2 = QuickGraph(division_2, SortOrder=0)
panel_10 = Panel(item_8)

# ----
# Solar Potentials
# unobstructed
number_slider_5 = Slider(0, range=0..360)
simplepanel = SimplePanel(Tilt=Slider(17.369, range=0..90), Azimuth=number_slider_5, DHI=data, DNI=data_2)

# ----
# PV Yield unobstructed
# Values in kWh
panel_11 = Panel("1")
list_3 = ValueList({"day", "month", "year"}, selected="month")
data_9 = Data([8.8, 8.6, 8.4, 8.3, 8.2, 8.1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])
noct_pv = NOCTPV(A=panel_11, T_amb=data_9, I=simplepanel)  # -> Elec, Effic
sum_yield = SumYield(Sum_mode=list_3, Elec=noct_pv.Elec)
division_3 = Division(A=sum_yield, B="1000")
panel_12 = Panel(division_3)
graph_3 = QuickGraph(panel_12, SortOrder=0)
graph_4 = QuickGraph(noct_pv.Elec, SortOrder=0)

# ----
# PV Yield
# Values in kWh
list_4 = ValueList({"day", "month", "year"}, selected="month")
data_10 = Data([8.8, 8.6, 8.4, 8.3, 8.2, 8.1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])
noct_pv_2 = NOCTPV(A=area_3.Area, T_amb=data_10, I=division)  # -> Elec, Effic
sum_yield_2 = SumYield(Sum_mode=list_4, Elec=noct_pv_2.Elec)
division_4 = Division(A=sum_yield_2, B="1000")
panel_13 = Panel(division_4)
graph_5 = QuickGraph(panel_13, SortOrder=0)
graph_6 = QuickGraph(noct_pv_2.Elec, SortOrder=0)

# ----
# Visualize Demand
panel_14 = Panel("0")
panel_15 = Panel("""1
2
3
4
5
6
7
8
9
10
11
12""")
item_10 = ListItem(List=panel_2, Index=panel_14, Wrap=True)
python_2 = GhPythonScript(x=graft(panel_15), y="30,5,0")  # -> out, a; inputs y: Point3d
# ---------- python_2: Python ----------
__author__ = "chwaibel"
__version__ = "2019.12.11"

import rhinoscriptsyntax as rs
a = rs.AddPoint(x+ y.X, y.Y, y.Z)
# ---------- end python_2 ----------
division_5 = Division(A=item_10, B="10000")
panel_16 = Panel(python_2.a)
python_3 = GhPythonScript(x="1", y="1", z=division_5)  # -> out, a
# ---------- python_3: Python ----------
__author__ = "chwaibel"
__version__ = "2019.12.11"

import rhinoscriptsyntax as rs

a = rs.AddPoint(x,y,z)
# ---------- end python_3 ----------
python_4 = GhPythonScript(x="0,0,0", y=panel_16)  # -> out, a; inputs x: Point3d, y: Vector3d
# ---------- python_4: Python ----------
__author__ = "chwaibel"
__version__ = "2019.12.11"

import rhinoscriptsyntax as rs

a = rs.AddPoint(x.X + y.X, x.Y + y.Y, x.Z + y.Z)
# ---------- end python_4 ----------
python_5 = GhPythonScript(x=python_3.a, y=panel_16)  # -> out, a; inputs x: Point3d, y: Vector3d; same code as python_4
xy = XYPlane(Origin=panel_16)
box = Box2Pt(PointA=python_4.a, PointB=python_5.a, Plane=xy)
