# Grasshopper definition Assert.gh (Grasshopper 0.9.75)

c_script = CSharpScript(toggle=Toggle(True))  # -> out, A; inputs toggle: Boolean
# ---------- c_script: C# ----------
    Color ok = Color.Green;
    Color notOk = Color.Red;

    List<Grasshopper.Kernel.Special.GH_Group> groups = GrasshopperDocument
      .Objects
      .OfType<Grasshopper.Kernel.Special.GH_Group>()
      .Where(gr => gr.ObjectIDs.Contains(Component.InstanceGuid))
      .ToList<Grasshopper.Kernel.Special.GH_Group>();

    Color renderColor = ok;
    if (!toggle)
    {
      renderColor = notOk;
    }

    foreach (Grasshopper.Kernel.Special.GH_Group gr in groups)
    {
      gr.Colour = renderColor;
    }
# ---------- end c_script ----------

# ----
# Assert value is true
boolean_toggle = BooleanToggle(False)
c_script_2 = CSharpScript(toggle=boolean_toggle)  # -> out, A; inputs toggle: Boolean; same code as c_script
