# Grasshopper definition BugInASHPsimpleCop.gh (Grasshopper 1.0.7)
# plug-ins: HiveIO

# ---- group: Pfad zur Wetterdatei (*.epw)
panel = Panel("C:\Users\christoph\Documents\GitHub\hive\GrasshopperExamples\LectureExercises\HIVE_Zurich.epw")

# ----
hiveparainensys = ParametricInputEnergySystemsHive(
    ASHPCapacity="1000",
    ASHPCost="1000",
    ASHPEmissions="1000",
    ASHPCOP="0.9",
    NGBoilerCapacity="1000",
    NGBoilerCost="1000",
    NGBoilerEmissions="1000",
    NGBoilerEfficiency="0.95",
    CHPCapacity="1000",
    CHPCost="1000",
    CHPEmissions="1000",
    CHPHTP="1.5",
    CHPEffElec="0.3",
    ChillerCapacity="1000",
    ChillerCost="1000",
    ChillerEmissions="1000",
    ChillerCOP="0.9",
    HeatExchangerCapacity="1000",
    HeatExchangerCost="1000",
    HeatExchangerEmissions="1000",
    HeatExchangerLosses="0.05",
    CoolExchangerCapacity="1000",
    CoolExchangerCost="1000",
    CoolExchangerEmissions="1000",
    CoolExchangerLosses="0.05")

# ---- group: PV Fläche
srf = Surface(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)

# ---- group: Gebäudevolumen
brep = Brep(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)

# ---- group: Boden
mesh = Mesh(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)

# ----
mesh_uv = MeshSurface(Surface=srf, UCount="6", VCount="6", Overhang=True, Equalize=False)

# ---- group: Umgebungsbebauung
mesh_2 = Mesh([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])

# ---- group: Fensterflächen
srf_2 = Surface([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])

# ----
hiveparainemitter = ParametricInputEmitterHive(
    Vorlauf="65",
    Rücklauf="55",
    Capacity="1000",
    InvestmentCost="1000",
    EmbodiedEmissions="1000",
    Name="HeatingRadiator",
    AirEmitter=False,
    Cooling=False)
hiveparainemitter_2 = ParametricInputEmitterHive(
    Vorlauf="20",
    Rücklauf="25",
    Capacity="1000",
    InvestmentCost="1000",
    EmbodiedEmissions="1000",
    Name="AirDiffuserCool",
    AirEmitter="true",
    Cooling="true")
mesh_3 = Mesh(mesh_uv)
hive_io_env = HiveIOEnvironment(EPWPath=panel, ObstaclesGeometry=[mesh, mesh_2])
hive_io_bldg = HiveIOBuilding(ZoneBrepGeometries=brep, WindowsSurfaces=srf_2)
hiveinputenergysystems = InputEnergySystemsHive(
    SolarTechProperties=mesh_uv,
    ConversionTechProperties=hiveparainensys,
    EmitterProperties=[hiveparainemitter, hiveparainemitter_2])  # -> flatten(EnergySystems)
hiveiodistr = HiveIODistributor(HiveInputObjects=[hive_io_env, hive_io_bldg, hiveinputenergysystems])  # -> HiveIOBuilding, HiveIOEnvironment, HiveIOEnergySystemSurfaceBasedTech, HiveIOEnergySystemConversionTech, HiveIOEnergySystemsEmitter

# ---- group: Simulate solar?
toggle = BooleanToggle(False)

# ---- group: Simple efficiency calculations?
toggle_2 = BooleanToggle(True)

# ----
hivedistenvironment = DistributorEnvironmentHive(HiveIOEnvironment=hiveiodistr.HiveIOEnvironment)  # -> Filepath, NaturalGas, BioGas, WoodPellets, DistrictHeating, DistrictCooling, GridElectricity, AmbientAirTemp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
nickname = GhDistributorConversionTech(HiveIOEnergySystemConversionTech=hiveiodistr.HiveIOEnergySystemConversionTech)  # -> HiveIOEnergySystemAirSourceHeatPump, HiveIOEnergySystemChiller, HiveIOEnergySystemsBoiler, HiveIOEnergySystemsCombinedHeatPowert, HiveIOEnergySystemsHeatExchanger, HiveIOEnergySystemsCoolExchanger, HiveIOEnergySystemElectricalSubstation
python = GhPythonScript(emitters=hiveiodistr.HiveIOEnergySystemsEmitter)  # -> out, monthlyHeatingSupTemp, monthlyCoolingSupTemp, heatingCarrier, monthlyHeatingReturnTemp, yearlyHeatingSupTemp, yearlyHeatingReturnTemp, monthlyCoolingReturnTemp; inputs emitters: list
# ---------- python: Python ----------
__author__ = "chwaibel"
__version__ = "2020.08.20"

import rhinoscriptsyntax as rs

for e in emitters:
    if e.IsCooling:
        monthlyCoolingSupTemp = e.InletCarrier.MonthlyTemperature
        monthlyCoolingReturnTemp = e.ReturnCarrier.MonthlyTemperature
    else:
        monthlyHeatingSupTemp = e.InletCarrier.MonthlyTemperature
        heatingCarrier = e
        monthlyHeatingReturnTemp = e.ReturnCarrier.MonthlyTemperature
        yearlyHeatingSupTemp = e.InletCarrier.Temperature
        yearlyHeatingReturnTemp = e.ReturnCarrier.Temperature
# ---------- end python ----------
data = Data([1685.98258, 817.7029895, 24.74503303, 0.1256812419, 8.364482899e-06, 7.748021744e-10, 8.498318493e-12, 1.105945557e-11, 0.00041330518, 19.05675402, 1113.028015, 1715.765745])
hivemergerashp = MergerAirSourceHeatPumpHive(
    Air=hivedistenvironment.AmbientAirTemp,
    Electricity=hivedistenvironment.GridElectricity,
    HeatGenerated=data,
    SuppTemp=python.monthlyHeatingSupTemp,
    ReturnTemp=python.monthlyHeatingReturnTemp,
    SimpleMode=toggle_2,
    ASHP=nickname.HiveIOEnergySystemAirSourceHeatPump)
