# Grasshopper definition Hive_PhotovoltaicEnergySystem.gh (Grasshopper 1.0.7)
# plug-ins: HiveIO

performanceratio = SolarPerformanceRatio({"Roof perfect": 0.85, "Roof normal": 0.75, "Roof dirty": 0.7, "Facade perfect": 0.75, "Facade normal": 0.7, "Facade shaded": 0.6}, selected="Roof perfect")
panel = Panel("1")
panel_2 = Panel("0.15")
# "Note: Move "A" to the top of the inputs list.
# 
# Change "A" to "Area".
# Change "G" to "Irrad"
# 
# Reason: Consistency w/ other components.
# Q: Add more description here?
kwh_m² = Panel("1200")
m² = Panel("12")
panel_3 = Panel(performanceratio)
pvsimple = PhotovoltaicEnergySystemCSharp(Global_Irradiation=kwh_m², FormFactor=panel, SurfaceArea=m², PVEfficiency=panel_2, PerformanceRatio=panel_3)
kwh = Panel(pvsimple)
