# Grasshopper definition Hive_PhotovoltaicTimeResolvedEnergySystem.gh (Grasshopper 1.0.7)
# plug-ins: HiveIO

panel = Panel("C:\Users\Christoph\Documents\GitHub\hive\GrasshopperExamples\Templates\HIVE_Zurich.epw")

# ---- group: Path to weather file (.epw)
panel_2 = Panel("C:\Users\HIVE_Zurich.epw")

# ----
distepw = DistributorEPW(EPWFilepath=panel, WriteLists=Toggle(True))  # -> EPW, Latitude, Longitude, CityCountry, GHI, DNI, DHI, DryBulb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
m² = Panel("12")
panel_3 = Panel("20")
panel_4 = Panel("800")
panel_5 = Panel("0.15")
panel_6 = Panel("0.004")
panel_7 = Panel("45")
pvtimeresolved = PhotovoltaicTimeResolvedEnergySystemCSharp(
    A=m²,
    Eta_PVref=panel_5,
    Beta=panel_6,
    NOCT=panel_7,
    NOCT_ref=panel_3,
    NOCT_sol=panel_4,
    T_amb=distepw.DryBulb,
    I=distepw.GHI)  # -> Elec, Effic
panel_8 = Panel(pvtimeresolved.Elec)
