# Grasshopper definition Hive_SolarOrientationFactor.gh (Grasshopper 1.0.7)
# plug-ins: Hive.Core.solar_tech

kwh_m² = Panel("960")
kwh_m²_2 = Panel("1200")
orientationfactor = SolarOrientationFactor(G_flat=kwh_m²_2, G_angled=kwh_m²)
panel = Panel(orientationfactor)
