# Grasshopper definition Hive_SolarThermalEnergySystem.gh (Grasshopper 1.0.7)
# plug-ins: Hive.Core.solar_tech

panel = Panel("1")
panel_2 = Panel("0.15")
panel_3 = Panel("0.75")
# Q: Add more description/explanation here?
# 
# Best would be if it correlates with the EaCS1, 2 and 3 curriculums
kwh_m² = Panel("1200")
m² = Panel("12")
solarthermalsimple = SolarThermalEnergySystem(Global_Irradiation=kwh_m², FormFactor=panel, SurfaceArea=m², STEfficiency=panel_2, DistributionLosses=panel_3)
kwh = Panel(solarthermalsimple)
