# Grasshopper definition Hive_SummarizePVElectricity Yield.gh (Grasshopper 1.0.7)
# plug-ins: Hive.Core.solar_tech

# Instructions_1: If you don't have 8760 hourly PV generation values, you can roughly estimate them, using this equation:
# 
# Electricity Generation (on a horizontal plane) [kWh] =
# (Hourly global horizontal irradiation values [Wh/m^2] / 1000) * Typical PV module efficiency (for example, 0.15) [-] * Area [m^2]
elec_kwh = Panel("""0
0
0
0
0
0
0
0
0.0006
0.0102
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""")

# ---- group: OPTIONAL: to generate 8760 PV electricity values / Path to weather file (.epw)
panel = Panel("C:\Users\HIVE_Zurich.epw")

# ----
list = ValueList({"Day": "day", "Month": "month", "Year": "year"}, selected="Day")
sumpvyield = SummarizePVElectricityYield(Sum_mode=list, Elec=elec_kwh)
yield_kwh = Panel(sumpvyield)

# ---- group: OPTIONAL: to generate 8760 PV electricity values / Typical module efficiency
panel_2 = Panel("0.15")

# ---- group: OPTIONAL: to generate 8760 PV electricity values / from Wh to kWh
panel_3 = Panel("1000")

# ---- group: OPTIONAL: to generate 8760 PV electricity values / PV module(s) area [m^2]
panel_4 = Panel("1")

# ---- group: OPTIONAL: to generate 8760 PV electricity values
# Instructions_2: Of course, it can be difficult to run this equation manually for 8760 hours. So, you can use the below script (using Ladybug components) to get the desired hourly PV generation values over a year.
ladybug = Ladybug_Ladybug()  # -> Vviiiiiiiiiizzz; plug-in component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
importepw = Ladybug_ImportEpw(epwFile=panel)  # -> readMe, latitude, location, dryBulbTemperature, dewPointTemperature, relativeHumidity, windSpeed, windDirection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; plug-in component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
strnum = Ladybug_SeparateData(inputList=flatten(importepw.globalHorizontalRadiation))  # -> numbers, strings; plug-in component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
multiplication = Multiplication(A=strnum.numbers, B=panel_2)
wh_m_2 = Panel(multiplication)
division = Division(A=multiplication, B=panel_3)
kwh_m_2 = Panel(division)
multiplication_2 = Multiplication(A=division, B=panel_4)
elec_kwh_2 = Panel(multiplication_2)
