# Grasshopper definition Ladybug_SolarPotentialsUnobstructed.gh (Grasshopper 1.0.7)

# ---- group: Set the Toggle to "True" and choose the weather file location on your PC/Laptop
# Instructions: Set the Toggle to "True" and choose the weather file location on your PC/Laptop
toggle = BooleanToggle(False)
open_weather_file = Ladybug_OpenEPWWeatherFile(open=toggle)  # -> epwFile; plug-in component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

# ---- group: Alternative / Path to weather file (.epw)
# Instructions: An alternative is to type the weather file path in a panel and connect it to the "_epwFile" input in the "Ladybug_Import epw" component
panel = Panel("C:\Users\HIVE_Zurich.epw")

# ----
# Ladybug Sunpath
ladybug = Ladybug_Ladybug()  # -> Vviiiiiiiiiizzz; plug-in component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
importepw = Ladybug_ImportEpw(epwFile=open_weather_file)  # -> readMe, latitude, location, dryBulbTemperature, dewPointTemperature, relativeHumidity, windSpeed, windDirection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; plug-in component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
number_slider = Slider(0.05, range=0..1)
analysisperiod = Ladybug_AnalysisPeriod(fromMonth="1", fromDay="1", fromHour="1", toMonth="12", toDay="365", toHour="24")  # -> readMe, analysisPeriod; plug-in component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
sunpath = Ladybug_SunPath(
    location=importepw.location,
    hour=12,
    day=21,
    month=12,
    timeStep=1,
    analysisPeriod=analysisperiod.analysisPeriod,
    sunPathScale=number_slider,
    sunScale=number_slider,
    dailyOrAnnualSunPath=True)  # -> readMe, sunVectors, sunAltitudes, sunAzimuths, port, sunSpheresMesh, sunPathCrvs, compassCrvs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; plug-in component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
preview = CustomPreview(Geometry=[sunpath.sunPathCrvs, sunpath.compassCrvs], Shader=ColourSwatch(SwatchColor=RGB(0, 0, 0)))
