# Grasshopper definition S_TODO__Q__Hive_SolarThermalTimeResolvedEnergySystem.gh (Grasshopper 1.0.7)
# plug-ins: Hive.Core.solar_tech, Hive.Core.epw_reader

# ---- group: Path to weather file (.epw)
panel = Panel("C:\Users\HIVE_Zurich.epw")

# ----
panel_2 = Panel("""24
24
24
25
25
25
25
26
26
26
27
27
27
28
28
28
29
29
29
30
30
30
31
31
31""")
panel_3 = Panel("""12
12
12
12
12
12
12
11
11
11
11
11
11
12
12
12
12
12
12
12
11
11
11
11
11""")

epwreader = EPWReader(Path=panel)  # -> Latitude, Longitude, CityCountry, GHI, DNI, DHI, DryBulb, DewPoint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
panel_4 = Panel("""12
12
12
12
12
12
12
11
11
11
11
11
11
12
12
12
12
12
12
12
11
11
11
11
11""")
m² = Panel("12")
w_m²k = Panel("0.8")

# ---- group: Create a Python scirpt to create 8760 values of 24
panel_6 = Panel("22")
multiplication = Multiplication(A=epwreader.DryBulb, B=Slider(0.6, range=0..1.1))

# ----
solarthermaltimeresolved = SolarThermalTimeResolvedEnergySystem(T_in=panel_6, T_amb=epwreader.DryBulb, OpticEff=panel_4, HeatLoss=w_m²k, Irrad=epwreader.GHI, Area=m²)  # -> Heating, Eta
panel_7 = Panel(solarthermaltimeresolved.Heating)
