# Grasshopper definition TODO__Q__Hive_PhotovoltaicTimeResolvedEnergySystem.gh (Grasshopper 1.0.7)
# plug-ins: Hive.Core.solar_tech

# ---- group: Path to weather file (.epw)
panel = Panel("C:\Users\HIVE_Zurich.epw")

# ----
importepw = Ladybug_ImportEpw(epwFile=panel)  # -> readMe, latitude, location, dryBulbTemperature, dewPointTemperature, relativeHumidity, windSpeed, windDirection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; plug-in component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
ladybug = Ladybug_Ladybug()  # -> Vviiiiiiiiiizzz; plug-in component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
strnum = Ladybug_SeparateData(inputList=flatten(importepw.dryBulbTemperature))  # -> numbers, strings; plug-in component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
m² = Panel("12")
strnum_2 = Ladybug_SeparateData(inputList=flatten(importepw.globalHorizontalRadiation))  # -> numbers, strings; plug-in component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
panel_2 = Panel("20")
panel_3 = Panel("800")
panel_4 = Panel("0.15")
panel_5 = Panel("0.004")
panel_6 = Panel("45")

# ---- group: Can we move the "Area" input to the top. To be consistent w/ the below component?
solarthermaltimeresolved = SolarThermalTimeResolvedEnergySystem()  # -> Heating, Eta

# ---- group: Can we change the "A" to "Area" to be consistent w/ the above component? Also "I" to "Irrad"?
pvtimeresolved = PhotovoltaicTimeResolvedEnergySystem(
    A=m²,
    Eta_PVref=panel_4,
    Beta=panel_5,
    NOCT=panel_6,
    NOCT_ref=panel_2,
    NOCT_sol=panel_3,
    T_amb=strnum.numbers,
    I=strnum_2.numbers)  # -> Elec, Effic

# ----
panel_7 = Panel(pvtimeresolved.Elec)
