# Grasshopper definition TODO__Q__Hive_SolarThermalTimeResolvedEnergySystem.gh (Grasshopper 1.0.7)
# plug-ins: Hive.Core.solar_tech

# ---- group: Path to weather file (.epw)
panel = Panel("C:\Users\HIVE_Zurich.epw")

# ----
importepw = Ladybug_ImportEpw(epwFile=panel)  # -> readMe, latitude, location, dryBulbTemperature, dewPointTemperature, relativeHumidity, windSpeed, windDirection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; plug-in component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

panel_2 = Panel("""24
24
24
25
25
25
25
26
26
26
27
27
27
28
28
28
29
29
29
30
30
30
31
31
31""")
panel_3 = Panel("""12
12
12
12
12
12
12
11
11
11
11
11
11
12
12
12
12
12
12
12
11
11
11
11
11""")

ladybug = Ladybug_Ladybug()  # -> Vviiiiiiiiiizzz; plug-in component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
strnum = Ladybug_SeparateData(inputList=flatten(importepw.dryBulbTemperature))  # -> numbers, strings; plug-in component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
strnum_2 = Ladybug_SeparateData(inputList=flatten(importepw.dryBulbTemperature))  # -> numbers, strings; plug-in component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
w_m²k = Panel("0.8")
panel_4 = Panel("""12
12
12
12
12
12
12
11
11
11
11
11
11
12
12
12
12
12
12
12
11
11
11
11
11""")
panel_5 = Panel("""12
12
12
12
12
12
12
11
11
11
11
11
11
12
12
12
12
12
12
12
11
11
11
11
11""")
m² = Panel("12")

# ---- group: When connecting to Irrad... Error occurs
strnum_3 = Ladybug_SeparateData(inputList=flatten(importepw.globalHorizontalRadiation))  # -> numbers, strings; plug-in component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

# ----
multiplication = Multiplication(A=strnum_2.numbers, B=Slider(1.1, range=0..1.1))
solarthermaltimeresolved = SolarThermalTimeResolvedEnergySystem(T_in=multiplication, T_amb=strnum.numbers, OpticEff=panel_4, HeatLoss=w_m²k, Irrad=panel_5, Area=m²)  # -> Heating, Eta
panel_6 = Panel(solarthermaltimeresolved.Heating)
