# Grasshopper definition Hive_Distributor_Test.gh (Grasshopper 1.0.7)
# plug-ins: HiveIO, sia380Parameters

rooms_existing = RoomsExisting({"1.1 Wohnen Mehrfamilienhaus": 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, "1.2 Wohnen Einfamilienhaus": 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, "2.1 Hotelzimmer": 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, "2.2 Empfang, Lobby": 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, "3.1 Einzel-, Gruppenbuero": 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, "3.2 Grossraumbuero": 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, "3.3 Sitzungszimmer": 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, "3.4 Schalterhalle, Empfang": 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, "4.1 Schulzimmer": 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, "4.2 Lehrerzimmer": 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}, selected="7.3 Ausstellungshalle": {"description": "7.3 Ausstellungshalle", "Raumlufttemperatur Auslegung Heizen (Winter)": 21.0, "Nettogeschossflaeche": 400.0, "Thermische Gebaeudehuellflaeche": 494.0, "U-Wert Fenster": 1.5, "Waermeeintragsleistung Personen (bei 24.0 deg C, bzw. 70 W)": 23.300000000000001, "Jaehrliche Vollaststunden der Geraete": 2900.0, "U-Wert opake Bauteile": 0.80000000000000004, "Jaehrliche Vollaststunden der Raumbeleuchtung": 2770.0, "Vollaststunden pro Jahr (Personen)": 2600.0, "Abminderungsfaktor fuer Fensterrahmen": 0.75, "Aussenluft-Volumenstrom durch Infiltration": 0.29999999999999999, "Raumlufttemperatur Auslegung Kuehlung (Sommer)": 26.0, "Glasanteil": 50.0, "Zeitkonstante": 32.0, "Waermeeintragsleistung der Raumbeleuchtung": 10.800000000000001, "Waermeeintragsleistung der Geraete": 15.0, "Gesamtenergiedurchlassgrad Verglasung": 0.65000000000000002, "Temperatur-Aenderungsgrad der Waermerueckgewinnung": 0.5, "Aussenluft-Volumenstrom (pro NGF)": 12.0})
panel = Panel("C:\Users\chwaibel\Documents\GitHub\hive\src\Hive.Core\epw_reader\Zurich.epw")
mesh = Mesh(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)
mesh_2 = Mesh(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)
mesh_3 = Mesh(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)
io_pv = HiveIOPV(Mesh=mesh)  # -> flatten(PVObj), HiveIOEnergySystemsEmitter
io_pv_2 = HiveIOPV(Mesh=[mesh_2, mesh_3])  # -> flatten(PVObj), HiveIOEnergySystemsEmitter
brep = Brep(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)
srf = Surface([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])
hive_io_env = HiveIOEnvironment(EPWPath=panel)
hive_io_bldg = HiveIOBuilding(ZoneBrepGeometries=brep, WindowsSurfaces=srf, SIA2024Room=rooms_existing)
hiveiodistr = HiveIODistributor(HiveInputObjects=[hive_io_bldg, io_pv.PVObj, io_pv.HiveIOEnergySystemsEmitter, io_pv_2.PVObj, hive_io_env])  # -> HiveIOBuilding, HiveIOEnvironment, HiveIOEnergySystemSurfaceBasedTech, HiveIOEnergySystemConversionTech
panel_2 = Panel([hiveiodistr.HiveIOBuilding, hiveiodistr.HiveIOEnvironment, hiveiodistr.HiveIOEnergySystemSurfaceBasedTech, hiveiodistr.HiveIOEnergySystemConversionTech])
