# Grasshopper definition Hive_Form_PV.gh (Grasshopper 1.0.7)
# plug-ins: HiveIO

mesh = Mesh(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)
energysystems = HiveIOEnergySystems(Mesh=mesh)  # -> flatten(HiveIOEnergySystemsConversionTech), HiveIOEnergySystemsEmitter
panel = Panel(energysystems.HiveIOEnergySystemsConversionTech)
hiveiodistr = HiveIODistributor(HiveInputObjects=[energysystems.HiveIOEnergySystemsConversionTech, energysystems.HiveIOEnergySystemsEmitter])  # -> HiveIOBuilding, HiveIOEnvironment, HiveIOEnergySystemSurfaceBasedTech, HiveIOEnergySystemConversionTech
panel_2 = Panel([hiveiodistr.HiveIOBuilding, hiveiodistr.HiveIOEnvironment, hiveiodistr.HiveIOEnergySystemSurfaceBasedTech, hiveiodistr.HiveIOEnergySystemConversionTech])
