# Grasshopper definition Hive_Full_Workflow.gh (Grasshopper 1.0.7)
# plug-ins: HiveIO, sia380Parameters, solar, heatpumps, sia380, GHSolar, epw-reader

rooms_standard = RoomsStandard({"1.1 Wohnen Mehrfamilienhaus": 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, "1.2 Wohnen Einfamilienhaus": {"description": "1.2 Wohnen Einfamilienhaus", "Raumlufttemperatur Auslegung Heizen (Winter)": 21.0, "Nettogeschossflaeche": 20.0, "Thermische Gebaeudehuellflaeche": 38.0, "U-Wert Fenster": 1.2, "Waermeeintragsleistung Personen (bei 24.0 deg C, bzw. 70 W)": 1.3999999999999999, "Jaehrliche Vollaststunden der Geraete": 1780.0, "U-Wert opake Bauteile": 0.20000000000000001, "Jaehrliche Vollaststunden der Raumbeleuchtung": 1450.0, "Vollaststunden pro Jahr (Personen)": 4090.0, "Abminderungsfaktor fuer Fensterrahmen": 0.75, "Aussenluft-Volumenstrom durch Infiltration": 0.14999999999999999, "Raumlufttemperatur Auslegung Kuehlung (Sommer)": 26.0, "Glasanteil": 30.0, "Zeitkonstante": 164.0, "Waermeeintragsleistung der Raumbeleuchtung": 2.7000000000000002, "Waermeeintragsleistung der Geraete": 8.0, "Gesamtenergiedurchlassgrad Verglasung": 0.5, "Temperatur-Aenderungsgrad der Waermerueckgewinnung": 0.69999999999999996, "Aussenluft-Volumenstrom (pro NGF)": 0.59999999999999998}, "2.1 Hotelzimmer": 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, "2.2 Empfang, Lobby": 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, "3.1 Einzel-, Gruppenbuero": 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, "3.2 Grossraumbuero": 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, "3.3 Sitzungszimmer": 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, "3.4 Schalterhalle, Empfang": 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, "4.1 Schulzimmer": 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, "4.2 Lehrerzimmer": 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}, selected="1.2 Wohnen Einfamilienhaus")
rooms_existing = RoomsExisting({"1.1 Wohnen Mehrfamilienhaus": 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, "1.2 Wohnen Einfamilienhaus": {"description": "1.2 Wohnen Einfamilienhaus", "Raumlufttemperatur Auslegung Heizen (Winter)": 21.0, "Nettogeschossflaeche": 20.0, "Thermische Gebaeudehuellflaeche": 38.0, "U-Wert Fenster": 1.5, "Waermeeintragsleistung Personen (bei 24.0 deg C, bzw. 70 W)": 1.3999999999999999, "Jaehrliche Vollaststunden der Geraete": 1780.0, "U-Wert opake Bauteile": 0.80000000000000004, "Jaehrliche Vollaststunden der Raumbeleuchtung": 1450.0, "Vollaststunden pro Jahr (Personen)": 4090.0, "Abminderungsfaktor fuer Fensterrahmen": 0.75, "Aussenluft-Volumenstrom durch Infiltration": 0.29999999999999999, "Raumlufttemperatur Auslegung Kuehlung (Sommer)": 26.0, "Glasanteil": 30.0, "Zeitkonstante": 56.0, "Waermeeintragsleistung der Raumbeleuchtung": 2.7000000000000002, "Waermeeintragsleistung der Geraete": 10.0, "Gesamtenergiedurchlassgrad Verglasung": 0.65000000000000002, "Temperatur-Aenderungsgrad der Waermerueckgewinnung": NaN, "Aussenluft-Volumenstrom (pro NGF)": 0.59999999999999998}, "2.1 Hotelzimmer": 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, "2.2 Empfang, Lobby": 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, "3.1 Einzel-, Gruppenbuero": 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, "3.2 Grossraumbuero": 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, "3.3 Sitzungszimmer": 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, "3.4 Schalterhalle, Empfang": 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, "4.1 Schulzimmer": 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, "4.2 Lehrerzimmer": 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}, selected="1.2 Wohnen Einfamilienhaus")
rooms_ideal = RoomsIdeal({"1.1 Wohnen Mehrfamilienhaus": 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, "1.2 Wohnen Einfamilienhaus": {"description": "1.2 Wohnen Einfamilienhaus", "Raumlufttemperatur Auslegung Heizen (Winter)": 21.0, "Nettogeschossflaeche": 20.0, "Thermische Gebaeudehuellflaeche": 38.0, "U-Wert Fenster": 0.90000000000000002, "Waermeeintragsleistung Personen (bei 24.0 deg C, bzw. 70 W)": 1.3999999999999999, "Jaehrliche Vollaststunden der Geraete": 1780.0, "U-Wert opake Bauteile": 0.10000000000000001, "Jaehrliche Vollaststunden der Raumbeleuchtung": 1110.0, "Vollaststunden pro Jahr (Personen)": 4090.0, "Abminderungsfaktor fuer Fensterrahmen": 0.75, "Aussenluft-Volumenstrom durch Infiltration": 0.14999999999999999, "Raumlufttemperatur Auslegung Kuehlung (Sommer)": 26.0, "Glasanteil": 30.0, "Zeitkonstante": 238.0, "Waermeeintragsleistung der Raumbeleuchtung": 1.7, "Waermeeintragsleistung der Geraete": 4.0, "Gesamtenergiedurchlassgrad Verglasung": 0.5, "Temperatur-Aenderungsgrad der Waermerueckgewinnung": 0.80000000000000004, "Aussenluft-Volumenstrom (pro NGF)": 0.59999999999999998}, "2.1 Hotelzimmer": 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, "2.2 Empfang, Lobby": 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, "3.1 Einzel-, Gruppenbuero": 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, "3.2 Grossraumbuero": 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, "3.3 Sitzungszimmer": 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, "3.4 Schalterhalle, Empfang": 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, "4.1 Schulzimmer": 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, "4.2 Lehrerzimmer": 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}, selected="1.2 Wohnen Einfamilienhaus")

# ---- group: Pfad zur Wetterdatei (*.epw)
# EuKS2 - Heizwärmebedarf und PV Ertrag (simuliert)
# Berechnungen zur Abschätzung des Wärmebedarfs.
# Basiert auf der Excel Tabelle "Interaktion Struktur, Klima und Wärmebedarf.xlsx"
# 
# Sonneneinstrahlung simuliert gemäss "Waibel, C., Evins, R., Carmeliet, J. 2017. Efficient time-resolved 3D solar potential modelling. Solar Energy 158 (2017) 960–976."
panel = Panel("C:\Users\chwaibel\Documents\GitHub\hive\src\Hive.Core\epw_reader\Zurich.epw")

# ---- group: PV Fläche
srf = Surface(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)

# ---- group: Boden
mesh = Mesh(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)

# ---- group: Gebäudevolumen
brep = Brep(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)

# ----
mesh_uv = MeshSurface(Surface=srf, UCount="6", VCount="6", Overhang=True, Equalize=False)

# ---- group: Umgebungsbebauung
mesh_2 = Mesh([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])

# ---- group: Fensterflächen
srf_2 = Surface([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])

# ----
hiveiosolar = HiveIOSolarTech(Mesh=mesh_uv)  # -> flatten(HiveIOEnergySystemSurfaceSystem), HiveIOEnergySystemsEmitter
hive_io_bldg = HiveIOBuilding(ZoneBrepGeometries=brep, WindowsSurfaces=srf_2, SIA2024Room_2=rooms_standard)
hive_io_env = HiveIOEnvironment(EPWPath=panel, ObstaclesGeometry=[mesh, mesh_2])
hiveiodistr = HiveIODistributor(HiveInputObjects=[hive_io_env, hive_io_bldg, hiveiosolar.HiveIOEnergySystemSurfaceSystem, hiveiosolar.HiveIOEnergySystemsEmitter])  # -> HiveIOBuilding, HiveIOEnvironment, HiveIOEnergySystemSurfaceBasedTech, HiveIOEnergySystemConversionTech
distrsolar = HiveIODistributorSolar(
    HiveIOBuilding=hiveiodistr.HiveIOBuilding,
    HiveIOEnergySystemSurfaceBased=hiveiodistr.HiveIOEnergySystemSurfaceBasedTech,
    HiveIOEnvironment=hiveiodistr.HiveIOEnvironment)  # -> EnvironmentMesh, BuildingCentroid, ExternalSurfaces, WindowGeometries, SolarTechMesh
hiveiodistrsupsys = HiveIODistributorSupplySystem(HiveIOEnergySystemsSurfaceBased=hiveiodistr.HiveIOEnergySystemSurfaceBasedTech)  # -> EfficiencyPV, PVAreas, EfficiencyST, STAreas, ElectricEfficiencyPVT, ThermalEfficiencyPVT, PVTAreas
distributorsia = DistributorSIA(BuildingObj=hiveiodistr.HiveIOBuilding)  # -> ZoneAreas, WindowsAreas, ExtSrfAreas, SIA2024json
hiveiodistrepw = HiveIODistributorEPW(HiveIOEnvironment=hiveiodistr.HiveIOEnvironment)  # -> Filepath, InputCarriers
epw_reader = EPWReader(Path=hiveiodistrepw.Filepath)  # -> Latitude, Longitude, CityCountry, GHI, DNI, DHI, DryBulb, DewPoint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
adaptcomf = AdaptiveComfort(T_m=epw_reader.DryBulbMonthly)  # -> T_n, T_n80ub, T_n80lb, T_n90ub, T_n90lb
sia2024 = SIA2024Rooms(
    Room=distributorsia.SIA2024json,
    Area=distributorsia.ZoneAreas,
    Month=[1, 2, 3, 4, 5, 6, 7, 8, 9, 10, 11, 12],
    Season="winter")  # -> Τ_h, Θ_i_C, T_h, A_op_m2, A_w_m2, U_op_W_m2K, U_w_W_m2K, V_e_m3_h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

# ----
# Transmissions-Wärmetransferkoeffizient
# H_T = A_op * U_op + A_w * U_w
# [H_T] = W/K
# [A_op] = m^2
# [A_w] = m^2
# [U_op] = W/(m^2K)
# [U_w] = W/(m^2K)
subtraction = Subtraction(A=distributorsia.ExtSrfAreas, B=distributorsia.WindowsAreas)
python = GhPythonScript(A_op=subtraction, U_op=sia2024.U_op_W_m2K, A_w=distributorsia.WindowsAreas, U_w=sia2024.U_w_W_m2K)  # -> H_T
# ---------- python: Python ----------
"""Transmissions-Wärmetransferkoeffizient in W/K.
    Inputs:
        A_op:   Aussenwandfläche (opak) in m^2
        U_op:   Wärmedurchgangskoeffizient Aussenwand (opak) in W/m^2K
        A_w:    Aussenwandläche (transparent) in m^2
        U_w:    Wärmedurchgangskoeffizient Aussenwand (transparent) in W/m^2K
    Output:
        H_T:    Transmissions-Wärmetransferkoeffizient in W/K"""

__author__ = "A/S ETH"
__version__ = "2020.04.18"

import rhinoscriptsyntax as rs

H_T = A_op * U_op + A_w * U_w
# ---------- end python ----------

# ----
# SIA 380 GHPYTHON SCRIPTS
# Thermisch wirksamer Aussenluftvolumenstrom
# Vdot_th = Vdot_e * (1 - eta_rec) + Vdot_inf
# [Vdot_th] = m^3/h oder m^3/s
# [Vdot_e] = m^3/h oder m^3/s
# [Vdot_inf] = m^3/h oder m^3/s
# [eta_rec] = -
python_2 = GhPythonScript(Vdot_e=sia2024.V_e_m3_h, Vdot_inf=sia2024.V_inf_m3_h, eta_rec=sia2024.Η_rec_)  # -> Vdot_th
# ---------- python_2: Python ----------
"""Thermisch wirksamer Aussenluftvolumenstrom.
    Inputs:
        Vdot_e:         Aussenluft-Volumenstrom durch Lüftung in m^3/h
        Vdot_inf:       Aussenluft-Volumenstrom durch Infiltration in m^3/h
        eta_rec:        Nutzungsgrad der Wärmerückgewinnung
    Output:
        Vdot_th:        Thermisch wirksamer Aussenluft Volumenstrom in m^3/h"""

__author__ = "A/S ETH"
__version__ = "2020.04.18"

import rhinoscriptsyntax as rs
import math

if math.isnan(eta_rec):
    eta_rec = 0
Vdot_th = Vdot_e * (1-eta_rec) + Vdot_inf
# ---------- end python_2 ----------

# ----
# Interne Wärmeeinträge
# Q_i = Phi_P * t_P + Phi_B * t_B + Phi_G * t_G
# [Q_i] = Wh
# [Phi_P,B,G] = W
# [t_P,B,G] = h
python_3 = GhPythonScript(Phi_P=sia2024.Φ_P_W, t_P=sia2024.T_P_h, Phi_B=sia2024.Φ_L_W, t_B=sia2024.T_L_h, Phi_G=sia2024.Φ_G_W, t_G=sia2024.T_A_h)  # -> Q_i
# ---------- python_3: Python ----------
"""Interne Wärmeeinträge in Wh.
    Inputs:
        Phi_P:      Wärmeagbage Personen in W
        t_P:        Vollaststunden Personen in h
        Phi_B:      Wärmeabgabe Beleuchtung in W
        t_B:        Vollaststunden Beleuchtung in h
        Phi_G:      Wärmeabgabe Geräte in W
        t_G:        Vollaststunden Geräte in h
    Output:
        Q_i:        Interne Wärmeeinträge in Wh"""

__author__ = "A/S ETH"
__version__ = "2020.04.18"

import rhinoscriptsyntax as rs

Q_i = Phi_P*t_P + Phi_B * t_B + Phi_G * t_G
# ---------- end python_3 ----------

# ----
# Aussenlufttemperatur
panel_2 = Panel(epw_reader.DryBulbMonthly)

# ----
# Lüftungs-Wärmetransferkoeffizient
# H_V = Vdot_th * rho * c_p
# [H_V] = W/K
# [Vdot_th] = m^3/s
# [rho] = kg/m^3
# [c_p] = J/(kgK)
panel_3 = Panel("1.2")
python_4 = GhPythonScript(Vdot_th=python_2, rho=panel_3, c_p="1005")  # -> H_V
# ---------- python_4: Python ----------
"""Lüftungs-Wärmetransferkoeffizient.
    Inputs:
        Vdot_th:    Thermisch wirksamer Aussenluft-Volumenstrom in m^3/s
        rho:        Luftdichte in kg/m^3
        c_p:        Spezifische Wärmekapazität Luft in J/kgK
    Output:
        H_V:        Lüftungs-Wärmetransferkoeffizient in W/K"""

__author__ = "A/S ETH"
__version__ = "2020.04.18"

import rhinoscriptsyntax as rs

H_V = Vdot_th/3600 * rho * c_p
# ---------- end python_4 ----------

# ----
# Transmissionswärmeverluste
# Q_T = H_T * (T_i - T_e) * t
# [Q_T] = Wh
# [H_T] = W/K
# [T_i] = K oder °C
# [T_e] = K oder °C
# [t] = h
python_5 = GhPythonScript(H_T=python, T_i=sia2024.Θ_i_C, T_e=panel_2, t=sia2024.T_h)  # -> Q_T
# ---------- python_5: Python ----------
"""Transmissionswärmeverluste in Wh.
    Inputs:
        H_T:    Transmissions-Wärmetransferkoeffizient in W/K
        T_i:    Raumlufttemperatur in °C oder K
        T_e:    Aussenlufttemperatur in °C oder K
        t:      Länger der Berechnungsperiode in h
    Output:
        Q_T:    Transmissionswärmeverluste in Wh"""

__author__ = "A/S ETH"
__version__ = "2020.04.18"

import rhinoscriptsyntax as rs

Q_T = H_T * (T_i - T_e) * t
# ---------- end python_5 ----------

# ----
# Lüftungswärmeverluste
# Q_V = H_V * (T_i - T_e) * t
# [Q_V] = Wh
# [H_V] = W/K
# [T_i] = K oder °C
# [T_e] = K oder °C
# [t] = h
python_6 = GhPythonScript(H_V=python_4, T_i=sia2024.Θ_i_C, T_e=panel_2, t=sia2024.T_h)  # -> Q_V
# ---------- python_6: Python ----------
"""Lüftungswärmeverluste in Wh.
    Inputs:
        H_V:    Lüftungs-Wärmetransferkoeffizient in W/K
        T_i:    Raumlufttemperatur in °C oder K
        T_a:    Aussenlufttemperatur in °C oder K
        t:      Länge der Berechnungsperiode in h
    Output:
        Q_V:    Lüftungswärmeverluste in Wh"""

__author__ = "A/S ETH"
__version__ = "2020.04.18"

import rhinoscriptsyntax as rs

Q_V = H_V * (T_i - T_e) * t
# ---------- end python_6 ----------

# ----
# PV Ertrag (simuliert)
data = Data([0.8, 0.8, 0.8, 0.8, 0.8, 0.8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])
mesh_3 = Mesh(distrsolar.ExternalSurfaces)
obstobj = ObstacleObject(Mesh=distrsolar.SolarTechMesh, Albedo=data, SpecCoeff=data, ReflType=0, Tolerance=0.01, Name="PV", MT=True)
obstobj_2 = ObstacleObject(Mesh=[distrsolar.EnvironmentMesh, mesh_3], Albedo=data, SpecCoeff=data, ReflType=0, Tolerance=0.01, Name="PV", MT=True)
irrmshy = IrradiationMeshYear(
    AnalysisObjects=obstobj,
    ObstacleObjects=obstobj_2,
    Latitude=epw_reader.Latitude,
    Longitude=epw_reader.Longitude,
    Year=2017,
    DNI=epw_reader.DNI,
    DHI=epw_reader.DHI,
    MainSkyRes=1,
    SpecBounces=0,
    DiffIReflSkyRes=0,
    DiffIReflMode=2,
    MT=True)
readresults = ReadResults(Mesh=distrsolar.SolarTechMesh, I=irrmshy, Value=7)  # -> Results, SP
python_7 = GhPythonScript(x=simplify(readresults.Results), month=[0, 1, 2, 3, 4, 5, 6, 7, 8, 9, 10, 11])  # -> out, a; inputs x: list, month: Int32
# ---------- python_7: Python ----------
__author__ = "chwaibel"
__version__ = "2020.02.25"

import rhinoscriptsyntax as rs

# 8760 time series
# get monthly average...
# how to know how many days a month? somewhere, I have typical year.
# in some honey-badger script

dayspermonth = [31.0, 28.0, 31.0, 30.0, 31.0, 30.0, 31.0, 31.0, 30.0, 31.0, 30.0, 31.0]

hour_per_day = 24
start_hour = int(hour_per_day * sum(dayspermonth[0:month])) 
end_hour = int(hour_per_day * sum(dayspermonth[0:month+1]))

cumulative_data = sum(x[start_hour:end_hour])

a = cumulative_data / 1000
# ---------- end python_7 ----------
c_script = CSharpScript(G=python_7.a, g=hiveiodistrsupsys.EfficiencyPV)  # -> out, Q_s; inputs G: tree of Double, g: list of Double
# ---------- c_script: C# ----------
    int winCount = G.BranchCount;
    double [] Q_array = new double[12];

    DataTree<double> doubleTree = new DataTree<double>();
    for (int i = 0; i < G.BranchCount; i++)
    {
      for (int j = 0; j < G.Branch(i).Count; ++j) // should be 12, 1 for each month of the year
      {
        GH_Path path = new GH_Path(i, j);
        double irrad = G.Branch(i)[j]  * g[i];
        doubleTree.Add(irrad, path);

        Q_array[j] += irrad;
      }
    }

    Q_s = Q_array;
# ---------- end c_script ----------
ma = MassAddition(Input=c_script.Q_s)  # -> Result, PartialResults
ma_2 = MassAddition(Input=hiveiodistrsupsys.PVAreas)  # -> Result, PartialResults
division = Division(A=ma.Result, B=ma_2.Result)

# ----
# Solare Wärmeeinträge
mesh_4 = MeshBrep(
    Brep=distrsolar.WindowGeometries,
    Settings={GridMaxCount=0, GridMinCount=16, JaggedSeams=False, MaxEdgeLength=0, MinEdgeLength=0.0001, MinTolerance=0, Refine=True, RefineAngle=0, RelativeTolerance=0.65, SimplePlanes=True, Tolerance=0})
# SOLAR
obstobj_3 = ObstacleObject(Mesh=mesh_4, Albedo=data, SpecCoeff=data, ReflType=0, Tolerance=0.01, Name="PV", MT=True)
irrmshy_2 = IrradiationMeshYear(
    AnalysisObjects=obstobj_3,
    ObstacleObjects=obstobj_2,
    Latitude=epw_reader.Latitude,
    Longitude=epw_reader.Longitude,
    Year=2017,
    DNI=epw_reader.DNI,
    DHI=epw_reader.DHI,
    MainSkyRes=1,
    SpecBounces=0,
    DiffIReflSkyRes=0,
    DiffIReflMode=2,
    MT=True)
readresults_2 = ReadResults(Mesh=mesh_4, I=irrmshy_2, Value=7)  # -> simplify(Results), SP
python_8 = GhPythonScript(x=simplify(readresults_2.Results), month=[0, 1, 2, 3, 4, 5, 6, 7, 8, 9, 10, 11])  # -> out, a; inputs x: list, month: Int32; same code as python_7
item = ListItem(List=sia2024.G_, Index=0, Wrap=True)
c_script_2 = CSharpScript(G=python_8.a, g=item)  # -> out, Q_s; inputs G: tree of Double, g: Double
# ---------- c_script_2: C# ----------
    int winCount = G.BranchCount;
    double [] Q_array = new double[12];

    DataTree<double> doubleTree = new DataTree<double>();
    for (int i = 0; i < G.BranchCount; i++)
    {
      for (int j = 0; j < G.Branch(i).Count; ++j) // should be 12, 1 for each month of the year
      {
        GH_Path path = new GH_Path(i, j);
        double irrad = G.Branch(i)[j] *  g;
        doubleTree.Add(irrad, path);

        Q_array[j] += irrad;
      }
    }

    Q_s = Q_array;
# ---------- end c_script_2 ----------
panel_4 = Panel(c_script_2.Q_s)

# ---- group: NEW SIA 380 COMPONENT / obstructed
c_script_3 = CSharpScript(G=python_8.a, g=item)  # -> out, Q_s; inputs G: tree of Double, g: Double
# ---------- c_script_3: C# ----------
    int winCount = G.BranchCount;
    double [][] Q_array = new double[12][];
    for(int j = 0; j < G.Branch(0).Count; j++)
      Q_array[j] = new double[G.BranchCount];

    DataTree<double> doubleTree = new DataTree<double>();
    for (int i = 0; i < G.BranchCount; i++)
    {
      for (int j = 0; j < G.Branch(i).Count; ++j) // should be 12, 1 for each month of the year
      {
        GH_Path path = new GH_Path(i, j);
        double irrad = G.Branch(i)[j] * g;
        doubleTree.Add(irrad, path);

        Q_array[j][i] = irrad*1000;
      }
    }
    jagged jag = new jagged();
    jag.data = Q_array;

    Q_s = jag;
# ---------- c_script_3: C# additional code ----------
  public struct jagged
  {
    public double [][] data;
  }
# ---------- end c_script_3 ----------

# ----
# Solare Wärmeeinträge
# Q_s = G * F_F * A_w * g
# [Q_s] = kWh
# [G] = kWh/m^2
# [F_F] = -
# [A_w] = m^2
# [g] = -
c_script_4 = CSharpScript(x=distrsolar.WindowGeometries)  # -> out, tilt, azimuth, area; inputs x: Brep
# ---------- c_script_4: C# ----------
    Surface srf = x.Surfaces[0];

    AreaMassProperties massProp = AreaMassProperties.Compute(srf);
    Point3d cen = massProp.Centroid;
    double u,v;
    srf.ClosestPoint(cen, out u, out v);
    Vector3d normal = srf.NormalAt(u, v);

    if(x.Faces[0].OrientationIsReversed)
      normal.Reverse();

    Vector3d vnormal = new Vector3d(0, 0, 1);
    Vector3d tiltZ0 = new Vector3d(0, 0, 1);

    double tiltValue = Vector3d.VectorAngle(normal, tiltZ0, vnormal);
    tilt = tiltValue * (180.0 / Math.PI);

    double azimuthValue = Vector3d.VectorAngle(new Vector3d(normal.X, normal.Y, 0), new Vector3d(0, 1, 0), vnormal);
    azimuth = azimuthValue * (180 / Math.PI);

//    Line normalLine = new Line(cen, cen + normal);
//    Line azimuthLine = new Line(cen, cen + new Vector3d(0, 1, 0));
//    Line tiltLine = new Line(cen, cen + tiltZ0);
//    A = normalLine;
//    B = azimuthLine;
//    C = tiltLine;


    area = AreaMassProperties.Compute(x.Faces[0]).Area;
# ---------- end c_script_4 ----------
simplepanel = SimplePanel(
    Tilt=c_script_4.tilt,
    Azimuth=c_script_4.azimuth,
    DHI=epw_reader.DHI,
    DNI=epw_reader.DNI,
    Latitude=epw_reader.Latitude,
    Longitude=epw_reader.Longitude)
python_9 = GhPythonScript(x=simplify(simplepanel), month=[0, 1, 2, 3, 4, 5, 6, 7, 8, 9, 10, 11])  # -> out, a; inputs x: list, month: Int32; same code as python_7
c_script_5 = CSharpScript(G=python_9.a, A_w=c_script_4.area, g=item)  # -> out, Q_s; inputs G: tree of Double, A_w: list of Double, g: Double
# ---------- c_script_5: C# ----------
    int winCount = G.BranchCount;
    double [] Q_array = new double[12];

    DataTree<double> doubleTree = new DataTree<double>();
    for (int i = 0; i < G.BranchCount; i++)
    {
      for (int j = 0; j < G.Branch(i).Count; ++j) // should be 12, 1 for each month of the year
      {
        GH_Path path = new GH_Path(i, j);
        double irrad = G.Branch(i)[j] * A_w[i] * g;
        doubleTree.Add(irrad, path);

        Q_array[j] += irrad;
      }
    }

    Q_s = Q_array;
# ---------- end c_script_5 ----------
panel_5 = Panel(c_script_5.Q_s)

# ---- group: NEW SIA 380 COMPONENT / unobstructed
c_script_6 = CSharpScript(G=python_9.a, A_w=c_script_4.area, g=item)  # -> out, Q_s; inputs G: tree of Double, A_w: list of Double, g: Double
# ---------- c_script_6: C# ----------
    int winCount = G.BranchCount;
    double [][] Q_array = new double[12][];
    for(int j = 0; j < G.Branch(0).Count; j++)
      Q_array[j] = new double[G.BranchCount];

    DataTree<double> doubleTree = new DataTree<double>();
    for (int i = 0; i < G.BranchCount; i++)
    {
      for (int j = 0; j < G.Branch(i).Count; ++j) // should be 12, 1 for each month of the year
      {
        GH_Path path = new GH_Path(i, j);
        double irrad = G.Branch(i)[j] * A_w[i] * g;
        doubleTree.Add(irrad, path);

        Q_array[j][i] = irrad*1000;
      }
    }

    jagged output = new jagged();
    output.data = Q_array;
    Q_s = output;
# ---------- c_script_6: C# additional code ----------
  public struct jagged
  {
    public double [][] data;
  }
# ---------- end c_script_6 ----------

# ----
# Wärmeeintrag/-verlust-Verhältnis
# gamma = (Q_i + Q_s) / (Q_T + Q_V)
# [gamma] = -
# [Q_T] = Wh
# [Q_V] = Wh
# [Q_i] = Wh
# [Q_s] = Wh (script erfordert kWh!)
python_10 = GhPythonScript(Q_T=python_5, Q_V=python_6, Q_i=python_3, Q_s=c_script_2.Q_s)  # -> gamma
# ---------- python_10: Python ----------
"""Wärmeeintrag/-verlust-Verhältnis.
    Inputs:
        Q_T:        Transmissionswärmeverluste in Wh
        Q_V:        Lüftungswärmeverluste in Wh
        Q_i:        Interne Wärmeeinträge in Wh
        Q_s:        Solare Wärmeeinträge in kWh
    Output:
        gamma:      Wärmeeintrag/-verlust-Verhältnis"""

__author__ = "A/S ETH"
__version__ = "2020.04.18"

import rhinoscriptsyntax as rs

gamma = (Q_i + Q_s*1000) / (Q_T + Q_V)
# ---------- end python_10 ----------

# ----
# Ausnutzungsgrad für Wärmegewinne
panel_6 = Panel("""eta_g = (1 - gamma^a) / (1 - gamma^(a+1))
a = 1 + tau / 15
[eta_g] = -
[gamma] = -
[tau] = h""")
python_11 = GhPythonScript(gamma=python_10, tau=sia2024.Τ_h, Q_T=python_5, Q_V=python_6)  # -> eta_g
# ---------- python_11: Python ----------
"""Ausnutzungsgrad für Wärmegewinne.
    Inputs:
        gamma:      Wärmeeintrag/-verlust-Verhältnis
        tau:        Zeitkonstante des Gebäudes in h
        Q_T:        Transmissionswärmeverluste in Wh
        Q_V:        Lüftungswärmeverluste in Wh
    Output:
        eta_g:      Ausnutzungsgrad für Wärmegewinne"""

__author__ = "A/S ETH"
__version__ = "2020.04.18"

import rhinoscriptsyntax as rs

if Q_T + Q_V < 0:
    eta_g = 0
elif gamma==1:
    eta_g = (1 + tau / 5) / (2 + tau/15)
else:
    a = 1 + tau / 15
    eta_g = (1-gamma**a) / (1-gamma**(a+1))
# ---------- end python_11 ----------

# ----
# Heizwärmebedarf
# Q_H = Q_T + Q_V - eta_g * (Q_i + Q_s)
# [Q_H] = Wh (script errechnet kWh!)
# [Q_T] = Wh
# [Q_V] = Wh
# [Q_i] = Wh
# [Q_s] = Wh (script erfordert kWh!)
# [eta_g] = -
python_12 = GhPythonScript(Q_T=python_5, Q_V=python_6, Q_i=python_3, Q_s=c_script_2.Q_s, eta_g=python_11)  # -> Q_H
# ---------- python_12: Python ----------
"""Heizwärmebedarf.
    Inputs:
        Q_T:    Transmissionswärmeverluste in Wh
        Q_V:    Lüftungswärmeverluste in Wh
        Q_i:    Interne Wärmeeinträge in Wh
        Q_s:    Solare Wärmeeinträge in kWh
        eta_g:  Ausnutzungsgrad für Wärmerückgewinnung
    Output:
        Q_H:    Heiwärmebedarf in kWh"""

__author__ = "A/S ETH"
__version__ = "2020.04.19"

import rhinoscriptsyntax as rs

Q_H = Q_T + Q_V - eta_g * (Q_i + Q_s*1000)
if Q_H < 0:
    Q_H = 0
Q_H /= 1000
# ---------- end python_12 ----------
ma_3 = MassAddition(Input=python_12)  # -> Result, PartialResults
division_2 = Division(A=ma_3.Result, B=distributorsia.ZoneAreas)

# ---- group: providing heat with heatpump
simple_hp = SimpleHp(Q_th=python_12, COP="3.5")
ma_4 = MassAddition(Input=simple_hp)  # -> Result, PartialResults
division_3 = Division(A=ma_4.Result, B=distributorsia.ZoneAreas)

# ---- group: Wärmepumpe Strom abzgl. PV Strom
subtraction_2 = Subtraction(A=simple_hp, B=c_script.Q_s)

# ----
data_2 = Data([ma_3.Result, ma_4.Result, ma.Result, division_2, division_3, division])
panel_7 = Panel("""0
0
0
0
0
0
0
0
0
0
0
0""")
hiveioresults = HiveIOResults(
    CoolingMonthly=panel_7,
    HeatingMonthly=python_12,
    ElectricityMonthly=subtraction_2,
    HiveBuilding=hiveiodistr.HiveIOBuilding)
hive_io_visualizer = HiveIOVisualizer(hiveioresults)

# ---- group: Heizwärmebedarf, Strombedarf Wärmepumpe und Stromertrag PV
# Jahresheizwärmebedarf in kWh
# Jahresstrombedarf Wärmepumpe in kWh
# Jahresstromertrag PV in kWh
# Jahresheizwärmebedarf in kWh/m^2
# Jahresstrombedarf Wärmepumpe in kWh/m^2
# Jahresstromertrag PV in kWh/m^2 PV
panel_8 = Panel(data_2)

# ---- group: Sonnenstandsdiagrammm
epw_reader_2 = EPWReader(Path=panel)  # -> Latitude, Longitude, CityCountry, GHI, DNI, DHI, DryBulb, DewPoint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
pt = Point(Point(25.44273959, -13.55326394, 0))
skydome = GHSkydome(
    RecursionLevel=Slider(5, range=0..5),
    Viewfactors=Toggle(False),
    SunPath=Toggle(False),
    SolarVec=False,
    HOY=1,
    Location=[epw_reader_2.Longitude, epw_reader_2.Latitude],
    Size="0.3",
    Context=mesh_2,
    Sp=pt)  # -> Mesh, Vectors, Sunpaths, SunGeo

# ---- group: Visualisierung Sonneneinstrahlung
number_slider = Slider(200, range=0..1500)
number_slider_2 = Slider(1200, range=0..1500)
visumshsol = VisualizeMeshSolar(Mesh=mesh_4, I=irrmshy_2, Value=0, Min=number_slider, Max=number_slider_2, Clr=1)
visumshsol_2 = VisualizeMeshSolar(Mesh=distrsolar.SolarTechMesh, I=irrmshy, Value=0, Min=number_slider, Max=number_slider_2, Clr=1)

# ---- group: NEW SIA 380 COMPONENT
# SIA 380
panel_9 = Panel("""transp
transp
transp
transp
transp
opaque""")
# SIA 380 NEW COMPONENT
subtraction_3 = Subtraction(A=distributorsia.ExtSrfAreas, B=distributorsia.WindowsAreas)
merge = Merge(Data1=c_script_4.area, Data2=subtraction_3)  # -> flatten(Result)
sia380 = SIA380(
    Room_properties=distributorsia.SIA2024json,
    Floor_area=distributorsia.ZoneAreas,
    T_e=epw_reader.DryBulbMonthly,
    Setpoints_ub=adaptcomf.T_n80ub,
    Setpoints_lb=adaptcomf.T_n80lb,
    Surface_areas=merge,
    Surface_type=panel_9,
    Q_s_per_surface=c_script_3.Q_s)  # -> Q_Heat, Q_Cool, Q_Elec, Q_T, Q_V, Q_i, Q_s
ma_5 = MassAddition(Input=sia380.Q_Heat)  # -> Result, PartialResults
division_4 = Division(A=ma_5.Result, B=distributorsia.ZoneAreas)

# ---- group: NEW SIA 380 COMPONENT / providing heat with heatpump
simple_hp_2 = SimpleHp(Q_th=sia380.Q_Heat, COP="3.5")
ma_6 = MassAddition(Input=simple_hp_2)  # -> Result, PartialResults
division_5 = Division(A=ma_6.Result, B=distributorsia.ZoneAreas)

# ---- group: NEW SIA 380 COMPONENT / Wärmepumpe Strom abzgl. PV Strom
subtraction_4 = Subtraction(A=simple_hp_2, B=c_script.Q_s)

# ---- group: NEW SIA 380 COMPONENT (continued)
python_13 = GhPythonScript(x=sia380.Q_Elec, y=subtraction_4)  # -> out, a; inputs x: list, y: list
# ---------- python_13: Python ----------
__author__ = "Christoph"
__version__ = "2020.05.20"

import rhinoscriptsyntax as rs
elec = []
for i in range(len(x)):
    elec.append(x[i] + y[i])

a = elec
# ---------- end python_13 ----------
data_3 = Data([ma_5.Result, ma_6.Result, ma.Result, division_4, division_5, division])

# ----
hiveioresults_2 = HiveIOResults(
    CoolingMonthly=sia380.Q_Cool,
    HeatingMonthly=sia380.Q_Heat,
    ElectricityMonthly=python_13.a,
    HiveBuilding=hiveiodistr.HiveIOBuilding)
hive_io_visualizer_2 = HiveIOVisualizer(hiveioresults_2)

# ---- group: Heizwärmebedarf, Strombedarf Wärmepumpe und Stromertrag PV
panel_10 = Panel(data_3)
