# Grasshopper definition Hive_Merger_Solar_Test.gh (Grasshopper 1.0.7)
# plug-ins: HiveIO, solar-tech, sia380Parameters, GHSolar, epw-reader

rooms_standard = RoomsStandard({"1.1 Wohnen Mehrfamilienhaus": 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, "1.2 Wohnen Einfamilienhaus": {"description": "1.2 Wohnen Einfamilienhaus", "Raumlufttemperatur Auslegung Heizen (Winter)": 21.0, "Nettogeschossflaeche": 20.0, "Thermische Gebaeudehuellflaeche": 38.0, "U-Wert Fenster": 1.2, "Waermeeintragsleistung Personen (bei 24.0 deg C, bzw. 70 W)": 1.3999999999999999, "Jaehrliche Vollaststunden der Geraete": 1780.0, "U-Wert opake Bauteile": 0.20000000000000001, "Jaehrliche Vollaststunden der Raumbeleuchtung": 1450.0, "Vollaststunden pro Jahr (Personen)": 4090.0, "Abminderungsfaktor fuer Fensterrahmen": 0.75, "Aussenluft-Volumenstrom durch Infiltration": 0.14999999999999999, "Raumlufttemperatur Auslegung Kuehlung (Sommer)": 26.0, "Glasanteil": 30.0, "Zeitkonstante": 164.0, "Waermeeintragsleistung der Raumbeleuchtung": 2.7000000000000002, "Waermeeintragsleistung der Geraete": 8.0, "Gesamtenergiedurchlassgrad Verglasung": 0.5, "Temperatur-Aenderungsgrad der Waermerueckgewinnung": 0.69999999999999996, "Aussenluft-Volumenstrom (pro NGF)": 0.59999999999999998}, "2.1 Hotelzimmer": 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, "2.2 Empfang, Lobby": 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, "3.1 Einzel-, Gruppenbuero": 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, "3.2 Grossraumbuero": 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, "3.3 Sitzungszimmer": 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, "3.4 Schalterhalle, Empfang": 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, "4.1 Schulzimmer": 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, "4.2 Lehrerzimmer": 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}, selected="1.2 Wohnen Einfamilienhaus")

# ---- group: Pfad zur Wetterdatei (*.epw)
panel = Panel("C:\Users\chwaibel\Documents\GitHub\hive\src\Hive.Core\epw_reader\Zurich.epw")

# ---- group: PV Fläche
srf = Surface(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)

# ---- group: Boden
mesh = Mesh(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)

# ---- group: Gebäudevolumen
brep = Brep(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)

# ----
mesh_uv = MeshSurface(Surface=srf, UCount="6", VCount="6", Overhang=True, Equalize=False)
hiveparainemitter = ParametricInputEmitterHive(
    Vorlauf="65",
    Rücklauf="55",
    Capacity="1000",
    InvestmentCost="1000",
    EmbodiedEmissions="1000",
    Name="hi",
    AirEmitter=False,
    Cooling=False)

# ---- group: Umgebungsbebauung
mesh_2 = Mesh([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])

# ---- group: Fensterflächen
srf_2 = Surface([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])

# ----
hiveiosolar = HiveIOSolarTech(Mesh=mesh_uv, EmitterJson=hiveparainemitter)  # -> flatten(HiveIOEnergySystemSurfaceSystem)
hive_io_bldg = HiveIOBuilding(ZoneBrepGeometries=brep, WindowsSurfaces=srf_2, SIA2024Room_2=rooms_standard)
hive_io_env = HiveIOEnvironment(EPWPath=panel, ObstaclesGeometry=[mesh, mesh_2])
hiveiodistr = HiveIODistributor(HiveInputObjects=[hive_io_env, hive_io_bldg, hiveiosolar])  # -> HiveIOBuilding, HiveIOEnvironment, HiveIOEnergySystemSurfaceBasedTech, HiveIOEnergySystemConversionTech, HiveIOEnergySystemsEmitter
python = GhPythonScript(x=hiveiodistr.HiveIOEnergySystemsEmitter)  # -> out, a
# ---------- python: Python ----------
__author__ = "chwaibel"
__version__ = "2020.08.21"

import rhinoscriptsyntax as rs
a = x.InletCarrier

print(x.ReturnCarrier)
# ---------- end python ----------
hiveiodistrsupsys = HiveIODistributorSupplySystem(HiveIOEnergySystemsSurfaceBased=hiveiodistr.HiveIOEnergySystemSurfaceBasedTech)  # -> EfficiencyPV, PVAreas, EfficiencyST, STAreas, ElectricEfficiencyPVT, ThermalEfficiencyPVT, PVTAreas
distrsolar = HiveIODistributorSolar(
    HiveIOBuilding=hiveiodistr.HiveIOBuilding,
    HiveIOEnergySystemSurfaceBased=hiveiodistr.HiveIOEnergySystemSurfaceBasedTech,
    HiveIOEnvironment=hiveiodistr.HiveIOEnvironment)  # -> EnvironmentMesh, BuildingCentroid, ExternalSurfaces, WindowGeometries, SolarTechMesh, WindowAzimuth, WindowAreas, SolarTechMesh_2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
hiveiodistrepw = HiveIODistributorEPW(HiveIOEnvironment=hiveiodistr.HiveIOEnvironment)  # -> Filepath, InputCarriers
epw_reader = EPWReader(Path=hiveiodistrepw.Filepath)  # -> Latitude, Longitude, CityCountry, GHI, DNI, DHI, DryBulb, DewPoint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

# ----
# PV Ertrag (simuliert)
data = Data([0.8, 0.8, 0.8, 0.8, 0.8, 0.8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])
mesh_3 = Mesh(distrsolar.ExternalSurfaces)
obstobj = ObstacleObject(Mesh=distrsolar.SolarTechMesh_2, Albedo=data, SpecCoeff=data, ReflType=0, Tolerance=0.01, Name="PV", MT=True)
obstobj_2 = ObstacleObject(Mesh=[distrsolar.EnvironmentMesh, mesh_3], Albedo=data, SpecCoeff=data, ReflType=0, Tolerance=0.01, Name="PV", MT=True)
irrmshy = IrradiationMeshYear(
    AnalysisObjects=obstobj,
    ObstacleObjects=obstobj_2,
    Latitude=epw_reader.Latitude,
    Longitude=epw_reader.Longitude,
    Year=2017,
    DNI=epw_reader.DNI,
    DHI=epw_reader.DHI,
    MainSkyRes=1,
    SpecBounces=0,
    DiffIReflSkyRes=0,
    DiffIReflMode=2,
    MT=True)

python_2 = GhPythonScript(x=irrmshy)  # -> out, a
# ---------- python_2: Python ----------
__author__ = "chwaibel"
__version__ = "2020.08.21"

import rhinoscriptsyntax as rs

a = x.I_hourly
# ---------- end python_2 ----------

# ----
# PV / ST in Hive.IO
hivemergersolartech = MergerSolarTechHive(
    GHSolarResults=python_2.a,
    SolarTech=hiveiodistr.HiveIOEnergySystemSurfaceBasedTech,
    Air=epw_reader.AmbientTemperatureCarrier,
    TimeResolution="monthly",
    SimpleMode=False)

# ----
# PV / ST in Honey-Badger
panel_2 = Panel("hourly")
solartechsetoutputs = SolarTechSetOutputs(
    GHSolar_CResults=irrmshy,
    Hive_SurfaceBased=hiveiodistr.HiveIOEnergySystemSurfaceBasedTech,
    Amb_T_carrier=epw_reader.AmbientTemperatureCarrier,
    Return_water_carrier=hiveiodistr.HiveIOEnergySystemsEmitter,
    TimeResolution=panel_2)
python_3 = GhPythonScript(x=solartechsetoutputs)  # -> out, a
# ---------- python_3: Python ----------
__author__ = "Christoph"
__version__ = "2020.07.06"

import rhinoscriptsyntax as rs

import Hive.IO.EnergySystems as ensys

a = x.OutputCarriers[0].AvailableEnergy
# ---------- end python_3 ----------
panel_3 = Panel(solartechsetoutputs)
panel_4 = Panel(python_3.a)
