# Grasshopper definition Hive_Merger_Solar_Test_Hive.gh (Grasshopper 1.0.7)
# plug-ins: HiveIO, solar-tech, sia380Parameters, GHSolar

rooms_standard = RoomsStandard({"1.1 Wohnen Mehrfamilienhaus": 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, "1.2 Wohnen Einfamilienhaus": {"description": "1.2 Wohnen Einfamilienhaus", "Raumlufttemperatur Auslegung Heizen (Winter)": 21.0, "Nettogeschossflaeche": 20.0, "Thermische Gebaeudehuellflaeche": 38.0, "U-Wert Fenster": 1.2, "Waermeeintragsleistung Personen (bei 24.0 deg C, bzw. 70 W)": 1.3999999999999999, "Jaehrliche Vollaststunden der Geraete": 1780.0, "U-Wert opake Bauteile": 0.20000000000000001, "Jaehrliche Vollaststunden der Raumbeleuchtung": 1450.0, "Vollaststunden pro Jahr (Personen)": 4090.0, "Abminderungsfaktor fuer Fensterrahmen": 0.75, "Aussenluft-Volumenstrom durch Infiltration": 0.14999999999999999, "Raumlufttemperatur Auslegung Kuehlung (Sommer)": 26.0, "Glasanteil": 30.0, "Zeitkonstante": 164.0, "Waermeeintragsleistung der Raumbeleuchtung": 2.7000000000000002, "Waermeeintragsleistung der Geraete": 8.0, "Gesamtenergiedurchlassgrad Verglasung": 0.5, "Temperatur-Aenderungsgrad der Waermerueckgewinnung": 0.69999999999999996, "Aussenluft-Volumenstrom (pro NGF)": 0.59999999999999998}, "2.1 Hotelzimmer": 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, "2.2 Empfang, Lobby": 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, "3.1 Einzel-, Gruppenbuero": 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, "3.2 Grossraumbuero": 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, "3.3 Sitzungszimmer": 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, "3.4 Schalterhalle, Empfang": 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, "4.1 Schulzimmer": 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, "4.2 Lehrerzimmer": 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}, selected="1.2 Wohnen Einfamilienhaus")

# ---- group: Pfad zur Wetterdatei (*.epw)
panel = Panel("C:\Users\chwaibel\Documents\GitHub\hive\src\Hive.Core\epw_reader\Zurich.epw")

# ---- group: Boden
mesh = Mesh(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)

# ---- group: Gebäudevolumen
brep = Brep(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)

# ---- group: PV Fläche
srf = Surface(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)

# ---- group: Umgebungsbebauung
mesh_2 = Mesh([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])

# ---- group: Fensterflächen
srf_2 = Surface([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])

# ----
mesh_uv = MeshSurface(Surface=srf, UCount="6", VCount="6", Overhang=True, Equalize=False)
hiveparainemitter = ParametricInputEmitterHive(
    Vorlauf="65",
    Rücklauf="55",
    Capacity="1000",
    InvestmentCost="1000",
    EmbodiedEmissions="1000",
    Name="hi",
    AirEmitter=False,
    Cooling=False)
hive_io_bldg = HiveIOBuilding(ZoneBrepGeometries=brep, WindowsSurfaces=srf_2, SIA2024Room_2=rooms_standard)
hive_io_env = HiveIOEnvironment(EPWPath=panel, ObstaclesGeometry=[mesh, mesh_2])
hiveiosolar = HiveIOSolarTech(Mesh=mesh_uv, EmitterJson=hiveparainemitter)  # -> flatten(HiveIOEnergySystemSurfaceSystem)
hiveiodistr = HiveIODistributor(HiveInputObjects=[hive_io_env, hive_io_bldg, hiveiosolar])  # -> HiveIOBuilding, HiveIOEnvironment, HiveIOEnergySystemSurfaceBasedTech, HiveIOEnergySystemConversionTech, HiveIOEnergySystemsEmitter
hiveiodistrepw = HiveIODistributorEPW(HiveIOEnvironment=hiveiodistr.HiveIOEnvironment)  # -> Filepath, InputCarriers, BioGas, WoodPellets, DistrictHeating, DistrictCooling, GridElectricity, AmbientAirTemp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
distrsolar = HiveIODistributorSolar(
    HiveIOBuilding=hiveiodistr.HiveIOBuilding,
    HiveIOEnergySystemSurfaceBased=hiveiodistr.HiveIOEnergySystemSurfaceBasedTech,
    HiveIOEnvironment=hiveiodistr.HiveIOEnvironment)  # -> EnvironmentMesh, BuildingCentroid, ExternalSurfaces, WindowGeometries, SolarTechMesh, WindowAzimuth, WindowAreas, SolarTechMesh_2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
hiveiodistrsupsys = HiveIODistributorSupplySystem(HiveIOEnergySystemsSurfaceBased=hiveiodistr.HiveIOEnergySystemSurfaceBasedTech)  # -> EfficiencyPV, PVAreas, EfficiencyST, STAreas, ElectricEfficiencyPVT, ThermalEfficiencyPVT, PVTAreas
data = Data(47.377)
data_2 = Data(8.549)
data_3 = Data([0, 0, 0, 0, 0, 0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])
data_4 = Data([0, 0, 0, 0, 0, 0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])

# ----
# PV Ertrag (simuliert)
data_5 = Data([0.8, 0.8, 0.8, 0.8, 0.8, 0.8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])
mesh_3 = Mesh(distrsolar.ExternalSurfaces)
obstobj = ObstacleObject(Mesh=distrsolar.SolarTechMesh_2, Albedo=data_5, SpecCoeff=data_5, ReflType=0, Tolerance=0.01, Name="PV", MT=True)
obstobj_2 = ObstacleObject(
    Mesh=[distrsolar.EnvironmentMesh, mesh_3],
    Albedo=data_5,
    SpecCoeff=data_5,
    ReflType=0,
    Tolerance=0.01,
    Name="PV",
    MT=True)
irrmshy = IrradiationMeshYear(
    AnalysisObjects=obstobj,
    ObstacleObjects=obstobj_2,
    Latitude=data,
    Longitude=data_2,
    Year=2017,
    DNI=data_3,
    DHI=data_4,
    MainSkyRes=1,
    SpecBounces=0,
    DiffIReflSkyRes=0,
    DiffIReflMode=2,
    MT=True)

# ----
# PV / ST in Hive.IO
python = GhPythonScript(x=irrmshy)  # -> out, a
# ---------- python: Python ----------
__author__ = "chwaibel"
__version__ = "2020.08.21"

import rhinoscriptsyntax as rs

a = x.I_hourly
# ---------- end python ----------
python_2 = GhPythonScript(x=hiveiodistr.HiveIOEnergySystemsEmitter)  # -> out, supTemp, retTemp
# ---------- python_2: Python ----------
__author__ = "chwaibel"
__version__ = "2020.08.21"

import rhinoscriptsyntax as rs
supTemp = x.InletCarrier.Temperature
retTemp = x.ReturnCarrier.Temperature

print(x.ReturnCarrier)
# ---------- end python_2 ----------
hivemergersolartech = MergerSolarTechHive(
    I_hourly=python.a,
    SolarTech=hiveiodistr.HiveIOEnergySystemSurfaceBasedTech,
    Air=hiveiodistrepw.AmbientAirTemp,
    SupplyTemp=python_2.supTemp,
    ReturnTemp=python_2.retTemp,
    SimpleMode=Toggle(True))
python_3 = GhPythonScript(x=hivemergersolartech)  # -> out, monthlyCumulativeSolarEnergy, yearly
# ---------- python_3: Python ----------
__author__ = "chwaibel"
__version__ = "2020.08.21"

import rhinoscriptsyntax as rs

print(type(x.OutputCarriers[0].Energy))

monthlyCumulativeSolarEnergy = x.OutputCarriers[0].MonthlyCumulativeEnergy
yearly = x.OutputCarriers[0].Energy
# ---------- end python_3 ----------
panel_2 = Panel(python_3.monthlyCumulativeSolarEnergy)
ma = MassAddition(Input=panel_2)  # -> Result, PartialResults
panel_3 = Panel(ma.Result)

# ----
# PV / ST in Honey-Badger
panel_4 = Panel("yearly")
solartechsetoutputs = SolarTechSetOutputs(
    GHSolar_CResults=irrmshy,
    Hive_SurfaceBased=hiveiodistr.HiveIOEnergySystemSurfaceBasedTech,
    Amb_T_carrier=hiveiodistrepw.AmbientAirTemp,
    Return_water_carrier=hiveiodistr.HiveIOEnergySystemsEmitter,
    TimeResolution=panel_4)
panel_5 = Panel(solartechsetoutputs)

python_4 = GhPythonScript(x=solartechsetoutputs)  # -> out, monthlyCumulativeSolarEnergy, yearly; same code as python_3

panel_6 = Panel(python_4.monthlyCumulativeSolarEnergy)
