# Grasshopper definition EaCS3_E02_Hive_BuildingDemand.gh (Grasshopper 1.0.7)
# plug-ins: HiveIO, Hive.Core.solar, Hive.Core.sia380, GHSolar, Hive.Core.epw_reader

# ---- group: Path to weather file (.epw)
panel = Panel("C:\EnergyPlusV9-1-0\WeatherData\USA_CA_San.Francisco.Intl.AP.724940_TMY3.epw")

# ---- group: static shading
mesh = Mesh(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)

# ---- group: Windows
srf = Surface([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])

# ---- group: refine windows discretisation
panel_2 = Panel("4")
panel_3 = Panel("30")

# ---- group: Ground
mesh_2 = Mesh(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)

# ---- group: Context (City, obstacles, etc.)
mesh_3 = Mesh([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])

# ---- group: Building volume
brep = Brep(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)

# ---- group: Hive model description
hiveinputenvironment = InputEnvironmentHive(EpwPath=panel, ObstacleGeometries=[mesh_2, mesh_3, mesh])
hiveinputbuilding = InputBuildingHive(ZoneGeometry=brep, WindowsSurfaces=srf, SiaRoom="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")

# ----
hivedistributor = MainDistributorHive(HiveInputs=[hiveinputenvironment, hiveinputbuilding])  # -> HiveBuilding, HiveEnvironment, HiveEnergySystemsSurfaceBasedTech, HiveEnergySystemsConversionTech, HiveEnergySystemsEmitter

# ---- group: shading mask rec level
toggle = BooleanToggle(False)
number_slider = Slider(3, range=0..5)
number_slider_2 = Slider(0.113, range=0..2)

# ---- group: sun vector HOY
toggle_2 = BooleanToggle(False)
number_slider_3 = Slider(2680, range=0..8759)

# ---- group: show sunpath
toggle_3 = BooleanToggle(False)

# ---- group: Simulate solar?
toggle_4 = BooleanToggle(False)

# ----
# Distributor
hivedistenvironment = DistributorEnvironmentHive(HiveIOEnvironment=hivedistributor.HiveEnvironment)  # -> Filepath, NaturalGas, BioGas, WoodPellets, DistrictHeating, DistrictCooling, GridElectricity, AmbientAirTemp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
distributorsia = DistributorSIA(BuildingObj=hivedistributor.HiveBuilding)  # -> ZoneAreas, WindowsAreas, ExtSrfAreas, SIA2024json, AllExtSrfAreas, SurfaceType, SUA2024Schedules
distrsolar = HiveIODistributorSolar(
    HiveIOBuilding=hivedistributor.HiveBuilding,
    HiveIOEnergySystemSurfaceBased=hivedistributor.HiveEnergySystemsSurfaceBasedTech,
    HiveIOEnvironment=hivedistributor.HiveEnvironment)  # -> EnvironmentMesh, BuildingCentroid, ExternalSurfaces, WindowGeometries, SolarTechMesh, WindowAzimuth, WindowAreas, SolarTechMesh_2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
nickname = GhDistributorConversionTech(HiveIOEnergySystemConversionTech=hivedistributor.HiveEnergySystemsConversionTech)  # -> HiveIOEnergySystemAirSourceHeatPump, HiveIOEnergySystemChiller, HiveIOEnergySystemsBoiler, HiveIOEnergySystemsCombinedHeatPowert, HiveIOEnergySystemsHeatExchanger, HiveIOEnergySystemsCoolExchanger, HiveIOEnergySystemElectricalSubstation
bool = Boolean(toggle_4)
python = GhPythonScript(x=distrsolar.WindowGeometries, y=bool)  # -> out, a
# ---------- python: Python ----------
__author__ = "chwaibel"
__version__ = "2020.09.09"

import rhinoscriptsyntax as rs

if y:
    a = x
# ---------- end python ----------
epw_reader = EPWReader(Path=hivedistenvironment.Filepath)  # -> Latitude, Longitude, CityCountry, GHI, DNI, DHI, DryBulb, DewPoint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
sia2024room = SIA2024RoomReader(Room=distributorsia.SIA2024json, Area=distributorsia.ZoneAreas)  # -> Τ_h, Θ_i_C, T_h, A_op_m2, A_w_m2, U_op_W_m2K, U_w_W_m2K, V_e_m3_h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
adaptivecomfort = AdaptiveComfort(AirTemperature=epw_reader.DryBulb)  # -> ThermalComfort, Comfort80UpperBound, Comfort80LowerBound, Comfort90UpperBound, Comfort90LowerBound

# ---- group: Upper temperature setpoint (°C)
panel_4 = Panel(adaptivecomfort.Comfort90UpperBound)

# ---- group: Lower temperature setpoint (°C)
panel_5 = Panel(adaptivecomfort.Comfort90LowerBound)

# ---- group: Monthly average dry bulb temperature (°C)
panel_6 = Panel(epw_reader.DryBulbMonthly)

# ---- group: checking windows order
item = ListItem(List=distrsolar.WindowGeometries, Index=Slider(0, range=0..5), Wrap=True)
offset = OffsetSurface(Surface=item, Distance=0.5, Retrim=True)
preview = CustomPreview(Geometry=offset, Shader=ColourSwatch(SwatchColor=RGB(74, 207, 255)))

# ----
graph = QuickGraph([panel_4, panel_5, panel_6], SortOrder=0)

# ---- group: DHI
data = Data(epw_reader.DHI)

# ----
# Shading Mask
dni = Data(epw_reader.DNI)
panel_7 = Panel([epw_reader.Longitude, epw_reader.Latitude])
pt = Point(distrsolar.BuildingCentroid)
skydome = GHSkydome(
    RecursionLevel=number_slider,
    Viewfactors=toggle,
    CumSkyMatrix=Toggle(False),
    SunPath=toggle_3,
    SolarVec=toggle_2,
    HOY=number_slider_3,
    Location=panel_7,
    DNI=dni,
    DHI=data,
    Size=number_slider_2,
    Context=distrsolar.EnvironmentMesh,
    Sp=pt,
    Timezone=epw_reader.Timezone)  # -> Mesh, Vectors, Sunpaths, SunGeo
preview_2 = CustomPreview(Geometry=skydome.Sunpaths, Shader=ColourSwatch(SwatchColor=RGB(0, 0, 0)))

# ----
# Solare Wärmeeinträge (unshaded)
simplepanel = SimplePanel(
    Tilt=distrsolar.SolarTechMesh,
    Azimuth=distrsolar.WindowAzimuth,
    DHI=epw_reader.DHI,
    DNI=epw_reader.DNI,
    Latitude=epw_reader.Latitude,
    Longitude=epw_reader.Longitude,
    Aw=distrsolar.WindowAreas,
    Timezone=epw_reader.Timezone)

# ---- group: min (blue) to max (yellow) irradiation (kWh/m^2)
number_slider_4 = Slider(0, range=0..1000)
number_slider_5 = Slider(1800, range=0..2000)

# ----
# SOLAR SIMULATION
num = Number(number_slider_5)
num_2 = Number(number_slider_4)
mesh_4 = Mesh(distrsolar.ExternalSurfaces)
data_2 = Data([0.8, 0.8, 0.8, 0.8, 0.8, 0.8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])
obstobj = ObstacleObject(
    Mesh=[distrsolar.EnvironmentMesh, mesh_4],
    Albedo=data_2,
    SpecCoeff=data_2,
    ReflType=0,
    Tolerance=0.01,
    Name="PV",
    MT=True)

# ----
# Solare Wärmeeinträge (shaded)
mesh_uv = MeshSurface(Surface=python.a, UCount=panel_2, VCount=panel_3, Overhang=True, Equalize=False)  # -> flatten(Mesh)
mesh_5 = Mesh(mesh_uv)
obstobj_2 = ObstacleObject(Mesh=mesh_5, Albedo=data_2, SpecCoeff=data_2, ReflType=0, Tolerance=0.01, Name="PV", MT=True)
irrmshy = IrradiationMeshYear(
    AnalysisObjects=obstobj_2,
    ObstacleObjects=obstobj,
    Latitude=epw_reader.Latitude,
    Longitude=epw_reader.Longitude,
    Year=2017,
    DNI=epw_reader.DNI,
    DHI=epw_reader.DHI,
    MainSkyRes=1,
    SpecBounces=0,
    DiffIReflSkyRes=0,
    DiffIReflMode=2,
    MT=True,
    Timezone=epw_reader.Timezone)
readresults = ReadResults(Mesh=mesh_5, I=irrmshy, Value=7)  # -> simplify(Results), SP
visumshsol = VisualizeMeshSolar(Mesh=mesh_5, I=irrmshy, Value=0, Min=num_2, Max=num, Clr=0)

# ---- group: min (blue) to max (yellow) irradiation (kWh/m^2) (continued)
mesh_6 = Mesh(visumshsol)

# ---- group: NEW SIA 380 COMPONENT
# DEMAND
toggle_5 = BooleanToggle(False)
sia380 = BuildingDemandSIA380(
    RoomProperties=distributorsia.SIA2024json,
    RoomSchedules=distributorsia.SUA2024Schedules,
    FloorArea=distributorsia.ZoneAreas,
    AirTemperature=epw_reader.DryBulb,
    SetpointsUpperBounds=adaptivecomfort.Comfort90UpperBound,
    SetpointsLowerBounds=adaptivecomfort.Comfort90LowerBound,
    EnvelopeSurfaceAreas=distributorsia.AllExtSrfAreas,
    EnvelopeSurfaceTypes=distributorsia.SurfaceType,
    SurfaceIrradiation=readresults.Results,
    SurfaceIrradiationUnobstructed=simplepanel,
    GValue=sia2024room.G_,
    GValueWithSunscreen=sia2024room.G_total_,
    SetpointSunscreen=sia2024room.G_T_W_m_2,
    RunObstructedSolarSimulation=bool,
    RunHourly=toggle_5)  # -> HeatingDemand, CoolingDemand, ElectricityDemand, TransmissionHeatLosses, VentilationHeatLosses, InternalGains, SolarGains, TransmissionHeatLossesOfOpaqueSurfaces, TransmissionHeatLossesOfTransparentSurfaces, SolarGainsPerTransparentSurface
abs = Absolute(Value=sia380.CoolingDemand)

# ----
# Purchased Grid Electricity
python_2 = GhPythonScript(siaElec=sia380.ElectricityDemand)  # -> out, additionalElec; inputs siaElec: list
# ---------- python_2: Python ----------
__author__ = "Christoph"
__version__ = "2020.09.13"

import rhinoscriptsyntax as rs
if chiller != None and ashp != None:
    additionalElec = [a+b+c for a,b,c in zip(chiller.InputCarrier.MonthlyCumulativeEnergy, ashp.InputCarrier.MonthlyCumulativeEnergy, siaElec)]
elif ashp != None and chiller is None:
    additionalElec = [a+b for a,b in zip(ashp.InputCarrier.MonthlyCumulativeEnergy, siaElec)]
elif ashp is None and chiller != None:
    additionalElec = [a+b for a,b in zip(chiller.InputCarrier.MonthlyCumulativeEnergy, siaElec)]
else:
    additionalElec = siaElec
# ---------- end python_2 ----------
python_3 = GhPythonScript(elecDemandIn=python_2.additionalElec, heatDemandIn=sia380.HeatingDemand)  # -> out, flatten(elecDemandOut), heatDemandOut; inputs elecDemandIn: list, heatDemandIn: list
# ---------- python_3: Python ----------
__author__ = "Christoph"
__version__ = "2020.09.13"

import rhinoscriptsyntax as rs
import Hive.IO.EnergySystems
if(pvOrSt != None):
    energyRenewable = pvOrSt.OutputCarriers[0].MonthlyCumulativeEnergy

if(type(pvOrSt) == Hive.IO.EnergySystems.Photovoltaic):
    elecDemandOut = [x - y for x, y in zip(elecDemandIn, energyRenewable)]
    heatDemandOut = heatDemandIn
elif(type(pvOrSt) == Hive.IO.EnergySystems.SolarThermal):
    heatDemandOut = [x - y for x, y in zip(heatDemandIn, energyRenewable)] 
    elecDemandOut = elecDemandIn
else:
    heatDemandOut = heatDemandIn
    elecDemandOut = elecDemandIn
# ---------- end python_3 ----------
hivemergersubstation = MergerElectricalSubstationHive(
    GridElectricity=hivedistenvironment.GridElectricity,
    ElecPurchased=python_3.elecDemandOut,
    ElectricalSubstation=nickname.HiveIOEnergySystemElectricalSubstation)

# ----
# Results
hiveresults = ResultsHive(
    CoolingMonthly=abs,
    HeatingMonthly=python_3.heatDemandOut,
    ElectricityMonthly=python_3.elecDemandOut,
    HiveBuilding=hivedistributor.HiveBuilding,
    HiveConversionTech=flatten(hivemergersubstation),
    Q_T_opaque=sia380.TransmissionHeatLossesOfOpaqueSurfaces,
    Q_T_transparent=sia380.TransmissionHeatLossesOfTransparentSurfaces,
    Q_V=sia380.VentilationHeatLosses,
    Q_i=sia380.InternalGains,
    Q_s=sia380.SolarGains,
    ConsumedElec=python_2.additionalElec,
    ConsumedHeat=sia380.HeatingDemand,
    Q_s_per_win=sia380.SolarGainsPerTransparentSurface)
python_4 = GhPythonScript(hiveResults=hiveresults)  # -> out, a, heatingLoads, coolingLoads, electricityLoads, windowSolarGains, gainsAndLosses
# ---------- python_4: Python ----------
__author__ = "chwaibel"
__version__ = "2020.09.23"

x = hiveResults

import rhinoscriptsyntax as rs

heatingLoads = x.TotalFinalHeatingMonthly
coolingLoads = x.TotalFinalCoolingMonthly
electricityLoads = x.TotalFinalElectricityMonthly
windowSolarGains = [] 
for j in range(len(x.MonthlySolarGainsPerWindow)):
    window = x.MonthlySolarGainsPerWindow[j]
    for i in range(len(window)):
        if i==0:
            windowSolarGains.append("______")
            windowSolarGains.append("window " + str(j))
        windowSolarGains.append(window[i])
        

gainsAndLosses = []
gainsAndLossesDict = \
{"SolarGains: ": x.TotalSolarGains, \
"InternalGains: ": x.TotalInternalGains, \
"PrimaryEnergy: ": sum(x.TotalPrimaryEnergyMonthlyNonRenewable), \
"VentilationHeatGains: ": x.TotalVentilationHeatGains, \
"EnvelopeHeatGains: ": x.TotalOpaqueTransmissionHeatGains, \
"WindowHeatGains: ": x.TotalWindowTransmissionHeatGains, \
"ElectricityDemand: ": sum(x.TotalConsumedElectricityMonthly), \
"VentilationHeatLosses: ": x.TotalVentilationHeatLosses, \
"EnvelopeHeatLosses: ": x.TotalOpaqueTransmissionHeatLosses, \
"WindowHeatLosses: ": x.TotalWindowTransmissionHeatLosses, \
"SystemConversionLosses: ": x.TotalSystemLosses}

for k, v in gainsAndLossesDict.iteritems():
    gainsAndLosses.append(k + str(v))
# ---------- end python_4 ----------

hive_io_visualizer = HiveIOVisualizer(
    hiveresults,
    PlotProperties="""{
  "$type": "System.Collections.Generic.Dictionary`2[[System.String, mscorlib],[System.String, mscorlib]], mscorlib"
}""")

# ---- group: Zone Gains and Losses
panel_8 = Panel(python_4.gainsAndLosses)

# ---- group: Heating Loads
panel_9 = Panel(python_4.heatingLoads)

# ---- group: Cooling Loads
panel_10 = Panel(python_4.coolingLoads)

# ---- group: Windows Solar Gains
panel_11 = Panel(python_4.windowSolarGains)

# ---- group: Electricity Loads
panel_12 = Panel(python_4.electricityLoads)

# ---- group: Hive Results
data_3 = Data(hiveresults)

# ---- group: internalise data to store results
hiveresults_2 = HiveResultsParameter(data_3)
