# Grasshopper definition EaCS3_E02_Hive_SolarUnobstructed.gh (Grasshopper 1.0.7)
# plug-ins: solar, GHSolar, epw-reader

# ---- group: surface orientation
number_slider = Slider(33.169, range=0..90)
number_slider_2 = Slider(108.001, range=0..360)

# ---- group: Path to weather file (.epw)
panel = Panel("C:\EnergyPlusV9-3-0\WeatherData\USA_CA_San.Francisco.Intl.AP.724940_TMY3.epw")

# ---- group: Sky view factor
toggle = BooleanToggle(True)
number_slider_3 = Slider(2, range=0..5)
number_slider_4 = Slider(0.25, range=0..1)

# ---- group: Sky view factor / Context (City, obstacles, etc.)
mesh = Mesh([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])

# ---- group: Sky view factor / analysis point
pt = Point(Point(21.71647424, -7.258711689, 0))

# ----
# Ladybug Sunpath
ladybug = Ladybug_Ladybug()  # -> Vviiiiiiiiiizzz; disabled; plug-in component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
importepw = Ladybug_ImportEpw(epwFile=panel)  # -> readMe, latitude, location, dryBulbTemperature, dewPointTemperature, relativeHumidity, windSpeed, windDirection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; disabled; plug-in component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
number_slider_5 = Slider(0.05, range=0..1)  # disabled
panel_2 = Panel("24")  # disabled
panel_3 = Panel("1")  # disabled
panel_4 = Panel("12")  # disabled
panel_5 = Panel("365")  # disabled
analysisperiod = Ladybug_AnalysisPeriod(fromMonth=panel_3, fromDay=panel_3, fromHour=panel_3, toMonth=panel_4, toDay=panel_5, toHour=panel_2)  # -> readMe, analysisPeriod; disabled; plug-in component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
sunpath = Ladybug_SunPath(
    location=importepw.location,
    hour=12,
    day=21,
    month=12,
    timeStep=1,
    analysisPeriod=analysisperiod.analysisPeriod,
    sunPathScale=number_slider_5,
    sunScale=number_slider_5,
    dailyOrAnnualSunPath=True)  # -> readMe, sunVectors, sunAltitudes, sunAzimuths, port, sunSpheresMesh, sunPathCrvs, compassCrvs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; disabled; plug-in component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
swatch = ColourSwatch(SwatchColor=RGB(0, 0, 0))  # disabled
preview = CustomPreview(Geometry=[sunpath.sunPathCrvs, sunpath.compassCrvs], Shader=swatch)  # disabled

# ----
# Sunpath and unobstructred surface insolation
epw_reader = EPWReader(Path=panel)  # -> Latitude, Longitude, CityCountry, GHI, DNI, DHI, DryBulb, DewPoint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
skydome = GHSkydome(
    RecursionLevel=number_slider_3,
    Viewfactors=toggle,
    SolarVec=False,
    HOY=0,
    Location=[epw_reader.Longitude, epw_reader.Latitude],
    DNI=epw_reader.DNI,
    DHI=epw_reader.DHI,
    Size=number_slider_4,
    Context=mesh,
    Sp=pt,
    Timezone=epw_reader.Timezone)  # -> Mesh, Vectors, Sunpaths, SunGeo
simplepanel = SimplePanel(
    Tilt=number_slider,
    Azimuth=number_slider_2,
    DHI=epw_reader.DHI,
    DNI=epw_reader.DNI,
    Latitude=epw_reader.Latitude,
    Longitude=epw_reader.Longitude,
    Timezone=epw_reader.Timezone)
panel_6 = Panel(simplepanel)
crv = Curve(skydome.Sunpaths)
graph = QuickGraph(simplepanel, SortOrder=0)
