# Grasshopper definition EaCS3_E04_Hive_Template_Parametric.gh (Grasshopper 1.0.7)
# plug-ins: HiveIO, Hive.Core.solar, Hive.Core.sia380, Hive.Core.sia380Parameters, GHSolar, Hive.Core.epw_reader

# ----
# Building
number_slider = Slider(0.25, range=0..1)
list = ValueList({"1.2 Wohnen Einfamilienhaus"}, selected="1.2 Wohnen Einfamilienhaus")
rooms_existing = RoomsExisting({"1.1 Wohnen Mehrfamilienhaus": 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, "1.2 Wohnen Einfamilienhaus": {"description": "1.2 Wohnen Einfamilienhaus", "Raumlufttemperatur Auslegung Heizen (Winter)": 21.0, "Nettogeschossflaeche": 20.0, "Thermische Gebaeudehuellflaeche": 38.0, "U-Wert Fenster": 1.5, "Waermeeintragsleistung Personen (bei 24.0 deg C, bzw. 70 W)": 1.3999999999999999, "Jaehrliche Vollaststunden der Geraete": 1780.0, "U-Wert opake Bauteile": 0.80000000000000004, "Jaehrliche Vollaststunden der Raumbeleuchtung": 1450.0, "Vollaststunden pro Jahr (Personen)": 4090.0, "Abminderungsfaktor fuer Fensterrahmen": 0.75, "Aussenluft-Volumenstrom durch Infiltration": 0.29999999999999999, "Raumlufttemperatur Auslegung Kuehlung (Sommer)": 26.0, "Glasanteil": 30.0, "Zeitkonstante": 56.0, "Waermeeintragsleistung der Raumbeleuchtung": 2.7000000000000002, "Waermeeintragsleistung der Geraete": 10.0, "Gesamtenergiedurchlassgrad Verglasung": 0.65000000000000002, "Temperatur-Aenderungsgrad der Waermerueckgewinnung": NaN, "Aussenluft-Volumenstrom (pro NGF)": 0.59999999999999998}, "2.1 Hotelzimmer": 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, "2.2 Empfang, Lobby": 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, "3.1 Einzel-, Gruppenbuero": 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, "3.2 Grossraumbuero": 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, "3.3 Sitzungszimmer": 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, "3.4 Schalterhalle, Empfang": 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, "4.1 Schulzimmer": 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, "4.2 Lehrerzimmer": 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}, selected="1.2 Wohnen Einfamilienhaus")
srf = Surface([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])
brep = Brep(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)
hiveparainroom = ParametricInputSIARoomHive(
    Description=list,
    RoomConstant=Slider(50, range=50..300),
    CoolingSetpoint=Slider(26, range=16..30),
    HeatingSetpoint=Slider(21, range=16..30),
    FloorArea=Slider(0.25, range=0..1),
    EnvelopeArea=Slider(0.25, range=0..1),
    GlazingRatio=Slider(0.25, range=0..1),
    UValueOpaque=Slider(0.25, range=0..1),
    UValueTransparent=Slider(0.387, range=0..1),
    GValue=Slider(0.25, range=0..1),
    GValueTotal=Slider(0.25, range=0..1),
    ShadingSetpoint=number_slider,
    WindowFrameReduction=Slider(0.25, range=0..1),
    AirChangeRate=Slider(0.25, range=0..1),
    Infiltration=Slider(0.356, range=0..1),
    HeatRecovery=Slider(0.25, range=0..1),
    OccupantLoads=Slider(0.25, range=0..1),
    LightingLoads=Slider(0.25, range=0..1),
    EquipmentLoads=Slider(0.25, range=0..1),
    OccupantYearlyHours=Slider(0.25, range=0..1),
    LightingYearlyHours=Slider(0.25, range=0..1),
    EquipmentYearlyHours=Slider(0.197, range=0..1),
    OpaqueCost=Slider(0.342, range=0..1),
    TransparentCost=Slider(0.202, range=0..1),
    OpaqueEmissions=Slider(0.288, range=0..1),
    TransparentEmissions=Slider(0.527, range=0..1),
    TransparentEmissions_2=Slider(0.527, range=0..1))
hiveinputbuilding = InputBuildingHive(ZoneGeometry=brep, WindowsSurfaces=srf, SIA2024Room=hiveparainroom)
python = GhPythonScript(x=hiveinputbuilding)  # -> out, a
# ---------- python: Python ----------
__author__ = "Christoph"
__version__ = "2020.11.10"

import rhinoscriptsyntax as rs

r = x.SIA2024
print("RoomType: ", r.RoomType)
print("RoomConstant: ", r.RoomConstant)
print("CoolingSetpoint: ", r.CoolingSetpoint)
print("HeatingSetpoint: ", r.HeatingSetpoint)
print("FloorArea: ", r.FloorArea)
print("EnvelopeArea: ", r.EnvelopeArea)
print("GlazingRatio: ", r.GlazingRatio)
print("UValueOpaque: ", r.UValueOpaque)
print("UValueTransparent: ", r.UValueTransparent)
print("GValue: ", r.GValue)
print("GValueTotal: ", r.GValueTotal)
print("ShadingSetpoint: ", r.ShadingSetpoint)
print("WindowFrameReduction: ", r.WindowFrameReduction)
print("AirChangeRate: ", r.AirChangeRate)
print("Infiltration: ", r.Infiltration)
print("HeatRecovery: ", r.HeatRecovery)
print("OccupantLoads: ", r.OccupantLoads)
print("LightingLoads: ", r.LightingLoads)
print("EquipmentLoads: ", r.EquipmentLoads)
print("OccupantYearlyHours: ", r.OccupantYearlyHours)
print("LightingYearlyHours: ", r.LightingYearlyHours)
print("EquipmentYearlyHours: ", r.EquipmentYearlyHours)
print("OpaqueCost: ", r.OpaqueCost)
print("TransparentCost: ", r.TransparentCost)
print("OpaqueEmissions: ", r.OpaqueEmissions)
print("TransparentEmissions: ", r.TransparentEmissions)
# ---------- end python ----------
panel = Panel(python.out)

# ----
# Environment
panel_2 = Panel("UCT-Mix")
python_2 = GhPythonScript()  # -> out, a
# ---------- python_2: Python ----------
__author__ = "chwaibel"
__version__ = "2020.08.19"

import rhinoscriptsyntax as rs

a = [0.1] * 8760
# ---------- end python_2 ----------
panel_3 = Panel("C:\Users\chwaibel\Documents\GitHub\hive\GrasshopperExamples\LectureExercises\HIVE_Zurich.epw")
hiveparainpotentials = ParametricInputEnergyPotantialsHive(
    NaturalGasName="gazprom",
    NaturalGasPrice=python_2.a,
    NaturalGasEmissions=python_2.a,
    NaturalGasAvailability=python_2.a,
    BioGasName="Altstetten-Biogas",
    BioGasPrice=python_2.a,
    BioGasEmissions=python_2.a,
    BioGasAvailability=python_2.a,
    WoodPelletsName="ZuriWald",
    WoodPelletsPrice=python_2.a,
    WoodPelletsEmissions=python_2.a,
    WoodPelletsAvailability=python_2.a,
    DistrictHeatingName="Schwamendingen",
    DistrictHeatingPrice=python_2.a,
    DistrictHeatingEmissions=python_2.a,
    DistrictHeatingAvailability=python_2.a,
    DistrictHeatingSupplyTemp=python_2.a,
    DistrictCoolingName="Zurilake",
    DistrictCoolingPrice=python_2.a,
    DistrictCoolingEmissions=python_2.a,
    DistrictCoolingAvailability=python_2.a,
    DistrictCoolingSupplyTemp=python_2.a,
    GridElectricityName=panel_2,
    GridElectricityPrice=python_2.a,
    GridElectricityEmissions=python_2.a,
    GridElectricityAvailability=python_2.a)
mesh = Mesh(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)
hiveinputenvironment = InputEnvironmentHive(EpwPath=panel_3, ObstacleGeometries=mesh, Potentials=hiveparainpotentials)
python_3 = GhPythonScript(x=hiveinputenvironment)  # -> out, a
# ---------- python_3: Python ----------
__author__ = "Christoph"
__version__ = "2020.11.10"

import rhinoscriptsyntax as rs
import Hive.IO.Misc as misc

for carrier in x.EnergyPotentials:
    print("")
    print(type(carrier))
    print("Gas Name: ", carrier.Name)
    print("Unit: ", carrier.Unit)
    print("Horizon: ", carrier.Horizon)
    print("MonthlyCumulativeEnergy: ", carrier.EnergyMonthlyCumulative)
    print("MonthlyAverageHourlyPrice: ", misc.GetAverageMonthlyValue(carrier.SpecificCost))
    print("MonthlyAverageHourlyEmissions: ", misc.GetAverageMonthlyValue(carrier.SpecificEmissions))
    print("PEF: ", carrier.PrimaryEnergyFactor)
    print("MonthlyAverageTemperature: ", carrier.TemperatureMonthly)
# ---------- end python_3 ----------
panel_4 = Panel(python_3.out)

# ---- group: this solar tech needs to be defined in the Form!
mesh_2 = Mesh(graft(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))

# ----
run_hive = BooleanToggle(True)

# ---- group: shading mask rec level
toggle = BooleanToggle(False)
number_slider_2 = Slider(3, range=0..5)
number_slider_3 = Slider(0.113, range=0..2)

# ---- group: sun vector HOY
toggle_2 = BooleanToggle(False)
number_slider_4 = Slider(2680, range=0..8759)

# ---- group: show sunpath
toggle_3 = BooleanToggle(False)

# ---- group: Simulate solar?
toggle_4 = BooleanToggle(False)

# ---- group: min (blue) to max (yellow) irradiation (kWh/m^2)
number_slider_5 = Slider(0, range=0..1000)
number_slider_6 = Slider(930.703, range=0..2000)

# ---- group: hourly demand?
toggle_5 = BooleanToggle(False)

# ---- group: Simple efficiency calculations?
toggle_6 = BooleanToggle(False)

# ----
# EnergySystems
number_slider_7 = Slider(20.223, range=10..25)
number_slider_8 = Slider(36.007, range=35..65)
number_slider_9 = Slider(0.3, range=0..100)
number_slider_10 = Slider(0.25, range=0..100)
number_slider_11 = Slider(0.25, range=0..100)
number_slider_12 = Slider(22.871, range=0..100)
addition = Addition(A=number_slider_7, B="5")
subtraction = Subtraction(A=number_slider_8, B="10")
number_slider_13 = Slider(0, range=0..100)
number_slider_14 = Slider(0.25, range=0..100)
panel_5 = Panel(subtraction)
panel_6 = Panel(number_slider_8)
panel_7 = Panel(number_slider_7)
panel_8 = Panel(addition)
panel_9 = Panel(Slider(0.3, range=0.01..0.3))
mesh_3 = Mesh(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)
mesh_4 = Mesh(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)
nickname = GhParametricInputEnergySystems(
    ASHPCapacity=number_slider_14,
    ASHPCost=number_slider_14,
    ASHPEmissions=number_slider_14,
    ASHPCOP=number_slider_14,
    NGBoilerCapacity=number_slider_13,
    NGBoilerCost=number_slider_13,
    NGBoilerEmissions=number_slider_13,
    NGBoilerEfficiency=number_slider_13,
    CHPCapacity=number_slider_12,
    CHPCost=number_slider_12,
    CHPEmissions=number_slider_12,
    CHPHTP=number_slider_12,
    CHPEffElec=number_slider_12,
    ChillerCapacity=number_slider_9,
    ChillerCost=number_slider_9,
    ChillerEmissions=number_slider_9,
    ChillerCOP=number_slider_9,
    HeatExchangerCapacity=number_slider_11,
    HeatExchangerCost=number_slider_11,
    HeatExchangerEmissions=number_slider_11,
    HeatExchangerLosses=number_slider_11,
    CoolExchangerCapacity=number_slider_10,
    CoolExchangerCost=number_slider_10,
    CoolExchangerEmissions=number_slider_10,
    CoolExchangerLosses=number_slider_10)
emitterinputs = HiveIOEnergySystemsEmitter(
    Vorlauf=panel_6,
    Rücklauf=panel_5,
    Capacity="1.0",
    InvestmentCost="200",
    EmbodiedEmissions="50",
    Name="Heater",
    AirEmitter=False,
    Cooling=False)
emitterinputs_2 = HiveIOEnergySystemsEmitter(
    Vorlauf=panel_7,
    Rücklauf=panel_8,
    Capacity="1.0",
    InvestmentCost="200",
    EmbodiedEmissions="50",
    Name="Cooler",
    AirEmitter="true",
    Cooling="true")
hiveparainsolartech = ParametricInputSolarTechHive(
    Mesh=mesh_4,
    Type="PV",
    Technology="A/S wow tech",
    EfficiencyElectric=panel_9,
    EfficiencyThermal="0.0",
    InvestmentCost="3000",
    EmbodiedEmissions="200",
    InvestmentCost_2="1000",
    EmbodiedEmissions_2="1000")

hiveparainsolartech_2 = ParametricInputSolarTechHive(
    Mesh=mesh_3,
    Type="ST",
    Technology="NanoBorgTech",
    EfficiencyElectric="0.0",
    EfficiencyThermal="0.2",
    InvestmentCost="2500",
    EmbodiedEmissions="150",
    InvestmentCost_2="1000",
    EmbodiedEmissions_2="1000")

hiveinputenergysystems = InputEnergySystemsHive(
    MeshSolarTechnologyProperties=[mesh_2, hiveparainsolartech_2, hiveparainsolartech],
    ConversionTechnologyProperties=nickname,
    EmitterProperties=[emitterinputs, emitterinputs_2],
    conversions="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",
    emitters="""{
  "$type": "Hive.IO.Forms.EmitterPropertiesViewModel[], Hive.IO",
  "$values": []
}""",
    meshConnections="""{
  "$type": "System.Collections.Generic.Dictionary`2[[System.Int32, mscorlib],[System.Int32, mscorlib]], mscorlib",
  "0": 0
}""",
    meshes="""{
  "$type": "Hive.IO.Forms.SurfaceViewModel[], Hive.IO",
  "$values": [
    {
      "$type": "Hive.IO.Forms.SurfaceViewModel, Hive.IO",
      "Name": "srf0",
      "Area": 23.465697270459675
    }
  ]
}""")
panel_10 = Panel(hiveinputenergysystems)
python_4 = GhPythonScript(x=hiveinputenergysystems)  # -> out, a; inputs x: list
# ---------- python_4: Python ----------
__author__ = "chwaibel"
__version__ = "2020.08.11"

import rhinoscriptsyntax as rs

for tech in x:
    print(type(tech))
    print("Name: ", tech.Name)
    print("Capacity: ", tech.Capacity)
    print("CapacityUnit: ", tech.CapacityUnit)
# ---------- end python_4 ----------
python_5 = GhPythonScript(x=hiveinputenergysystems)  # -> out, a
# ---------- python_5: Python ----------
__author__ = "chwaibel"
__version__ = "2020.08.11"

import rhinoscriptsyntax as rs

a= x.SpecificInvestmentCost
# ---------- end python_5 ----------
panel_11 = Panel(python_5.a)

python_6 = GhPythonScript(tech=hiveinputenergysystems)  # -> out, a
# ---------- python_6: Python ----------
__author__ = "chwaibel"
__version__ = "2020.08.11"

import rhinoscriptsyntax as rs
import Hive.IO.EnergySystems as hive
import Hive.IO.Misc as misc

print(type(tech))
print("Name: ", tech.Name)
print("Capacity: ", tech.Capacity)
print("CapacityUnit: ", tech.CapacityUnit)
if type(tech)==hive.Photovoltaic:
    print("detailedName: ", tech.DetailedName)
    print("Efficiency: ", tech.RefEfficiencyElectric)
    print("area: ", tech.SurfaceArea)
if type(tech) == hive.SolarThermal:
    print("detailedName: ", tech.DetailedName)
    print("Efficiency: ", tech.RefEfficiencyHeating)
if type(tech) == hive.GasBoiler:
    print("detailedName: ", tech.DetailedName)
    print("Efficiency: ", tech.Efficiency)
if type(tech) == hive.Radiator or type(tech) == hive.AirDiffuser:
    print("Supply Temp: ", misc.GetAverageMonthlyValue(tech.InletCarrier.Temperature))
    print("Return Temp: ", misc.GetAverageMonthlyValue(tech.ReturnCarrier.Temperature))
    print("cooling?: ", tech.IsCooling)
    print("heating?: ", tech.IsHeating)

print("spec cost: ", tech.SpecificInvestmentCost)
print("tot COst: ", tech.SpecificInvestmentCost * tech.Capacity)
# ---------- end python_6 ----------
panel_12 = Panel(python_4.out)

panel_13 = Panel(python_6.out)

hivedistributor = MainDistributorHive(HiveInputs=flatten([run_hive, hiveinputenvironment, hiveinputbuilding, hiveinputenergysystems]))  # -> HiveBuilding, HiveEnvironment, HiveEnergySystemsSurfaceBasedTech, HiveEnergySystemsConversionTech, HiveEnergySystemsEmitter

# ----
# Distributor
hivedistemitter = DistributorEmitterHive(Emitters=hivedistributor.HiveEnergySystemsEmitter)  # -> HourlyHtgSupTemp, HourlyHtgRetTemp, HourlyClgSupTemp, HourlyClgRetTemp
hivedistsolarsimu = DistributorSolarSimulationHive(
    HiveBuilding=hivedistributor.HiveBuilding,
    HiveSolarTechnologies=hivedistributor.HiveEnergySystemsSurfaceBasedTech,
    HiveEnvironment=hivedistributor.HiveEnvironment)  # -> EnvironmentMesh, BuildingCentroid, ExternalSurfaces, WindowGeometries, WindowTilt, WindowAzimuth, WindowAreas, SolarTechMesh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
hivedistconversiontech = DistributorConversionTechHive(ConversionTechnologies=hivedistributor.HiveEnergySystemsConversionTech)  # -> AirSourceHeatPump, Chiller, Boiler, CombinedHeatAndPower, HeatExchanger, ColdExchanger, DirectElectricity
hivedistsiaroom = DistributorSIARoomHive(HiveBuilding=hivedistributor.HiveBuilding)  # -> ZoneAreas, WindowsAreas, ExternalSurfacesAreas, SIA2024Room, AllExternalSurfaceAreas, SurfaceType, SUA2024Schedules, UseAdaptiveComfort, UseNaturalVentilation, UseFixedTimeConstant
hivedistenvironment = DistributorEnvironmentHive(HiveEnvironment=hivedistributor.HiveEnvironment)  # -> Filepath, NaturalGas, BioGas, WoodPellets, DistrictHeating, DistrictCooling, GridElectricity, AmbientAirTemp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
bool = Boolean(toggle_4)
python_7 = GhPythonScript(x=hivedistsolarsimu.WindowGeometries, y=bool)  # -> out, a
# ---------- python_7: Python ----------
__author__ = "chwaibel"
__version__ = "2020.09.09"

import rhinoscriptsyntax as rs

if y:
    a = x
# ---------- end python_7 ----------
python_8 = GhPythonScript(x=hivedistsolarsimu.SolarTechMesh, y=toggle_4)  # -> out, a; same code as python_7
epw_reader = EPWReader(Path=hivedistenvironment.Filepath)  # -> Latitude, Longitude, CityCountry, GHI, DNI, DHI, DryBulb, DewPoint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
sia2024room = SIA2024RoomReader(Room=hivedistsiaroom.SIA2024Room, Area=hivedistsiaroom.ZoneAreas)  # -> Τ_h, Θ_i_C, T_h, A_op_m2, A_w_m2, U_op_W_m2K, U_w_W_m2K, V_e_m3_h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
adaptivecomfort = AdaptiveComfort(AirTemperature=epw_reader.DryBulb)  # -> ThermalComfort, Comfort80UpperBound, Comfort80LowerBound, Comfort90UpperBound, Comfort90LowerBound

# ---- group: Upper temperature setpoint (°C)
panel_14 = Panel(adaptivecomfort.Comfort80UpperBound)

# ---- group: Lower temperature setpoint (°C)
panel_15 = Panel(adaptivecomfort.Comfort80LowerBound)

# ---- group: Monthly average dry bulb temperature (°C)
panel_16 = Panel(epw_reader.DryBulbMonthly)

# ---- group: checking windows order
item = ListItem(List=hivedistsolarsimu.WindowGeometries, Index=Slider(0, range=0..5), Wrap=True)
offset = OffsetSurface(Surface=item, Distance=0.5, Retrim=True)
preview = CustomPreview(Geometry=offset, Shader=ColourSwatch(SwatchColor=RGB(74, 207, 255)))

# ----
graph = QuickGraph([panel_14, panel_15, panel_16], SortOrder=0)

# ---- group: DHI
data = Data(epw_reader.DHI)

# ----
# Shading Mask
dni = Data(epw_reader.DNI)
panel_17 = Panel([epw_reader.Longitude, epw_reader.Latitude])
pt = Point(hivedistsolarsimu.BuildingCentroid)
skydome = GHSkydome(
    RecursionLevel=number_slider_2,
    Viewfactors=toggle,
    CumSkyMatrix=Toggle(False),
    SunPath=toggle_3,
    SolarVec=toggle_2,
    HOY=number_slider_4,
    Location=panel_17,
    DNI=dni,
    DHI=data,
    Size=number_slider_3,
    Context=hivedistsolarsimu.EnvironmentMesh,
    Sp=pt,
    Timezone=epw_reader.Timezone)  # -> Mesh, Vectors, Sunpaths, SunGeo
preview_2 = CustomPreview(Geometry=skydome.Sunpaths, Shader=ColourSwatch(SwatchColor=RGB(0, 0, 0)))

# ----
# SOLAR SIMULATION
num = Number(number_slider_6)
num_2 = Number(number_slider_5)
mesh_5 = Mesh(hivedistsolarsimu.ExternalSurfaces)
data_2 = Data([0.8, 0.8, 0.8, 0.8, 0.8, 0.8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])
obstobj = ObstacleObject(
    Mesh=[hivedistsolarsimu.EnvironmentMesh, mesh_5],
    Albedo=data_2,
    SpecCoeff=data_2,
    ReflType=0,
    Tolerance=0.01,
    Name="PV",
    MT=True)

# ----
# Solare Wärmeeinträge (shaded)
mesh_uv = MeshSurface(Surface=python_7.a, UCount=4, VCount=4, Overhang=True, Equalize=False)  # -> flatten(Mesh)
mesh_6 = Mesh(mesh_uv)
obstobj_2 = ObstacleObject(Mesh=mesh_6, Albedo=data_2, SpecCoeff=data_2, ReflType=0, Tolerance=0.01, Name="PV", MT=True)
irrmshy = IrradiationMeshYear(
    AnalysisObjects=obstobj_2,
    ObstacleObjects=obstobj,
    Latitude=epw_reader.Latitude,
    Longitude=epw_reader.Longitude,
    Year=2017,
    DNI=epw_reader.DNI,
    DHI=epw_reader.DHI,
    MainSkyRes=1,
    SpecBounces=0,
    DiffIReflSkyRes=0,
    DiffIReflMode=2,
    MT=True,
    Timezone=epw_reader.Timezone)
readresults = ReadResults(Mesh=mesh_6, I=irrmshy, Value=7)  # -> simplify(Results), SP
visumshsol = VisualizeMeshSolar(Mesh=mesh_6, I=irrmshy, Value=0, Min=num_2, Max=num, Clr=0)

# ---- group: Windows
mesh_7 = Mesh(visumshsol)

# ----
# Solare Wärmeeinträge (unshaded)
simplepanel = SimplePanel(
    Tilt=hivedistsolarsimu.WindowTilt,
    Azimuth=hivedistsolarsimu.WindowAzimuth,
    DHI=epw_reader.DHI,
    DNI=epw_reader.DNI,
    Latitude=epw_reader.Latitude,
    Longitude=epw_reader.Longitude,
    Aw=hivedistsolarsimu.WindowAreas,
    Timezone=epw_reader.Timezone)

# ----
# PV Ertrag (simuliert)
obstobj_3 = ObstacleObject(Mesh=python_8.a, Albedo=data_2, SpecCoeff=data_2, ReflType=0, Tolerance=0.01, Name="PV", MT=True)
irrmshy_2 = IrradiationMeshYear(
    AnalysisObjects=obstobj_3,
    ObstacleObjects=obstobj,
    Latitude=epw_reader.Latitude,
    Longitude=epw_reader.Longitude,
    Year=2017,
    DNI=epw_reader.DNI,
    DHI=epw_reader.DHI,
    MainSkyRes=1,
    SpecBounces=0,
    DiffIReflSkyRes=0,
    DiffIReflMode=2,
    MT=True,
    Timezone=0)
visumshsol_2 = VisualizeMeshSolar(Mesh=hivedistsolarsimu.SolarTechMesh, I=irrmshy_2, Value=0, Min=num_2, Max=num)

# ---- group: PV Panels
mesh_8 = Mesh(visumshsol_2)

# ---- group: NEW SIA 380 COMPONENT
# DEMAND
sia380 = BuildingDemandSIA380(
    RoomProperties=hivedistsiaroom.SIA2024Room,
    RoomSchedules=hivedistsiaroom.SUA2024Schedules,
    FloorArea=hivedistsiaroom.ZoneAreas,
    AirTemperature=epw_reader.DryBulb,
    SetpointsUpperBounds=adaptivecomfort.Comfort80UpperBound,
    SetpointsLowerBounds=adaptivecomfort.Comfort80LowerBound,
    EnvelopeSurfaceAreas=hivedistsiaroom.AllExternalSurfaceAreas,
    EnvelopeSurfaceTypes=hivedistsiaroom.SurfaceType,
    SurfaceIrradiation=readresults.Results,
    SurfaceIrradiationUnobstructed=simplepanel,
    GValue=sia2024room.G_,
    GValueWithSunscreen=sia2024room.G_total_,
    SetpointSunscreen=sia2024room.G_T_W_m_2,
    RunObstructedSolarSimulation=bool,
    RunHourly=toggle_5,
    UseAdaptiveComfort=hivedistsiaroom.UseAdaptiveComfort,
    UseNaturalVentilation=hivedistsiaroom.UseNaturalVentilation,
    UseFixedTimeConstant=hivedistsiaroom.UseFixedTimeConstant)  # -> HeatingDemand, DomesticHotWaterDemand, CoolingDemand, ElectricityDemand, TransmissionHeatLosses, VentilationHeatLosses, InternalGains, SolarGains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
abs = Absolute(Value=sia380.CoolingDemand)

# ----
# PV Ertrag (unverschattet)
# Q_s = G * F_F * A_w * g
# [Q_s] = kWh
# [G] = kWh/m^2
# [F_F] = -
# [A_w] = m^2
# [g] = -
simplepanel_2 = SimplePanel(
    Tilt=hivedistsolarsimu.SolarTechTilt,
    Azimuth=hivedistsolarsimu.SolarTechAzimuth,
    DHI=epw_reader.DHI,
    DNI=epw_reader.DNI,
    Latitude=epw_reader.Latitude,
    Longitude=epw_reader.Longitude)

# ----
# Chiller
hivemergerchiller = MergerChillerHive(
    AirCarrier=hivedistenvironment.AmbientAirTemp,
    ElectricityCarrier=hivedistenvironment.GridElectricity,
    CoolingGenerated=abs,
    SupplyTemperature=hivedistemitter.HourlyClgSupTemp,
    SimpleMode=toggle_6,
    HiveChiller=hivedistconversiontech.Chiller)

# ----
# Air Source Heat Pump
hivemergerashp = MergerAirSourceHeatPumpHive(
    AirCarrier=hivedistenvironment.AmbientAirTemp,
    ElectricityCarrier=hivedistenvironment.GridElectricity,
    HeatingGenerated=sia380.HeatingDemand,
    SupplyTemperature=hivedistemitter.HourlyHtgSupTemp,
    SimpleMode=toggle_6,
    HiveAirSourceHeatPump=hivedistconversiontech.AirSourceHeatPump)

# ----
# PV / ST
python_9 = GhPythonScript(x=irrmshy_2)  # -> out, a
# ---------- python_9: Python ----------
__author__ = "chwaibel"
__version__ = "2020.08.21"

import rhinoscriptsyntax as rs

a = x.I_hourly
# ---------- end python_9 ----------
hivemergersolartech = MergerSolarTechHive(
    I_hourlyM=python_9.a,
    SolarTechnologies=hivedistributor.HiveEnergySystemsSurfaceBasedTech,
    AirCarrier=hivedistenvironment.AmbientAirTemp,
    SupplyTemperature=hivedistemitter.HourlyHtgSupTemp,
    ReturnTemperature=hivedistemitter.HourlyHtgRetTemp,
    SimpleMode=toggle_6,
    I_hourly=simplepanel_2)
python_10 = GhPythonScript(x=hivemergersolartech)  # -> out, a
# ---------- python_10: Python ----------
__author__ = "chwaibel"
__version__ = "2020.08.24"

import rhinoscriptsyntax as rs
a = x.OutputCarriers[0].EnergyMonthlyCumulative
# ---------- end python_10 ----------
panel_18 = Panel(hivemergersolartech)
ma = MassAddition(Input=python_10.a)  # -> Result, PartialResults
graph_2 = QuickGraph(python_10.a, SortOrder=0)
panel_19 = Panel(ma.Result)

# ---- group: PV electricity generation (kWh/month)
panel_20 = Panel(python_10.a)

# ----
# Plug-in any conversion tech
python_11 = GhPythonScript(x=hivemergerchiller)  # -> out, description, outEnergy
# ---------- python_11: Python ----------
__author__ = "chwaibel"
__version__ = "2020.08.18"

import rhinoscriptsyntax as rs

a = ("total investment cost: ", x.SpecificInvestmentCost * x.Capacity)
b = ("capacity: ", x.Capacity)
c = ("cap unit; ", x.CapacityUnit)
d = ("name: ", x.Name)
e = ("opCost CHF/a: ", sum(x.InputCarrier.TotalCost ))
f = ("tot Input Energy kWh/a: ", sum(x.InputCarrier.Energy))
g = ("Tot Output Energy kWh/a: ", sum(x.OutputCarriers[0].EnergyMonthlyCumulative))
h = ("Inp Car PEF: ", x.InputCarrier.PrimaryEnergyFactor)
description = [a, b, c, d, e, f, g, h]

# print(x.InputCarrier.EnergyMonthlyCumulative)
#print(x.OutputCarriers[0].Energy)
print(x.InputCarrier.PrimaryEnergyFactor)
print("Input type: ", type(x.InputCarrier))
print("Output type: ", type(x.OutputCarriers[0]))
outEnergy = x.OutputCarriers[0].EnergyMonthlyCumulative
print(x.IsCooling)
# ---------- end python_11 ----------
panel_21 = Panel(python_11.description)

# ----
# Purchased Grid Electricity
python_12 = GhPythonScript(chiller=hivemergerchiller, ashp=hivemergerashp, siaElec=sia380.ElectricityDemand, hourly=toggle_5)  # -> out, additionalElec; inputs siaElec: list, hourly: Boolean
# ---------- python_12: Python ----------
__author__ = "Christoph"
__version__ = "2020.09.13"

import rhinoscriptsyntax as rs

if not hourly:
    if chiller != None and ashp != None:
        additionalElec = [a+b+c for a,b,c in zip(chiller.InputCarrier.EnergyMonthlyCumulative, ashp.InputCarrier.EnergyMonthlyCumulative, siaElec)]
    elif ashp != None and chiller is None:
        additionalElec = [a+b for a,b in zip(ashp.InputCarrier.EnergyMonthlyCumulative, siaElec)]
    elif ashp is None and chiller != None:
        additionalElec = [a+b for a,b in zip(chiller.InputCarrier.EnergyMonthlyCumulative, siaElec)]
    else:
        additionalElec = siaElec
else:
    if chiller != None and ashp != None:
        additionalElec = [a+b+c for a,b,c in zip(chiller.InputCarrier.Energy, ashp.InputCarrier.Energy, siaElec)]
    elif ashp != None and chiller is None:
        additionalElec = [a+b for a,b in zip(ashp.InputCarrier.Energy, siaElec)]
    elif ashp is None and chiller != None:
        additionalElec = [a+b for a,b in zip(chiller.InputCarrier.Energy, siaElec)]
    else:
        additionalElec = siaElec
# ---------- end python_12 ----------
python_13 = GhPythonScript(
    pvOrStList=hivemergersolartech,
    elecDemandIn=python_12.additionalElec,
    heatDemandIn=sia380.HeatingDemand,
    hourly=toggle_5)  # -> out, flatten(elecDemandOut), heatDemandOut; inputs pvOrStList: list, elecDemandIn: list, heatDemandIn: list, hourly: Boolean
# ---------- python_13: Python ----------
__author__ = "Christoph"
__version__ = "2020.09.13"

import rhinoscriptsyntax as rs
import Hive.IO.EnergySystems

horizon = 8760
if not hourly:
    horizon = 12

totalRenewableHeat = [0.0] * horizon
totalRenewableElec = [0.0] * horizon

if not hourly:
    for pvOrSt in pvOrStList:
        if(pvOrSt != None):
            energyRenewable = pvOrSt.OutputCarriers[0].EnergyMonthlyCumulative
        
        if(type(pvOrSt) == Hive.IO.EnergySystems.Photovoltaic):
            totalRenewableElec = [x + y for x, y in zip (totalRenewableElec, energyRenewable)]
        elif(type(pvOrSt) == Hive.IO.EnergySystems.SolarThermal):
            totalRenewableHeat = [x + y for x, y in zip (totalRenewableHeat, energyRenewable)]
else:
    for pvOrSt in pvOrStList:
        if(pvOrSt != None):
            energyRenewable = pvOrSt.OutputCarriers[0].Energy
        
        if(type(pvOrSt) == Hive.IO.EnergySystems.Photovoltaic):
            totalRenewableElec = [x + y for x, y in zip (totalRenewableElec, energyRenewable)]
        elif(type(pvOrSt) == Hive.IO.EnergySystems.SolarThermal):
            totalRenewableHeat = [x + y for x, y in zip (totalRenewableHeat, energyRenewable)]


elecDemandOut = [x - y for x, y in zip(elecDemandIn, totalRenewableElec)]
heatDemandOut = [x - y for x, y in zip(heatDemandIn, totalRenewableHeat)]
# ---------- end python_13 ----------
hivemergerdirectelectricity = MergerDirectElectricityHive(
    ElectricityCarrier=hivedistenvironment.GridElectricity,
    ElectricityPurchased=python_13.elecDemandOut,
    DirectElectricity=hivedistconversiontech.DirectElectricity)

# ----
# Results
hiveresults = ResultsHive(
    CoolingLoad=abs,
    SpaceHeatingLoad=python_13.heatDemandOut,
    ElectricityLoad=python_13.elecDemandOut,
    DomesticHotWaterLoad=sia380.DomesticHotWaterDemand,
    HiveBuilding=hivedistributor.HiveBuilding,
    HiveConversionTech=flatten([hivemergerdirectelectricity, hivemergerchiller, hivemergerashp, hivemergersolartech]),
    Q_T_opaque=sia380.TransmissionHeatLossesOfOpaqueSurfaces,
    Q_T_transparent=sia380.TransmissionHeatLossesOfTransparentSurfaces,
    Q_V=sia380.VentilationHeatLosses,
    Q_i=sia380.InternalGains,
    Q_s=sia380.SolarGains,
    ConsumedElec=python_12.additionalElec,
    ConsumedHeat=sia380.HeatingDemand,
    Q_s_per_win=sia380.SolarGainsPerTransparentSurface)
python_14 = GhPythonScript(hiveResults=hiveresults)  # -> out, a, heatingLoads, coolingLoads, electricityLoads, windowSolarGains, gainsAndLosses
# ---------- python_14: Python ----------
__author__ = "chwaibel"
__version__ = "2020.09.23"

x = hiveResults

import rhinoscriptsyntax as rs

heatingLoads = x.TotalFinalHeatingMonthly
coolingLoads = x.TotalFinalCoolingMonthly
electricityLoads = x.TotalFinalElectricityMonthly
windowSolarGains = [] 
for j in range(len(x.MonthlySolarGainsPerWindow)):
    window = x.MonthlySolarGainsPerWindow[j]
    for i in range(len(window)):
        if i==0:
            windowSolarGains.append("______")
            windowSolarGains.append("window " + str(j))
        windowSolarGains.append(window[i])
        

gainsAndLosses = []
gainsAndLossesDict = \
{"SolarGains: ": x.TotalSolarGains, \
"InternalGains: ": x.TotalInternalGains, \
"PrimaryEnergy: ": sum(x.TotalPrimaryEnergyNonRenewableMonthly), \
"VentilationHeatGains: ": x.TotalVentilationHeatGains, \
"EnvelopeHeatGains: ": x.TotalOpaqueTransmissionHeatGains, \
"WindowHeatGains: ": x.TotalWindowTransmissionHeatGains, \
"ElectricityDemand: ": sum(x.TotalConsumedElectricityMonthly), \
"VentilationHeatLosses: ": x.TotalVentilationHeatLosses, \
"EnvelopeHeatLosses: ": x.TotalOpaqueTransmissionHeatLosses, \
"WindowHeatLosses: ": x.TotalWindowTransmissionHeatLosses, \
"SystemConversionLosses: ": x.TotalSystemLosses}

for k, v in gainsAndLossesDict.iteritems():
    gainsAndLosses.append(k + str(v))
# ---------- end python_14 ----------

# ---- group: Zone Gains and Losses
panel_22 = Panel(python_14.gainsAndLosses)

# ----
hiveresultsvisualizer = ResultsVisualizerHive(
    hiveresults,
    PlotProperties="""{
  "$type": "System.Collections.Generic.Dictionary`2[[System.String, mscorlib],[System.String, mscorlib]], mscorlib"
}""")

# ---- group: Heating Loads
panel_23 = Panel(python_14.heatingLoads)

# ---- group: Cooling Loads
panel_24 = Panel(python_14.coolingLoads)

# ---- group: Windows Solar Gains
panel_25 = Panel(python_14.windowSolarGains)

# ---- group: Electricity Loads
panel_26 = Panel(python_14.electricityLoads)

# ---- group: Hive Results
data_3 = Data(hiveresults)

# ---- group: internalise data to store results
hiveresults_2 = HiveResultsParameter(data_3)
