# Grasshopper definition EaCS3_E0X_WalkieTalkie.gh (Grasshopper 1.0.7)
# plug-ins: HiveIO, GHSolar

# ---- group: decision variables
number_slider = Slider(9.842, range=0..30)
number_slider_2 = Slider(10.621, range=0..30)
number_slider_3 = Slider(11.786, range=0..30)
number_slider_4 = Slider(42.325, range=10..70)

# ---- group: parametric model of main facade
pt = Point(Point(0, 0, 80))
pt_2 = Point(Point(-31.16123251, -5.799938234, 12.99032799))
pt_3 = Point(Point(0, 0, 12.99032799))
pt_4 = Point(Point(31.16123251, -5.799938234, 12.99032799))
pt_5 = Point(Point(0, 0, 0))
pdecon = Deconstruct(Point=pt)  # -> XComponent, YComponent, ZComponent
pdecon_2 = Deconstruct(Point=pt_2)  # -> XComponent, YComponent, ZComponent
pdecon_3 = Deconstruct(Point=pt_3)  # -> XComponent, YComponent, ZComponent
pdecon_4 = Deconstruct(Point=pt_4)  # -> XComponent, YComponent, ZComponent
pdecon_5 = Deconstruct(Point=pt_5)  # -> XComponent, YComponent, ZComponent
pt_6 = ConstructPoint(XCoordinate=pdecon.XComponent, YCoordinate=number_slider, ZCoordinate=pdecon.ZComponent)
pt_7 = ConstructPoint(XCoordinate=pdecon_2.XComponent, YCoordinate=pdecon_2.YComponent, ZCoordinate=number_slider_4)
pt_8 = ConstructPoint(XCoordinate=pdecon_3.XComponent, YCoordinate=number_slider_2, ZCoordinate=number_slider_4)
pt_9 = ConstructPoint(XCoordinate=pdecon_4.XComponent, YCoordinate=pdecon_4.YComponent, ZCoordinate=number_slider_4)
pt_10 = ConstructPoint(XCoordinate=pdecon_5.XComponent, YCoordinate=number_slider_3, ZCoordinate=pdecon_5.ZComponent)
pt_11 = Point(Point(-31.16123251, -24.39991912, 80))
pt_12 = Point(pt_6)
pt_13 = Point(Point(31.16123251, -24.39991912, 80))
pt_14 = Point(pt_8)
pt_15 = Point(Point(-31.16123251, -12.25019344, 0))
pt_16 = Point(pt_10)
pt_17 = Point(Point(31.16123251, -12.25019344, 0))
pt_18 = Point([pt_11, pt_12, pt_13])
pt_19 = Point([pt_7, pt_14, pt_9])
pt_20 = Point([pt_15, pt_16, pt_17])
nurbs = NurbsCurve(Vertices=pt_18, Degree=2, Periodic=False)  # -> Curve, Length, Domain
nurbs_2 = NurbsCurve(Vertices=pt_19, Degree=2, Periodic=False)  # -> Curve, Length, Domain
nurbs_3 = NurbsCurve(Vertices=pt_20, Degree=2, Periodic=False)  # -> Curve, Length, Domain
loft = Loft(
    Curves=[nurbs.Curve, nurbs_2.Curve, nurbs_3.Curve],
    Options={Adjust=False, Closed=False, LoftEnds=0, LoftSimp=0, LoftType=0, Rebuild=10, Refit=0.01})

# ---- group: try your own location / Path to weather file (.epw)
panel = Panel("D:\TEACHING\20_EaCS3_HS20\Lectures\L04_ParametricModelingOptimization\material\GBR_London.Gatwick.037760_IWEC.epw")

# ---- group: Optimize
galapagos = Galapagos(fitness=num, gene=[number_slider, number_slider_2, number_slider_3, number_slider_4])

# ---- group: 3d
debrep = DeconstructBrep(Brep=loft)  # -> Faces, Edges, Vertices
line = Line(Line((31.16123251, 25.60008088, 80), (-31.16123251, 25.60008088, 80)))
line_2 = Line(Line((-31.16123251, 25.60008088, 0), (31.16123251, 25.60008088, 0)))
line_3 = Line(Line((31.16123251, 25.60008088, 0), (31.16123251, 25.60008088, 80)))
line_4 = Line(Line((-31.16123251, 25.60008088, 80), (-31.16123251, 25.60008088, 0)))
item = ListItem(List=debrep.Edges, Index=Slider(1, range=0..3), Wrap=True)
item_2 = ListItem(List=debrep.Edges, Index=Slider(0, range=0..3), Wrap=True)
item_3 = ListItem(List=debrep.Edges, Index=Slider(2, range=0..3), Wrap=True)
item_4 = ListItem(List=debrep.Edges, Index=Slider(3, range=0..3), Wrap=True)
loft_2 = Loft(
    Curves=flatten([item, line_2]),
    Options={Adjust=False, Closed=False, LoftEnds=0, LoftSimp=0, LoftType=0, Rebuild=10, Refit=0.01})
loft_3 = Loft(
    Curves=flatten([item_2, line_4]),
    Options={Adjust=False, Closed=False, LoftEnds=0, LoftSimp=0, LoftType=0, Rebuild=10, Refit=0.01})
loft_4 = Loft(
    Curves=flatten([item_3, line_3]),
    Options={Adjust=False, Closed=False, LoftEnds=0, LoftSimp=0, LoftType=0, Rebuild=10, Refit=0.01})
loft_5 = Loft(
    Curves=flatten([item_4, line]),
    Options={Adjust=False, Closed=False, LoftEnds=0, LoftSimp=0, LoftType=0, Rebuild=10, Refit=0.01})

# ---- group: connect to "vectors"
vec = Vector([Vector(-72.73718732, 27.91824208, -79.19490295), Vector(-51.7765507, 40.6819756, -89.47695218), Vector(-27.28844979, 48.78652901, -96.00611651), Vector(-0.9413093999, 51.67968574, -98.33759877), Vector(25.46977263, 49.16431638, -96.31261594), Vector(50.14535418, 41.41181335, -90.0692205), Vector(71.40427298, 28.95040529, -80.03288791)])

# ---- group: reflection and intersection: evaluation model and objective function
srf = Surface(loft)
mesh_uv = MeshSurface(Surface=srf, UCount="20", VCount="20", Overhang=True, Equalize=False)
item_5 = ListItem(List=vec, Index=Slider(3, range=0..6), Wrap=True)
python = GhPythonScript(mesh=mesh_uv, solar_vectors=item_5)  # -> out, reflected; inputs solar_vectors: list
# ---------- python: Python ----------
"""Reflects incoming vectors on a mesh.
    Inputs:
        x: The x script variable
        y: The y script variable
    Output:
        a: The a output variable"""

__author__ = "Christoph"
__version__ = "2020.11.11"

import rhinoscriptsyntax as rs
import Rhino.Geometry as rg


def reflect(normal, incident_vector):
    return rs.VectorSubtract(incident_vector, rs.VectorScale(normal, rs.VectorMultiply(incident_vector, normal) * 2.0))


# reflect vectors on each mesh vertex
lines = []
mesh_obj = rs.coercemesh(mesh)
vertices = mesh_obj.Vertices
normals = rs.MeshVertexNormals(mesh_obj)

scalar = 100

for solar_vector in solar_vectors:
    for normal, vertex in zip(normals, vertices):
        solar = rs.VectorReverse(solar_vector)
    #    lines.append(rs.AddLine(vertex, rs.VectorAdd(vertex, normal)))
    #    lines.append(rs.AddLine(vertex, rs.VectorAdd(vertex, rs.VectorScale(rs.VectorUnitize(solar), scalar))))
        angle = rs.VectorAngle(normal, solar)
        if angle < 90:
            lines.append(rs.AddLine(vertex, rs.VectorAdd(vertex, rs.VectorScale(rs.VectorUnitize(reflect(normal, solar_vector)), scalar))))

reflected = lines
# ---------- end python ----------
srf_2 = Surface(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)
brep = Brep(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)
scx = SurfaceCurve(Surface=srf_2, Curve=python.reflected)  # -> Curves, Points, UVPoints, Normals, Parameters, Tangents
bcx = BrepCurve(Brep=brep, Curve=python.reflected)  # -> Curves, flatten(Points)
python_2 = GhPythonScript(x=bcx.Points)  # -> out, a; inputs x: list
# ---------- python_2: Python ----------
__author__ = "Christoph"
__version__ = "2020.11.11"

import rhinoscriptsyntax as rs

count = 0
if x:
    count = len(x)
    
a = count
# ---------- end python_2 ----------

# ---- group: try your own location
distepw = DistributorEPW(EPWFilepath=panel, WriteLists=Toggle(True))  # -> EPW, Latitude, Longitude, CityCountry, GHI, DNI, DHI, DryBulb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; disabled
panel_2 = Panel("""4065
4066
4067
4068
4069
4070
4071""")  # disabled
mesh = Mesh(srf)  # disabled
toggle = BooleanToggle(False)  # disabled
toggle_2 = BooleanToggle(True)  # disabled
area = Area(Geometry=mesh)  # -> Area, Centroid; disabled
skydome = GHSkydome(
    RecursionLevel=1,
    CumSkyMatrix=False,
    SunPath=toggle,
    SolarVec=toggle_2,
    HOY=panel_2,
    Location=[distepw.Longitude, distepw.Latitude],
    DNI=distepw.DNI,
    DHI=distepw.DHI,
    Context=mesh,
    Sp=area.Centroid,
    Timezone=distepw.Timezone)  # -> Mesh, Vectors, Sunpaths, SunGeo; disabled

# ---- group: number of rays hitting our car: objective value
panel_3 = Panel(python_2.a)
num = Number(panel_3)
