# Grasshopper definition EuKS2_02_Hive_Solar.gh (Grasshopper 1.0.7)
# plug-ins: HiveIO, Hive.Core.sia380Parameters, GHSolar

rooms_standard = RoomsStandard({"1.1 Wohnen Mehrfamilienhaus": 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, "1.2 Wohnen Einfamilienhaus": {"description": "1.2 Wohnen Einfamilienhaus", "Raumlufttemperatur Auslegung Heizen (Winter)": 21.0, "Nettogeschossflaeche": 20.0, "Thermische Gebaeudehuellflaeche": 38.0, "U-Wert Fenster": 1.2, "Waermeeintragsleistung Personen (bei 24.0 deg C, bzw. 70 W)": 1.3999999999999999, "Jaehrliche Vollaststunden der Geraete": 1780.0, "U-Wert opake Bauteile": 0.20000000000000001, "Jaehrliche Vollaststunden der Raumbeleuchtung": 1450.0, "Vollaststunden pro Jahr (Personen)": 4090.0, "Abminderungsfaktor fuer Fensterrahmen": 0.75, "Aussenluft-Volumenstrom durch Infiltration": 0.14999999999999999, "Raumlufttemperatur Auslegung Kuehlung (Sommer)": 26.0, "Glasanteil": 30.0, "Zeitkonstante": 164.0, "Waermeeintragsleistung der Raumbeleuchtung": 2.7000000000000002, "Waermeeintragsleistung der Geraete": 8.0, "Gesamtenergiedurchlassgrad Verglasung": 0.5, "Temperatur-Aenderungsgrad der Waermerueckgewinnung": 0.69999999999999996, "Aussenluft-Volumenstrom (pro NGF)": 0.59999999999999998}, "2.1 Hotelzimmer": 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, "2.2 Empfang, Lobby": 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, "3.1 Einzel-, Gruppenbuero": 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, "3.2 Grossraumbuero": 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, "3.3 Sitzungszimmer": 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, "3.4 Schalterhalle, Empfang": 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, "4.1 Schulzimmer": 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, "4.2 Lehrerzimmer": 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}, selected="1.2 Wohnen Einfamilienhaus")
rooms_existing = RoomsExisting({"1.1 Wohnen Mehrfamilienhaus": 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, "1.2 Wohnen Einfamilienhaus": {"description": "1.2 Wohnen Einfamilienhaus", "Raumlufttemperatur Auslegung Heizen (Winter)": 21.0, "Nettogeschossflaeche": 20.0, "Thermische Gebaeudehuellflaeche": 38.0, "U-Wert Fenster": 1.5, "Waermeeintragsleistung Personen (bei 24.0 deg C, bzw. 70 W)": 1.3999999999999999, "Jaehrliche Vollaststunden der Geraete": 1780.0, "U-Wert opake Bauteile": 0.80000000000000004, "Jaehrliche Vollaststunden der Raumbeleuchtung": 1450.0, "Vollaststunden pro Jahr (Personen)": 4090.0, "Abminderungsfaktor fuer Fensterrahmen": 0.75, "Aussenluft-Volumenstrom durch Infiltration": 0.29999999999999999, "Raumlufttemperatur Auslegung Kuehlung (Sommer)": 26.0, "Glasanteil": 30.0, "Zeitkonstante": 56.0, "Waermeeintragsleistung der Raumbeleuchtung": 2.7000000000000002, "Waermeeintragsleistung der Geraete": 10.0, "Gesamtenergiedurchlassgrad Verglasung": 0.65000000000000002, "Temperatur-Aenderungsgrad der Waermerueckgewinnung": NaN, "Aussenluft-Volumenstrom (pro NGF)": 0.59999999999999998}, "2.1 Hotelzimmer": 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, "2.2 Empfang, Lobby": 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, "3.1 Einzel-, Gruppenbuero": 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, "3.2 Grossraumbuero": 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, "3.3 Sitzungszimmer": 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, "3.4 Schalterhalle, Empfang": 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, "4.1 Schulzimmer": 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, "4.2 Lehrerzimmer": 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}, selected="1.2 Wohnen Einfamilienhaus")

# ---- group: Pfad zur Wetterdatei (*.epw)
# EuKS2 - Heizwärmebedarf und PV Ertrag
# Berechnungen zur Abschätzung des Wärmebedarfs.
# Basiert auf der Excel Tabelle "Interaktion Struktur, Klima und Wärmebedarf.xlsx"
# 
# Sonneneinstrahlung berechnet gemäss "Perez, R., Ineichen, P., Seals, R., Michalsky, J., Stewart, R., 1990. Modeling daylight availability and irradiance components from direct and global irradiance. Solar Energy 44 (5), 271-289."
panel = Panel("C:\EnergyPlusV9-1-0\WeatherData\USA_CA_San.Francisco.Intl.AP.724940_TMY3.epw")

# ----
rooms_ideal = RoomsIdeal({"1.1 Wohnen Mehrfamilienhaus": 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, "1.2 Wohnen Einfamilienhaus": {"description": "1.2 Wohnen Einfamilienhaus", "Raumlufttemperatur Auslegung Heizen (Winter)": 21.0, "Nettogeschossflaeche": 20.0, "Thermische Gebaeudehuellflaeche": 38.0, "U-Wert Fenster": 0.90000000000000002, "Waermeeintragsleistung Personen (bei 24.0 deg C, bzw. 70 W)": 1.3999999999999999, "Jaehrliche Vollaststunden der Geraete": 1780.0, "U-Wert opake Bauteile": 0.10000000000000001, "Jaehrliche Vollaststunden der Raumbeleuchtung": 1110.0, "Vollaststunden pro Jahr (Personen)": 4090.0, "Abminderungsfaktor fuer Fensterrahmen": 0.75, "Aussenluft-Volumenstrom durch Infiltration": 0.14999999999999999, "Raumlufttemperatur Auslegung Kuehlung (Sommer)": 26.0, "Glasanteil": 30.0, "Zeitkonstante": 238.0, "Waermeeintragsleistung der Raumbeleuchtung": 1.7, "Waermeeintragsleistung der Geraete": 4.0, "Gesamtenergiedurchlassgrad Verglasung": 0.5, "Temperatur-Aenderungsgrad der Waermerueckgewinnung": 0.80000000000000004, "Aussenluft-Volumenstrom (pro NGF)": 0.59999999999999998}, "2.1 Hotelzimmer": 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, "2.2 Empfang, Lobby": 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, "3.1 Einzel-, Gruppenbuero": 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, "3.2 Grossraumbuero": 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, "3.3 Sitzungszimmer": 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, "3.4 Schalterhalle, Empfang": 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, "4.1 Schulzimmer": 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, "4.2 Lehrerzimmer": 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}, selected="1.2 Wohnen Einfamilienhaus")

# ---- group: PV Fläche
srf = Surface(<surface referenced from the Rhino model>)

# ---- group: Boden
mesh = Mesh(<mesh referenced from the Rhino model>)

# ---- group: Gebäudevolumen
brep = Brep(<brep referenced from the Rhino model>)

# ---- group: Fensterflächen
srf_2 = Surface([<surface referenced from the Rhino model> x5])

# ----
mesh_uv = MeshSurface(Surface=srf, UCount=4, VCount=4, Overhang=True, Equalize=False)
hiveinputenergysystems = InputEnergySystemsHive(
    MeshSolarTechnologyProperties=mesh_uv,
    conversions="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",
    emitters="""{
  "$type": "Hive.IO.Forms.EmitterPropertiesViewModel[], Hive.IO",
  "$values": []
}""",
    meshConnections="""{
  "$type": "System.Collections.Generic.Dictionary`2[[System.Int32, mscorlib],[System.Int32, mscorlib]], mscorlib",
  "0": 0
}""",
    meshes="""{
  "$type": "Hive.IO.Forms.SurfaceViewModel[], Hive.IO",
  "$values": [
    {
      "$type": "Hive.IO.Forms.SurfaceViewModel, Hive.IO",
      "Name": "srf0",
      "Area": 72.761414769930539
    }
  ]
}""")
hiveinputbuilding = InputBuildingHive(ZoneGeometry=brep, WindowsSurfaces=srf_2, SIA2024Room=rooms_ideal, SiaRoom="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")
hive_io_env = HiveIOEnvironment(EPWPath=panel, ObstaclesGeometry=mesh)
cluster = Cluster(hiveinputs=[hive_io_env, hiveinputbuilding, hiveinputenergysystems])  # -> q_s, q_h, R_2, R_3, R_5, R_6, R_7, R, R_4

# ---- group: solare Wärmegewinne
data = Data(cluster.q_s)

# ---- group: heating demand
data_2 = Data(cluster.q_h)

# ----
data_3 = Data([cluster.R_2, cluster.R_3, cluster.R_5, cluster.R_6, cluster.R, cluster.R_4])

# ---- group: electricity demand
data_4 = Data(cluster.R_7)

# ---- group: Heizwärmebedarf, Strombedarf Wärmepumpe und Stromertrag PV
# Jahresheizwärmebedarf in kWh
# Jahresstrombedarf Wärmepumpe in kWh
# Jahresstromertrag PV in kWh
# Jahresheizwärmebedarf in kWh/m^2
# Jahresstrombedarf Wärmepumpe in kWh/m^2
# Jahresstromertrag PV in kWh/m^2 PV
panel_2 = Panel(data_3)

# ----
graph = QuickGraph([data_4, data_2, data], SortOrder=0)

# ---- group: Sonnenstandsdiagrammm
pt = Point(Point(19.06384852, -3.527946336, 0))
distepw = DistributorEPW(EPWFilepath=panel, WriteLists=Toggle(True))  # -> EPW, Latitude, Longitude, CityCountry, GHI, DNI, DHI, DryBulb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
skydome = GHSkydome(
    RecursionLevel=Slider(3, range=0..5),
    Viewfactors=Toggle(False),
    SunPath=Toggle(False),
    SolarVec=False,
    HOY=1,
    Location=[distepw.Longitude, distepw.Latitude],
    Size="2",
    Context=brep,
    Sp=pt,
    Timezone=distepw.Timezone)  # -> Mesh, Vectors, Sunpaths, SunGeo

# ==== cluster Cluster
hiveinputs = ClusterInput()
hivedistributor = MainDistributorHive(HiveInputs=flatten(hiveinputs))  # -> HiveBuilding, HiveEnvironment, HiveEnergySystemsSurfaceBasedTech, HiveEnergySystemsConversionTech, HiveEnergySystemsEmitter
distributorsia = DistributorSIA(BuildingObj=hivedistributor.HiveBuilding)  # -> ZoneAreas, WindowsAreas, ExtSrfAreas, SIA2024json, AllExternalSurfaceAreas, SurfaceType, SUA2024Schedules, UseAdaptiveComfort, UseNaturalVentilation, UseFixedTimeConstant
distributorepw = DistributorEPW(EnvironmentObj=hivedistributor.HiveEnvironment)  # -> Filepath, NaturalGas, BioGas, WoodPellets, DistrictHeating, DistrictCooling, GridElectricity, AmbientAirTemp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
hivedistsolarsimu = DistributorSolarSimulationHive(
    HiveBuilding=hivedistributor.HiveBuilding,
    HiveSolarTechnologies=hivedistributor.HiveEnergySystemsSurfaceBasedTech,
    HiveEnvironment=hivedistributor.HiveEnvironment)  # -> EnvironmentMesh, BuildingCentroid, ExternalSurfaces, WindowGeometries, WindowTilt, WindowAzimuth, WindowAreas, SolarTechMesh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
hiveiodistrsupsys = HiveIODistributorSupplySystem(HiveIOEnergySystemPV=hivedistributor.HiveEnergySystemsSurfaceBasedTech)  # -> EfficiencyPV, PVAreas, EfficiencyST, STAreas, ElectricEfficiencyPVT, ThermalEfficiencyPVT, PVTAreas
sia2024 = SIA2024Rooms(
    Room=distributorsia.SIA2024json,
    Area=distributorsia.ZoneAreas,
    Month=[1, 2, 3, 4, 5, 6, 7, 8, 9, 10, 11, 12],
    Season="winter")  # -> Τ_h, Θ_i_C, T_h, A_op_m2, A_w_m2, U_op_W_m2K, U_w_W_m2K, V_e_m3_h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
epw_reader = EPWReader(Path=distributorepw.Filepath)  # -> Latitude, Longitude, CityCountry, GHI, DNI, DHI, DryBulb, DewPoint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
python = GhPythonScript(x=epw_reader.DryBulb, month=[0, 1, 2, 3, 4, 5, 6, 7, 8, 9, 10, 11])  # -> out, a; inputs x: list, month: Int32
# ---------- python: Python ----------
__author__ = "chwaibel"
__version__ = "2020.02.25"

import rhinoscriptsyntax as rs

# 8760 time series
# get monthly average...
# how to know how many days a month? somewhere, I have typical year.
# in some honey-badger script

dayspermonth = [31.0, 28.0, 31.0, 30.0, 31.0, 30.0, 31.0, 31.0, 30.0, 31.0, 30.0, 31.0]

hour_per_day = 24
start_hour = int(hour_per_day * sum(dayspermonth[0:month])) 
end_hour = int(hour_per_day * sum(dayspermonth[0:month+1]))

cumulative_data = sum(x[start_hour:end_hour])
hours_per_month = (dayspermonth[month] * hour_per_day)

a = cumulative_data / hours_per_month
# ---------- end python ----------
python_2 = GhPythonScript(x=epw_reader.GHI, month=[0, 1, 2, 3, 4, 5, 6, 7, 8, 9, 10, 11])  # -> out, a; inputs x: list, month: Int32
# ---------- python_2: Python ----------
__author__ = "chwaibel"
__version__ = "2020.02.25"

import rhinoscriptsyntax as rs

# 8760 time series
# get monthly average...
# how to know how many days a month? somewhere, I have typical year.
# in some honey-badger script

dayspermonth = [31.0, 28.0, 31.0, 30.0, 31.0, 30.0, 31.0, 31.0, 30.0, 31.0, 30.0, 31.0]

hour_per_day = 24
start_hour = int(hour_per_day * sum(dayspermonth[0:month])) 
end_hour = int(hour_per_day * sum(dayspermonth[0:month+1]))

cumulative_data = sum(x[start_hour:end_hour])

a = cumulative_data / 1000
# ---------- end python_2 ----------

# ----
# Solare Wärmeeinträge
# Q_s = G * F_F * A_w * g
# [Q_s] = kWh
# [G] = kWh/m^2
# [F_F] = -
# [A_w] = m^2
# [g] = -
c_script = CSharpScript(x=hivedistsolarsimu.WindowGeometries)  # -> out, tilt, azimuth, area; inputs x: Brep
# ---------- c_script: C# ----------
    Surface srf = x.Surfaces[0];

    AreaMassProperties massProp = AreaMassProperties.Compute(srf);
    Point3d cen = massProp.Centroid;
    double u,v;
    srf.ClosestPoint(cen, out u, out v);
    Vector3d normal = srf.NormalAt(u, v);

    if(x.Faces[0].OrientationIsReversed)
      normal.Reverse();

    Vector3d vnormal = new Vector3d(0, 0, 1);
    Vector3d tiltZ0 = new Vector3d(0, 0, 1);

    double tiltValue = Vector3d.VectorAngle(normal, tiltZ0, vnormal);
    tilt = tiltValue * (180.0 / Math.PI);

    double azimuthValue = Vector3d.VectorAngle(new Vector3d(normal.X, normal.Y, 0), new Vector3d(0, 1, 0), vnormal);
    azimuth = azimuthValue * (180 / Math.PI);

//    Line normalLine = new Line(cen, cen + normal);
//    Line azimuthLine = new Line(cen, cen + new Vector3d(0, 1, 0));
//    Line tiltLine = new Line(cen, cen + tiltZ0);
//    A = normalLine;
//    B = azimuthLine;
//    C = tiltLine;


    area = AreaMassProperties.Compute(x.Faces[0]).Area;
# ---------- end c_script ----------
simplepanel = SimplePanel(
    Tilt=c_script.tilt,
    Azimuth=c_script.azimuth,
    DHI=epw_reader.DHI,
    DNI=epw_reader.DNI,
    Latitude=epw_reader.Latitude,
    Longitude=epw_reader.Longitude)
python_3 = GhPythonScript(x=simplify(simplepanel), month=[0, 1, 2, 3, 4, 5, 6, 7, 8, 9, 10, 11])  # -> out, a; inputs x: list, month: Int32; same code as python_2
item = ListItem(List=sia2024.G_, Index=0, Wrap=True)
c_script_2 = CSharpScript(G=python_3.a, A_w=c_script.area, g=item)  # -> out, Q_s; inputs G: tree of Double, A_w: list of Double, g: Double
# ---------- c_script_2: C# ----------
    int winCount = G.BranchCount;
    double [] Q_array = new double[12];
    
    DataTree<double> doubleTree = new DataTree<double>();
    for (int i = 0; i < G.BranchCount; i++)
    {
      for (int j = 0; j < G.Branch(i).Count; ++j) // should be 12, 1 for each month of the year
      {
        GH_Path path = new GH_Path(i, j);
        double irrad = G.Branch(i)[j] * A_w[i] * g;
        doubleTree.Add(irrad, path);
        
        Q_array[j] += irrad;
      }
    }   
    
    Q_s = Q_array;
# ---------- end c_script_2 ----------
panel = Panel(c_script_2.Q_s)

# ----
# Thermisch wirksamer Aussenluftvolumenstrom
# Vdot_th = Vdot_e * (1 - eta_rec) * Vdot_inf
# [Vdot_th] = m^3/h oder m^3/s
# [Vdot_e] = m^3/h oder m^3/s
# [Vdot_inf] = m^3/h oder m^3/s
# [eta_rec] = -
python_4 = GhPythonScript(Vdot_e=sia2024.V_e_m3_h, Vdot_inf=sia2024.V_inf_m3_h, eta_rec=sia2024.Η_rec_)  # -> Vdot_th
# ---------- python_4: Python ----------
"""Thermisch wirksamer Aussenluftvolumenstrom.
    Inputs:
        Vdot_e:         Aussenluft-Volumenstrom durch Lüftung in m^3/h
        Vdot_inf:       Aussenluft-Volumenstrom durch Infiltration in m^3/h
        eta_rec:        Nutzungsgrad der Wärmerückgewinnung
    Output:
        Vdot_th:        Thermisch wirksamer Aussenluft Volumenstrom in m^3/h"""

__author__ = "A/S ETH"
__version__ = "2020.04.18"

import rhinoscriptsyntax as rs
import math

if math.isnan(eta_rec):
    eta_rec = 0
Vdot_th = Vdot_e * (1-eta_rec) + Vdot_inf
# ---------- end python_4 ----------

# ----
# Transmissions-Wärmetransferkoeffizient
# H_T = A_op * U_op + A_w * U_w
# [H_T] = W/K
# [A_op] = m^2
# [A_w] = m^2
# [U_op] = W/(m^2K)
# [U_w] = W/(m^2K)
subtraction = Subtraction(A=distributorsia.ExtSrfAreas, B=distributorsia.WindowsAreas)
python_5 = GhPythonScript(A_op=subtraction, U_op=sia2024.U_op_W_m2K, A_w=distributorsia.WindowsAreas, U_w=sia2024.U_w_W_m2K)  # -> H_T
# ---------- python_5: Python ----------
"""Transmissions-Wärmetransferkoeffizient in W/K.
    Inputs:
        A_op:   Aussenwandfläche (opak) in m^2
        U_op:   Wärmedurchgangskoeffizient Aussenwand (opak) in W/m^2K
        A_w:    Aussenwandläche (transparent) in m^2
        U_w:    Wärmedurchgangskoeffizient Aussenwand (transparent) in W/m^2K
    Output:
        H_T:    Transmissions-Wärmetransferkoeffizient in W/K"""

__author__ = "A/S ETH"
__version__ = "2020.04.18"

import rhinoscriptsyntax as rs

H_T = A_op * U_op + A_w * U_w
# ---------- end python_5 ----------

# ----
# Interne Wärmeeinträge
# Q_i = Phi_P * t_P + Phi_B * t_B + Phi_G * t_G
# [Q_i] = Wh
# [Phi_P,B,G] = W
# [t_P,B,G] = h
python_6 = GhPythonScript(Phi_P=sia2024.Φ_P_W, t_P=sia2024.T_P_h, Phi_B=sia2024.Φ_L_W, t_B=sia2024.T_L_h, Phi_G=sia2024.Φ_G_W, t_G=sia2024.T_A_h)  # -> Q_i
# ---------- python_6: Python ----------
"""Interne Wärmeeinträge in Wh.
    Inputs:
        Phi_P:      Wärmeagbage Personen in W
        t_P:        Vollaststunden Personen in h
        Phi_B:      Wärmeabgabe Beleuchtung in W
        t_B:        Vollaststunden Beleuchtung in h
        Phi_G:      Wärmeabgabe Geräte in W
        t_G:        Vollaststunden Geräte in h
    Output:
        Q_i:        Interne Wärmeeinträge in Wh"""

__author__ = "A/S ETH"
__version__ = "2020.04.18"

import rhinoscriptsyntax as rs

Q_i = Phi_P*t_P + Phi_B * t_B + Phi_G * t_G
# ---------- end python_6 ----------

q_s = ClusterOutput(c_script_2.Q_s)

# ----
# Aussenlufttemperatur
panel_2 = Panel(python.a)

# ----
# Lüftungs-Wärmetransferkoeffizient
# H_V = Vdot_th * rho * c_p
# [H_V] = W/K
# [Vdot_th] = m^3/s
# [rho] = kg/m^3
# [c_p] = J/(kgK)
panel_3 = Panel("1.2")
python_7 = GhPythonScript(Vdot_th=python_4, rho=panel_3, c_p="1005")  # -> H_V
# ---------- python_7: Python ----------
"""Lüftungs-Wärmetransferkoeffizient.
    Inputs:
        Vdot_th:    Thermisch wirksamer Aussenluft-Volumenstrom in m^3/s
        rho:        Luftdichte in kg/m^3
        c_p:        Spezifische Wärmekapazität Luft in J/kgK
    Output:
        H_V:        Lüftungs-Wärmetransferkoeffizient in W/K"""

__author__ = "A/S ETH"
__version__ = "2020.04.18"

import rhinoscriptsyntax as rs

H_V = Vdot_th/3600 * rho * c_p
# ---------- end python_7 ----------

# ----
# Transmissionswärmeverluste
# Q_T = H_T * (T_i + T_e) * t
# [Q_T] = Wh
# [H_T] = W/K
# [T_i] = K oder °C
# [T_e] = K oder °C
# [t] = h
python_8 = GhPythonScript(H_T=python_5, T_i=sia2024.Θ_i_C, T_e=panel_2, t=sia2024.T_h)  # -> Q_T
# ---------- python_8: Python ----------
"""Transmissionswärmeverluste in Wh.
    Inputs:
        H_T:    Transmissions-Wärmetransferkoeffizient in W/K
        T_i:    Raumlufttemperatur in °C oder K
        T_e:    Aussenlufttemperatur in °C oder K
        t:      Länger der Berechnungsperiode in h
    Output:
        Q_T:    Transmissionswärmeverluste in Wh"""

__author__ = "A/S ETH"
__version__ = "2020.04.18"

import rhinoscriptsyntax as rs

Q_T = H_T * (T_i - T_e) * t
# ---------- end python_8 ----------

# ----
# Lüftungswärmeverluste
# Q_V = H_V * (T_i - T_e) * t
# [Q_V] = Wh
# [H_V] = W/K
# [T_i] = K oder °C
# [T_e] = K oder °C
# [t] = h
python_9 = GhPythonScript(H_V=python_7, T_i=sia2024.Θ_i_C, T_e=panel_2, t=sia2024.T_h)  # -> Q_V
# ---------- python_9: Python ----------
"""Lüftungswärmeverluste in Wh.
    Inputs:
        H_V:    Lüftungs-Wärmetransferkoeffizient in W/K
        T_i:    Raumlufttemperatur in °C oder K
        T_a:    Aussenlufttemperatur in °C oder K
        t:      Länge der Berechnungsperiode in h
    Output:
        Q_V:    Lüftungswärmeverluste in Wh"""

__author__ = "A/S ETH"
__version__ = "2020.04.18"

import rhinoscriptsyntax as rs

Q_V = H_V * (T_i - T_e) * t
# ---------- end python_9 ----------

# ----
# Wärmeeintrag/-verlust-Verhältnis
# gamma = (Q_i + Q_s) / (Q_T + Q_V)
# [gamma] = -
# [Q_T] = Wh
# [Q_V] = Wh
# [Q_i] = Wh
# [Q_s] = Wh (script erfordert kWh!)
python_10 = GhPythonScript(Q_T=python_8, Q_V=python_9, Q_i=python_6, Q_s=c_script_2.Q_s)  # -> gamma
# ---------- python_10: Python ----------
"""Wärmeeintrag/-verlust-Verhältnis.
    Inputs:
        Q_T:        Transmissionswärmeverluste in Wh
        Q_V:        Lüftungswärmeverluste in Wh
        Q_i:        Interne Wärmeeinträge in Wh
        Q_s:        Solare Wärmeeinträge in kWh
    Output:
        gamma:      Wärmeeintrag/-verlust-Verhältnis"""

__author__ = "A/S ETH"
__version__ = "2020.04.18"

import rhinoscriptsyntax as rs

gamma = (Q_i + Q_s*1000) / (Q_T + Q_V)
# ---------- end python_10 ----------

# ----
# Ausnutzungsgrad für Wärmegewinne
panel_4 = Panel("""eta_g = (1 - gamma^a) / (1 - gamma^(a+1))
a = 1 + tau / 15
[eta_g] = -
[gamma] = -
[tau] = h""")
python_11 = GhPythonScript(gamma=python_10, tau=sia2024.Τ_h, Q_T=python_8, Q_V=python_9)  # -> eta_g
# ---------- python_11: Python ----------
"""Ausnutzungsgrad für Wärmegewinne.
    Inputs:
        gamma:      Wärmeeintrag/-verlust-Verhältnis
        tau:        Zeitkonstante des Gebäudes in h
        Q_T:        Transmissionswärmeverluste in Wh
        Q_V:        Lüftungswärmeverluste in Wh
    Output:
        eta_g:      Ausnutzungsgrad für Wärmegewinne"""

__author__ = "A/S ETH"
__version__ = "2020.04.18"

import rhinoscriptsyntax as rs

if Q_T + Q_V < 0:
    eta_g = 0
elif gamma==1:
    eta_g = (1 + tau / 5) / (2 + tau/15)
else:
    a = 1 + tau / 15
    eta_g = (1-gamma**a) / (1-gamma**(a+1))
# ---------- end python_11 ----------

# ---- group: PV Strom
c_script_3 = CSharpScript(mesh=hivedistsolarsimu.SolarTechMesh)  # -> out, tilt, azimuth; inputs mesh: Mesh
# ---------- c_script_3: C# ----------
    mesh.FaceNormals.ComputeFaceNormals();

    Vector3d normal = mesh.Normals[0];
 
    Point3d cen = mesh.Faces.GetFaceCenter(0);

    Vector3d vnormal = new Vector3d(0, 0, 1);
    Vector3d tiltZ0 = new Vector3d(0, 0, 1);

    double tiltValue = Vector3d.VectorAngle(normal, tiltZ0, vnormal);
    tiltValue *= (180.0 / Math.PI);


    if (tiltValue == 0)
    {
      azimuth = 0;
    }else{
      double azimuthValue = Vector3d.VectorAngle(new Vector3d(normal.X, normal.Y, 0), new Vector3d(0, 1, 0), vnormal);
      azimuth = azimuthValue * (180 / Math.PI);
    }


    tilt = tiltValue;


    Line normalLine = new Line(cen, cen + normal);
    Line azimuthLine = new Line(cen, cen + new Vector3d(0, 1, 0));
    Line tiltLine = new Line(cen, cen + tiltZ0);
//    A = normalLine;
//    B = azimuthLine;
//    C = tiltLine;
//    D = mesh;
# ---------- end c_script_3 ----------
simplepanel_2 = SimplePanel(
    Tilt=c_script_3.tilt,
    Azimuth=c_script_3.azimuth,
    DHI=epw_reader.DHI,
    DNI=epw_reader.DNI,
    Latitude=epw_reader.Latitude,
    Longitude=epw_reader.Longitude)
python_12 = GhPythonScript(x=simplify(simplepanel_2), month=[0, 1, 2, 3, 4, 5, 6, 7, 8, 9, 10, 11])  # -> out, a; inputs x: list, month: Int32; same code as python_2
c_script_4 = CSharpScript(G=python_12.a, A_w=hiveiodistrsupsys.PVAreas, g=hiveiodistrsupsys.EfficiencyPV)  # -> out, Q_s; inputs G: tree of Double, A_w: list of Double, g: list of Double
# ---------- c_script_4: C# ----------
    int winCount = G.BranchCount;
    double [] Q_array = new double[12];

    DataTree<double> doubleTree = new DataTree<double>();
    for (int i = 0; i < G.BranchCount; i++)
    {
      for (int j = 0; j < G.Branch(i).Count; ++j) // should be 12, 1 for each month of the year
      {
        GH_Path path = new GH_Path(i, j);
        double irrad = G.Branch(i)[j] * A_w[i] * g[i];
        doubleTree.Add(irrad, path);

        Q_array[j] += irrad;
      }
    }

    Q_s = Q_array;
# ---------- end c_script_4 ----------
ma = MassAddition(Input=hiveiodistrsupsys.PVAreas)  # -> Result, PartialResults
ma_2 = MassAddition(Input=c_script_4.Q_s)  # -> Result, PartialResults
division = Division(A=ma_2.Result, B=ma.Result)

# ----
# Heizwärmebedarf
# Q_H = Q_T + Q_V - eta_g * (Q_i + Q_s)
# [Q_H] = Wh (script errechnet kWh!)
# [Q_T] = Wh
# [Q_V] = Wh
# [Q_i] = Wh
# [Q_s] = Wh (script erfordert kWh!)
# [eta_g] = -
python_13 = GhPythonScript(Q_T=python_8, Q_V=python_9, Q_i=python_6, Q_s=c_script_2.Q_s, eta_g=python_11)  # -> Q_H
# ---------- python_13: Python ----------
"""Heizwärmebedarf.
    Inputs:
        Q_T:    Transmissionswärmeverluste in Wh
        Q_V:    Lüftungswärmeverluste in Wh
        Q_i:    Interne Wärmeeinträge in Wh
        Q_s:    Solare Wärmeeinträge in kWh
        eta_g:  Ausnutzungsgrad für Wärmerückgewinnung
    Output:
        Q_H:    Heiwärmebedarf in kWh"""

__author__ = "A/S ETH"
__version__ = "2020.04.19"

import rhinoscriptsyntax as rs

Q_H = Q_T + Q_V - eta_g * (Q_i + Q_s*1000)
if Q_H < 0:
    Q_H = 0
Q_H /= 1000
# ---------- end python_13 ----------
ma_3 = MassAddition(Input=python_13)  # -> Result, PartialResults
division_2 = Division(A=ma_3.Result, B=distributorsia.ZoneAreas)

q_h = ClusterOutput(python_13)
R = ClusterOutput(ma_2.Result)
R_2 = ClusterOutput(ma_3.Result)
R_3 = ClusterOutput(division_2)
R_4 = ClusterOutput(division)

# ---- group: providing heat with heatpump
simple_hp = SimpleHp(Q_th=python_13, COP="3.5")
ma_4 = MassAddition(Input=simple_hp)  # -> Result, PartialResults
division_3 = Division(A=ma_4.Result, B=distributorsia.ZoneAreas)

# ----
R_5 = ClusterOutput(ma_4.Result)
R_6 = ClusterOutput(division_3)

# ---- group: Wärmepumpe Strom abzgl. PV Strom
subtraction_2 = Subtraction(A=simple_hp, B=c_script_4.Q_s)

# ----
R_7 = ClusterOutput(subtraction_2)
