# Grasshopper definition EuKS2_03_Hive_SolarSimulation.gh (Grasshopper 1.0.7)
# plug-ins: HiveIO, Hive.Core.sia380Parameters, GHSolar

rooms_standard = RoomsStandard({"1.1 Wohnen Mehrfamilienhaus": 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, "1.2 Wohnen Einfamilienhaus": {"description": "1.2 Wohnen Einfamilienhaus", "Raumlufttemperatur Auslegung Heizen (Winter)": 21.0, "Nettogeschossflaeche": 20.0, "Thermische Gebaeudehuellflaeche": 38.0, "U-Wert Fenster": 1.2, "Waermeeintragsleistung Personen (bei 24.0 deg C, bzw. 70 W)": 1.3999999999999999, "Jaehrliche Vollaststunden der Geraete": 1780.0, "U-Wert opake Bauteile": 0.20000000000000001, "Jaehrliche Vollaststunden der Raumbeleuchtung": 1450.0, "Vollaststunden pro Jahr (Personen)": 4090.0, "Abminderungsfaktor fuer Fensterrahmen": 0.75, "Aussenluft-Volumenstrom durch Infiltration": 0.14999999999999999, "Raumlufttemperatur Auslegung Kuehlung (Sommer)": 26.0, "Glasanteil": 30.0, "Zeitkonstante": 164.0, "Waermeeintragsleistung der Raumbeleuchtung": 2.7000000000000002, "Waermeeintragsleistung der Geraete": 8.0, "Gesamtenergiedurchlassgrad Verglasung": 0.5, "Temperatur-Aenderungsgrad der Waermerueckgewinnung": 0.69999999999999996, "Aussenluft-Volumenstrom (pro NGF)": 0.59999999999999998}, "2.1 Hotelzimmer": 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, "2.2 Empfang, Lobby": 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, "3.1 Einzel-, Gruppenbuero": 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, "3.2 Grossraumbuero": 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, "3.3 Sitzungszimmer": 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, "3.4 Schalterhalle, Empfang": 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, "4.1 Schulzimmer": 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, "4.2 Lehrerzimmer": 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}, selected="1.2 Wohnen Einfamilienhaus")
rooms_existing = RoomsExisting({"1.1 Wohnen Mehrfamilienhaus": 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, "1.2 Wohnen Einfamilienhaus": {"description": "1.2 Wohnen Einfamilienhaus", "Raumlufttemperatur Auslegung Heizen (Winter)": 21.0, "Nettogeschossflaeche": 20.0, "Thermische Gebaeudehuellflaeche": 38.0, "U-Wert Fenster": 1.5, "Waermeeintragsleistung Personen (bei 24.0 deg C, bzw. 70 W)": 1.3999999999999999, "Jaehrliche Vollaststunden der Geraete": 1780.0, "U-Wert opake Bauteile": 0.80000000000000004, "Jaehrliche Vollaststunden der Raumbeleuchtung": 1450.0, "Vollaststunden pro Jahr (Personen)": 4090.0, "Abminderungsfaktor fuer Fensterrahmen": 0.75, "Aussenluft-Volumenstrom durch Infiltration": 0.29999999999999999, "Raumlufttemperatur Auslegung Kuehlung (Sommer)": 26.0, "Glasanteil": 30.0, "Zeitkonstante": 56.0, "Waermeeintragsleistung der Raumbeleuchtung": 2.7000000000000002, "Waermeeintragsleistung der Geraete": 10.0, "Gesamtenergiedurchlassgrad Verglasung": 0.65000000000000002, "Temperatur-Aenderungsgrad der Waermerueckgewinnung": NaN, "Aussenluft-Volumenstrom (pro NGF)": 0.59999999999999998}, "2.1 Hotelzimmer": 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, "2.2 Empfang, Lobby": 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, "3.1 Einzel-, Gruppenbuero": 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, "3.2 Grossraumbuero": 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, "3.3 Sitzungszimmer": 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, "3.4 Schalterhalle, Empfang": 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, "4.1 Schulzimmer": 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, "4.2 Lehrerzimmer": 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}, selected="1.2 Wohnen Einfamilienhaus")

# ---- group: Pfad zur Wetterdatei (*.epw)
# EuKS2 - Heizwärmebedarf und PV Ertrag (simuliert)
# Berechnungen zur Abschätzung des Wärmebedarfs.
# Basiert auf der Excel Tabelle "Interaktion Struktur, Klima und Wärmebedarf.xlsx"
# 
# Sonneneinstrahlung simuliert gemäss "Waibel, C., Evins, R., Carmeliet, J. 2017. Efficient time-resolved 3D solar potential modelling. Solar Energy 158 (2017) 960–976."
panel = Panel("C:\EnergyPlusV9-1-0\WeatherData\USA_CA_San.Francisco.Intl.AP.724940_TMY3.epw")

# ----
rooms_ideal = RoomsIdeal({"1.1 Wohnen Mehrfamilienhaus": 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, "1.2 Wohnen Einfamilienhaus": {"description": "1.2 Wohnen Einfamilienhaus", "Raumlufttemperatur Auslegung Heizen (Winter)": 21.0, "Nettogeschossflaeche": 20.0, "Thermische Gebaeudehuellflaeche": 38.0, "U-Wert Fenster": 0.90000000000000002, "Waermeeintragsleistung Personen (bei 24.0 deg C, bzw. 70 W)": 1.3999999999999999, "Jaehrliche Vollaststunden der Geraete": 1780.0, "U-Wert opake Bauteile": 0.10000000000000001, "Jaehrliche Vollaststunden der Raumbeleuchtung": 1110.0, "Vollaststunden pro Jahr (Personen)": 4090.0, "Abminderungsfaktor fuer Fensterrahmen": 0.75, "Aussenluft-Volumenstrom durch Infiltration": 0.14999999999999999, "Raumlufttemperatur Auslegung Kuehlung (Sommer)": 26.0, "Glasanteil": 30.0, "Zeitkonstante": 238.0, "Waermeeintragsleistung der Raumbeleuchtung": 1.7, "Waermeeintragsleistung der Geraete": 4.0, "Gesamtenergiedurchlassgrad Verglasung": 0.5, "Temperatur-Aenderungsgrad der Waermerueckgewinnung": 0.80000000000000004, "Aussenluft-Volumenstrom (pro NGF)": 0.59999999999999998}, "2.1 Hotelzimmer": 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, "2.2 Empfang, Lobby": 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, "3.1 Einzel-, Gruppenbuero": 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, "3.2 Grossraumbuero": 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, "3.3 Sitzungszimmer": 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, "3.4 Schalterhalle, Empfang": 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, "4.1 Schulzimmer": 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, "4.2 Lehrerzimmer": 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}, selected="1.2 Wohnen Einfamilienhaus")

# ---- group: PV Fläche
srf = Surface(<surface referenced from the Rhino model>)

# ---- group: Boden
mesh = Mesh(<mesh referenced from the Rhino model>)

# ---- group: Gebäudevolumen
brep = Brep(<brep referenced from the Rhino model>)

# ----
mesh_uv = MeshSurface(Surface=srf, UCount="6", VCount="6", Overhang=True, Equalize=False)

# ---- group: Umgebungsbebauung
mesh_2 = Mesh([<mesh referenced from the Rhino model> x2796])

# ---- group: Fensterflächen
srf_2 = Surface([<surface referenced from the Rhino model> x5])

# ----
hiveinputenergysystems = InputEnergySystemsHive(
    MeshSolarTechnologyProperties=mesh_uv,
    conversions="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",
    emitters="""{
  "$type": "Hive.IO.Forms.EmitterPropertiesViewModel[], Hive.IO",
  "$values": []
}""",
    meshConnections="""{
  "$type": "System.Collections.Generic.Dictionary`2[[System.Int32, mscorlib],[System.Int32, mscorlib]], mscorlib",
  "0": 0
}""",
    meshes="""{
  "$type": "Hive.IO.Forms.SurfaceViewModel[], Hive.IO",
  "$values": [
    {
      "$type": "Hive.IO.Forms.SurfaceViewModel, Hive.IO",
      "Name": "srf0",
      "Area": 72.761414769930553
    }
  ]
}""")
hiveinputbuilding = InputBuildingHive(ZoneGeometry=brep, WindowsSurfaces=srf_2, SIA2024Room=rooms_ideal, SiaRoom="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")
hive_io_env = HiveIOEnvironment(EPWPath=panel, ObstaclesGeometry=[mesh, mesh_2])
cluster = Cluster(hiveinputs=[hiveinputenergysystems, hive_io_env, hiveinputbuilding])  # -> solarmesh, q_h, E, data_3, q_s_2, q_s_3, results_2, M, results, q_s

# ---- group: Heizwärmebedarf, Strombedarf Wärmepumpe und Stromertrag PV
# Jahresheizwärmebedarf in kWh
# Jahresstrombedarf Wärmepumpe in kWh
# Jahresstromertrag PV in kWh
# Jahresheizwärmebedarf in kWh/m^2
# Jahresstrombedarf Wärmepumpe in kWh/m^2
# Jahresstromertrag PV in kWh/m^2 PV
panel_2 = Panel(cluster.data_3)

# ---- group: Strombedarf Wärmepumpe
data = Data(cluster.E)

# ---- group: Wärmebedarf
data_2 = Data(cluster.q_h)

# ---- group: PV
data_3 = Data(cluster.q_s_3)

# ---- group: solare Wärmegewinne
data_4 = Data(cluster.q_s_2)

# ---- group: solare Wärmegewinne simuliert
data_5 = Data(cluster.q_s)

# ----
graph = QuickGraph(data_2, SortOrder=0)
graph_2 = QuickGraph(data, SortOrder=0)
graph_3 = QuickGraph(data_3, SortOrder=0)
graph_4 = QuickGraph([data_5, data_4], SortOrder=0)

# ---- group: Sonnenstandsdiagrammm
distepw = DistributorEPW(EPWFilepath=panel, WriteLists=Toggle(True))  # -> EPW, Latitude, Longitude, CityCountry, GHI, DNI, DHI, DryBulb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
pt = Point(Point(25.44273959, -13.55326394, 0))
skydome = GHSkydome(
    RecursionLevel=Slider(5, range=0..5),
    Viewfactors=Toggle(False),
    SunPath=Toggle(False),
    SolarVec=False,
    HOY=1,
    Location=[distepw.Longitude, distepw.Latitude],
    Size="0.3",
    Context=mesh_2,
    Sp=pt,
    Timezone=0)  # -> Mesh, Vectors, Sunpaths, SunGeo

# ---- group: Visualisierung Sonneneinstrahlung
number_slider = Slider(200, range=0..1500)
number_slider_2 = Slider(1200, range=0..1500)
visumshsol = VisualizeMeshSolar(Mesh=cluster.M, I=cluster.results, Value=0, Min=number_slider, Max=number_slider_2, Clr=1)
visumshsol_2 = VisualizeMeshSolar(Mesh=cluster.solarmesh, I=cluster.results_2, Value=0, Min=number_slider, Max=number_slider_2, Clr=1)

# ==== cluster Cluster
hiveinputs = ClusterInput()
hivedistributor = MainDistributorHive(HiveInputs=flatten(hiveinputs))  # -> HiveBuilding, HiveEnvironment, HiveEnergySystemsSurfaceBasedTech, HiveEnergySystemsConversionTech, HiveEnergySystemsEmitter
distributorsia = DistributorSIA(BuildingObj=hivedistributor.HiveBuilding)  # -> ZoneAreas, WindowsAreas, ExtSrfAreas, SIA2024json, AllExternalSurfaceAreas, SurfaceType, SUA2024Schedules, UseAdaptiveComfort, UseNaturalVentilation, UseFixedTimeConstant
distributorepw = DistributorEPW(EnvironmentObj=hivedistributor.HiveEnvironment)  # -> Filepath, NaturalGas, BioGas, WoodPellets, DistrictHeating, DistrictCooling, GridElectricity, AmbientAirTemp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
hivedistsolarsimu = DistributorSolarSimulationHive(
    HiveBuilding=hivedistributor.HiveBuilding,
    HiveSolarTechnologies=hivedistributor.HiveEnergySystemsSurfaceBasedTech,
    HiveEnvironment=hivedistributor.HiveEnvironment)  # -> EnvironmentMesh, BuildingCentroid, ExternalSurfaces, WindowGeometries, WindowTilt, WindowAzimuth, WindowAreas, SolarTechMesh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
hiveiodistrsupsys = HiveIODistributorSupplySystem(HiveIOEnergySystemPV=hivedistributor.HiveEnergySystemsSurfaceBasedTech)  # -> EfficiencyPV, PVAreas, EfficiencyST, STAreas, ElectricEfficiencyPVT, ThermalEfficiencyPVT, PVTAreas
solarmesh = ClusterOutput(hivedistsolarsimu.SolarTechMesh)
sia2024 = SIA2024Rooms(
    Room=distributorsia.SIA2024json,
    Area=distributorsia.ZoneAreas,
    Month=[1, 2, 3, 4, 5, 6, 7, 8, 9, 10, 11, 12],
    Season="winter")  # -> Τ_h, Θ_i_C, T_h, A_op_m2, A_w_m2, U_op_W_m2K, U_w_W_m2K, V_e_m3_h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
epw_reader = EPWReader(Path=distributorepw.Filepath)  # -> Latitude, Longitude, CityCountry, GHI, DNI, DHI, DryBulb, DewPoint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
python = GhPythonScript(x=epw_reader.DryBulb, month=[0, 1, 2, 3, 4, 5, 6, 7, 8, 9, 10, 11])  # -> out, a; inputs x: list, month: Int32
# ---------- python: Python ----------
__author__ = "chwaibel"
__version__ = "2020.02.25"

import rhinoscriptsyntax as rs

# 8760 time series
# get monthly average...
# how to know how many days a month? somewhere, I have typical year.
# in some honey-badger script

dayspermonth = [31.0, 28.0, 31.0, 30.0, 31.0, 30.0, 31.0, 31.0, 30.0, 31.0, 30.0, 31.0]

hour_per_day = 24
start_hour = int(hour_per_day * sum(dayspermonth[0:month])) 
end_hour = int(hour_per_day * sum(dayspermonth[0:month+1]))

cumulative_data = sum(x[start_hour:end_hour])
hours_per_month = (dayspermonth[month] * hour_per_day)

a = cumulative_data / hours_per_month
# ---------- end python ----------
python_2 = GhPythonScript(x=epw_reader.GHI, month=[0, 1, 2, 3, 4, 5, 6, 7, 8, 9, 10, 11])  # -> out, a; inputs x: list, month: Int32
# ---------- python_2: Python ----------
__author__ = "chwaibel"
__version__ = "2020.02.25"

import rhinoscriptsyntax as rs

# 8760 time series
# get monthly average...
# how to know how many days a month? somewhere, I have typical year.
# in some honey-badger script

dayspermonth = [31.0, 28.0, 31.0, 30.0, 31.0, 30.0, 31.0, 31.0, 30.0, 31.0, 30.0, 31.0]

hour_per_day = 24
start_hour = int(hour_per_day * sum(dayspermonth[0:month])) 
end_hour = int(hour_per_day * sum(dayspermonth[0:month+1]))

cumulative_data = sum(x[start_hour:end_hour])

a = cumulative_data / 1000
# ---------- end python_2 ----------

# ----
# Transmissions-Wärmetransferkoeffizient
# H_T = A_op * U_op + A_w * U_w
# [H_T] = W/K
# [A_op] = m^2
# [A_w] = m^2
# [U_op] = W/(m^2K)
# [U_w] = W/(m^2K)
subtraction = Subtraction(A=distributorsia.ExtSrfAreas, B=distributorsia.WindowsAreas)
python_3 = GhPythonScript(A_op=subtraction, U_op=sia2024.U_op_W_m2K, A_w=distributorsia.WindowsAreas, U_w=sia2024.U_w_W_m2K)  # -> H_T
# ---------- python_3: Python ----------
"""Transmissions-Wärmetransferkoeffizient in W/K.
    Inputs:
        A_op:   Aussenwandfläche (opak) in m^2
        U_op:   Wärmedurchgangskoeffizient Aussenwand (opak) in W/m^2K
        A_w:    Aussenwandläche (transparent) in m^2
        U_w:    Wärmedurchgangskoeffizient Aussenwand (transparent) in W/m^2K
    Output:
        H_T:    Transmissions-Wärmetransferkoeffizient in W/K"""

__author__ = "A/S ETH"
__version__ = "2020.04.18"

import rhinoscriptsyntax as rs

H_T = A_op * U_op + A_w * U_w
# ---------- end python_3 ----------

# ----
# Thermisch wirksamer Aussenluftvolumenstrom
# Vdot_th = Vdot_e * (1 - eta_rec) * Vdot_inf
# [Vdot_th] = m^3/h oder m^3/s
# [Vdot_e] = m^3/h oder m^3/s
# [Vdot_inf] = m^3/h oder m^3/s
# [eta_rec] = -
python_4 = GhPythonScript(Vdot_e=sia2024.V_e_m3_h, Vdot_inf=sia2024.V_inf_m3_h, eta_rec=sia2024.Η_rec_)  # -> Vdot_th
# ---------- python_4: Python ----------
"""Thermisch wirksamer Aussenluftvolumenstrom.
    Inputs:
        Vdot_e:         Aussenluft-Volumenstrom durch Lüftung in m^3/h
        Vdot_inf:       Aussenluft-Volumenstrom durch Infiltration in m^3/h
        eta_rec:        Nutzungsgrad der Wärmerückgewinnung
    Output:
        Vdot_th:        Thermisch wirksamer Aussenluft Volumenstrom in m^3/h"""

__author__ = "A/S ETH"
__version__ = "2020.04.18"

import rhinoscriptsyntax as rs
import math

if math.isnan(eta_rec):
    eta_rec = 0
Vdot_th = Vdot_e * (1-eta_rec) + Vdot_inf
# ---------- end python_4 ----------

# ----
# Interne Wärmeeinträge
# Q_i = Phi_P * t_P + Phi_B * t_B + Phi_G * t_G
# [Q_i] = Wh
# [Phi_P,B,G] = W
# [t_P,B,G] = h
python_5 = GhPythonScript(Phi_P=sia2024.Φ_P_W, t_P=sia2024.T_P_h, Phi_B=sia2024.Φ_L_W, t_B=sia2024.T_L_h, Phi_G=sia2024.Φ_G_W, t_G=sia2024.T_A_h)  # -> Q_i
# ---------- python_5: Python ----------
"""Interne Wärmeeinträge in Wh.
    Inputs:
        Phi_P:      Wärmeagbage Personen in W
        t_P:        Vollaststunden Personen in h
        Phi_B:      Wärmeabgabe Beleuchtung in W
        t_B:        Vollaststunden Beleuchtung in h
        Phi_G:      Wärmeabgabe Geräte in W
        t_G:        Vollaststunden Geräte in h
    Output:
        Q_i:        Interne Wärmeeinträge in Wh"""

__author__ = "A/S ETH"
__version__ = "2020.04.18"

import rhinoscriptsyntax as rs

Q_i = Phi_P*t_P + Phi_B * t_B + Phi_G * t_G
# ---------- end python_5 ----------

# ----
# Aussenlufttemperatur
panel = Panel(python.a)

# ----
# Lüftungs-Wärmetransferkoeffizient
# H_V = Vdot_th * rho * c_p
# [H_V] = W/K
# [Vdot_th] = m^3/s
# [rho] = kg/m^3
# [c_p] = J/(kgK)
panel_2 = Panel("1.2")
python_6 = GhPythonScript(Vdot_th=python_4, rho=panel_2, c_p="1005")  # -> H_V
# ---------- python_6: Python ----------
"""Lüftungs-Wärmetransferkoeffizient.
    Inputs:
        Vdot_th:    Thermisch wirksamer Aussenluft-Volumenstrom in m^3/s
        rho:        Luftdichte in kg/m^3
        c_p:        Spezifische Wärmekapazität Luft in J/kgK
    Output:
        H_V:        Lüftungs-Wärmetransferkoeffizient in W/K"""

__author__ = "A/S ETH"
__version__ = "2020.04.18"

import rhinoscriptsyntax as rs

H_V = Vdot_th/3600 * rho * c_p
# ---------- end python_6 ----------

# ----
# Transmissionswärmeverluste
# Q_T = H_T * (T_i + T_e) * t
# [Q_T] = Wh
# [H_T] = W/K
# [T_i] = K oder °C
# [T_e] = K oder °C
# [t] = h
python_7 = GhPythonScript(H_T=python_3, T_i=sia2024.Θ_i_C, T_e=panel, t=sia2024.T_h)  # -> Q_T
# ---------- python_7: Python ----------
"""Transmissionswärmeverluste in Wh.
    Inputs:
        H_T:    Transmissions-Wärmetransferkoeffizient in W/K
        T_i:    Raumlufttemperatur in °C oder K
        T_e:    Aussenlufttemperatur in °C oder K
        t:      Länger der Berechnungsperiode in h
    Output:
        Q_T:    Transmissionswärmeverluste in Wh"""

__author__ = "A/S ETH"
__version__ = "2020.04.18"

import rhinoscriptsyntax as rs

Q_T = H_T * (T_i - T_e) * t
# ---------- end python_7 ----------

# ----
# Lüftungswärmeverluste
# Q_V = H_V * (T_i - T_e) * t
# [Q_V] = Wh
# [H_V] = W/K
# [T_i] = K oder °C
# [T_e] = K oder °C
# [t] = h
python_8 = GhPythonScript(H_V=python_6, T_i=sia2024.Θ_i_C, T_e=panel, t=sia2024.T_h)  # -> Q_V
# ---------- python_8: Python ----------
"""Lüftungswärmeverluste in Wh.
    Inputs:
        H_V:    Lüftungs-Wärmetransferkoeffizient in W/K
        T_i:    Raumlufttemperatur in °C oder K
        T_a:    Aussenlufttemperatur in °C oder K
        t:      Länge der Berechnungsperiode in h
    Output:
        Q_V:    Lüftungswärmeverluste in Wh"""

__author__ = "A/S ETH"
__version__ = "2020.04.18"

import rhinoscriptsyntax as rs

Q_V = H_V * (T_i - T_e) * t
# ---------- end python_8 ----------

# ----
# PV Ertrag (simuliert)
data = Data([0.8, 0.8, 0.8, 0.8, 0.8, 0.8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])
mesh = Mesh(hivedistsolarsimu.ExternalSurfaces)
obstobj = ObstacleObject(
    Mesh=[hivedistsolarsimu.EnvironmentMesh, mesh],
    Albedo=data,
    SpecCoeff=data,
    ReflType=0,
    Tolerance=0.01,
    Name="PV",
    MT=True)
obstobj_2 = ObstacleObject(Mesh=hivedistsolarsimu.SolarTechMesh, Albedo=data, SpecCoeff=data, ReflType=0, Tolerance=0.01, Name="PV", MT=True)
irrmshy = IrradiationMeshYear(
    AnalysisObjects=obstobj_2,
    ObstacleObjects=obstobj,
    Latitude=epw_reader.Latitude,
    Longitude=epw_reader.Longitude,
    Year=2017,
    DNI=epw_reader.DNI,
    DHI=epw_reader.DHI,
    MainSkyRes=1,
    SpecBounces=0,
    DiffIReflSkyRes=0,
    DiffIReflMode=2,
    MT=True,
    Timezone=0)
readresults = ReadResults(Mesh=hivedistsolarsimu.SolarTechMesh, I=irrmshy, Value=7)  # -> Results, SP
python_9 = GhPythonScript(x=simplify(readresults.Results), month=[0, 1, 2, 3, 4, 5, 6, 7, 8, 9, 10, 11])  # -> out, a; inputs x: list, month: Int32; same code as python_2
c_script = CSharpScript(G=python_9.a, g=hiveiodistrsupsys.EfficiencyPV)  # -> out, Q_s; inputs G: tree of Double, g: list of Double
# ---------- c_script: C# ----------
    int winCount = G.BranchCount;
    double [] Q_array = new double[12];

    DataTree<double> doubleTree = new DataTree<double>();
    for (int i = 0; i < G.BranchCount; i++)
    {
      for (int j = 0; j < G.Branch(i).Count; ++j) // should be 12, 1 for each month of the year
      {
        GH_Path path = new GH_Path(i, j);
        double irrad = G.Branch(i)[j]  * g[i];
        doubleTree.Add(irrad, path);

        Q_array[j] += irrad;
      }
    }

    Q_s = Q_array;
# ---------- end c_script ----------
ma = MassAddition(Input=c_script.Q_s)  # -> Result, PartialResults
ma_2 = MassAddition(Input=hiveiodistrsupsys.PVAreas)  # -> Result, PartialResults
division = Division(A=ma.Result, B=ma_2.Result)

# ----
# Solare Wärmeeinträge
mesh_2 = MeshBrep(
    Brep=hivedistsolarsimu.WindowGeometries,
    Settings={GridMaxCount=0, GridMinCount=16, JaggedSeams=False, MaxEdgeLength=0, MinEdgeLength=0.0001, MinTolerance=0, Refine=True, RefineAngle=0, RelativeTolerance=0.65, SimplePlanes=True, Tolerance=0})
obstobj_3 = ObstacleObject(Mesh=mesh_2, Albedo=data, SpecCoeff=data, ReflType=0, Tolerance=0.01, Name="PV", MT=True)
irrmshy_2 = IrradiationMeshYear(
    AnalysisObjects=obstobj_3,
    ObstacleObjects=obstobj,
    Latitude=epw_reader.Latitude,
    Longitude=epw_reader.Longitude,
    Year=2017,
    DNI=epw_reader.DNI,
    DHI=epw_reader.DHI,
    MainSkyRes=1,
    SpecBounces=0,
    DiffIReflSkyRes=0,
    DiffIReflMode=2,
    MT=True,
    Timezone=0)
readresults_2 = ReadResults(Mesh=mesh_2, I=irrmshy_2, Value=7)  # -> simplify(Results), SP
python_10 = GhPythonScript(x=simplify(readresults_2.Results), month=[0, 1, 2, 3, 4, 5, 6, 7, 8, 9, 10, 11])  # -> out, a; inputs x: list, month: Int32; same code as python_2
item = ListItem(List=sia2024.G_, Index=0, Wrap=True)
c_script_2 = CSharpScript(G=python_10.a, g=item)  # -> out, Q_s; inputs G: tree of Double, g: Double
# ---------- c_script_2: C# ----------
    int winCount = G.BranchCount;
    double [] Q_array = new double[12];

    DataTree<double> doubleTree = new DataTree<double>();
    for (int i = 0; i < G.BranchCount; i++)
    {
      for (int j = 0; j < G.Branch(i).Count; ++j) // should be 12, 1 for each month of the year
      {
        GH_Path path = new GH_Path(i, j);
        double irrad = G.Branch(i)[j] *  g;
        doubleTree.Add(irrad, path);

        Q_array[j] += irrad;
      }
    }

    Q_s = Q_array;
# ---------- end c_script_2 ----------
panel_3 = Panel(c_script_2.Q_s)

M = ClusterOutput(mesh_2)
results = ClusterOutput(irrmshy_2)

# ----
# Solare Wärmeeinträge
# Q_s = G * F_F * A_w * g
# [Q_s] = kWh
# [G] = kWh/m^2
# [F_F] = -
# [A_w] = m^2
# [g] = -
c_script_3 = CSharpScript(x=hivedistsolarsimu.WindowGeometries)  # -> out, tilt, azimuth, area; inputs x: Brep
# ---------- c_script_3: C# ----------
    Surface srf = x.Surfaces[0];

    AreaMassProperties massProp = AreaMassProperties.Compute(srf);
    Point3d cen = massProp.Centroid;
    double u,v;
    srf.ClosestPoint(cen, out u, out v);
    Vector3d normal = srf.NormalAt(u, v);

    if(x.Faces[0].OrientationIsReversed)
      normal.Reverse();

    Vector3d vnormal = new Vector3d(0, 0, 1);
    Vector3d tiltZ0 = new Vector3d(0, 0, 1);

    double tiltValue = Vector3d.VectorAngle(normal, tiltZ0, vnormal);
    tilt = tiltValue * (180.0 / Math.PI);

    double azimuthValue = Vector3d.VectorAngle(new Vector3d(normal.X, normal.Y, 0), new Vector3d(0, 1, 0), vnormal);
    azimuth = azimuthValue * (180 / Math.PI);

//    Line normalLine = new Line(cen, cen + normal);
//    Line azimuthLine = new Line(cen, cen + new Vector3d(0, 1, 0));
//    Line tiltLine = new Line(cen, cen + tiltZ0);
//    A = normalLine;
//    B = azimuthLine;
//    C = tiltLine;


    area = AreaMassProperties.Compute(x.Faces[0]).Area;
# ---------- end c_script_3 ----------
simplepanel = SimplePanel(
    Tilt=c_script_3.tilt,
    Azimuth=c_script_3.azimuth,
    DHI=epw_reader.DHI,
    DNI=epw_reader.DNI,
    Latitude=epw_reader.Latitude,
    Longitude=epw_reader.Longitude)
python_11 = GhPythonScript(x=simplify(simplepanel), month=[0, 1, 2, 3, 4, 5, 6, 7, 8, 9, 10, 11])  # -> out, a; inputs x: list, month: Int32; same code as python_2
c_script_4 = CSharpScript(G=python_11.a, A_w=c_script_3.area, g=item)  # -> out, Q_s; inputs G: tree of Double, A_w: list of Double, g: Double
# ---------- c_script_4: C# ----------
    int winCount = G.BranchCount;
    double [] Q_array = new double[12];

    DataTree<double> doubleTree = new DataTree<double>();
    for (int i = 0; i < G.BranchCount; i++)
    {
      for (int j = 0; j < G.Branch(i).Count; ++j) // should be 12, 1 for each month of the year
      {
        GH_Path path = new GH_Path(i, j);
        double irrad = G.Branch(i)[j] * A_w[i] * g;
        doubleTree.Add(irrad, path);

        Q_array[j] += irrad;
      }
    }

    Q_s = Q_array;
# ---------- end c_script_4 ----------
panel_4 = Panel(c_script_4.Q_s)

q_s = ClusterOutput(c_script_2.Q_s)
q_s_2 = ClusterOutput(c_script_4.Q_s)

# ----
# Wärmeeintrag/-verlust-Verhältnis
# gamma = (Q_i + Q_s) / (Q_T + Q_V)
# [gamma] = -
# [Q_T] = Wh
# [Q_V] = Wh
# [Q_i] = Wh
# [Q_s] = Wh (script erfordert kWh!)
python_12 = GhPythonScript(Q_T=python_7, Q_V=python_8, Q_i=python_5, Q_s=c_script_2.Q_s)  # -> gamma
# ---------- python_12: Python ----------
"""Wärmeeintrag/-verlust-Verhältnis.
    Inputs:
        Q_T:        Transmissionswärmeverluste in Wh
        Q_V:        Lüftungswärmeverluste in Wh
        Q_i:        Interne Wärmeeinträge in Wh
        Q_s:        Solare Wärmeeinträge in kWh
    Output:
        gamma:      Wärmeeintrag/-verlust-Verhältnis"""

__author__ = "A/S ETH"
__version__ = "2020.04.18"

import rhinoscriptsyntax as rs

gamma = (Q_i + Q_s*1000) / (Q_T + Q_V)
# ---------- end python_12 ----------

# ----
# Ausnutzungsgrad für Wärmegewinne
panel_5 = Panel("""eta_g = (1 - gamma^a) / (1 - gamma^(a+1))
a = 1 + tau / 15
[eta_g] = -
[gamma] = -
[tau] = h""")
python_13 = GhPythonScript(gamma=python_12, tau=sia2024.Τ_h, Q_T=python_7, Q_V=python_8)  # -> eta_g
# ---------- python_13: Python ----------
"""Ausnutzungsgrad für Wärmegewinne.
    Inputs:
        gamma:      Wärmeeintrag/-verlust-Verhältnis
        tau:        Zeitkonstante des Gebäudes in h
        Q_T:        Transmissionswärmeverluste in Wh
        Q_V:        Lüftungswärmeverluste in Wh
    Output:
        eta_g:      Ausnutzungsgrad für Wärmegewinne"""

__author__ = "A/S ETH"
__version__ = "2020.04.18"

import rhinoscriptsyntax as rs

if Q_T + Q_V < 0:
    eta_g = 0
elif gamma==1:
    eta_g = (1 + tau / 5) / (2 + tau/15)
else:
    a = 1 + tau / 15
    eta_g = (1-gamma**a) / (1-gamma**(a+1))
# ---------- end python_13 ----------

results_2 = ClusterOutput(irrmshy)

# ----
# Heizwärmebedarf
# Q_H = Q_T + Q_V - eta_g * (Q_i + Q_s)
# [Q_H] = Wh (script errechnet kWh!)
# [Q_T] = Wh
# [Q_V] = Wh
# [Q_i] = Wh
# [Q_s] = Wh (script erfordert kWh!)
# [eta_g] = -
python_14 = GhPythonScript(Q_T=python_7, Q_V=python_8, Q_i=python_5, Q_s=c_script_2.Q_s, eta_g=python_13)  # -> Q_H
# ---------- python_14: Python ----------
"""Heizwärmebedarf.
    Inputs:
        Q_T:    Transmissionswärmeverluste in Wh
        Q_V:    Lüftungswärmeverluste in Wh
        Q_i:    Interne Wärmeeinträge in Wh
        Q_s:    Solare Wärmeeinträge in kWh
        eta_g:  Ausnutzungsgrad für Wärmerückgewinnung
    Output:
        Q_H:    Heiwärmebedarf in kWh"""

__author__ = "A/S ETH"
__version__ = "2020.04.19"

import rhinoscriptsyntax as rs

Q_H = Q_T + Q_V - eta_g * (Q_i + Q_s*1000)
if Q_H < 0:
    Q_H = 0
Q_H /= 1000
# ---------- end python_14 ----------
ma_3 = MassAddition(Input=python_14)  # -> Result, PartialResults
division_2 = Division(A=ma_3.Result, B=distributorsia.ZoneAreas)

q_s_3 = ClusterOutput(c_script.Q_s)
q_h = ClusterOutput(python_14)

# ---- group: providing heat with heatpump
simple_hp = SimpleHp(Q_th=python_14, COP="3.5")
ma_4 = MassAddition(Input=simple_hp)  # -> Result, PartialResults
division_3 = Division(A=ma_4.Result, B=distributorsia.ZoneAreas)

# ----
E = ClusterOutput(simple_hp)

# ---- group: Wärmepumpe Strom abzgl. PV Strom
subtraction_2 = Subtraction(A=simple_hp, B=c_script.Q_s)

# ----
data_2 = Data([ma_3.Result, ma_4.Result, ma.Result, division_2, division_3, division])
data_3 = ClusterOutput(data_2)
