# Grasshopper definition EuKS2_04_Hive_Optimierung.gh (Grasshopper 1.0.7)
# plug-ins: HiveIO, epw-reader

# ---- group: Klimatisierte Grundfläche in m^2
# EuKS2 - Heizwärmebedarf
# Berechnungen zur Abschätzung des Wärmebedarfs.
# Basiert auf der Excel Tabelle "Interaktion Struktur, Klima und Wärmebedarf.xlsx"
number_slider = Slider(203.53, range=150..500)
panel = Panel(number_slider)

# ---- group: Fensterfläche in m^2
number_slider_2 = Slider(88.822, range=10..200)
panel_2 = Panel(number_slider_2)

# ---- group: Opake Hüllfläche in m2
number_slider_3 = Slider(301.916, range=250..800)
panel_3 = Panel(number_slider_3)

# ---- group: U-Wert opake Flächen in W/m^2K
number_slider_4 = Slider(1.117, range=0.05..2)
panel_4 = Panel(number_slider_4)

# ---- group: U-Wert Fenster in W/m^2K
number_slider_5 = Slider(2.135, range=0.1..4)
panel_5 = Panel(number_slider_5)

# ---- group: g-Wert der Verglasung
number_slider_6 = Slider(0.607, range=0.05..0.95)
panel_6 = Panel(number_slider_6)

# ---- group: Aussenluftvolumenstrom in m^3/h pro m^2
number_slider_7 = Slider(0.612, range=0.1..0.9)
panel_7 = Panel(number_slider_7)

# ---- group: Infiltration in m^3/h pro m^2
number_slider_8 = Slider(0.148, range=0.05..0.5)
panel_8 = Panel(number_slider_8)

# ---- group: Wärmerückgewinnung (Wert zwischen 0 - 1)
number_slider_9 = Slider(0, range=0..0.9)
panel_9 = Panel(number_slider_9)

# ---- group: Raumlufttemperatur (Heizperiode) in °C
number_slider_10 = Slider(21.012, range=17..25)
panel_10 = Panel(number_slider_10)

# ---- group: Zeitkonstante tau des Gebäudes in h
number_slider_11 = Slider(242.188, range=50..800)
panel_11 = Panel(number_slider_11)

# ---- group: Solver
galapagos = Galapagos(
    fitness=num,
    gene=[number_slider, number_slider_4, number_slider_7, number_slider_10, number_slider_2, number_slider_5, number_slider_8, number_slider_11, number_slider_3, number_slider_6, number_slider_9])

# ---- group: Pfad zur Wetterdatei (*.epw)
panel_12 = Panel("D:\RESEARCH\TEACHING\20_EuKS2\Draft\HIVE_Zurich.epw")

# ---- group: Formfaktor (Wert zwischen 0 - 1)
panel_13 = Panel("""0.84
0.78
0.69
0.6
0.63
0.62
0.59
0.63
0.67
0.66
0.75
0.75""")

# ----
# Interne Wärmeeinträge
# Q_i = Phi_P * t_P + Phi_B * t_B + Phi_G * t_G
# [Q_i] = Wh
# [Phi_P,B,G] = W
# [t_P,B,G] = h
panel_14 = Panel("2.7")
multiplication = Multiplication(A="1.4", B=panel)
multiplication_2 = Multiplication(A=panel_14, B=panel)
multiplication_3 = Multiplication(A="8", B=panel)
python = GhPythonScript(Phi_P=multiplication, t_P="420", Phi_B=multiplication_2, t_B="210", Phi_G=multiplication_3, t_G="183")  # -> Q_i
# ---------- python: Python ----------
"""Interne Wärmeeinträge in Wh.
    Inputs:
        Phi_P:      Wärmeagbage Personen in W
        t_P:        Vollaststunden Personen in h
        Phi_B:      Wärmeabgabe Beleuchtung in W
        t_B:        Vollaststunden Beleuchtung in h
        Phi_G:      Wärmeabgabe Geräte in W
        t_G:        Vollaststunden Geräte in h
    Output:
        Q_i:        Interne Wärmeeinträge in Wh"""

__author__ = "A/S ETH"
__version__ = "2020.04.18"

import rhinoscriptsyntax as rs

Q_i = Phi_P*t_P + Phi_B * t_B + Phi_G * t_G
# ---------- end python ----------
panel_15 = Panel(python)

# ----
# Thermisch wirksamer Aussenluftvolumenstrom
# Vdot_th = Vdot_e * (1 - eta_rec) * Vdot_inf
# [Vdot_th] = m^3/h oder m^3/s
# [Vdot_e] = m^3/h oder m^3/s
# [Vdot_inf] = m^3/h oder m^3/s
# [eta_rec] = -
multiplication_4 = Multiplication(A=panel, B=panel_7)
multiplication_5 = Multiplication(A=panel, B=panel_8)
python_2 = GhPythonScript(Vdot_e=multiplication_4, Vdot_inf=multiplication_5, eta_rec=panel_9)  # -> Vdot_th
# ---------- python_2: Python ----------
"""Thermisch wirksamer Aussenluftvolumenstrom.
    Inputs:
        Vdot_e:         Aussenluft-Volumenstrom durch Lüftung in m^3/h
        Vdot_inf:       Aussenluft-Volumenstrom durch Infiltration in m^3/h
        eta_rec:        Nutzungsgrad der Wärmerückgewinnung
    Output:
        Vdot_th:        Thermisch wirksamer Aussenluft Volumenstrom in m^3/h"""

__author__ = "A/S ETH"
__version__ = "2020.04.18"

import rhinoscriptsyntax as rs
import math

if math.isnan(eta_rec):
    eta_rec = 0
Vdot_th = Vdot_e * (1-eta_rec) + Vdot_inf
# ---------- end python_2 ----------
panel_16 = Panel(python_2)

# ----
# Transmissions-Wärmetransferkoeffizient
# H_T = A_op * U_op + A_w * U_w
# [H_T] = W/K
# [A_op] = m^2
# [A_w] = m^2
# [U_op] = W/(m^2K)
# [U_w] = W/(m^2K)
python_3 = GhPythonScript(A_op=panel_3, U_op=panel_4, A_w=panel_2, U_w=panel_5)  # -> H_T
# ---------- python_3: Python ----------
"""Transmissions-Wärmetransferkoeffizient in W/K.
    Inputs:
        A_op:   Aussenwandfläche (opak) in m^2
        U_op:   Wärmedurchgangskoeffizient Aussenwand (opak) in W/m^2K
        A_w:    Aussenwandläche (transparent) in m^2
        U_w:    Wärmedurchgangskoeffizient Aussenwand (transparent) in W/m^2K
    Output:
        H_T:    Transmissions-Wärmetransferkoeffizient in W/K"""

__author__ = "A/S ETH"
__version__ = "2020.04.18"

import rhinoscriptsyntax as rs

H_T = A_op * U_op + A_w * U_w
# ---------- end python_3 ----------
panel_17 = Panel(python_3)

# ----
# Lüftungs-Wärmetransferkoeffizient
# H_V = Vdot_th * rho * c_p
# [H_V] = W/K
# [Vdot_th] = m^3/s
# [rho] = kg/m^3
# [c_p] = J/(kgK)
panel_18 = Panel("1.2")
python_4 = GhPythonScript(Vdot_th=python_2, rho=panel_18, c_p="1005")  # -> H_V
# ---------- python_4: Python ----------
"""Lüftungs-Wärmetransferkoeffizient.
    Inputs:
        Vdot_th:    Thermisch wirksamer Aussenluft-Volumenstrom in m^3/s
        rho:        Luftdichte in kg/m^3
        c_p:        Spezifische Wärmekapazität Luft in J/kgK
    Output:
        H_V:        Lüftungs-Wärmetransferkoeffizient in W/K"""

__author__ = "A/S ETH"
__version__ = "2020.04.18"

import rhinoscriptsyntax as rs

H_V = Vdot_th/3600 * rho * c_p
# ---------- end python_4 ----------
panel_19 = Panel(python_4)

panel_20 = Panel("""0
0
0
0
0
0
0
0
0
0
0
0""")
epw_reader = EPWReader(Path=panel_12)  # -> Latitude, Longitude, CityCountry, GHI, DNI, DHI, DryBulb, DewPoint, RH
python_5 = GhPythonScript(x=epw_reader.GHI, month=[0, 1, 2, 3, 4, 5, 6, 7, 8, 9, 10, 11])  # -> out, a; inputs x: list, month: Int32
# ---------- python_5: Python ----------
__author__ = "chwaibel"
__version__ = "2020.02.25"

import rhinoscriptsyntax as rs

# 8760 time series
# get monthly average...
# how to know how many days a month? somewhere, I have typical year.
# in some honey-badger script

dayspermonth = [31.0, 28.0, 31.0, 30.0, 31.0, 30.0, 31.0, 31.0, 30.0, 31.0, 30.0, 31.0]

hour_per_day = 24
start_hour = int(hour_per_day * sum(dayspermonth[0:month])) 
end_hour = int(hour_per_day * sum(dayspermonth[0:month+1]))

cumulative_data = sum(x[start_hour:end_hour])

a = cumulative_data / 1000
# ---------- end python_5 ----------

# ---- group: Globalstrahlung in kWh/m^2
panel_21 = Panel(python_5.a)

# ----
# Solare Wärmeeinträge
# Q_s = G * F_F * A_w * g
# [Q_s] = kWh
# [G] = kWh/m^2
# [F_F] = -
# [A_w] = m^2
# [g] = -
python_6 = GhPythonScript(G=panel_21, F_F=panel_13, A_w=panel_2, g=panel_6)  # -> Q_s
# ---------- python_6: Python ----------
"""Solare Wärmeeinträge.
    Inputs:
        G:      Globalstrahlung (abhängig vom Ort) in kWh/m^2
        F_F:    Faktor für Ausrichtung der Einstrahlungsebene
        A_w:    Aussenwandfläche (transparent) in m^2
        g:      g-Wert
    Output:
        Q_s:    Solare Wärmeeinträge in kWh"""

__author__ = "A/S ETH"
__version__ = "2020.04.18"

import rhinoscriptsyntax as rs

Q_s = G * F_F * A_w * g
# ---------- end python_6 ----------
panel_22 = Panel(python_6)

python_7 = GhPythonScript(x=epw_reader.DryBulb, month=[0, 1, 2, 3, 4, 5, 6, 7, 8, 9, 10, 11])  # -> out, a; inputs x: list, month: Int32
# ---------- python_7: Python ----------
__author__ = "chwaibel"
__version__ = "2020.02.25"

import rhinoscriptsyntax as rs

# 8760 time series
# get monthly average...
# how to know how many days a month? somewhere, I have typical year.
# in some honey-badger script

dayspermonth = [31.0, 28.0, 31.0, 30.0, 31.0, 30.0, 31.0, 31.0, 30.0, 31.0, 30.0, 31.0]

hour_per_day = 24
start_hour = int(hour_per_day * sum(dayspermonth[0:month])) 
end_hour = int(hour_per_day * sum(dayspermonth[0:month+1]))

cumulative_data = sum(x[start_hour:end_hour])
hours_per_month = (dayspermonth[month] * hour_per_day)

a = cumulative_data / hours_per_month
# ---------- end python_7 ----------

# ---- group: Durchschnittliche Aussenlufttemperatur pro Monat in °C
panel_23 = Panel(python_7.a)

# ----
# Transmissionswärmeverluste
# Q_T = H_T * (T_i + T_e) * t
# [Q_T] = Wh
# [H_T] = W/K
# [T_i] = K oder °C
# [T_e] = K oder °C
# [t] = h
panel_24 = Panel("24*30")
python_8 = GhPythonScript(H_T=python_3, T_i=panel_10, T_e=panel_23, t=panel_24)  # -> Q_T
# ---------- python_8: Python ----------
"""Transmissionswärmeverluste in Wh.
    Inputs:
        H_T:    Transmissions-Wärmetransferkoeffizient in W/K
        T_i:    Raumlufttemperatur in °C oder K
        T_e:    Aussenlufttemperatur in °C oder K
        t:      Länger der Berechnungsperiode in h
    Output:
        Q_T:    Transmissionswärmeverluste in Wh"""

__author__ = "A/S ETH"
__version__ = "2020.04.18"

import rhinoscriptsyntax as rs

Q_T = H_T * (T_i - T_e) * t
# ---------- end python_8 ----------
panel_25 = Panel(python_8)

# ----
# Lüftungswärmeverluste
# Q_V = H_V * (T_i - T_e) * t
# [Q_V] = Wh
# [H_V] = W/K
# [T_i] = K oder °C
# [T_e] = K oder °C
# [t] = h
python_9 = GhPythonScript(H_V=python_4, T_i=panel_10, T_e=panel_23, t=panel_24)  # -> Q_V
# ---------- python_9: Python ----------
"""Lüftungswärmeverluste in Wh.
    Inputs:
        H_V:    Lüftungs-Wärmetransferkoeffizient in W/K
        T_i:    Raumlufttemperatur in °C oder K
        T_a:    Aussenlufttemperatur in °C oder K
        t:      Länge der Berechnungsperiode in h
    Output:
        Q_V:    Lüftungswärmeverluste in Wh"""

__author__ = "A/S ETH"
__version__ = "2020.04.18"

import rhinoscriptsyntax as rs

Q_V = H_V * (T_i - T_e) * t
# ---------- end python_9 ----------
panel_26 = Panel(python_9)

# ----
# Wärmeeintrag/-verlust-Verhältnis
# gamma = (Q_i + Q_s) / (Q_T + Q_V)
# [gamma] = -
# [Q_T] = Wh
# [Q_V] = Wh
# [Q_i] = Wh
# [Q_s] = Wh (script erfordert kWh!)
python_10 = GhPythonScript(Q_T=python_8, Q_V=python_9, Q_i=python, Q_s=python_6)  # -> gamma
# ---------- python_10: Python ----------
"""Wärmeeintrag/-verlust-Verhältnis.
    Inputs:
        Q_T:        Transmissionswärmeverluste in Wh
        Q_V:        Lüftungswärmeverluste in Wh
        Q_i:        Interne Wärmeeinträge in Wh
        Q_s:        Solare Wärmeeinträge in kWh
    Output:
        gamma:      Wärmeeintrag/-verlust-Verhältnis"""

__author__ = "A/S ETH"
__version__ = "2020.04.18"

import rhinoscriptsyntax as rs

gamma = (Q_i + Q_s*1000) / (Q_T + Q_V)
# ---------- end python_10 ----------
panel_27 = Panel(python_10)

# ----
# Ausnutzungsgrad für Wärmegewinne
panel_28 = Panel("""eta_g = (1 - gamma^a) / (1 - gamma^(a+1))
a = 1 + tau / 15
[eta_g] = -
[gamma] = -
[tau] = h""")
python_11 = GhPythonScript(gamma=python_10, tau=panel_11, Q_T=python_8, Q_V=python_9)  # -> eta_g
# ---------- python_11: Python ----------
"""Ausnutzungsgrad für Wärmegewinne.
    Inputs:
        gamma:      Wärmeeintrag/-verlust-Verhältnis
        tau:        Zeitkonstante des Gebäudes in h
        Q_T:        Transmissionswärmeverluste in Wh
        Q_V:        Lüftungswärmeverluste in Wh   
    Output:
        eta_g:      Ausnutzungsgrad für Wärmegewinne"""

__author__ = "A/S ETH"
__version__ = "2020.04.18"

import rhinoscriptsyntax as rs

if Q_T + Q_V < 0:
    eta_g = 0
elif gamma==1:
    eta_g = (1 + tau / 5) / (2 + tau/15)
else:
    a = 1 + tau / 15
    eta_g = (1-gamma**a) / (1-gamma**(a+1))
# ---------- end python_11 ----------
panel_29 = Panel(python_11)

# ----
# Heizwärmebedarf
# Q_H = Q_T + Q_V - eta_g * (Q_i + Q_s)
# [Q_H] = Wh (script errechnet kWh!)
# [Q_T] = Wh
# [Q_V] = Wh
# [Q_i] = Wh
# [Q_s] = Wh (script erfordert kWh!)
# [eta_g] = -
python_12 = GhPythonScript(Q_T=python_8, Q_V=python_9, Q_i=python, Q_s=python_6, eta_g=python_11)  # -> Q_H
# ---------- python_12: Python ----------
"""Heizwärmebedarf.
    Inputs:
        Q_T:    Transmissionswärmeverluste in Wh
        Q_V:    Lüftungswärmeverluste in Wh
        Q_i:    Interne Wärmeeinträge in Wh
        Q_s:    Solare Wärmeeinträge in kWh
        eta_g:  Ausnutzungsgrad für Wärmerückgewinnung
    Output:
        Q_H:    Heiwärmebedarf in kWh"""

__author__ = "A/S ETH"
__version__ = "2020.04.19"

import rhinoscriptsyntax as rs

Q_H = Q_T + Q_V - eta_g * (Q_i + Q_s*1000)
if Q_H < 0:
    Q_H = 0
Q_H /= 1000
# ---------- end python_12 ----------

hiveioresults = HiveIOResults(CoolingMonthly=panel_20, HeatingMonthly=python_12, ElectricityMonthly=panel_20)
hive_io_visualizer = HiveIOVisualizer(hiveioresults)
ma = MassAddition(Input=python_12)  # -> Result, PartialResults

# ---- group: Jahresheizenergiebedarf in kWh
panel_30 = Panel(ma.Result)

# ----
division = Division(A=ma.Result, B=panel)

# ---- group: Jahresheizenergiebedarf in kWh/m^2
panel_31 = Panel(division)
num = Number(panel_31)
