# Grasshopper definition GhPython_HeatingDemand.gh (Grasshopper 1.0.7)

# ---- group: Klimatisierte Grundfläche in m^2
# Energie- und Klimasysteme (EK)
# Heizwärmebedarf
# Berechnungen zur Abschätzung des Wärmebedarfs.
# Basiert auf der Excel Tabelle "Interaktion Struktur, Klima und Wärmebedarf.xlsx"
# 
# https://moodle-app2.let.ethz.ch/mod/glossary/showentry.php?eid=42209
number_slider = Slider(20, range=20..500)
panel = Panel(number_slider)

# ---- group: Fensterfläche in m^2
panel_2 = Panel(Slider(11.4, range=1..200))

# ---- group: Opake Hüllfläche in m2
panel_3 = Panel(Slider(26.6, range=20..800))

# ---- group: U-Wert Fenster in W/m^2K
panel_4 = Panel(Slider(1.529, range=0.1..4))

# ---- group: U-Wert opake Flächen in W/m^2K
panel_5 = Panel(Slider(0.877, range=0.05..2))

# ---- group: g-Wert der Verglasung
panel_6 = Panel(Slider(0.594, range=0.05..0.95))

# ---- group: Aussenluftvolumenstrom in m^3/h pro m^2
panel_7 = Panel(Slider(0.612, range=0.1..0.9))

# ---- group: Infiltration in m^3/h pro m^2
panel_8 = Panel(Slider(0.148, range=0.05..0.5))

# ---- group: Wärmerückgewinnung (Wert zwischen 0 - 1)
panel_9 = Panel(Slider(0.334, range=0..0.9))

# ---- group: Zeitkonstante tau des Gebäudes in h
panel_10 = Panel(Slider(160, range=50..800))

# ---- group: Raumlufttemperatur (Heizperiode) in °C
panel_11 = Panel(Slider(21.03, range=17..25))

# ---- group: Reduktionsfaktor externe Verschattung (0 - 1)
panel_12 = Panel(Slider(0.702, range=0..1))

# ---- group: hourly drybulb (°C) from .epw
drybulb = Data([1.1, 2, 1, 1, 1, 0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])

# ----
python = GhPythonScript(x=drybulb, month=[0, 1, 2, 3, 4, 5, 6, 7, 8, 9, 10, 11])  # -> out, a; inputs x: list, month: Int32
# ---------- python: Python ----------
__author__ = "chwaibel"
__version__ = "2020.02.25"

import rhinoscriptsyntax as rs

# 8760 time series
# get monthly average...
# how to know how many days a month? somewhere, I have typical year.
# in some honey-badger script

dayspermonth = [31.0, 28.0, 31.0, 30.0, 31.0, 30.0, 31.0, 31.0, 30.0, 31.0, 30.0, 31.0]

hour_per_day = 24
start_hour = int(hour_per_day * sum(dayspermonth[0:month])) 
end_hour = int(hour_per_day * sum(dayspermonth[0:month+1]))

cumulative_data = sum(x[start_hour:end_hour])
hours_per_month = (dayspermonth[month] * hour_per_day)

a = cumulative_data / hours_per_month
# ---------- end python ----------

# ---- group: Durchschnittliche Aussenlufttemperatur pro Monat in °C
panel_13 = Panel(python.a)

# ---- group: GHI (Wh) from .epw
ghi = Data([0, 0, 0, 0, 0, 0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])

# ----
python_2 = GhPythonScript(x=ghi, month=[0, 1, 2, 3, 4, 5, 6, 7, 8, 9, 10, 11])  # -> out, a; inputs x: list, month: Int32
# ---------- python_2: Python ----------
__author__ = "chwaibel"
__version__ = "2020.02.25"

import rhinoscriptsyntax as rs

# 8760 time series
# get monthly average...
# how to know how many days a month? somewhere, I have typical year.
# in some honey-badger script

dayspermonth = [31.0, 28.0, 31.0, 30.0, 31.0, 30.0, 31.0, 31.0, 30.0, 31.0, 30.0, 31.0]

hour_per_day = 24
start_hour = int(hour_per_day * sum(dayspermonth[0:month])) 
end_hour = int(hour_per_day * sum(dayspermonth[0:month+1]))

cumulative_data = sum(x[start_hour:end_hour])

a = cumulative_data / 1000
# ---------- end python_2 ----------

# ---- group: Monatlich kumulative Globalstrahlung in kWh/m^2
panel_14 = Panel(python_2.a)

# ---- group: Formfaktor (Wert zwischen 0 - 1) (Hier: Südschrägdach)
# Calculation scripts
panel_15 = Panel("""0.84
0.78
0.69
0.6
0.63
0.62
0.59
0.63
0.67
0.66
0.75
0.75""")

# ----
# Interne Wärmeeinträge
# Q_i = Phi_P * t_P + Phi_B * t_B + Phi_G * t_G
# [Q_i] = Wh
# [Phi_P,B,G] = W
# [t_P,B,G] = h
panel_16 = Panel("2.7")
multiplication = Multiplication(A="8", B=panel)
multiplication_2 = Multiplication(A="1.4", B=panel)
multiplication_3 = Multiplication(A=panel_16, B=panel)
python_3 = GhPythonScript(Phi_P=multiplication_2, t_P="420", Phi_B=multiplication_3, t_B="210", Phi_G=multiplication, t_G="183")  # -> Q_i
# ---------- python_3: Python ----------
"""Interne Wärmeeinträge in Wh.
    Inputs:
        Phi_P:      Wärmeagbage Personen in W
        t_P:        Vollaststunden Personen in h
        Phi_B:      Wärmeabgabe Beleuchtung in W
        t_B:        Vollaststunden Beleuchtung in h
        Phi_G:      Wärmeabgabe Geräte in W
        t_G:        Vollaststunden Geräte in h
    Output:
        Q_i:        Interne Wärmeeinträge in Wh"""

__author__ = "A/S ETH"
__version__ = "2020.04.18"

import rhinoscriptsyntax as rs

Q_i = Phi_P*t_P + Phi_B * t_B + Phi_G * t_G
# ---------- end python_3 ----------
panel_17 = Panel(python_3)

# ----
# Thermisch wirksamer Aussenluftvolumenstrom
# Vdot_th = Vdot_e * (1 - eta_rec) * Vdot_inf
# [Vdot_th] = m^3/h oder m^3/s
# [Vdot_e] = m^3/h oder m^3/s
# [Vdot_inf] = m^3/h oder m^3/s
# [eta_rec] = -
multiplication_4 = Multiplication(A=panel, B=panel_7)
multiplication_5 = Multiplication(A=panel, B=panel_8)
python_4 = GhPythonScript(Vdot_e=multiplication_4, Vdot_inf=multiplication_5, eta_rec=panel_9)  # -> Vdot_th
# ---------- python_4: Python ----------
"""Thermisch wirksamer Aussenluftvolumenstrom.
    Inputs:
        Vdot_e:         Aussenluft-Volumenstrom durch Lüftung in m^3/h
        Vdot_inf:       Aussenluft-Volumenstrom durch Infiltration in m^3/h
        eta_rec:        Nutzungsgrad der Wärmerückgewinnung
    Output:
        Vdot_th:        Thermisch wirksamer Aussenluft Volumenstrom in m^3/h"""

__author__ = "A/S ETH"
__version__ = "2020.04.18"

import rhinoscriptsyntax as rs
import math

if math.isnan(eta_rec):
    eta_rec = 0
Vdot_th = Vdot_e * (1-eta_rec) + Vdot_inf
# ---------- end python_4 ----------
panel_18 = Panel(python_4)

# ----
# Transmissions-Wärmetransferkoeffizient
# H_T = A_op * U_op + A_w * U_w
# [H_T] = W/K
# [A_op] = m^2
# [A_w] = m^2
# [U_op] = W/(m^2K)
# [U_w] = W/(m^2K)
python_5 = GhPythonScript(A_op=panel_3, U_op=panel_5, A_w=panel_2, U_w=panel_4)  # -> H_T
# ---------- python_5: Python ----------
"""Transmissions-Wärmetransferkoeffizient in W/K.
    Inputs:
        A_op:   Aussenwandfläche (opak) in m^2
        U_op:   Wärmedurchgangskoeffizient Aussenwand (opak) in W/m^2K
        A_w:    Aussenwandläche (transparent) in m^2
        U_w:    Wärmedurchgangskoeffizient Aussenwand (transparent) in W/m^2K
    Output:
        H_T:    Transmissions-Wärmetransferkoeffizient in W/K"""

__author__ = "A/S ETH"
__version__ = "2020.04.18"

import rhinoscriptsyntax as rs

H_T = A_op * U_op + A_w * U_w
# ---------- end python_5 ----------
panel_19 = Panel(python_5)

# ----
# Solare Wärmeeinträge
# Q_s = G * F_F * A_w * g * f_V
# [Q_s] = kWh
# [G] = kWh/m^2
# [F_F] = -
# [A_w] = m^2
# [g] = -
# [f_V] = -
python_6 = GhPythonScript(G=panel_14, F_F=panel_15, A_w=panel_2, g=panel_6, f_V=panel_12)  # -> Q_s
# ---------- python_6: Python ----------
"""Solare Wärmeeinträge.
    Inputs:
        G:      Globalstrahlung (abhängig vom Ort) in kWh/m^2
        F_F:    Faktor für Ausrichtung der Einstrahlungsebene
        A_w:    Aussenwandfläche (transparent) in m^2
        g:      g-Wert
    Output:
        Q_s:    Solare Wärmeeinträge in kWh"""

__author__ = "A/S ETH"
__version__ = "2020.04.18"

import rhinoscriptsyntax as rs

Q_s = G * F_F * A_w * g * f_V
# ---------- end python_6 ----------
panel_20 = Panel(python_6)

# ----
# Transmissionswärmeverluste
# Q_T = H_T * (T_i + T_e) * t
# [Q_T] = Wh
# [H_T] = W/K
# [T_i] = K oder °C
# [T_e] = K oder °C
# [t] = h
panel_21 = Panel("24*30")
python_7 = GhPythonScript(H_T=python_5, T_i=panel_11, T_e=panel_13, t=panel_21)  # -> Q_T
# ---------- python_7: Python ----------
"""Transmissionswärmeverluste in Wh.
    Inputs:
        H_T:    Transmissions-Wärmetransferkoeffizient in W/K
        T_i:    Raumlufttemperatur in °C oder K
        T_e:    Aussenlufttemperatur in °C oder K
        t:      Länger der Berechnungsperiode in h
    Output:
        Q_T:    Transmissionswärmeverluste in Wh"""

__author__ = "A/S ETH"
__version__ = "2020.04.18"

import rhinoscriptsyntax as rs

Q_T = H_T * (T_i - T_e) * t
# ---------- end python_7 ----------
panel_22 = Panel(python_7)

# ----
# Lüftungs-Wärmetransferkoeffizient
# H_V = Vdot_th * rho * c_p
# [H_V] = W/K
# [Vdot_th] = m^3/s
# [rho] = kg/m^3
# [c_p] = J/(kgK)
panel_23 = Panel("1.2")
python_8 = GhPythonScript(Vdot_th=python_4, rho=panel_23, c_p="1005")  # -> H_V
# ---------- python_8: Python ----------
"""Lüftungs-Wärmetransferkoeffizient.
    Inputs:
        Vdot_th:    Thermisch wirksamer Aussenluft-Volumenstrom in m^3/s
        rho:        Luftdichte in kg/m^3
        c_p:        Spezifische Wärmekapazität Luft in J/kgK
    Output:
        H_V:        Lüftungs-Wärmetransferkoeffizient in W/K"""

__author__ = "A/S ETH"
__version__ = "2020.04.18"

import rhinoscriptsyntax as rs

H_V = Vdot_th/3600 * rho * c_p
# ---------- end python_8 ----------
panel_24 = Panel(python_8)

# ----
# Lüftungswärmeverluste
# Q_V = H_V * (T_i - T_e) * t
# [Q_V] = Wh
# [H_V] = W/K
# [T_i] = K oder °C
# [T_e] = K oder °C
# [t] = h
python_9 = GhPythonScript(H_V=python_8, T_i=panel_11, T_e=panel_13, t=panel_21)  # -> Q_V
# ---------- python_9: Python ----------
"""Lüftungswärmeverluste in Wh.
    Inputs:
        H_V:    Lüftungs-Wärmetransferkoeffizient in W/K
        T_i:    Raumlufttemperatur in °C oder K
        T_a:    Aussenlufttemperatur in °C oder K
        t:      Länge der Berechnungsperiode in h
    Output:
        Q_V:    Lüftungswärmeverluste in Wh"""

__author__ = "A/S ETH"
__version__ = "2020.04.18"

import rhinoscriptsyntax as rs

Q_V = H_V * (T_i - T_e) * t
# ---------- end python_9 ----------
panel_25 = Panel(python_9)

# ----
# Wärmeeintrag/-verlust-Verhältnis
# gamma = (Q_i + Q_s) / (Q_T + Q_V)
# [gamma] = -
# [Q_T] = Wh
# [Q_V] = Wh
# [Q_i] = Wh
# [Q_s] = Wh (script erfordert kWh!)
python_10 = GhPythonScript(Q_T=python_7, Q_V=python_9, Q_i=python_3, Q_s=python_6)  # -> gamma
# ---------- python_10: Python ----------
"""Wärmeeintrag/-verlust-Verhältnis.
    Inputs:
        Q_T:        Transmissionswärmeverluste in Wh
        Q_V:        Lüftungswärmeverluste in Wh
        Q_i:        Interne Wärmeeinträge in Wh
        Q_s:        Solare Wärmeeinträge in kWh
    Output:
        gamma:      Wärmeeintrag/-verlust-Verhältnis"""

__author__ = "A/S ETH"
__version__ = "2020.04.18"

import rhinoscriptsyntax as rs

gamma = (Q_i + Q_s*1000) / (Q_T + Q_V)
# ---------- end python_10 ----------
panel_26 = Panel(python_10)

# ----
# Ausnutzungsgrad für Wärmegewinne/verluste
# (Hier: Heizfall)
panel_27 = Panel("""eta_g = (1 - gamma^a) / (1 - gamma^(a+1))
a = 1 + tau / 15
[eta_g] = -
[gamma] = -
[tau] = h""")
python_11 = GhPythonScript(gamma=python_10, tau=panel_10, Q_T=python_7, Q_V=python_9)  # -> eta_g
# ---------- python_11: Python ----------
"""Ausnutzungsgrad für Wärmegewinne.
    Inputs:
        gamma:      Wärmeeintrag/-verlust-Verhältnis
        tau:        Zeitkonstante des Gebäudes in h
        Q_T:        Transmissionswärmeverluste in Wh
        Q_V:        Lüftungswärmeverluste in Wh   
    Output:
        eta_g:      Ausnutzungsgrad für Wärmegewinne"""

__author__ = "A/S ETH"
__version__ = "2020.04.18"

import rhinoscriptsyntax as rs

if gamma < 1:
    eta_g = 1
elif Q_T + Q_V < 0:
    eta_g = 0
else:
    a = 1 + tau / 15
    eta_g = (1-gamma**a) / (1-gamma**(a+1))
# ---------- end python_11 ----------
panel_28 = Panel(python_11)

# ----
# Heizwärmebedarf
# Q_H = Q_T + Q_V - eta_g * (Q_i + Q_s)
# [Q_H] = Wh (script errechnet kWh!)
# [Q_T] = Wh
# [Q_V] = Wh
# [Q_i] = Wh
# [Q_s] = Wh (script erfordert kWh!)
# [eta_g] = -
python_12 = GhPythonScript(Q_T=python_7, Q_V=python_9, Q_i=python_3, Q_s=python_6, eta_g=python_11)  # -> Q_H
# ---------- python_12: Python ----------
"""Heizwärmebedarf.
    Inputs:
        Q_T:    Transmissionswärmeverluste in Wh
        Q_V:    Lüftungswärmeverluste in Wh
        Q_i:    Interne Wärmeeinträge in Wh
        Q_s:    Solare Wärmeeinträge in kWh
        eta_g:  Ausnutzungsgrad für Wärmerückgewinnung
    Output:
        Q_H:    Heiwärmebedarf in kWh"""

__author__ = "A/S ETH"
__version__ = "2020.04.19"

import rhinoscriptsyntax as rs

Q_H = Q_T + Q_V - eta_g * (Q_i + Q_s*1000)
if Q_H < 0:
    Q_H = 0
Q_H /= 1000
# ---------- end python_12 ----------

# ---- group: Monthly heating demand in kWh
panel_29 = Panel(python_12)
graph = QuickGraph(panel_29, SortOrder=0)

# ----
ma = MassAddition(Input=python_12)  # -> Result, PartialResults

# ---- group: Annual heating demand in kWh
panel_30 = Panel(ma.Result)

# ----
division = Division(A=ma.Result, B=panel)

# ---- group: Annual heating demand in kWh/m^2
panel_31 = Panel(division)
