# Grasshopper definition Hive_Solar_Unobstructed.gh (Grasshopper 1.0.7)
# plug-ins: HiveIO, GHSolar

# ---- group: surface orientation
number_slider = Slider(33.169, range=0..90)
number_slider_2 = Slider(108.001, range=0..360)

# ---- group: Path to weather file (.epw)
panel = Panel("C:\EnergyPlusV9-3-0\WeatherData\USA_CA_San.Francisco.Intl.AP.724940_TMY3.epw")

# ---- group: Sky view factor
toggle = BooleanToggle(True)
number_slider_3 = Slider(2, range=0..5)
number_slider_4 = Slider(0.25, range=0..1)

# ---- group: Sky view factor / Context (City, obstacles, etc.)
mesh = Mesh([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])

# ---- group: Sky view factor / analysis point
pt = Point(Point(21.71647424, -7.258711689, 0))

# ----
# Sunpath and unobstructred surface insolation
toggle_2 = BooleanToggle(True)
distepw = DistributorEPW(EPWFilepath=panel, WriteLists=toggle_2)  # -> EPW, Latitude, Longitude, CityCountry, GHI, DNI, DHI, DryBulb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
solarpotentialsunobstructed = SolarPotentialsUnobstructedCSharp(
    Tilt=number_slider,
    Azimuth=number_slider_2,
    DHI=distepw.DHI,
    DNI=distepw.DNI,
    Latitude=distepw.Latitude,
    Longitude=distepw.Longitude,
    Aw=1,
    Timezone=distepw.Timezone)
skydome = GHSkydome(
    RecursionLevel=number_slider_3,
    Viewfactors=toggle,
    SolarVec=False,
    HOY=0,
    Location=[distepw.Longitude, distepw.Latitude],
    DNI=distepw.DNI,
    DHI=distepw.DHI,
    Size=number_slider_4,
    Context=mesh,
    Sp=pt,
    Timezone=distepw.Timezone)  # -> Mesh, Vectors, Sunpaths, SunGeo
panel_2 = Panel(solarpotentialsunobstructed)
crv = Curve(skydome.Sunpaths)
graph = QuickGraph(solarpotentialsunobstructed, SortOrder=0)

# ----
# Ladybug Sunpath
ladybug = Ladybug_Ladybug()  # -> Vviiiiiiiiiizzz; disabled; plug-in component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
importepw = Ladybug_ImportEpw(epwFile=panel)  # -> readMe, latitude, location, dryBulbTemperature, dewPointTemperature, relativeHumidity, windSpeed, windDirection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; disabled; plug-in component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
number_slider_5 = Slider(0.05, range=0..1)  # disabled
panel_3 = Panel("24")  # disabled
panel_4 = Panel("1")  # disabled
panel_5 = Panel("12")  # disabled
panel_6 = Panel("365")  # disabled
analysisperiod = Ladybug_AnalysisPeriod(fromMonth=panel_4, fromDay=panel_4, fromHour=panel_4, toMonth=panel_5, toDay=panel_6, toHour=panel_3)  # -> readMe, analysisPeriod; disabled; plug-in component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
sunpath = Ladybug_SunPath(
    location=importepw.location,
    hour=12,
    day=21,
    month=12,
    timeStep=1,
    analysisPeriod=analysisperiod.analysisPeriod,
    sunPathScale=number_slider_5,
    sunScale=number_slider_5,
    dailyOrAnnualSunPath=True)  # -> readMe, sunVectors, sunAltitudes, sunAzimuths, port, sunSpheresMesh, sunPathCrvs, compassCrvs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; disabled; plug-in component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
swatch = ColourSwatch(SwatchColor=RGB(0, 0, 0))  # disabled
preview = CustomPreview(Geometry=[sunpath.sunPathCrvs, sunpath.compassCrvs], Shader=swatch)  # disabled
