# Grasshopper definition Core_DemandHourly.gh (Grasshopper 1.0.7)
# plug-ins: HiveIO, Hive.Core.solar, Hive.Core.sia380, GHSolar

# ---- group: Path to weather file (.epw)
panel = Panel("C:\Users\christoph\Documents\GitHub\hive\GrasshopperExamples\Templates\HIVE_Zurich.epw")

# ---- group: refine windows discretisation
panel_2 = Panel("4")
panel_3 = Panel("10")

# ---- group: PV Fläche
srf = Surface(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)

# ---- group: static shading
mesh = Mesh(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)

# ---- group: Ground
mesh_2 = Mesh(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)

# ---- group: Context (City, obstacles, etc.)
mesh_3 = Mesh([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])

# ---- group: Windows
srf_2 = Surface([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])

# ---- group: Building volume
brep = Brep(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)

# ----
mesh_uv = MeshSurface(Surface=srf, UCount="6", VCount="6", Overhang=True, Equalize=False)

# ---- group: Hive model description
hiveinputenergysystems = InputEnergySystemsHive(
    MeshSolarTechnologyProperties=mesh_uv,
    conversions="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",
    emitters="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",
    meshConnections="""{
  "$type": "System.Collections.Generic.Dictionary`2[[System.Int32, mscorlib],[System.Int32, mscorlib]], mscorlib"
}""",
    meshes="""{
  "$type": "Hive.IO.Forms.SurfaceViewModel[], Hive.IO",
  "$values": [
    {
      "$type": "Hive.IO.Forms.SurfaceViewModel, Hive.IO",
      "Name": "srf0",
      "Area": 41.19041518967525
    }
  ]
}""")  # -> flatten(HiveEnergySystems)
hiveinputenvironment = InputEnvironmentHive(EpwPath=panel, ObstacleGeometries=[mesh_2, mesh_3, mesh])

# ----
hiveinputbuilding = InputBuildingHive(ZoneGeometry=brep, WindowsSurfaces=srf_2, SiaRoom="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")
hivedistributor = MainDistributorHive(HiveInputs=flatten([hiveinputenvironment, hiveinputbuilding, hiveinputenergysystems]))  # -> HiveBuilding, HiveEnvironment, HiveEnergySystemsSurfaceBasedTech, HiveEnergySystemsConversionTech, HiveEnergySystemsEmitter

# ----
# Distributor
hivedistsolarsimu = DistributorSolarSimulationHive(
    HiveBuilding=hivedistributor.HiveBuilding,
    HiveSolarTechnologies=hivedistributor.HiveEnergySystemsSurfaceBasedTech,
    HiveEnvironment=hivedistributor.HiveEnvironment)  # -> EnvironmentMesh, BuildingCentroid, ExternalSurfaces, WindowGeometries, WindowTilt, WindowAzimuth, WindowAreas, SolarTechMesh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
hivedistsiaroom = DistributorSIARoomHive(HiveBuilding=hivedistributor.HiveBuilding)  # -> ZoneAreas, WindowsAreas, ExternalSurfacesAreas, SIA2024Room, AllExternalSurfaceAreas, SurfaceType, SUA2024Schedules, UseAdaptiveComfort, UseNaturalVentilation, UseFixedTimeConstant
hivedistconversiontech = DistributorConversionTechHive(ConversionTechnologies=hivedistributor.HiveEnergySystemsConversionTech)  # -> AirSourceHeatPump, Chiller, Boiler, CombinedHeatAndPower, HeatExchanger, ColdExchanger, DirectElectricity
hivedistenvironment = DistributorEnvironmentHive(HiveEnvironment=hivedistributor.HiveEnvironment)  # -> Filepath, NaturalGas, BioGas, WoodPellets, DistrictHeating, DistrictCooling, GridElectricity, AmbientAirTemp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
bool = Boolean()
hivedistepw = DistributorEPW(EPW=hivedistenvironment.Filepath, WriteGHNumbers=True)  # -> EPW, Latitude, Longitude, CityCountry, GHI, DNI, DHI, DryBulb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
sia2024reader = SIA2024RoomReader(RoomJson=hivedistsiaroom.SIA2024Room, RoomArea=hivedistsiaroom.ZoneAreas, Month=1)  # -> TimeConstant, TemperatureSetpoint, CalculationPeriod, OpaqueEnvelopeArea, WindowArea, U_op_W_m_2K, UValueWindow, VolumetricAirFlowRate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
python = GhPythonScript(x=hivedistsolarsimu.WindowGeometries, y=bool)  # -> out, a
# ---------- python: Python ----------
__author__ = "chwaibel"
__version__ = "2020.09.09"

import rhinoscriptsyntax as rs

if y:
    a = x
# ---------- end python ----------
python_2 = GhPythonScript(x=hivedistsolarsimu.SolarTechMesh)  # -> out, a; same code as python
adaptivecomfort = AdaptiveComfort(AirTemperature=hivedistepw.DryBulbMonthly)  # -> ThermalComfort, Comfort80UpperBound, Comfort80LowerBound, Comfort90UpperBound, Comfort90LowerBound

adaptivecomfort_2 = AdaptiveComfort(AirTemperature=hivedistepw.DryBulb)  # -> ThermalComfort, Comfort80UpperBound, Comfort80LowerBound, Comfort90UpperBound, Comfort90LowerBound
panel_4 = Panel(hivedistsiaroom.AllExternalSurfaceAreas)

# ---- group: DHI
data = Data(hivedistepw.DHI)

# ----
# Shading Mask
dni = Data(hivedistepw.DNI)
panel_5 = Panel([hivedistepw.Longitude, hivedistepw.Latitude])
pt = Point(hivedistsolarsimu.BuildingCentroid)
skydome = GHSkydome(
    CumSkyMatrix=Toggle(False),
    Location=panel_5,
    DNI=dni,
    DHI=data,
    Context=hivedistsolarsimu.EnvironmentMesh,
    Sp=pt,
    Timezone=hivedistepw.Timezone)  # -> Mesh, Vectors, Sunpaths, SunGeo
preview = CustomPreview(Geometry=skydome.Sunpaths, Shader=ColourSwatch(SwatchColor=RGB(0, 0, 0)))

# ----
# SOLAR SIMULATION
num = Number()
num_2 = Number()
mesh_4 = Mesh(hivedistsolarsimu.ExternalSurfaces)
data_2 = Data([0.8, 0.8, 0.8, 0.8, 0.8, 0.8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])
obstobj = ObstacleObject(
    Mesh=[hivedistsolarsimu.EnvironmentMesh, mesh_4],
    Albedo=data_2,
    SpecCoeff=data_2,
    ReflType=0,
    Tolerance=0.01,
    Name="PV",
    MT=True)

# ----
# Solare Wärmeeinträge (shaded)
mesh_uv_2 = MeshSurface(Surface=python.a, UCount=panel_2, VCount=panel_3, Overhang=True, Equalize=False)  # -> flatten(Mesh)
mesh_5 = Mesh(mesh_uv_2)
obstobj_2 = ObstacleObject(Mesh=mesh_5, Albedo=data_2, SpecCoeff=data_2, ReflType=0, Tolerance=0.01, Name="PV", MT=True)
irrmshy = IrradiationMeshYear(
    AnalysisObjects=obstobj_2,
    ObstacleObjects=obstobj,
    Latitude=hivedistepw.Latitude,
    Longitude=hivedistepw.Longitude,
    Year=2017,
    DNI=hivedistepw.DNI,
    DHI=hivedistepw.DHI,
    MainSkyRes=1,
    SpecBounces=0,
    DiffIReflSkyRes=0,
    DiffIReflMode=2,
    MT=True,
    Timezone=hivedistepw.Timezone)
readresults = ReadResults(Mesh=mesh_5, I=irrmshy, Value=7)  # -> simplify(Results), SP
visumshsol = VisualizeMeshSolar(Mesh=mesh_5, I=irrmshy, Value=0, Min=num_2, Max=num, Clr=0)

# ----
# Solare Wärmeeinträge (unshaded)
simplepanel = SimplePanel(
    Tilt=hivedistsolarsimu.WindowTilt,
    Azimuth=hivedistsolarsimu.WindowAzimuth,
    DHI=hivedistepw.DHI,
    DNI=hivedistepw.DNI,
    Latitude=hivedistepw.Latitude,
    Longitude=hivedistepw.Longitude,
    Aw=hivedistsolarsimu.WindowAreas,
    Timezone=hivedistepw.Timezone)

toggle = BooleanToggle(True)

# ----
# PV Ertrag (simuliert)
obstobj_3 = ObstacleObject(Mesh=python_2.a, Albedo=data_2, SpecCoeff=data_2, ReflType=0, Tolerance=0.01, Name="PV", MT=True)
irrmshy_2 = IrradiationMeshYear(
    AnalysisObjects=obstobj_3,
    ObstacleObjects=obstobj,
    Latitude=hivedistepw.Latitude,
    Longitude=hivedistepw.Longitude,
    Year=2017,
    DNI=hivedistepw.DNI,
    DHI=hivedistepw.DHI,
    MainSkyRes=1,
    SpecBounces=0,
    DiffIReflSkyRes=0,
    DiffIReflMode=2,
    MT=True,
    Timezone=0)
visumshsol_2 = VisualizeMeshSolar(Mesh=hivedistsolarsimu.SolarTechMesh, I=irrmshy_2, Value=0, Min=num_2, Max=num)

bang = ExplodeTree(Data=simplepanel)  # -> Branch0, Branch1
sia380 = BuildingDemandSIA380(
    RoomProperties=hivedistsiaroom.SIA2024Room,
    RoomSchedules=hivedistsiaroom.SUA2024Schedules,
    FloorArea=hivedistsiaroom.ZoneAreas,
    AirTemperature=hivedistepw.DryBulb,
    SetpointsUpperBounds=adaptivecomfort_2.Comfort90UpperBound,
    SetpointsLowerBounds=adaptivecomfort_2.Comfort90LowerBound,
    EnvelopeSurfaceAreas=hivedistsiaroom.AllExternalSurfaceAreas,
    EnvelopeSurfaceTypes=hivedistsiaroom.SurfaceType,
    SurfaceIrradiation=readresults.Results,
    SurfaceIrradiationUnobstructed=simplepanel,
    GValue=sia2024reader.GValue,
    GValueWithSunscreen=sia2024reader.GValueWithSunscreen,
    SetpointSunscreen=sia2024reader.ShadingSetpoint,
    RunObstructedSolarSimulation=Toggle(False),
    RunHourly=Toggle(True),
    UseAdaptiveComfort=hivedistsiaroom.UseAdaptiveComfort)  # -> HeatingDemand, CoolingDemand, ElectricityDemand, TransmissionHeatLosses, VentilationHeatLosses, InternalGains, SolarGains, TransmissionHeatLossesOfOpaqueSurfaces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
viewer = ParamViewer(simplepanel)
panel_6 = Panel(bang.Branch1)
q_t = Panel("""2019.188256
1442.144948
674.475524
176.414787
0
0
0
0
5.178783
294.165603
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""")
viewer_2 = ParamViewer(sia380.SolarGainsPerTransparentSurface)

# ----
# PV Ertrag (unverschattet)
# Q_s = G * F_F * A_w * g
# [Q_s] = kWh
# [G] = kWh/m^2
# [F_F] = -
# [A_w] = m^2
# [g] = -
simplepanel_2 = SimplePanel(
    Tilt=hivedistsolarsimu.SolarTechTilt,
    Azimuth=hivedistsolarsimu.SolarTechAzimuth,
    DHI=hivedistepw.DHI,
    DNI=hivedistepw.DNI,
    Latitude=hivedistepw.Latitude,
    Longitude=hivedistepw.Longitude)

# ---- group: NEW SIA 380 COMPONENT
# DEMAND
abs = Absolute(Value=sia380.CoolingDemand)

# ----
panel_7 = Panel(sia380.HeatingDemand)
panel_8 = Panel([sia380.HeatingDemand, sia380.CoolingDemand, sia380.ElectricityDemand, sia380.TransmissionHeatLosses, sia380.VentilationHeatLosses, sia380.InternalGains, sia380.SolarGains, sia380.TransmissionHeatLossesOfOpaqueSurfaces, sia380.TransmissionHeatLossesOfTransparentSurfaces])
panel_9 = Panel(sia380.CoolingDemand)
python_3 = GhPythonScript(x=q_t, y=panel_8)  # -> out, a; inputs x: list, y: list
# ---------- python_3: Python ----------
__author__ = "Maxence"
__version__ = "2021.04.23"

import rhinoscriptsyntax as rs

params = ["Q_Heat", "Q_cool", "Q_Elec", 'Q_T', 'Q_V', 'Q_i',
    'Q_s', 'Q_T_opaque', 'Q_T_transp', 'Q_s_per_windows'
]

for i, t in enumerate(zip(x,y)):
    xi,yi = t
    if i % 12 == 0:
        print
        print params[int(i/12)]
    print float(xi) - float(yi)
# ---------- end python_3 ----------
ma = MassAddition(Input=sia380.CoolingDemand)  # -> Result, PartialResults
ma_2 = MassAddition(Input=sia380.HeatingDemand)  # -> Result, PartialResults

# ---- group: Onlz for testing monthly
cluster = Cluster(first_number=q_t, second_number=panel_8)  # disabled
test_monthly = Panel(cluster)

# ----
total_heating = Panel(ma_2.Result)
total_cooling = Panel(ma.Result)
hour_range = Slider(168, range=0..10000)
hour_start = Slider(4000, range=0..10000)
hourly_visualiser = HourlyVisualiser(
    L=sia380.HeatingDemand,
    L_2=sia380.CoolingDemand,
    A=hour_start,
    B=hour_range,
    L_3=hivedistepw.DryBulb,
    L_4=adaptivecomfort_2.Comfort90UpperBound,
    L_5=adaptivecomfort_2.Comfort90LowerBound,
    L_6=sia380.TransmissionHeatLosses,
    L_7=sia380.VentilationHeatLosses,
    L_8=sia380.InternalGains,
    L_9=sia380.SolarGains)  # -> L_10, L_11, L_12, L_13, L_14, L_15, L_16, L_17, L_18
graph = QuickGraph([hourly_visualiser.L_10, hourly_visualiser.L_11], SortOrder=0)
graph_2 = QuickGraph([hourly_visualiser.L_12, hourly_visualiser.L_13, hourly_visualiser.L_14], SortOrder=0)
graph_3 = QuickGraph([hourly_visualiser.L_15, hourly_visualiser.L_16, hourly_visualiser.L_17, hourly_visualiser.L_18], SortOrder=0)

# ==== cluster Cluster
first_number = ClusterInput()
second_number = ClusterInput()
equality = Equality(FirstNumber=first_number, SecondNumber=second_number)  # -> Equality, Inequality
mass_addition = MassAddition(Input=equality.Equality)  # -> Result, PartialResults
list_length = ListLength(List=equality.Equality)
equality_2 = Equality(FirstNumber=list_length, SecondNumber=mass_addition.Result)  # -> Equality, Inequality
equality_3 = ClusterOutput(equality_2.Equality)

# ==== cluster HourlyVisualiser
A = ClusterInput()
B = ClusterInput()
addition = Addition(A=A, B=B)
L = ClusterInput()
L_2 = ClusterInput()
L_3 = ClusterInput()
L_4 = ClusterInput()
L_5 = ClusterInput()
L_6 = ClusterInput()
L_7 = ClusterInput()
L_8 = ClusterInput()
L_9 = ClusterInput()
dom = ConstructDomain(DomainStart=A, DomainEnd=addition)
subset = SubList(List=L, Domain=dom, Wrap=True)  # -> List, Index
subset_2 = SubList(List=L_2, Domain=dom, Wrap=True)  # -> List, Index
subset_3 = SubList(List=L_3, Domain=dom, Wrap=True)  # -> List, Index
subset_4 = SubList(List=L_4, Domain=dom, Wrap=True)  # -> List, Index
subset_5 = SubList(List=L_5, Domain=dom, Wrap=True)  # -> List, Index
subset_6 = SubList(List=L_6, Domain=dom, Wrap=True)  # -> List, Index
subset_7 = SubList(List=L_7, Domain=dom, Wrap=True)  # -> List, Index
subset_8 = SubList(List=L_8, Domain=dom, Wrap=True)  # -> List, Index
subset_9 = SubList(List=L_9, Domain=dom, Wrap=True)  # -> List, Index
L_10 = ClusterOutput(subset.List)
L_11 = ClusterOutput(subset_2.List)
L_12 = ClusterOutput(subset_3.List)
L_13 = ClusterOutput(subset_4.List)
L_14 = ClusterOutput(subset_5.List)
L_15 = ClusterOutput(subset_6.List)
L_16 = ClusterOutput(subset_7.List)
L_17 = ClusterOutput(subset_8.List)
L_18 = ClusterOutput(subset_9.List)
