# Grasshopper definition Full_Hive_Template_DebuggWithGhPython.gh (Grasshopper 1.0.7)
# plug-ins: HiveIO, Hive.Core.solar, Hive.Core.sia380, GHSolar, Hive.Core.epw_reader

# ---- group: Path to weather file (.epw)
panel = Panel("C:\EnergyPlusV9-3-0\WeatherData\USA_CA_San.Francisco.Intl.AP.724940_TMY3.epw")

# ---- group: refine windows discretisation
panel_2 = Panel("4")
panel_3 = Panel("10")

# ---- group: PV Fläche
srf = Surface(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)

# ---- group: static shading
mesh = Mesh(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)

# ---- group: Ground
mesh_2 = Mesh(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)

# ---- group: Context (City, obstacles, etc.)
mesh_3 = Mesh([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])

# ---- group: Windows
srf_2 = Surface([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])

# ---- group: Building volume
brep = Brep(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)

# ----
mesh_uv = MeshSurface(Surface=srf, UCount="6", VCount="6", Overhang=True, Equalize=False)

# ---- group: Hive model description
hiveinputenergysystems = InputEnergySystemsHive(
    MeshSolarTechnologyProperties=mesh_uv,
    conversions="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",
    emitters="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",
    meshConnections="""{
  "$type": "System.Collections.Generic.Dictionary`2[[System.Int32, mscorlib],[System.Int32, mscorlib]], mscorlib",
  "0": 2
}""",
    meshes="""{
  "$type": "Hive.IO.Forms.SurfaceViewModel[], Hive.IO",
  "$values": [
    {
      "$type": "Hive.IO.Forms.SurfaceViewModel, Hive.IO",
      "Name": "srf0",
      "Area": 41.19041518967525
    }
  ]
}""")  # -> flatten(HiveEnergySystems)
hiveinputbuilding = InputBuildingHive(ZoneGeometry=brep, WindowsSurfaces=srf_2, SiaRoom="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")
hiveinputenvironment = InputEnvironmentHive(EpwPath=panel, ObstacleGeometries=[mesh_2, mesh_3, mesh])

# ----
hivedistributor = MainDistributorHive(HiveInputs=[hiveinputenvironment, hiveinputbuilding, hiveinputenergysystems])  # -> HiveBuilding, HiveEnvironment, HiveEnergySystemsSurfaceBasedTech, HiveEnergySystemsConversionTech, HiveEnergySystemsEmitter

# ---- group: shading mask rec level
toggle = BooleanToggle(False)
number_slider = Slider(3, range=0..5)
number_slider_2 = Slider(0.113, range=0..2)

# ---- group: sun vector HOY
toggle_2 = BooleanToggle(False)
number_slider_3 = Slider(2680, range=0..8759)

# ---- group: show sunpath
toggle_3 = BooleanToggle(False)

# ---- group: Simulate solar?
toggle_4 = BooleanToggle(False)

# ---- group: min (blue) to max (yellow) irradiation (kWh/m^2)
number_slider_4 = Slider(0, range=0..1000)
number_slider_5 = Slider(930.703, range=0..2000)

# ----
# Distributor
hivedistenvironment = DistributorEnvironmentHive(HiveIOEnvironment=hivedistributor.HiveEnvironment)  # -> Filepath, NaturalGas, BioGas, WoodPellets, DistrictHeating, DistrictCooling, GridElectricity, AmbientAirTemp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
distributorsia = DistributorSIA(BuildingObj=hivedistributor.HiveBuilding)  # -> ZoneAreas, WindowsAreas, ExtSrfAreas, SIA2024json, AllExtSrfAreas, SurfaceType
distrsolar = HiveIODistributorSolar(
    HiveIOBuilding=hivedistributor.HiveBuilding,
    HiveIOEnergySystemSurfaceBased=hivedistributor.HiveEnergySystemsSurfaceBasedTech,
    HiveIOEnvironment=hivedistributor.HiveEnvironment)  # -> EnvironmentMesh, BuildingCentroid, ExternalSurfaces, WindowGeometries, SolarTechMesh, WindowAzimuth, WindowAreas, SolarTechMesh_2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
nickname = GhDistributorConversionTech(HiveIOEnergySystemConversionTech=hivedistributor.HiveEnergySystemsConversionTech)  # -> HiveIOEnergySystemAirSourceHeatPump, HiveIOEnergySystemChiller, HiveIOEnergySystemsBoiler, HiveIOEnergySystemsCombinedHeatPowert, HiveIOEnergySystemsHeatExchanger, HiveIOEnergySystemsCoolExchanger, HiveIOEnergySystemElectricalSubstation
bool = Boolean(toggle_4)
python = GhPythonScript(x=distrsolar.WindowGeometries, y=bool)  # -> out, a
# ---------- python: Python ----------
__author__ = "chwaibel"
__version__ = "2020.09.09"

import rhinoscriptsyntax as rs

if y:
    a = x
# ---------- end python ----------
python_2 = GhPythonScript(x=distrsolar.SolarTechMesh_2, y=toggle_4)  # -> out, a; same code as python
epw_reader = EPWReader(Path=hivedistenvironment.Filepath)  # -> Latitude, Longitude, CityCountry, GHI, DNI, DHI, DryBulb, DewPoint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
sia2024room = SIA2024RoomReader(Room=distributorsia.SIA2024json, Area=distributorsia.ZoneAreas)  # -> Τ_h, Θ_i_C, T_h, A_op_m2, A_w_m2, U_op_W_m2K, U_w_W_m2K, V_e_m3_h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
adaptcomf = AdaptiveComfort(T_m=epw_reader.DryBulbMonthly)  # -> T_n, T_n80ub, T_n80lb, T_n90ub, T_n90lb

# ---- group: Upper temperature setpoint (°C)
panel_4 = Panel(adaptcomf.T_n90ub)

# ---- group: Lower temperature setpoint (°C)
panel_5 = Panel(adaptcomf.T_n90lb)

# ---- group: Monthly average dry bulb temperature (°C)
panel_6 = Panel(epw_reader.DryBulbMonthly)

# ---- group: checking windows order
item = ListItem(List=distrsolar.WindowGeometries, Index=Slider(0, range=0..5), Wrap=True)
offset = OffsetSurface(Surface=item, Distance=0.5, Retrim=True)
preview = CustomPreview(Geometry=offset, Shader=ColourSwatch(SwatchColor=RGB(74, 207, 255)))

# ----
graph = QuickGraph([panel_4, panel_5, panel_6], SortOrder=0)

# ---- group: DHI
data = Data(epw_reader.DHI)

# ----
# Shading Mask
dni = Data(epw_reader.DNI)
panel_7 = Panel([epw_reader.Longitude, epw_reader.Latitude])
pt = Point(distrsolar.BuildingCentroid)
skydome = GHSkydome(
    RecursionLevel=number_slider,
    Viewfactors=toggle,
    CumSkyMatrix=Toggle(False),
    SunPath=toggle_3,
    SolarVec=toggle_2,
    HOY=number_slider_3,
    Location=panel_7,
    DNI=dni,
    DHI=data,
    Size=number_slider_2,
    Context=distrsolar.EnvironmentMesh,
    Sp=pt,
    Timezone=epw_reader.Timezone)  # -> Mesh, Vectors, Sunpaths, SunGeo
preview_2 = CustomPreview(Geometry=skydome.Sunpaths, Shader=ColourSwatch(SwatchColor=RGB(0, 0, 0)))

# ----
# SOLAR SIMULATION
num = Number(number_slider_5)
num_2 = Number(number_slider_4)
mesh_4 = Mesh(distrsolar.ExternalSurfaces)
data_2 = Data([0.8, 0.8, 0.8, 0.8, 0.8, 0.8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])
obstobj = ObstacleObject(
    Mesh=[distrsolar.EnvironmentMesh, mesh_4],
    Albedo=data_2,
    SpecCoeff=data_2,
    ReflType=0,
    Tolerance=0.01,
    Name="PV",
    MT=True)

# ----
# Solare Wärmeeinträge (shaded)
mesh_uv_2 = MeshSurface(Surface=python.a, UCount=panel_2, VCount=panel_3, Overhang=True, Equalize=False)  # -> flatten(Mesh)
mesh_5 = Mesh(mesh_uv_2)
obstobj_2 = ObstacleObject(Mesh=mesh_5, Albedo=data_2, SpecCoeff=data_2, ReflType=0, Tolerance=0.01, Name="PV", MT=True)
irrmshy = IrradiationMeshYear(
    AnalysisObjects=obstobj_2,
    ObstacleObjects=obstobj,
    Latitude=epw_reader.Latitude,
    Longitude=epw_reader.Longitude,
    Year=2017,
    DNI=epw_reader.DNI,
    DHI=epw_reader.DHI,
    MainSkyRes=1,
    SpecBounces=0,
    DiffIReflSkyRes=0,
    DiffIReflMode=2,
    MT=True,
    Timezone=epw_reader.Timezone)
readresults = ReadResults(Mesh=mesh_5, I=irrmshy, Value=7)  # -> simplify(Results), SP
visumshsol = VisualizeMeshSolar(Mesh=mesh_5, I=irrmshy, Value=0, Min=num_2, Max=num, Clr=0)

# ---- group: Windows
mesh_6 = Mesh(visumshsol)

# ----
# Solare Wärmeeinträge (unshaded)
simplepanel = SimplePanel(
    Tilt=distrsolar.SolarTechMesh,
    Azimuth=distrsolar.WindowAzimuth,
    DHI=epw_reader.DHI,
    DNI=epw_reader.DNI,
    Latitude=epw_reader.Latitude,
    Longitude=epw_reader.Longitude,
    Aw=distrsolar.WindowAreas,
    Timezone=epw_reader.Timezone)

python_3 = GhPythonScript()  # -> out, a; inputs T_e: list, setpoints_ub: list, setpoints_lb: list, surface_areas: list, surface_type: list, srf_irrad_obstr_tree: tree, srf_irrad_unobstr_tree: tree, run_obstructed_simulation: Boolean
# ---------- python_3: Python ----------
from __future__ import division
# coding=utf-8
"""
Monthly heating, cooling and electricity demand calculation according to SIA 380.
Equations from 'Interaktion Struktu, Klima und Wärmebedarf_HS20.xlsx', 19.10.2020

heating and cooling demand: SIA 380.1
thermal balance depends on individual surfaces, i.e. each building surface (both transparent and opaque) can have
individual proporties (U-value, g-value, infiltration, etc.)

temperature set-point must be an input, e.g. from an adaptive thermal comfort module

electricity demand: currently simply by using sqm and internal loads for lighting and equipment
"""

__author__ = "Christoph"
__version__ = "2020.12.02"

import rhinoscriptsyntax as rs
import math
import sys
import ghpythonlib.treehelpers as th
import json

def cleanDictForNaN(d):
    # a = d.values()
    # b = d.keys()
    for i in d:
        if math.isnan(d[i]) or d[i] == "NaN":
            d[i] = 0.0

    return d



def min_and_index(*sequence):
    min_value = min(sequence)
    index = sequence.index(min_value)
    return min_value, index


def negatives_to_zero(values):
    new_values = []
    for value in values:
        if value < 0.0:
            new_values.append(0.0)
        else:
            new_values.append(value)
    return new_values


def calc_gamma(Q_i, Q_s, Q_T, Q_V):
    """
    Wärmeeintrag/-verlust Verhältnis. Ratio of gains and losses of a zone
    :param Q_i: internal gains
    :param Q_s: solar gains
    :param Q_T: transmission heat losses
    :param Q_V: ventilation heat losses
    :return: float. ratio of gains and losses
    """
    return (Q_i + Q_s) / (Q_T + Q_V)


# usage of heat gains (Ausnutzungsgrad für Wärmegewinne), eta_g
def calc_eta_g(gamma, tau, cooling=False):
    """
    Ausnutzungsgrad für Wärmegewinne/-verluste. A variable that describes thermal losses/gains of a zone
    :param gamma: Wärmeeintrag/-verlust Verhältnis. Ratio between gains and losses (Q_i + Q_s) / (Q_T + Q_V)
    :param tau: Zeitkonstante. Time constant of the zone, describing thermal latency (C * A) / ( H_T + H_V). Or coefficients from SIA 2024
    :param cooling: Boolean to indicate whether this function should return eta_g for the cooling case. Default is False
    :return: float. Value for the degree of thermal losses/gains of a zone
    """
    if gamma < 0.0:
        eta_g = 1.0
    else:
        a = 1.0 + tau / 15.0
        if cooling:
            eta_g = (1.0 - gamma ** (-a)) / (1.0 - gamma ** (-(a+1.0)))
        else:
            eta_g = (1.0 - gamma ** a) / (1.0 - gamma ** (a + 1.0))
    return eta_g


def tree_to_jagged_monthly(run_obstr, tree_obstr, tree_unobstr, g_value, g_value_total, setpoint, win_areas):
    # sia2024: 200 W/m2. but maybe should be if srf_irrad > 200 W/m2 && Troom > 22?
    #
    # c# code
    # private void RunScript(DataTree < double > G, double g, ref object Q_s)
    # {
    #       int winCount = G.BranchCount;
    #       double[][] Q_array = new double[12][];
    #       for (int j = 0; j < G.Branch(0).Count; j++)
    #           Q_array[j] = new double[G.BranchCount];
    #       DataTree < double > doubleTree = new DataTree < double > ();
    #       for (int i = 0; i < G.BranchCount; i++)
    #       {
    #           for (int j = 0; j < G.Branch(i).Count; ++j) // should be 12, 1 for each month of the year
    #           {
    #               GH_Path path = new GH_Path(i, j);
    #               double irrad = G.Branch(i)[j] * g;
    #               doubleTree.Add(irrad, path);
    #
    #               Q_array[j][i] = irrad * 1000;
    #            }
    #       }
    #       jagged jag = new jagged();
    #       jag.data = Q_array;
    #
    #       Q_s = jag;
    # }
    #
    # public struct jagged
    # {
    #     public double[][] data;
    # }
    def get_monthly_average(annual_timeseries):
        dayspermonth = [31.0, 28.0, 31.0, 30.0, 31.0, 30.0, 31.0, 31.0, 30.0, 31.0, 30.0, 31.0]
        months = 12
        hour_per_day = 24
        monthly_list = []
        for month in range(months):
            start_hour = int(hour_per_day * sum(dayspermonth[0:month]))
            end_hour = int(hour_per_day * sum(dayspermonth[0:month + 1]))
            monthly_list.append(sum(annual_timeseries[start_hour:end_hour]))
        return monthly_list

    tree = tree_obstr
    if run_obstr == False:
        tree = tree_unobstr

    Q_array = []
    for i in range(tree.BranchCount):
        row = []
        for j in range(tree.Branch(i).Count):
            irrad = tree.Branch(i)[j] / win_areas[i]    # calculating per W/m2 for shading control
            if irrad > setpoint:
                irrad *= g_value_total
            else:
                irrad *= g_value
            row.append(irrad * win_areas[i])    # calculating back to total irradiance of entire surface
        monthly_row = get_monthly_average(row)
        Q_array.append(monthly_row)

    return Q_array

def transpose_jagged_2D_array(array):
    transposed_array = []
    len_d1 = len(array)
    len_d2 = len(array[0])

    for i in range(len_d2):
        transposed_row = []
        for j in range(len_d1):
            transposed_row.append(array[j][i])
        transposed_array.append(transposed_row)

    return transposed_array



# (room_properties, floor_area, T_e, setpoints_ub, setpoints_lb, surface_areas, surface_type, srf_irrad_obstr_tree, srf_irrad_unobstr_tree, g_value, g_value_total, setpoint_shading, run_obstructed_simulation):

rho = 1.2       # Luftdichte in kg/m^3
c_p = 1005      # Spez. Wärmekapazität Luft in J/(kgK)
hours_per_day = 24
months_per_year = 12
days_per_month = [31, 28, 31, 30, 31, 30, 31, 31, 30, 31, 30, 31]
t = [(hours_per_day * days) for days in days_per_month]   # length of calculation period (hours per month) [h]

# read room properties from sia2024
room_properties = json.loads(room_properties)
room_properties = cleanDictForNaN(room_properties)

# f_sh = 0.9  # sia2024, p.12, 1.3.1.9 Reduktion solare Wärmeeinträge
# theta_i_summer = room_properties["Raumlufttemperatur Auslegung Kuehlung (Sommer)"]
# theta_i_winter = room_properties["Raumlufttemperatur Auslegung Heizen (Winter)"]
# g = room_properties["Gesamtenergiedurchlassgrad Verglasung"]
tau = room_properties["Zeitkonstante"]
U_op = room_properties["U-Wert opake Bauteile"]
U_w = room_properties["U-Wert Fenster"]
Vdot_e_spec = room_properties["Aussenluft-Volumenstrom (pro NGF)"]
Vdot_inf_spec = room_properties["Aussenluft-Volumenstrom durch Infiltration"]
eta_rec = room_properties["Temperatur-Aenderungsgrad der Waermerueckgewinnung"]
Phi_P = room_properties["Waermeeintragsleistung Personen (bei 24.0 deg C, bzw. 70 W)"]
Phi_L = room_properties["Waermeeintragsleistung der Raumbeleuchtung"]
Phi_A = room_properties["Waermeeintragsleistung der Geraete"]
t_P = [room_properties["Vollaststunden pro Jahr (Personen)"]] * 12
t_L = [room_properties["Jaehrliche Vollaststunden der Raumbeleuchtung"]] * 12
t_A = [room_properties["Jaehrliche Vollaststunden der Geraete"]] * 12

# transforming daily sia2024 data to monthly
for i in range(len(days_per_month)):
    t_P[i] *= days_per_month[i] / 365.0
    t_L[i] *= days_per_month[i] / 365.0
    t_A[i] *= days_per_month[i] / 365.0

# formatting the grasshopper tree that contains solar irradiation time series for each window
# could be changed later to also include solar irradiation on opaque surfaces...
# ...would need to be adapted in the 'for surface in range(num_surfaces):' loop as well then
win_areas = [x for (x, y) in zip(surface_areas, surface_type) if y != "opaque"]

Q_s_per_surface = []
Q_s_jagged = None
if (srf_irrad_obstr_tree.Branch(0).Count == 0 and srf_irrad_unobstr_tree.BranchCount == 0):
    for i in range(months_per_year):
        Q_s_per_surface.append([0.0])
else:
    Q_s_jagged = tree_to_jagged_monthly(run_obstructed_simulation, srf_irrad_obstr_tree, srf_irrad_unobstr_tree, g_value, g_value_total, setpoint_shading, win_areas)
    Q_s_per_surface = transpose_jagged_2D_array(Q_s_jagged)

# assign room properties to individual surfaces
#    surface_type = ["opaque", "opaque", "transp", "transp"]
#    surface_areas = [44.0, 62.3, 4.0, 5.2]
num_surfaces = len(surface_type)

# calculations from Illias Excel sheet:
# preAllocate arrays. its a bit faster than .append (https://levelup.gitconnected.com/faster-lists-in-python-4c4287502f0a)
Q_i = [0.0] * months_per_year
Q_s = [0.0] * months_per_year
Q_i_out = [0.0] * months_per_year
Q_s_out = [0.0] * months_per_year
Q_V_out = [0.0] * months_per_year
Q_T_out = [0.0] * months_per_year
QT_opaque_out = [0.0] * months_per_year
QT_transparent_out = [0.0] * months_per_year

Q_Heat = [0.0] * months_per_year
Q_Cool = [0.0] * months_per_year
Q_Elec = [0.0] * months_per_year

Phi_P_tot = Phi_P * floor_area
Phi_L_tot = Phi_L * floor_area
Phi_A_tot = Phi_A * floor_area

# For each month, compute gains and losses of the zone
# for some variables, we compute upper and lower bounds (subscripts ub & lb)
# furthermore, cooling and heating demand requires us to compute certain variables differently.
# See equation sheet 'EK1_Formelsammlung_HS20.pdf'
for month in range(months_per_year):
    # External air flowrate (thermisch wirksamer Aussenluftvolumenstrom)
    Vdot_e = Vdot_e_spec * floor_area
    Vdot_inf = Vdot_inf_spec * floor_area
    Vdot_th = Vdot_e * (1.0 - eta_rec) + Vdot_inf
    Vdot_th_no_heat_recovery = Vdot_e + Vdot_inf

    # Ventilation heat loss coefficient (Lüftungs-Wärmetransferkoeffizient), H_V
    H_V = Vdot_th/3600.0 * rho * c_p
    H_V_no_heat_recovery = Vdot_th_no_heat_recovery/3600.0 * rho * c_p

    # Ventilation losses (Lüftungswärmeverluste), Q_V = H_V * (T_i - T_e) * t
    # we compute with and without heat recovery, ub and lb, and take the respectively best (lowest demand)
    # this assumes, the ventilation system operates ideally and does not, for example, keep warm air in summer
    Q_V_ub_heating = H_V * (setpoints_ub[month] - T_e[month]) * t[month]
    Q_V_lb_heating = H_V * (setpoints_lb[month] - T_e[month]) * t[month]
    Q_V_ub_cooling = H_V * (setpoints_ub[month] - T_e[month]) * t[month]
    Q_V_lb_cooling = H_V * (setpoints_lb[month] - T_e[month]) * t[month]
    Q_V_ub_heating_no_heat_recovery = H_V_no_heat_recovery * (setpoints_ub[month] - T_e[month]) * t[month]
    Q_V_lb_heating_no_heat_recovery = H_V_no_heat_recovery * (setpoints_lb[month] - T_e[month]) * t[month]
    Q_V_ub_cooling_no_heat_recovery = H_V_no_heat_recovery * (setpoints_ub[month] - T_e[month]) * t[month]
    Q_V_lb_cooling_no_heat_recovery = H_V_no_heat_recovery * (setpoints_lb[month] - T_e[month]) * t[month]

    # Internal loads (interne Wärmeeinträge)
    Q_i[month] = Phi_P_tot * t_P[month] + Phi_L_tot * t_L[month] + Phi_A_tot * t_A[month]
    Q_T_per_surfaces_this_month_ub = [0.0] * num_surfaces
    Q_T_per_surfaces_this_month_lb = [0.0] * num_surfaces
    QT_op_per_srf_this_month_ub = []
    QT_op_per_srf_this_month_lb = []
    QT_tr_per_srf_this_month_ub = []
    QT_tr_per_srf_this_month_lb = []

    # transmission heat losses, Q_T, per surface, both transparent and opaque
    for surface in range(num_surfaces):
        # Transmission heat transfer coefficient (Transmissions-Wärmetransferkoeffizient), H_T, (PER SURFACE)
        if(surface_type[surface] == "opaque"):
            H_T = surface_areas[surface] * U_op
            QT_op_per_srf_this_month_ub.append(H_T * (setpoints_ub[month] - T_e[month]) * t[month])
            QT_op_per_srf_this_month_lb.append(H_T * (setpoints_lb[month] - T_e[month]) * t[month])
        else:
            H_T = surface_areas[surface] * U_w
            QT_tr_per_srf_this_month_ub.append(H_T * (setpoints_ub[month] - T_e[month]) * t[month])
            QT_tr_per_srf_this_month_lb.append(H_T * (setpoints_lb[month] - T_e[month]) * t[month])

        # Transmission losses (Transmissionswärmeverluste), Q_T, (PER SURFACE, because function of H_T)
        Q_T_per_surfaces_this_month_ub[surface] = H_T * (setpoints_ub[month] - T_e[month]) * t[month]
        Q_T_per_surfaces_this_month_lb[surface] = H_T * (setpoints_lb[month] - T_e[month]) * t[month]

    Q_T_ub = sum(Q_T_per_surfaces_this_month_ub)
    Q_T_lb = sum(Q_T_per_surfaces_this_month_lb)

    # solar gains (solare Wärmeeinträge), Q_s, (PER SURFACE)
    # unobstructed or obstructed, both using SolarModel.dll and GHSolar.gha
    Q_s[month] = sum(Q_s_per_surface[month])    # currently, only transparent surfaces

    # Heatgains/-losses ratio (Wärmeeintrag/-verlust Verhältnis), gamma
    # calculating for different cases, heating / cooling, upper / lower bounds, with / without heat recovery
    gamma_ub_heating = calc_gamma(Q_i[month], Q_s[month], Q_T_ub, Q_V_ub_heating)
    gamma_lb_heating = calc_gamma(Q_i[month], Q_s[month], Q_T_lb, Q_V_lb_heating)
    gamma_ub_cooling = calc_gamma(Q_i[month], Q_s[month], Q_T_ub, Q_V_ub_cooling)
    gamma_lb_cooling = calc_gamma(Q_i[month], Q_s[month], Q_T_lb, Q_V_lb_cooling)
    gamma_ub_heating_no_hr = calc_gamma(Q_i[month], Q_s[month], Q_T_ub, Q_V_ub_heating_no_heat_recovery)
    gamma_lb_heating_no_hr = calc_gamma(Q_i[month], Q_s[month], Q_T_lb, Q_V_lb_heating_no_heat_recovery)
    gamma_ub_cooling_no_hr = calc_gamma(Q_i[month], Q_s[month], Q_T_ub, Q_V_ub_cooling_no_heat_recovery)
    gamma_lb_cooling_no_hr = calc_gamma(Q_i[month], Q_s[month], Q_T_lb, Q_V_lb_cooling_no_heat_recovery)

    # usage of heat gains (Ausnutzungsgrad für Wärmegewinne), eta_g
    eta_g_lb_heating = calc_eta_g(gamma_lb_heating, tau, False)
    eta_g_ub_heating = calc_eta_g(gamma_ub_heating, tau, False)
    eta_g_lb_cooling = calc_eta_g(gamma_lb_cooling, tau, True)
    eta_g_ub_cooling = calc_eta_g(gamma_ub_cooling, tau, True)
    eta_g_lb_heating_no_hr = calc_eta_g(gamma_lb_heating_no_hr, tau)
    eta_g_ub_heating_no_hr = calc_eta_g(gamma_ub_heating_no_hr, tau)
    eta_g_lb_cooling_no_hr = calc_eta_g(gamma_lb_cooling_no_hr, tau, True)
    eta_g_ub_cooling_no_hr = calc_eta_g(gamma_ub_cooling_no_hr, tau, True)

    # heating demand (Heizwärmebedarf), Q_H
    # calculating different cases, lower/upper bounds (lb/ub), with/without heat recovery (hr)
    Q_H_ub = Q_T_ub + Q_V_ub_heating - eta_g_ub_heating * (Q_i[month] + Q_s[month])
    Q_H_lb = Q_T_lb + Q_V_lb_heating - eta_g_lb_heating * (Q_i[month] + Q_s[month])
    Q_H_ub_no_hr = Q_T_ub + Q_V_ub_heating_no_heat_recovery - eta_g_ub_heating_no_hr * (Q_i[month] + Q_s[month])
    Q_H_lb_no_hr = Q_T_lb + Q_V_lb_heating_no_heat_recovery - eta_g_lb_heating_no_hr * (Q_i[month] + Q_s[month])
    Q_H_ub, Q_H_lb, Q_H_ub_no_hr, Q_H_lb_no_hr = negatives_to_zero([Q_H_ub, Q_H_lb, Q_H_ub_no_hr, Q_H_lb_no_hr])

    # cooling demand (Kältebedarf), Q_K
    # calculating different cases, lower/upper bounds (lb/ub), with/without heat recovery (hr)
    Q_K_lb = Q_i[month] + Q_s[month] - eta_g_lb_cooling * (Q_T_lb + Q_V_lb_cooling)
    Q_K_ub = Q_i[month] + Q_s[month] - eta_g_ub_cooling * (Q_T_ub + Q_V_ub_cooling)
    Q_K_lb_no_hr = Q_i[month] + Q_s[month] - eta_g_lb_cooling_no_hr * (Q_T_lb + Q_V_lb_cooling_no_heat_recovery)
    Q_K_ub_no_hr = Q_i[month] + Q_s[month] - eta_g_ub_cooling_no_hr * (Q_T_ub + Q_V_ub_cooling_no_heat_recovery)
    Q_K_lb, Q_K_ub, Q_K_lb_no_hr, Q_K_ub_no_hr = negatives_to_zero([Q_K_lb, Q_K_ub, Q_K_lb_no_hr, Q_K_ub_no_hr])

    # take smaller value of both comfort set points and remember the index
    Q_H, Q_H_index = min_and_index(Q_H_lb, Q_H_ub, Q_H_lb_no_hr, Q_H_ub_no_hr)
    Q_K, Q_K_index = min_and_index(Q_K_lb, Q_K_ub, Q_K_lb_no_hr, Q_K_ub_no_hr)
    Q_K *= -1.0     # make cooling negative

    # either subtract heating from cooling, but then also account for that in losses/gains by subtracting those too
    # or just take the higher load of both and then take the corresponding losses/gains
    # demand = Q_K + Q_H  # sometimes we have both cooling and heating. so subtract one from another
    # if demand < 0:
    #     Q_Cool[month] = demand * -1
    #     Q_Heat[month] = 0
    # else:
    #     Q_Cool[month] = 0
    #     Q_Heat[month] = demand
    if abs(Q_K) > Q_H:
        demand = Q_K
        Q_Cool[month] = Q_K
        Q_Heat[month] = 0.0
    else:
        demand = Q_H
        Q_Cool[month] = 0.0
        Q_Heat[month] = Q_H

    Q_Elec[month] = Phi_L_tot * t_L[month] + Phi_A_tot * t_A[month]   # lighting and utility loads. simplification, because utility and lighting have efficiencies (inefficiencies are heat loads). I would need to know that to get full electricity loads


    # Q_i, Q_s are * with eta_rec in heating case
    # Q_T, Q_V are * with eta_rec in cooling case
    sum_QT_op_lb = sum(QT_op_per_srf_this_month_lb) # index 0 or 2
    sum_QT_op_ub = sum(QT_op_per_srf_this_month_ub) # index 1 or 3
    sum_QT_tr_lb = sum(QT_tr_per_srf_this_month_lb)
    sum_QT_tr_ub = sum(QT_tr_per_srf_this_month_ub)

    Q_T_list = [Q_T_lb, Q_T_ub, Q_T_lb, Q_T_ub]
    QT_opaque_list = [sum_QT_op_lb, sum_QT_op_ub, sum_QT_op_lb, sum_QT_op_ub]
    QT_transparent_list = [sum_QT_tr_lb, sum_QT_tr_ub, sum_QT_tr_lb, sum_QT_tr_ub]
    Q_V_heating_list = [Q_V_lb_heating, Q_V_ub_heating, Q_V_lb_heating_no_heat_recovery, Q_V_ub_heating_no_heat_recovery]
    Q_V_cooling_list = [Q_V_lb_cooling, Q_V_ub_cooling, Q_V_lb_cooling_no_heat_recovery, Q_V_ub_cooling_no_heat_recovery]
    eta_rec_heating_list = [eta_g_lb_heating, eta_g_ub_heating, eta_g_lb_heating_no_hr, eta_g_ub_heating_no_hr]
    eta_rec_cooling_list = [eta_g_lb_cooling, eta_g_ub_cooling, eta_g_lb_cooling_no_hr, eta_g_ub_cooling_no_hr]

    if demand < 0:  # cooling
        Q_T_out[month] = Q_T_list[Q_K_index] * eta_rec_cooling_list[Q_K_index]
        QT_opaque_out[month] = QT_opaque_list[Q_K_index] * eta_rec_cooling_list[Q_K_index]
        QT_transparent_out[month] = QT_transparent_list[Q_K_index] * eta_rec_cooling_list[Q_K_index]
        Q_V_out[month] = Q_V_cooling_list[Q_K_index] * eta_rec_cooling_list[Q_K_index]
        Q_i_out[month] = Q_i[month]
        Q_s_out[month] = Q_s[month]
    else:   # heating
        Q_T_out[month] = Q_T_list[Q_H_index]
        QT_opaque_out[month] = QT_opaque_list[Q_H_index]
        QT_transparent_out[month] = QT_transparent_list[Q_H_index]
        Q_V_out[month] = Q_V_heating_list[Q_H_index]
        Q_i_out[month] = Q_i[month] * eta_rec_heating_list[Q_H_index]
        Q_s_out[month] = Q_s[month] * eta_rec_heating_list[Q_H_index]


if Q_s_jagged != None:
    Q_s_tree = th.list_to_tree(Q_s_jagged, source=[0, 0])   # import ghpythonlib.treehelpers as th
else:
    Q_s_tree = None

tokWh = 1000.0
a= [x / tokWh for x in Q_Heat], [x / tokWh for x in Q_Cool], [x / tokWh for x in Q_Elec], [x / tokWh for x in Q_T_out], [x / tokWh for x in Q_V_out], [x / tokWh for x in Q_i_out], [x / tokWh for x in Q_s_out], [x / tokWh for x in QT_opaque_out], [x / tokWh for x in QT_transparent_out], Q_s_tree
# ---------- end python_3 ----------

# ---- group: NEW SIA 380 COMPONENT
# DEMAND
sia380 = SIA380(
    Room_properties=distributorsia.SIA2024json,
    Floor_area=distributorsia.ZoneAreas,
    T_e=epw_reader.DryBulbMonthly,
    Setpoints_ub=adaptcomf.T_n90ub,
    Setpoints_lb=adaptcomf.T_n90lb,
    Surface_areas=distributorsia.AllExtSrfAreas,
    Surface_type=distributorsia.SurfaceType,
    Q_s_tree=readresults.Results,
    Q_s_tree_unobstructed=simplepanel,
    G_value=sia2024room.G_,
    G_value_total=sia2024room.G_total_,
    Setpoint=sia2024room.G_T_W_m_2,
    Run_obstr=bool)  # -> Q_Heat, Q_Cool, Q_Elec, Q_T, Q_V, Q_i, Q_s, Q_T_opaque, Q_T_transparent, Q_s_per_windows
abs = Absolute(Value=sia380.Q_Cool)

# ----
# PV Ertrag (simuliert)
obstobj_3 = ObstacleObject(Mesh=python_2.a, Albedo=data_2, SpecCoeff=data_2, ReflType=0, Tolerance=0.01, Name="PV", MT=True)
irrmshy_2 = IrradiationMeshYear(
    AnalysisObjects=obstobj_3,
    ObstacleObjects=obstobj,
    Latitude=epw_reader.Latitude,
    Longitude=epw_reader.Longitude,
    Year=2017,
    DNI=epw_reader.DNI,
    DHI=epw_reader.DHI,
    MainSkyRes=1,
    SpecBounces=0,
    DiffIReflSkyRes=0,
    DiffIReflMode=2,
    MT=True,
    Timezone=0)
visumshsol_2 = VisualizeMeshSolar(Mesh=distrsolar.SolarTechMesh_2, I=irrmshy_2, Value=0, Min=num_2, Max=num)

# ---- group: PV Panels
mesh_7 = Mesh(visumshsol_2)

# ----
# PV Ertrag (unverschattet)
# Q_s = G * F_F * A_w * g
# [Q_s] = kWh
# [G] = kWh/m^2
# [F_F] = -
# [A_w] = m^2
# [g] = -
simplepanel_2 = SimplePanel(
    Tilt=distrsolar.SolarTechTilt,
    Azimuth=distrsolar.SolarTechAzimuth,
    DHI=epw_reader.DHI,
    DNI=epw_reader.DNI,
    Latitude=epw_reader.Latitude,
    Longitude=epw_reader.Longitude)

python_4 = GhPythonScript(emitters=hivedistributor.HiveEnergySystemsEmitter)  # -> out, monthlyHeatingSupTemp, monthlyCoolingSupTemp, heatingCarrier, monthlyHeatingReturnTemp, yearlyHeatingSupTemp, yearlyHeatingReturnTemp, monthlyCoolingReturnTemp; inputs emitters: list
# ---------- python_4: Python ----------
__author__ = "chwaibel"
__version__ = "2020.08.20"

import rhinoscriptsyntax as rs

for e in emitters:
    if e.IsCooling:
        monthlyCoolingSupTemp = e.InletCarrier.MonthlyTemperature
        monthlyCoolingReturnTemp = e.ReturnCarrier.MonthlyTemperature
    else:
        monthlyHeatingSupTemp = e.InletCarrier.MonthlyTemperature
        heatingCarrier = e
        monthlyHeatingReturnTemp = e.ReturnCarrier.MonthlyTemperature
        yearlyHeatingSupTemp = e.InletCarrier.Temperature
        yearlyHeatingReturnTemp = e.ReturnCarrier.Temperature
# ---------- end python_4 ----------

# ---- group: Simple efficiency calculations?
toggle_5 = BooleanToggle(False)

# ----
# Air Source Heat Pump
hivemergerashp = MergerAirSourceHeatPumpHive(
    Air=hivedistenvironment.AmbientAirTemp,
    Electricity=hivedistenvironment.GridElectricity,
    HeatGenerated=sia380.Q_Heat,
    SuppTemp=python_4.monthlyHeatingSupTemp,
    SimpleMode=toggle_5,
    ASHP=nickname.HiveIOEnergySystemAirSourceHeatPump)

# ----
# Chiller
hivemergerchiller = MergerChillerHive(
    Air=hivedistenvironment.AmbientAirTemp,
    Electricity=hivedistenvironment.GridElectricity,
    CoolingGenerated=abs,
    CondenserTemp=python_4.monthlyCoolingSupTemp,
    SimpleMode=toggle_5,
    Chiller=nickname.HiveIOEnergySystemChiller)

# ----
# PV / ST
python_5 = GhPythonScript(x=irrmshy_2)  # -> out, a
# ---------- python_5: Python ----------
__author__ = "chwaibel"
__version__ = "2020.08.21"

import rhinoscriptsyntax as rs

a = x.I_hourly
# ---------- end python_5 ----------
hivemergersolartech = MergerSolarTechHive(
    I_hourlyM=python_5.a,
    SolarTech=hivedistributor.HiveEnergySystemsSurfaceBasedTech,
    Air=hivedistenvironment.AmbientAirTemp,
    SupplyTemp=python_4.yearlyHeatingSupTemp,
    ReturnTemp=python_4.yearlyHeatingReturnTemp,
    SimpleMode=toggle_5,
    I_hourly=simplepanel_2)
python_6 = GhPythonScript(x=hivemergersolartech)  # -> out, a
# ---------- python_6: Python ----------
__author__ = "chwaibel"
__version__ = "2020.08.24"

import rhinoscriptsyntax as rs
a = x.OutputCarriers[0].MonthlyCumulativeEnergy
# ---------- end python_6 ----------
panel_8 = Panel(hivemergersolartech)
ma = MassAddition(Input=python_6.a)  # -> Result, PartialResults
graph_2 = QuickGraph(python_6.a, SortOrder=0)
panel_9 = Panel(ma.Result)

# ---- group: PV electricity generation (kWh/month)
panel_10 = Panel(python_6.a)

# ----
# Plug-in any conversion tech
python_7 = GhPythonScript(x=hivemergerchiller)  # -> out, description, outEnergy
# ---------- python_7: Python ----------
__author__ = "chwaibel"
__version__ = "2020.08.18"

import rhinoscriptsyntax as rs

a = ("total investment cost: ", x.SpecificInvestmentCost * x.Capacity)
b = ("capacity: ", x.Capacity)
c = ("cap unit; ", x.CapacityUnit)
d = ("name: ", x.Name)
e = ("opCost CHF/a: ", sum(x.InputCarrier.TotalEnergyCost))
f = ("tot Input Energy kWh/a: ", sum(x.InputCarrier.Energy))
g = ("Tot Output Energy kWh/a: ", sum(x.OutputCarriers[0].MonthlyCumulativeEnergy))
h = ("Inp Car PEF: ", x.InputCarrier.PrimaryEnergyFactor)
description = [a, b, c, d, e, f, g, h]

# print(x.InputCarrier.MonthlyCumulativeEnergy)
#print(x.OutputCarriers[0].Energy)
print(x.InputCarrier.PrimaryEnergyFactor)
print("Input type: ", type(x.InputCarrier))
print("Output type: ", type(x.OutputCarriers[0]))
outEnergy = x.OutputCarriers[0].MonthlyCumulativeEnergy
print(x.IsCooling)
# ---------- end python_7 ----------
panel_11 = Panel(python_7.description)

# ----
# Purchased Grid Electricity
python_8 = GhPythonScript(chiller=hivemergerchiller, ashp=hivemergerashp, siaElec=sia380.Q_Elec)  # -> out, additionalElec; inputs siaElec: list
# ---------- python_8: Python ----------
__author__ = "Christoph"
__version__ = "2020.09.13"

import rhinoscriptsyntax as rs
if chiller != None and ashp != None:
    additionalElec = [a+b+c for a,b,c in zip(chiller.InputCarrier.MonthlyCumulativeEnergy, ashp.InputCarrier.MonthlyCumulativeEnergy, siaElec)]
elif ashp != None and chiller is None:
    additionalElec = [a+b for a,b in zip(ashp.InputCarrier.MonthlyCumulativeEnergy, siaElec)]
elif ashp is None and chiller != None:
    additionalElec = [a+b for a,b in zip(chiller.InputCarrier.MonthlyCumulativeEnergy, siaElec)]
else:
    additionalElec = siaElec
# ---------- end python_8 ----------
python_9 = GhPythonScript(pvOrStList=hivemergersolartech, elecDemandIn=python_8.additionalElec, heatDemandIn=sia380.Q_Heat)  # -> out, flatten(elecDemandOut), heatDemandOut; inputs pvOrStList: list, elecDemandIn: list, heatDemandIn: list
# ---------- python_9: Python ----------
__author__ = "Christoph"
__version__ = "2020.09.13"

import rhinoscriptsyntax as rs
import Hive.IO.EnergySystems

months = 12
totalRenewableHeat = [0.0] * months
totalRenewableElec = [0.0] * months

for pvOrSt in pvOrStList:
    if(pvOrSt != None):
        energyRenewable = pvOrSt.OutputCarriers[0].MonthlyCumulativeEnergy
    
    if(type(pvOrSt) == Hive.IO.EnergySystems.Photovoltaic):
        totalRenewableElec = [x + y for x, y in zip (totalRenewableElec, energyRenewable)]
    elif(type(pvOrSt) == Hive.IO.EnergySystems.SolarThermal):
        totalRenewableHeat = [x + y for x, y in zip (totalRenewableHeat, energyRenewable)]

elecDemandOut = [x - y for x, y in zip(elecDemandIn, totalRenewableElec)]
heatDemandOut = [x - y for x, y in zip(heatDemandIn, totalRenewableHeat)]
# ---------- end python_9 ----------
hivemergersubstation = MergerElectricalSubstationHive(
    GridElectricity=hivedistenvironment.GridElectricity,
    ElecPurchased=python_9.elecDemandOut,
    ElectricalSubstation=nickname.HiveIOEnergySystemElectricalSubstation)

# ----
# Results
hiveresults = ResultsHive(
    CoolingMonthly=abs,
    HeatingMonthly=python_9.heatDemandOut,
    ElectricityMonthly=python_9.elecDemandOut,
    HiveBuilding=hivedistributor.HiveBuilding,
    HiveConversionTech=flatten([hivemergersubstation, hivemergerchiller, hivemergerashp, hivemergersolartech]),
    Q_T_opaque=sia380.Q_T_opaque,
    Q_T_transparent=sia380.Q_T_transparent,
    Q_V=sia380.Q_V,
    Q_i=sia380.Q_i,
    Q_s=sia380.Q_s,
    ConsumedElec=python_8.additionalElec,
    ConsumedHeat=sia380.Q_Heat,
    Q_s_per_win=sia380.Q_s_per_windows)
python_10 = GhPythonScript(hiveResults=hiveresults)  # -> out, a, heatingLoads, coolingLoads, electricityLoads, windowSolarGains, gainsAndLosses
# ---------- python_10: Python ----------
__author__ = "chwaibel"
__version__ = "2020.09.23"

x = hiveResults

import rhinoscriptsyntax as rs

heatingLoads = x.TotalFinalHeatingMonthly
coolingLoads = x.TotalFinalCoolingMonthly
electricityLoads = x.TotalFinalElectricityMonthly
windowSolarGains = [] 
for j in range(len(x.MonthlySolarGainsPerWindow)):
    window = x.MonthlySolarGainsPerWindow[j]
    for i in range(len(window)):
        if i==0:
            windowSolarGains.append("______")
            windowSolarGains.append("window " + str(j))
        windowSolarGains.append(window[i])
        

gainsAndLosses = []
gainsAndLossesDict = \
{"SolarGains: ": x.TotalSolarGains, \
"InternalGains: ": x.TotalInternalGains, \
"PrimaryEnergy: ": sum(x.TotalPrimaryEnergyMonthlyNonRenewable), \
"VentilationHeatGains: ": x.TotalVentilationHeatGains, \
"EnvelopeHeatGains: ": x.TotalOpaqueTransmissionHeatGains, \
"WindowHeatGains: ": x.TotalWindowTransmissionHeatGains, \
"ElectricityDemand: ": sum(x.TotalConsumedElectricityMonthly), \
"VentilationHeatLosses: ": x.TotalVentilationHeatLosses, \
"EnvelopeHeatLosses: ": x.TotalOpaqueTransmissionHeatLosses, \
"WindowHeatLosses: ": x.TotalWindowTransmissionHeatLosses, \
"SystemConversionLosses: ": x.TotalSystemLosses}

for k, v in gainsAndLossesDict.iteritems():
    gainsAndLosses.append(k + str(v))
# ---------- end python_10 ----------

hive_io_visualizer = HiveIOVisualizer(hiveresults)

# ---- group: Zone Gains and Losses
panel_12 = Panel(python_10.gainsAndLosses)

# ---- group: Heating Loads
panel_13 = Panel(python_10.heatingLoads)

# ---- group: Cooling Loads
panel_14 = Panel(python_10.coolingLoads)

# ---- group: Windows Solar Gains
panel_15 = Panel(python_10.windowSolarGains)

# ---- group: Electricity Loads
panel_16 = Panel(python_10.electricityLoads)

# ---- group: Hive Results
data_3 = Data(hiveresults)

# ---- group: internalise data to store results
hiveresults_2 = HiveResultsParameter(data_3)
