# Grasshopper definition Hive_BuildingGeometries.gh (Grasshopper 1.0.7)
# plug-ins: HiveIO

# ---- group: non-convex with middle floor
srf = Surface([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])
brep = Brep(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)
hive_io_bldg = HiveIOBuilding(ZoneBrepGeometries=brep, AdditionalFloorSurfaces=srf, SiaRoom="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")

# ---- group: case 3: edge windows
brep_2 = Brep(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)
srf_2 = Surface([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])
hiveinputbuilding = InputBuildingHive(ZoneGeometry=brep_2, WindowsSurfaces=srf_2, SiaRoom="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")

# ---- group: Case 1: edge window
brep_3 = Brep(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)
srf_3 = Surface([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])
hiveinputbuilding_2 = InputBuildingHive(ZoneGeometry=brep_3, WindowsSurfaces=srf_3, SiaRoom="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")

# ---- group: case 4: various shapes
brep_4 = Brep(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)
srf_4 = Surface([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])
hiveinputbuilding_3 = InputBuildingHive(ZoneGeometry=brep_4, WindowsSurfaces=srf_4, SiaRoom="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")

# ---- group: case 2: corner window
brep_5 = Brep(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)
srf_5 = Surface(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)
hiveinputbuilding_4 = InputBuildingHive(ZoneGeometry=brep_5, WindowsSurfaces=srf_5, SiaRoom="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")

# ---- group: box, but rounded windows- check if wndw areas correct
srf_6 = Surface([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])
brep_6 = Brep(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)
hive_io_bldg_2 = HiveIOBuilding(ZoneBrepGeometries=brep_6, WindowsSurfaces=srf_6, SiaRoom="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")

# ---- group: regular house with windows - no problemos
# THESE ONES WORK
brep_7 = Brep(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)
srf_7 = Surface([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])
hive_io_bldg_3 = HiveIOBuilding(ZoneBrepGeometries=brep_7, WindowsSurfaces=srf_7, SiaRoom="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")

# ---- group: non-linear
brep_8 = Brep(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)
hive_io_bldg_4 = HiveIOBuilding(ZoneBrepGeometries=brep_8, SiaRoom="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")

# ---- group: non-convex
brep_9 = Brep(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)
hive_io_bldg_5 = HiveIOBuilding(ZoneBrepGeometries=brep_9, SiaRoom="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")

# ----
python = GhPythonScript(x=hive_io_bldg)  # -> out, a
# ---------- python: Python ----------
__author__ = "Chris"
__version__ = "2020.07.30"

import rhinoscriptsyntax as rs

for val in x.Zones[0].Floors:
    print(val.Area)
# ---------- end python ----------
panel = Panel(python.out)  # disabled

# ---- group: non-linear with rounded window
# THESE DON'T
brep_10 = Brep(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)
srf_8 = Surface(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)
hive_io_bldg_6 = HiveIOBuilding(ZoneBrepGeometries=brep_10, WindowsSurfaces=srf_8, SiaRoom="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")

# ---- group: non-linear with 2 rounded windows intersecting
srf_9 = Surface(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)
brep_11 = Brep(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)
srf_10 = Surface(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)
hive_io_bldg_7 = HiveIOBuilding(ZoneBrepGeometries=brep_11, WindowsSurfaces=[srf_10, srf_9], SiaRoom="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")

# ---- group: open - must result in error
brep_12 = Brep(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)
hive_io_bldg_8 = HiveIOBuilding(ZoneBrepGeometries=brep_12, SiaRoom="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")
