# Grasshopper definition Hive_ConversionTech_Test.gh (Grasshopper 1.0.7)
# plug-ins: HiveIO

# ---- group: Pfad zur Wetterdatei (*.epw)
panel = Panel("C:\Users\christoph\Documents\GitHub\hive\GrasshopperExamples\LectureExercises\HIVE_Zurich.epw")

# ----
hiveparainensys = ParametricInputEnergySystemsHive(
    ASHPCapacity="1000",
    ASHPCost="1000",
    ASHPEmissions="1000",
    ASHPCOP="0.3",
    NGBoilerCapacity="1000",
    NGBoilerCost="1000",
    NGBoilerEmissions="1000",
    NGBoilerEfficiency="0.95",
    CHPCapacity="1000",
    CHPCost="1000",
    CHPEmissions="1000",
    CHPHTP="1.5",
    CHPEffElec="0.3",
    ChillerCapacity="1000",
    ChillerCost="1000",
    ChillerEmissions="1000",
    ChillerCOP="0.3",
    HeatExchangerCapacity="1000",
    HeatExchangerCost="1000",
    HeatExchangerEmissions="1000",
    HeatExchangerLosses="0.05",
    CoolExchangerCapacity="1000",
    CoolExchangerCost="1000",
    CoolExchangerEmissions="1000",
    CoolExchangerLosses="0.05")

# ---- group: PV Fläche
srf = Surface(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)

# ---- group: Gebäudevolumen
brep = Brep(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)

# ---- group: Boden
mesh = Mesh(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)

# ----
mesh_uv = MeshSurface(Surface=srf, UCount="6", VCount="6", Overhang=True, Equalize=False)

# ---- group: Umgebungsbebauung
mesh_2 = Mesh([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])

# ---- group: Fensterflächen
srf_2 = Surface([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])

# ----
hiveparainemitter = ParametricInputEmitterHive(
    Vorlauf="35",
    Rücklauf="55",
    Capacity="1000",
    InvestmentCost="1000",
    EmbodiedEmissions="1000",
    Name="HeatingRadiator",
    AirEmitter=False,
    Cooling=False)
hiveparainemitter_2 = ParametricInputEmitterHive(
    Vorlauf="20",
    Rücklauf="25",
    Capacity="1000",
    InvestmentCost="1000",
    EmbodiedEmissions="1000",
    Name="AirDiffuserCool",
    AirEmitter="true",
    Cooling="true")
mesh_3 = Mesh(mesh_uv)
hive_io_env = HiveIOEnvironment(EPWPath=panel, ObstaclesGeometry=[mesh, mesh_2])
hive_io_bldg = HiveIOBuilding(ZoneBrepGeometries=brep, WindowsSurfaces=srf_2, SiaRoom="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")
hiveinputenergysystems = InputEnergySystemsHive(
    SolarTechProperties=mesh_uv,
    ConversionTechProperties=hiveparainensys,
    EmitterProperties=[hiveparainemitter, hiveparainemitter_2],
    conversions="""{
  "$type": "Hive.IO.Forms.ConversionTechPropertiesViewModel[], Hive.IO",
  "$values": []
}""",
    emitters="""{
  "$type": "Hive.IO.Forms.EmitterPropertiesViewModel[], Hive.IO",
  "$values": []
}""",
    meshConnections="""{
  "$type": "System.Collections.Generic.Dictionary`2[[System.Int32, mscorlib],[System.Int32, mscorlib]], mscorlib"
}""",
    meshes="""{
  "$type": "Hive.IO.Forms.SurfaceViewModel[], Hive.IO",
  "$values": [
    {
      "$type": "Hive.IO.Forms.SurfaceViewModel, Hive.IO",
      "Name": "srf0",
      "Area": 72.761414769930553
    }
  ]
}""")  # -> flatten(EnergySystems)
hiveiodistr = HiveIODistributor(HiveInputObjects=[hive_io_env, hive_io_bldg, hiveinputenergysystems])  # -> HiveIOBuilding, HiveIOEnvironment, HiveIOEnergySystemSurfaceBasedTech, HiveIOEnergySystemConversionTech, HiveIOEnergySystemsEmitter

# ---- group: Simulate solar?
toggle = BooleanToggle(False)

# ---- group: Simple efficiency calculations?
toggle_2 = BooleanToggle(False)

# ----
hivedistenvironment = DistributorEnvironmentHive(HiveEnvironment=hiveiodistr.HiveIOEnvironment)  # -> EPW, NaturalGas, BioGas, WoodPellets, DistrictHeating, DistrictCooling, GridElectricity, AmbientAirTemp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
python = GhPythonScript(emitters=hiveiodistr.HiveIOEnergySystemsEmitter)  # -> out, monthlyHeatingSupTemp, monthlyCoolingSupTemp, heatingCarrier, monthlyHeatingReturnTemp, yearlyHeatingSupTemp, yearlyHeatingReturnTemp, monthlyCoolingReturnTemp; inputs emitters: list
# ---------- python: Python ----------
__author__ = "chwaibel"
__version__ = "2020.08.20"

import rhinoscriptsyntax as rs

for e in emitters:
    if e.IsCooling:
        monthlyCoolingSupTemp = e.InletCarrier.TemperatureMonthly
        monthlyCoolingReturnTemp = e.ReturnCarrier.TemperatureMonthly
    else:
        monthlyHeatingSupTemp = e.InletCarrier.TemperatureMonthly
        heatingCarrier = e
        monthlyHeatingReturnTemp = e.ReturnCarrier.TemperatureMonthly
        yearlyHeatingSupTemp = e.InletCarrier.Temperature
        yearlyHeatingReturnTemp = e.ReturnCarrier.Temperature
# ---------- end python ----------
nickname = GhDistributorConversionTech(HiveIOEnergySystemConversionTech=hiveiodistr.HiveIOEnergySystemConversionTech)  # -> HiveIOEnergySystemAirSourceHeatPump, HiveIOEnergySystemChiller, HiveIOEnergySystemsBoiler, HiveIOEnergySystemsCombinedHeatPowert, HiveIOEnergySystemsHeatExchanger, HiveIOEnergySystemsCoolExchanger, HiveIOEnergySystemElectricalSubstation

# ---- group: heating demand
data = Data([1685.98258, 817.7029895, 24.74503303, 0.1256812419, 8.364482899e-06, 7.748021744e-10, 8.498318493e-12, 1.105945557e-11, 0.00041330518, 19.05675402, 1113.028015, 1715.765745])

# ---- group: cooling demand
data_2 = Data([0, 0, 2.91e-14, 0, 0, 1.16993984, 124.9125926, 49.0920708, 3.72300489, 0, 0, 0])

# ---- group: elec demand
data_3 = Data([308.3863014, 278.5424658, 308.3863014, 298.4383562, 308.3863014, 298.4383562, 308.3863014, 308.3863014, 298.4383562, 308.3863014, 298.4383562, 308.3863014])

# ----
hivemergerashp = MergerAirSourceHeatPumpHive(
    Air=hivedistenvironment.AmbientAirTemp,
    Electricity=hivedistenvironment.GridElectricity,
    HeatGenerated=data,
    SuppTemp=python.monthlyHeatingSupTemp,
    SimpleMode=toggle_2,
    ASHP=nickname.HiveIOEnergySystemAirSourceHeatPump)
python_2 = GhPythonScript(x=hivemergerashp)  # -> out, a, b
# ---------- python_2: Python ----------
__author__ = "Christoph"
__version__ = "2020.09.13"

import rhinoscriptsyntax as rs
a = x.OutputCarriers[0].Energy
b = x.InputCarrier.Energy
print(x.COP)
# ---------- end python_2 ----------
panel_2 = Panel([python_2.a, data, python_2.b])
