# Grasshopper definition Hive_EnvironmentAndEpwReader.gh (Grasshopper 1.0.7)
# plug-ins: HiveIO

python = GhPythonScript()  # -> out, a
# ---------- python: Python ----------
__author__ = "chwaibel"
__version__ = "2020.08.19"

import rhinoscriptsyntax as rs

a = [0.1] * 8760
# ---------- end python ----------
panel = Panel("C:\Users\christoph\Documents\GitHub\hive\GrasshopperExamples\templates\HIVE_Zurich.epw")
hiveparainpotentials = ParametricInputEnergyPotantialsHive(
    NaturalGasName="gazprom",
    NaturalGasPrice=python.a,
    NaturalGasEmissions=python.a,
    NaturalGasAvailability=python.a,
    BioGasName="Altstetten-Biogas",
    BioGasPrice=python.a,
    BioGasEmissions=python.a,
    BioGasAvailability=python.a,
    WoodPelletsName="ZuriWald",
    WoodPelletsPrice=python.a,
    WoodPelletsEmissions=python.a,
    WoodPelletsAvailability=python.a,
    DistrictHeatingName="Schwamendingen",
    DistrictHeatingPrice=python.a,
    DistrictHeatingEmissions=python.a,
    DistrictHeatingAvailability=python.a,
    DistrictHeatingSupplyTemp=python.a,
    DistrictCoolingName="Zurilake",
    DistrictCoolingPrice=python.a,
    DistrictCoolingEmissions=python.a,
    DistrictCoolingAvailability=python.a,
    DistrictCoolingSupplyTemp=python.a,
    GridElectricityName="UCT-Mix",
    GridElectricityPrice=python.a,
    GridElectricityEmissions=python.a,
    GridElectricityAvailability=python.a)
panel_2 = Panel(hiveparainpotentials)
hiveinputenvironment = InputEnvironmentHive(EPWPath=panel, Potentials=hiveparainpotentials)
hivedistenvironment = DistributorEnvironmentHive(HiveEnvironment=hiveinputenvironment)  # -> Epw, NaturalGas, BioGas, WoodPellets, DistrictHeating, DistrictCooling, GridElectricity, AmbientAirTemp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
python_2 = GhPythonScript(e=hiveinputenvironment)  # -> out, a
# ---------- python_2: Python ----------
__author__ = "maxence ryan"
__version__ = "2021.12.15"

import rhinoscriptsyntax as rs

def assert_val(actual, expected, var):
    assert actual == expected, var + " was " + actual + " but expected " + expected

# EPW tests
assert_val(e.EpwData.City, "Zuerich-Kloten", "Environment.EpwData.City") 
assert_val(e.EpwData.DryBulbTemperature.Length, 8760, "e.EpwData.DryBulbTemperature.Length")
assert_val(e.EpwData.DryBulbTemperatureMonthly.Length, 12, "e.EpwData.DryBulbTemperatureMonthly.Length")

# TODO

print "All tests pass"
# ---------- end python_2 ----------
panel_3 = Panel(python_2.out)

# ---- group: Can be used with a path / can also be used with a file-path
toggle = BooleanToggle(True)

# ---- group: parsing epw-object
toggle_2 = BooleanToggle(True)

# ----
distepw = DistributorEPW(EPW=hivedistenvironment.Epw, WriteGHNumbers=toggle_2)  # -> EPW, Latitude, Longitude, CityCountry, GHI, DNI, DHI, DryBulb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

# ---- group: Can be used with a path
distepw_2 = DistributorEPW(EPWFilepath=panel, WriteGHNumbers=toggle)  # -> EPW, Latitude, Longitude, CityCountry, GHI, DNI, DHI, DryBulb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

# ----
python_3 = GhPythonScript(
    a=[distepw_2.Latitude, distepw_2.Longitude, distepw_2.CityCountry],
    b=[distepw.Latitude, distepw.Longitude, distepw.CityCountry])  # -> out, a
# ---------- python_3: Python ----------
__author__ = "maxence ryan"
__version__ = "2021.12.15"

import rhinoscriptsyntax as rs

def assert_val(actual, expected):
    assert actual == expected, "was " + actual + " but expected " + expected

# EPW tests
assert_val(a, b) 

# TODO

print "All tests pass"
# ---------- end python_3 ----------
panel_4 = Panel([distepw_2.EPW, distepw.EPW])
panel_5 = Panel(python_3.out)
