# Grasshopper definition Hive_Environment_Test.gh (Grasshopper 1.0.7)
# plug-ins: HiveIO, Hive.Core.epw_reader

python = GhPythonScript()  # -> out, a
# ---------- python: Python ----------
__author__ = "chwaibel"
__version__ = "2020.08.19"

import rhinoscriptsyntax as rs

a = [0.1] * 8760
# ---------- end python ----------
panel = Panel("C:\Users\chwaibel\Documents\GitHub\hive\GrasshopperExamples\LectureExercises\HIVE_Zurich.epw")
hiveparainpotentials = ParametricInputEnergyPotantialsHive(
    NaturalGasName="gazprom",
    NaturalGasPrice=python.a,
    NaturalGasEmissions=python.a,
    NaturalGasAvailability=python.a,
    BioGasName="Altstetten-Biogas",
    BioGasPrice=python.a,
    BioGasEmissions=python.a,
    BioGasAvailability=python.a,
    WoodPelletsName="ZuriWald",
    WoodPelletsPrice=python.a,
    WoodPelletsEmissions=python.a,
    WoodPelletsAvailability=python.a,
    DistrictHeatingName="Schwamendingen",
    DistrictHeatingPrice=python.a,
    DistrictHeatingEmissions=python.a,
    DistrictHeatingAvailability=python.a,
    DistrictHeatingSupplyTemp=python.a,
    DistrictCoolingName="Zurilake",
    DistrictCoolingPrice=python.a,
    DistrictCoolingEmissions=python.a,
    DistrictCoolingAvailability=python.a,
    DistrictCoolingSupplyTemp=python.a,
    GridElectricityName="UCT-Mix",
    GridElectricityPrice=python.a,
    GridElectricityEmissions=python.a,
    GridElectricityAvailability=python.a)
panel_2 = Panel("C:\Users\maxze\Documents\Hive\hive\GrasshopperExamples\LectureExercises\HIVE_Zurich.epw")
panel_3 = Panel(hiveparainpotentials)
hiveinputenvironment = InputEnvironmentHive(EPWPath=panel_2, Potentials=hiveparainpotentials)
hivedistenvironment = DistributorEnvironmentHive(HiveEnvironment=hiveinputenvironment)  # -> Epw, NaturalGas, BioGas, WoodPellets, DistrictHeating, DistrictCooling, GridElectricity, AmbientAirTemp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
python_2 = GhPythonScript(e=hiveinputenvironment)  # -> out, a
# ---------- python_2: Python ----------
__author__ = "maxence ryan"
__version__ = "2021.12.15"

import rhinoscriptsyntax as rs

def assert_val(actual, expected, var):
    assert actual == expected, var + " was " + actual + " but expected " + expected

# EPW tests
assert_val(e.EpwData.City, "Zuerich-Kloten", "Environment.EpwData.City") 
assert_val(e.EpwData.DryBulbTemperature.Length, 8760, "e.EpwData.DryBulbTemperature.Length")
assert_val(e.EpwData.DryBulbTemperatureMonthly.Length, 12, "e.EpwData.DryBulbTemperatureMonthly.Length")

# TODO

print "All tests pass"
# ---------- end python_2 ----------
panel_4 = Panel(python_2.out)
panel_5 = Panel("C:\Users\maxze\Documents\Hive\hive\GrasshopperExamples\LectureExercises\HIVE_Helsinki.epw")
distepw = DistributorEPW(EPW=hivedistenvironment.Epw, WriteLists=Toggle(True))  # -> EPW, Latitude, Longitude, CityCountry, GHI, DNI, DHI, DryBulb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
epwreader = EPWReader(Path=panel_2)  # -> Latitude, Longitude, CityCountry, GHI, DNI, DHI, DryBulb, DewPoint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
python_3 = GhPythonScript(x=distepw.AmbientTemperatureCarrier, y=epwreader.AmbientTemperatureCarrier)  # -> out, a
# ---------- python_3: Python ----------
__author__ = "maxze"
__version__ = "2021.12.15"

import rhinoscriptsyntax as rs

assert x.CostMonthlyCumulative == y.CostMonthlyCumulative
assert x.EmissionsMonthly == y.EmissionsMonthly
assert x.Energy == y.Energy
assert x.EnergyMonthlyAverage == y.EnergyMonthlyAverage
assert x.EnergyMonthlyCumulative == y.EnergyMonthlyCumulative
assert x.EnergyUnit == y.EnergyUnit
assert x.Name == y.Name
# and more...

print "all good"
# ---------- end python_3 ----------
panel_6 = Panel(distepw.EPW)
python_4 = GhPythonScript(
    latitude=[epwreader.Latitude, distepw.Latitude],
    longitude=[distepw.Longitude, epwreader.Longitude],
    ghi=[epwreader.GHI, distepw.GHI],
    dni=[epwreader.DNI, distepw.DNI],
    dhi=[distepw.DHI, epwreader.DHI],
    drybulb=[epwreader.DryBulb, distepw.DryBulb],
    dewpoint=[epwreader.DewPoint, distepw.DewPoint],
    rh=[epwreader.RH, distepw.RH],
    ghimonthly=[epwreader.GHIMonthly, distepw.GHIMonthly],
    drybulbmonthly=[epwreader.DryBulbMonthly, distepw.DryBulbMonthly],
    rhmonthly=[distepw.AmbientTemperatureCarrier, distepw.RHMonthly, epwreader.RHMonthly],
    timezone=[epwreader.Timezone, distepw.Timezone])  # -> out, a; inputs latitude: list, longitude: list, ghi: list, dni: list, dhi: list, drybulb: list, dewpoint: list, rh: list, ghimonthly: list, drybulbmonthly: list, rhmonthly: list, timezone: list
# ---------- python_4: Python ----------
from ghpythonlib.componentbase import executingcomponent as component
import Grasshopper, GhPython
import System
import Rhino
import rhinoscriptsyntax as rs

class MyComponent(component):
    
    def RunScript(self, *args):
        """Provides a scripting component.
            Inputs:
                x: The x script variable
                y: The y script variable
            Output:
                a: The a output variable"""
                
        __author__ = "maxze"
        __version__ = "2021.12.15"
                
        import rhinoscriptsyntax as rs
                
        def assert_vals(a, varname):
            if (isinstance(a, list)):
                length = int(len(a) / 2)
                test = True
                for a,b in zip(a[0:length], a[length:]):
                    if a != b:
                        test = False
                        break
                message = ""           
            else: 
                test = a[0] == a[1]
                if not test:
                    message = varname + " : " + str(a[0]) + " != " + str(a[1])
                    raise ValueError(message)
                
            return test, message
                        
        for i, arg in enumerate(args):
            test, message = assert_vals(arg, "Param " + str(i))
            if not test: 
                raise AssertionError("Failed: " + str(arg ) + message)
        
        print "All tests pass"
# ---------- end python_4 ----------
panel_7 = Panel([distepw.CityCountry, epwreader.CityCountry])
panel_8 = Panel(python_3.out)
