# Grasshopper definition Hive_Form_Building.gh (Grasshopper 1.0.7)
# plug-ins: HiveIO, Hive.Core.sia380Parameters

sia2024roomsexisting = SIA2024ExistingRooms({"1.1 Wohnen Mehrfamilienhaus": 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, "1.2 Wohnen Einfamilienhaus": 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, "2.1 Hotelzimmer": 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, "2.2 Empfang, Lobby": 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, "3.1 Einzel-, Gruppenbuero": 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, "3.2 Grossraumbuero": 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}, selected="7.2 Mehrzweckhalle": {"Raumlufttemperatur Auslegung Kuehlung (Sommer) - Absenktemperatur": 28.0, "U-Wert opake Bauteile": 0.80000000000000004, "description": "7.2 Mehrzweckhalle", "Temperatur-Aenderungsgrad der Waermerueckgewinnung": 0.5, "Waermeeintragsleistung Personen (bei 24.0 deg C, bzw. 70 W)": 23.300000000000001, "Waermeeintragsleistung der Raumbeleuchtung": 10.800000000000001, "Jaehrliche Vollaststunden der Geraete": 2990.0, "Emissionen transparente Bauteile": 50.0, "Emissionen opake Bauteile": 64.0, "Gesamtenergiedurchlassgrad Verglasung und Sonnenschutz": 0.20000000000000001, "Glasanteil": 50.0, "Raumlufttemperatur Auslegung Heizen (Winter)": 21.0, "Waermespeicherfaehigkeit des Raumes": 106.0, "Jaehrliche Vollaststunden der Raumbeleuchtung": 2770.0, "Kosten transparente Bauteile": 420.0, "Waermeeintragsleistung der Geraete": 6.0, "Strahlungsleistung fuer Betaetigung Sonnenschutz": 200.0, "Vollaststunden pro Jahr (Personen)": 2600.0, "Gesamtenergiedurchlassgrad Verglasung": 0.65000000000000002, "U-Wert Fenster": 1.5, "Thermische Gebaeudehuellflaeche": 494.0, "Zeitkonstante": 32.0, "Aussenluft-Volumenstrom (pro NGF)": 12.0, "Jaehrlicher Waermebedarf fuer Warmwasser": 7.2999999999999998, "Raumlufttemperatur Auslegung Kuehlung (Sommer)": 26.0, "Abminderungsfaktor fuer Fensterrahmen": 0.75, "Aussenluft-Volumenstrom durch Infiltration": 0.29999999999999999, "Nettogeschossflaeche": 400.0, "Raumlufttemperatur Auslegung Heizen (Winter) - Absenktemperatur": 19.0, "Kosten opake Bauteile": 268.0})
sia2024roomsstandard = SIA2024StandardRooms({"1.1 Wohnen Mehrfamilienhaus": {"Raumlufttemperatur Auslegung Kuehlung (Sommer) - Absenktemperatur": 28.0, "U-Wert opake Bauteile": 0.20000000000000001, "description": "1.1 Wohnen Mehrfamilienhaus", "Temperatur-Aenderungsgrad der Waermerueckgewinnung": 0.69999999999999996, "Waermeeintragsleistung Personen (bei 24.0 deg C, bzw. 70 W)": 2.2999999999999998, "Waermeeintragsleistung der Raumbeleuchtung": 2.7000000000000002, "Jaehrliche Vollaststunden der Geraete": 1780.0, "Emissionen transparente Bauteile": 64.0, "Emissionen opake Bauteile": 63.0, "Gesamtenergiedurchlassgrad Verglasung und Sonnenschutz": 0.14000000000000001, "Glasanteil": 30.0, "Raumlufttemperatur Auslegung Heizen (Winter)": 21.0, "Waermespeicherfaehigkeit des Raumes": 120.0, "Jaehrliche Vollaststunden der Raumbeleuchtung": 1450.0, "Kosten transparente Bauteile": 467.0, "Waermeeintragsleistung der Geraete": 8.0, "Strahlungsleistung fuer Betaetigung Sonnenschutz": 200.0, "Vollaststunden pro Jahr (Personen)": 4090.0, "Gesamtenergiedurchlassgrad Verglasung": 0.5, "U-Wert Fenster": 1.2, "Thermische Gebaeudehuellflaeche": 26.0, "Zeitkonstante": 182.0, "Aussenluft-Volumenstrom (pro NGF)": 1.0, "Jaehrlicher Waermebedarf fuer Warmwasser": 19.800000000000001, "Raumlufttemperatur Auslegung Kuehlung (Sommer)": 26.0, "Abminderungsfaktor fuer Fensterrahmen": 0.75, "Aussenluft-Volumenstrom durch Infiltration": 0.14999999999999999, "Nettogeschossflaeche": 20.0, "Raumlufttemperatur Auslegung Heizen (Winter) - Absenktemperatur": 19.0, "Kosten opake Bauteile": 347.0}, "1.2 Wohnen Einfamilienhaus": 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, "2.1 Hotelzimmer": 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, "2.2 Empfang, Lobby": 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, "3.1 Einzel-, Gruppenbuero": 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, "3.2 Grossraumbuero": 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}, selected="1.1 Wohnen Mehrfamilienhaus")
sia2024roomsideal = SIA2024IdealRooms({"1.1 Wohnen Mehrfamilienhaus": {"Raumlufttemperatur Auslegung Kuehlung (Sommer) - Absenktemperatur": 28.0, "U-Wert opake Bauteile": 0.10000000000000001, "description": "1.1 Wohnen Mehrfamilienhaus", "Temperatur-Aenderungsgrad der Waermerueckgewinnung": 0.80000000000000004, "Waermeeintragsleistung Personen (bei 24.0 deg C, bzw. 70 W)": 2.2999999999999998, "Waermeeintragsleistung der Raumbeleuchtung": 1.7, "Jaehrliche Vollaststunden der Geraete": 1780.0, "Emissionen transparente Bauteile": 79.599999999999994, "Emissionen opake Bauteile": 69.0, "Gesamtenergiedurchlassgrad Verglasung und Sonnenschutz": 0.10000000000000001, "Glasanteil": 30.0, "Raumlufttemperatur Auslegung Heizen (Winter)": 21.0, "Waermespeicherfaehigkeit des Raumes": 120.0, "Jaehrliche Vollaststunden der Raumbeleuchtung": 1110.0, "Kosten transparente Bauteile": 514.0, "Waermeeintragsleistung der Geraete": 4.0, "Strahlungsleistung fuer Betaetigung Sonnenschutz": 200.0, "Vollaststunden pro Jahr (Personen)": 4090.0, "Gesamtenergiedurchlassgrad Verglasung": 0.5, "U-Wert Fenster": 0.90000000000000002, "Thermische Gebaeudehuellflaeche": 26.0, "Zeitkonstante": 258.0, "Aussenluft-Volumenstrom (pro NGF)": 1.0, "Jaehrlicher Waermebedarf fuer Warmwasser": 19.800000000000001, "Raumlufttemperatur Auslegung Kuehlung (Sommer)": 26.0, "Abminderungsfaktor fuer Fensterrahmen": 0.75, "Aussenluft-Volumenstrom durch Infiltration": 0.14999999999999999, "Nettogeschossflaeche": 20.0, "Raumlufttemperatur Auslegung Heizen (Winter) - Absenktemperatur": 19.0, "Kosten opake Bauteile": 426.0}, "1.2 Wohnen Einfamilienhaus": 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, "2.1 Hotelzimmer": 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, "2.2 Empfang, Lobby": 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, "3.1 Einzel-, Gruppenbuero": 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, "3.2 Grossraumbuero": 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}, selected="1.1 Wohnen Mehrfamilienhaus")
srf = Surface([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])
brep = Brep(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)
hiveinputbuilding = InputBuildingHive(ZoneGeometry=brep, WindowsSurfaces=srf, SIA2024Room=sia2024roomsstandard)
hivedistsiaroom = DistributorSIARoomHive(HiveBuilding=hiveinputbuilding)  # -> ZoneAreas, WindowsAreas, ExternalSurfacesAreas, SIA2024Room, AllExternalSurfaceAreas, SurfaceType, SUARoomSchedules, UseAdaptiveComfort, UseNaturalVentilation, UseFixedTimeConstant
python = GhPythonScript(x=hiveinputbuilding)  # -> out, a, b, c, d
# ---------- python: Python ----------
__author__ = "darthoma"
__version__ = "2020.08.24"

import rhinoscriptsyntax as rs

a = x.SIA2024.BuildingUseType

totalVolume = 0.0
totalWallArea = 0.0
totalFloorArea = 0.0
totalWinArea = 0.0
totalRoofArea = 0.0
for zone in x.Zones:
    totalVolume += zone.Volume
    for floor in zone.Floors:
        totalFloorArea += floor.Area
    for window in zone.Windows:
        totalWinArea += window.Area
    for wall in zone.Walls:
        totalWallArea += wall.Area
    for roof in zone.Roofs:
        totalRoofArea += roof.Area

b = ("Volume: ", totalVolume, "WallArea: ", totalWallArea, "FloorArea: ", totalFloorArea, "WindowsArea: ", totalWinArea, "RoofArea: ", totalRoofArea)

wallCost = x.Zones[0].Walls[0].TotalCost
wallEmissions = x.Zones[0].Walls[0].TotalEmissions
wallUValue = x.Zones[0].Walls[0].Construction.UValue

c = ("wallTotalCost: ", wallCost, "wallEmissions: ", wallEmissions, "wallU-Value: ", wallUValue)
d = ("windows co2: ", x.Zones[0].Windows[0].TotalEmissions)

print("Uvalue wall: ", x.Zones[0].Walls[0].Construction.UValue)
print("Uvalue roofs: ", x.Zones[0].Roofs[0].Construction.UValue)
print("Uvalue floors: ", x.Zones[0].Floors[0].Construction.UValue)
print("Uvalue windows: ", x.Zones[0].Windows[0].Construction.UValue)
# ---------- end python ----------
panel = Panel(python.d)
panel_2 = Panel(hivedistsiaroom.UseNaturalVentilation)
panel_3 = Panel(hivedistsiaroom.UseAdaptiveComfort)
python_2 = GhPythonScript(x=hivedistsiaroom.SIA2024Room)  # -> out, a
# ---------- python_2: Python ----------
__author__ = "Maxence"
__version__ = "2021.07.29"

import rhinoscriptsyntax as rs

a = x.split(",")
# ---------- end python_2 ----------
panel_4 = Panel(python.b)
panel_5 = Panel(python.c)

# ---- group: Room Properties JSON
panel_6 = Panel(python_2.a)
