# Grasshopper definition Hive_Form_Building_Test.gh (Grasshopper 1.0.7)
# plug-ins: HiveIO, Hive.Core.sia380, Hive.Core.sia380Parameters

list = ValueList({"1.2 Wohnen Einfamilienhaus"}, selected="1.2 Wohnen Einfamilienhaus")
number_slider = Slider(0.25, range=0..1)
sia2024roomsexisting = SIA2024ExistingRooms({"1.1 Wohnen Mehrfamilienhaus": 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, "1.2 Wohnen Einfamilienhaus": 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, "2.1 Hotelzimmer": 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, "2.2 Empfang, Lobby": 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, "3.1 Einzel-, Gruppenbuero": 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, "3.2 Grossraumbuero": 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}, selected="12.6 WC, Bad, Dusche": {"U-Wert opake Bauteile": 0.80000000000000004, "description": "12.6 WC, Bad, Dusche", "Temperatur-Aenderungsgrad der Waermerueckgewinnung": NaN, "Waermeeintragsleistung Personen (bei 24.0 deg C, bzw. 70 W)": NaN, "Jaehrliche Vollaststunden der Geraete": NaN, "Waermeeintragsleistung der Raumbeleuchtung": 10.5, "Emissionen transparente Bauteile": 50.0, "Emissionen opake Bauteile": 64.0, "Gesamtenergiedurchlassgrad Verglasung und Sonnenschutz": 0.20000000000000001, "Glasanteil": 30.0, "Raumlufttemperatur Auslegung Heizen (Winter)": 21.0, "Jaehrliche Vollaststunden der Raumbeleuchtung": 1240.0, "Kosten transparente Bauteile": 420.0, "Waermeeintragsleistung der Geraete": NaN, "Strahlungsleistung fuer Betaetigung Sonnenschutz": 200.0, "Vollaststunden pro Jahr (Personen)": 1250.0, "Gesamtenergiedurchlassgrad Verglasung": 0.65000000000000002, "U-Wert Fenster": 1.5, "Thermische Gebaeudehuellflaeche": 12.0, "Zeitkonstante": 19.0, "Aussenluft-Volumenstrom (pro NGF)": 16.0, "Raumlufttemperatur Auslegung Kuehlung (Sommer)": NaN, "Abminderungsfaktor fuer Fensterrahmen": 0.75, "Aussenluft-Volumenstrom durch Infiltration": 0.29999999999999999, "Nettogeschossflaeche": 20.0, "Kosten opake Bauteile": 268.0})
sia2024roomsideal = SIA2024IdealRooms({"1.1 Wohnen Mehrfamilienhaus": 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, "1.2 Wohnen Einfamilienhaus": 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, "2.1 Hotelzimmer": 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, "2.2 Empfang, Lobby": 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, "3.1 Einzel-, Gruppenbuero": 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, "3.2 Grossraumbuero": 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}, selected="12.2 Verkehrsflaeche 24 h": {"U-Wert opake Bauteile": 0.10000000000000001, "description": "12.2 Verkehrsflaeche 24 h", "Temperatur-Aenderungsgrad der Waermerueckgewinnung": 0.80000000000000004, "Waermeeintragsleistung Personen (bei 24.0 deg C, bzw. 70 W)": NaN, "Jaehrliche Vollaststunden der Geraete": NaN, "Waermeeintragsleistung der Raumbeleuchtung": 8.3000000000000007, "Emissionen transparente Bauteile": 79.599999999999994, "Emissionen opake Bauteile": 69.0, "Gesamtenergiedurchlassgrad Verglasung und Sonnenschutz": 0.10000000000000001, "Glasanteil": 30.0, "Raumlufttemperatur Auslegung Heizen (Winter)": 18.0, "Jaehrliche Vollaststunden der Raumbeleuchtung": 4890.0, "Kosten transparente Bauteile": 514.0, "Waermeeintragsleistung der Geraete": NaN, "Strahlungsleistung fuer Betaetigung Sonnenschutz": 200.0, "Vollaststunden pro Jahr (Personen)": 2040.0, "Gesamtenergiedurchlassgrad Verglasung": 0.5, "U-Wert Fenster": 0.90000000000000002, "Thermische Gebaeudehuellflaeche": 6.0, "Zeitkonstante": 403.0, "Aussenluft-Volumenstrom (pro NGF)": 2.0, "Raumlufttemperatur Auslegung Kuehlung (Sommer)": NaN, "Abminderungsfaktor fuer Fensterrahmen": 0.75, "Aussenluft-Volumenstrom durch Infiltration": 0.14999999999999999, "Nettogeschossflaeche": 20.0, "Kosten opake Bauteile": 426.0})
sia2024roomsstandard = SIA2024StandardRooms({"1.1 Wohnen Mehrfamilienhaus": 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, "1.2 Wohnen Einfamilienhaus": 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, "2.1 Hotelzimmer": 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, "2.2 Empfang, Lobby": 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, "3.1 Einzel-, Gruppenbuero": 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, "3.2 Grossraumbuero": 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}, selected="12.4 Nebenraum": {"U-Wert opake Bauteile": 0.20000000000000001, "description": "12.4 Nebenraum", "Temperatur-Aenderungsgrad der Waermerueckgewinnung": 0.69999999999999996, "Waermeeintragsleistung Personen (bei 24.0 deg C, bzw. 70 W)": NaN, "Jaehrliche Vollaststunden der Geraete": NaN, "Waermeeintragsleistung der Raumbeleuchtung": 6.0, "Emissionen transparente Bauteile": 64.0, "Emissionen opake Bauteile": 63.0, "Gesamtenergiedurchlassgrad Verglasung und Sonnenschutz": 0.14000000000000001, "Glasanteil": 30.0, "Raumlufttemperatur Auslegung Heizen (Winter)": 18.0, "Jaehrliche Vollaststunden der Raumbeleuchtung": 2170.0, "Kosten transparente Bauteile": 467.0, "Waermeeintragsleistung der Geraete": NaN, "Strahlungsleistung fuer Betaetigung Sonnenschutz": 200.0, "Vollaststunden pro Jahr (Personen)": 1400.0, "Gesamtenergiedurchlassgrad Verglasung": 0.5, "U-Wert Fenster": 1.2, "Thermische Gebaeudehuellflaeche": 12.0, "Zeitkonstante": 242.0, "Aussenluft-Volumenstrom (pro NGF)": 0.5, "Raumlufttemperatur Auslegung Kuehlung (Sommer)": NaN, "Abminderungsfaktor fuer Fensterrahmen": 0.75, "Aussenluft-Volumenstrom durch Infiltration": 0.14999999999999999, "Nettogeschossflaeche": 20.0, "Kosten opake Bauteile": 347.0})
sia2024creator = SIA2024RoomCreator(
    Description=list,
    TimeConstant=Slider(50, range=50..300),
    CoolingSetpoint=[Slider(16, range=16..30), Slider(16, range=16..30)],
    FloorArea=number_slider,
    EnvelopeArea=number_slider,
    GlazingRatio=number_slider,
    U_op_W_m_2K=number_slider,
    UValueTransparent=number_slider,
    GValue=number_slider,
    WindowsFrameReductionFactor=number_slider,
    VolumetricAirFlowRate=number_slider,
    V_inf_m_3_h=number_slider,
    HeatRecovery=number_slider,
    OccupationInternalHeatGains=number_slider,
    LightingInternalHeatGains=number_slider,
    EquipmentInternalHeatGains=number_slider,
    OccupationLoadHours=number_slider,
    LightingLoadHours=number_slider,
    EquipmentLoadHours=number_slider,
    OpaqueConstructionCost=number_slider,
    TransparentConstructionCost=number_slider,
    OpaqueConstructionEmbodiedEmissions=number_slider,
    TransparentConstructionEmbodiedEmissions=number_slider)
srf = Surface([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])
brep = Brep(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)
hiveinputbuilding = InputBuildingHive(ZoneGeometry=brep, WindowsSurfaces=srf, SiaRoom="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")
hivedistsiaroom = DistributorSIARoomHive(HiveBuilding=hiveinputbuilding)  # -> ZoneAreas, WindowsAreas, ExternalSurfacesAreas, SIA2024Room, AllExternalSurfaceAreas, SurfaceType, SUARoomSchedules, UseAdaptiveComfort, UseNaturalVentilation, UseFixedTimeConstant
panel = Panel(hivedistsiaroom.UseNaturalVentilation)
panel_2 = Panel(hivedistsiaroom.UseAdaptiveComfort)
python = GhPythonScript(x=hivedistsiaroom.SIA2024Room)  # -> out, a
# ---------- python: Python ----------
__author__ = "Maxence"
__version__ = "2021.07.29"

import rhinoscriptsyntax as rs

a = x.split(",")
# ---------- end python ----------
python_2 = GhPythonScript(x=sia2024creator)  # -> out, a; same code as python

# ---- group: Room Properties JSON
panel_3 = Panel(python.a)

# ----
panel_4 = Panel(python_2.a)
python_3 = GhPythonScript(x=hiveinputbuilding)  # -> out, a, b, c, d
# ---------- python_3: Python ----------
__author__ = "darthoma"
__version__ = "2020.08.24"

import rhinoscriptsyntax as rs

a = x.SIA2024.BuildingUseType

totalVolume = 0.0
totalWallArea = 0.0
totalFloorArea = 0.0
totalWinArea = 0.0
totalRoofArea = 0.0
for zone in x.Zones:
    totalVolume += zone.Volume
    for floor in zone.Floors:
        totalFloorArea += floor.Area
    for window in zone.Windows:
        totalWinArea += window.Area
    for wall in zone.Walls:
        totalWallArea += wall.Area
    for roof in zone.Roofs:
        totalRoofArea += roof.Area

b = ("Volume: ", totalVolume, "WallArea: ", totalWallArea, "FloorArea: ", totalFloorArea, "WindowsArea: ", totalWinArea, "RoofArea: ", totalRoofArea)

wallCost = x.Zones[0].Walls[0].TotalCost
wallEmissions = x.Zones[0].Walls[0].TotalEmissions
wallUValue = x.Zones[0].Walls[0].Construction.UValue

c = ("wallTotalCost: ", wallCost, "wallEmissions: ", wallEmissions, "wallU-Value: ", wallUValue)
d = ("windows co2: ", x.Zones[0].Windows[0].TotalEmissions)

print("Uvalue wall: ", x.Zones[0].Walls[0].Construction.UValue)
print("Uvalue roofs: ", x.Zones[0].Roofs[0].Construction.UValue)
print("Uvalue floors: ", x.Zones[0].Floors[0].Construction.UValue)
print("Uvalue windows: ", x.Zones[0].Windows[0].Construction.UValue)
# ---------- end python_3 ----------
panel_5 = Panel(python_3.d)
panel_6 = Panel(python_3.b)
panel_7 = Panel(python_3.c)
