# Grasshopper definition Hive_Full_Workflow.gh (Grasshopper 1.0.7)
# plug-ins: HiveIO, Hive.Core.solar, Hive.Core.sia380, GHSolar, Hive.Core.epw_reader

# ---- group: Pfad zur Wetterdatei (*.epw)
# C:\EnergyPlusV9-1-0\WeatherData\USA_FL_Tampa.Intl.AP.722110_TMY3.epw
panel = Panel("C:\Users\chwaibel\Documents\GitHub\hive\GrasshopperExamples\LectureExercises\HIVE_Zurich.epw")

# ---- group: PV Fläche
srf = Surface(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)

# ---- group: Gebäudevolumen
brep = Brep(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)

# ---- group: Fensterflächen
srf_2 = Surface([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])

# ---- group: Boden
mesh = Mesh(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)

# ---- group: Umgebungsbebauung
mesh_2 = Mesh([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])

# ----
mesh_uv = MeshSurface(Surface=srf, UCount="6", VCount="6", Overhang=True, Equalize=False)
hiveinputenergysystems = InputEnergySystemsHive(
    SolarTechProperties=mesh_uv,
    conversions="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",
    emitters="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",
    meshConnections="""{
  "$type": "System.Collections.Generic.Dictionary`2[[System.Int32, mscorlib],[System.Int32, mscorlib]], mscorlib"
}""",
    meshes="""{
  "$type": "Hive.IO.Forms.SurfaceViewModel[], Hive.IO",
  "$values": [
    {
      "$type": "Hive.IO.Forms.SurfaceViewModel, Hive.IO",
      "Name": "srf0",
      "Area": 72.761414769930553
    }
  ]
}""")  # -> flatten(EnergySystems)
hive_io_env = HiveIOEnvironment(EPWPath=panel, ObstaclesGeometry=[mesh, mesh_2])
hiveinputbuilding = InputBuildingHive(ZoneBrepGeometries=brep, WindowsSurfaces=srf_2, SiaRoom="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")
hiveiodistr = HiveIODistributor(HiveInputObjects=[hive_io_env, hiveinputbuilding, hiveinputenergysystems])  # -> HiveIOBuilding, HiveIOEnvironment, HiveIOEnergySystemSurfaceBasedTech, HiveIOEnergySystemConversionTech, HiveIOEnergySystemsEmitter

# ---- group: shading mask rec level
number_slider = Slider(5, range=0..5)
number_slider_2 = Slider(0.089, range=0..2)
toggle = BooleanToggle(False)

# ---- group: sun vector HOY
number_slider_3 = Slider(2294, range=0..8759)
toggle_2 = BooleanToggle(False)

# ---- group: show sunpath
toggle_3 = BooleanToggle(False)

# ---- group: Simple efficiency calculations?
toggle_4 = BooleanToggle(False)

# ---- group: Simulate solar?
toggle_5 = BooleanToggle(False)

# ----
nickname = GhDistributorConversionTech(HiveIOEnergySystemConversionTech=hiveiodistr.HiveIOEnergySystemConversionTech)  # -> HiveIOEnergySystemAirSourceHeatPump, HiveIOEnergySystemChiller, HiveIOEnergySystemsBoiler, HiveIOEnergySystemsCombinedHeatPowert, HiveIOEnergySystemsHeatExchanger, HiveIOEnergySystemsCoolExchanger, HiveIOEnergySystemElectricalSubstation
distrsolar = HiveIODistributorSolar(
    HiveIOBuilding=hiveiodistr.HiveIOBuilding,
    HiveIOEnergySystemSurfaceBased=hiveiodistr.HiveIOEnergySystemSurfaceBasedTech,
    HiveIOEnvironment=hiveiodistr.HiveIOEnvironment)  # -> EnvironmentMesh, BuildingCentroid, ExternalSurfaces, WindowGeometries, SolarTechMesh, WindowAzimuth, WindowAreas, SolarTechMesh_2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
distributorsia = DistributorSIA(BuildingObj=hiveiodistr.HiveIOBuilding)  # -> ZoneAreas, WindowsAreas, ExtSrfAreas, SIA2024json, AllExtSrfAreas, SurfaceType, SUA2024Schedules
hiveiodistrsupsys = HiveIODistributorSupplySystem(HiveIOEnergySystemsSurfaceBased=hiveiodistr.HiveIOEnergySystemSurfaceBasedTech)  # -> EfficiencyPV, PVAreas, EfficiencyST, STAreas, ElectricEfficiencyPVT, ThermalEfficiencyPVT, PVTAreas
hivedistenvironment = DistributorEnvironmentHive(HiveIOEnvironment=hiveiodistr.HiveIOEnvironment)  # -> Filepath, NaturalGas, BioGas, WoodPellets, DistrictHeating, DistrictCooling, GridElectricity, AmbientAirTemp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
epw_reader = EPWReader(Path=hivedistenvironment.Filepath)  # -> Latitude, Longitude, CityCountry, GHI, DNI, DHI, DryBulb, DewPoint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
sia2024room = SIA2024RoomReader(Room=distributorsia.SIA2024json, Area=distributorsia.ZoneAreas)  # -> Τ_h, Θ_i_C, T_h, A_op_m2, A_w_m2, U_op_W_m2K, U_w_W_m2K, V_e_m3_h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
python = GhPythonScript(x=distrsolar.WindowGeometries, y=toggle_5)  # -> out, a
# ---------- python: Python ----------
__author__ = "chwaibel"
__version__ = "2020.09.09"

import rhinoscriptsyntax as rs

if y:
    a = x
# ---------- end python ----------
python_2 = GhPythonScript(x=distrsolar.SolarTechMesh_2, y=toggle_5)  # -> out, a; same code as python
adaptivecomfort = AdaptiveComfort(AirTemperature=epw_reader.DryBulb)  # -> ThermalComfort, Comfort80UpperBound, Comfort80LowerBound, Comfort90UpperBound, Comfort90LowerBound

# ----
# SOLAR SIMULATION
data = Data([0.8, 0.8, 0.8, 0.8, 0.8, 0.8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])
mesh_3 = Mesh(distrsolar.ExternalSurfaces)
obstobj = ObstacleObject(Mesh=[distrsolar.EnvironmentMesh, mesh_3], Albedo=data, SpecCoeff=data, ReflType=0, Tolerance=0.01, Name="PV", MT=True)
item = ListItem(List=sia2024room.G_, Index=0, Wrap=True)

# ----
# Solare Wärmeeinträge (shaded)
mesh_4 = MeshBrep(
    Brep=python.a,
    Settings={GridMaxCount=0, GridMinCount=16, JaggedSeams=False, MaxEdgeLength=0, MinEdgeLength=0.0001, MinTolerance=0, Refine=True, RefineAngle=0, RelativeTolerance=0.65, SimplePlanes=True, Tolerance=0})
obstobj_2 = ObstacleObject(Mesh=mesh_4, Albedo=data, SpecCoeff=data, ReflType=0, Tolerance=0.01, Name="PV", MT=True)
irrmshy = IrradiationMeshYear(
    AnalysisObjects=obstobj_2,
    ObstacleObjects=obstobj,
    Latitude=epw_reader.Latitude,
    Longitude=epw_reader.Longitude,
    Year=2017,
    DNI=epw_reader.DNI,
    DHI=epw_reader.DHI,
    MainSkyRes=1,
    SpecBounces=0,
    DiffIReflSkyRes=0,
    DiffIReflMode=2,
    MT=True,
    Timezone=epw_reader.Timezone)
readresults = ReadResults(Mesh=mesh_4, I=irrmshy, Value=7)  # -> simplify(Results), SP
visumshsol = VisualizeMeshSolar(Mesh=mesh_4, I=irrmshy, Value=0)

# ---- group: DHI
data_2 = Data(epw_reader.DHI)

# ----
# Shading Mask
dni = Data(epw_reader.DNI)
panel_2 = Panel([epw_reader.Longitude, epw_reader.Latitude])
pt = Point(distrsolar.BuildingCentroid)
skydome = GHSkydome(
    RecursionLevel=number_slider,
    Viewfactors=toggle,
    CumSkyMatrix=Toggle(False),
    SunPath=toggle_3,
    SolarVec=toggle_2,
    HOY=number_slider_3,
    Location=panel_2,
    DNI=dni,
    DHI=data_2,
    Size=number_slider_2,
    Context=distrsolar.EnvironmentMesh,
    Sp=pt,
    Timezone=epw_reader.Timezone)  # -> Mesh, Vectors, Sunpaths, SunGeo

# ----
# Solare Wärmeeinträge (unshaded)
simplepanel = SimplePanel(
    Tilt=distrsolar.SolarTechMesh,
    Azimuth=distrsolar.WindowAzimuth,
    DHI=epw_reader.DHI,
    DNI=epw_reader.DNI,
    Latitude=epw_reader.Latitude,
    Longitude=epw_reader.Longitude,
    Aw=distrsolar.WindowAreas,
    Timezone=epw_reader.Timezone)

# ---- group: NEW SIA 380 COMPONENT
# DEMAND MODELING
toggle_6 = BooleanToggle(False)
sia380 = BuildingDemandSIA380(
    RoomProperties=distributorsia.SIA2024json,
    FloorArea=distributorsia.ZoneAreas,
    AirTemperature=epw_reader.DryBulb,
    SetpointsUpperBounds=adaptivecomfort.Comfort90UpperBound,
    SetpointsLowerBounds=adaptivecomfort.Comfort90LowerBound,
    EnvelopeSurfaceAreas=distributorsia.AllExtSrfAreas,
    EnvelopeSurfaceTypes=distributorsia.SurfaceType,
    SurfaceIrradiation=readresults.Results,
    SurfaceIrradiationUnobstructed=simplepanel,
    GValue=item,
    GValueWithSunscreen=sia2024room.G_total_,
    SetpointSunscreen=sia2024room.G_T_W_m_2,
    RunObstructedSolarSimulation=toggle_5,
    RunHourly=toggle_6)  # -> HeatingDemand, CoolingDemand, ElectricityDemand, TransmissionHeatLosses, VentilationHeatLosses, InternalGains, SolarGains, TransmissionHeatLossesOfOpaqueSurfaces, TransmissionHeatLossesOfTransparentSurfaces, SolarGainsPerTransparentSurface
ma = MassAddition(Input=sia380.HeatingDemand)  # -> Result, PartialResults
abs = Absolute(Value=sia380.CoolingDemand)
division = Division(A=ma.Result, B=distributorsia.ZoneAreas)

# ----
# PV Ertrag (simuliert)
obstobj_3 = ObstacleObject(Mesh=python_2.a, Albedo=data, SpecCoeff=data, ReflType=0, Tolerance=0.01, Name="PV", MT=True)
irrmshy_2 = IrradiationMeshYear(
    AnalysisObjects=obstobj_3,
    ObstacleObjects=obstobj,
    Latitude=epw_reader.Latitude,
    Longitude=epw_reader.Longitude,
    Year=2017,
    DNI=epw_reader.DNI,
    DHI=epw_reader.DHI,
    MainSkyRes=1,
    SpecBounces=0,
    DiffIReflSkyRes=0,
    DiffIReflMode=2,
    MT=True,
    Timezone=epw_reader.Timezone)
readresults_2 = ReadResults(Mesh=distrsolar.SolarTechMesh_2, I=irrmshy_2, Value=7)  # -> Results, SP
python_3 = GhPythonScript(x=simplify(readresults_2.Results), month=[0, 1, 2, 3, 4, 5, 6, 7, 8, 9, 10, 11])  # -> out, a; inputs x: list, month: Int32
# ---------- python_3: Python ----------
__author__ = "chwaibel"
__version__ = "2020.02.25"

import rhinoscriptsyntax as rs

# 8760 time series
# get monthly average...
# how to know how many days a month? somewhere, I have typical year.
# in some honey-badger script

dayspermonth = [31.0, 28.0, 31.0, 30.0, 31.0, 30.0, 31.0, 31.0, 30.0, 31.0, 30.0, 31.0]

hour_per_day = 24
start_hour = int(hour_per_day * sum(dayspermonth[0:month])) 
end_hour = int(hour_per_day * sum(dayspermonth[0:month+1]))

cumulative_data = sum(x[start_hour:end_hour])

a = cumulative_data / 1000
# ---------- end python_3 ----------
visumshsol_2 = VisualizeMeshSolar(Mesh=distrsolar.SolarTechMesh_2, I=irrmshy_2, Value=0)
c_script = CSharpScript(G=python_3.a, g=hiveiodistrsupsys.EfficiencyPV)  # -> out, Q_s; inputs G: tree of Double, g: list of Double
# ---------- c_script: C# ----------
    int winCount = G.BranchCount;
    double [] Q_array = new double[12];

    DataTree<double> doubleTree = new DataTree<double>();
    for (int i = 0; i < G.BranchCount; i++)
    {
      for (int j = 0; j < G.Branch(i).Count; ++j) // should be 12, 1 for each month of the year
      {
        GH_Path path = new GH_Path(i, j);
        double irrad = G.Branch(i)[j]  * g[i];
        doubleTree.Add(irrad, path);

        Q_array[j] += irrad;
      }
    }

    Q_s = Q_array;
# ---------- end c_script ----------
ma_2 = MassAddition(Input=c_script.Q_s)  # -> Result, PartialResults
ma_3 = MassAddition(Input=hiveiodistrsupsys.PVAreas)  # -> Result, PartialResults
division_2 = Division(A=ma_2.Result, B=ma_3.Result)

# ----
# PV Ertrag (unverschattet)
# Q_s = G * F_F * A_w * g
# [Q_s] = kWh
# [G] = kWh/m^2
# [F_F] = -
# [A_w] = m^2
# [g] = -
simplepanel_2 = SimplePanel(
    Tilt=distrsolar.SolarTechTilt,
    Azimuth=distrsolar.SolarTechAzimuth,
    DHI=epw_reader.DHI,
    DNI=epw_reader.DNI,
    Latitude=epw_reader.Latitude,
    Longitude=epw_reader.Longitude)

# ----
# Energy Hub
python_4 = GhPythonScript(emitters=hiveiodistr.HiveIOEnergySystemsEmitter)  # -> out, monthlyHeatingSupTemp, monthlyCoolingSupTemp, heatingCarrier, monthlyHeatingReturnTemp, yearlyHeatingSupTemp, yearlyHeatingReturnTemp, monthlyCoolingReturnTemp; inputs emitters: list
# ---------- python_4: Python ----------
__author__ = "chwaibel"
__version__ = "2020.08.20"

import rhinoscriptsyntax as rs

for e in emitters:
    if e.IsCooling:
        monthlyCoolingSupTemp = e.InletCarrier.MonthlyTemperature
        monthlyCoolingReturnTemp = e.ReturnCarrier.MonthlyTemperature
    else:
        monthlyHeatingSupTemp = e.InletCarrier.MonthlyTemperature
        heatingCarrier = e
        monthlyHeatingReturnTemp = e.ReturnCarrier.MonthlyTemperature
        yearlyHeatingSupTemp = e.InletCarrier.Temperature
        yearlyHeatingReturnTemp = e.ReturnCarrier.Temperature
# ---------- end python_4 ----------

# ----
# PV / ST
python_5 = GhPythonScript(x=irrmshy_2)  # -> out, a
# ---------- python_5: Python ----------
__author__ = "chwaibel"
__version__ = "2020.08.21"

import rhinoscriptsyntax as rs

a = x.I_hourly
# ---------- end python_5 ----------
hivemergersolartech = MergerSolarTechHive(
    I_hourlyM=python_5.a,
    SolarTech=hiveiodistr.HiveIOEnergySystemSurfaceBasedTech,
    Air=hivedistenvironment.AmbientAirTemp,
    SupplyTemp=python_4.yearlyHeatingSupTemp,
    ReturnTemp=python_4.yearlyHeatingReturnTemp,
    SimpleMode=toggle_4,
    I_hourly=simplepanel_2)
python_6 = GhPythonScript(x=hivemergersolartech)  # -> out, a
# ---------- python_6: Python ----------
__author__ = "chwaibel"
__version__ = "2020.08.24"

import rhinoscriptsyntax as rs
a = x.OutputCarriers[0].MonthlyCumulativeEnergy
# ---------- end python_6 ----------
panel_3 = Panel(hivemergersolartech)
ma_4 = MassAddition(Input=python_6.a)  # -> Result, PartialResults
graph = QuickGraph(python_6.a, SortOrder=0)
panel_4 = Panel(ma_4.Result)

# ----
# Heat Exchanger for District Heating
hivemergerhx = MergerHeatExchangerHive(
    DistrictHeating=hivedistenvironment.DistrictHeating,
    HeatDemand=sia380.HeatingDemand,
    SuppTemp=python_4.monthlyHeatingSupTemp,
    ReturnTemp=python_4.monthlyHeatingReturnTemp,
    HeatExchanger=nickname.HiveIOEnergySystemsHeatExchanger)
panel_5 = Panel(hivemergerhx)

# ----
# Gas Boiler
hivemergerboiler = MergerGasBoilerHive(
    Gas=hivedistenvironment.NaturalGas,
    HeatDemand=sia380.HeatingDemand,
    SuppTemp=python_4.monthlyHeatingSupTemp,
    HiveIOGasBoiler=nickname.HiveIOEnergySystemsBoiler)
panel_6 = Panel(hivemergerboiler)

# ----
# Air Source Heat Pump
hivemergerashp = MergerAirSourceHeatPumpHive(
    Air=hivedistenvironment.AmbientAirTemp,
    Electricity=hivedistenvironment.GridElectricity,
    HeatGenerated=sia380.HeatingDemand,
    SuppTemp=python_4.monthlyHeatingSupTemp,
    SimpleMode=toggle_4,
    ASHP=nickname.HiveIOEnergySystemAirSourceHeatPump)
panel_7 = Panel(hivemergerashp)

# ----
# Heat Exchanger for District Cooling
hivemergercx = MergerCoolingExchangerHive(
    DistrictCooling=hivedistenvironment.DistrictCooling,
    CoolDemand=abs,
    SuppTemp=python_4.monthlyCoolingSupTemp,
    ReturnTemp=python_4.monthlyCoolingReturnTemp,
    CoolingExchanger=nickname.HiveIOEnergySystemsCoolExchanger)
panel_8 = Panel(hivemergercx)

# ----
# Chiller
hivemergerchiller = MergerChillerHive(
    Air=hivedistenvironment.AmbientAirTemp,
    Electricity=hivedistenvironment.GridElectricity,
    CoolingGenerated=abs,
    CondenserTemp=python_4.monthlyCoolingSupTemp,
    SimpleMode=toggle_4,
    Chiller=nickname.HiveIOEnergySystemChiller)
panel_9 = Panel(hivemergerchiller)

# ----
# Plug-in any conversion tech
python_7 = GhPythonScript(x=hivemergerchiller)  # -> out, description, outEnergy
# ---------- python_7: Python ----------
__author__ = "chwaibel"
__version__ = "2020.08.18"

import rhinoscriptsyntax as rs

a = ("total investment cost: ", x.SpecificInvestmentCost * x.Capacity)
b = ("capacity: ", x.Capacity)
c = ("cap unit; ", x.CapacityUnit)
d = ("name: ", x.Name)
e = ("opCost CHF/a: ", sum(x.InputCarrier.TotalEnergyCost))
f = ("tot Input Energy kWh/a: ", sum(x.InputCarrier.Energy))
g = ("Tot Output Energy kWh/a: ", sum(x.OutputCarriers[0].MonthlyCumulativeEnergy))
h = ("Inp Car PEF: ", x.InputCarrier.PrimaryEnergyFactor)
description = [a, b, c, d, e, f, g, h]

# print(x.InputCarrier.MonthlyCumulativeEnergy)
#print(x.OutputCarriers[0].Energy)
print(x.InputCarrier.PrimaryEnergyFactor)
print("Input type: ", type(x.InputCarrier))
print("Output type: ", type(x.OutputCarriers[0]))
outEnergy = x.OutputCarriers[0].MonthlyCumulativeEnergy
print(x.IsCooling)
# ---------- end python_7 ----------
panel_10 = Panel(python_7.description)

python_8 = GhPythonScript(chiller=hivemergerchiller, ashp=hivemergerashp, siaElec=sia380.ElectricityDemand)  # -> out, additionalElec; inputs siaElec: list
# ---------- python_8: Python ----------
__author__ = "Christoph"
__version__ = "2020.09.13"

import rhinoscriptsyntax as rs
if chiller != None and ashp != None:
    additionalElec = [a+b+c for a,b,c in zip(chiller.InputCarrier.MonthlyCumulativeEnergy, ashp.InputCarrier.MonthlyCumulativeEnergy, siaElec)]
elif ashp != None and chiller is None:
    additionalElec = [a+b for a,b in zip(ashp.InputCarrier.MonthlyCumulativeEnergy, siaElec)]
elif ashp is None and chiller != None:
    additionalElec = [a+b for a,b in zip(chiller.InputCarrier.MonthlyCumulativeEnergy, siaElec)]
else:
    additionalElec = siaElec
# ---------- end python_8 ----------
python_9 = GhPythonScript(pvOrSt=hivemergersolartech, elecDemandIn=python_8.additionalElec, heatDemandIn=sia380.HeatingDemand)  # -> out, flatten(elecDemandOut), heatDemandOut; inputs elecDemandIn: list, heatDemandIn: list
# ---------- python_9: Python ----------
__author__ = "Christoph"
__version__ = "2020.09.13"

import rhinoscriptsyntax as rs
import Hive.IO.EnergySystems
if(pvOrSt != None):
    energyRenewable = pvOrSt.OutputCarriers[0].MonthlyCumulativeEnergy

if(type(pvOrSt) == Hive.IO.EnergySystems.Photovoltaic):
    elecDemandOut = [x - y for x, y in zip(elecDemandIn, energyRenewable)]
    heatDemandOut = heatDemandIn
elif(type(pvOrSt) == Hive.IO.EnergySystems.SolarThermal):
    heatDemandOut = [x - y for x, y in zip(heatDemandIn, energyRenewable)] 
    elecDemandOut = elecDemandIn
else:
    heatDemandOut = heatDemandIn
    elecDemandOut = elecDemandIn
# ---------- end python_9 ----------

# ----
# Purchased Grid Electricity for appliances
hivemergersubstation = MergerElectricalSubstationHive(
    GridElectricity=hivedistenvironment.GridElectricity,
    ElecPurchased=python_9.elecDemandOut,
    ElectricalSubstation=nickname.HiveIOEnergySystemElectricalSubstation)
panel_11 = Panel(hivemergersubstation)

# ----
# CHP
hivemergerchp = MergerCHPHive(
    Gas=hivedistenvironment.NaturalGas,
    EnergyDemand=sia380.ElectricityDemand,
    IsHeatingDemand=False,
    SuppTemp=python_4.monthlyHeatingSupTemp,
    HiveIOCombinedHeatPower=nickname.HiveIOEnergySystemsCombinedHeatPowert)
panel_12 = Panel(hivemergerchp)

# ----
# Results
hiveresults = ResultsHive(
    CoolingMonthly=abs,
    HeatingMonthly=python_9.heatDemandOut,
    ElectricityMonthly=python_9.elecDemandOut,
    HiveBuilding=hiveiodistr.HiveIOBuilding,
    HiveConversionTech=flatten([hivemergerboiler, hivemergerhx, hivemergercx, hivemergersolartech, hivemergersubstation, hivemergerchiller, hivemergerashp]),
    Q_T_opaque=sia380.TransmissionHeatLossesOfOpaqueSurfaces,
    Q_T_transparent=sia380.TransmissionHeatLossesOfTransparentSurfaces,
    Q_V=sia380.VentilationHeatLosses,
    Q_i=sia380.InternalGains,
    Q_s=sia380.SolarGains,
    ConsumedElec=python_8.additionalElec,
    ConsumedHeat=sia380.HeatingDemand,
    Q_s_per_win=sia380.SolarGainsPerTransparentSurface)

hive_io_visualizer = HiveIOVisualizer(
    hiveresults,
    PlotProperties="""{
  "$type": "System.Collections.Generic.Dictionary`2[[System.String, mscorlib],[System.String, mscorlib]], mscorlib"
}""")
python_10 = GhPythonScript(x=hiveresults)  # -> out, a
# ---------- python_10: Python ----------
__author__ = "chwaibel"
__version__ = "2020.09.23"

import rhinoscriptsyntax as rs
print("IN")
print("SolarGains: ", x.TotalSolarGains)
print("InternalGains: ", x.TotalInternalGains)
print("PrimaryEnergy: ", sum(x.TotalPrimaryEnergyMonthlyNonRenewable))
print("RenewableEnergy: ", sum(x.TotalFinalEnergyMonthlyRenewable))
print("OUT")
print("Electricity: ", sum(x.TotalConsumedElectricityMonthly))
print("VentilationLosses: ", x.TotalVentilationHeatLosses)
print("EnvelopeLosses: ", x.TotalOpaqueTransmissionHeatLosses)
print("WindowLosses: ", x.TotalWindowTransmissionHeatLosses)
print("SystemLosses: ", x.TotalSystemLosses)
print("ActiveCooling: ", sum(x.TotalActiveCoolingMonthly))
print("SurplusElectricity: ", sum(x.TotalFeedInElectricityMonthly))
print("SurplusHeating: ", sum(x.TotalSurplusHeatingMonthly))
print("Technologies")
print(x.ConversionTechnologies)

print(x.Building.Zones[0].HeatingLoadsMonthly)
# ---------- end python_10 ----------
panel_13 = Panel(python_10.out)
