# Grasshopper definition Hive_Parametric_Inputs.gh (Grasshopper 1.0.7)
# plug-ins: HiveIO, Hive.Core.sia380Parameters

# ----
# Building
number_slider = Slider(0.25, range=0..1)
list = ValueList({"1.2 Wohnen Einfamilienhaus"}, selected="1.2 Wohnen Einfamilienhaus")
rooms_existing = RoomsExisting({"1.1 Wohnen Mehrfamilienhaus": {"description": "1.1 Wohnen Mehrfamilienhaus", "Raumlufttemperatur Auslegung Heizen (Winter)": 21.0, "Nettogeschossflaeche": 20.0, "Thermische Gebaeudehuellflaeche": 26.0, "U-Wert Fenster": 1.5, "Waermeeintragsleistung Personen (bei 24.0 deg C, bzw. 70 W)": 2.2999999999999998, "Jaehrliche Vollaststunden der Geraete": 1780.0, "U-Wert opake Bauteile": 0.80000000000000004, "Jaehrliche Vollaststunden der Raumbeleuchtung": 1450.0, "Vollaststunden pro Jahr (Personen)": 4090.0, "Abminderungsfaktor fuer Fensterrahmen": 0.75, "Aussenluft-Volumenstrom durch Infiltration": 0.29999999999999999, "Raumlufttemperatur Auslegung Kuehlung (Sommer)": 26.0, "Glasanteil": 30.0, "Zeitkonstante": 68.0, "Waermeeintragsleistung der Raumbeleuchtung": 2.7000000000000002, "Waermeeintragsleistung der Geraete": 10.0, "Gesamtenergiedurchlassgrad Verglasung": 0.65000000000000002, "Temperatur-Aenderungsgrad der Waermerueckgewinnung": NaN, "Aussenluft-Volumenstrom (pro NGF)": 1.0}, "1.2 Wohnen Einfamilienhaus": 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, "2.1 Hotelzimmer": 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, "2.2 Empfang, Lobby": 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, "3.1 Einzel-, Gruppenbuero": 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, "3.2 Grossraumbuero": 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, "3.3 Sitzungszimmer": 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, "3.4 Schalterhalle, Empfang": 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, "4.1 Schulzimmer": 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, "4.2 Lehrerzimmer": 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}, selected="1.1 Wohnen Mehrfamilienhaus")
number_slider_2 = Slider(0.527, range=0..1)
number_slider_3 = Slider(0.288, range=0..1)
number_slider_4 = Slider(0.527, range=0..1)
hiveparainroom = ParametricInputSIARoomHive(
    Description=list,
    RoomConstant=Slider(50, range=50..300),
    CapacitancePerFloorArea=Slider(16, range=16..30),
    CoolingSetpoint=Slider(16, range=16..30),
    HeatingSetpoint=Slider(0.25, range=0..1),
    UValueOpaque=Slider(0.25, range=0..1),
    UValueTransparent=Slider(0.25, range=0..1),
    GValue=Slider(0.25, range=0..1),
    GValueTotal=Slider(0.387, range=0..1),
    ShadingSetpoint=Slider(0.25, range=0..1),
    WindowFrameReduction=Slider(0.25, range=0..1),
    AirChangeRate=number_slider,
    Infiltration=Slider(0.25, range=0..1),
    HeatRecovery=Slider(0.25, range=0..1),
    OccupantLoads=Slider(0.356, range=0..1),
    LightingLoads=Slider(0.25, range=0..1),
    EquipmentLoads=Slider(0.25, range=0..1),
    OccupantYearlyHours=Slider(0.25, range=0..1),
    LightingYearlyHours=Slider(0.25, range=0..1),
    EquipmentYearlyHours=Slider(0.25, range=0..1),
    OpaqueCost=Slider(0.25, range=0..1),
    TransparentCost=Slider(0.197, range=0..1),
    OpaqueEmissions=Slider(0.342, range=0..1),
    TransparentEmissions=Slider(0.202, range=0..1))
srf = Surface([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])
brep = Brep(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)
hiveinputbuilding = InputBuildingHive(ZoneGeometry=brep, WindowsSurfaces=srf, SIA2024Room=hiveparainroom)
python = GhPythonScript(x=hiveinputbuilding)  # -> out, a
# ---------- python: Python ----------
__author__ = "Christoph"
__version__ = "2020.11.10"

import rhinoscriptsyntax as rs

r = x.SIA2024
print("RoomType: ", r.RoomType)
print("RoomConstant: ", r.RoomConstant)
print("CoolingSetpoint: ", r.CoolingSetpoint)
print("HeatingSetpoint: ", r.HeatingSetpoint)
print("FloorArea: ", r.FloorArea)
print("EnvelopeArea: ", r.EnvelopeArea)
print("GlazingRatio: ", r.GlazingRatio)
print("UValueOpaque: ", r.UValueOpaque)
print("UValueTransparent: ", r.UValueTransparent)
print("GValue: ", r.GValue)
print("GValueTotal: ", r.GValueTotal)
print("ShadingSetpoint: ", r.ShadingSetpoint)
print("WindowFrameReduction: ", r.WindowFrameReduction)
print("AirChangeRate: ", r.AirChangeRate)
print("Infiltration: ", r.Infiltration)
print("HeatRecovery: ", r.HeatRecovery)
print("OccupantLoads: ", r.OccupantLoads)
print("LightingLoads: ", r.LightingLoads)
print("EquipmentLoads: ", r.EquipmentLoads)
print("OccupantYearlyHours: ", r.OccupantYearlyHours)
print("LightingYearlyHours: ", r.LightingYearlyHours)
print("EquipmentYearlyHours: ", r.EquipmentYearlyHours)
print("OpaqueCost: ", r.OpaqueCost)
print("TransparentCost: ", r.TransparentCost)
print("OpaqueEmissions: ", r.OpaqueEmissions)
print("TransparentEmissions: ", r.TransparentEmissions)
print("")
print("Volume: ", x.Zones[0].Volume)
print("Net floor area: ", x.Zones[0].FloorsAreaNet)
print("gross floor area: ", x.Zones[0].FloorsAreaGross)
print("Window area: ", x.Zones[0].WindowArea)
print("Wall area: ", x.Zones[0].WallsArea)
print("Roof area: ", x.Zones[0].RoofsArea)
# ---------- end python ----------
panel = Panel(python.out)

# ----
# Environment
panel_2 = Panel("UCT-Mix")
python_2 = GhPythonScript()  # -> out, a
# ---------- python_2: Python ----------
__author__ = "chwaibel"
__version__ = "2020.08.19"

import rhinoscriptsyntax as rs

a = [0.1] * 8760
# ---------- end python_2 ----------
panel_3 = Panel("C:\Users\chwaibel\Documents\GitHub\hive\GrasshopperExamples\LectureExercises\HIVE_Zurich.epw")
hiveparainpotentials = ParametricInputEnergyPotantialsHive(
    NaturalGasName="gazprom",
    NaturalGasPrice=python_2.a,
    NaturalGasEmissions=python_2.a,
    NaturalGasAvailability=python_2.a,
    BioGasName="Altstetten-Biogas",
    BioGasPrice=python_2.a,
    BioGasEmissions=python_2.a,
    BioGasAvailability=python_2.a,
    WoodPelletsName="ZuriWald",
    WoodPelletsPrice=python_2.a,
    WoodPelletsEmissions=python_2.a,
    WoodPelletsAvailability=python_2.a,
    DistrictHeatingName="Schwamendingen",
    DistrictHeatingPrice=python_2.a,
    DistrictHeatingEmissions=python_2.a,
    DistrictHeatingAvailability=python_2.a,
    DistrictHeatingSupplyTemp=python_2.a,
    DistrictCoolingName="Zurilake",
    DistrictCoolingPrice=python_2.a,
    DistrictCoolingEmissions=python_2.a,
    DistrictCoolingAvailability=python_2.a,
    DistrictCoolingSupplyTemp=python_2.a,
    GridElectricityName=panel_2,
    GridElectricityPrice=python_2.a,
    GridElectricityEmissions=python_2.a,
    GridElectricityAvailability=python_2.a)
hiveinputenvironment = InputEnvironmentHive(EpwPath=panel_3, Potentials=hiveparainpotentials)
python_3 = GhPythonScript(x=hiveinputenvironment)  # -> out, a
# ---------- python_3: Python ----------
__author__ = "Christoph"
__version__ = "2020.11.10"

import rhinoscriptsyntax as rs
import Hive.IO.Misc as misc

for carrier in x.EnergyPotentials:
    print("")
    print(type(carrier))
    print("Gas Name: ", carrier.Name)
    print("Unit: ", carrier.Unit)
    print("Horizon: ", carrier.Horizon)
    print("MonthlyCumulativeEnergy: ", carrier.EnergyMonthlyCumulative)
    print("MonthlyAverageHourlyPrice: ", misc.GetAverageMonthlyValue(carrier.SpecificCost))
    print("MonthlyAverageHourlyEmissions: ", misc.GetAverageMonthlyValue(carrier.SpecificEmissions))
    print("PEF: ", carrier.PrimaryEnergyFactor)
    print("MonthlyAverageTemperature: ", carrier.TemperatureMonthly)
# ---------- end python_3 ----------
panel_4 = Panel(python_3.out)

# ---- group: this solar tech needs to be defined in the Form!
mesh = Mesh(graft(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))

# ----
# EnergySystems
number_slider_5 = Slider(20.223, range=10..25)
number_slider_6 = Slider(36.007, range=35..65)
number_slider_7 = Slider(23.178, range=0..100)
number_slider_8 = Slider(0.25, range=0..100)
number_slider_9 = Slider(0.25, range=0..100)
addition = Addition(A=number_slider_5, B="5")
subtraction = Subtraction(A=number_slider_6, B="10")
number_slider_10 = Slider(0, range=0..100)
number_slider_11 = Slider(22.871, range=0..100)
number_slider_12 = Slider(0.25, range=0..100)
panel_5 = Panel(subtraction)
panel_6 = Panel(number_slider_6)
panel_7 = Panel(number_slider_5)
panel_8 = Panel(addition)
panel_9 = Panel(Slider(0.3, range=0.01..0.3))
mesh_2 = Mesh(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)
mesh_3 = Mesh(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)
nickname = GhParametricInputEnergySystems(
    ASHPCapacity=number_slider_12,
    ASHPCost=number_slider_12,
    ASHPEmissions=number_slider_12,
    ASHPCOP=number_slider_12,
    NGBoilerCapacity=number_slider_10,
    NGBoilerCost=number_slider_10,
    NGBoilerEmissions=number_slider_10,
    NGBoilerEfficiency=number_slider_10,
    CHPCapacity=number_slider_11,
    CHPCost=number_slider_11,
    CHPEmissions=number_slider_11,
    CHPHTP=number_slider_11,
    CHPEffElec=number_slider_11,
    ChillerCapacity=number_slider_7,
    ChillerCost=number_slider_7,
    ChillerEmissions=number_slider_7,
    ChillerCOP=number_slider_7,
    HeatExchangerCapacity=number_slider_9,
    HeatExchangerCost=number_slider_9,
    HeatExchangerEmissions=number_slider_9,
    HeatExchangerLosses=number_slider_9,
    CoolExchangerCapacity=number_slider_8,
    CoolExchangerCost=number_slider_8,
    CoolExchangerEmissions=number_slider_8,
    CoolExchangerLosses=number_slider_8)
emitterinputs = HiveIOEnergySystemsEmitter(
    Vorlauf=panel_6,
    Rücklauf=panel_5,
    Capacity="1.0",
    InvestmentCost="200",
    EmbodiedEmissions="50",
    Name="Heater",
    AirEmitter=False,
    Cooling=False)
emitterinputs_2 = HiveIOEnergySystemsEmitter(
    Vorlauf=panel_7,
    Rücklauf=panel_8,
    Capacity="1.0",
    InvestmentCost="200",
    EmbodiedEmissions="50",
    Name="Cooler",
    AirEmitter="true",
    Cooling="true")
hiveparainsolartech = ParametricInputSolarTechHive(
    Mesh=mesh_3,
    Type="PV",
    Technology="A/S wow tech",
    EfficiencyElectric=panel_9,
    EfficiencyThermal="0.0",
    InvestmentCost="3000",
    EmbodiedEmissions="200",
    InvestmentCost_2="1000",
    EmbodiedEmissions_2="1000")

hiveparainsolartech_2 = ParametricInputSolarTechHive(
    Mesh=mesh_2,
    Type="ST",
    Technology="NanoBorgTech",
    EfficiencyElectric="0.0",
    EfficiencyThermal="0.2",
    InvestmentCost="2500",
    EmbodiedEmissions="150",
    InvestmentCost_2="1000",
    EmbodiedEmissions_2="1000")

hiveinputenergysystems = InputEnergySystemsHive(
    MeshSolarTechnologyProperties=[mesh, hiveparainsolartech_2, hiveparainsolartech],
    ConversionTechnologyProperties=nickname,
    EmitterProperties=[emitterinputs, emitterinputs_2],
    conversions="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",
    emitters="""{
  "$type": "Hive.IO.Forms.EmitterPropertiesViewModel[], Hive.IO",
  "$values": []
}""",
    meshConnections="""{
  "$type": "System.Collections.Generic.Dictionary`2[[System.Int32, mscorlib],[System.Int32, mscorlib]], mscorlib",
  "0": 0
}""",
    meshes="""{
  "$type": "Hive.IO.Forms.SurfaceViewModel[], Hive.IO",
  "$values": [
    {
      "$type": "Hive.IO.Forms.SurfaceViewModel, Hive.IO",
      "Name": "srf0",
      "Area": 23.465697270459675
    }
  ]
}""")
panel_10 = Panel(hiveinputenergysystems)
python_4 = GhPythonScript(x=hiveinputenergysystems)  # -> out, a; inputs x: list
# ---------- python_4: Python ----------
__author__ = "chwaibel"
__version__ = "2020.08.11"

import rhinoscriptsyntax as rs

for tech in x:
    print(type(tech))
    print("Name: ", tech.Name)
    print("Capacity: ", tech.Capacity)
    print("CapacityUnit: ", tech.CapacityUnit)
# ---------- end python_4 ----------
python_5 = GhPythonScript(x=hiveinputenergysystems)  # -> out, a
# ---------- python_5: Python ----------
__author__ = "chwaibel"
__version__ = "2020.08.11"

import rhinoscriptsyntax as rs

a= x.SpecificInvestmentCost
# ---------- end python_5 ----------
panel_11 = Panel(python_5.a)

python_6 = GhPythonScript(tech=hiveinputenergysystems)  # -> out, a
# ---------- python_6: Python ----------
__author__ = "chwaibel"
__version__ = "2020.08.11"

import rhinoscriptsyntax as rs
import Hive.IO.EnergySystems as hive
import Hive.IO.Misc as misc

print(type(tech))
print("Name: ", tech.Name)
print("Capacity: ", tech.Capacity)
print("CapacityUnit: ", tech.CapacityUnit)
if type(tech)==hive.Photovoltaic:
    print("detailedName: ", tech.DetailedName)
    print("Efficiency: ", tech.RefEfficiencyElectric)
    print("area: ", tech.SurfaceArea)
if type(tech) == hive.SolarThermal:
    print("detailedName: ", tech.DetailedName)
    print("Efficiency: ", tech.RefEfficiencyHeating)
if type(tech) == hive.GasBoiler:
    print("detailedName: ", tech.DetailedName)
    print("Efficiency: ", tech.Efficiency)
if type(tech) == hive.Radiator or type(tech) == hive.AirDiffuser:
    print("Supply Temp: ", misc.GetAverageMonthlyValue(tech.InletCarrier.Temperature))
    print("Return Temp: ", misc.GetAverageMonthlyValue(tech.ReturnCarrier.Temperature))
    print("cooling?: ", tech.IsCooling)
    print("heating?: ", tech.IsHeating)

print("spec cost: ", tech.SpecificInvestmentCost)
print("tot COst: ", tech.SpecificInvestmentCost * tech.Capacity)
# ---------- end python_6 ----------
panel_12 = Panel(python_4.out)

panel_13 = Panel(python_6.out)

hivedistributor = MainDistributorHive(HiveInputs=flatten([hiveinputenvironment, hiveinputbuilding, hiveinputenergysystems]))  # -> HiveBuilding, HiveEnvironment, HiveEnergySystemsSurfaceBasedTech, HiveEnergySystemsConversionTech, HiveEnergySystemsEmitter
