# Grasshopper definition Hive_Results.gh (Grasshopper 1.0.7)
# plug-ins: HiveIO

# ---- group: Windows
srf = Surface([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])

# ---- group: Building volume
brep = Brep(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)

# ----
hiveinputbuilding = InputBuildingHive(ZoneGeometry=brep, WindowsSurfaces=srf, SiaRoom="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")
data = Data([0, 0, 0, 0, 791.7275443, 926.1483241, 1020.391622, 904.2285485, 544.0756493, 0, 0, 0])
data_2 = Data([887.1419179, 750.7646012, 640.5423939, 502.0043118, 234.8020055, 195.6598913, 190.1095567, 176.7961969, 204.3932611, 479.5219244, 710.1155642, 836.401585])
data_3 = Data([1494.208015, 1264.508487, 1078.861859, 845.5229668, 395.4756635, 329.5488264, 320.2004297, 297.7768146, 344.2583908, 807.6560113, 1196.043549, 1408.746365])
data_4 = Data([2175.65153, 1704.972573, 1240.861465, 830.0144965, 0, 0, 0, 0, 0, 871.0376534, 1634.843988, 2045.588655])
data_5 = Data([781.7591643, 633.417249, 524.8939663, 420.7703606, 483.5039062, 533.6989326, 577.7191975, 546.527421, 408.7056104, 432.8145254, 614.6294472, 738.1270165])
data_6 = Data([302.6958904, 273.4027397, 302.6958904, 292.9315068, 302.6958904, 292.9315068, 302.6958904, 302.6958904, 292.9315068, 302.6958904, 292.9315068, 302.6958904])
data_7 = Data([415.550817, 351.6696, 300.0398355, 235.146483, 281.0723785, 234.216871, 227.5727805, 211.6358736, 244.6712494, 224.6153895, 332.6289705, 391.7832705])
data_8 = Data([293.4828857, 387.8265512, 519.6757824, 538.8109176, 1281.718797, 1277.807338, 1336.915594, 1169.078639, 929.6319753, 397.9848052, 306.1782018, 264.4751971])
data_9 = Data([781.7591643, 633.417249, 524.8939663, 420.7703606, 483.5039062, 533.6989326, 577.7191975, 546.527421, 408.7056104, 432.8145254, 614.6294472, 738.1270165])
data_10 = Data([327.7663342, 274.1435644, 258.9068417, 213.8483476, 421.3587945, 407.7665753, 421.3587945, 421.3587945, 407.7665753, 242.7708666, 297.7658936, 326.8673688])
data_11 = Data([2175.65153, 1704.972573, 1240.861465, 830.0144965, 0, 0, 0, 0, 0, 871.0376534, 1634.843988, 2045.588655])
data_12 = Data(Tree({0;0;0}: [179207.1811, 274382.1429, 423311.8212, 540275.6378, 634716.6807, 630120.0008, 662570.5163, 595263.3286, 475753.5977, 351494.507, 196812.6057, 154619.1162], {0;0;1}: [198078.6535, 264021.3683, 422436.2471, 487130.3958, 647002.1166, 647687.3368, 674345.0776, 573815.3104, 453878.3776, 339257.23, 222473.953, 186311.0619]))

# ----
# Results
hiveresults = ResultsHive(
    CoolingLoad=data,
    SpaceHeatingLoad=data_4,
    ElectricityLoad=data_5,
    DomesticHotWaterLoad=data_6,
    HiveBuilding=hiveinputbuilding,
    Q_T_opaque=data_3,
    Q_T_transparent=data_2,
    Q_V=data_7,
    Q_i=data_10,
    Q_s=data_8,
    ConsumedElec=data_9,
    ConsumedHeat=data_11,
    Q_s_per_win=data_12)

hiveresultstype = ResultsType({"Cost - Lifetime Embodied": TotalCostEmbodied, "Cost - Lifetime Embodied Construction": TotalCostEmbodiedConstruction, "Cost - Lifetime Embodied Systems": TotalCostEmbodiedSystems, "Cost - Lifetime Operational": TotalCostOperational, "Cost - Lifetime Operational Construction": TotalCostOperationalConstruction, "Cost - Lifetime Operational Systems": TotalCostOperationalSystems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}, selected="Cost - Lifetime Embodied")
hiveresultsvisualizer = ResultsVisualizerHive(
    hiveresults,
    PlotProperties="""{
  "$type": "System.Collections.Generic.Dictionary`2[[System.String, mscorlib],[System.String, mscorlib]], mscorlib"
}""")
hivedistresultsloads = DistributorResultsLoadsHive(Results=hiveresults)  # -> HeatingLoads, CoolingLoads, ElectricityLoads, WindowSolarGains, GainsAndLosses
hiveresultsexposer = ResultsExposerHive(Results=hiveresults, ResultType=hiveresultstype)
panel = Panel(hiveresultsexposer)
panel_2 = Panel(hivedistresultsloads.HeatingLoads)
