# Grasshopper definition Hive_Results_Visualizer_Test.gh (Grasshopper 1.0.7)
# plug-ins: HiveIO, Hive.Core.sia380Parameters

rooms_existing = RoomsExisting({"1.1 Wohnen Mehrfamilienhaus": {"description": "1.1 Wohnen Mehrfamilienhaus", "Raumlufttemperatur Auslegung Heizen (Winter)": 21.0, "Nettogeschossflaeche": 20.0, "Thermische Gebaeudehuellflaeche": 26.0, "U-Wert Fenster": 1.5, "Waermeeintragsleistung Personen (bei 24.0 deg C, bzw. 70 W)": 2.2999999999999998, "Jaehrliche Vollaststunden der Geraete": 1780.0, "U-Wert opake Bauteile": 0.80000000000000004, "Jaehrliche Vollaststunden der Raumbeleuchtung": 1450.0, "Vollaststunden pro Jahr (Personen)": 4090.0, "Abminderungsfaktor fuer Fensterrahmen": 0.75, "Aussenluft-Volumenstrom durch Infiltration": 0.29999999999999999, "Raumlufttemperatur Auslegung Kuehlung (Sommer)": 26.0, "Glasanteil": 30.0, "Zeitkonstante": 68.0, "Waermeeintragsleistung der Raumbeleuchtung": 2.7000000000000002, "Waermeeintragsleistung der Geraete": 10.0, "Gesamtenergiedurchlassgrad Verglasung": 0.65000000000000002, "Temperatur-Aenderungsgrad der Waermerueckgewinnung": NaN, "Aussenluft-Volumenstrom (pro NGF)": 1.0}, "1.2 Wohnen Einfamilienhaus": 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, "2.1 Hotelzimmer": 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, "2.2 Empfang, Lobby": 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, "3.1 Einzel-, Gruppenbuero": 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, "3.2 Grossraumbuero": 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, "3.3 Sitzungszimmer": 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, "3.4 Schalterhalle, Empfang": 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, "4.1 Schulzimmer": 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, "4.2 Lehrerzimmer": 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}, selected="1.1 Wohnen Mehrfamilienhaus")

panel = Panel("""11
4
3
2
1
0
5
6
12
14
11
15""")
panel_2 = Panel("""0
0
0
0
0
1
3
6
3
0
0
0""")
panel_3 = Panel("""0
0
0
0
0
1
3
6
3
0
0
0""")
c_script = CSharpScript(x=panel, y=panel_2, z=panel_3)  # -> out, A; inputs x: list of Double, y: list of Double, z: list of Double
# ---------- c_script: C# ----------
    DataTree<GH_Number> tree = new DataTree<GH_Number>();

    GH_Path path0 = new GH_Path(0);
    GH_Path path1 = new GH_Path(1);
    GH_Path path2 = new GH_Path(2);
    
    foreach(double xin in x)
    {
      tree.Add(new GH_Number(xin), path0);
    }

    foreach(double yin in y)
    {
      tree.Add(new GH_Number(yin), path1);
    }

    foreach(double zin in z)
    {
      tree.Add(new GH_Number(zin), path2);
    }
    
    A = tree;

    //    DataTree<Sphere> sphereTree = new DataTree<Sphere>();
    //
    //    foreach (GH_Path path in pointTree.Paths)
    //    {
    //      List<Point3d> points = pointTree.Branch(path);
    //      List<Sphere> spheres = new List<Sphere>();
    //
    //      foreach (Point3d point in points)
    //        spheres.Add(new Sphere(point, 1.0));
    //
    //      sphereTree.AddRange(spheres, path);
    //    }
    //
    //    spheresOutput = sphereTree;
# ---------- end c_script ----------

brep = Brep(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)
panel_4 = Panel("""200
123.6
50.0""")

panel_5 = Panel("""False
True
False""")
panel_6 = Panel("""True
True
False""")
panel_7 = Panel("""True
False
False""")
c_script_2 = CSharpScript(x=panel_6, y=panel_5, z=panel_7)  # -> out, A; inputs x: list of Boolean, y: list of Boolean, z: list of Boolean
# ---------- c_script_2: C# ----------
    DataTree<GH_Boolean> tree = new DataTree<GH_Boolean>();

    GH_Path path0 = new GH_Path(0);
    GH_Path path1 = new GH_Path(1);
    GH_Path path2 = new GH_Path(2);

    foreach(bool xin in x)
    {
      tree.Add(new GH_Boolean(xin), path0);
    }

    foreach(bool yin in y)
    {
      tree.Add(new GH_Boolean(yin), path1);
    }

    foreach(bool xin in x)
    {
      tree.Add(new GH_Boolean(xin), path2);
    }

    A = tree;
# ---------- end c_script_2 ----------

panel_8 = Panel("""chp
hp
pv""")
hive_io_bldg = HiveIOBuilding(ZoneBrepGeometries=brep, SiaRoom="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")
panel_9 = Panel("""kWh
kWh
sqm""")
panel_10 = Panel("""0
0
0
0
0
0
0
0
0
0
0
0""")
data = Data(["53.833452", "40.62361", "27.53208", "9.093143", "0.752296", "0.007861", "0.000669", "0.002482", "2.353706", "17.218301", "38.493977", "52.055572"])
data_2 = Data(["2.806142", "2.806142", "2.806142", "2.806142", "2.806142", "2.806142", "2.806142", "2.806142", "2.806142", "2.806142", "2.806142", "2.806142"])
mesh = Mesh([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])
mesh_2 = Mesh(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)
crv = Curve([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])
hiveresults = ResultsHive(
    CoolingLoad=panel_10,
    SpaceHeatingLoad=data,
    ElectricityLoad=data_2,
    SupplySystemCapacities=panel_4,
    SupplySystemNames=panel_8,
    OperationMonthly=c_script.A,
    SupplySystemSuitability=c_script_2.A,
    SupplySystemUnits=panel_9,
    SolarIrradiatedSurfaces=mesh,
    SkyViewFactor=mesh_2,
    SunpathDiagram=crv,
    HiveBuilding=hive_io_bldg)
hive_io_visualizer = HiveIOVisualizer(
    hiveresults,
    PlotProperties="""{
  "$type": "System.Collections.Generic.Dictionary`2[[System.String, mscorlib],[System.String, mscorlib]], mscorlib"
}""")
panel_11 = Panel(hiveresults)
