# Grasshopper definition Hive_Solar_Test.gh (Grasshopper 1.0.7)
# plug-ins: HiveIO, Hive.Core.solar, Hive.Core.epw_reader

srf = Surface(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)
panel = Panel("C:\Users\maxze\Documents\Hive\hive\GrasshopperExamples\LectureExercises\HIVE_Zurich.epw")
mesh_uv = MeshSurface(Surface=srf, UCount=5, VCount=5, Overhang=True, Equalize=False)
srf_2 = Surface(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)
brep = Brep(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)
hiveinputenergysystems = InputEnergySystemsHive(
    MeshSolarTechnologyProperties=mesh_uv,
    conversions="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",
    emitters="""{
  "$type": "Hive.IO.Forms.EmitterPropertiesViewModel[], Hive.IO",
  "$values": []
}""",
    meshConnections="""{
  "$type": "System.Collections.Generic.Dictionary`2[[System.Int32, mscorlib],[System.Int32, mscorlib]], mscorlib",
  "0": 0
}""",
    meshes="""{
  "$type": "Hive.IO.Forms.SurfaceViewModel[], Hive.IO",
  "$values": [
    {
      "$type": "Hive.IO.Forms.SurfaceViewModel, Hive.IO",
      "Name": "srf0",
      "Area": 44.00082650533399
    }
  ]
}""")  # -> flatten(HiveEnergySystems)
hiveinputenvironment = InputEnvironmentHive(EpwPath=panel)
hiveinputbuilding = InputBuildingHive(ZoneGeometry=brep, WindowsSurfaces=srf_2, SiaRoom="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")
hivedistributor = MainDistributorHive(HiveInputs=[hiveinputenergysystems, hiveinputbuilding, hiveinputenvironment])  # -> HiveBuilding, HiveEnvironment, HiveEnergySystemsSurfaceBasedTech, HiveEnergySystemsConversionTech, HiveEnergySystemsEmitter
epwreader = EPWReader(Path=panel)  # -> Latitude, Longitude, CityCountry, GHI, DNI, DHI, DryBulb, DewPoint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
hivedistsolarsimu = DistributorSolarSimulationHive(
    HiveBuilding=hivedistributor.HiveBuilding,
    HiveSolarTechnologies=hivedistributor.HiveEnergySystemsSurfaceBasedTech,
    HiveEnvironment=hivedistributor.HiveEnvironment)  # -> EnvironmentMesh, BuildingCentroid, ExternalSurfaces, WindowGeometries, WindowTilt, WindowAzimuth, WindowAreas, SolarTechMesh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
solarpotentialsunobstructed = SolarPotentialsUnobstructed(
    Tilt=hivedistsolarsimu.WindowTilt,
    Azimuth=hivedistsolarsimu.WindowAzimuth,
    DHI=epwreader.DHI,
    DNI=epwreader.DNI,
    Latitude=epwreader.Latitude,
    Longitude=epwreader.Longitude,
    Aw=hivedistsolarsimu.WindowAreas,
    Timezone=epwreader.Timezone)
solarpotentialsunobstructed_2 = SolarPotentialsUnobstructed(
    Tilt=hivedistsolarsimu.WindowTilt,
    Azimuth=hivedistsolarsimu.WindowAzimuth,
    DHI=epwreader.DHI,
    DNI=epwreader.DNI,
    Latitude=epwreader.Latitude,
    Longitude=epwreader.Longitude,
    Aw=hivedistsolarsimu.WindowAreas,
    Timezone=epwreader.Timezone)
python = GhPythonScript(x=solarpotentialsunobstructed_2, y=solarpotentialsunobstructed)  # -> out, a; inputs x: list, y: list
# ---------- python: Python ----------
__author__ = "maxze"
__version__ = "2021.12.20"

import rhinoscriptsyntax as rs

assert x == y, "Not equal"


print "Pass"
# ---------- end python ----------
panel_2 = Panel(python.out)
