# Grasshopper definition olar.gh (Grasshopper 1.0.7)
# plug-ins: HiveIO

panel = Panel("C:\Users\maxze\Documents\Hive\hive\GrasshopperExamples\LectureExercises\HIVE_Zurich.epw")
hiveparainsolartech = ParametricInputSolarTechHive()
hiveinputbuilding = InputBuildingHive(SiaRoom="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")
hiveinputenvironment = InputEnvironmentHive(EpwPath=panel)
hivedistsolarsimu = DistributorSolarSimulationHive(HiveBuilding=hiveinputbuilding, HiveSolarTechnologies=hiveparainsolartech, HiveEnvironment=hiveinputenvironment)  # -> EnvironmentMesh, BuildingCentroid, ExternalSurfaces, WindowGeometries, WindowTilt, WindowAzimuth, WindowAreas, SolarTechMesh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
solarpotentialsunobstructed = SolarPotentialsUnobstructed(Latitude=47.36667, Longitude=8.55, Aw=1, Timezone=0)
