# Grasshopper definition lisa.gh (Grasshopper 0.9.76)
# plug-ins: Python Interpreter

_0_hive = Hive_Hive()  # -> out
# ---------- _0_hive: Python ----------
#
# Hive: An educational plugin developed by the A/S chair at ETH Zurich
#
# This comoponent contains an object-oriented adaptation of the RC model 
# referred to as the 'Simple Hourly Method' in ISO 13790, (superceded by 
# EN ISO 52016-1).

# The code contains the version of building_physics.py found in the nested_rc 
# branch. The modifications make it easier to accomodate a more modular zone 
# definiton, made of a zone and elements. 
# See https://github.com/architecture-building-systems/RC_BuildingSimulator for
# extensive documentation is available on the project wiki.

# Authors: Prageeth Jayathissa <jayathissa@arch.ethz.ch>, Justin Zarb 
# <zarbj@student.ethz.ch>
# Adapted for Grasshopper by Justin Zarb
#
# This file is part of Hive
#
#TODO: Licensing/Copyright and liability stuff


"""
This needs to be on the canvas for Hive components to work.
-
Provided by Hive 0.0.1
"""

ghenv.Component.Name = "Hive_Hive"
ghenv.Component.NickName = '0.Hive'
ghenv.Component.Message = 'VER 0.0.1\nMAY_29_2018'
ghenv.Component.IconDisplayMode = ghenv.Component.IconDisplayMode.application
ghenv.Component.Category = "Hive"
ghenv.Component.SubCategory = "0"
# ComponentExposure=1

import scriptcontext as sc
import rhinoscriptsyntax as rs
import Rhino as rc
import ghpythonlib.components as gh
import Grasshopper.Kernel as ghKernel
import math
import datetime
import time

from itertools import product
from operator import itemgetter
from Grasshopper.Kernel.Data import GH_Path
from Grasshopper import DataTree
from System.Collections.Generic import List
import System.Reflection
import os 

clipper_path = os.path.join(os.getenv('APPDATA'), 'Grasshopper', 'Libraries', 'clipper_library.dll')
clipper_library = System.Reflection.Assembly.LoadFrom(clipper_path)

clipper = clipper_library.ClipperLib.Clipper()
polyTree = clipper_library.ClipperLib.PolyTree
polyType = clipper_library.ClipperLib.PolyType
clipType = clipper_library.ClipperLib.ClipType
polyFillType = clipper_library.ClipperLib.PolyFillType

IntPoint = clipper_library.ClipperLib.IntPoint


class HivePreparation(object):
    """ 
    Credits: Ladybug
    This object contains some hand-picked functions from the Ladybug Preparation component.
    It provides support for other components which have been adapted from Ladybug to Hive.
    """
    def __init__(self):
        self.monthList = ['JAN', 'FEB', 'MAR', 'APR', 'MAY', 'JUN', 'JUL', 'AUG', 'SEP', 'OCT', 'NOV', 'DEC']
        self.numOfDays = [0, 31, 59, 90, 120, 151, 181, 212, 243, 273, 304, 334, 365]
        self.numOfDaysEachMonth = [31, 28, 31, 30, 31, 30, 31, 31, 30, 31, 30, 31]
        self.numOfHours = [24 * numOfDay for numOfDay in self.numOfDays]
    
    strToBeFound = 'key:location/dataType/units/frequency/startsAt/endsAt'
    
    def hour2Date(self, hour, alternate = False):
        numOfDays = [0, 31, 59, 90, 120, 151, 181, 212, 243, 273, 304, 334, 365]
        numOfHours = [24 * numOfDay for numOfDay in numOfDays]
        #print hour/24
        if hour%8760==0 and not alternate: return `31`+ ' ' + 'DEC' + ' 24:00'
        elif hour%8760==0: return 31, 11, 24
    
        for h in range(len(numOfHours)-1):
            if hour <= numOfHours[h+1]: month = self.monthList[h]; break
        try: month
        except: month = self.monthList[h] # for the last hour of the year
    
        if (hour)%24 == 0:
            day = int((hour - numOfHours[h]) / 24)
            time = `24` + ':00'
            hour = 24
        else:
            day = int((hour - numOfHours[h]) / 24) + 1
            minutes = `int(round((hour - math.floor(hour)) * 60))`
            if len(minutes) == 1: minutes = '0' + minutes
            time = `int(hour%24)` + ':' + minutes
        if alternate:
            time = hour%24
            if time == 0: time = 24
            month = self.monthList.index(month)
            return day, month, time
            
        return (`day` + ' ' + month + ' ' + time)
    
    def set_simulation_period(self,start_hoy,end_hoy):
        if start_hoy is None:
            start = 1
        else:
            if 1 <= int(start_hoy) < 8760:
                start = start_hoy
            else:
                warningMsg = "Invalid start_HOY_ replaced with 1."
                w = gh.GH_RuntimeMessageLevel.Warning
                ghenv.Component.AddRuntimeMessage(w, warningMsg)
                start = 1
        
        if end_hoy is None:
            end = 8760
        else:
            if start <= end_hoy < 8761:
                end = end_hoy
            else:
                warningMsg = "Invalid start_HOY_ replaced with 8759."
                w = gh.GH_RuntimeMessageLevel.Warning
                ghenv.Component.AddRuntimeMessage(w, warningMsg)
                end = 8760
        
        return int(start),int(end)
    
    def getJD(self, month, day):
        numOfDays = [0, 31, 59, 90, 120, 151, 181, 212, 243, 273, 304, 334]
        return numOfDays[int(month)-1] + int(day)
    
    def epwLocation(self, epw_file):
        epwfile = open(epw_file,"r")
        headline = epwfile.readline()
        csheadline = headline.split(',')
        while 1>0: #remove empty cells from the end of the list if any
            try: float(csheadline[-1]); break
            except: csheadline.pop()
        locName = ''
        for hLine in range(1,4):
            if csheadline[hLine] != '-':
                locName = locName + csheadline[hLine] + '_'
        locName = locName[:-1]
        lat = csheadline[-4]
        lngt = csheadline[-3]
        timeZone = csheadline[-2]
        elev = csheadline[-1].strip()
        epwfile.close
        return locName, lat, lngt, timeZone, elev
    
    def cleanAndCoerceList(self, brepList):
        """ This definition clean the list and add them to RhinoCommon"""
        outputMesh = []
        outputBrep = []
        
        for id in brepList:
            if rs.IsMesh(id):
                geo = rs.coercemesh(id)
                if geo is not None:
                    outputMesh.append(geo)
                    try: rs.DeleteObject(id)
                    except: pass
                
            elif rs.IsBrep(id):
                geo = rs.coercebrep(id)
                if geo is not None:
                    outputBrep.append(geo)
                    try: rs.DeleteObject(id)
                    except: pass
                    
                else:
                    # the idea was to remove the problematice surfaces
                    # not all the geometry which is not possible since
                    # badGeometries won't pass rs.IsBrep()
                    tempBrep = []
                    surfaces = rs.ExplodePolysurfaces(id)
                    for surface in surfaces:
                        geo = rs.coercesurface(surface)
                        if geo is not None:
                            tempBrep.append(geo)
                            try: rs.DeleteObject(surface)
                            except: pass
                    geo = rc.Geometry.Brep.JoinBreps(tempBrep, sc.doc.ModelAbsoluteTolerance)
                    for Brep in tempBrep:
                        Brep.Dispose()
                        try: rs.DeleteObject(id)
                        except: pass
                    outputBrep.append(geo)
        return outputMesh, outputBrep
        
    def epwDataReader(self, epw_file, location = 'Somewhere!'):
        # weather data
        modelYear = [self.strToBeFound, location, 'Year', 'Year', 'Hourly', (1, 1, 1), (12, 31, 24)];
        dbTemp = [self.strToBeFound, location, 'Dry Bulb Temperature', 'C', 'Hourly', (1, 1, 1), (12, 31, 24)];
        dewPoint = [self.strToBeFound, location, 'Dew Point Temperature', 'C', 'Hourly', (1, 1, 1), (12, 31, 24)];
        RH = [self.strToBeFound, location, 'Relative Humidity', '%', 'Hourly', (1, 1, 1), (12, 31, 24)];
        windSpeed = [self.strToBeFound, location, 'Wind Speed', 'm/s', 'Hourly', (1, 1, 1), (12, 31, 24)];
        windDir = [self.strToBeFound, location, 'Wind Direction', 'degrees', 'Hourly', (1, 1, 1), (12, 31, 24)];
        dirRad = [self.strToBeFound, location, 'Direct Normal Radiation', 'Wh/m2', 'Hourly', (1, 1, 1), (12, 31, 24)];
        difRad = [self.strToBeFound, location, 'Diffuse Horizontal Radiation', 'Wh/m2', 'Hourly', (1, 1, 1), (12, 31, 24)];
        glbRad = [self.strToBeFound, location, 'Global Horizontal Radiation', 'Wh/m2', 'Hourly', (1, 1, 1), (12, 31, 24)];
        infRad = [self.strToBeFound, location, 'Horizontal Infrared Radiation Intensity', 'Wh/m2', 'Hourly', (1, 1, 1), (12, 31, 24)];
        dirIll = [self.strToBeFound, location, 'Direct Normal Illuminance', 'lux', 'Hourly', (1, 1, 1), (12, 31, 24)];
        difIll = [self.strToBeFound, location, 'Diffuse Horizontal Illuminance', 'lux', 'Hourly', (1, 1, 1), (12, 31, 24)];
        glbIll = [self.strToBeFound, location, 'Global Horizontal Illuminance', 'lux', 'Hourly', (1, 1, 1), (12, 31, 24)];
        cloudCov = [self.strToBeFound, location, 'Total Cloud Cover', 'tenth', 'Hourly', (1, 1, 1), (12, 31, 24)];
        visibility = [self.strToBeFound, location, 'Visibility', 'km', 'Hourly', (1, 1, 1), (12, 31, 24)];
        barPress = [self.strToBeFound, location, 'Barometric Pressure', 'Pa', 'Hourly', (1, 1, 1), (12, 31, 24)];
        epwfile = open(epw_file,"r")
        lnum = 1 # line number
        for line in epwfile:
            if lnum > 8:
                modelYear.append(float(line.split(',')[0]))
                dbTemp.append(float(line.split(',')[6]))
                dewPoint.append(float(line.split(',')[7]))
                RH.append(float(line.split(',')[8]))
                barPress.append(float(line.split(',')[9]))
                windSpeed.append(float(line.split(',')[21]))
                windDir.append(float(line.split(',')[20]))
                dirRad.append(float(line.split(',')[14]))
                difRad.append(float(line.split(',')[15]))
                glbRad.append(float(line.split(',')[13]))
                infRad.append(float(line.split(',')[12]))
                dirIll.append(float(line.split(',')[17]))
                difIll.append(float(line.split(',')[18]))
                glbIll.append(float(line.split(',')[16]))
                cloudCov.append(float(line.split(',')[22]))
            lnum += 1
        epwfile.close()
        return dbTemp, dewPoint, RH, windSpeed, windDir, dirRad, difRad, glbRad, dirIll, difIll, glbIll, cloudCov, infRad, barPress, modelYear
    
    def list_to_tree(self, nestedlist):
        layerTree = DataTree[object]()
        for i, item_list in enumerate(nestedlist):
            path = GH_Path(i)
            layerTree.AddRange(item_list,path)
        return layerTree
   
    def dict_to_tree(self, dict):
        dictTree = DataTree[object]()
        for day,value in dict.iteritems():
            path = GH_Path(day)
            dictTree.Add(value,path)
        return dictTree
    
    def deconstruct_input_geometry(self,brep_geometry):
        surfaces = []
        for geometry in brep_geometry:
            g = rs.coercebrep(geometry)
            brep_faces = gh.DeconstructBrep(g)[0]
            if brep_faces:
                if type(brep_faces) is not list:
                    # geometry is a single surface
                    s = brep_faces.Faces[0].DuplicateSurface()
                    surfaces.append(s)
                else:
                    # geometry was a polysurface and got deconstructed into a list
                    for b in brep_faces:
                        s = b.Faces[0].DuplicateSurface()
                        surfaces.append(s)
        return surfaces
    
    def raise_warning(self,warning_str):
        warning = warning_str
        w = ghKernel.GH_RuntimeMessageLevel.Warning
        ghenv.Component.AddRuntimeMessage(w, warning)
    
    def raise_error(self,error_str):
        error = error_str
        e = ghKernel.GH_RuntimeMessageLevel.Error
        ghenv.Component.AddRuntimeMessage(e, error)


class RelativeSun(object):
    def __init__(self,location,window_azimuth_rad, window_altitude_rad, normal):
        # Extract location data
        self.latitude_deg = float(location[0])
        self.longitude_deg = float(location[1])
        self.utc_offset = float(location[2])
        self.year = int(location[3])
        
        self.window_azimuth_rad = window_azimuth_rad
        self.window_altitude_rad = window_altitude_rad
        self.normal = normal
    
    def is_sunny(self, sun_alt, relative_sun_az):
        return sun_alt >= 0.0 and abs(relative_sun_az) < 90.0
    
    def calc_relative_sun_position(self, hoy):
        """
        Credits: JoanDM
        Calculate sun position in respect to the glazed surface. 
        - Traditional convention:
            Sun azimuth: Clockwise due north. i.e. [0,360) degrees
        - Facade convention:
            Sun azimuth: Zero is coincident with the normal to glazed surface. From there, 
                         it ranges clockwise and counter clockwise till 180, i.e. 
                         [-180, 180) relative degrees.

        :param utc_offset: Time zone offset i.r. to Prime Meridian [hours]
        :type utc_offset: int
        :param latitude_deg: Local Latitude [Degrees]. North+, South-.
        :type latitude_deg: float
        :param longitude_deg: Local Longitude [Degrees]. East+, West-.
        :type longitude_deg: float
        :param asf_normal_az: Azimuth position of normal to ASF plane  [Degrees](Traditional convention)
        :type asf_normal_az: int
        :return: sun_alt, asf_sun_az: Sun altitude and azimuth [Degrees] (Facade convention)
        :rtype: tuple (float, float)
        """
        
        # Calculate sun position following traditional convention
        sun_alt, sun_az = self.calc_sun_position(hoy)
        
        # Redefine azimuth following ASF convention
        relative_sun_az = self.calc_relative_azimuth(sun_az)
        relative_sun_alt = self.calc_relative_altitude(sun_alt)
        return relative_sun_alt, relative_sun_az
    
    def calc_sun_position(self, hoy):
        """
        Credits: Prageeth Jayathissa, Joan Domènech Masferrer 
    
        Calculates the sun position for a specific hour of the year and location,
        according to traditional convention.
        :param latitude_deg: Local Latitude [Degrees]. North+, South-.
        :type latitude_deg: float
        :param longitude_deg: Local Longitude [Degrees]. East+, West-.
        :type longitude_deg: float
        :param year: year
        :type year: int
        :param hoy: Hour of the year from the start. The first hour of January is 1
        :type hoy: int
        :param utc_offset: Time zone offset i.r. to Prime Meridian [hours]
        :type utc_offset: int
        :return: altitude, azimuth: Sun altitude and azimuth [Degrees] (Traditional convention)
        :rtype: tuple
        """
        # Source http://www.pveducation.org/pvcdrom/properties-of-sunlight/declination-angle
    
        # Set the date in UTC based off the hour of year and the year itself
        start_of_year = datetime.datetime(self.year, 1, 1, 0, 0, 0, 0);
        utc_datetime = start_of_year + datetime.timedelta(hours = float(hoy));
    
        # Determine the day of the year
        day_of_year = utc_datetime.timetuple().tm_yday;
    
        # Calculate B parameter (in radians) for equation of time
        b_factor = (day_of_year - 1) * ((2 * math.pi) / 365);
    
        # Equation of time: empirical equation that corrects for the eccentricity of 
        # the Earth's orbit and the Earth's axial tilt        
        equation_of_time = 229.2 * 0.000075 + 229.2 * (0.001868 * math.cos(b_factor) - \
                                                       0.032077 * math.sin(b_factor)) - \
                                                       229.2 * (0.014615 * math.cos(2 * b_factor) + \
                                                                0.04089 * math.sin(2 * b_factor));
    
        # Local Standart Time Meridian (Earth rotation 15 degrees/h)
        standard_time = 15 * self.utc_offset
    
        # Time correction between local standard time and true solar time (in minutes) 
        time_correction = 4 * (self.longitude_deg - standard_time) + equation_of_time 
    
        # Local Solar Time (in hours) = Local Time + TC (in hours)
        solar_time = utc_datetime.hour + (utc_datetime.minute + time_correction) / 60.0;
    
        # Translate Local Solar Time to an angle 
        hour_angle_rad = (math.pi * 2 / 24) * (solar_time - 12);
    
        # Calculate the declination angle: The variation due to the earths tilt
        declination_rad = math.radians(23.45 * math.sin((2 * math.pi / 365.0) * 
                                                        (day_of_year - 81)));
    
        # Convert latitude to to radians
        latitude_rad = math.radians(self.latitude_deg);
    
        # Altitude Position of the sun in radians
        sun_alt_rad = math.asin(math.cos(latitude_rad) * math.cos(declination_rad) * 
                                 math.cos(hour_angle_rad) +
                                 math.sin(latitude_rad) * math.sin(declination_rad));
    
        # Azimuth Position fo the sun in radians
        sun_az_rad = math.acos((math.sin(declination_rad) *
                                    math.cos(latitude_rad) - math.cos(declination_rad) *
                                    math.sin(latitude_rad) * math.cos(hour_angle_rad)) /
                                    math.cos(sun_alt_rad))
    
        # Range azimuth [0, 360) degrees
        if hour_angle_rad > 0 or hour_angle_rad < - math.pi :
            sun_az_rad = math.pi * 2 - sun_az_rad
    
        return math.degrees(sun_alt_rad), math.degrees(sun_az_rad)
    
    def calc_sun_vector(self,sun_alt, sun_az):
        sun_alt_rad = math.radians(sun_alt)
        sun_az_rad = math.radians(sun_az)
        sunvec_x = -math.sin(sun_az_rad) * math.cos(sun_alt_rad)
        sunvec_y = -math.cos(sun_az_rad) * math.cos(sun_alt_rad)
        sunvec_z = -math.sin(sun_alt_rad)
        
        return rc.Geometry.Vector3d(sunvec_x,sunvec_y,sunvec_z)

    def calc_relative_azimuth(self, sun_az):
        """
        Calculates the sun position relative to the facade orientation.
        :param sun_az: Sun azimuth [Degrees] (Traditional convention)
        :type sun_az: float
        :return: relative_sun_az: Sun azimuth [Degrees] (Facade convention)
        :rtype: float
        """
                    
        relative_sun_az = 180 - sun_az + math.degrees(self.window_azimuth_rad)
        if relative_sun_az < -180:
            relative_sun_az +=360
        return relative_sun_az
    
    def calc_relative_altitude(self, sun_alt):
        relative_sun_alt = sun_alt - 90 + math.degrees(self.window_altitude_rad)
        return relative_sun_alt


class WindowRadiation(object):
    """
    Adapted from shaded_window.py and radiation.py from the ASF_Control 
    repository by Joan DM 
    
    Contains functions to calculate window radiation with shading.
    """

    def __init__(self, window_geometry, context_geometry, point_in_zone, albedo=0.12, glass_solar_transmittance=0.7, glass_light_transmittance=0.8):
        
        self.window_geometry = window_geometry
        self.point_in_zone = point_in_zone
        
        #context geometry can either be a single surface, a polysurface, or a mixed list.
        HivePreparation = sc.sticky['HivePreparation']()
        context_surfaces = HivePreparation.deconstruct_input_geometry(context_geometry)
        
        self.clipper_accuracy = 100000
        self.extract_window_geometry()
        self.transform_all_shades(context_surfaces)
        
        self.albedo = albedo
        self.glass_solar_transmittance = glass_solar_transmittance
        self.glass_light_transmittance = glass_light_transmittance
        
        self.perez_coef = {'f_11': [-0.0083117, 0.1299457, 0.3296958, 0.5682053, 0.873028, 1.1326077, 1.0601591, 0.677747],
              'f_12': [0.5877285, 0.6825954, 0.4868735, 0.1874525, -0.3920403, -1.2367284, -1.5999137, -0.3272588],
              'f_13': [-0.0620636, -0.1513752, -0.2210958, -0.295129, -0.3616149, -0.4118494, -0.3589221, -0.2504286],
              'f_21': [-0.0596012, -0.0189325, 0.055414, 0.1088631, 0.2255647, 0.2877813, 0.2642124, 0.1561313],
              'f_22': [0.0721249, 0.065965, -0.0639588, -0.1519229, -0.4620442, -0.8230357, -1.127234, -1.3765031],
              'f_23': [-0.0220216, -0.0288748, -0.0260542, -0.0139754, 0.0012448, 0.0558651, 0.1310694, 0.2506212]}
    
    def extract_window_geometry(self):
        """
        Extract geometry properties 
        """
        
        north = rc.Geometry.Vector3d(0,1,0)
        vertical = rc.Geometry.Vector3d(0,0,1)
        
        # Window centroid
        self.window_centroid = rs.SurfaceAreaCentroid(self.window_geometry)[0]
        
        # Initialize outward facing normal
        normal = rs.SurfaceNormal(self.window_geometry,[0.5,0.5])
        window_zone_vector = gh.Vector2Pt(self.window_centroid,self.point_in_zone)
        if abs(rs.VectorAngle(normal,window_zone_vector[0])) < 90:
            self.window_normal = rs.VectorReverse(normal)
        else:
            self.window_normal = normal
        
        # Initialize window area and plane
        self.window_area = rs.Area(self.window_geometry)
        edges = rs.DuplicateEdgeCurves(self.window_geometry)
        self.window_vertices = rs.SurfaceEditPoints(self.window_geometry)
        
        
        lower_points = [p for p in self.window_vertices if p[2] == min([z[2] for z in self.window_vertices])]
        
        x_n = self.window_normal[0]
        if x_n > 0:
            basepoint = [p for p in lower_points if p[1] == min([y[1] for y in lower_points])][0]
        else:
            basepoint = [p for p in lower_points if p[1] == max([y[1] for y in lower_points])][0]
        
        plane_y = rc.Geometry.Vector3d(0,0,1)
        plane_x = rs.VectorRotate(plane_y,270,self.window_normal)
        self.window_plane = rc.Geometry.Plane(basepoint,plane_x,plane_y)
        
        self.window_transformation = gh.Orient(None,self.window_plane,gh.XYPlane(rc.Geometry.Point3d(0,0,0)))[1]
        
        self.window_edges = rs.JoinCurves(edges)
        edge_lengths = [rs.CurveLength(e) for e in edges]
        edge_vectors = [round(rs.VectorCreate(rs.CurveStartPoint(e),rs.CurveEndPoint(e))[2]) for e in edges] 
        window_width = edge_lengths[0] if edge_vectors[0] == 0 else edge_lengths[1]
        window_height = edge_lengths[0] if edge_vectors[0] !=0 else edge_lengths[1]
        window_intpoint_vertices = [IntPoint(0,0), IntPoint(self.clipper_accuracy*window_width, 0), IntPoint(self.clipper_accuracy*window_width, self.clipper_accuracy*window_height), IntPoint(0, self.clipper_accuracy*window_height)]
        self.window_frame = List[IntPoint](window_intpoint_vertices)

        # Find panel azimuth (X-Z axes). Set it in the proper quarter (+ CW / -CCW i.r to Z axis)
        azimuth = math.pi - math.atan2(-self.window_normal[0], self.window_normal[1])
        if azimuth > math.pi:
            azimuth -= 2*math.pi 
        
        try:
            altitude = rs.VectorAngle(rc.Geometry.Vector3d(0,0,1),normal)
        except ValueError:
            altitude = 0
        
        self.window_altitude_rad = math.radians(altitude)
        self.window_azimuth_rad = azimuth
    
    def sort_surface_vertices_clockwise(self,points,centroid,normal):
        """
        :return sorted_points: list of points sorted clockwise
        :rtype sorted_points: list
        """
        
        # Generate plane opposing the dominant direction of the surface
        if normal[0] == 0 and normal[2] == 0:
            # Normal parallel to y axis
            if normal[1]>0:
                plane = rc.Geometry.Plane(centroid,rc.Geometry.Vector3d(0,-1,0))
            else:
                plane = rc.Geometry.Plane(centroid,rc.Geometry.Vector3d(0,1,0))
        
        if normal[1] == 0 and normal[2] == 0:
            # Normal parallel to x axis
            if normal[0]>0:
                plane = rc.Geometry.Plane(centroid,rc.Geometry.Vector3d(-1,0,0))
            else:
                plane = rc.Geometry.Plane(centroid,rc.Geometry.Vector3d(1,0,0))
        
        if normal[2] != 0:
            # Normal not on xy plane
            plane = rc.Geometry.Plane(centroid,rc.Geometry.Vector3d(0,0,-1))
        
        else:
            rs.VectorReverse(normal)
            # Trying this out! Need to remember what the previous code did...
            plane = rc.Geometry.Plane(centroid,rs.VectorReverse(normal))
            
        # calculate vectors from center to points
        vecs = [centroid - point for point in points]
        
        # calculate angles between vectors and plane x-axis
        angles = [rc.Geometry.Vector3d.VectorAngle(plane.XAxis,v,plane) for v in vecs]

        sorted_points = [p[1] for p in sorted(zip(angles,points))] 
        return sorted_points
    
    def transform_shade(self,shade):
        """
        Transform the vertices of a shading surface to match the window as projected on the xy plane.
        case 1: All vertices are in front of the window
        case 2: Some vertices are behind the window.
        case 3: All the vertices are behind the window, a null value is returned.
        
        :return rounded_oriented_centroid: oriented centroid. rounding affects how easily array patterns are identified.
        :return transformed points: 
        """
        
        # Test shading position
        points = rs.SurfacePoints(shade,True)
        a,b,c,d = rs.PlaneEquation(self.window_plane)
        point_is_outside_window = [a*p[0] + b*p[1] + c*p[2] + d > 0 for p in points]
        if all(point_is_outside_window):
            # Case 1
            pass
        elif any(point_is_outside_window):
            # case 2: add the intersection points to the list of points
            intersection = gh.BrepXPlane(shade,self.window_plane)[0]
            if intersection is not None:
                # Case 2
                points.append(rs.CurveEndPoint(intersection))
                points.append(rs.CurveStartPoint(intersection))
        else:
            # Case 3
            return None, None
            print 'shade element ignored as it is behind the window.'
        
        centroid, e= rs.SurfaceAreaCentroid(shade)
        normal = rs.SurfaceNormal(shade,[0.5,0.5])
        clockwise_shade_points = self.sort_surface_vertices_clockwise(points,centroid,normal)
        
        def round2(x):
            return int(round(x*100))
        
        oriented_centroid = gh.Transform(centroid,self.window_transformation)
        rounded_oriented_centroid = [round2(oriented_centroid[0]),round2(oriented_centroid[1])]
        
        transformed_points = []
        for p in clockwise_shade_points:
            p1 = gh.Transform(p,self.window_transformation)
            if round(p1[2],2) >= 0:
                # point is in front of window
                transformed_points.append(p1)
        
        return rounded_oriented_centroid, transformed_points
    
    def transform_all_shades(self,context_geometry):
        """
        Check if points are aligned horizontally or vertically and create an array
        Transform context
        Return a dictionary with
        key: shade centroid
        value: transformed points for each shade
        """
        self.context = {}
        points_dict = {}
        index = 0
        for xg in context_geometry:
            c,points = self.transform_shade(xg)
            if c is not None:
                self.context[index] = points
                index += 1
    
    def calc_shadow(self, shade, relative_sun_alt, relative_sun_az):
        """
        Coordinate system:
        X = Horizontal direction, parallel to glazing surface
        Y = Vertical direction, parallel to glazing surface
        Z = Perpendicular in respect of glazing surface
        """
        
        def transform_point(point,sunvec_x,sunvec_y,sunvec_z):
            # Define t paramater from parametric equation. Window plane is placed z=0 
            t = - point[2] / sunvec_z;
            # Project points using sun vector
            x_point = point[0] + sunvec_x * t;
            y_point = point[1] + sunvec_y * t;
            return x_point, y_point
        
        # Align relative_sun_az with window plane, convert angles to radians
        # Note: this procedure is only done when is sunny, hence relative_sun_az in range[-90, 90];
        relative_sun_az_rad, relative_sun_alt_rad = map(math.radians, [relative_sun_az + 90, relative_sun_alt]);
    
        # Create sun vector
        sunvec_x = -math.cos(relative_sun_az_rad) * math.cos(relative_sun_alt_rad);
        sunvec_y = math.sin(relative_sun_alt_rad);
        sunvec_z = math.sin(relative_sun_az_rad) * math.cos(relative_sun_alt_rad);
        
        a, b = self.longer_edge_of_shade(shade)
        a_shadow = transform_point(a,sunvec_x,sunvec_y,sunvec_z)
        b_shadow = transform_point(b,sunvec_x,sunvec_y,sunvec_z)
        pv_shadow_vector = [b_shadow[0] - a_shadow[0], b_shadow[1] - a_shadow[1]]
        
        # Calculate the projection on a 2-D surface (x,y)
        shadowintpoints = [] # IntPoints for clipping
        for point_3d in shade:   
            x_point, y_point = transform_point(point_3d,sunvec_x,sunvec_y,sunvec_z)
            shadowintpoints.append(IntPoint(self.clipper_accuracy*x_point,self.clipper_accuracy*y_point))
            
        return List[IntPoint](shadowintpoints)#, pv_shadow_vector
    
    def longer_edge_of_shade(self,shade_points):
        """
        Identify the longer edge of the shading geometry, from 
        the window-side outwards, in the window coordinate system.
        Returns: a (closest to the window), b (farthest from the window)
        """
        long_edge_length = 0
        for ii in range(0,len(shade_points)-1):
            if abs(rs.Distance(shade_points[ii],shade_points[ii+1])) > long_edge_length:
                long_edge_length = abs(rs.Distance(shade_points[ii],shade_points[ii+1]))
                if rs.DistanceToPlane(self.window_plane,shade_points[ii]) < rs.DistanceToPlane(self.window_plane,shade_points[ii+1]):
                    a = shade_points[ii]
                    b = shade_points[ii+1]
                else:
                    a = shade_points[ii+1]
                    b = shade_points[ii]
        return a,b
        
    def calc_gross_shadows(self,relative_sun_alt,relative_sun_az):
        """
        projects all shading objects onto window coordinate plane
        """
        if self.context == {}:
            return None
        
        gross_shadows = {}
        pv_vectors = {}
        for k in self.context.keys():
            gross_shadows[k] = self.calc_shadow(self.context[k],relative_sun_alt,relative_sun_az)
        return gross_shadows
    
    def draw_shadow_points(self,clipper_result):
        """
        optional function which returns polylines of the trimmed shadows for each hour
        :param clipper_result: a .net List of polygons (list of intPoints)
        :type clipper_result: List(List(intPoint))
        """
        clipper_result_geometry = []

        u_domain = rs.SurfaceDomain(self.window_geometry,0)[1]
        
        for ms in clipper_result:
            points = []
            for p in ms:
                # points.append(rc.Geometry.Point3d(p.X/self.clipper_accuracy, p.Y/self.clipper_accuracy,0))
                points.append(rs.EvaluatePlane(self.window_plane, [p.X/self.clipper_accuracy, p.Y/self.clipper_accuracy]))
            # clipper_result_geometry.append(PolyLine(points,closed=True)) 
            clipper_result_geometry.append(points) 
        return clipper_result_geometry

    def calc_unshaded_area(self,shaded_polygons):
        """
        For a given set of shadows (one hour) subtract the regions outside the 
        window frame from net_shadows dictionary  and compute the total shadow 
        laying on the window as a % of its area.
        """
        
        shaded_area = 0
        for p in shaded_polygons:
            shaded_area += abs(clipper.Area(p))
         
        try:
            assert clipper.Area(self.window_frame) >= shaded_area
            return (clipper.Area(self.window_frame) - shaded_area)/ self.clipper_accuracy**2
        except AssertionError:
            # clipper failed and returned overlapping geometries.
            print 'clipping warning for hour: ', h

    def calc_shadow_polygons(self,gross_shadows):
        """
        Combine shadow polygons and clip them using the window frame.
        Returns: polygons representing shaded areas on the window.
        """
        # Initialise shadows list
        subj = []
        shadows = List[List[IntPoint]](gross_shadows.values())
        merged_shadows = List[List[IntPoint]]()
        clipper.Clear()
        clipper.AddPolygons(shadows,polyType.ptSubject)
        union = clipper.Execute(clipType.ctUnion, merged_shadows, polyFillType.pftNonZero, polyFillType.pftNonZero)
        
        # Remove parts of shadows which lie outside the window frame
        unshaded_polygons = List[List[IntPoint]]()
        clipper.Clear()
        clipper.AddPolygon(self.window_frame,polyType.ptClip)
        clipper.AddPolygons(merged_shadows,polyType.ptSubject)
        diff = clipper.Execute(clipType.ctIntersection, unshaded_polygons, polyFillType.pftNonZero, polyFillType.pftNonZero)
        
        if diff:
            return unshaded_polygons
        else:
            return None

    def perez(self, angle_incidence, sun_alt, norm_radiation, hor_radiation):
        """"
        Credits: JoanDM
        Calculate the diffuse irradiation components (circumsolar and horizon brightening)
        via Perez 1990 model.
    
        :param angle_incidence: Angle of incidence between sun rays and panel [rad]
        :type angle_incidence: float
        :param sun_alt: sun altitude
        :type sun_alt: float
        :param norm_radiation: Direct normal radiation [Wh/m^2]. 
        :type norm_radiation: float
        :param hor_radiation: Diffuse horizontal radiation [Wh/m^2]. 
        :type hor_radiation: float
        :type sun_alt: dict {key:string, value:float}
        :return: circumsolar and horizon brightening components [Wh/m^2].
        :rtype: tuple(float, float)
        """
        
        a = max(0, math.cos(angle_incidence))
        b = max(math.cos(math.radians(85)), math.cos(angle_incidence))
        k = 5.534 / 1000000
        zenith = 90 - sun_alt
    
        if 0 <= zenith <= 87.5:
            epsilon = ((norm_radiation + hor_radiation) / float(hor_radiation) + k * ( zenith ** 3)) / (1 + k * (zenith ** 3))
            
            air_mass = (math.cos(b) + 0.15 * (93.9 - zenith) ** (-1.253) ) ** (-1)
            
            delta = hor_radiation * (air_mass / 1367.0)
            
            if epsilon <= 1.065:
                coeff_selector = 0
            elif epsilon <= 1.23:
                coeff_selector = 1
            elif epsilon <= 1.5:
                coeff_selector = 2
            elif epsilon <= 1.95:
                coeff_selector = 3
            elif epsilon <= 2.8:
                coeff_selector = 4
            elif epsilon <= 4.5:
                coeff_selector = 5
            elif epsilon <= 6.2:
                coeff_selector = 6
            elif epsilon > 6.2:
                coeff_selector = 7
            
            f_11 = self.perez_coef['f_11'][coeff_selector]
            f_12 = self.perez_coef['f_12'][coeff_selector]
            f_13 = self.perez_coef['f_13'][coeff_selector]
            f_21 = self.perez_coef['f_21'][coeff_selector]
            f_22 = self.perez_coef['f_22'][coeff_selector]
            f_23 = self.perez_coef['f_23'][coeff_selector]
            
            zenith_rad = math.radians(zenith)
            f_1 = max(0, f_11 + delta * f_12 + zenith_rad * f_13)
            f_2 = max(0, f_21 + delta * f_22 + zenith_rad * f_23)
            
            diff_circum = hor_radiation * f_1 * a / b
            diff_horizon = hor_radiation * f_2 * math.sin(self.window_altitude_rad)
    
        else: #87.5 < zenith <  90:
            f_1 = 0
            diff_circum = 0
            diff_horizon = 0
    
        return  diff_circum, diff_horizon, f_1
    
    def calc_diffuse_irradiation(self, norm_radiation, hor_radiation, view_factor, sun_alt, angle_incidence):
        """
        credits: JoanDM
        
        TODO: Include the surrounding effect of the shading geometry on the window view factor
        """
        
        diff_circum, diff_horizon, f_1 = self.perez(angle_incidence, sun_alt, norm_radiation, hor_radiation);
        
        diff_isotropic = hor_radiation * view_factor * (1 - f_1)
                                               
        if diff_circum > 2 * diff_isotropic:
            diff_isotropic = 0.0
        
        if diff_circum > 2 * diff_horizon:
            diff_horizon = 0
        return (diff_isotropic + diff_circum + diff_horizon) * self.window_area
    
    def calc_ground_ref_irradiation(self, norm_radiation, hor_radiation, sun_alt, view_factor):
        sun_alt_rad = math.radians(sun_alt)
        global_hor_radiation = norm_radiation * math.sin(sun_alt_rad) + hor_radiation
        ground_ref_radiation = self.albedo * global_hor_radiation * (1 - view_factor)
        
        return ground_ref_radiation
    
    def radiation(self, sun_alt, angle_incidence, normal_irradiation, horizontal_irradiation, normal_lux, horizontal_lux, unshaded_area):
        """
        credits: JoanDM
        """
        dir_irradiation = 0
        diff_irradiation = 0
        diff_irradiation_simple = 0
        ground_ref_irradiation = 0
        normal_lux = 0
        window_diff_lux = 0
        window_ground_ref_lux = 0
        
        # VF is a combination of tilt and shaded area
        view_factor = ((1 + math.cos(self.window_altitude_rad)) / 2) * unshaded_area/self.window_area
        
        # Direct Irradiation
        if normal_irradiation != 0 and math.cos(angle_incidence) > 0:
            dir_irradiation = normal_irradiation * math.cos(angle_incidence) * unshaded_area
        
        if normal_lux != 0:
            window_dir_lux = normal_lux * math.cos(angle_incidence) * unshaded_area
        
        # Diffuse Irradiation
        if not horizontal_irradiation == 0:
            diff_irradiation_simple =  horizontal_irradiation * ((1 + math.cos(self.window_altitude_rad)) / 2) * self.window_area
            diff_irradiation = self.calc_diffuse_irradiation(normal_irradiation, horizontal_irradiation,
                                                             view_factor, sun_alt, angle_incidence)  
            # Calculate diffuse and reflected irradiation
            ground_ref_irradiation = self.calc_ground_ref_irradiation(normal_irradiation, 
                                                                 horizontal_irradiation, sun_alt,
                                                                 view_factor)  
        
        window_diff_lux = horizontal_lux * view_factor
        window_ground_ref_lux = self.albedo * horizontal_lux * (1 - view_factor)
        window_illuminance =  normal_lux + window_diff_lux + window_ground_ref_lux
        
        return dir_irradiation, diff_irradiation, diff_irradiation_simple, ground_ref_irradiation, window_illuminance


class Element(object):
    """
    Element object representing an opaque or transparent element.
    ##OUTLOOK##
    absorptivity, reflectivity: Not yet implemented, but adding these parameters 
    would improve the accuracy of solar gains calculations in opaque and 
    transparent elements.The RC model would need to be adapted for this. Note to 
    future developers: when adding attributes, make sure to upadate the copy 
    method below with the same attributes!
    """
    def __init__(self, name = 'Element', area = 15.0, u_value = 1.0, frame_factor=1.0, opaque = True):

        self.name = name
        self.area = area
        self.u_value = u_value
        self.h_tr = self.u_value * self.area #element conductance [W/K]
        self.frame_factor = frame_factor
        self.opaque = opaque


class ElementBuilder(object):
    def __init__(self,element_name,u_value,frame_factor,opaque):
        self.element_name = element_name if element_name is not None else 'Wall'
        self.opaque = opaque
        if self.opaque:
            self.u_value = 0.2 if u_value is None else u_value
            self.frame_factor = 1
        else:
            self.u_value = 1 if u_value is None else u_value
            self.frame_factor = 1 if frame_factor is None else frame_factor

    def get_data(self,surface):
        centroid = rs.SurfaceAreaCentroid(surface)[0]
        normal = rs.SurfaceNormal(surface,[0.5,0.5])
        area = rs.SurfaceArea(surface)[0]
        return centroid,normal,area

    def add_element(self,geometry):
        centroids = []
        normals = []
        elements = []
        if geometry is not None:
            # Invalid input
            if not (rs.IsSurface(geometry) or rs.IsPolysurface(geometry)):
                error = """geometry is not a surface or polysurface"""
                e = ghKernel.GH_RuntimeMessageLevel.Error
                ghenv.Component.AddRuntimeMessage(e, error)
        
            # Single surface
            elif rs.IsSurface(geometry):
                centroid,normal,area = self.get_data(geometry)
                centroids = centroid
                normals = normal
                elements = [sc.sticky['Element'](
                    name=self.element_name,
                    area=area,
                    u_value=self.u_value, 
                    frame_factor=self.frame_factor,
                    opaque = self.opaque)]

            # Polysurface
            elif rs.IsPolysurface(geometry):
                all_parts = rs.ExplodePolysurfaces(geometry)
                for part in all_parts:
                    centroid,normal,area,azimuth,angle = self.get_data(part)
                    centroids.append(centroid)
                    normals.append(normal)
                    element = sc.sticky['Element'](
                        name=self.element_name,
                        area=area,
                        u_value=self.u_value, 
                        frame_factor=self.frame_factor,
                        opaque = self.opaque)
                    elements.append(element)
        return centroids,normals,elements


class ThermalBridge(object):
    def __init__(self,
                 name,
                 length,
                 linear_conductance):
        self.name = name if name is not None else 'Thermal bridge'
        self.name = name
        self.length = length
        self.linear_conductance = linear_conductance
        self.h_tr = length * linear_conductance


"""""""""""""""Emission Systems"""""""""""""""""""""

class EmissionDirector:

    """
    The director sets what Emission system is being used, and runs that set Emission system
    """

    builder = None

    # Sets what Emission system is used
    def set_builder(self, builder):
        #        self.__builder = builder
        self.builder = builder
    # Calcs the energy load of that system. This is the main() fu

    def calc_flows(self):

        # Director asks the builder to produce the system body. self.builder
        # is an instance of the class

        body = self.builder.heat_flows()

        return body

class EmissionSystemBase:

    """ 
    The base class in which systems are built from
    """

    def __init__(self, energy_demand):

        self.energy_demand = energy_demand


    def heat_flows(self): pass
    """
    determines the node where the heating/cooling system is active based on the system used
    Also determines the return and supply temperatures for the heating/cooling system
    """

class OldRadiators(EmissionSystemBase):
    """
    Old building with radiators and high supply temperature
    Heat is emitted to the air node
    """

    def heat_flows(self):
        flows = Flows()
        flows.phi_ia_plus = self.energy_demand
        flows.phi_st_plus = 0
        flows.phi_m_plus = 0

        flows.heating_supply_temperature = 65
        flows.heating_return_temperature = 45
        flows.cooling_supply_temperature = 12
        flows.cooling_return_temperature = 21

        return flows

class NewRadiators(EmissionSystemBase):
    """    
    Newer building with radiators and medium supply temperature
    Heat is emitted to the air node
    """

    def heat_flows(self):
        flows = Flows()
        flows.phi_ia_plus = self.energy_demand
        flows.phi_st_plus = 0
        flows.phi_m_plus = 0

        flows.heating_supply_temperature = 50
        flows.heating_return_temperature = 35
        flows.cooling_supply_temperature = 12
        flows.cooling_return_temperature = 21

        return flows

class ChilledBeams(EmissionSystemBase):
    """
    Chilled beams: identical to newRadiators but used for cooling
    Heat is emitted to the air node
    """

    def heat_flows(self):
        flows = Flows()
        flows.phi_ia_plus = self.energy_demand
        flows.phi_st_plus = 0
        flows.phi_m_plus = 0

        flows.heating_supply_temperature = 50
        flows.heating_return_temperature = 35
        flows.cooling_supply_temperature = 18
        flows.cooling_return_temperature = 21

        return flows

class AirConditioning(EmissionSystemBase):
    """
    All heat is given to the air via an AC-unit. HC input via the air node as in the ISO 13790 Annex C.
    supplyTemperature as with new radiators (assumption)
    Heat is emitted to the air node
    """

    def heat_flows(self):
        flows = Flows()
        flows.phi_ia_plus = self.energy_demand
        flows.phi_st_plus = 0
        flows.phi_m_plus = 0

        flows.heating_supply_temperature = 40
        flows.heating_return_temperature = 20
        flows.cooling_supply_temperature = 6
        flows.cooling_return_temperature = 15

        return flows

class FloorHeating(EmissionSystemBase):
    """
    All HC energy goes into the surface node, supplyTemperature low
    Heat is emitted to the surface node
    """

    def heat_flows(self):
        flows = Flows()
        flows.phi_ia_plus = 0
        flows.phi_st_plus = self.energy_demand
        flows.phi_m_plus = 0

        flows.heating_supply_temperature = 40
        flows.heating_return_temperature = 5
        flows.cooling_supply_temperature = 12
        flows.cooling_return_temperature = 21

        return flows

class TABS(EmissionSystemBase):
    """
    Thermally activated Building systems. HC energy input into bulk node. Supply Temperature low.
    Heat is emitted to the thermal mass node
    """

    def heat_flows(self):
        flows = Flows()
        flows.phi_ia_plus = 0
        flows.phi_st_plus = 0
        flows.phi_m_plus = self.energy_demand
        
        flows.heating_supply_temperature = 50
        flows.heating_return_temperature = 35
        flows.cooling_supply_temperature = 12
        flows.cooling_return_temperature = 21
        
        return flows

class Flows:
    """
    A base object to store output variables
    """

    phi_ia_plus = float("nan")
    phi_m_plus = float("nan")
    phi_st_plus = float("nan")

    heating_supply_temperature = float("nan")
    cooling_supply_temperature = float("nan")
    # return temperatures

"""""""""""""""Supply Systems"""""""""""""""""""""

class SupplyDirector:

    """
    The director sets what Supply system is being used, and runs that set Supply system
    """

    builder = None

    # Sets what building system is used
    def set_builder(self, builder):
        self.builder = builder

    # Calcs the energy load of that system. This is the main() function
    def calc_system(self):

        # Director asks the builder to produce the system body. self.builder
        # is an instance of the class

        body = self.builder.calc_loads()

        return body

class SupplySystemBase:

    """
     The base class in which Supply systems are built from 
    """

    def __init__(self, load, t_out, heating_supply_temperature, cooling_supply_temperature, has_heating_demand, has_cooling_demand):
        self.load = load  # Energy Demand of the building at that time step
        self.t_out = t_out  # Outdoor Air Temperature
        # Temperature required by the emission system
        self.heating_supply_temperature = heating_supply_temperature
        self.cooling_supply_temperature = cooling_supply_temperature
        self.has_heating_demand = has_heating_demand
        self.has_cooling_demand = has_cooling_demand

    def calc_loads(self): pass
    """
    Caculates the electricty / fossil fuel consumption of the set supply system
    If the system also generates electricity, then this is stored as electricity_out
    """

class OilBoilerOld(SupplySystemBase):
    """
    Old oil boiler with fuel efficiency of 63 percent (medium of range in report of semester project M. Fehr)
    No condensation, pilot light
    """

    def calc_loads(self):
        system = SupplyOut()
        system.fossils_in = self.load / 0.63
        system.electricity_in = 0
        system.electricity_out = 0
        return system

class OilBoilerMed(SupplySystemBase):
    """
    Classic oil boiler with fuel efficiency of 82 percent (medium of range in report of semester project M. Fehr)
    No condensation, but better nozzles etc.
    """

    def calc_loads(self):
        system = SupplyOut()
        system.fossils_in = self.load / 0.82
        system.electricity_in = 0
        system.electricity_out = 0
        return system

class OilBoilerNew(SupplySystemBase):
    """
    New oil boiler with fuel efficiency of 98 percent (value from report of semester project M. Fehr)
    Condensation boiler, latest generation
    """

    def calc_loads(self):
        system = SupplyOut()
        system.fossils_in = self.load / 0.98
        system.electricity_in = 0
        system.electricity_out = 0
        return system

class HeatPumpAir(SupplySystemBase):
    """
    BETA Version
    Air-Water heat pump. Outside Temperature as reservoir temperature.
    COP based off regression analysis of manufacturers data
    Source: "A review of domestic heat pumps, Iain Staffell, Dan Brett, Nigel Brandonc and Adam Hawkes"
    http://pubs.rsc.org/en/content/articlepdf/2012/ee/c2ee22653g

    TODO: Validate this methodology
    """

    def calc_loads(self):
        system = SupplyOut()

        if self.has_heating_demand:
            # determine the temperature difference, if negative, set to 0
            deltaT = max(0, self.heating_supply_temperature - self.t_out)
            # Eq (4) in Staggell et al.
            system.cop = 6.81 - 0.121 * deltaT + 0.000630 * deltaT**2
            system.electricity_in = self.load / system.cop

        elif self.has_cooling_demand:
            # determine the temperature difference, if negative, set to 0
            deltaT = max(0, self.t_out - self.cooling_supply_temperature)
            # Eq (4) in Staggell et al.
            system.cop = 6.81 - 0.121 * deltaT + 0.000630 * deltaT**2
            system.electricity_in = self.load / system.cop

        else:
            raise ValueError(
                'HeatPumpAir called although there is no heating/cooling demand')

        system.fossils_in = 0
        system.electricity_out = 0
        return system

class HeatPumpWater(SupplySystemBase):
    """"
    BETA Version
    Reservoir temperatures 7 degC (winter) and 12 degC (summer).
    Ground-Water heat pump. Outside Temperature as reservoir temperature.
    COP based off regression analysis of manufacturers data
    Source: "A review of domestic heat pumps, Iain Staffell, Dan Brett, Nigel Brandonc and Adam Hawkes"
    http://pubs.rsc.org/en/content/articlepdf/2012/ee/c2ee22653g

        # TODO: Validate this methodology
    """


    def calc_loads(self):
        system = SupplyOut()
        if self.has_heating_demand:
            deltaT = max(0, self.heating_supply_temperature - 7.0)
            # Eq (4) in Staggell et al.
            system.cop = 8.77 - 0.150 * deltaT + 0.000734 * deltaT**2
            system.electricity_in = self.load / system.cop

        elif self.has_cooling_demand:
            deltaT = max(0, 12.0 - self.cooling_supply_temperature)
            # Eq (4) in Staggell et al.
            system.cop = 8.77 - 0.150 * deltaT + 0.000734 * deltaT**2
            system.electricity_in = self.load / system.cop

        system.fossils_in = 0
        system.electricity_out = 0
        return system

class ElectricHeating(SupplySystemBase):
    """
    Straight forward electric heating. 100 percent conversion to heat.
    """

    def calc_loads(self):
        system = SupplyOut()
        system.electricity_in = self.load
        system.fossils_in = 0
        system.electricity_out = 0
        return system

class CHP(SupplySystemBase):
    """
    Combined heat and power unit with 60 percent thermal and 33 percent
    electrical fuel conversion. 93 percent overall
    """

    def calc_loads(self):
        system = SupplyOut()
        system.fossils_in = self.load / 0.6
        system.electricity_in = 0
        system.electricity_out = system.fossils_in * 0.33
        return system

class DirectHeater(SupplySystemBase):
    """
    Created by PJ to check accuracy against previous simulation
    """

    def calc_loads(self):
        system = SupplyOut()
        system.electricity_in = self.load
        system.fossils_in = 0
        system.electricity_out = 0
        return system

class DirectCooler(SupplySystemBase):
    """
    Created by PJ to check accuracy against previous simulation
    """

    def calc_loads(self):
        system = SupplyOut()
        system.electricity_in = self.load
        system.fossils_in = 0
        system.electricity_out = 0
        return system

class SupplyOut:
    """
    The System class which is used to output the final results
    """
    fossils_in = float("nan")
    electricity_in = float("nan")
    electricity_out = float("nan")
    cop = float("nan")

""""""""""""""""""""""""""""""""""""""""""""""""
sc.sticky["OilBoilerOld"] = OilBoilerOld
sc.sticky["OilBoilerMed"] = OilBoilerMed
sc.sticky["OilBoilerNew"] = OilBoilerNew
sc.sticky["HeatPumpAir"] = HeatPumpAir
sc.sticky["HeatPumpWater"] = HeatPumpWater
sc.sticky["ElectricHeating"] = ElectricHeating
sc.sticky["CHP"] = CHP
sc.sticky["DirectHeater"] = DirectHeater
sc.sticky["DirectCooler"] = DirectCooler
sc.sticky["SupplyDirector"] = SupplyDirector

sc.sticky["EmissionDirector"] = EmissionDirector
sc.sticky["OldRadiators"] = OldRadiators
sc.sticky["AirConditioning"] = AirConditioning
sc.sticky["NewRadiators"] = NewRadiators
sc.sticky["ChilledBeams"] = ChilledBeams
sc.sticky["FloorHeating"] = FloorHeating
sc.sticky["TABS"] = TABS
""""""""""""""""""""""""""""""""""""""""""""""""


class ThermalZone(object):
    def __init__(self,
                 occupants = 1, 
                 elements = None,
                 thermal_bridges = None,
                 floor_area = 34.3,
                 volume = 106.33,
                 thermal_capacitance_per_floor_area=165000,
                 ach_vent=1.5,
                 ach_infl=0.5,
                 ventilation_efficiency=1,
                 t_set_heating = 20,
                 t_set_cooling = 26,
                 max_heating_energy_per_floor_area = 12,
                 max_cooling_energy_per_floor_area = -12,
                 heating_supply_system=sc.sticky["DirectHeater"],
                 cooling_supply_system=sc.sticky["DirectCooler"],
                 heating_emission_system=sc.sticky["AirConditioning"],
                 cooling_emission_system=sc.sticky["AirConditioning"],
                ):

        # Element objects
        self.elements = elements
        self.elements_added = 0  # for reporting purposes
        self.element_names = []  # for reporting purposes
        
        # Thermal bridges
        self.thermal_bridges = thermal_bridges

        # direct inputs
        self.occupants = occupants
        self.floor_area = floor_area
        self.volume = volume
        self.total_internal_area = floor_area * 4.5 #ISO13790 7.2.2.2
        self.ach_vent = ach_vent
        self.ach_infl = ach_infl
        self.ventilation_efficiency = ventilation_efficiency
        self.thermal_capacitance_per_floor_area=thermal_capacitance_per_floor_area
        self.max_heating_energy_per_floor_area = max_heating_energy_per_floor_area
        self.max_cooling_energy_per_floor_area = max_cooling_energy_per_floor_area
        self.heating_supply_system = heating_supply_system
        self.heating_emission_system = heating_emission_system
        self.cooling_supply_system = cooling_supply_system
        self.cooling_emission_system = cooling_emission_system
        self.t_set_heating = t_set_heating
        self.t_set_cooling = t_set_cooling

        # initialize envelope properties
        self.h_tr_em = 0
        self.h_tr_w = 0
        self.wall_area = 0
        self.window_area = 0
        self.window_wall_ratio = 0

        #if left blank, zone elements will be set to ASF default values
        if self.elements == None:
            Window = Element(name='ASF_window', area=13.5, u_value=1.1)
            Wall = Element(name='ASF_wall', area=1.69, u_value=0.2)
            self.elements = [Window,Wall]

        for element in self.elements:
            self.add_elements(element)

        if self.thermal_bridges is not None:
            for tb in self.thermal_bridges:
                self.add_thermal_bridge(tb)


    def add_elements(self,e):
        self.element_names.append(e.name)
        # add surface conductances to conductance of mass
        if e.opaque:
            self.h_tr_em += e.h_tr
            self.elements_added += 1
            self.wall_area += e.area
        # add window conductance to window conductances
        else:
            self.h_tr_w += e.h_tr
            self.elements_added += 1
            self.window_area += e.area

    def add_thermal_bridge(self,tb):
        self.h_tr_em += tb.h_tr
        self.elements_added += 1

    def summary(self):
        #report the number of elements added to facilitate bug detection
        print 'Zone with %i elements'%len(self.elements)
        print 'Conductance of opaque surfaces to exterior [W/K], h_tr_em:', self.h_tr_em
        print 'Conductance to exterior through glazed surfaces [W/K], h_tr_w', self.h_tr_w
        print 'windows: %f m2, walls: %f m2, total: %f m2'%(self.window_area,self.wall_area,self.window_area+self.wall_area)
        try:
            print 'window to wall ratio: %f %%\n'%(int(round(self.window_area/self.wall_area*100,1)))
        except ZeroDivisionError:
            print '100% glazed'


class ElementBuilding(object):
    """
    The modular version. 
    Sets the parameters of the building.
    """

    def __init__(self,
                 zone=None,
                 lighting_load=11.7,
                 lighting_control=300.0,
                 lighting_utilisation_factor=0.45,
                 lighting_maintenance_factor=0.9,
                 ):

        # Initialise Zone
        self.zone = zone
        if self.zone == None:
            self.zone = Zone()

        # Fenestration and Lighting Properties
        self.lighting_load = lighting_load  # [kW/m2] lighting load
        self.lighting_control = lighting_control  # [lux] Lighting set point
        # How the light entering the window is transmitted to the working plane
        self.lighting_utilisation_factor = lighting_utilisation_factor
        # How dirty the window is. Section 2.2.3.1 Environmental Science
        # Handbook
        self.lighting_maintenance_factor = lighting_maintenance_factor

        # Calculated Properties
        self.floor_area = self.zone.floor_area # [m2] Floor Area
        # [m2] Effective Mass Area assuming a medium weight building #12.3.1.2
        # very light: 2.5 x Af
        # heavy: 3.0 x Af
        # very heavy: 3.5 x Af
        self.mass_area = self.floor_area * 2.5
        self.room_vol = self.zone.volume# [m3] Room Volume
        self.total_internal_area = self.zone.total_internal_area
        # TODO: Standard doesn't explain what A_t is. Needs to be checked
        self.A_t = self.total_internal_area

        # Single Capacitance  5 conductance Model Parameters
        # [kWh/K] Room Capacitance. Default based on ISO standard 12.3.1.2 for medium heavy buildings
        self.c_m = self.zone.thermal_capacitance_per_floor_area * self.floor_area
        # Conductance of opaque surfaces to exterior [W/K]
        self.h_tr_em = self.zone.h_tr_em
        # Conductance to exterior through glazed surfaces [W/K], based on
        # U-wert of 1W/m2K
        self.h_tr_w = self.zone.h_tr_w
        # Determine the ventilation conductance
        ach_tot = self.zone.ach_infl + self.zone.ach_vent  # Total Air Changes Per Hour
        # temperature adjustment factor taking ventilation and infiltration
        # [ISO: E -27]
        if ach_tot > 0:
            b_ek = 1 - (self.zone.ach_vent / ach_tot) * self.zone.ventilation_efficiency
        else:
            b_ek = 1
        # b_ek = (self.zone.ach_vent/ ach_tot) * self.zone.ventilation_efficiency
        self.h_ve_adj = 1200 * b_ek * self.room_vol * \
            (ach_tot / 3600)  # Conductance through ventilation [W/M]
        # transmittance from the internal air to the thermal mass of the
        # building
        self.h_tr_ms = 9.1 * self.mass_area
        # Conductance from the conditioned air to interior building surface
        self.h_tr_is = self.total_internal_area * 3.45

        # Thermal set points
        self.t_set_heating = self.zone.t_set_heating
        self.t_set_cooling = self.zone.t_set_cooling

        # Thermal Properties
        self.has_heating_demand = False  # Boolean for if heating is required
        self.has_cooling_demand = False  # Boolean for if cooling is required
        self.max_cooling_energy = zone.max_cooling_energy_per_floor_area * \
            self.floor_area  # max cooling load (W/m2)
        self.max_heating_energy = zone.max_heating_energy_per_floor_area * \
            self.floor_area  # max heating load (W/m2)
        # Building System Properties
        self.heating_supply_system = zone.heating_supply_system
        self.cooling_supply_system = zone.cooling_supply_system
        self.heating_emission_system = zone.heating_emission_system
        self.cooling_emission_system = zone.cooling_emission_system

    def solve_building_lighting(self, illuminance, occupancy):
        """
        Calculates the lighting demand for a set timestep
        :param illuminance: Illuminance transmitted through the window [Lumens]
        :type illuminance: float
        :param : Probability of full occupancy
        :type occupancy: float
        :return: self.lighting_demand, Lighting Energy Required for the timestep
        :rtype: float
        """
        # Cite: Environmental Science Handbook, SV Szokolay, Section 2.2.1.3
        # also, this might be sped up by pre-calculating the constants, but idk. first check with profiler...
        lux = (illuminance * self.lighting_utilisation_factor *
               self.lighting_maintenance_factor) / self.floor_area  # [Lux]

        if lux < self.lighting_control and occupancy > 0:
            # Lighting demand for the hour
            self.lighting_demand = self.lighting_load * self.floor_area
        else:
            self.lighting_demand = 0

    def solve_building_energy(self, internal_gains, solar_gains, t_out, t_m_prev):
        """
        Calculates the heating and cooling consumption of a building for a set timestep
        :param internal_gains: internal heat gains from people and appliances [W]
        :type internal_gains: float
        :param solar_gains: solar heat gains [W]
        :type solar_gains: float
        :param t_out: Outdoor air temperature [C]
        :type t_out: float
        :param t_m_prev: Previous air temperature [C]
        :type t_m_prev: float
        :return: self.heating_demand, space heating demand of the building
        :return: self.heating_sys_electricity, heating electricity consumption
        :return: self.heating_sys_fossils, heating fossil fuel consumption
        :return: self.cooling_demand, space cooling demand of the building
        :return: self.cooling_sys_electricity, electricity consumption from cooling
        :return: self.cooling_sys_fossils, fossil fuel consumption from cooling
        :return: self.electricity_out, electricity produced from combined heat pump systems
        :return: self.sys_total_energy, total exergy consumed (electricity + fossils) for heating and cooling
        :return: self.heating_energy, total exergy consumed (electricity + fossils) for heating
        :return: self.cooling_energy, total exergy consumed (electricity + fossils) for cooling
        :return: self.cop, Coefficient of Performance of the heating or cooling system
        :rtype: float
        """
        # Main File
        # Calculate the heat transfer definitions for formula simplification
        self.calc_h_tr_1()
        self.calc_h_tr_2()
        self.calc_h_tr_3()

        # check demand, and change state of self.has_heating_demand, and self._has_cooling_demand
        self.has_demand(internal_gains, solar_gains, t_out, t_m_prev)

        if not self.has_heating_demand and not self.has_cooling_demand:
            # no heating or cooling demand
            # calculate temperatures of building R-C-model and exit
            # --> rc_model_function_1(...)
            self.energy_demand = 0

            # y u no pep8 bra?
            self.heating_demand = 0  # Energy required by the Zone
            self.cooling_demand = 0  # Energy surplus of the Zone
            # Energy (in electricity) required by the supply system to provide
            # HeatingDemand
            self.heating_sys_electricity = 0
            # Energy (in fossil fuel) required by the supply system to provide
            # HeatingDemand
            self.heating_sys_fossils = 0
            # Energy (in electricity) required by the supply system to get rid
            # of CoolingDemand
            self.cooling_sys_electricity = 0
            # Energy (in fossil fuel) required by the supply system to get rid
            # of CoolingDemand
            self.cooling_sys_fossils = 0
            # Electricity produced by the supply system (e.g. CHP)
            self.electricity_out = 0

        else:
            # has heating/cooling demand

            # Calculates energy_demand used below
            self.calc_energy_demand(
                internal_gains, solar_gains, t_out, t_m_prev)

            self.calc_temperatures_crank_nicolson(
                self.energy_demand, internal_gains, solar_gains, t_out, t_m_prev)
            # calculates the actual t_m resulting from the actual heating
            # demand (energy_demand)

            # Calculate the Heating/Cooling Input Energy Required

            supply_director = sc.sticky["SupplyDirector"]()  # Initialise Heating System Manager

            if self.has_heating_demand:
                supply_director.set_builder(self.heating_supply_system(load=self.energy_demand,
                                                                t_out=t_out,
                                                                heating_supply_temperature=self.heating_supply_temperature,
                                                                cooling_supply_temperature=self.cooling_supply_temperature,
                                                                has_heating_demand=self.has_heating_demand,
                                                                has_cooling_demand=self.has_cooling_demand))
                supplyOut = supply_director.calc_system()
                # All Variables explained underneath line 467
                self.heating_demand = self.energy_demand
                self.heating_sys_electricity = supplyOut.electricity_in
                self.heating_sys_fossils = supplyOut.fossils_in
                self.cooling_demand = 0
                self.cooling_sys_electricity = 0
                self.cooling_sys_fossils = 0
                self.electricity_out = supplyOut.electricity_out

            elif self.has_cooling_demand:
                supply_director.set_builder(self.cooling_supply_system(load=self.energy_demand * (-1),
                                                                t_out=t_out,
                                                                heating_supply_temperature=self.heating_supply_temperature,
                                                                cooling_supply_temperature=self.cooling_supply_temperature,
                                                                has_heating_demand=self.has_heating_demand,
                                                                has_cooling_demand=self.has_cooling_demand))
                supplyOut = supply_director.calc_system()
                self.heating_demand = 0
                self.heating_sys_electricity = 0
                self.heating_sys_fossils = 0
                self.cooling_demand = self.energy_demand
                self.cooling_sys_electricity = supplyOut.electricity_in
                self.cooling_sys_fossils = supplyOut.fossils_in
                self.electricity_out = supplyOut.electricity_out

            self.cop = supplyOut.cop

        self.sys_total_energy = self.heating_sys_electricity + self.heating_sys_fossils + \
            self.cooling_sys_electricity + self.cooling_sys_fossils
        self.heating_energy = self.heating_sys_electricity + self.heating_sys_fossils
        self.cooling_energy = self.cooling_sys_electricity + self.cooling_sys_fossils

    # TODO: rename. this is expected to return a boolean. instead, it changes state??? you don't want to change state...
    # why not just return has_heating_demand and has_cooling_demand?? then call the function "check_demand"
    # has_heating_demand, has_cooling_demand = self.check_demand(...)
    def has_demand(self, internal_gains, solar_gains, t_out, t_m_prev):
        """
        Determines whether the building requires heating or cooling
        Used in: solve_building_energy()
        # step 1 in section C.4.2 in [C.3 ISO 13790]
        """
        # set energy demand to 0 and see if temperatures are within the comfort
        # range
        energy_demand = 0
        # Solve for the internal temperature t_Air
        self.calc_temperatures_crank_nicolson(
            energy_demand, internal_gains, solar_gains, t_out, t_m_prev)
        # If the air temperature is less or greater than the set temperature,
        # there is a heating/cooling load
        if self.t_air < self.t_set_heating:
            self.has_heating_demand = True
            self.has_cooling_demand = False
        elif self.t_air > self.t_set_cooling:
            self.has_cooling_demand = True
            self.has_heating_demand = False
        else:
            self.has_heating_demand = False
            self.has_cooling_demand = False

    def calc_temperatures_crank_nicolson(self, energy_demand, internal_gains, solar_gains, t_out, t_m_prev):
        """
        Determines node temperatures and computes derivation to determine the new node temperatures
        Used in: has_demand(), solve_building_energy(), calc_energy_demand()
        # section C.3 in [C.3 ISO 13790]
        """
        self.calc_heat_flow(t_out, internal_gains, solar_gains, energy_demand)

        self.calc_phi_m_tot(t_out)

        # calculates the new bulk temperature POINT from the old one
        self.calc_t_m_next(t_m_prev)

        # calculates the AVERAGE bulk temperature used for the remaining
        # calculation
        self.calc_t_m(t_m_prev)

        self.calc_t_s(t_out)

        self.calc_t_air(t_out)

        self.calc_t_operative()
        return self.t_m, self.t_air, self.t_operative

    def calc_energy_demand(self, internal_gains, solar_gains, t_out, t_m_prev):
        """
        Calculates the energy demand of the space if heating/cooling is active
        Used in: solve_building_energy()
        # Step 1 - Step 4 in Section C.4.2 in [C.3 ISO 13790]
        """

        # Step 1: Check if heating or cooling is needed
        #(Not needed, but doing so for readability when comparing with the standard)
        # Set heating/cooling to 0
        energy_demand_0 = 0
        # Calculate the air temperature with no heating/cooling
        t_air_0 = self.calc_temperatures_crank_nicolson(
            energy_demand_0, internal_gains, solar_gains, t_out, t_m_prev)[1]

        # Step 2: Calculate the unrestricted heating/cooling required

        # determine if we need heating or cooling based based on the condition
        # that no heating or cooling is required
        if self.has_heating_demand:
            t_air_set = self.t_set_heating
        elif self.has_cooling_demand:
            t_air_set = self.t_set_cooling
        else:
            raise NameError(
                'heating function has been called even though no heating is required')

        # Set a heating case where the heating load is 10x the floor area (10
        # W/m2)
        energy_floorAx10 = 10 * self.floor_area

        # Calculate the air temperature obtained by having this 10 W/m2
        # setpoint
        t_air_10 = self.calc_temperatures_crank_nicolson(
            energy_floorAx10, internal_gains, solar_gains, t_out, t_m_prev)[1]

        # Determine the unrestricted heating/cooling off the building
        self.calc_energy_demand_unrestricted(
            energy_floorAx10, t_air_set, t_air_0, t_air_10)

        # Step 3: Check if available heating or cooling power is sufficient
        if self.max_cooling_energy <= self.energy_demand_unrestricted <= self.max_heating_energy:

            self.energy_demand = self.energy_demand_unrestricted
            self.t_air_ac = t_air_set  # not sure what this is used for at this stage TODO

        # Step 4: if not sufficient then set the heating/cooling setting to the
        # maximum
        # necessary heating power exceeds maximum available power
        elif self.energy_demand_unrestricted > self.max_heating_energy:
            self.energy_demand = self.max_heating_energy

        # necessary cooling power exceeds maximum available power
        elif self.energy_demand_unrestricted < self.max_cooling_energy:

            self.energy_demand = self.max_cooling_energy

        else:
            self.energy_demand = 0
            raise ValueError('unknown radiative heating/cooling system status')

        # calculate system temperatures for Step 3/Step 4
        self.calc_temperatures_crank_nicolson(
            self.energy_demand, internal_gains, solar_gains, t_out, t_m_prev)

    def calc_energy_demand_unrestricted(self, energy_floorAx10, t_air_set, t_air_0, t_air_10):
        """
        Calculates the energy demand of the system if it has no maximum output restrictions
        # (C.13) in [C.3 ISO 13790]
        Based on the Thales Intercept Theorem.
        Where we set a heating case that is 10x the floor area and determine the temperature as a result
        Assuming that the relation is linear, one can draw a right angle triangle.
        From this we can determine the heating level required to achieve the set point temperature
        This assumes a perfect HVAC control system
        """
        self.energy_demand_unrestricted = energy_floorAx10 * \
            (t_air_set - t_air_0) / (t_air_10 - t_air_0)

    def calc_heat_flow(self, t_out, internal_gains, solar_gains, energy_demand):
        """
        Calculates the heat flow from the solar gains, heating/cooling system, and internal gains into the building
        The input of the building is split into the air node, surface node, and thermal mass node based on
        on the following equations
        #C.1 - C.3 in [C.3 ISO 13790]
        Note that this equation has diverged slightly from the standard
        as the heating/cooling node can enter any node depending on the
        emission system selected
        """

        # Calculates the heat flows to various points of the building based on the breakdown in section C.2, formulas C.1-C.3
        # Heat flow to the air node
        self.phi_ia = 0.5 * internal_gains
        # Heat flow to the surface node
        self.phi_st = (1 - (self.mass_area / self.A_t) - (self.h_tr_w /
                            (9.1 * self.A_t))) * (0.5 * internal_gains + solar_gains)
        # Heatflow to the thermal mass node
        self.phi_m = (self.mass_area / self.A_t) * \
            (0.5 * internal_gains + solar_gains)

        # We call the EmissionDirector to modify these flows depending on the
        # system and the energy demand
        emDirector = sc.sticky["EmissionDirector"]()
        # Set the emission system to the type specified by the user

        emDirector.set_builder(self.heating_emission_system(
            energy_demand=energy_demand))
        # Calculate the new flows to each node based on the heating system
        flows = emDirector.calc_flows()

        # Set modified flows to building object
        self.phi_ia += flows.phi_ia_plus
        self.phi_st += flows.phi_st_plus
        self.phi_m += flows.phi_m_plus

        # Set supply temperature to building object
        # TODO: This currently is constant for all emission systems, to be
        # modified in the future
        self.heating_supply_temperature = flows.heating_supply_temperature
        self.cooling_supply_temperature = flows.cooling_supply_temperature

    def calc_t_m_next(self, t_m_prev):
        """
        Primary Equation, calculates the temperature of the next time step
        # (C.4) in [C.3 ISO 13790]
        """

        self.t_m_next = ((t_m_prev * ((self.c_m / 3600.0) - 0.5 * (self.h_tr_3 + self.h_tr_em))) +
                         self.phi_m_tot) / ((self.c_m / 3600.0) + 0.5 * (self.h_tr_3 + self.h_tr_em))

    def calc_phi_m_tot(self, t_out):
        """
        Calculates a global heat transfer. This is a definition used to simplify equation
        calc_t_m_next so it's not so long to write out
        # (C.5) in [C.3 ISO 13790]
        # h_ve = h_ve_adj and t_supply = t_out [9.3.2 ISO 13790]
        """

        t_supply = t_out  # ASSUMPTION: Supply air comes straight from the outside air
        h_tr_3 = False
        for key in self.__dict__:
            if 'h_tr_3' in key:
                h_tr_3 = True
        if not h_tr_3: # This is the case when heating is supplied and crank-nicholson is called directly
            self.calc_h_tr_3()


        self.phi_m_tot = self.phi_m + self.h_tr_em * t_out + \
            self.h_tr_3 * (self.phi_st + self.h_tr_w * t_out + self.h_tr_1 *
                           ((self.phi_ia / self.h_ve_adj) + t_supply)) / self.h_tr_2

    def calc_h_tr_1(self):
        """
        Definition to simplify calc_phi_m_tot
        # (C.6) in [C.3 ISO 13790]
        """
        self.h_tr_1 = 1.0 / (1.0 / self.h_ve_adj + 1.0 / self.h_tr_is)

    def calc_h_tr_2(self):
        """
        Definition to simplify calc_phi_m_tot
        # (C.7) in [C.3 ISO 13790]
        """
        h_tr_1 = False
        for key in self.__dict__:
            if 'h_tr_1' in key:
                h_tr_1 = True
        if not h_tr_1:
            self.calc_h_tr_1 ()

        self.h_tr_2 = self.h_tr_1 + self.h_tr_w

    def calc_h_tr_3(self):
        """
        Definition to simplify calc_phi_m_tot
        # (C.8) in [C.3 ISO 13790]
        """
        h_tr_2 = False
        for key in self.__dict__:
            if 'h_tr_2' in key:
                h_tr_2 = True
        if not h_tr_2:
            self.calc_h_tr_2()

        self.h_tr_3 = 1.0 / (1.0 / self.h_tr_2 + 1.0 / self.h_tr_ms)

    def calc_t_m(self, t_m_prev):
        """
        Temperature used for the calculations, average between newly calculated and previous bulk temperature
        # (C.9) in [C.3 ISO 13790]
        """
        self.t_m = (self.t_m_next + t_m_prev) / 2.0
    def calc_t_s(self, t_out):
        """
        Calculate the temperature of the inside room surfaces
        # (C.10) in [C.3 ISO 13790]
        # h_ve = h_ve_adj and t_supply = t_out [9.3.2 ISO 13790]
        """

        t_supply = t_out  # ASSUMPTION: Supply air comes straight from the outside air

        self.t_s = (self.h_tr_ms * self.t_m + self.phi_st + self.h_tr_w * t_out + self.h_tr_1 * \
            (t_supply + self.phi_ia / self.h_ve_adj)) / \
            (self.h_tr_ms + self.h_tr_w + self.h_tr_1)

    def calc_t_air(self, t_out):
        """
        Calculate the temperature of the air node
        # (C.11) in [C.3 ISO 13790]
        # h_ve = h_ve_adj and t_supply = t_out [9.3.2 ISO 13790]
        """

        t_supply = t_out

        # Calculate the temperature of the inside air
        self.t_air = (self.h_tr_is * self.t_s + self.h_ve_adj *
                      t_supply + self.phi_ia) / (self.h_tr_is + self.h_ve_adj)

    def calc_t_operative(self):
        """
        The operative temperature is a weighted average of the air and mean radiant temperatures.
        It is not used in any further calculation at this stage
        # (C.12) in [C.3 ISO 13790]
        """
        
        self.t_operative = 0.3 * self.t_air + 0.7 * self.t_s


class Building(object):
    """
    The original code as found in RC_BuildingSimulator
    """

    def __init__(self,
                 window_area=13.5,
                 external_envelope_area=15.19,
                 room_depth=7,
                 room_width=4.9,
                 room_height=3.1,
                 lighting_load=11.7,
                 lighting_control=300,
                 lighting_utilisation_factor=0.45,
                 lighting_maintenance_factor=0.9,
                 u_walls=0.2,
                 u_windows=1.1,
                 g_windows=0.6,
                 ach_vent=1.5,
                 ach_infl=0.5,
                 ventilation_efficiency=0,
                 thermal_capacitance_per_floor_area=165000,
                 t_set_heating=20,
                 t_set_cooling=26,
                 max_cooling_energy_per_floor_area=-12,
                 max_heating_energy_per_floor_area=12,
                 heating_supply_system=sc.sticky["DirectHeater"],
                 cooling_supply_system=sc.sticky["DirectCooler"],
                 heating_emission_system=sc.sticky["AirConditioning"],
                 cooling_emission_system=sc.sticky["AirConditioning"],
                 ):

        # Building Dimensions
        self.window_area = window_area  # [m2] Window Area
        self.room_depth = room_depth  # [m] Room Depth
        self.room_width = room_width  # [m] Room Width
        self.room_height = room_height  # [m] Room Height

        # Fenestration and Lighting Properties
        self.g_windows = g_windows
        self.lighting_load = lighting_load  # [kW/m2] lighting load
        self.lighting_control = lighting_control  # [lux] Lighting set point
        # How the light entering the window is transmitted to the working plane
        self.lighting_utilisation_factor = lighting_utilisation_factor
        # How dirty the window is. Section 2.2.3.1 Environmental Science
        # Handbook
        self.lighting_maintenance_factor = lighting_maintenance_factor

        # Calculated Properties
        self.floor_area = room_depth * room_width  # [m2] Floor Area
        # [m2] Effective Mass Area assuming a medium weight building #12.3.1.2
        self.mass_area = self.floor_area * 2.5
        self.room_vol = room_width * room_depth * \
            room_height  # [m3] Room Volume
        self.total_internal_area = self.floor_area * 2 + \
            room_width * room_height * 2 + room_depth * room_height * 2
        # TODO: Standard doesn't explain what A_t is. Needs to be checked
        self.A_t = self.total_internal_area

        # Single Capacitance  5 conductance Model Parameters
        # [kWh/K] Room Capacitance. Default based on ISO standard 12.3.1.2 for medium heavy buildings
        self.c_m = thermal_capacitance_per_floor_area * self.floor_area
        # Conductance of opaque surfaces to exterior [W/K]
        self.h_tr_em = u_walls * (external_envelope_area - window_area)
        # Conductance to exterior through glazed surfaces [W/K], based on
        # U-wert of 1W/m2K
        self.h_tr_w = u_windows * window_area

        # Determine the ventilation conductance
        ach_tot = ach_infl + ach_vent  # Total Air Changes Per Hour
        # temperature adjustment factor taking ventilation and infiltration
        # [ISO: E -27]
        b_ek = (1 - (ach_vent / (ach_tot)) * ventilation_efficiency)
        self.h_ve_adj = 1200 * b_ek * self.room_vol * \
            (ach_tot / 3600)  # Conductance through ventilation [W/M]
        # transmittance from the internal air to the thermal mass of the
        # building
        self.h_tr_ms = 9.1 * self.mass_area
        # Conductance from the conditioned air to interior building surface
        self.h_tr_is = self.total_internal_area * 3.45

        # Thermal set points
        self.t_set_heating = t_set_heating
        self.t_set_cooling = t_set_cooling

        # Thermal Properties
        self.has_heating_demand = False  # Boolean for if heating is required
        self.has_cooling_demand = False  # Boolean for if cooling is required
        self.max_cooling_energy = max_cooling_energy_per_floor_area * \
            self.floor_area  # max cooling load (W/m2)
        self.max_heating_energy = max_heating_energy_per_floor_area * \
            self.floor_area  # max heating load (W/m2)

        # Building System Properties
        self.heating_supply_system = heating_supply_system
        self.cooling_supply_system = cooling_supply_system
        self.heating_emission_system = heating_emission_system
        self.cooling_emission_system = cooling_emission_system

    def solve_building_lighting(self, illuminance, occupancy):
        """
        Calculates the lighting demand for a set timestep

        :param illuminance: Illuminance transmitted through the window [Lumens]
        :type illuminance: float
        :param occupancy: Probability of full occupancy
        :type occupancy: float

        :return: self.lighting_demand, Lighting Energy Required for the timestep
        :rtype: float

        """
        # Cite: Environmental Science Handbook, SV Szokolay, Section 2.2.1.3
        # also, this might be sped up by pre-calculating the constants, but idk. first check with profiler...
        lux = (illuminance * self.lighting_utilisation_factor *
               self.lighting_maintenance_factor) / self.floor_area  # [Lux]

        if lux < self.lighting_control and occupancy > 0:
            # Lighting demand for the hour
            self.lighting_demand = self.lighting_load * self.floor_area
        else:
            self.lighting_demand = 0

    def solve_building_energy(self, internal_gains, solar_gains, t_out, t_m_prev):
        """
        Calculates the heating and cooling consumption of a building for a set timestep

        :param internal_gains: internal heat gains from people and appliances [W]
        :type internal_gains: float
        :param solar_gains: solar heat gains [W]
        :type solar_gains: float
        :param t_out: Outdoor air temperature [C]
        :type t_out: float
        :param t_m_prev: Previous air temperature [C]
        :type t_m_prev: float

        :return: self.heating_demand, space heating demand of the building
        :return: self.heating_sys_electricity, heating electricity consumption
        :return: self.heating_sys_fossils, heating fossil fuel consumption 
        :return: self.cooling_demand, space cooling demand of the building
        :return: self.cooling_sys_electricity, electricity consumption from cooling
        :return: self.cooling_sys_fossils, fossil fuel consumption from cooling
        :return: self.electricity_out, electricity produced from combined heat pump systems
        :return: self.sys_total_energy, total exergy consumed (electricity + fossils) for heating and cooling
        :return: self.heating_energy, total exergy consumed (electricity + fossils) for heating 
        :return: self.cooling_energy, total exergy consumed (electricity + fossils) for cooling
        :return: self.cop, Coefficient of Performance of the heating or cooling system
        :rtype: float

        """
        # Main File

        # Calculate the heat transfer definitions for formula simplification
        self.calc_h_tr_1()
        self.calc_h_tr_2()
        self.calc_h_tr_3()

        # check demand, and change state of self.has_heating_demand, and self._has_cooling_demand
        self.has_demand(internal_gains, solar_gains, t_out, t_m_prev)

        if not self.has_heating_demand and not self.has_cooling_demand:

            # no heating or cooling demand
            # calculate temperatures of building R-C-model and exit
            # --> rc_model_function_1(...)
            self.energy_demand = 0

            # y u no pep8 bra?
            self.heating_demand = 0  # Energy required by the zone
            self.cooling_demand = 0  # Energy surplus of the zone
            # Energy (in electricity) required by the supply system to provide
            # HeatingDemand
            self.heating_sys_electricity = 0
            # Energy (in fossil fuel) required by the supply system to provide
            # HeatingDemand
            self.heating_sys_fossils = 0
            # Energy (in electricity) required by the supply system to get rid
            # of CoolingDemand
            self.cooling_sys_electricity = 0
            # Energy (in fossil fuel) required by the supply system to get rid
            # of CoolingDemand
            self.cooling_sys_fossils = 0
            # Electricity produced by the supply system (e.g. CHP)
            self.electricity_out = 0

        else:

            # has heating/cooling demand

            # Calculates energy_demand used below
            self.calc_energy_demand(
                internal_gains, solar_gains, t_out, t_m_prev)

            self.calc_temperatures_crank_nicolson(
                self.energy_demand, internal_gains, solar_gains, t_out, t_m_prev)
            # calculates the actual t_m resulting from the actual heating
            # demand (energy_demand)

            # Calculate the Heating/Cooling Input Energy Required

            supply_director = sc.sticky["SupplyDirector"]()  # Initialise Heating System Manager

            if self.has_heating_demand:
                supply_director.set_builder(self.heating_supply_system(load=self.energy_demand, 
                                                                t_out=t_out, 
                                                                heating_supply_temperature=self.heating_supply_temperature,
                                                                cooling_supply_temperature=self.cooling_supply_temperature, 
                                                                has_heating_demand=self.has_heating_demand, 
                                                                has_cooling_demand=self.has_cooling_demand))
                supplyOut = supply_director.calc_system()
                # All Variables explained underneath line 467
                self.heating_demand = self.energy_demand
                self.heating_sys_electricity = supplyOut.electricity_in
                self.heating_sys_fossils = supplyOut.fossils_in
                self.cooling_demand = 0
                self.cooling_sys_electricity = 0
                self.cooling_sys_fossils = 0
                self.electricity_out = supplyOut.electricity_out

            elif self.has_cooling_demand:
                supply_director.set_builder(self.cooling_supply_system(load=self.energy_demand * (-1), 
                                                                t_out=t_out, 
                                                                heating_supply_temperature=self.heating_supply_temperature,
                                                                cooling_supply_temperature=self.cooling_supply_temperature, 
                                                                has_heating_demand=self.has_heating_demand, 
                                                                has_cooling_demand=self.has_cooling_demand))
                supplyOut = supply_director.calc_system()
                self.heating_demand = 0
                self.heating_sys_electricity = 0
                self.heating_sys_fossils = 0
                self.cooling_demand = self.energy_demand
                self.cooling_sys_electricity = supplyOut.electricity_in
                self.cooling_sys_fossils = supplyOut.fossils_in
                self.electricity_out = supplyOut.electricity_out

            self.cop = supplyOut.cop

        self.sys_total_energy = self.heating_sys_electricity + self.heating_sys_fossils + \
            self.cooling_sys_electricity + self.cooling_sys_fossils
        self.heating_energy = self.heating_sys_electricity + self.heating_sys_fossils
        self.cooling_energy = self.cooling_sys_electricity + self.cooling_sys_fossils

    # TODO: rename. this is expected to return a boolean. instead, it changes state??? you don't want to change state...
    # why not just return has_heating_demand and has_cooling_demand?? then call the function "check_demand"
    # has_heating_demand, has_cooling_demand = self.check_demand(...)
    def has_demand(self, internal_gains, solar_gains, t_out, t_m_prev):
        """
        Determines whether the building requires heating or cooling
        Used in: solve_building_energy()

        # step 1 in section C.4.2 in [C.3 ISO 13790]
        """

        # set energy demand to 0 and see if temperatures are within the comfort
        # range
        energy_demand = 0
        # Solve for the internal temperature t_Air
        self.calc_temperatures_crank_nicolson(
            energy_demand, internal_gains, solar_gains, t_out, t_m_prev)

        # If the air temperature is less or greater than the set temperature,
        # there is a heating/cooling load
        if self.t_air < self.t_set_heating:
            self.has_heating_demand = True
            self.has_cooling_demand = False
        elif self.t_air > self.t_set_cooling:
            self.has_cooling_demand = True
            self.has_heating_demand = False
        else:
            self.has_heating_demand = False
            self.has_cooling_demand = False

    def calc_temperatures_crank_nicolson(self, energy_demand, internal_gains, solar_gains, t_out, t_m_prev):
        """
        Determines node temperatures and computes derivation to determine the new node temperatures
        Used in: has_demand(), solve_building_energy(), calc_energy_demand()
        # section C.3 in [C.3 ISO 13790]
        """

        self.calc_heat_flow(t_out, internal_gains, solar_gains, energy_demand)

        self.calc_phi_m_tot(t_out)

        # calculates the new bulk temperature POINT from the old one
        self.calc_t_m_next(t_m_prev)

        # calculates the AVERAGE bulk temperature used for the remaining
        # calculation
        self.calc_t_m(t_m_prev)

        self.calc_t_s(t_out)

        self.calc_t_air(t_out)

        self.calc_t_operative()

        return self.t_m, self.t_air, self.t_operative

    def calc_energy_demand(self, internal_gains, solar_gains, t_out, t_m_prev):
        """
        Calculates the energy demand of the space if heating/cooling is active
        Used in: solve_building_energy()
        # Step 1 - Step 4 in Section C.4.2 in [C.3 ISO 13790]
        """

        # Step 1: Check if heating or cooling is needed 
        #(Not needed, but doing so for readability when comparing with the standard)
        # Set heating/cooling to 0
        energy_demand_0 = 0
        # Calculate the air temperature with no heating/cooling
        t_air_0 = self.calc_temperatures_crank_nicolson(
            energy_demand_0, internal_gains, solar_gains, t_out, t_m_prev)[1]

        # Step 2: Calculate the unrestricted heating/cooling required

        # determine if we need heating or cooling based based on the condition
        # that no heating or cooling is required
        if self.has_heating_demand:
            t_air_set = self.t_set_heating
        elif self.has_cooling_demand:
            t_air_set = self.t_set_cooling
        else:
            raise NameError(
                'heating function has been called even though no heating is required')

        # Set a heating case where the heating load is 10x the floor area (10
        # W/m2)
        energy_floorAx10 = 10 * self.floor_area

        # Calculate the air temperature obtained by having this 10 W/m2
        # setpoint
        t_air_10 = self.calc_temperatures_crank_nicolson(
            energy_floorAx10, internal_gains, solar_gains, t_out, t_m_prev)[1]

        # Determine the unrestricted heating/cooling off the building
        self.calc_energy_demand_unrestricted(
            energy_floorAx10, t_air_set, t_air_0, t_air_10)

        # Step 3: Check if available heating or cooling power is sufficient
        if self.max_cooling_energy <= self.energy_demand_unrestricted <= self.max_heating_energy:

            self.energy_demand = self.energy_demand_unrestricted
            self.t_air_ac = t_air_set  # not sure what this is used for at this stage TODO

        # Step 4: if not sufficient then set the heating/cooling setting to the
        # maximum
        # necessary heating power exceeds maximum available power
        elif self.energy_demand_unrestricted > self.max_heating_energy:

            self.energy_demand = self.max_heating_energy

        # necessary cooling power exceeds maximum available power
        elif self.energy_demand_unrestricted < self.max_cooling_energy:

            self.energy_demand = self.max_cooling_energy

        else:
            self.energy_demand = 0
            raise ValueError('unknown radiative heating/cooling system status')

        # calculate system temperatures for Step 3/Step 4
        self.calc_temperatures_crank_nicolson(
            self.energy_demand, internal_gains, solar_gains, t_out, t_m_prev)

    def calc_energy_demand_unrestricted(self, energy_floorAx10, t_air_set, t_air_0, t_air_10):
        """
        Calculates the energy demand of the system if it has no maximum output restrictions
        # (C.13) in [C.3 ISO 13790]


        Based on the Thales Intercept Theorem. 
        Where we set a heating case that is 10x the floor area and determine the temperature as a result 
        Assuming that the relation is linear, one can draw a right angle triangle. 
        From this we can determine the heating level required to achieve the set point temperature
        This assumes a perfect HVAC control system
        """
        self.energy_demand_unrestricted = energy_floorAx10 * \
            (t_air_set - t_air_0) / (t_air_10 - t_air_0)

    def calc_heat_flow(self, t_out, internal_gains, solar_gains, energy_demand):
        """
        Calculates the heat flow from the solar gains, heating/cooling system, and internal gains into the building

        The input of the building is split into the air node, surface node, and thermal mass node based on
        on the following equations

        #C.1 - C.3 in [C.3 ISO 13790]

        Note that this equation has diverged slightly from the standard 
        as the heating/cooling node can enter any node depending on the
        emission system selected

        """

        # Calculates the heat flows to various points of the building based on the breakdown in section C.2, formulas C.1-C.3
        # Heat flow to the air node
        self.phi_ia = 0.5 * internal_gains
        # Heat flow to the surface node
        self.phi_st = (1 - (self.mass_area / self.A_t) - (self.h_tr_w /
                            (9.1 * self.A_t))) * (0.5 * internal_gains + solar_gains)
        # Heatflow to the thermal mass node
        self.phi_m = (self.mass_area / self.A_t) * \
            (0.5 * internal_gains + solar_gains)

        # We call the EmissionDirector to modify these flows depending on the
        # system and the energy demand
        emDirector = sc.sticky["EmissionDirector"]()
        # Set the emission system to the type specified by the user
        emDirector.set_builder(self.heating_emission_system(
            energy_demand=energy_demand))
        # Calculate the new flows to each node based on the heating system
        flows = emDirector.calc_flows()

        # Set modified flows to building object
        self.phi_ia += flows.phi_ia_plus
        self.phi_st += flows.phi_st_plus
        self.phi_m += flows.phi_m_plus

        # Set supply temperature to building object
        # TODO: This currently is constant for all emission systems, to be
        # modified in the future
        self.heating_supply_temperature = flows.heating_supply_temperature
        self.cooling_supply_temperature = flows.cooling_supply_temperature

    def calc_t_m_next(self, t_m_prev):
        """
        Primary Equation, calculates the temperature of the next time step
        # (C.4) in [C.3 ISO 13790]
        """

        self.t_m_next = ((t_m_prev * ((self.c_m / 3600.0) - 0.5 * (self.h_tr_3 + self.h_tr_em))) +
                         self.phi_m_tot) / ((self.c_m / 3600.0) + 0.5 * (self.h_tr_3 + self.h_tr_em))

    def calc_phi_m_tot(self, t_out):
        """
        Calculates a global heat transfer. This is a definition used to simplify equation
        calc_t_m_next so it's not so long to write out
        # (C.5) in [C.3 ISO 13790]
        # h_ve = h_ve_adj and t_supply = t_out [9.3.2 ISO 13790]
        """

        t_supply = t_out  # ASSUMPTION: Supply air comes straight from the outside air

        self.phi_m_tot = self.phi_m + self.h_tr_em * t_out + \
            self.h_tr_3 * (self.phi_st + self.h_tr_w * t_out + self.h_tr_1 *
                           ((self.phi_ia / self.h_ve_adj) + t_supply)) / self.h_tr_2

    def calc_h_tr_1(self):
        """
        Definition to simplify calc_phi_m_tot
        # (C.6) in [C.3 ISO 13790]

        """
        self.h_tr_1 = 1.0 / (1.0 / self.h_ve_adj + 1.0 / self.h_tr_is)

    def calc_h_tr_2(self):
        """
        Definition to simplify calc_phi_m_tot
        # (C.7) in [C.3 ISO 13790]

        """

        self.h_tr_2 = self.h_tr_1 + self.h_tr_w

    def calc_h_tr_3(self):
        """
        Definition to simplify calc_phi_m_tot
        # (C.8) in [C.3 ISO 13790]

        """

        self.h_tr_3 = 1.0 / (1.0 / self.h_tr_2 + 1.0 / self.h_tr_ms)


    def calc_t_m(self, t_m_prev):
        """
        Temperature used for the calculations, average between newly calculated and previous bulk temperature
        # (C.9) in [C.3 ISO 13790]
        """
        self.t_m = (self.t_m_next + t_m_prev) / 2.0

    def calc_t_s(self, t_out):
        """
        Calculate the temperature of the inside room surfaces
        # (C.10) in [C.3 ISO 13790]
        # h_ve = h_ve_adj and t_supply = t_out [9.3.2 ISO 13790]
        """

        t_supply = t_out  # ASSUMPTION: Supply air comes straight from the outside air

        self.t_s = (self.h_tr_ms * self.t_m + self.phi_st + self.h_tr_w * t_out + self.h_tr_1 * \
            (t_supply + self.phi_ia / self.h_ve_adj)) / \
            (self.h_tr_ms + self.h_tr_w + self.h_tr_1)

    def calc_t_air(self, t_out):
        """
        Calculate the temperature of the air node
        # (C.11) in [C.3 ISO 13790]
        # h_ve = h_ve_adj and t_supply = t_out [9.3.2 ISO 13790]
        """

        t_supply = t_out

        # Calculate the temperature of the inside air
        self.t_air = (self.h_tr_is * self.t_s + self.h_ve_adj *
                      t_supply + self.phi_ia) / (self.h_tr_is + self.h_ve_adj)

    def calc_t_operative(self):
        """
        The operative temperature is a weighted average of the air and mean radiant temperatures. 
        It is not used in any further calculation at this stage
        # (C.12) in [C.3 ISO 13790]
        """

        self.t_operative = 0.3 * self.t_air + 0.7 * self.t_s


    
sc.sticky["RelativeSun"] = RelativeSun
sc.sticky["WindowRadiation"] = WindowRadiation
sc.sticky["Element"] = Element
sc.sticky["ElementBuilder"] = ElementBuilder
sc.sticky["ThermalBridge"] = ThermalBridge
sc.sticky["ThermalZone"] = ThermalZone
sc.sticky["RCModel"] = ElementBuilding
sc.sticky["RCModelClassic"] = Building
sc.sticky["HivePreparation"] = HivePreparation

print 'Modular Building Physics is go!'
# ---------- end _0_hive ----------
ladybug = Ladybug_Ladybug()  # -> Vviiiiiiiiiizzz; plug-in component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
_0_hive_2 = Hive_Hive()  # -> out; same code as _0_hive
number_slider = Slider(2680, range=0..10000)
number_slider_2 = Slider(0.31, range=0.05..0.8)
ladybug_2 = Ladybug_Ladybug()  # -> Vviiiiiiiiiizzz; plug-in component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
open_weather_file = Ladybug_OpenEPWWeatherFile(open=Toggle(True))  # -> epwFile; plug-in component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
gencumulativeskymtx = Ladybug_GenCumulativeSkyMtx(epwFile=open_weather_file, skyDensity=0, useOldRes=True, runIt=Toggle(True))  # -> readMe, cumulativeSkyMtx; plug-in component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
selectskymtx = Ladybug_selectSkyMtx(cumulativeSkyMtx=gencumulativeskymtx.cumulativeSkyMtx, HOY=number_slider, removeDiffuse=False, removeDirect=False)  # -> readMe, selectedSkyMtx; plug-in component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
X = UnitX(Factor=Slider(4, range=0..10))

# ---- group: sets time steps for simulation
# Simulation Data
number_slider_3 = Slider(1, range=1..12)
start_day = Panel("1")
panel = Panel("C:\Users\Zghiru\Documents\GitHub\hive\HIVE_RC_simulator\auxiliary\Zurich-Kloten_2013.epw")
doy_hoy = Ladybug_DOY_HOY(days=start_day, months=number_slider_3, hours=1)  # -> HOY, DOY, date; plug-in component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
number_of_hours = Panel("1")

# ----
eval = Evaluate(F="x+y-1", x=number_slider, y=number_of_hours)

# ---- group: sets time steps for simulation (continued)
getweatherdata = Hive_getWeatherData(epw_file=panel, start_HOY=number_slider, end_HOY=eval)  # -> out, location, temperature, irradiation; inputs start_HOY: Int32, end_HOY: Int32
# ---------- getweatherdata: Python ----------
#
# Hive: An educational plugin developed by the A/S chair at ETH Zurich
# 
# This file is part of Hive.
# 
# TODO: Check terms of GNU modification.
#
# This component is a mashup of functions from Ladybug for importing and reading 
# EPW files. 
# 

"""
Extract temperature, location and irradiation data from a weather file. 
-
Provided by Hive 0.0.1

    Args:
        epw_file: connect a path to a weather file
        browse_for_epw: Set to True to browse for a weather file in your system.
        start_HOY: Default=1. Optional HOY for the start of the analysis period
        end_HOY: Default=8760. Optional HOY for the end of the analysis period
    Returns:
        ReadMe!: ...
        location: a list of longitude, latitude, utc offset and year
        temperature: a tree in the form: {hoy,temperature}
        irradiation: a tree in the form: {hoy, direct normal irradiation, diffuse horizontal irradiation, direct normal illuminance, diffuse horizontal illuminance)
"""

ghenv.Component.Name = "Hive_getWeatherData"
ghenv.Component.NickName = 'getWeatherData'
ghenv.Component.Message = 'VER 0.0.1\nMAY_29_2018'
ghenv.Component.Category = "Hive"
ghenv.Component.SubCategory = "1. Environment"
# ComponentExposure=1

import rhinoscriptsyntax as rs
import scriptcontext as sc
import Grasshopper.Kernel as ghKernel
from Grasshopper.Kernel.Data import GH_Path
from Grasshopper import DataTree
from System import Object

class GhPythonDictionary(object):
    def __init__(self, pythonDict=None):
        if pythonDict:
            self.d = pythonDict
        else:
            self.d = {}
    def ToString(self):
        return 'GhPythonDictionary object'

def separate_data(inputList):
    # Based on Ladybug_Separate data, but uses lists instead of DataTree objects
    num = []
    str = []
    lastOne = None
    
    strPath = 0
    numPath = 0
    
    p = []
    numbers = []
    strings = []
    
    for count, item in enumerate(inputList):
        try:
            item = float(item)
            if count == 0: numfirst = True
            if lastOne == None: lastOne = "float"
            if lastOne!= "float":
                lastOne = "float"
                numPath += 1
            if numfirst == False:
                p.append(numPath-1)
                numbers.append(item)
            else:
                p.append(numPath)
                numbers.append(item)
        except:
            if count == 0: numfirst = False
            if lastOne == None: lastOne = "str"
            if lastOne!= "str":
                lastOne = "str"
                strPath += 1
            if numfirst == True:
                p.append(strPath-1)
                strings.append(item)
            else:
                p.append(strPath)
                strings.append(item)
    
    return numbers

def open_epw(open):
    #Based on Ladybug_Open EPW Weather File
    if open == True:
        filter = "EPW file (*.epw)|*.epw|All Files (*.*)|*.*||"
        epwFile = rs.OpenFileName("Open .epw Weather File", filter)
        print 'Done!'
        return epwFile
    else:
        print 'Please set open to True'

def list_to_tree(nestedlist):
    layerTree = DataTree[object]()
    for i, item_list in enumerate(nestedlist):
        path = GH_Path(i)
        layerTree.AddRange(item_list,path)
    return layerTree

def main(epw_file,start_HOY,end_HOY):
    if not sc.sticky.has_key('HivePreparation'): return "Add the modular RC component to the canvas!"
    #TODO: Set up compatibility checks like in Ladybug.
    
    sc.sticky['simulation_period'] = '[%i,%i]'%(start_HOY,end_HOY)
    
    HivePreparation = sc.sticky["HivePreparation"]()
    start,end = HivePreparation.set_simulation_period(start_HOY,end_HOY)
    temperature = []
    irradiation = []
    
    if (epw_file is not None):
        locationData = HivePreparation.epwLocation(epw_file)
        weatherData = HivePreparation.epwDataReader(epw_file, locationData[0])

        location = [locationData[1], locationData[2], locationData[3]]
        dryBulbTemperature, dewPointTemperature, relativeHumidity, windSpeed, windDirection, directNormalRadiation, diffuseHorizontalRadiation, globalHorizontalRadiation, directNormalIlluminance, diffuseHorizontalIlluminance, globalHorizontalIlluminance, totalSkyCover, horizontalInfraredRadiation, barometricPressure, modelYear = weatherData
        location.append(modelYear[7])

        dryBulbTemperature = separate_data(dryBulbTemperature)
        directRadiation = separate_data(directNormalRadiation)
        diffuseRadiation = separate_data(diffuseHorizontalRadiation)
        directIlluminance = separate_data(directNormalIlluminance)
        diffuseIlluminance = separate_data(diffuseHorizontalIlluminance)
        
        for i in range(start-1,end):
            temperature.append([i,dryBulbTemperature[i]])
            irradiation.append([i, directRadiation[i], diffuseRadiation[i], directIlluminance[i], diffuseIlluminance[i]])
    
    return location, list_to_tree(temperature), list_to_tree(irradiation)

def raise_warning(warning_str):
    warning = warning_str
    w = ghKernel.GH_RuntimeMessageLevel.Warning
    ghenv.Component.AddRuntimeMessage(w, warning)

""""""""""""""""""""""""""""""""""""""""""""""""""""""""""""""""""

if epw_file is None:
    if browse_for_epw:
        epw_file = open_epw(browse_for_epw)
else:
    if start_HOY is None or end_HOY is None:
        raise_warning('start_HOY or end_HOY are disconnected. Default values of 0 or 8760, respectively, will be assumed')
    
    start_HOY = 1 if not start_HOY else start_HOY
    end_HOY = 8760 if not end_HOY else end_HOY
    location, temperature, irradiation = main(epw_file,start_HOY,end_HOY)
# ---------- end getweatherdata ----------

# ----
# Geometry
brep = Brep(<brep referenced from the Rhino model>)
edges = BrepEdges(Brep=brep)  # -> Naked, Interior, NonManifold
debrep = DeconstructBrep(Brep=brep)  # -> Faces, Edges, Vertices
volume = Volume(Geometry=brep)  # -> Volume, Centroid
brep_2 = Brep([<brep referenced from the Rhino model> x2])
shader = Shader(ColourSwatch(SwatchColor=RGBA(12, 194, 245, 131)))

# ---- group: Window NW
rooof = ListItem(List=debrep.Faces, Index=2, Wrap=True)
area = Area(Geometry=rooof)  # -> Area, Centroid

# ---- group: surface tags
cluster = Cluster(G=debrep.Faces, L=debrep.Faces)  # -> orientedtocam, int_2
tag = TextTag3D(Location=cluster.orientedtocam, Text=cluster.int_2, Size=0.4, Justification=7)

# ---- group: roof
rooof_2 = ListItem(List=debrep.Faces, Index=9, Wrap=True)
shader_2 = Shader(ColourSwatch(SwatchColor=RGBA(255, 236, 94, 83)))
preview = CustomPreview(Geometry=rooof_2, Shader=shader_2)

# ---- group: window SE
rooof_3 = ListItem(List=debrep.Faces, Index=0, Wrap=True)
area_2 = Area(Geometry=rooof_3)  # -> Area, Centroid

# ----
debrep_2 = DeconstructBrep(Brep=rooof_3)  # -> Faces, Edges, Vertices
vec = Vector(Vector(-0.8972798405, 0.4414622157, 0))
multiplication = Multiplication(A=Slider(1.3, range=0..2), B=vec)
item = ListItem(List=debrep_2.Edges, Index=2, Wrap=True)
extr = Extrude(Base=item, Direction=multiplication)
series = Series(Start=0, Step=Slider(-1.6, range=-2..0), Count=Slider(3, range=1..5))
Z = UnitZ(Factor=series)
move = Move(Geometry=extr, Motion=Z)  # -> Geometry, Transform

area_3 = Area(Geometry=rooof_2)  # -> Area, Centroid
preview_2 = CustomPreview(Geometry=[rooof_3, rooof], Shader=shader)

# ----
# Create Zone
u_value = Panel("0.73")
g_value = Panel("0.2")
toggle = BooleanToggle(True)
glazedelement = Hive_GlazedElement(
    window_name="window_SE",
    window_geometry=rooof,
    context_geometry=flatten(brep_2),
    u_value=u_value,
    point_in_zone=area_3.Centroid,
    location=getweatherdata.location,
    irradiation=getweatherdata.irradiation,
    solar_transmittance=g_value,
    draw_shadows=toggle)  # -> out, glazed_elements, solar_gains, illuminance, port, window_centroid, window_normal, window_area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; inputs context_geometry: list, point_in_zone: Point3d, location: list, irradiation: tree; disabled
# ---------- glazedelement: Python ----------
# Glazed element
#
# HIVE: A energy simulation plugin developed by the A/S chair at ETH Zurich
# This component is based on building_physics.py in the RC_BuildingSimulator Github repository
# https://github.com/architecture-building-systems/RC_BuildingSimulator
# Extensive documentation is available on the project wiki.
#
# Author: Justin Zarb <zarbj@student.ethz.ch>
#
# This file is part of HIVE
#
# Licensing/Copyright and liability comments go here.
# <Copyright 2018, Architecture and Building Systems - ETH Zurich>
# <Licence: MIT>

"""
Dual-purpose component which outputs an element and calculates solar gains.
-
Provided by HIVE 0.0.1
    
    Args:
        _window_geometry: a surface or polysurface representing the 
             of the element
        window_name: optional element name
        _u_value: element u-value [W/(m^2.K)]. Typical values for a single glazed window 4.8, good double-glazed window:1-1.2, triple-glazed window: 0.15.
        solar_transmittance: [default:0.7] (aka. g-factor) % radiation that can pass through glazing
        light_transmittance: [default:0.8] % light that passes through glazing
    Returns:
        centers: list of center points to check input
        normals: list of normals to check input
        glazed_elements: list of element objects representing each surface that was inputted.
        solar_gains: hourly solar gains through the glazed element as a list
        illuminance: hourly illuminance through the glazed element as a list
        shadow: surface representing the shadow which corresponds to hour_to_visualise
"""

ghenv.Component.Name = "Hive_GlazedElement"
ghenv.Component.NickName = 'GlazedElement'
ghenv.Component.Message = 'VER 0.0.1\nMAY_30_2018'
ghenv.Component.IconDisplayMode = ghenv.Component.IconDisplayMode.application
ghenv.Component.Category = "Hive"
ghenv.Component.SubCategory = "2. Zone"
# ComponentExposure=1

import scriptcontext as sc
import rhinoscriptsyntax as rs
import Rhino as rc
import ghpythonlib.components as gh
import Grasshopper.Kernel as ghKernel
import math
import datetime

def build_glazed_element(window_name,_window_geometry,u_value,frame_factor):
    if not sc.sticky.has_key('ElementBuilder'): 
        return "Add the modular RC component to the canvas!"
    
    name = 'Glazed Element' if window_name is None else window_name

    Builder = sc.sticky['ElementBuilder'](name,u_value,frame_factor,False)
    centers,normals,glazed_elements = Builder.add_element(_window_geometry)
    
    for g in glazed_elements:
        print 'element name: ',g.name,'\n U-value:',g.u_value,'W/m2K \n area:',g.area,'m2'
    
    return centers, normals, glazed_elements


def solar_gains_through_element(window_geometry, point_in_zone, context_geometry, location, irradiation,solar_transmittance,light_transmittance, draw_shadows):
    """
    #TODO: Deal with polysurface input for shading
    #TODO: collect points and merge shadows in pyclipper for a faster shading visualisation.
    """
    if not sc.sticky.has_key('WindowRadiation'): return "Add the modular building physics component to the canvas!"
    HivePreparation = sc.sticky["HivePreparation"]()
    
    glass_solar_transmittance = 0.7 if solar_transmittance is None else solar_transmittance
    glass_light_transmittance = 0.8 if light_transmittance is None else light_transmittance
    
    Window = sc.sticky["WindowRadiation"](window_geometry=_window_geometry,
                                          point_in_zone=_point_in_zone,
                                          context_geometry=context_geometry,
                                          glass_solar_transmittance=glass_solar_transmittance,
                                          glass_light_transmittance=glass_light_transmittance
                                          )
    try:
        Sun = sc.sticky["RelativeSun"](location=location,
                          window_azimuth_rad=Window.window_azimuth_rad,
                          window_altitude_rad=Window.window_altitude_rad,
                          normal = Window.window_normal)
    except:
        print 'For solar calculations, connect Location data from the Hive_getSimulationData'
    
    # Results
    dir_irradiation = []
    diff_irradiation = []
    diff_irradiation_simple = []
    ground_ref_irradiation = []
    window_illuminance = []
    window_solar_gains = []
    
    # Diagnostic
    sun_vectors = []
    incidence_angles = []
    shadows = []
    shading_factor = []
    
    for b in range(irradiation.BranchCount):
        # Initialize results
        incidence = 0
        solar_gains_this_hour = 0
        lighting = 0
        dnirr = 0
        dhirr = 0
        dhirr_simple = 0
        grirr = 0
        sun_vector = None
        shadows_hour = [None]
        
        # read radiation data
        hoy, normal_irradiation, horizontal_irradiation, normal_illuminance, horizontal_illuminance = list(irradiation.Branch(b))
        day,month,hour = HivePreparation.hour2Date(hoy,alternate=True)
        
        # Calculate sun
        relative_sun_alt,relative_sun_az = Sun.calc_relative_sun_position(hoy)
        sun_alt,sun_az = Sun.calc_sun_position(hoy)
        
        # print sun_az, relative_sun_az
        incidence = math.acos(math.cos(math.radians(relative_sun_alt)) * math.cos(math.radians(relative_sun_az)))

        # Calculate shading
        if context_geometry == [] or not (sun_alt > 0 and abs(relative_sun_az) < 90):
            # Window is unshaded
            unshaded_area = Window.window_area
        else:
            shadow_dict = Window.calc_gross_shadows(relative_sun_alt,relative_sun_az)
            if shadow_dict is not None:
                shadows_polygons = Window.calc_shadow_polygons(shadow_dict)
                unshaded_area = Window.calc_unshaded_area(shadows_polygons)
                if draw_shadows and day%7 ==0:
                    shadows_hour = Window.draw_shadow_points(shadows_polygons)
            else:
                unshaded_area = Window.window_area
        
        dnirr, dhirr, dhirr_simple, grirr, lighting = Window.radiation(sun_alt, incidence, normal_irradiation, horizontal_irradiation, normal_illuminance, horizontal_illuminance, unshaded_area)
        
        solar_gains_this_hour = Window.glass_solar_transmittance * (dnirr + dhirr + grirr)
        lighting *= Window.glass_light_transmittance
        
        shading_factor.append(unshaded_area/Window.window_area)
        
        if sun_alt > 0 and abs(relative_sun_az) < 90:
            sun_vector = Sun.calc_sun_vector(sun_alt,sun_az)
            incidence = math.degrees(incidence)
        
        # Append results
        window_illuminance.append([lighting])
        window_solar_gains.append([solar_gains_this_hour])
        
        dir_irradiation.append(dnirr)
        diff_irradiation.append(dhirr)
        diff_irradiation_simple.append(dhirr_simple)
        sun_vectors.append(sun_vector)
        incidence_angles.append(incidence)
        ground_ref_irradiation.append(grirr)
        shadows.append(shadows_hour)
    
    solar_gains = HivePreparation.list_to_tree(window_solar_gains)
    illuminance = HivePreparation.list_to_tree(window_illuminance)
    shadows = [s[0] for s in shadows if len(s)<0 and s[0] is not None]
    shadows = HivePreparation.list_to_tree(shadows)
    
    total_solar_gains = round(sum([i[0] for i in window_solar_gains])/1000,2)
    print 'Total solar gains:', total_solar_gains,'kWh'
    sf = [sf for sf,sv in zip(shading_factor,sun_vectors) if sv is not None]
    if sf:
        print 'Mean shading factor: ', sum(sf)/len(sf)
    
    return incidence_angles, Window.window_centroid, Window.window_normal, sun_vectors, solar_gains, illuminance, dir_irradiation, diff_irradiation, diff_irradiation_simple, ground_ref_irradiation, shadows

""""""""""""""""""""""""""""""""""""""""""""""""""""""""""""""""""""""""""""""

centers, normals, glazed_elements = build_glazed_element(window_name, _window_geometry, u_value, frame_factor)
window_area = [g.area for g in glazed_elements]

if len(location) == 4 and _point_in_zone and  _window_geometry:
    incidence_angle, window_centroid, window_normal, sun_vectors, solar_gains, illuminance, dir_irradiation, diff_irradiation, diff_irradiation_simple, ground_ref_irradiation, shadow_points = solar_gains_through_element(_window_geometry, _point_in_zone, context_geometry, location, irradiation, solar_transmittance, light_transmittance, draw_shadows)
    
else:
    warning = """Warning: Insufficient inputs for solar calculations"""
    print 'location:',location
    print '_point_in_zone',_point_in_zone
    print '_window_geometry',_window_geometry
    w = ghKernel.GH_RuntimeMessageLevel.Warning
    ghenv.Component.AddRuntimeMessage(w, warning)
# ---------- end glazedelement ----------
glazedelement_2 = Hive_GlazedElement(
    window_name="window_NW",
    window_geometry=rooof_3,
    context_geometry=flatten([brep_2, move.Geometry]),
    u_value=u_value,
    point_in_zone=area_3.Centroid,
    location=getweatherdata.location,
    irradiation=getweatherdata.irradiation,
    solar_transmittance=g_value,
    draw_shadows=toggle)  # -> out, glazed_elements, solar_gains, illuminance, port, window_centroid, window_normal, window_area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; inputs context_geometry: list, point_in_zone: Point3d, location: list, irradiation: tree
# ---------- glazedelement_2: Python ----------
# Glazed element
#
# HIVE: A energy simulation plugin developed by the A/S chair at ETH Zurich
# This component is based on building_physics.py in the RC_BuildingSimulator Github repository
# https://github.com/architecture-building-systems/RC_BuildingSimulator
# Extensive documentation is available on the project wiki.
#
# Author: Justin Zarb <zarbj@student.ethz.ch>
#
# This file is part of HIVE
#
# Licensing/Copyright and liability comments go here.
# <Copyright 2018, Architecture and Building Systems - ETH Zurich>
# <Licence: MIT>

"""
Dual-purpose component which outputs an element and calculates solar gains.
-
Provided by HIVE 0.0.1
    
    Args:
        _window_geometry: a surface or polysurface representing the 
             of the element
        window_name: optional element name
        _u_value: element u-value [W/(m^2.K)]. Typical values for a single glazed window 4.8, good double-glazed window:1-1.2, triple-glazed window: 0.15.
        solar_transmittance: [default:0.7] (aka. g-factor) % radiation that can pass through glazing
        light_transmittance: [default:0.8] % light that passes through glazing
    Returns:
        centers: list of center points to check input
        normals: list of normals to check input
        glazed_elements: list of element objects representing each surface that was inputted.
        solar_gains: hourly solar gains through the glazed element as a list
        illuminance: hourly illuminance through the glazed element as a list
        shadow: surface representing the shadow which corresponds to hour_to_visualise
"""

ghenv.Component.Name = "Hive_GlazedElement"
ghenv.Component.NickName = 'GlazedElement'
ghenv.Component.Message = 'VER 0.0.1\nMAY_31_2018'
ghenv.Component.IconDisplayMode = ghenv.Component.IconDisplayMode.application
ghenv.Component.Category = "Hive"
ghenv.Component.SubCategory = "2. Zone"
# ComponentExposure=1

import scriptcontext as sc
import rhinoscriptsyntax as rs
import Rhino as rc
import ghpythonlib.components as gh
import Grasshopper.Kernel as ghKernel
import math
import datetime

def build_glazed_element(window_name,_window_geometry,u_value,frame_factor):
    if not sc.sticky.has_key('ElementBuilder'): 
        return "Add the modular RC component to the canvas!"
    
    name = 'Glazed Element' if window_name is None else window_name

    Builder = sc.sticky['ElementBuilder'](name,u_value,frame_factor,False)
    centers,normals,glazed_elements = Builder.add_element(_window_geometry)
    
    for g in glazed_elements:
        print 'element name: ',g.name,'\n U-value:',g.u_value,'W/m2K \n area:',g.area,'m2'
    
    return centers, normals, glazed_elements


def solar_gains_through_element(window_geometry, point_in_zone, context_geometry, location, irradiation,solar_transmittance,light_transmittance, draw_shadows):
    """
    #TODO: Deal with polysurface input for shading
    #TODO: collect points and merge shadows in pyclipper for a faster shading visualisation.
    """
    if not sc.sticky.has_key('WindowRadiation'): return "Add the modular building physics component to the canvas!"
    HivePreparation = sc.sticky["HivePreparation"]()
    
    glass_solar_transmittance = 0.7 if solar_transmittance is None else solar_transmittance
    glass_light_transmittance = 0.8 if light_transmittance is None else light_transmittance
    
    Window = sc.sticky["WindowRadiation"](window_geometry=_window_geometry,
                                          point_in_zone=_point_in_zone,
                                          context_geometry=context_geometry,
                                          glass_solar_transmittance=glass_solar_transmittance,
                                          glass_light_transmittance=glass_light_transmittance
                                          )
    try:
        Sun = sc.sticky["RelativeSun"](location=location,
                          window_azimuth_rad=Window.window_azimuth_rad,
                          window_altitude_rad=Window.window_altitude_rad,
                          normal = Window.window_normal)
    except:
        print 'For solar calculations, connect Location data from the Hive_getSimulationData'
    
    # Results
    dir_irradiation = []
    diff_irradiation = []
    diff_irradiation_simple = []
    ground_ref_irradiation = []
    window_illuminance = []
    window_solar_gains = []
    
    # Diagnostic
    sun_vectors = []
    incidence_angles = []
    shadows = []
    shading_factor = []
    
    for b in range(irradiation.BranchCount):
        # Initialize results
        incidence = 0
        solar_gains_this_hour = 0
        lighting = 0
        dnirr = 0
        dhirr = 0
        dhirr_simple = 0
        grirr = 0
        sun_vector = None
        shadows_hour = [None]
        
        # read radiation data
        hoy, normal_irradiation, horizontal_irradiation, normal_illuminance, horizontal_illuminance = list(irradiation.Branch(b))
        day,month,hour = HivePreparation.hour2Date(hoy,alternate=True)
        
        # Calculate sun
        relative_sun_alt,relative_sun_az = Sun.calc_relative_sun_position(hoy)
        sun_alt,sun_az = Sun.calc_sun_position(hoy)
        
        # print sun_az, relative_sun_az
        incidence = math.acos(math.cos(math.radians(relative_sun_alt)) * math.cos(math.radians(relative_sun_az)))

        # Calculate shading
        if context_geometry == [] or not (sun_alt > 0 and abs(relative_sun_az) < 90):
            # Window is unshaded
            unshaded_area = Window.window_area
        else:
            shadow_dict = Window.calc_gross_shadows(relative_sun_alt,relative_sun_az)
            if shadow_dict is not None:
                shadows_polygons = Window.calc_shadow_polygons(shadow_dict)
                unshaded_area = Window.calc_unshaded_area(shadows_polygons)
                if draw_shadows and day%7 ==0:
                    shadows_hour = Window.draw_shadow_points(shadows_polygons)
            else:
                unshaded_area = Window.window_area
        
        dnirr, dhirr, dhirr_simple, grirr, lighting = Window.radiation(sun_alt, incidence, normal_irradiation, horizontal_irradiation, normal_illuminance, horizontal_illuminance, unshaded_area)
        
        solar_gains_this_hour = Window.glass_solar_transmittance * (dnirr + dhirr + grirr)
        lighting *= Window.glass_light_transmittance
        
        shading_factor.append(unshaded_area/Window.window_area)
        
        if sun_alt > 0 and abs(relative_sun_az) < 90:
            sun_vector = Sun.calc_sun_vector(sun_alt,sun_az)
            incidence = math.degrees(incidence)
        
        # Append results
        window_illuminance.append([lighting])
        window_solar_gains.append([solar_gains_this_hour])
        dir_irradiation.append(dnirr)
        diff_irradiation.append(dhirr)
        diff_irradiation_simple.append(dhirr_simple)
        sun_vectors.append(sun_vector)
        incidence_angles.append(incidence)
        ground_ref_irradiation.append(grirr)
        shadows.append(shadows_hour)
    
    solar_gains = HivePreparation.list_to_tree(window_solar_gains)
    illuminance = HivePreparation.list_to_tree(window_illuminance)
    
    try:
        shadows = [s[0] for s in shadows if (s[0] is not None)]
    except:
        shadows = [s for s in shadows if len(s)>0]
        shadows = [s[0] for s in shadows if s[0] is not None]
    shadows = HivePreparation.list_to_tree(shadows)

    total_solar_gains = round(sum([i[0] for i in window_solar_gains])/1000,2)
    print 'Total solar gains:', total_solar_gains,'kWh'
    sf = [sf for sf,sv in zip(shading_factor,sun_vectors) if sv is not None]
    if sf:
        print 'Mean shading factor: ', sum(sf)/len(sf)
    
    return incidence_angles, Window.window_centroid, Window.window_normal, sun_vectors, solar_gains, illuminance, dir_irradiation, diff_irradiation, diff_irradiation_simple, ground_ref_irradiation, shadows

""""""""""""""""""""""""""""""""""""""""""""""""""""""""""""""""""""""""""""""

centers, normals, glazed_elements = build_glazed_element(window_name, _window_geometry, u_value, frame_factor)
window_area = [g.area for g in glazed_elements]

if len(location) == 4 and _point_in_zone and  _window_geometry:
    incidence_angle, window_centroid, window_normal, sun_vectors, solar_gains, illuminance, dir_irradiation, diff_irradiation, diff_irradiation_simple, ground_ref_irradiation, shadow_points = solar_gains_through_element(_window_geometry, _point_in_zone, context_geometry, location, irradiation, solar_transmittance, light_transmittance, draw_shadows)
    
else:
    warning = """Warning: Insufficient inputs for solar calculations"""
    print 'location:',location
    print '_point_in_zone',_point_in_zone
    print '_window_geometry',_window_geometry
    w = ghKernel.GH_RuntimeMessageLevel.Warning
    ghenv.Component.AddRuntimeMessage(w, warning)
# ---------- end glazedelement_2 ----------
opaqueelement = Hive_OpaqueElement(geometry=rooof_2, element_name="roof", u_value=Slider(0.3, range=0..0.6))  # -> out, centers, normals, elements; inputs geometry: list of Brep; plug-in component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
shading_overlap = Hive_DrawShadows(
    shade_points=glazedelement_2.shadow_points,
    window=rooof_3,
    window_normal=glazedelement_2.window_normal,
    max_edge=number_slider_2)  # -> meshes_2, color_2
shading_overlap_2 = Hive_DrawShadows(
    shade_points=glazedelement.shadow_points,
    window=rooof,
    window_normal=glazedelement.window_normal,
    max_edge=number_slider_2)  # -> meshes_2, color_2
constructzone = Hive_ConstructZone(
    elements=flatten([opaqueelement.elements, glazedelement_2.glazed_elements, glazedelement.glazed_elements]),
    volume=volume.Volume,
    floor_area=area_3.Area,
    ach_vent=Slider(0.7, range=0..1.5),
    ventilation_efficiency=Slider(0.6, range=0..1),
    max_heating_energy_per_floor_area=Slider(30, range=0..100))  # -> readMe, Zone; inputs elements: list, thermal_bridges: list; disabled
# ---------- constructzone: Python ----------
# This component creates a zone made of elements: the user is allowed 
# to override the default attributes and customize it.
#
# Hive: A energy simulation plugin developed by the A/S chair at ETH Zurich
# This component is based on building_physics.py in the RC_BuildingSimulator Github repository
# https://github.com/architecture-building-systems/RC_BuildingSimulator
# Extensive documentation is available on the project wiki.
#
# Author: Justin Zarb <zarbj@student.ethz.ch>
#
# This file is part of Hive
#
# Licensing/Copyright and liability comments go here.
# <Copyright 2018, Architecture and Building Systems - ETH Zurich>
# <Licence: MIT>

"""
construct a customized zone using elements as inputs.
Parameters left blank will be filled with default values.
-
Provided by Hive 0.0.1
    
    Args:
        glazed_elements: Element objects with additional glazing properties
        opaque_elements: Element objects
        thermal_bridges: Linear thermal bridge objects
        floor_area: [default=] The conditioned floor area within the zone
        zone_volume: [default=] Volume of the zone being simulated [m^2]
        thermal_capacitance_per_floor_area: [default=165000] Thermal capacitance of the room per 
            floor area [J/m2K]. Lightweight = 18000, medium weight = 165000, heavyweight = 360000
        lighting_load: [default=11.7] Lighting Load [W/m2] 
        lighting_control: [default=300] Lux threshold at which the lights turn on [Lx]
        lighting_utilization_factor: [default=0.45] How the light entering the window is 
            transmitted to the working plane
        lighting_maintenance_factor: [default=0.9] How dirty the window is
        ach_vent: [default= 1.5] Air changes per hour through ventilation 
        ach_infl: [default= 0.5] Air changes per hour through infiltration 
        ventilation_efficiency: [default=0] The efficiency of the heat recovery system for ventilation. Set to 0 if there is no heat 
            recovery.
        t_set_heating : [default=20] Thermal heating set point [C]
        t_set_cooling: [default=26] Thermal cooling set point [C]
        max_cooling_energy_per_floor_area: [default=12] Maximum cooling load. Set to -np.inf for unrestricted cooling [C]
        max_heating_energy_per_floor_area: [default=-12] Maximum heating load per floor area. Set to no.inf for unrestricted heating [C]
        heating_supply_system: The type of heating system. Choices are DirectHeater, ResistiveHeater, HeatPumpHeater. 
            Direct heater has no changes to the heating demand load, a resistive heater takes an efficiency into account, 
            HeatPumpHeatercalculates a COP based on the outdoor and system supply temperature 
        cooling_supply_system: The type of cooling system. Choices are DirectCooler HeatPumpCooler. 
            DirectCooler has no changes to the cooling demand load, 
            HeatPumpCooler calculates a COP based on the outdoor and system supply temperature 
        heating_emission_system: How the heat is distributed to the building
        cooling_emission_system: How the cooling energy is distributed to the building
    Returns:
        readMe!: ...
        Zone: ModularRCZone object
        Zone1_string_: a string which can be pasted into a Python script to test the Building object
        Zone2_string_: a string which can be pasted into a Python script to test the ElementBuilding object
        
"""

ghenv.Component.Name = "Hive_ConstructZone"
ghenv.Component.NickName = 'ConstructZone'
ghenv.Component.Message = 'VER 0.0.1\nMAY_30_2018'
ghenv.Component.IconDisplayMode = ghenv.Component.IconDisplayMode.application
ghenv.Component.Category = "Hive"
ghenv.Component.SubCategory = "2. Zone"
# ComponentExposure=1

import scriptcontext as sc
import Grasshopper.Kernel as gh
import Grasshopper.Kernel as ghKernel
HivePreparation = sc.sticky['HivePreparation']()
import math

""""""""""""""""""""""""""""""""""""""""""""""""""""""""""""""""""""""""
def main(elements,thermal_bridges,thermal_attributes,lighting_attributes):
    if not sc.sticky.has_key('ThermalZone'): return "Add the modular RC component to the canvas!"
    
    #Declare zone
    ThermalZone = sc.sticky['ThermalZone'](elements = elements,
                             thermal_bridges = thermal_bridges,
                             floor_area = thermal_attributes['floor_area'],
                             volume = thermal_attributes['volume'],
                             thermal_capacitance_per_floor_area=thermal_attributes['thermal_capacitance_per_floor_area'],
                             ach_vent=thermal_attributes['ach_vent'],
                             ach_infl=thermal_attributes['ach_infl'],
                             ventilation_efficiency=thermal_attributes['ventilation_efficiency'],
                             t_set_heating = thermal_attributes['t_set_heating'],
                             t_set_cooling = thermal_attributes['t_set_cooling'],
                             max_heating_energy_per_floor_area = thermal_attributes['max_heating_energy_per_floor_area'],
                             max_cooling_energy_per_floor_area = thermal_attributes['max_cooling_energy_per_floor_area'],
                             heating_supply_system=thermal_attributes['heating_supply_system'],
                             cooling_supply_system=thermal_attributes['cooling_supply_system'],
                             heating_emission_system=thermal_attributes['heating_emission_system'],
                             cooling_emission_system=thermal_attributes['cooling_emission_system'],
                             )
    ThermalZone.summary()
    
    # Zone with thermal and lighting attributes
    Zone = sc.sticky['RCModel'](zone=ThermalZone,                 
                  lighting_load=lighting_attributes['lighting_load'],
                  lighting_control=lighting_attributes['lighting_control'],
                  lighting_utilisation_factor=lighting_attributes['lighting_utilisation_factor'],
                  lighting_maintenance_factor=lighting_attributes['lighting_maintenance_factor'])
    
    return Zone

def raise_error(error_str):
    error = error_str
    e = ghKernel.GH_RuntimeMessageLevel.Error
    ghenv.Component.AddRuntimeMessage(e, error)
        
def raise_warning(warning_str):
    warning = warning_str
    w = ghKernel.GH_RuntimeMessageLevel.Warning
    ghenv.Component.AddRuntimeMessage(w, warning)

def zone_object_string(Zone,unique_inputs,thermal_attributes):
    
    room_sqrt_area = math.sqrt(Zone.floor_area)
    room_height = volume/Zone.floor_area
    
    if Zone.zone.elements is not None:
        external_envelope_area =  sum([e.area for e in Zone.zone.elements])
        wall_area = sum([e.area for e in Zone.zone.elements if e.opaque])
        u_walls = sum([e.area * e.u_value for e in Zone.zone.elements if e.opaque])/wall_area
        window_area =  sum([e.area for e in Zone.zone.elements if not e.opaque])
        if window_area >0:
            u_windows = sum([e.area * e.u_value for e in Zone.zone.elements if not e.opaque])/window_area
        else:
            u_windows = None
    classic_zone_inputs = {'room_depth':room_sqrt_area,
                           'room_width':room_sqrt_area,
                           'room_height':room_height,
                           'window_area':window_area,
                           'external_envelope_area':external_envelope_area,
                           'u_windows':u_windows,
                           'u_walls':u_walls}
    for k in unique_inputs:
        if k not in ['floor_area','thermal_bridges','elements','volume']:
            classic_zone_inputs[k] = unique_inputs[k]
    
    for t in thermal_attributes.keys():
        if 'supply' in t:
            classic_zone_inputs[t] = 'supply_system.'+str(thermal_attributes[t])[9:]
        if 'emission' in t:
            classic_zone_inputs[t] = 'emission_system.'+str(thermal_attributes[t])[9:]

    zone1 = 'Building('
    for k,v in classic_zone_inputs.iteritems():
        zone1 += k
        zone1 += '='
        zone1 += str(v)
        zone1 += ',\n'
    zone1 += ')'
    
    zone2 = 'ElementBuilding('
    for k,v in unique_inputs.iteritems():
        zone2 += k
        zone2 += '='
        zone2 += str(v)
        zone2 += ', '
    zone2 += ')'

    return zone1, zone2
    
""""""""""""""""""""""""""""""""""""""""""""""""""""""""""""""""""""""""""""""
if elements ==[] or volume is None or floor_area is None:
    raise_error('Data missing: Elements, Zone volume or floor area are not specified.')

#  Initialize default values which will be used if no input is detected
thermal_attributes = {
              "elements":None,
              "volume":None,
              "floor_area":None,
              "thermal_bridges":None,
              "thermal_capacitance_per_floor_area":165000,
              "ach_vent":1.5,
              "ach_infl":0.5,
              "ventilation_efficiency":0,
              "t_set_heating":20,
              "t_set_cooling":26,
              "max_heating_energy_per_floor_area":float('inf'),
              "max_cooling_energy_per_floor_area":-float('inf'),
              "heating_supply_system":sc.sticky["DirectHeater"],
              "cooling_supply_system":sc.sticky["DirectCooler"],
              "heating_emission_system":sc.sticky["AirConditioning"],
              "cooling_emission_system":sc.sticky["AirConditioning"]
              }
lighting_attributes = {'lighting_load':11.7,
                       'lighting_control':300.0,
                       'lighting_utilisation_factor':0.45,
                       'lighting_maintenance_factor':0.9}


# Replace default values with whatever is inputted to the component
unique_inputs = {}
for t in thermal_attributes.keys():
    if locals()[t] is not None:
        thermal_attributes[t] = locals()[t]
        # Add item to unique_inputs
        if 'supply' not in t and 'emission' not in t:
            value = locals()[t]
        elif 'supply' in t:
            value = t+': supply_system.'+str(locals()[t])[22:-2]
        elif 'emission' in t:
            value = t+': emission_system.'+str(locals()[t])[22:-2]
        unique_inputs[t] = value

# Add lighting attributes
for l in lighting_attributes.keys():
    if locals()[l] is not None:
        lighting_attributes[l] = locals()[l]
        value = l+':'+str(locals()[l])
        unique_inputs[l] = value

# Initialise thermal bridges
t = [x for x in thermal_bridges if x is sc.sticky['ThermalBridge']]
if len(t) != len(thermal_bridges):
    raise_error("Invalid thermal bridge detected")
if len(t) == 0:
    thermal_bridges = None

# Initialise elements
if any([type(e).__name__!='Element' for e in elements]):
    raise_error('Invalid Element input')

elif len(elements) != 0 and floor_area is not None and volume is not None:
    Zone = main(elements,thermal_bridges,thermal_attributes,lighting_attributes)
    Zone1_string, Zone2_string = zone_object_string(Zone,unique_inputs,thermal_attributes)
    print 'The following is a Python-friendly definition of the Zone, compatible with the RC_BuildingSimulator Github repository:'
    print Zone1_string
# ---------- end constructzone ----------
# ----
# Update userObjects and Github folder
panel_2 = Panel("C:\Users\Zghiru\Documents\GitHub\hive\HIVE_RC_simulator")
panel_3 = Panel("*")
exporthive = Hive_exportHive(components=glazedelement_2.out, targetFolder=panel_2, export=Toggle(False))  # -> readMe; inputs components: list
# ---------- exporthive: Python ----------
#
# Hive: An educational plugin developed by the A/S chair at ETH Zurich
# 
# This file is part of Hive.
# 
#TODO: Check terms of GNU modification.
#
# This component is based on the Ladybug_Export Ladybug component. It has been
# slightly modified to work without Ladybug, but it does exactly the same thing.
# 
# Ladybug is a free software registered under a GNU public license.
# 

"""
Based on Ladybug_Export Ladybug. Code Developers of Hive can use this component to export user objects and source code that they create to the Github folder on their computer.
This eases and automates the steps before commiting new components to the Github.
This component was written thanks to Giulio Piacentino a really helpful example.
-
Provided by Hive 0.0.1

    Args:
        _components: Any output from a new Ladybug (or Honeybee) component that you wish to export. Right now, only one component can be connected at a time but you can input a "*" (without quotation marsk) to search all changed Ladybug components on a grasshopper canvas.
        _targetFolder: A file path on your system which you would like to export the user object and source code to.  For most code developers, this file path will lead to their Github folder for Ladybug (or Honeybee), which is usually installed in "My Documents" by default. Exported source code will be saved at .\src and exported userObjects will be saved at .\userObjects in this _targetFolder.
        _export: Set to "True" to export Ladybug (or Honeybee) components to the _targerFolder.
    Returns:
        readMe!: ...
"""
ghenv.Component.Name = "Hive_exportHive"
ghenv.Component.NickName = 'exportHive'
ghenv.Component.Message = 'VER 0.0.1\nMAR_22_2018'
ghenv.Component.Category = "Hive"
ghenv.Component.SubCategory = "4 | Developers"


import Grasshopper.Folders as folders
import Grasshopper.Kernel as gh
import scriptcontext as sc
import shutil
import os
import uuid

UOFolder = folders.UserObjectFolders[0]
cs = gh.GH_ComponentServer()

#gh.GH_ComponentServer

exposureDict = {0 : ghenv.Component.Exposure.dropdown,
                1 : ghenv.Component.Exposure.primary,
                2 : ghenv.Component.Exposure.secondary,
                3 : ghenv.Component.Exposure.tertiary,
                4 : ghenv.Component.Exposure.quarternary,
                5 : ghenv.Component.Exposure.quinary,
                6 : ghenv.Component.Exposure.senary,
                7 : ghenv.Component.Exposure.septenary
                }



def exportToUserObject(component, targetFolder, hive_preparation):
    targetFolder = os.path.join(targetFolder, "userObjects")
    if not os.path.isdir(targetFolder): os.mkdir(targetFolder)
    
    def isNewerVersion(currentUO, component):
        # check if the component has a newer version than the current userObjects
        # version of the connected component
        if component.Message == None: return True
        if len(component.Message.split("\n"))<2: return True

        ghVersion, ghDate = component.Message.split("\n")
        ghCompVersion = map(int, ghVersion.split("VER ")[1].split("."))
        month, day, ghYear  = ghDate.split("_")
        # print version, date
        month = hive_preparation.monthList.index(month.upper()) + 1
        ghCompDate = int(hive_preparation.getJD(month, day))
        
        # in case there was no date for the userobject
        # the file will be considered older and will be overwrittern
        ghComponent = currentUO.InstantiateObject()
        # this is not the best way but works for now!
        # should be a better way to compute the component and get the message
        componentCode = ghComponent.Code.split("\n")
        
        UODate = ghCompDate - 1
        # version of the file
        for lineCount, line in enumerate(componentCode):
            if lineCount > 200: break
            if line.strip().startswith("ghenv.Component.Message"):
                print line
                # print line.split("=")[1].strip().split("\n")
                version, date = line.split("=")[1].strip().split("\\n")
                
                # in case the file doesn't have an standard Ladybug message let it be updated
                try: UOVersion = map(int, version.split("VER ")[1].split("."))
                except: return True
                month, day, UOYear  = date.split("_")
                
                # should find the reason and fix it later
                if month == "SEPT": month = "SEP"
                
                month = hive_preparation.monthList.index(month.upper()) + 1
                UODate = int(hive_preparation.getJD(month, day))
                break
        
        # check if the version of the code is newer
        try:
            if int(ghYear.strip()) > int(UOYear[:-1].strip()):
                    return True
            elif ghCompDate > UODate:
                return True
            elif ghCompDate == UODate:
                for ghVer, UOVer in zip(UOVersion, UOVersion):
                    if ghVer < UOVer: return False
                return True
            else:
                print "\nThere is a newer userObject in Grasshopper folder that will be copied: " + currentUO.Path + "." + \
                      "\nUserObject version is: " +  version + " " + date + \
                      "\nThe component version is: "  +  ghVersion + " " + ghDate + ".\n"
                
                return False
        except:
            return True

    if component.Name.find("Hive")>=0:
        # check if the userObject is already existed in the folder
        try:
            filePath = os.path.join(UOFolder, component.Name + ".ghuser")
            currentUO = gh.GH_UserObject(filePath)
        except:
            # the userobject is not there so just create it
            currentUO = None
    
        if currentUO!=None:
            print isNewerVersion(currentUO,component)
            # if is newer remove
            if isNewerVersion(currentUO, component):
                # it has a newer version so let's remove the old one and creat a new userobject
                
                if not component.Category == "Maths":
                    removeNicely = cs.RemoveCachedObject(filePath)
                    if not removeNicely: os.remove(filePath)
            else:
                # there is already a newer version so just copy that to the folder instead
                # and return
                dstFullPath = os.path.join(targetFolder, component.Name + ".ghuser")
                shutil.copy2(filePath, dstFullPath)
                return
    
        # create the new userObject in Grasshopper folder
        uo = gh.GH_UserObject()
        uo.Icon = component.Icon_24x24
        
    
        try:
            uo.Exposure = exposureDict[int(component.Code.split('ComponentExposure=')[1].split('\n')[0])]
        except:
            uo.Exposure = exposureDict[int(1)]
        
        uo.BaseGuid = component.ComponentGuid
        uo.Description.Name = component.Name
        uo.Description.Description = component.Description
        
        # if user hasn't identified the category then put it into honeybee as an unknown!
        if component.Category == "Maths":
            uo.Description.Category = "Hive"
        else:
            uo.Description.Category = component.Category
            
        if component.SubCategory == "Script":
            uo.Description.SubCategory = "UnknownHiveComponents"
        else:
            uo.Description.SubCategory = component.SubCategory
        
        uo.CreateDefaultPath(True)
        uo.SetDataFromObject(component)
        uo.SaveToFile()
        
        # copy the component over
        dstFullPath = os.path.join(targetFolder, component.Name + ".ghuser")
        shutil.copy2(filePath, dstFullPath)
        
        gh.GH_ComponentServer.UpdateRibbonUI()
        
        print "UserObject successfully added to: "

def exportToFile(component, targetFolder, hive_preparation):
    
    targetFolder = os.path.join(targetFolder, "src")
    if not os.path.isdir(targetFolder): os.mkdir(targetFolder)
    
    def isNewerVersion(componentCode, fileName):
        # check if the component has a newer version of source code
        # version of the connected component
        if component.Message == None: return True
        if len(component.Message.split("\n"))<2: return True
        
        ghVersion, ghDate = component.Message.split("\n")
        ghCompVersion = map(int, ghVersion.split("VER ")[1].split("."))
        month, day, ghYear  = ghDate.split("_")
        # print version, date
        month = hive_preparation.monthList.index(month.upper()) + 1
        ghCompDate = int(hive_preparation.getJD(month, day))
        
        # in case there was no date in the file
        # the file will be considered older and will be overwrittern
        # 
        pyFileDate = ghCompDate - 1
        
        # version of the file
        with open(os.path.join(targetFolder,fileName), "r") as pyFile:
            for lineCount, line in enumerate(pyFile):
                if lineCount > 200: break
                if line.strip().startswith("ghenv.Component.Message"):
                    # print line
                    # print line.split("=")[1].strip().split("\n")
                    version, date = line.split("=")[1].strip().split("\\n")
                    try:
                        pyFileVersion = map(int, version.split("VER ")[1].split("."))
                    except:
                        # in case the file doesn't have an standard Ladybug message
                        return True
                    month, day, pyYear  = date.split("_")
                    month = hive_preparation.monthList.index(month.upper()) + 1
                    pyFileDate = int(hive_preparation.getJD(month, day))
                    break
        
        # check if the version of the code is newer
        try:
            if int(ghYear.strip()) > int(pyYear[:-1].strip()):
                    return True
            elif ghCompDate > pyFileDate:
                return True
            elif ghCompDate == pyFileDate:
                for ghVer, pyVer in zip(ghVersion, pyFileVersion):
                    if ghVer < pyVer: return False
                return True
            else:
                print "\nThere is already a newer version in the folder for: " + fileName + "." + \
                      "\nCurrent file version is: " +  version + " " + date + \
                      "\nThe component version is: "  +  ghVersion + " " + ghDate + ".\n"
                
                return False
        except:
            print "Failed to check version for %s"%fileName
            with open("c:\\ladybug\\failed.txt", "w") as ff:
                ff.write(fileName)
            return True
    
    if component.Name.find("Hive")>=0:
        
        fileName = component.Name + ".py"
        
        # code inside the component
        code = component.Code
        
        # check if the file already exist
        if os.path.isfile(os.path.join(targetFolder, fileName)):
            if not isNewerVersion(code, fileName):
                return False
                
        with open(os.path.join(targetFolder, fileName), "w") as pyoutf:
            if isinstance(code, unicode):
                code = code.encode('ascii','ignore').replace("\r", "")
            pyoutf.write(code)
        
        print "Exported " + fileName + " to: " + os.path.join(targetFolder, fileName)
        return True

def getAllTheComponents(onlyGHPython = True):
    components = []
    
    document = ghenv.Component.OnPingDocument()
    
    for component in document.Objects:
        if onlyGHPython and type(component)!= type(ghenv.Component):
            pass
        else:
            components.append(component)
    
    return components

def getListOfConnectedComponents(componentInputParamIndex = 0, onlyGHPython = True):
    # this function is edited version of Guilio's code from here:
    # [github link]
    components = []
    
    param = ghenv.Component.Params.Input[componentInputParamIndex]
    sources = param.Sources
    if sources.Count == 0: return components
    
    for source in sources:
        attr = source.Attributes
        if (attr is None) or (attr.GetTopLevel is None):
            pass
        else:
            component = attr.GetTopLevel.DocObject
    
    if component == None or (onlyGHPython and type(component) != type(ghenv.Component)):
            #collect only python components
            pass
    else:
        components.append(component)
    
    return components

def main(components, targetFolder):
    if not sc.sticky.has_key('RCModel'): return "Add the modular building physics component to the canvas!"
    hive_preparation = sc.sticky["HivePreparation"]()
    
    if not os.path.isdir(targetFolder): os.mkdir(targetFolder)
        
    if str(components[0]) == "*":
        ghComps = getAllTheComponents()
    else:
        ghComps = getListOfConnectedComponents()
    
    if len(ghComps)== 0: return "Found 0 components!"
    
    for ghComp in ghComps:
        fileExported = exportToFile(ghComp, targetFolder, hive_preparation)
        if fileExported:
            exportToUserObject(ghComp, targetFolder, hive_preparation)

if _export and len(_components)!=0 and _targetFolder!=None:
    msg = main(_components, _targetFolder)
    ghenv.Component.AddRuntimeMessage(gh.GH_RuntimeMessageLevel.Warning, msg)
else:
    print "At the minimum one of the components are missing!"
# ---------- end exporthive ----------

# ---- group: Hacky grasshopper way to read schedule from csv
# Internal Gains
occupancy_schedules_csv = Panel("C:\Users\Zghiru\Documents\GitHub\hive\HIVE_RC_simulator\auxiliary\occupancy_schedules.csv")
internalgains = Hive_internalGains(Zone=constructzone.Zone, max_occupancy="3", load_pattern=occupancy_schedules_csv)  # -> readMe, occupancy_profile, internal_gains
#   port occupancy_profile: occupancy profile (people per hour)
# ---------- internalgains: Python ----------
# Generate occupancy and internal gains profiles. A constant value or a profile loaded from csv may be used.
#
# Hive: A energy simulation plugin developed by the A/S chair at ETH Zurich
# The occupancy profile
# Extensive documentation is available on the project wiki.
#
# Author: Justin Zarb <zarbj@student.ethz.ch>
#
# This file is part of Hive
#
# Licensing/Copyright and liability comments go here.
# <Copyright 2018, Architecture and Building Systems - ETH Zurich>
# <Licence: MIT>

"""
Create a customized zone using elements as inputs.
Parameters left blank will be filled with default values.
-
Provided by Hive 0.0.1
    
    Args:
        Zone: plug in the Zone component (floor area is extracted from here)
        simulation_period: default=[0,8760] connect this to the ReadMe! outpt of the getWeatherData component, or input a string with the starting HOY and ending HOY. 
        max_occupancy: default=1 person. the maximum number of people expected to occupy the zone.
        appliance_gains: default=14W/m2.
        gains_per_person: default=100W.
        load_pattern: add a file path to occupancy_schedules.csv, which is available in the auxiliary folder (the file is based on Swiss statistical data from the CEA Toolbox).
        building_type: default=OFFICE. Works with occupancy_schedules.csv. Possible profiles are 1:MULTI_RES, 2:SINGLE_RES, 3:HOTEL, 4:OFFICE, 5:RETAIL, 6:FOODSTORE, 7:RESTAURANT, 8:INDUSTRIAL, 9:SCHOOL, 10:HOSPITAL, 11:GYM
        define_pattern: Input a list of values between 0 and 1 indicating the % occupied. The list must be the same length as the simulation period.
        
    Returns:
        readMe!: ...
        occupancy: occupancy profile (people/h)
        internal_gains: internal gains profile (Wh/h)
"""

ghenv.Component.Name = "Hive_internalGains"
ghenv.Component.NickName = 'internalGains'
ghenv.Component.Message = 'VER 0.0.1\nMAY_29_2018'
ghenv.Component.IconDisplayMode = ghenv.Component.IconDisplayMode.application
ghenv.Component.Category = "Hive"
ghenv.Component.SubCategory = "1. Environment"
# ComponentExposure=1


import scriptcontext as sc
import rhinoscriptsyntax as rs
import re
import Grasshopper.Kernel as ghKernel

def read_csv(path,col,simulation_period):
    f = open(path, 'r')
    occupancy_m2 = []
    for line in f.readlines():
        values = line.strip().split(',')
        try:
            occupancy_m2.append(values[col])
        except:
            raise_error('The index submitted in building_type does not correspond to any column in the csv.')
    return occupancy_m2[0],occupancy_m2[simulation_period[0]:simulation_period[-1]+1]
    f.close()

def raise_warning(warning_str):
    warning = warning_str
    w = ghKernel.GH_RuntimeMessageLevel.Warning
    ghenv.Component.AddRuntimeMessage(w, warning)

def raise_error(error_str):
    error = error_str
    e = ghKernel.GH_RuntimeMessageLevel.Error
    ghenv.Component.AddRuntimeMessage(e, error)

def main(Zone,max_occupancy,appliance_gains,gains_per_person,load_pattern,building_type,define_pattern):
    if not sc.sticky.has_key('HivePreparation'): 
        raise_warning("Add HIVE to the canvas!")
        return -1
    HivePreparation = sc.sticky['HivePreparation']()
    
    try:
        floor_area = float(Zone.floor_area)
    except:
        raise_error('Add a valid zone')
    
    max_occupancy = 1 if max_occupancy is None else max_occupancy
    appliance_gains = 14 if appliance_gains is None else appliance_gains
    gains_per_person = 100 if gains_per_person is None else gains_per_person
    
    # Use stickys to get simulation period from getWeatherData component
    simulation_period = sc.sticky['simulation_period']
    simulation_period = [int(i) for i in re.findall(r'\d+',simulation_period)]
    
    if load_pattern:
        path = r'%s'%load_pattern
        building_type = 3 if building_type is None else int(building_type)
        profile_type, occupancy_profile = read_csv(path,building_type,simulation_period)
    
    if define_pattern:
        if any([x<0 or x>1 for x in define_pattern]):
            raise_warning('values in custom pattern must be between 0 and 1')
            occupancy_profile = define_pattern
            profile_type = 'user defined pattern'
        if len(define_pattern) != range(simulation_period):
            raise_error('Custom pattern does not match the length of the simulation period.')
    
    # Calculate occupancy profile and internal gains
    if 'occupancy_profile' in locals():
        occupancy = [float(p)*max_occupancy for p in occupancy_profile]
        occupancy_tree = HivePreparation.list_to_tree([[o] for o in occupancy_profile])
        
        internal_gains = [x*gains_per_person + floor_area * appliance_gains for x in occupancy]
        internal_gains_tree = HivePreparation.list_to_tree([[ig] for ig in internal_gains])
        
        print 'profile with %i values'%len(occupancy)
        print
        print 'Occupancy pattern: ',profile_type
        print 'occupancy = occupancy_pattern * %i people'%max_occupancy
        print 'internal gains = occupant gains + appliance gains'
        print 'occupant gains = 100W * occupancy_pattern'
        print 'appliance gains = 14W * %fm2'%floor_area
        
        return occupancy_tree, internal_gains_tree

    else:
        raise_warning('Occupancy pattern is missing')
        return -1


""""""""""""""""""""""""""""""""""""""""""""""""""""""""""""""""""""""""

result = main(Zone, max_occupancy, appliance_gains, gains_per_person, load_pattern, building_type,define_pattern)

if result != -1:
    occupancy_profile, internal_gains = result
# ---------- end internalgains ----------

# ----
preview_3 = CustomPreview(Geometry=shading_overlap_2.meshes_2, Shader=shading_overlap_2.color_2)
preview_4 = CustomPreview(Geometry=shading_overlap.meshes_2, Shader=shading_overlap.color_2)
simulatemultipletimesteps = Hive_simulateMultipleTimeSteps(
    Zone=simplify(constructzone.Zone),
    outdoor_air_temperature=simplify(getweatherdata.temperature),
    solar_gains=simplify([glazedelement.solar_gains, glazedelement_2.solar_gains]),
    illuminance=simplify([glazedelement_2.illuminance, glazedelement.illuminance]),
    occupancy=simplify(internalgains.occupancy_profile),
    internal_gains=simplify(internalgains.internal_gains))  # -> out, zone_variables, port, indoor_air_temperature, operative_temperature, mass_temperature, lighting_demand, heating_demand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; inputs outdoor_air_temperature: tree, solar_gains: tree, illuminance: tree, occupancy: tree, internal_gains: tree
# ---------- simulatemultipletimesteps: Python ----------
# This component can be used to simulate indoor temperature, heating, cooling and lighting demand for a series of hourly time steps.
#
# Hive: A energy simulation plugin developed by the A/S chair at ETH Zurich
# This component is adapted from examples\annualSimulation.py in the RC_BuildingSimulator Github repository
# https://github.com/architecture-building-systems/RC_BuildingSimulator
# Extensive documentation about the model is available on the project wiki.
#
# Author: Justin Zarb <zarbj@student.ethz.ch>
#
# This file is part of Hive
#
# Licensing/Copyright and liability comments go here.
# <Copyright 2018, Architecture and Building Systems - ETH Zurich>
# <Licence: MIT>

"""
Use this component to simulate indoor temperature, heating, cooling and lighting for a series of hourly time steps. You may add a custom zone or leave the Zone arg blank for the default zone.
-
Provided by Hive 0.0.1
    
    Args:
        Zone: Input a customized Zone from the Zone component.
        outdoor_air_temperature: Tree where each branch contains a HOY and the corresponding outdoor air temperatures
        previous_mass_temperature: The temperature of the mass node during the hour prior to the first time step. This temperature represents the average temperature of the building envelope itself.
        internal_gains: List of hourly internal heat gains [Watts].
        solar_irradiation: List of solar irradiation gains [Watts].
        illuminance: Illuminance after transmitting through the window [Lumens]
        occupancy: Occupancy for the timestep [people/hour/square_meter]
    Returns:
        readMe!: Currently shows the list lengths of all the inputs for quick debugging.
        indoor_air_temperature: Profile of the indoor air temperature.
        lighting_demand: Profile of the lighting energy demand.
        heating_demand: Profile of the heating energy demand required to maintain the heating setpoint temperature defined in the Zone.
        cooling_demand: Profile of the cooling energy demand required to maintain the cooling setpoint temperature defined in the Zone.
        energy_demand: Sum of heating, cooling and lighting demand profiles for the given timestep.
        solar_gains: Estimated solar gains, calculated by multiplying the irradiation by a transmission factor.
        ill: hourly illuminance levels
        energy_pie: plug this into the Grasshopper Pie Chart component to visualise the energy distribution.
        comfort_pie: not really comfort, but shows the number of hours that indoor air temperatures are within the heating and cooling setpoint temperatures
"""

ghenv.Component.Name = "Hive_simulateMultipleTimeSteps"
ghenv.Component.NickName = 'simulateMultipleTimeSteps'
ghenv.Component.Message = 'VER 0.0.1\nMAY_29_2018'
ghenv.Component.IconDisplayMode = ghenv.Component.IconDisplayMode.application
ghenv.Component.Category = "Hive"
ghenv.Component.SubCategory = "3. Simulate"
# ComponentExposure=2


import Grasshopper.Kernel as ghKernel
import scriptcontext as sc

def main(Zone, outdoor_air_temperature, previous_mass_temperature, internal_gains, solar_gains, occupancy, illuminance):
    if not sc.sticky.has_key('RCModel'): return "Add the modular RC component to the canvas!"
    HivePreparation = sc.sticky['HivePreparation']()
    
    # Initialise previous mass temperature if it hasn't been specified
    t_m_prev = initial_mass_temperature if initial_mass_temperature is not None else 20.0
    
    #Initialise result lists
    indoor_air_temperature = []
    operative_temperature = []
    mass_temperature = []
    energy_demand = []
    heating_demand = []
    cooling_demand = []
    lighting_demand = []

    #Start simulation
    for b in range(outdoor_air_temperature.BranchCount):
        hour, ta = outdoor_air_temperature.Branch(b)
        oc = occupancy[b] if occupancy else 0
        ig = internal_gains[b] if internal_gains else 0
        sg = solar_gains[b] if solar_gains else 0
        il = illuminance[b] if illuminance else 0
        
        try:
            Zone.solve_building_energy(ig, sg, ta, t_m_prev)
            Zone.solve_building_lighting(il, oc)
        except:
            print 'building energy could not be solved for the following inputs'
            print 'outdoor air temperature: ', ta
            print 'previous mass temperature: ', previous_mass_temperature
            print 'internal gains: ', ig
            print 'solar gains: ', sg
            print 'illuminance: ',il
            print 'occupancy: ',oc
            Zone.solve_building_energy(ig, sg, ta, previous_mass_temperature) 
            break
        
        #Set T_m as t_m_prev for next timestep
        t_m_prev = Zone.t_m_next
        
        #Record Results
        indoor_air_temperature.append([Zone.t_air])
        operative_temperature.append([Zone.t_operative])
        mass_temperature.append([Zone.t_m]) 
        lighting_demand.append([Zone.lighting_demand])  
        energy_demand.append([abs(Zone.energy_demand)]) 
        heating_demand.append([Zone.heating_demand])
        cooling_demand.append([Zone.cooling_demand])
    
    
    print 'Heating demand: %f kWh/m2'%(sum([l[0] for l in heating_demand])/(1000*Zone.floor_area))
    print 'Cooling demand: %f kWh/m2'%(sum([l[0] for l in cooling_demand])/(1000*Zone.floor_area))
    print 'Lighting demand: %f kWh/m2'%(sum([l[0] for l in lighting_demand])/(1000*Zone.floor_area))
    print 'Total energy demand: %f kWh/m2'%(sum([l[0] for l in energy_demand])/(1000*Zone.floor_area))
    if solar_gains: 
        print 'Solar gains: %f kWh/m2'%(sum(solar_gains)/(1000*Zone.floor_area))
    if internal_gains:
        print 'Internal gains: %f kWh/m2'%(sum(internal_gains)/(1000*Zone.floor_area))
    
    if len(indoor_air_temperature)>0:
        energy_pie = energy_pie_chart(heating_demand,cooling_demand,lighting_demand)
        comfort_pie = comfort_pie_chart(Zone, indoor_air_temperature)
    else:
        energy_pie = None
        comfort_pie = None
    
    return HivePreparation.list_to_tree(indoor_air_temperature), \
    HivePreparation.list_to_tree(operative_temperature), \
    HivePreparation.list_to_tree(mass_temperature), \
    HivePreparation.list_to_tree(lighting_demand), \
    HivePreparation.list_to_tree(energy_demand), \
    HivePreparation.list_to_tree(heating_demand), \
    HivePreparation.list_to_tree(cooling_demand),energy_pie, comfort_pie

def raise_error(error_str):
    error = error_str
    e = ghKernel.GH_RuntimeMessageLevel.Error
    ghenv.Component.AddRuntimeMessage(e, error)

def raise_warning(warning_str):
    warning = warning_str
    w = ghKernel.GH_RuntimeMessageLevel.Warning
    ghenv.Component.AddRuntimeMessage(w, warning)

def check_input_tree(input_tree,input_tree_name):
    if input_tree.BranchCount>1 or (input_tree.BranchCount==1 and input_tree.Branch(0)!=None):
        total_per_hour = []
        for b in range(0,input_tree.BranchCount):
            total_per_hour.append(sum(input_tree.Branch(b)))
        return total_per_hour
    else:
        raise_warning('No data for %s'%input_tree_name)
        return False

def energy_pie_chart(heating_demand,cooling_demand,lighting_demand):
    heating = round(sum([h[0] for h in heating_demand]),2)
    cooling = round(-sum([c[0] for c in cooling_demand]),2)
    lighting = round(sum([l[0] for l in lighting_demand]),2)
    
    value = [heating,cooling,lighting]
    lengths = [len(str(int(v))) for v in value if v>0]
    ratio = [round(v / 10**(min(lengths)-2)) for v in value]
    
    
    energy_pie = ['Heating demand \n %fkWh'%(heating/1000.)]*int(ratio[0]) + \
        ['Cooling demand \n %fkWh'%(cooling/1000.)]*int(ratio[1]) + \
        ['lighting demand \n %fkWh'%(lighting/1000.)]*int(ratio[2])
    
    return energy_pie

def comfort_pie_chart(Zone, temperature):
    """A very crude comfort assessment... just looking at the temperature setpoints"""
    hot = sum([round(t[0])>Zone.t_set_cooling for t in temperature])
    cold = sum([round(t[0])<Zone.t_set_heating for t in temperature])
    comfy = sum([Zone.t_set_heating <= round(t[0]) <= Zone.t_set_cooling for t in temperature])
    
    value = [hot,cold,comfy]
    
    lengths = [len(str(int(v))) for v in value if v>0]
    ratio = [round(v / 10**(min(lengths)-2)) for v in value]
    
    comfort_pie = ['Above Cooling Setpoint \n %ih'%hot]*int(ratio[0]) + \
        ['Below Heating Setpoint \n %ih'%cold]*int(ratio[1]) + \
        ['Within Set Comfort Zone \n %ih'%comfy]*int(ratio[2])
    
    return comfort_pie
""""""""""""""""""""""""""""""""""""""""""""""""""""""""""""""""""""""""""""""

# Check input for outdoor air temperature
if outdoor_air_temperature.BranchCount==0:
    raise_warning('No data for outdoor_air_temperature')

# Check input and add all data streams
sg_list = check_input_tree(solar_gains,'solar_gains')
ill_list = check_input_tree(illuminance,'illuminance')
ig_list = check_input_tree(internal_gains,'internal_gains')
occ_list = check_input_tree(occupancy,'occupancy')

if Zone:
    indoor_air_temperature, operative_temperature, mass_temperature, \
    lighting_demand, energy_demand, heating_demand, cooling_demand, energy_pie, \
    comfort_pie = main(Zone, outdoor_air_temperature, initial_mass_temperature, \
    ig_list, sg_list, occ_list, ill_list)
    attrs = vars(Zone)
    zone_variables = ["%s: %s" % item for item in attrs.items()]
    #zone_variables = '\n'.join("%s: %s" % item for item in attrs.items())
else:
    print 'Connect all inputs to run simulation'
# ---------- end simulatemultipletimesteps ----------
pie = PieChart(simulatemultipletimesteps.energy_pie)
# Total Energy: Design Process
downsample = Hive_Downsample(hourly_data=simulatemultipletimesteps.energy_demand)  # -> Readme, daily_values, monthly_values, annual_value; inputs hourly_data: tree, resample_type: Int32
#   port resample_type: 0:sum (default) or 1:mean
# ---------- downsample: Python ----------
# Downsample data
#
# HIVE: A energy simulation plugin developed by the A/S chair at ETH Zurich
# This component is based on building_physics.py in the RC_BuildingSimulator Github repository
# https://github.com/architecture-building-systems/RC_BuildingSimulator
# Extensive documentation is available on the project wiki.
#
# Author: Justin Zarb <zarbj@student.ethz.ch>
#
# This file is part of HIVE
#
# Licensing/Copyright and liability comments go here.
# <Copyright 2018, Architecture and Building Systems - ETH Zurich>
# <Licence: MIT>

"""
Convert hourly values to daily,monthly or annual results.
-
Provided by HIVE 0.0.1
    
    Args:
        _hourly_data: a list of hourly values
        _start_hoy: the hour of the year corresponding to the first value.
        resample_type: [0:sum, 1:mean] (default=0)
    Returns:
        readMe!:...
        daily_values:
        monthly_values:
        annual_value:
"""

ghenv.Component.Name = "Hive_Downsample"
ghenv.Component.NickName = 'Downsample'
ghenv.Component.Message = 'VER 0.0.1\nMAY_30_2018'
ghenv.Component.IconDisplayMode = ghenv.Component.IconDisplayMode.application
ghenv.Component.Category = "Hive"
ghenv.Component.SubCategory = "4. Results"
# ComponentExposure=1

import scriptcontext as sc
import Grasshopper.Kernel as ghKernel

def main(_start_hoy, hourly_data, resample_type):
    if not sc.sticky.has_key('HivePreparation'): 
        return "Add the modular RC component to the canvas!"
    hive_preparation = sc.sticky['HivePreparation']()
    
    def resample(dict,resample_type):
        if resample_type == 0:
            for key in dict:
                dict[key] = sum(dict[key])
        if resample_type == 1:
            for key in dict:
                dict[key] = sum(dict[key])/len(dict)
        return dict.values()
    
    hoys = range(int(_start_hoy),int(_start_hoy+len(hourly_data[0])))
    doys = [(h-1)//24 for h in hoys]
    moys = [hive_preparation.hour2Date(hoy,True)[1] for hoy in hoys]
    
    daily_streams = []
    monthly_streams = []
    annual = []
    
    for stream in hourly_data:
        daily = dict(zip(range(0,365),[list()]*365))
        monthly = dict(zip(range(0,11),[list()]*11))
        day_last_hour = 0
        values_this_day = []
        month_last_hour = 0
        values_this_month = []
        
        for value,doy,moy in zip(hourly_data[stream],doys,moys):
            # Split values into days
            if doy == day_last_hour:
                values_this_day.append(value)
            else:
                daily[day_last_hour] = values_this_day
                values_this_day = []
                day_last_hour = doy
            daily[day_last_hour] = values_this_day
            
            # Split values into months
            if moy == month_last_hour:
                values_this_month.append(value)
            else:
                monthly[month_last_hour] = values_this_month
                values_this_month = []
                month_last_hour = moy
            monthly[month_last_hour] = values_this_month
        
        daily_streams.append(resample(daily,resample_type))
        monthly_streams.append(resample(monthly,resample_type))
        
        if resample_type == 0:
            annual.append([sum(hourly_data[stream])])
        if resample_type == 1:
            annual.append([sum(hourly_data[stream])/len(hourly_data[stream])])
    
    dailyTree = hive_preparation.list_to_tree(daily_streams)
    monthlyTree = hive_preparation.list_to_tree(monthly_streams)
    annualTree = hive_preparation.list_to_tree(annual)
    
    return dailyTree, monthlyTree, annualTree

""""""""""""""""""""""""""""""""""""""""""""""""""""""""""""""""""""""""""""""

resample_type_ = 0 if resample_type_ is None else resample_type_

#convert _hourly_data into a dictionary.
if _hourly_data.BranchCount > 0 :
    hourly_data = {}
    for stream in range(0,len(_hourly_data.Branch(0))):
        hourly_data[stream] = []
        for b in range(0,_hourly_data.BranchCount):
            hourly_data[stream].append(_hourly_data.Branch(b)[stream])
    if not _start_HOY:
        print """Start_HOY assumed to be 0: If this is not the case, add a 
        value to _start_HOY!"""
        _start_HOY = 1
    daily_values, monthly_values, annual_value = main(_start_HOY,hourly_data,resample_type_)
    print '%i data streams resampled'%len(_hourly_data.Branch(0))


else:
    print 'Connect a data stream to _hourly_data'
# ---------- end downsample ----------
radiationanalysis = Ladybug_RadiationAnalysis(
    geometry=flatten(rooof_3),
    gridSize=".2",
    disFromBase="0.1",
    selectedSkyMtx=flatten(selectskymtx.selectedSkyMtx),
    runIt=Toggle(True))  # -> readMe, contextMesh, analysisMesh, testPts, testVec, port, radiationResult, radiationMesh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; plug-in component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
pie_2 = PieChart(simulatemultipletimesteps.comfort_pie)
rec = DataRecorder(downsample.annual_value, DataLimit=-10, RecordData=True)
graph = QuickGraph(rec)

item_2 = ListItem(List=getweatherdata.temperature, Index=1, Wrap=True)
downsample_2 = Hive_Downsample(hourly_data=[glazedelement_2.illuminance, glazedelement.illuminance], start_HOY=number_slider)  # -> Readme, daily_values, monthly_values, annual_value; inputs hourly_data: tree, resample_type: Int32
#   port resample_type: 0:sum (default) or 1:mean
# ---------- downsample_2: Python ----------
# Downsample data
#
# HIVE: A energy simulation plugin developed by the A/S chair at ETH Zurich
# This component is based on building_physics.py in the RC_BuildingSimulator Github repository
# https://github.com/architecture-building-systems/RC_BuildingSimulator
# Extensive documentation is available on the project wiki.
#
# Author: Justin Zarb <zarbj@student.ethz.ch>
#
# This file is part of HIVE
#
# Licensing/Copyright and liability comments go here.
# <Copyright 2018, Architecture and Building Systems - ETH Zurich>
# <Licence: MIT>

"""
Define an opaque by adding a surface.
-
Provided by HIVE 0.0.1
    
    Args:
        _hourly_data: a list of hourly values
        _start_hoy: the hour of the year corresponding to the first value.
        resample_type: [0:sum, 1:mean] (default=0)
    Returns:
        readMe!:...
        daily_values:
        monthly_values:
        annual_value:
"""

ghenv.Component.Name = "Hive_Downsample"
ghenv.Component.NickName = 'Downsample'
ghenv.Component.Message = 'VER 0.0.1\nMAY_16_2018'
ghenv.Component.IconDisplayMode = ghenv.Component.IconDisplayMode.application
ghenv.Component.Category = "Hive"
ghenv.Component.SubCategory = "3 | Results"
# ComponentExposure=1

import scriptcontext as sc

def main(_start_hoy, hourly_data, resample_type):
    if not sc.sticky.has_key('HivePreparation'): 
        return "Add the modular RC component to the canvas!"
    hive_preparation = sc.sticky['HivePreparation']()
    
    def resample(dict,resample_type):
        if resample_type == 0:
            for key in dict:
                dict[key] = sum(dict[key])
        if resample_type == 1:
            for key in dict:
                dict[key] = sum(dict[key])/len(dict[key])
        return dict.values()
    
    hoys = range(int(_start_hoy),int(_start_hoy+len(hourly_data[0])))
    doys = [(h-1)//24 for h in hoys]
    moys = [hive_preparation.hour2Date(hoy,True)[1] for hoy in hoys]
    
    daily_streams = []
    monthly_streams = []
    annual = []
    
    for stream in hourly_data:
        daily = dict(zip(range(0,365),[list()]*365))
        monthly = dict(zip(range(0,11),[list()]*11))
        day_last_hour = 0
        values_this_day = []
        month_last_hour = 0
        values_this_month = []
        
        for value,doy,moy in zip(hourly_data[stream],doys,moys):
            # Split values into days
            if doy == day_last_hour:
                values_this_day.append(value)
            else:
                daily[day_last_hour] = values_this_day
                values_this_day = []
                day_last_hour = doy
            daily[day_last_hour] = values_this_day
            
            # Split values into months
            if moy == month_last_hour:
                values_this_month.append(value)
            else:
                monthly[month_last_hour] = values_this_month
                values_this_month = []
                month_last_hour = moy
            monthly[month_last_hour] = values_this_month
        
        daily_streams.append(resample(daily,resample_type))
        monthly_streams.append(resample(monthly,resample_type))
        
        if resample_type == 0:
            annual.append([sum(hourly_data[stream])])
        if resample_type == 1:
            annual.append([sum(hourly_data[stream])/len(hourly_data[stream])])
    
    dailyTree = hive_preparation.list_to_tree(daily_streams)
    monthlyTree = hive_preparation.list_to_tree(monthly_streams)
    annualTree = hive_preparation.list_to_tree(annual)
    
    return dailyTree, monthlyTree, annualTree

""""""""""""""""""""""""""""""""""""""""""""""""""""""""""""""""""""""""""""""

resample_type_ = 0 if resample_type_ is None else resample_type_

#convert _hourly_data into a dictionary.
if _hourly_data.BranchCount > 0 :
    hourly_data = {}
    for stream in range(0,len(_hourly_data.Branch(0))):
        hourly_data[stream] = []
        for b in range(0,_hourly_data.BranchCount):
            hourly_data[stream].append(_hourly_data.Branch(b)[stream])
    if _start_HOY:
        daily_values, monthly_values, annual_value = main(_start_HOY,hourly_data,resample_type_)
        print '%i data streams resampled'%len(_hourly_data.Branch(0))
    else:
        warning = """Warning: Add a value to _start_HOY!"""
        w = ghKernel.GH_RuntimeMessageLevel.Warning
        ghenv.Component.AddRuntimeMessage(w, warning)
else:
    print 'Connect a data stream to _hourly_data'
# ---------- end downsample_2 ----------
downsample_3 = Hive_Downsample(hourly_data=[item_2, simulatemultipletimesteps.operative_temperature], start_HOY=number_slider, resample_type="1")  # -> Readme, daily_values, monthly_values, annual_value; inputs hourly_data: tree, resample_type: Int32
#   port resample_type: 0:sum (default) or 1:mean
# ---------- downsample_3: Python ----------
# Downsample data
#
# HIVE: A energy simulation plugin developed by the A/S chair at ETH Zurich
# This component is based on building_physics.py in the RC_BuildingSimulator Github repository
# https://github.com/architecture-building-systems/RC_BuildingSimulator
# Extensive documentation is available on the project wiki.
#
# Author: Justin Zarb <zarbj@student.ethz.ch>
#
# This file is part of HIVE
#
# Licensing/Copyright and liability comments go here.
# <Copyright 2018, Architecture and Building Systems - ETH Zurich>
# <Licence: MIT>

"""
Convert hourly values to daily,monthly or annual results.
-
Provided by HIVE 0.0.1
    
    Args:
        _hourly_data: a list of hourly values
        _start_hoy: the hour of the year corresponding to the first value.
        resample_type: [0:sum, 1:mean] (default=0)
    Returns:
        readMe!:...
        daily_values:
        monthly_values:
        annual_value:
"""

ghenv.Component.Name = "Hive_Downsample"
ghenv.Component.NickName = 'Downsample'
ghenv.Component.Message = 'VER 0.0.1\nMAY_30_2018'
ghenv.Component.IconDisplayMode = ghenv.Component.IconDisplayMode.application
ghenv.Component.Category = "Hive"
ghenv.Component.SubCategory = "4. Results"
# ComponentExposure=1

import scriptcontext as sc
import Grasshopper.Kernel as ghKernel

def main(_start_hoy, hourly_data, resample_type):
    if not sc.sticky.has_key('HivePreparation'): 
        return "Add the modular RC component to the canvas!"
    hive_preparation = sc.sticky['HivePreparation']()
    
    def resample(dict,resample_type):
        if resample_type == 0:
            for key in dict:
                dict[key] = sum(dict[key])
        if resample_type == 1:
            for key in dict:
                dict[key] = sum(dict[key])/len(dict[key])
        return dict.values()
    
    hoys = range(int(_start_hoy),int(_start_hoy+len(hourly_data[0])))
    doys = [(h-1)//24 for h in hoys]
    moys = [hive_preparation.hour2Date(hoy,True)[1] for hoy in hoys]
    
    daily_streams = []
    monthly_streams = []
    annual = []
    
    for stream in hourly_data:
        daily = dict(zip(range(0,365),[list()]*365))
        monthly = dict(zip(range(0,11),[list()]*11))
        day_last_hour = 0
        values_this_day = []
        month_last_hour = 0
        values_this_month = []
        
        for value,doy,moy in zip(hourly_data[stream],doys,moys):
            # Split values into days
            if doy == day_last_hour:
                values_this_day.append(value)
            else:
                daily[day_last_hour] = values_this_day
                values_this_day = []
                day_last_hour = doy
            daily[day_last_hour] = values_this_day
            
            # Split values into months
            if moy == month_last_hour:
                values_this_month.append(value)
            else:
                monthly[month_last_hour] = values_this_month
                values_this_month = []
                month_last_hour = moy
            monthly[month_last_hour] = values_this_month
        
        daily_streams.append(resample(daily,resample_type))
        monthly_streams.append(resample(monthly,resample_type))
        
        if resample_type == 0:
            annual.append([sum(hourly_data[stream])])
        if resample_type == 1:
            annual.append([sum(hourly_data[stream])/len(hourly_data[stream])])
    
    dailyTree = hive_preparation.list_to_tree(daily_streams)
    monthlyTree = hive_preparation.list_to_tree(monthly_streams)
    annualTree = hive_preparation.list_to_tree(annual)
    
    return dailyTree, monthlyTree, annualTree

""""""""""""""""""""""""""""""""""""""""""""""""""""""""""""""""""""""""""""""

resample_type_ = 0 if resample_type_ is None else resample_type_

#convert _hourly_data into a dictionary.
if _hourly_data.BranchCount > 0 :
    hourly_data = {}
    for stream in range(0,len(_hourly_data.Branch(0))):
        hourly_data[stream] = []
        for b in range(0,_hourly_data.BranchCount):
            hourly_data[stream].append(_hourly_data.Branch(b)[stream])
    if not _start_HOY:
        print """Start_HOY assumed to be 0: If this is not the case, add a 
        value to _start_HOY!"""
        _start_HOY = 1
    daily_values, monthly_values, annual_value = main(_start_HOY,hourly_data,resample_type_)
    print '%i data streams resampled'%len(_hourly_data.Branch(0))


else:
    print 'Connect a data stream to _hourly_data'
# ---------- end downsample_3 ----------
downsample_4 = Hive_Downsample(
    hourly_data=[glazedelement_2.solar_gains, glazedelement.solar_gains, internalgains.internal_gains],
    start_HOY=number_slider)  # -> Readme, daily_values, monthly_values, annual_value; inputs hourly_data: tree
# ---------- downsample_4: Python ----------
# Downsample data
#
# HIVE: A energy simulation plugin developed by the A/S chair at ETH Zurich
# This component is based on building_physics.py in the RC_BuildingSimulator Github repository
# https://github.com/architecture-building-systems/RC_BuildingSimulator
# Extensive documentation is available on the project wiki.
#
# Author: Justin Zarb <zarbj@student.ethz.ch>
#
# This file is part of HIVE
#
# Licensing/Copyright and liability comments go here.
# <Copyright 2018, Architecture and Building Systems - ETH Zurich>
# <Licence: MIT>

"""
Define an opaque by adding a surface.
-
Provided by HIVE 0.0.1
    
    Args:
        _hourly_data: a list of hourly values
        _start_hoy: the hour of the year corresponding to the first value.
        resample_type: 0:sum (default) or 1:mean
    Returns:
        readMe!:...
        daily_values:
        monthly_values:
        annual_value:
"""

ghenv.Component.Name = "Hive_Downsample"
ghenv.Component.NickName = 'Downsample'
ghenv.Component.Message = 'VER 0.0.1\nMAY_16_2018'
ghenv.Component.IconDisplayMode = ghenv.Component.IconDisplayMode.application
ghenv.Component.Category = "Hive"
ghenv.Component.SubCategory = "3 | Results"
# ComponentExposure=1

import scriptcontext as sc

def main(_start_hoy, hourly_data, resample_type):
    if not sc.sticky.has_key('HivePreparation'): 
        return "Add the modular RC component to the canvas!"
    hive_preparation = sc.sticky['HivePreparation']()
    
    def resample(dict,resample_type):
        if resample_type == 0:
            for key in dict:
                dict[key] = sum(dict[key])
        if resample_type == 1:
            for key in dict:
                dict[key] = sum(dict[key])/len(dict[key])
        return dict.values()
    
    hoys = range(int(_start_hoy),int(_start_hoy+len(hourly_data[0])))
    doys = [(h-1)//24 for h in hoys]
    moys = [hive_preparation.hour2Date(hoy,True)[1] for hoy in hoys]
    
    daily_streams = []
    monthly_streams = []
    annual = []
    
    for stream in hourly_data:
        daily = dict(zip(range(0,365),[list()]*365))
        monthly = dict(zip(range(0,11),[list()]*11))
        day_last_hour = 0
        values_this_day = []
        month_last_hour = 0
        values_this_month = []
        
        for value,doy,moy in zip(hourly_data[stream],doys,moys):
            # Split values into days
            if doy == day_last_hour:
                values_this_day.append(value)
            else:
                daily[day_last_hour] = values_this_day
                values_this_day = []
                day_last_hour = doy
            daily[day_last_hour] = values_this_day
            
            # Split values into months
            if moy == month_last_hour:
                values_this_month.append(value)
            else:
                monthly[month_last_hour] = values_this_month
                values_this_month = []
                month_last_hour = moy
            monthly[month_last_hour] = values_this_month
        
        daily_streams.append(resample(daily,resample_type))
        monthly_streams.append(resample(monthly,resample_type))
        
        if resample_type == 0:
            annual.append([sum(hourly_data[stream])])
        if resample_type == 1:
            annual.append([sum(hourly_data[stream])/len(hourly_data[stream])])
        
    dailyTree = hive_preparation.list_to_tree(daily_streams)
    monthlyTree = hive_preparation.list_to_tree(monthly_streams)
    annualTree = hive_preparation.list_to_tree(annual)
    return dailyTree, monthlyTree, annualTree

""""""""""""""""""""""""""""""""""""""""""""""""""""""""""""""""""""""""""""""

resample_type_ = 0 if resample_type_ is None else resample_type_

#convert _hourly_data into a dictionary.
if _hourly_data.BranchCount > 0 :
    hourly_data = {}
    for stream in range(0,len(_hourly_data.Branch(0))):
        hourly_data[stream] = []
        for b in range(0,_hourly_data.BranchCount):
            hourly_data[stream].append(_hourly_data.Branch(b)[stream])
    if _start_HOY:
        daily_values, monthly_values, annual_value = main(_start_HOY,hourly_data,resample_type_)
        print '%i data streams resampled'%len(_hourly_data.Branch(0))
    else:
        warning = """Warning: Add a value to _start_HOY!"""
        w = ghKernel.GH_RuntimeMessageLevel.Warning
        ghenv.Component.AddRuntimeMessage(w, warning)
else:
    print 'Connect a data stream to _hourly_data'
# ---------- end downsample_4 ----------
downsample_5 = Hive_Downsample(
    hourly_data=[simulatemultipletimesteps.lighting_demand, simulatemultipletimesteps.cooling_demand, simulatemultipletimesteps.heating_demand],
    start_HOY=number_slider)  # -> Readme, daily_values, monthly_values, annual_value; inputs hourly_data: tree, resample_type: Int32; same code as downsample

# ---- group: Window1, Window2 Lux
graph_2 = QuickGraph(downsample_2.daily_values)

# ---- group: Window1, Window2, Internal gains
graph_3 = QuickGraph(downsample_4.daily_values)

# ---- group: Heating - Cooling - Lighting
graph_4 = QuickGraph(downsample_5.daily_values)

# ----
lng = ListLength(List=downsample_3.daily_values)
item_3 = ListItem(List=lng, Index=1, Wrap=True)
dup = DuplicateData(Data=Slider(20, range=0..100), Number=item_3, Order=True)  # -> simplify(flatten(Data))

# ---- group: Operative Indoor - Outdoor Temperature
graph_5 = QuickGraph([downsample_3.daily_values, dup])

# ----
panel_4 = Panel(downsample_3.monthly_values)

# ==== cluster Cluster
L = ClusterInput()
lng = ListLength(List=L)
G = ClusterInput()
series = Series(Start=0, Step=1, Count=lng)
area = Area(Geometry=G)  # -> Area, Centroid
int = Integer(series)
orient2camera = Ladybug_OrientToCamera(initPosition=area.Centroid)  # -> orientedToCam; plug-in component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
int_2 = ClusterOutput(int)
timer = Timer(TimerInterval=1000, Target=orient2camera)
orientedtocam = ClusterOutput(orient2camera)

# ==== cluster Hive_DrawShadows
max_edge = ClusterInput()
window = ClusterInput()
custom_mesh_settings = SettingsCustom(
    StitchSeams=True,
    SimplePlanes=False,
    Refine=True,
    MinCount=16,
    MaxCount=400,
    AspectRatio=20,
    MaxDistance=0,
    MaxAngle=20,
    MinEdge=0,
    MaxEdge=max_edge)
window_2 = Geometry(window)
shade_points = ClusterInput()
mesh = MeshBrep(Brep=window_2, Settings=custom_mesh_settings)
window_normal = ClusterInput()
shade_points_2 = Geometry(shade_points)
explode = MeshExplode(Mesh=mesh, Interpolate=False)
window_normal_2 = Data(window_normal)
move = Move(Geometry=shade_points_2, Motion=expr("-x", window_normal_2))  # -> simplify(Geometry), Transform
move_2 = Move(Geometry=shade_points_2, Motion=expr("x", window_normal_2))  # -> simplify(Geometry), Transform
area = MeshArea(Mesh=explode)  # -> Area, Centroid
geo = Geometry([move.Geometry, move_2.Geometry])
convexhull = _3DConvexHull(Points=geo)
minc = MeshInclusion(Mesh=convexhull, Point=area.Centroid, Strict=False)  # -> simplify(Inside)
flip = FlipMatrix(Data=minc)
ma = MassAddition(Input=flip)  # -> flatten(Result), PartialResults
bnd = Bounds(Numbers=ma.Result)
dom = ConstructDomain(DomainStart=255, DomainEnd=0)
remap = RemapNumbers(Value=ma.Result, Source=bnd, Target=dom)  # -> Mapped, Clipped
int = Integer(remap.Mapped)
rgb = ColourRGB(Alpha=Slider(193, range=0..255), Red=0, Green=int, Blue=int)
color = Data(rgb)
meshes = Geometry(explode)
color_2 = ClusterOutput(color)
meshes_2 = ClusterOutput(meshes)
