# Grasshopper definition test solar gains_recovered.gh (Grasshopper 0.9.76)
# plug-ins: Python Interpreter

# ---- group: sets time steps for simulation
# Simulation Data
start_day = Panel("1")
start_month = Panel("6")
ladybug = Ladybug_Ladybug()  # -> Vviiiiiiiiiizzz; plug-in component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
number_of_hours = Panel("720")
doy_hoy = Ladybug_DOY_HOY(days=start_day, months=start_month, hours=1)  # -> HOY, DOY, date; plug-in component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
open_weather_file = Ladybug_OpenEPWWeatherFile(open=Toggle(True))  # -> epwFile; plug-in component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
eval = Evaluate(F="x+y-1", x=doy_hoy.HOY, y=number_of_hours)
getsimulationdata = Hive_getSimulationData(epw_file=open_weather_file, browse_for_epw=Toggle(False), start_HOY=doy_hoy.HOY, end_HOY=eval)  # -> out, location, temperature, irradiation; inputs start_HOY: Int32, end_HOY: Int32
# ---------- getsimulationdata: Python ----------
#
# Hive: An educational plugin developed by the A/S chair at ETH Zurich
# 
# This file is part of Hive.
# 
# TODO: Check terms of GNU modification.
#
# This component is a mashup of functions from Ladybug for importing and reading 
# EPW files. Some of 
# 
# 
# 

"""
Extract temperature, location and irradiation data from a weather file. 
-
Provided by Hive 0.0.1

    Args:
        _open: Set Boolean to True to browse for a weather file on your system.
        start_HOY_: optional HOY for the start of the analysis period
        end_HOY_: optional HOY for the end of the analysis period
    Returns:
        out: ...
        location: a list of longitude, latitude, utc offset and year
        temperature: a dictionary in the form: {hoy:temperature}
        irradiation: a dictionary in the form: {hoy:[direct normal irradiation, diffuse horizontal irradiation, direct normal illuminance, diffuse horizontal illuminance)
"""

ghenv.Component.Name = "Hive_getSimulationData"
ghenv.Component.NickName = 'getSimulationData'
ghenv.Component.Message = 'VER 0.0.1\nMAY_07_2018'
ghenv.Component.Category = "Hive"
ghenv.Component.SubCategory = "2 | Simulation"
# ComponentExposure=1

import rhinoscriptsyntax as rs
import scriptcontext as sc
import Grasshopper.Kernel as gh
from Grasshopper.Kernel.Data import GH_Path
from Grasshopper import DataTree
from System import Object

class GhPythonDictionary(object):
    def __init__(self, pythonDict=None):
        if pythonDict:
            self.d = pythonDict
        else:
            self.d = {}
    def ToString(self):
        return 'GhPythonDictionary object'

def separate_data(inputList):
    # Based on Ladybug_Separate data, but uses lists instead of DataTree objects
    num = []
    str = []
    lastOne = None
    
    strPath = 0
    numPath = 0
    
    p = []
    numbers = []
    strings = []
    
    for count, item in enumerate(inputList):
        try:
            item = float(item)
            if count == 0: numfirst = True
            if lastOne == None: lastOne = "float"
            if lastOne!= "float":
                lastOne = "float"
                numPath += 1
            if numfirst == False:
                p.append(numPath-1)
                numbers.append(item)
            else:
                p.append(numPath)
                numbers.append(item)
        except:
            if count == 0: numfirst = False
            if lastOne == None: lastOne = "str"
            if lastOne!= "str":
                lastOne = "str"
                strPath += 1
            if numfirst == True:
                p.append(strPath-1)
                strings.append(item)
            else:
                p.append(strPath)
                strings.append(item)
    
    return numbers

def open_epw(open):
    #Based on Ladybug_Open EPW Weather File
    if open == True:
        filter = "EPW file (*.epw)|*.epw|All Files (*.*)|*.*||"
        epwFile = rs.OpenFileName("Open .epw Weather File", filter)
        print 'Done!'
        return epwFile
    else:
        print 'Please set open to True'

def set_simulation_period(start_hoy,end_hoy):
    if start_hoy is not None:
        if 0 <= int(start_hoy) < 8760:
            start = start_hoy
        else:
            warningMsg = "start_HOY_ must be an integer between 0 and 8760"
            w = gh.GH_RuntimeMessageLevel.Warning
            ghenv.Component.AddRuntimeMessage(w, warningMsg)
            return None
    else:
        start = 0
    
    if end_hoy is not None:
        if start <= end_hoy < 8760:
            end = end_hoy
        else:
            warningMsg = "end_HOY_ must be an integer between start_HOY_ and 8760"
            w = gh.GH_RuntimeMessageLevel.Warning
            ghenv.Component.AddRuntimeMessage(w, warningMsg)
            return None
    else:
        end = 8759
    
    return int(start),int(end)

def main(epw_file,start_HOY_,end_HOY_):
    if not sc.sticky.has_key('HivePreparation'): return "Add the modular RC component to the canvas!"
    #TODO: Set up compatibility checks like in Ladybug.
    
    hive_preparation = sc.sticky["HivePreparation"]()
    start,end = set_simulation_period(start_HOY_,end_HOY_)
    temperature = []
    irradiation = []
    
    if (epw_file is not None):
        locationData = hive_preparation.epwLocation(epw_file)
        weatherData = hive_preparation.epwDataReader(epw_file, locationData[0])
    
        location = [locationData[1], locationData[2], locationData[3]]
        dryBulbTemperature, dewPointTemperature, relativeHumidity, windSpeed, windDirection, directNormalRadiation, diffuseHorizontalRadiation, globalHorizontalRadiation, directNormalIlluminance, diffuseHorizontalIlluminance, globalHorizontalIlluminance, totalSkyCover, horizontalInfraredRadiation, barometricPressure, modelYear = weatherData
        location.append(modelYear[7])
    
        dryBulbTemperature = separate_data(dryBulbTemperature)
        directRadiation = separate_data(directNormalRadiation)
        diffuseRadiation = separate_data(diffuseHorizontalRadiation)
        directIlluminance = separate_data(directNormalIlluminance)
        diffuseIlluminance = separate_data(diffuseHorizontalIlluminance)
    
        for i in range(start,end):
            temperature.append([i,dryBulbTemperature[i]])
            irradiation.append([i, directRadiation[i], diffuseRadiation[i], directIlluminance[i], diffuseIlluminance[i]])
    
    return location, hive_preparation.list_to_tree(temperature), hive_preparation.list_to_tree(irradiation)

if epw_file is None:
    if browse_for_epw:
        epw_file = open_epw(_open)
        location, temperature, irradiation = main(epw_file,start_HOY_,end_HOY_)

else:
    try:
        location, temperature, irradiation = main(epw_file,start_HOY_,end_HOY_)
    except ValueError:
        print 'refresh this component'
# ---------- end getsimulationdata ----------

# ----
# Window Geometry
panel = Panel("2,0,2")
window_azimuth = Slider(70, range=-90..90)
window_tilt = Slider(0, range=-90..90)
xz = XZPlane(Origin=panel)
pt = Point("2,2,2")
rectangle = Rectangle(Plane=xz, XSize=Domain(-2, 2), YSize=Domain(-2, 2), Radius=0)  # -> Rectangle, Length
xy = XYPlane(Origin=panel)
yz = YZPlane(Origin=panel)
boundary = BoundarySurfaces(Edges=rectangle.Rectangle)
rotate = Rotate(Geometry=pt, Angle=degrees(window_azimuth), Plane=xy)  # -> Geometry, Transform
rotate_2 = Rotate(Geometry=yz, Angle=degrees(window_azimuth), Plane=xy)  # -> Geometry, Transform
rotate_3 = Rotate(Geometry=boundary, Angle=degrees(window_azimuth), Plane=xy)  # -> Geometry, Transform
area = Area(Geometry=rectangle.Rectangle)  # -> Area, Centroid
rotate_4 = Rotate(Geometry=rotate_3.Geometry, Angle=degrees(window_tilt), Plane=rotate_2.Geometry)  # -> Geometry, Transform

# ----
# Shading device
count = Slider(4, range=0..10)
depth = Slider(0.76, range=0..2)
sdivide = DivideSurface(Surface=reparameterize(rotate_4.Geometry), UCount=2, VCount=count)  # -> Points, Normals, Parameters
Y = UnitY(Factor=expr("-x", depth))
X = UnitX(Factor=expr("-x/2", "4"))
flip = FlipMatrix(Data=sdivide.Points)
addition = Addition(A=Y, B=X)
item = ListItem(List=flip, Index=1, Wrap=True)  # -> flatten(Item)
lng = ListLength(List=item)
cull_i = CullIndex(List=item, Indices=lng, Wrap=True)
rectangle_2 = Rectangle(Plane=cull_i, XSize="4", YSize=depth, Radius=0)  # -> Rectangle, Length
move = Move(Geometry=rectangle_2.Rectangle, Motion=addition)  # -> Geometry, Transform
boundary_2 = BoundarySurfaces(Edges=move.Geometry)  # -> flatten(Surfaces)
brep = Brep(<brep referenced from the Rhino model>)

emissionsystems = Hive_EmissionSystems()  # -> out
# ---------- emissionsystems: Python ----------
# This comoponent contains a car-builder system of objects which define simple 
# emission systems.
#
# Hive: An educational plugin developed by the A/S chair at ETH Zurich
# This component is based on emission_system.py in the RC_BuildingSimulator github repository
# https://github.com/architecture-building-systems/RC_BuildingSimulator
#
# Authors: Prageeth Jayathissa <jayathissa@arch.ethz.ch>, Michael Fehr
# Converted into a grasshopper plugin by Justin Zarb <zarbj@student.ethz.ch>
#
# This file is part of Hive
#
# Licensing/Copywrite and liability comments go here.
# Copyright 2018, Architecture and Building Systems - ETH Zurich
# Licence: MIT

"""
Place this component in the grasshopper workspace so that other Hive components can access the emission systems object definitions
-
Provided by Hive 0.0.1
"""

ghenv.Component.Name = "Hive_EmissionSystems"
ghenv.Component.NickName = 'EmissionSystems'
ghenv.Component.Message = 'VER 0.0.1\nFEB_23_2018'
ghenv.Component.IconDisplayMode = ghenv.Component.IconDisplayMode.application
ghenv.Component.Category = "Hive"
ghenv.Component.SubCategory = "0 | Core"
# ComponentExposure=2

import scriptcontext as sc
class EmissionDirector:

    """
    The director sets what Emission system is being used, and runs that set Emission system
    """

    builder = None

    # Sets what Emission system is used
    def set_builder(self, builder):
        #        self.__builder = builder
        self.builder = builder
    # Calcs the energy load of that system. This is the main() fu

    def calc_flows(self):

        # Director asks the builder to produce the system body. self.builder
        # is an instance of the class

        body = self.builder.heat_flows()

        return body


class EmissionSystemBase:

    """ 
    The base class in which systems are built from
    """

    def __init__(self, energy_demand):

        self.energy_demand = energy_demand


    def heat_flows(self): pass
    """
    determines the node where the heating/cooling system is active based on the system used
    Also determines the return and supply temperatures for the heating/cooling system
    """


class OldRadiators(EmissionSystemBase):
    """
    Old building with radiators and high supply temperature
    Heat is emitted to the air node
    """

    def heat_flows(self):
        flows = Flows()
        flows.phi_ia_plus = self.energy_demand
        flows.phi_st_plus = 0
        flows.phi_m_plus = 0

        flows.heating_supply_temperature = 65
        flows.heating_return_temperature = 45
        flows.cooling_supply_temperature = 12
        flows.cooling_return_temperature = 21

        return flows


class NewRadiators(EmissionSystemBase):
    """    
    Newer building with radiators and medium supply temperature
    Heat is emitted to the air node
    """

    def heat_flows(self):
        flows = Flows()
        flows.phi_ia_plus = self.energy_demand
        flows.phi_st_plus = 0
        flows.phi_m_plus = 0

        flows.heating_supply_temperature = 50
        flows.heating_return_temperature = 35
        flows.cooling_supply_temperature = 12
        flows.cooling_return_temperature = 21

        return flows

class ChilledBeams(EmissionSystemBase):
    """
    Chilled beams: identical to newRadiators but used for cooling
    Heat is emitted to the air node
    """

    def heat_flows(self):
        flows = Flows()
        flows.phi_ia_plus = self.energy_demand
        flows.phi_st_plus = 0
        flows.phi_m_plus = 0

        flows.heating_supply_temperature = 50
        flows.heating_return_temperature = 35
        flows.cooling_supply_temperature = 18
        flows.cooling_return_temperature = 21

        return flows


class AirConditioning(EmissionSystemBase):
    """
    All heat is given to the air via an AC-unit. HC input via the air node as in the ISO 13790 Annex C.
    supplyTemperature as with new radiators (assumption)
    Heat is emitted to the air node
    """

    def heat_flows(self):
        flows = Flows()
        flows.phi_ia_plus = self.energy_demand
        flows.phi_st_plus = 0
        flows.phi_m_plus = 0

        flows.heating_supply_temperature = 40
        flows.heating_return_temperature = 20
        flows.cooling_supply_temperature = 6
        flows.cooling_return_temperature = 15

        return flows

class FloorHeating(EmissionSystemBase):
    """
    All HC energy goes into the surface node, supplyTemperature low
    Heat is emitted to the surface node
    """

    def heat_flows(self):
        flows = Flows()
        flows.phi_ia_plus = 0
        flows.phi_st_plus = self.energy_demand
        flows.phi_m_plus = 0

        flows.heating_supply_temperature = 40
        flows.heating_return_temperature = 5
        flows.cooling_supply_temperature = 12
        flows.cooling_return_temperature = 21

        return flows

class TABS(EmissionSystemBase):
    """
    Thermally activated Building systems. HC energy input into bulk node. Supply Temperature low.
    Heat is emitted to the thermal mass node
    """

    def heat_flows(self):
        flows = Flows()
        flows.phi_ia_plus = 0
        flows.phi_st_plus = 0
        flows.phi_m_plus = self.energy_demand

        flows.heating_supply_temperature = 50
        flows.heating_return_temperature = 35
        flows.cooling_supply_temperature = 12
        flows.cooling_return_temperature = 21

        return flows


class Flows:
    """
    A base object to store output variables
    """

    phi_ia_plus = float("nan")
    phi_m_plus = float("nan")
    phi_st_plus = float("nan")

    heating_supply_temperature = float("nan")
    cooling_supply_temperature = float("nan")
    # return temperatures

connected = False

while not connected:
    try:
        sc.sticky["SupplyDirector"]
        connected = True
    except NameError:
        error = "Add the supply_systems component to the canvas!"
        e = gh.GH_RuntimeMessageLevel.error
        ghenv.Component.AddRuntimeMessage(e, error)


if connected:
    sc.sticky["EmissionDirector"] = EmissionDirector
    sc.sticky["OldRadiators"] = OldRadiators
    sc.sticky["AirConditioning"] = AirConditioning
    sc.sticky["NewRadiators"] = NewRadiators
    sc.sticky["ChilledBeams"] = ChilledBeams
    sc.sticky["FloorHeating"] = FloorHeating
    sc.sticky["TABS"] = TABS
    
    sc.sticky["emission_systems_ok"] = True
    sc.sticky["pushback"]()

    print 'Emission systems are go!'
# ---------- end emissionsystems ----------
supplysystems = Hive_SupplySystems()  # -> out
# ---------- supplysystems: Python ----------
# This comoponent contains a car-builder system of objects which define simple 
# emission systems.
#
# Hive: An educational plugin developed by the A/S chair at ETH Zurich
# This component is based on code in the RC_BuildingSimulator github repository
# https://github.com/architecture-building-systems/RC_BuildingSimulator
#
# Authors: Prageeth Jayathissa <jayathissa@arch.ethz.ch>, Michael Fehr
# Converted into a grasshopper plugin by Justin Zarb <zarbj@student.ethz.ch>
#
# This file is part of Hive
#
# Licensing/Copywrite and liability comments go here.
# Copyright 2018, Architecture and Building Systems - ETH Zurich
# Licence: MIT

"""
Place this component in the grasshopper workspace so that other Hive components can access the supply systems objects.
-
Provided by Hive 0.0.1
"""

ghenv.Component.Name = "Hive_SupplySystems"
ghenv.Component.NickName = 'SupplySystems'
ghenv.Component.Message = 'VER 0.0.1\nFEB_22_2018'
ghenv.Component.IconDisplayMode = ghenv.Component.IconDisplayMode.application
ghenv.Component.Category = "Hive"
ghenv.Component.SubCategory = "0 | Core"
# ComponentExposure=2


import scriptcontext as sc

# This is one layer of abstraction too many, however it is kept for future explansion of the supply system
class SupplyDirector:

    """
    The director sets what Supply system is being used, and runs that set Supply system
    """

    builder = None

    # Sets what building system is used
    def set_builder(self, builder):
        self.builder = builder

    # Calcs the energy load of that system. This is the main() function
    def calc_system(self):

        # Director asks the builder to produce the system body. self.builder
        # is an instance of the class

        body = self.builder.calc_loads()

        return body


class SupplySystemBase:

    """
     The base class in which Supply systems are built from 
    """

    def __init__(self, load, t_out, heating_supply_temperature, cooling_supply_temperature, has_heating_demand, has_cooling_demand):
        self.load = load  # Energy Demand of the building at that time step
        self.t_out = t_out  # Outdoor Air Temperature
        # Temperature required by the emission system
        self.heating_supply_temperature = heating_supply_temperature
        self.cooling_supply_temperature = cooling_supply_temperature
        self.has_heating_demand = has_heating_demand
        self.has_cooling_demand = has_cooling_demand

    def calc_loads(self): pass
    """
    Caculates the electricty / fossil fuel consumption of the set supply system
    If the system also generates electricity, then this is stored as electricity_out
    """


class OilBoilerOld(SupplySystemBase):
    """
    Old oil boiler with fuel efficiency of 63 percent (medium of range in report of semester project M. Fehr)
    No condensation, pilot light
    """

    def calc_loads(self):
        system = SupplyOut()
        system.fossils_in = self.load / 0.63
        system.electricity_in = 0
        system.electricity_out = 0
        return system


class OilBoilerMed(SupplySystemBase):
    """
    Classic oil boiler with fuel efficiency of 82 percent (medium of range in report of semester project M. Fehr)
    No condensation, but better nozzles etc.
    """

    def calc_loads(self):
        system = SupplyOut()
        system.fossils_in = self.load / 0.82
        system.electricity_in = 0
        system.electricity_out = 0
        return system


class OilBoilerNew(SupplySystemBase):
    """
    New oil boiler with fuel efficiency of 98 percent (value from report of semester project M. Fehr)
    Condensation boiler, latest generation
    """

    def calc_loads(self):
        system = SupplyOut()
        system.fossils_in = self.load / 0.98
        system.electricity_in = 0
        system.electricity_out = 0
        return system


class HeatPumpAir(SupplySystemBase):
    """
    BETA Version
    Air-Water heat pump. Outside Temperature as reservoir temperature.
    COP based off regression analysis of manufacturers data
    Source: "A review of domestic heat pumps, Iain Staffell, Dan Brett, Nigel Brandonc and Adam Hawkes"
    http://pubs.rsc.org/en/content/articlepdf/2012/ee/c2ee22653g

    TODO: Validate this methodology
    """

    def calc_loads(self):
        system = SupplyOut()

        if self.has_heating_demand:
            # determine the temperature difference, if negative, set to 0
            deltaT = max(0, self.heating_supply_temperature - self.t_out)
            # Eq (4) in Staggell et al.
            system.cop = 6.81 - 0.121 * deltaT + 0.000630 * deltaT**2
            system.electricity_in = self.load / system.cop

        elif self.has_cooling_demand:
            # determine the temperature difference, if negative, set to 0
            deltaT = max(0, self.t_out - self.cooling_supply_temperature)
            # Eq (4) in Staggell et al.
            system.cop = 6.81 - 0.121 * deltaT + 0.000630 * deltaT**2
            system.electricity_in = self.load / system.cop

        else:
            raise ValueError(
                'HeatPumpAir called although there is no heating/cooling demand')

        system.fossils_in = 0
        system.electricity_out = 0
        return system


class HeatPumpWater(SupplySystemBase):
    """"
    BETA Version
    Reservoir temperatures 7 degC (winter) and 12 degC (summer).
    Ground-Water heat pump. Outside Temperature as reservoir temperature.
    COP based off regression analysis of manufacturers data
    Source: "A review of domestic heat pumps, Iain Staffell, Dan Brett, Nigel Brandonc and Adam Hawkes"
    http://pubs.rsc.org/en/content/articlepdf/2012/ee/c2ee22653g

        # TODO: Validate this methodology
    """


    def calc_loads(self):
        system = SupplyOut()
        if self.has_heating_demand:
            deltaT = max(0, self.heating_supply_temperature - 7.0)
            # Eq (4) in Staggell et al.
            system.cop = 8.77 - 0.150 * deltaT + 0.000734 * deltaT**2
            system.electricity_in = self.load / system.cop

        elif self.has_cooling_demand:
            deltaT = max(0, 12.0 - self.cooling_supply_temperature)
            # Eq (4) in Staggell et al.
            system.cop = 8.77 - 0.150 * deltaT + 0.000734 * deltaT**2
            system.electricity_in = self.load / system.cop

        system.fossils_in = 0
        system.electricity_out = 0
        return system


class ElectricHeating(SupplySystemBase):
    """
    Straight forward electric heating. 100 percent conversion to heat.
    """

    def calc_loads(self):
        system = SupplyOut()
        system.electricity_in = self.load
        system.fossils_in = 0
        system.electricity_out = 0
        return system


class CHP(SupplySystemBase):
    """
    Combined heat and power unit with 60 percent thermal and 33 percent
    electrical fuel conversion. 93 percent overall
    """

    def calc_loads(self):
        system = SupplyOut()
        system.fossils_in = self.load / 0.6
        system.electricity_in = 0
        system.electricity_out = system.fossils_in * 0.33
        return system


class DirectHeater(SupplySystemBase):
    """
    Created by PJ to check accuracy against previous simulation
    """

    def calc_loads(self):
        system = SupplyOut()
        system.electricity_in = self.load
        system.fossils_in = 0
        system.electricity_out = 0
        return system


class DirectCooler(SupplySystemBase):
    """
    Created by PJ to check accuracy against previous simulation
    """

    def calc_loads(self):
        system = SupplyOut()
        system.electricity_in = self.load
        system.fossils_in = 0
        system.electricity_out = 0
        return system


class SupplyOut:
    """
    The System class which is used to output the final results
    """
    fossils_in = float("nan")
    electricity_in = float("nan")
    electricity_out = float("nan")
    cop = float("nan")


def pushback():
    """
    Push RC component to back. 
    The following lines are taken from Ladybug_Ladybug. Their purpose is to 
    initialise the sticky components upon startup. Without them, the components 
    need to be manually refreshed.
    """
    ghenv.Component.OnPingDocument().SelectAll()
    ghenv.Component.Attributes.Selected = False
    ghenv.Component.OnPingDocument().BringSelectionToTop()
    ghenv.Component.OnPingDocument().DeselectAll()

sc.sticky["OilBoilerOld"] = OilBoilerOld
sc.sticky["OilBoilerMed"] = OilBoilerMed
sc.sticky["OilBoilerNew"] = OilBoilerNew
sc.sticky["HeatPumpAir"] = HeatPumpAir
sc.sticky["HeatPumpWater"] = HeatPumpWater
sc.sticky["ElectricHeating"] = ElectricHeating
sc.sticky["CHP"] = CHP
sc.sticky["DirectHeater"] = DirectHeater
sc.sticky["DirectCooler"] = DirectCooler
sc.sticky["SupplyDirector"] = SupplyDirector


sc.sticky["pushback"] = pushback
pushback()
sc.sticky["supply_systems_ok"] = True

print 'Supply systems are go!'
# ---------- end supplysystems ----------
hive = Hive_Hive(systems=[emissionsystems, supplysystems])  # -> out; inputs systems: list
# ---------- hive: Python ----------
#
# Hive: An educational plugin developed by the A/S chair at ETH Zurich
#
# This comoponent contains an object-oriented adaptation of the RC model 
# referred to as the 'Simple Hourly Method' in ISO 13790, (superceded by 
# EN ISO 52016-1).

# The code contains the version of building_physics.py found in the nested_rc 
# branch. The modifications make it easier to accomodate a more modular zone 
# definiton, made of a zone and elements. 
# See https://github.com/architecture-building-systems/RC_BuildingSimulator for
# extensive documentation is available on the project wiki.

# Authors: Prageeth Jayathissa <jayathissa@arch.ethz.ch>, Justin Zarb 
# <zarbj@student.ethz.ch>
# Adapted for Grasshopper by Justin Zarb
#
# This file is part of Hive
#
#TODO: Licensing/Copyright and liability stuff


"""
Place this component in the grasshopper workspace so that zones can be defined and simulations run.
-
Provided by Hive 0.0.1
"""

ghenv.Component.Name = "Hive_Hive"
ghenv.Component.NickName = 'Hive'
ghenv.Component.Message = 'VER 0.0.1\nMAY_09_2018'
ghenv.Component.IconDisplayMode = ghenv.Component.IconDisplayMode.application
ghenv.Component.Category = "Hive"
ghenv.Component.SubCategory = "0 | Core"
# ComponentExposure=1

import scriptcontext as sc
import rhinoscriptsyntax as rs
import Rhino as rc
import ghpythonlib.components as gh
import Grasshopper.Kernel as ghKernel
import math
import datetime
import time

from itertools import product
from operator import itemgetter
from Grasshopper.Kernel.Data import GH_Path
from Grasshopper import DataTree
from System.Collections.Generic import List
import System.Reflection
import os 

clipper_path = os.path.join(os.getenv('APPDATA'), 'Grasshopper', 'Libraries', 'clipper_library.dll')
clipper_library = System.Reflection.Assembly.LoadFrom(clipper_path)

clipper = clipper_library.ClipperLib.Clipper()
polyTree = clipper_library.ClipperLib.PolyTree
polyType = clipper_library.ClipperLib.PolyType
clipType = clipper_library.ClipperLib.ClipType
polyFillType = clipper_library.ClipperLib.PolyFillType

IntPoint = clipper_library.ClipperLib.IntPoint


class HivePreparation(object):
    """ 
    Credits: Ladybug
    This object contains some hand-picked functions from the Ladybug Preparation component.
    It provides support for other components which have been adapted from Ladybug to Hive.
    """

    def hour2Date(self, hour, alternate = False):
        numOfDays = [0, 31, 59, 90, 120, 151, 181, 212, 243, 273, 304, 334, 365]
        numOfHours = [24 * numOfDay for numOfDay in numOfDays]
        #print hour/24
        if hour%8760==0 and not alternate: return `31`+ ' ' + 'DEC' + ' 24:00'
        elif hour%8760==0: return 31, 11, 24
    
        for h in range(len(numOfHours)-1):
            if hour <= numOfHours[h+1]: month = self.monthList[h]; break
        try: month
        except: month = self.monthList[h] # for the last hour of the year
    
        if (hour)%24 == 0:
            day = int((hour - numOfHours[h]) / 24)
            time = `24` + ':00'
            hour = 24
        else:
            day = int((hour - numOfHours[h]) / 24) + 1
            minutes = `int(round((hour - math.floor(hour)) * 60))`
            if len(minutes) == 1: minutes = '0' + minutes
            time = `int(hour%24)` + ':' + minutes
        if alternate:
            time = hour%24
            if time == 0: time = 24
            month = self.monthList.index(month)
            return day, month, time
            
        return (`day` + ' ' + month + ' ' + time)

    def __init__(self):
        self.monthList = ['JAN', 'FEB', 'MAR', 'APR', 'MAY', 'JUN', 'JUL', 'AUG', 'SEP', 'OCT', 'NOV', 'DEC']
        self.numOfDays = [0, 31, 59, 90, 120, 151, 181, 212, 243, 273, 304, 334, 365]
        self.numOfDaysEachMonth = [31, 28, 31, 30, 31, 30, 31, 31, 30, 31, 30, 31]
        self.numOfHours = [24 * numOfDay for numOfDay in self.numOfDays]
    
    strToBeFound = 'key:location/dataType/units/frequency/startsAt/endsAt'
    
    def getJD(self, month, day):
        numOfDays = [0, 31, 59, 90, 120, 151, 181, 212, 243, 273, 304, 334]
        return numOfDays[int(month)-1] + int(day)
    
    def epwLocation(self, epw_file):
        epwfile = open(epw_file,"r")
        headline = epwfile.readline()
        csheadline = headline.split(',')
        while 1>0: #remove empty cells from the end of the list if any
            try: float(csheadline[-1]); break
            except: csheadline.pop()
        locName = ''
        for hLine in range(1,4):
            if csheadline[hLine] != '-':
                locName = locName + csheadline[hLine] + '_'
        locName = locName[:-1]
        lat = csheadline[-4]
        lngt = csheadline[-3]
        timeZone = csheadline[-2]
        elev = csheadline[-1].strip()
        epwfile.close
        return locName, lat, lngt, timeZone, elev
    
    
    def cleanAndCoerceList(self, brepList):
        """ This definition clean the list and add them to RhinoCommon"""
        outputMesh = []
        outputBrep = []
        
        for id in brepList:
            if rs.IsMesh(id):
                geo = rs.coercemesh(id)
                if geo is not None:
                    outputMesh.append(geo)
                    try: rs.DeleteObject(id)
                    except: pass
                
            elif rs.IsBrep(id):
                geo = rs.coercebrep(id)
                if geo is not None:
                    outputBrep.append(geo)
                    try: rs.DeleteObject(id)
                    except: pass
                    
                else:
                    # the idea was to remove the problematice surfaces
                    # not all the geometry which is not possible since
                    # badGeometries won't pass rs.IsBrep()
                    tempBrep = []
                    surfaces = rs.ExplodePolysurfaces(id)
                    for surface in surfaces:
                        geo = rs.coercesurface(surface)
                        if geo is not None:
                            tempBrep.append(geo)
                            try: rs.DeleteObject(surface)
                            except: pass
                    geo = rc.Geometry.Brep.JoinBreps(tempBrep, sc.doc.ModelAbsoluteTolerance)
                    for Brep in tempBrep:
                        Brep.Dispose()
                        try: rs.DeleteObject(id)
                        except: pass
                    outputBrep.append(geo)
        return outputMesh, outputBrep
        
    def epwDataReader(self, epw_file, location = 'Somewhere!'):
        # weather data
        modelYear = [self.strToBeFound, location, 'Year', 'Year', 'Hourly', (1, 1, 1), (12, 31, 24)];
        dbTemp = [self.strToBeFound, location, 'Dry Bulb Temperature', 'C', 'Hourly', (1, 1, 1), (12, 31, 24)];
        dewPoint = [self.strToBeFound, location, 'Dew Point Temperature', 'C', 'Hourly', (1, 1, 1), (12, 31, 24)];
        RH = [self.strToBeFound, location, 'Relative Humidity', '%', 'Hourly', (1, 1, 1), (12, 31, 24)];
        windSpeed = [self.strToBeFound, location, 'Wind Speed', 'm/s', 'Hourly', (1, 1, 1), (12, 31, 24)];
        windDir = [self.strToBeFound, location, 'Wind Direction', 'degrees', 'Hourly', (1, 1, 1), (12, 31, 24)];
        dirRad = [self.strToBeFound, location, 'Direct Normal Radiation', 'Wh/m2', 'Hourly', (1, 1, 1), (12, 31, 24)];
        difRad = [self.strToBeFound, location, 'Diffuse Horizontal Radiation', 'Wh/m2', 'Hourly', (1, 1, 1), (12, 31, 24)];
        glbRad = [self.strToBeFound, location, 'Global Horizontal Radiation', 'Wh/m2', 'Hourly', (1, 1, 1), (12, 31, 24)];
        infRad = [self.strToBeFound, location, 'Horizontal Infrared Radiation Intensity', 'Wh/m2', 'Hourly', (1, 1, 1), (12, 31, 24)];
        dirIll = [self.strToBeFound, location, 'Direct Normal Illuminance', 'lux', 'Hourly', (1, 1, 1), (12, 31, 24)];
        difIll = [self.strToBeFound, location, 'Diffuse Horizontal Illuminance', 'lux', 'Hourly', (1, 1, 1), (12, 31, 24)];
        glbIll = [self.strToBeFound, location, 'Global Horizontal Illuminance', 'lux', 'Hourly', (1, 1, 1), (12, 31, 24)];
        cloudCov = [self.strToBeFound, location, 'Total Cloud Cover', 'tenth', 'Hourly', (1, 1, 1), (12, 31, 24)];
        visibility = [self.strToBeFound, location, 'Visibility', 'km', 'Hourly', (1, 1, 1), (12, 31, 24)];
        barPress = [self.strToBeFound, location, 'Barometric Pressure', 'Pa', 'Hourly', (1, 1, 1), (12, 31, 24)];
        epwfile = open(epw_file,"r")
        lnum = 1 # line number
        for line in epwfile:
            if lnum > 8:
                modelYear.append(float(line.split(',')[0]))
                dbTemp.append(float(line.split(',')[6]))
                dewPoint.append(float(line.split(',')[7]))
                RH.append(float(line.split(',')[8]))
                barPress.append(float(line.split(',')[9]))
                windSpeed.append(float(line.split(',')[21]))
                windDir.append(float(line.split(',')[20]))
                dirRad.append(float(line.split(',')[14]))
                difRad.append(float(line.split(',')[15]))
                glbRad.append(float(line.split(',')[13]))
                infRad.append(float(line.split(',')[12]))
                dirIll.append(float(line.split(',')[17]))
                difIll.append(float(line.split(',')[18]))
                glbIll.append(float(line.split(',')[16]))
                cloudCov.append(float(line.split(',')[22]))
            lnum += 1
        epwfile.close()
        return dbTemp, dewPoint, RH, windSpeed, windDir, dirRad, difRad, glbRad, dirIll, difIll, glbIll, cloudCov, infRad, barPress, modelYear
    
    def list_to_tree(self, nestedlist):
        layerTree = DataTree[object]()
        for i, item_list in enumerate(nestedlist):
            path = GH_Path(i)
            layerTree.AddRange(item_list,path)
        return layerTree
   
    def dict_to_tree(self, dict):
        dictTree = DataTree[object]()
        for day,value in dict.iteritems():
            path = GH_Path(day)
            dictTree.Add(value,path)
        return dictTree


class RelativeSun(object):
    def __init__(self,location,window_azimuth_rad, window_altitude_rad, normal):
        # Extract location data
        self.latitude_deg = float(location[0])
        self.longitude_deg = float(location[1])
        self.utc_offset = float(location[2])
        self.year = int(location[3])
        
        self.window_azimuth_rad = window_azimuth_rad
        self.window_altitude_rad = window_altitude_rad
        self.normal = normal
    
    def is_sunny(self, sun_alt, relative_sun_az):
        return sun_alt >= 0.0 and abs(relative_sun_az) < 90.0
    
    def calc_relative_sun_position(self, hoy):
        """
        Credits: JoanDM
        Calculate sun position in respect to the glazed surface. 
        - Traditional convention:
            Sun azimuth: Clockwise due north. i.e. [0,360) degrees
        - Facade convention:
            Sun azimuth: Zero is coincident with the normal to glazed surface. From there, 
                         it ranges clockwise and counter clockwise till 180, i.e. 
                         [-180, 180) relative degrees.

        :param utc_offset: Time zone offset i.r. to Prime Meridian [hours]
        :type utc_offset: int
        :param latitude_deg: Local Latitude [Degrees]. North+, South-.
        :type latitude_deg: float
        :param longitude_deg: Local Longitude [Degrees]. East+, West-.
        :type longitude_deg: float
        :param asf_normal_az: Azimuth position of normal to ASF plane  [Degrees](Traditional convention)
        :type asf_normal_az: int
        :return: sun_alt, asf_sun_az: Sun altitude and azimuth [Degrees] (Facade convention)
        :rtype: tuple (float, float)
        """
        
        # Calculate sun position following traditional convention
        sun_alt, sun_az = self.calc_sun_position(hoy)
        
        # Redefine azimuth following ASF convention
        relative_sun_az = self.calc_relative_azimuth(sun_az)
        relative_sun_alt = self.calc_relative_altitude(sun_alt)
        return relative_sun_alt, relative_sun_az
    
    def calc_sun_position(self, hoy):
        """
        Credits: Prageeth Jayathissa, Joan Domènech Masferrer 
    
        Calculates the sun position for a specific hour of the year and location,
        according to traditional convention.
        :param latitude_deg: Local Latitude [Degrees]. North+, South-.
        :type latitude_deg: float
        :param longitude_deg: Local Longitude [Degrees]. East+, West-.
        :type longitude_deg: float
        :param year: year
        :type year: int
        :param hoy: Hour of the year from the start. The first hour of January is 1
        :type hoy: int
        :param utc_offset: Time zone offset i.r. to Prime Meridian [hours]
        :type utc_offset: int
        :return: altitude, azimuth: Sun altitude and azimuth [Degrees] (Traditional convention)
        :rtype: tuple
        """
        # Source http://www.pveducation.org/pvcdrom/properties-of-sunlight/declination-angle
    
        # Set the date in UTC based off the hour of year and the year itself
        start_of_year = datetime.datetime(self.year, 1, 1, 0, 0, 0, 0);
        utc_datetime = start_of_year + datetime.timedelta(hours = float(hoy));
    
        # Determine the day of the year
        day_of_year = utc_datetime.timetuple().tm_yday;
    
        # Calculate B parameter (in radians) for equation of time
        b_factor = (day_of_year - 1) * ((2 * math.pi) / 365);
    
        # Equation of time: empirical equation that corrects for the eccentricity of 
        # the Earth's orbit and the Earth's axial tilt        
        equation_of_time = 229.2 * 0.000075 + 229.2 * (0.001868 * math.cos(b_factor) - \
                                                       0.032077 * math.sin(b_factor)) - \
                                                       229.2 * (0.014615 * math.cos(2 * b_factor) + \
                                                                0.04089 * math.sin(2 * b_factor));
    
        # Local Standart Time Meridian (Earth rotation 15 degrees/h)
        standard_time = 15 * self.utc_offset
    
        # Time correction between local standard time and true solar time (in minutes) 
        time_correction = 4 * (self.longitude_deg - standard_time) + equation_of_time 
    
        # Local Solar Time (in hours) = Local Time + TC (in hours)
        solar_time = utc_datetime.hour + (utc_datetime.minute + time_correction) / 60.0;
    
        # Translate Local Solar Time to an angle 
        hour_angle_rad = (math.pi * 2 / 24) * (solar_time - 12);
    
        # Calculate the declination angle: The variation due to the earths tilt
        declination_rad = math.radians(23.45 * math.sin((2 * math.pi / 365.0) * 
                                                        (day_of_year - 81)));
    
        # Convert latitude to to radians
        latitude_rad = math.radians(self.latitude_deg);
    
        # Altitude Position of the sun in radians
        sun_alt_rad = math.asin(math.cos(latitude_rad) * math.cos(declination_rad) * 
                                 math.cos(hour_angle_rad) +
                                 math.sin(latitude_rad) * math.sin(declination_rad));
    
        # Azimuth Position fo the sun in radians
        sun_az_rad = math.acos((math.sin(declination_rad) *
                                    math.cos(latitude_rad) - math.cos(declination_rad) *
                                    math.sin(latitude_rad) * math.cos(hour_angle_rad)) /
                                    math.cos(sun_alt_rad))
    
        # Range azimuth [0, 360) degrees
        if hour_angle_rad > 0 or hour_angle_rad < - math.pi :
            sun_az_rad = math.pi * 2 - sun_az_rad
    
        return math.degrees(sun_alt_rad), math.degrees(sun_az_rad)
    
    def calc_sun_vector(self,sun_alt, sun_az):
        sun_alt_rad = math.radians(sun_alt)
        sun_az_rad = math.radians(sun_az)
        sunvec_x = -math.sin(sun_az_rad) * math.cos(sun_alt_rad)
        sunvec_y = -math.cos(sun_az_rad) * math.cos(sun_alt_rad)
        sunvec_z = -math.sin(sun_alt_rad)
        
        return rc.Geometry.Vector3d(sunvec_x,sunvec_y,sunvec_z)

    def calc_relative_azimuth(self, sun_az):
        """
        Calculates the sun position relative to the facade orientation.
        :param sun_az: Sun azimuth [Degrees] (Traditional convention)
        :type sun_az: float
        :return: relative_sun_az: Sun azimuth [Degrees] (Facade convention)
        :rtype: float
        """
                    
        relative_sun_az = 180 - sun_az + math.degrees(self.window_azimuth_rad)
        if relative_sun_az < -180:
            relative_sun_az +=360
        return relative_sun_az
    
    def calc_relative_altitude(self, sun_alt):
        relative_sun_alt = sun_alt - 90 + math.degrees(self.window_altitude_rad)
        return relative_sun_alt


class WindowRadiation(object):
    """
    Adapted from shaded_window.py and radiation.py from the ASF_Control 
    repository by Joan DM 
    
    Contains functions to calculate window radiation with shading.
    """

    def __init__(self, window_geometry, context_geometry, point_in_zone, albedo=0.12, glass_solar_transmittance=0.7, glass_light_transmittance=0.8):
        
        self.window_geometry = window_geometry
        self.point_in_zone = point_in_zone
        
        #context geometry can either be a single surface, a polysurface, or a mixed list.
        context_surfaces = []
        for geometry in context_geometry:
            g = rs.coercebrep(geometry)
            brep_faces = gh.DeconstructBrep(g)[0]
            if brep_faces:
                if type(brep_faces) is not list:
                    # geometry is a single surface
                    s = brep_faces.Faces[0].DuplicateSurface()
                    context_surfaces.append(s)
                else:
                    # geometry was a polysurface and got deconstructed into a list
                    for b in brep_faces:
                        s = b.Faces[0].DuplicateSurface()
                        context_surfaces.append(s)
        
        
        self.clipper_accuracy = 100000
        self.extract_window_geometry()
        self.transform_all_shades(context_surfaces)
        
        self.albedo = albedo
        self.glass_solar_transmittance = glass_solar_transmittance
        self.glass_light_transmittance = glass_light_transmittance
        
        self.perez_coef = {'f_11': [-0.0083117, 0.1299457, 0.3296958, 0.5682053, 0.873028, 1.1326077, 1.0601591, 0.677747],
              'f_12': [0.5877285, 0.6825954, 0.4868735, 0.1874525, -0.3920403, -1.2367284, -1.5999137, -0.3272588],
              'f_13': [-0.0620636, -0.1513752, -0.2210958, -0.295129, -0.3616149, -0.4118494, -0.3589221, -0.2504286],
              'f_21': [-0.0596012, -0.0189325, 0.055414, 0.1088631, 0.2255647, 0.2877813, 0.2642124, 0.1561313],
              'f_22': [0.0721249, 0.065965, -0.0639588, -0.1519229, -0.4620442, -0.8230357, -1.127234, -1.3765031],
              'f_23': [-0.0220216, -0.0288748, -0.0260542, -0.0139754, 0.0012448, 0.0558651, 0.1310694, 0.2506212]}
    
    def extract_window_geometry(self):
        """
        Extract geometry properties 
        """
        
        north = rc.Geometry.Vector3d(0,1,0)
        vertical = rc.Geometry.Vector3d(0,0,1)
        
        # Window centroid
        self.window_centroid = rs.SurfaceAreaCentroid(self.window_geometry)[0]
        
        # Initialize outward facing normal
        normal = rs.SurfaceNormal(self.window_geometry,[0.5,0.5])
        window_zone_vector = gh.Vector2Pt(self.window_centroid,self.point_in_zone)
        if abs(rs.VectorAngle(normal,window_zone_vector[0])) < 90:
            self.window_normal = rs.VectorReverse(normal)
        else:
            self.window_normal = normal
        
        # Initialize window area and plane
        self.window_area = rs.Area(self.window_geometry)
        self.window_vertices = rs.SurfaceEditPoints(self.window_geometry)
        
        self.window_edges = rs.JoinCurves(rs.DuplicateEdgeCurves(self.window_geometry))
        edges = rs.DuplicateEdgeCurves(self.window_geometry)
        edge_lengths = [rs.CurveLength(e) for e in edges]
        edge_vectors = [round(rs.VectorCreate(rs.CurveStartPoint(e),rs.CurveEndPoint(e))[2]) for e in edges] 
        window_width = edge_lengths[0] if edge_vectors[0] == 0 else edge_lengths[1]
        window_height = edge_lengths[0] if edge_vectors[0] !=0 else edge_lengths[1]
        window_intpoint_vertices = [IntPoint(0,0), IntPoint(self.clipper_accuracy*window_width, 0), IntPoint(self.clipper_accuracy*window_width, self.clipper_accuracy*window_height), IntPoint(0, self.clipper_accuracy*window_height)]
        self.window_frame = List[IntPoint](window_intpoint_vertices)
        
        # window plane starts from the bottom left corner of the window, facing the window
        u0 = rs.SurfaceDomain(self.window_geometry,0)[0]
        v0 = rs.SurfaceDomain(self.window_geometry,1)[0]
        self.window_plane = rs.PlaneFromNormal(rs.EvaluateSurface(self.window_geometry,u0,v0),self.window_normal)
        
        self.window_transformation = gh.Orient(None,self.window_plane,gh.XYPlane(rc.Geometry.Point3d(0,0,0)))[1]
        


        # Find panel azimuth (X-Z axes). Set it in the proper quarter (+ CW / -CCW i.r to Z axis)
        azimuth = math.pi - math.atan2(-self.window_normal[0], self.window_normal[1])
        if azimuth > math.pi:
            azimuth -= 2*math.pi 
        
        try:
            altitude = rs.VectorAngle(rc.Geometry.Vector3d(0,0,1),normal)
        except ValueError:
            altitude = 0
        
        self.window_altitude_rad = math.radians(altitude)
        self.window_azimuth_rad = azimuth
    
    def sort_surface_vertices_clockwise(self,points,centroid,normal):
        """
        :return sorted_points: list of points sorted clockwise
        :rtype sorted_points: list
        """
        
        # Generate plane opposing the dominant direction of the surface
        if normal[0] == 0 and normal[2] == 0:
            # Normal parallel to y axis
            if normal[1]>0:
                plane = rc.Geometry.Plane(centroid,rc.Geometry.Vector3d(0,-1,0))
            else:
                plane = rc.Geometry.Plane(centroid,rc.Geometry.Vector3d(0,1,0))
        
        if normal[1] == 0 and normal[2] == 0:
            # Normal parallel to x axis
            if normal[0]>0:
                plane = rc.Geometry.Plane(centroid,rc.Geometry.Vector3d(-1,0,0))
            else:
                plane = rc.Geometry.Plane(centroid,rc.Geometry.Vector3d(1,0,0))
        
        if normal[2] != 0:
            # Normal not on xy plane
            plane = rc.Geometry.Plane(centroid,rc.Geometry.Vector3d(0,0,-1))
        
        else:
            rs.VectorReverse(normal)
            # Trying this out! Need to remember what the previous code did...
            plane = rc.Geometry.Plane(centroid,rs.VectorReverse(normal))
            
        # calculate vectors from center to points
        vecs = [centroid - point for point in points]
        
        # calculate angles between vectors and plane x-axis
        angles = [rc.Geometry.Vector3d.VectorAngle(plane.XAxis,v,plane) for v in vecs]

        sorted_points = [p[1] for p in sorted(zip(angles,points))] 
        return sorted_points
    
    def transform_shade(self,shade):
        """
        Transform the vertices of a shading surface to match the window as projected on the xy plane.
        If some vertices are behind the window, the part of the shade in front of the window is considered.
        if all the vertices are behind the window, a null value is returned.
        
        :return rounded_oriented_centroid: oriented centroid. rounding affects how easily array patterns are identified.
        :return transformed points: 
        """
        points = rs.SurfacePoints(shade,True)
        centroid, e= rs.SurfaceAreaCentroid(shade)
        normal = rs.SurfaceNormal(shade,[0.5,0.5])
        
        # If the surface intersects with the window, add the intersection points.
        intersection = gh.BrepXPlane(shade,self.window_plane)[0]
        if intersection is not None:
            start = rs.CurveParameter(intersection, 0)
            end = rs.CurveParameter(intersection,1)
            points.append(rs.EvaluateCurve(intersection, start))
            points.append(rs.EvaluateCurve(intersection, end))
        
        clockwise_shade_points = self.sort_surface_vertices_clockwise(points,centroid,normal)
        
        def round2(x):
            return int(round(x*100))
        
        oriented_centroid = gh.Transform(centroid,self.window_transformation)
        rounded_oriented_centroid = [round2(oriented_centroid[0]),round2(oriented_centroid[1])]
        
        transformed_points = []
        for p in clockwise_shade_points:
            p1 = gh.Transform(p,self.window_transformation)
            if round(p1[2],2) >= 0:
                # point is in front of window
                transformed_points.append(p1)
        
        return rounded_oriented_centroid, transformed_points
    
    def transform_all_shades(self,context_geometry):
        """
        Check if points are aligned horizontally or vertically and create an array
        Transform context
        Return a dictionary with
        key: shade centroid
        value: transformed points for each shade
        """
        
        centroids_and_points = {}
        for xg in context_geometry:
            c,points = self.transform_shade(xg) 
            for p in points:
                centroids_and_points[c[0],c[1]] = points
        
        #TODO: give this more tolerance so that it can also pick up array-like configurations.
        unique_x = sorted(list(set([x[0] for x in centroids_and_points.keys()])))
        if len(unique_x) < len(centroids_and_points):
            x_dict = {k:v for k,v in enumerate(unique_x)}
            self.nrows = len(unique_x)
        
        unique_y = sorted(list(set([x[1] for x in centroids_and_points.keys()])))
        if len(unique_x) < len(centroids_and_points):
            y_dict = {k:v for k,v in enumerate(unique_y)}
            self.ncols = len(y_dict)
        
        self.context = {}
        if 'x_dict' in locals() or 'y_dict' in locals():
            # Create new dictionary with tuple keys
            # This step will be important when implementing self shading.
            # It is not necessary when only considering window shading.
            for x,y in product(range(self.nrows),range(self.ncols)):
                self.context[x,y] = centroids_and_points[x_dict[x],y_dict[y]]
        else:
            # No array pattern, create a one-dimensional matrix
            for i,x in enumerate(centroids_and_points.values()):
                self.context[i,0] = x
    
    def calc_shadow(self, shade, relative_sun_alt, relative_sun_az):
        """
        Coordinate system:
        X = Horizontal direction, parallel to glazing surface
        Y = Vertical direction, parallel to glazing surface
        Z = Perpendicular in respect of glazing surface
        """
        
        def transform_point(point,sunvec_x,sunvec_y,sunvec_z):
            # Define t paramater from parametric equation. Window plane is placed z=0 
            t = - point[2] / sunvec_z;
            # Project points using sun vector
            x_point = point[0] + sunvec_x * t;
            y_point = point[1] + sunvec_y * t;
            return x_point, y_point
        
        # Align relative_sun_az with window plane, convert angles to radians
        # Note: this procedure is only done when is sunny, hence relative_sun_az in range[-90, 90];
        relative_sun_az_rad, relative_sun_alt_rad = map(math.radians, [relative_sun_az + 90, relative_sun_alt]);
    
        # Create sun vector
        sunvec_x = math.cos(relative_sun_az_rad) * math.cos(relative_sun_alt_rad);
        sunvec_y = math.sin(relative_sun_alt_rad);
        sunvec_z = math.sin(relative_sun_az_rad) * math.cos(relative_sun_alt_rad);
        
        a, b = self.longer_edge_of_shade(shade)
        a_shadow = transform_point(a,sunvec_x,sunvec_y,sunvec_z)
        b_shadow = transform_point(b,sunvec_x,sunvec_y,sunvec_z)
        pv_shadow_vector = [b_shadow[0] - a_shadow[0], b_shadow[1] - a_shadow[1]]
        
        # Calculate the projection on a 2-D surface (x,y)
        shadowintpoints = [] # IntPoints for clipping
        for point_3d in shade:   
            x_point, y_point = transform_point(point_3d,sunvec_x,sunvec_y,sunvec_z)
            shadowintpoints.append(IntPoint(self.clipper_accuracy*x_point,self.clipper_accuracy*y_point))
            
        return List[IntPoint](shadowintpoints)#, pv_shadow_vector
    
    def longer_edge_of_shade(self,shade_points):
        """
        Identify the longer edge of the shading geometry, from 
        the window-side outwards, in the window coordinate system.
        Returns: a (closest to the window), b (farthest from the window)
        """
        long_edge_length = 0
        for ii in range(0,len(shade_points)-1):
            if abs(rs.Distance(shade_points[ii],shade_points[ii+1])) > long_edge_length:
                long_edge_length = abs(rs.Distance(shade_points[ii],shade_points[ii+1]))
                if rs.DistanceToPlane(self.window_plane,shade_points[ii]) < rs.DistanceToPlane(self.window_plane,shade_points[ii+1]):
                    a = shade_points[ii]
                    b = shade_points[ii+1]
                else:
                    a = shade_points[ii+1]
                    b = shade_points[ii]
        
        return a,b
        
    def calc_gross_shadows(self,relative_sun_alt,relative_sun_az):
        """
        projects all shading objects onto window coordinate plane
        """
        gross_shadows = {}
        pv_vectors = {}
        if type(self.context.keys()[0]) == float:
            for k in self.context.keys():
                gross_shadows[k] = self.calc_shadow(self.context[k],relative_sun_alt,relative_sun_az)
        elif type(self.context.keys()[0]) == tuple:
            # an array configuration has been identified.
            for i,j in self.context.keys():
                gross_shadows[i,j] = self.calc_shadow(self.context[i,j],relative_sun_alt,relative_sun_az)
        return gross_shadows
    
    def draw_unshaded_polygons(self,clipper_result):
        """
        optional function which returns polylines of the trimmed shadows for each hour
        :param clipper_result: a .net List of polygons (list of intPoints)
        :type clipper_result: List(List(intPoint))
        """
        clipper_result_geometry = []

        u_domain = rs.SurfaceDomain(self.window_geometry,0)[1]
        
        for ms in clipper_result:
            points = []
            for p in ms:
#                points.append(rc.Geometry.Point3d(p.X/self.clipper_accuracy, p.Y/self.clipper_accuracy,0))
#                print p.X/self.clipper_accuracy
#                u = rs.SurfaceParameter(self.window_geometry, p.X/self.clipper_accuracy)
#                v = rs.SurfaceParameter(self.window_geometry, p.Y/self.clipper_accuracy)
#                points.append(rs.EvaluateSurface(self.window_geometry, u,v))
                points.append(rs.EvaluateSurface(self.window_geometry, p.X/self.clipper_accuracy,p.Y/self.clipper_accuracy))
            clipper_result_geometry.append(gh.PolyLine(points,closed=True))
        return clipper_result_geometry

    def calc_unshaded_area(self,unshaded_polygons):
        """
        For a given set of shadows (one hour)
        Subtract from net_shadows dictionary the regions outside the window frame and
        compute the total shadow laying on the window as a % of its area.
        """
        
        shaded_area = 0
        for p in unshaded_polygons:
            shaded_area += abs(clipper.Area(p))
         
        try:
            assert clipper.Area(self.window_frame) >= shaded_area
            return (clipper.Area(self.window_frame) - shaded_area)/ self.clipper_accuracy**2
        except AssertionError:
            # clipper failed and returned overlapping geometries.
            print 'clipping warning for hour: ', h

    def calc_unshaded_polygons(self,gross_shadows):
        """
        Combine shadow polygons and remove them from the window frame.
        Returns: polygons representing unshaded areas on the window.
        """
        # Initialise shadows list
        subj = []
        shadows = List[List[IntPoint]](gross_shadows.values())
        merged_shadows = List[List[IntPoint]]()
        clipper.Clear()
        clipper.AddPolygons(shadows,polyType.ptSubject)
        union = clipper.Execute(clipType.ctUnion, merged_shadows, polyFillType.pftNonZero, polyFillType.pftNonZero)
        
        # Remove parts of shadows which lie outside the window frame
        unshaded_polygons = List[List[IntPoint]]()
        clipper.Clear()
        clipper.AddPolygon(self.window_frame,polyType.ptClip)
        clipper.AddPolygons(merged_shadows,polyType.ptSubject)
        diff = clipper.Execute(clipType.ctIntersection, unshaded_polygons, polyFillType.pftNonZero, polyFillType.pftNonZero)
        
        if diff:
            return unshaded_polygons
        else:
            return None

    def perez(self, angle_incidence, sun_alt, norm_radiation, hor_radiation):
        """"
        Credits: JoanDM
        Calculate the diffuse irradiation components (circumsolar and horizon brightening)
        via Perez 1990 model.
    
        :param angle_incidence: Angle of incidence between sun rays and panel [rad]
        :type angle_incidence: float
        :param sun_alt: sun altitude
        :type sun_alt: float
        :param norm_radiation: Direct normal radiation [Wh/m^2]. 
        :type norm_radiation: float
        :param hor_radiation: Diffuse horizontal radiation [Wh/m^2]. 
        :type hor_radiation: float
        :type sun_alt: dict {key:string, value:float}
        :return: circumsolar and horizon brightening components [Wh/m^2].
        :rtype: tuple(float, float)
        """
        
        a = max(0, math.cos(angle_incidence))
        b = max(math.cos(math.radians(85)), math.cos(angle_incidence))
        k = 5.534 / 1000000
        zenith = 90 - sun_alt
    
        if 0 <= zenith <= 87.5:
            epsilon = ((norm_radiation + hor_radiation) / float(hor_radiation) + k * ( zenith ** 3)) / (1 + k * (zenith ** 3))
            
            air_mass = (math.cos(b) + 0.15 * (93.9 - zenith) ** (-1.253) ) ** (-1)
            
            delta = hor_radiation * (air_mass / 1367.0)
            
            if epsilon <= 1.065:
                coeff_selector = 0
            elif epsilon <= 1.23:
                coeff_selector = 1
            elif epsilon <= 1.5:
                coeff_selector = 2
            elif epsilon <= 1.95:
                coeff_selector = 3
            elif epsilon <= 2.8:
                coeff_selector = 4
            elif epsilon <= 4.5:
                coeff_selector = 5
            elif epsilon <= 6.2:
                coeff_selector = 6
            elif epsilon > 6.2:
                coeff_selector = 7
            
            f_11 = self.perez_coef['f_11'][coeff_selector]
            f_12 = self.perez_coef['f_12'][coeff_selector]
            f_13 = self.perez_coef['f_13'][coeff_selector]
            f_21 = self.perez_coef['f_21'][coeff_selector]
            f_22 = self.perez_coef['f_22'][coeff_selector]
            f_23 = self.perez_coef['f_23'][coeff_selector]
            
            zenith_rad = math.radians(zenith)
            f_1 = max(0, f_11 + delta * f_12 + zenith_rad * f_13)
            f_2 = max(0, f_21 + delta * f_22 + zenith_rad * f_23)
            
            diff_circum = hor_radiation * f_1 * a / b
            diff_horizon = hor_radiation * f_2 * math.sin(self.window_altitude_rad)
    
        else: #87.5 < zenith <  90:
            f_1 = 0
            diff_circum = 0
            diff_horizon = 0
    
        return  diff_circum, diff_horizon, f_1
    
    def calc_diffuse_irradiation(self, norm_radiation, hor_radiation, view_factor, sun_alt, angle_incidence):
        """
        credits: JoanDM
        
        TODO: Include the surrounding effect of the shading geometry on the window view factor
        """
        
        diff_circum, diff_horizon, f_1 = self.perez(angle_incidence, sun_alt, norm_radiation, hor_radiation);
        
        diff_isotropic = hor_radiation * view_factor * (1 - f_1)
                                               
        if diff_circum > 2 * diff_isotropic:
            diff_isotropic = 0.0
        
        if diff_circum > 2 * diff_horizon:
            diff_horizon = 0
        return (diff_isotropic + diff_circum + diff_horizon) * self.window_area
    
    def calc_ground_ref_irradiation(self, norm_radiation, hor_radiation, sun_alt, view_factor):
        sun_alt_rad = math.radians(sun_alt)
        global_hor_radiation = norm_radiation * math.sin(sun_alt_rad) + hor_radiation
        ground_ref_radiation = self.albedo * global_hor_radiation * (1 - view_factor)
        
        return ground_ref_radiation
    
    def radiation(self, sun_alt, angle_incidence, normal_irradiation, horizontal_irradiation, normal_lux, horizontal_lux, unshaded_area):
        """
        credits: JoanDM
        """
        dir_irradiation = 0
        diff_irradiation = 0
        diff_irradiation_simple = 0
        ground_ref_irradiation = 0
        normal_lux = 0
        window_diff_lux = 0
        window_ground_ref_lux = 0
        
        # VF is a combination of tilt and shaded area
        view_factor = ((1 + math.cos(self.window_altitude_rad)) / 2) * unshaded_area/self.window_area
        
        # Direct Irradiation
        if normal_irradiation != 0 and math.cos(angle_incidence) > 0:
            
            dir_irradiation = normal_irradiation * math.cos(angle_incidence) * unshaded_area
        
        if normal_lux != 0:
            window_dir_lux = normal_lux * math.cos(angle_incidence) * unshaded_area
        
        # Diffuse Irradiation
        if not horizontal_irradiation == 0:
            diff_irradiation_simple =  horizontal_irradiation * ((1 + math.cos(self.window_altitude_rad)) / 2) * self.window_area
            diff_irradiation = self.calc_diffuse_irradiation(normal_irradiation, horizontal_irradiation,
                                                             view_factor, sun_alt, angle_incidence)  
            # Calculate diffuse and reflected irradiation
            ground_ref_irradiation = self.calc_ground_ref_irradiation(normal_irradiation, 
                                                                 horizontal_irradiation, sun_alt,
                                                                 view_factor)  
        
        window_diff_lux = horizontal_lux * view_factor
        window_ground_ref_lux = self.albedo * horizontal_lux * (1 - view_factor)
        window_illuminance =  normal_lux + window_diff_lux + window_ground_ref_lux
        
        return dir_irradiation, diff_irradiation, diff_irradiation_simple, ground_ref_irradiation, window_illuminance


class Element(object):
    """
    Element object representing an opaque or transparent element.
    ##OUTLOOK##
    absorptivity, reflectivity: Not yet implemented, but adding these parameters 
    would improve the accuracy of solar gains calculations in opaque and 
    transparent elements.The RC model would need to be adapted for this. Note to 
    future developers: when adding attributes, make sure to upadate the copy 
    method below with the same attributes!
    """
    def __init__(self, name = 'Element', area = 15.0, u_value = 1.0, frame_factor=1.0, opaque = True):

        self.name = name
        self.area = area
        self.u_value = u_value
        self.h_tr = self.u_value * self.area #element conductance [W/K]
        self.frame_factor = frame_factor
        self.opaque = opaque


class ElementBuilder(object):
    def __init__(self,element_name,u_value,frame_factor,opaque):
        self.element_name = element_name if element_name is not None else 'Wall'
        self.opaque = opaque
        if self.opaque:
            self.u_value = 0.2 if u_value is None else u_value
            self.frame_factor = 1
        else:
            self.u_value = 1 if u_value is None else u_value
            self.frame_factor = 1 if frame_factor is None else frame_factor

    def get_data(self,surface):
        centroid = rs.SurfaceAreaCentroid(surface)[0]
        normal = rs.SurfaceNormal(surface,[0.5,0.5])
        area = rs.SurfaceArea(surface)[0]
        return centroid,normal,area

    def add_element(self,geometry):
        centroids = []
        normals = []
        elements = []
        if geometry is not None:
            # Invalid input
            if not (rs.IsSurface(geometry) or rs.IsPolysurface(geometry)):
                error = """geometry is not a surface or polysurface"""
                e = ghKernel.GH_RuntimeMessageLevel.Error
                ghenv.Component.AddRuntimeMessage(e, error)
        
            # Single surface
            elif rs.IsSurface(geometry):
                centroid,normal,area = self.get_data(geometry)
                centroids = centroid
                normals = normal
                elements = [sc.sticky['Element'](
                    name=self.element_name,
                    area=area,
                    u_value=self.u_value, 
                    frame_factor=self.frame_factor,
                    opaque = self.opaque)]

            # Polysurface
            elif rs.IsPolysurface(geometry):
                all_parts = rs.ExplodePolysurfaces(geometry)
                for part in all_parts:
                    centroid,normal,area,azimuth,angle = self.get_data(part)
                    centroids.append(centroid)
                    normals.append(normal)
                    element = sc.sticky['Element'](
                        name=self.element_name,
                        area=area,
                        u_value=self.u_value, 
                        frame_factor=self.frame_factor,
                        opaque = self.opaque)
                    elements.append(element)
        return centroids,normals,elements


class ThermalBridge(object):
    def __init__(self,
                 name,
                 length,
                 linear_conductance):
        self.name = name if name is not None else 'Thermal bridge'
        self.name = name
        self.length = length
        self.linear_conductance = linear_conductance
        self.h_tr = length * linear_conductance


class ThermalZone(object):
    def __init__(self,
                 occupants = 1, 
                 elements = None,
                 thermal_bridges = None,
                 floor_area = 34.3,
                 volume = 106.33,
                 thermal_capacitance_per_floor_area=165000,
                 ach_vent=1.5,
                 ach_infl=0.5,
                 ventilation_efficiency=1,
                 t_set_heating = 20,
                 t_set_cooling = 26,
                 max_heating_energy_per_floor_area = 12,
                 max_cooling_energy_per_floor_area = -12,
                 heating_supply_system=sc.sticky["DirectHeater"],
                 cooling_supply_system=sc.sticky["DirectCooler"],
                 heating_emission_system=sc.sticky["AirConditioning"],
                 cooling_emission_system=sc.sticky["AirConditioning"],
                ):

        # Element objects
        self.elements = elements
        self.elements_added = 0  # for reporting purposes
        self.element_names = []  # for reporting purposes
        
        # Thermal bridges
        self.thermal_bridges = thermal_bridges

        # direct inputs
        self.occupants = occupants
        self.floor_area = floor_area
        self.volume = volume
        self.total_internal_area = floor_area * 4.5 #ISO13790 7.2.2.2
        self.ach_vent = ach_vent
        self.ach_infl = ach_infl
        self.ventilation_efficiency = ventilation_efficiency
        self.thermal_capacitance_per_floor_area=thermal_capacitance_per_floor_area
        self.max_heating_energy_per_floor_area = max_heating_energy_per_floor_area
        self.max_cooling_energy_per_floor_area = max_cooling_energy_per_floor_area
        self.heating_supply_system = heating_supply_system
        self.heating_emission_system = heating_emission_system
        self.cooling_supply_system = cooling_supply_system
        self.cooling_emission_system = cooling_emission_system
        self.t_set_heating = t_set_heating
        self.t_set_cooling = t_set_cooling

        # initialize envelope properties
        self.h_tr_em = 0
        self.h_tr_w = 0
        self.wall_area = 0
        self.window_area = 0
        self.window_wall_ratio = 0

        #if left blank, zone elements will be set to ASF default values
        if self.elements == None:
            Window = Element(name='ASF_window', area=13.5, u_value=1.1)
            Wall = Element(name='ASF_wall', area=1.69, u_value=0.2)
            self.elements = [Window,Wall]

        for element in self.elements:
            self.add_elements(element)

        if self.thermal_bridges is not None:
            for tb in self.thermal_bridges:
                self.add_thermal_bridge(tb)


    def add_elements(self,e):
        self.element_names.append(e.name)
        # add surface conductances to conductance of mass
        if e.opaque:
            self.h_tr_em += e.h_tr
            self.elements_added += 1
            self.wall_area += e.area
        # add window conductance to window conductances
        else:
            self.h_tr_w += e.h_tr
            self.elements_added += 1
            self.window_area += e.area

    def add_thermal_bridge(self,tb):
        self.h_tr_em += tb.h_tr
        self.elements_added += 1

    def summary(self):
        #report the number of elements added to facilitate bug detection
        print 'Zone with %i elements'%len(self.elements)
        print 'Conductance of opaque surfaces to exterior [W/K], h_tr_em:', self.h_tr_em
        print 'Conductance to exterior through glazed surfaces [W/K], h_tr_w', self.h_tr_w
        print 'windows: %f m2, walls: %f m2, total: %f m2'%(self.window_area,self.wall_area,self.window_area+self.wall_area)
        try:
            print 'window to wall ratio: %f %%\n'%(int(round(self.window_area/self.wall_area*100,1)))
        except ZeroDivisionError:
            print '100% glazed'


class ElementBuilding(object):
    """
    The modular version. 
    Sets the parameters of the building.
    """

    def __init__(self,
                 zone=None,
                 lighting_load=11.7,
                 lighting_control=300.0,
                 lighting_utilisation_factor=0.45,
                 lighting_maintenance_factor=0.9,
                 ):

        # Initialise Zone
        self.zone = zone
        if self.zone == None:
            self.zone = Zone()

        # Fenestration and Lighting Properties
        self.lighting_load = lighting_load  # [kW/m2] lighting load
        self.lighting_control = lighting_control  # [lux] Lighting set point
        # How the light entering the window is transmitted to the working plane
        self.lighting_utilisation_factor = lighting_utilisation_factor
        # How dirty the window is. Section 2.2.3.1 Environmental Science
        # Handbook
        self.lighting_maintenance_factor = lighting_maintenance_factor

        # Calculated Properties
        self.floor_area = self.zone.floor_area # [m2] Floor Area
        # [m2] Effective Mass Area assuming a medium weight building #12.3.1.2
        # very light: 2.5 x Af
        # heavy: 3.0 x Af
        # very heavy: 3.5 x Af
        self.mass_area = self.floor_area * 2.5
        self.room_vol = self.zone.volume# [m3] Room Volume
        self.total_internal_area = self.zone.total_internal_area
        # TODO: Standard doesn't explain what A_t is. Needs to be checked
        self.A_t = self.total_internal_area

        # Single Capacitance  5 conductance Model Parameters
        # [kWh/K] Room Capacitance. Default based on ISO standard 12.3.1.2 for medium heavy buildings
        self.c_m = self.zone.thermal_capacitance_per_floor_area * self.floor_area
        # Conductance of opaque surfaces to exterior [W/K]
        self.h_tr_em = self.zone.h_tr_em
        # Conductance to exterior through glazed surfaces [W/K], based on
        # U-wert of 1W/m2K
        self.h_tr_w = self.zone.h_tr_w
        # Determine the ventilation conductance
        ach_tot = self.zone.ach_infl + self.zone.ach_vent  # Total Air Changes Per Hour
        # temperature adjustment factor taking ventilation and infiltration
        # [ISO: E -27]
        if ach_tot > 0:
            b_ek = 1 - (self.zone.ach_vent / ach_tot) * self.zone.ventilation_efficiency
        else:
            b_ek = 1
        # b_ek = (self.zone.ach_vent/ ach_tot) * self.zone.ventilation_efficiency
        self.h_ve_adj = 1200 * b_ek * self.room_vol * \
            (ach_tot / 3600)  # Conductance through ventilation [W/M]
        # transmittance from the internal air to the thermal mass of the
        # building
        self.h_tr_ms = 9.1 * self.mass_area
        # Conductance from the conditioned air to interior building surface
        self.h_tr_is = self.total_internal_area * 3.45

        # Thermal set points
        self.t_set_heating = self.zone.t_set_heating
        self.t_set_cooling = self.zone.t_set_cooling

        # Thermal Properties
        self.has_heating_demand = False  # Boolean for if heating is required
        self.has_cooling_demand = False  # Boolean for if cooling is required
        self.max_cooling_energy = zone.max_cooling_energy_per_floor_area * \
            self.floor_area  # max cooling load (W/m2)
        self.max_heating_energy = zone.max_heating_energy_per_floor_area * \
            self.floor_area  # max heating load (W/m2)
        # Building System Properties
        self.heating_supply_system = zone.heating_supply_system
        self.cooling_supply_system = zone.cooling_supply_system
        self.heating_emission_system = zone.heating_emission_system
        self.cooling_emission_system = zone.cooling_emission_system

    def solve_building_lighting(self, illuminance, occupancy):
        """
        Calculates the lighting demand for a set timestep
        :param illuminance: Illuminance transmitted through the window [Lumens]
        :type illuminance: float
        :param : Probability of full occupancy
        :type occupancy: float
        :return: self.lighting_demand, Lighting Energy Required for the timestep
        :rtype: float
        """
        # Cite: Environmental Science Handbook, SV Szokolay, Section 2.2.1.3
        # also, this might be sped up by pre-calculating the constants, but idk. first check with profiler...
        lux = (illuminance * self.lighting_utilisation_factor *
               self.lighting_maintenance_factor) / self.floor_area  # [Lux]

        if lux < self.lighting_control and occupancy > 0:
            # Lighting demand for the hour
            self.lighting_demand = self.lighting_load * self.floor_area
        else:
            self.lighting_demand = 0

    def solve_building_energy(self, internal_gains, solar_gains, t_out, t_m_prev):
        """
        Calculates the heating and cooling consumption of a building for a set timestep
        :param internal_gains: internal heat gains from people and appliances [W]
        :type internal_gains: float
        :param solar_gains: solar heat gains [W]
        :type solar_gains: float
        :param t_out: Outdoor air temperature [C]
        :type t_out: float
        :param t_m_prev: Previous air temperature [C]
        :type t_m_prev: float
        :return: self.heating_demand, space heating demand of the building
        :return: self.heating_sys_electricity, heating electricity consumption
        :return: self.heating_sys_fossils, heating fossil fuel consumption
        :return: self.cooling_demand, space cooling demand of the building
        :return: self.cooling_sys_electricity, electricity consumption from cooling
        :return: self.cooling_sys_fossils, fossil fuel consumption from cooling
        :return: self.electricity_out, electricity produced from combined heat pump systems
        :return: self.sys_total_energy, total exergy consumed (electricity + fossils) for heating and cooling
        :return: self.heating_energy, total exergy consumed (electricity + fossils) for heating
        :return: self.cooling_energy, total exergy consumed (electricity + fossils) for cooling
        :return: self.cop, Coefficient of Performance of the heating or cooling system
        :rtype: float
        """
        # Main File
        # Calculate the heat transfer definitions for formula simplification
        self.calc_h_tr_1()
        self.calc_h_tr_2()
        self.calc_h_tr_3()

        # check demand, and change state of self.has_heating_demand, and self._has_cooling_demand
        self.has_demand(internal_gains, solar_gains, t_out, t_m_prev)

        if not self.has_heating_demand and not self.has_cooling_demand:
            # no heating or cooling demand
            # calculate temperatures of building R-C-model and exit
            # --> rc_model_function_1(...)
            self.energy_demand = 0

            # y u no pep8 bra?
            self.heating_demand = 0  # Energy required by the Zone
            self.cooling_demand = 0  # Energy surplus of the Zone
            # Energy (in electricity) required by the supply system to provide
            # HeatingDemand
            self.heating_sys_electricity = 0
            # Energy (in fossil fuel) required by the supply system to provide
            # HeatingDemand
            self.heating_sys_fossils = 0
            # Energy (in electricity) required by the supply system to get rid
            # of CoolingDemand
            self.cooling_sys_electricity = 0
            # Energy (in fossil fuel) required by the supply system to get rid
            # of CoolingDemand
            self.cooling_sys_fossils = 0
            # Electricity produced by the supply system (e.g. CHP)
            self.electricity_out = 0

        else:
            # has heating/cooling demand

            # Calculates energy_demand used below
            self.calc_energy_demand(
                internal_gains, solar_gains, t_out, t_m_prev)

            self.calc_temperatures_crank_nicolson(
                self.energy_demand, internal_gains, solar_gains, t_out, t_m_prev)
            # calculates the actual t_m resulting from the actual heating
            # demand (energy_demand)

            # Calculate the Heating/Cooling Input Energy Required

            supply_director = sc.sticky["SupplyDirector"]()  # Initialise Heating System Manager

            if self.has_heating_demand:
                supply_director.set_builder(self.heating_supply_system(load=self.energy_demand,
                                                                t_out=t_out,
                                                                heating_supply_temperature=self.heating_supply_temperature,
                                                                cooling_supply_temperature=self.cooling_supply_temperature,
                                                                has_heating_demand=self.has_heating_demand,
                                                                has_cooling_demand=self.has_cooling_demand))
                supplyOut = supply_director.calc_system()
                # All Variables explained underneath line 467
                self.heating_demand = self.energy_demand
                self.heating_sys_electricity = supplyOut.electricity_in
                self.heating_sys_fossils = supplyOut.fossils_in
                self.cooling_demand = 0
                self.cooling_sys_electricity = 0
                self.cooling_sys_fossils = 0
                self.electricity_out = supplyOut.electricity_out

            elif self.has_cooling_demand:
                supply_director.set_builder(self.cooling_supply_system(load=self.energy_demand * (-1),
                                                                t_out=t_out,
                                                                heating_supply_temperature=self.heating_supply_temperature,
                                                                cooling_supply_temperature=self.cooling_supply_temperature,
                                                                has_heating_demand=self.has_heating_demand,
                                                                has_cooling_demand=self.has_cooling_demand))
                supplyOut = supply_director.calc_system()
                self.heating_demand = 0
                self.heating_sys_electricity = 0
                self.heating_sys_fossils = 0
                self.cooling_demand = self.energy_demand
                self.cooling_sys_electricity = supplyOut.electricity_in
                self.cooling_sys_fossils = supplyOut.fossils_in
                self.electricity_out = supplyOut.electricity_out

            self.cop = supplyOut.cop

        self.sys_total_energy = self.heating_sys_electricity + self.heating_sys_fossils + \
            self.cooling_sys_electricity + self.cooling_sys_fossils
        self.heating_energy = self.heating_sys_electricity + self.heating_sys_fossils
        self.cooling_energy = self.cooling_sys_electricity + self.cooling_sys_fossils

    # TODO: rename. this is expected to return a boolean. instead, it changes state??? you don't want to change state...
    # why not just return has_heating_demand and has_cooling_demand?? then call the function "check_demand"
    # has_heating_demand, has_cooling_demand = self.check_demand(...)
    def has_demand(self, internal_gains, solar_gains, t_out, t_m_prev):
        """
        Determines whether the building requires heating or cooling
        Used in: solve_building_energy()
        # step 1 in section C.4.2 in [C.3 ISO 13790]
        """
        # set energy demand to 0 and see if temperatures are within the comfort
        # range
        energy_demand = 0
        # Solve for the internal temperature t_Air
        self.calc_temperatures_crank_nicolson(
            energy_demand, internal_gains, solar_gains, t_out, t_m_prev)
        # If the air temperature is less or greater than the set temperature,
        # there is a heating/cooling load
        if self.t_air < self.t_set_heating:
            self.has_heating_demand = True
            self.has_cooling_demand = False
        elif self.t_air > self.t_set_cooling:
            self.has_cooling_demand = True
            self.has_heating_demand = False
        else:
            self.has_heating_demand = False
            self.has_cooling_demand = False

    def calc_temperatures_crank_nicolson(self, energy_demand, internal_gains, solar_gains, t_out, t_m_prev):
        """
        Determines node temperatures and computes derivation to determine the new node temperatures
        Used in: has_demand(), solve_building_energy(), calc_energy_demand()
        # section C.3 in [C.3 ISO 13790]
        """
        self.calc_heat_flow(t_out, internal_gains, solar_gains, energy_demand)

        self.calc_phi_m_tot(t_out)

        # calculates the new bulk temperature POINT from the old one
        self.calc_t_m_next(t_m_prev)

        # calculates the AVERAGE bulk temperature used for the remaining
        # calculation
        self.calc_t_m(t_m_prev)

        self.calc_t_s(t_out)

        self.calc_t_air(t_out)

        self.calc_t_opperative()
        return self.t_m, self.t_air, self.t_opperative

    def calc_energy_demand(self, internal_gains, solar_gains, t_out, t_m_prev):
        """
        Calculates the energy demand of the space if heating/cooling is active
        Used in: solve_building_energy()
        # Step 1 - Step 4 in Section C.4.2 in [C.3 ISO 13790]
        """

        # Step 1: Check if heating or cooling is needed
        #(Not needed, but doing so for readability when comparing with the standard)
        # Set heating/cooling to 0
        energy_demand_0 = 0
        # Calculate the air temperature with no heating/cooling
        t_air_0 = self.calc_temperatures_crank_nicolson(
            energy_demand_0, internal_gains, solar_gains, t_out, t_m_prev)[1]

        # Step 2: Calculate the unrestricted heating/cooling required

        # determine if we need heating or cooling based based on the condition
        # that no heating or cooling is required
        if self.has_heating_demand:
            t_air_set = self.t_set_heating
        elif self.has_cooling_demand:
            t_air_set = self.t_set_cooling
        else:
            raise NameError(
                'heating function has been called even though no heating is required')

        # Set a heating case where the heating load is 10x the floor area (10
        # W/m2)
        energy_floorAx10 = 10 * self.floor_area

        # Calculate the air temperature obtained by having this 10 W/m2
        # setpoint
        t_air_10 = self.calc_temperatures_crank_nicolson(
            energy_floorAx10, internal_gains, solar_gains, t_out, t_m_prev)[1]

        # Determine the unrestricted heating/cooling off the building
        self.calc_energy_demand_unrestricted(
            energy_floorAx10, t_air_set, t_air_0, t_air_10)

        # Step 3: Check if available heating or cooling power is sufficient
        if self.max_cooling_energy <= self.energy_demand_unrestricted <= self.max_heating_energy:

            self.energy_demand = self.energy_demand_unrestricted
            self.t_air_ac = t_air_set  # not sure what this is used for at this stage TODO

        # Step 4: if not sufficient then set the heating/cooling setting to the
        # maximum
        # necessary heating power exceeds maximum available power
        elif self.energy_demand_unrestricted > self.max_heating_energy:
            self.energy_demand = self.max_heating_energy

        # necessary cooling power exceeds maximum available power
        elif self.energy_demand_unrestricted < self.max_cooling_energy:

            self.energy_demand = self.max_cooling_energy

        else:
            self.energy_demand = 0
            raise ValueError('unknown radiative heating/cooling system status')

        # calculate system temperatures for Step 3/Step 4
        self.calc_temperatures_crank_nicolson(
            self.energy_demand, internal_gains, solar_gains, t_out, t_m_prev)

    def calc_energy_demand_unrestricted(self, energy_floorAx10, t_air_set, t_air_0, t_air_10):
        """
        Calculates the energy demand of the system if it has no maximum output restrictions
        # (C.13) in [C.3 ISO 13790]
        Based on the Thales Intercept Theorem.
        Where we set a heating case that is 10x the floor area and determine the temperature as a result
        Assuming that the relation is linear, one can draw a right angle triangle.
        From this we can determine the heating level required to achieve the set point temperature
        This assumes a perfect HVAC control system
        """
        self.energy_demand_unrestricted = energy_floorAx10 * \
            (t_air_set - t_air_0) / (t_air_10 - t_air_0)

    def calc_heat_flow(self, t_out, internal_gains, solar_gains, energy_demand):
        """
        Calculates the heat flow from the solar gains, heating/cooling system, and internal gains into the building
        The input of the building is split into the air node, surface node, and thermal mass node based on
        on the following equations
        #C.1 - C.3 in [C.3 ISO 13790]
        Note that this equation has diverged slightly from the standard
        as the heating/cooling node can enter any node depending on the
        emission system selected
        """

        # Calculates the heat flows to various points of the building based on the breakdown in section C.2, formulas C.1-C.3
        # Heat flow to the air node
        self.phi_ia = 0.5 * internal_gains
        # Heat flow to the surface node
        self.phi_st = (1 - (self.mass_area / self.A_t) - (self.h_tr_w /
                            (9.1 * self.A_t))) * (0.5 * internal_gains + solar_gains)
        # Heatflow to the thermal mass node
        self.phi_m = (self.mass_area / self.A_t) * \
            (0.5 * internal_gains + solar_gains)

        # We call the EmissionDirector to modify these flows depending on the
        # system and the energy demand
        emDirector = sc.sticky["EmissionDirector"]()
        # Set the emission system to the type specified by the user

        emDirector.set_builder(self.heating_emission_system(
            energy_demand=energy_demand))
        # Calculate the new flows to each node based on the heating system
        flows = emDirector.calc_flows()

        # Set modified flows to building object
        self.phi_ia += flows.phi_ia_plus
        self.phi_st += flows.phi_st_plus
        self.phi_m += flows.phi_m_plus

        # Set supply temperature to building object
        # TODO: This currently is constant for all emission systems, to be
        # modified in the future
        self.heating_supply_temperature = flows.heating_supply_temperature
        self.cooling_supply_temperature = flows.cooling_supply_temperature

    def calc_t_m_next(self, t_m_prev):
        """
        Primary Equation, calculates the temperature of the next time step
        # (C.4) in [C.3 ISO 13790]
        """

        self.t_m_next = ((t_m_prev * ((self.c_m / 3600.0) - 0.5 * (self.h_tr_3 + self.h_tr_em))) +
                         self.phi_m_tot) / ((self.c_m / 3600.0) + 0.5 * (self.h_tr_3 + self.h_tr_em))

    def calc_phi_m_tot(self, t_out):
        """
        Calculates a global heat transfer. This is a definition used to simplify equation
        calc_t_m_next so it's not so long to write out
        # (C.5) in [C.3 ISO 13790]
        # h_ve = h_ve_adj and t_supply = t_out [9.3.2 ISO 13790]
        """

        t_supply = t_out  # ASSUMPTION: Supply air comes straight from the outside air
        h_tr_3 = False
        for key in self.__dict__:
            if 'h_tr_3' in key:
                h_tr_3 = True
        if not h_tr_3: # This is the case when heating is supplied and crank-nicholson is called directly
            self.calc_h_tr_3()


        self.phi_m_tot = self.phi_m + self.h_tr_em * t_out + \
            self.h_tr_3 * (self.phi_st + self.h_tr_w * t_out + self.h_tr_1 *
                           ((self.phi_ia / self.h_ve_adj) + t_supply)) / self.h_tr_2

    def calc_h_tr_1(self):
        """
        Definition to simplify calc_phi_m_tot
        # (C.6) in [C.3 ISO 13790]
        """
        self.h_tr_1 = 1.0 / (1.0 / self.h_ve_adj + 1.0 / self.h_tr_is)

    def calc_h_tr_2(self):
        """
        Definition to simplify calc_phi_m_tot
        # (C.7) in [C.3 ISO 13790]
        """
        h_tr_1 = False
        for key in self.__dict__:
            if 'h_tr_1' in key:
                h_tr_1 = True
        if not h_tr_1:
            self.calc_h_tr_1 ()

        self.h_tr_2 = self.h_tr_1 + self.h_tr_w

    def calc_h_tr_3(self):
        """
        Definition to simplify calc_phi_m_tot
        # (C.8) in [C.3 ISO 13790]
        """
        h_tr_2 = False
        for key in self.__dict__:
            if 'h_tr_2' in key:
                h_tr_2 = True
        if not h_tr_2:
            self.calc_h_tr_2()

        self.h_tr_3 = 1.0 / (1.0 / self.h_tr_2 + 1.0 / self.h_tr_ms)

    def calc_t_m(self, t_m_prev):
        """
        Temperature used for the calculations, average between newly calculated and previous bulk temperature
        # (C.9) in [C.3 ISO 13790]
        """
        self.t_m = (self.t_m_next + t_m_prev) / 2.0
    def calc_t_s(self, t_out):
        """
        Calculate the temperature of the inside room surfaces
        # (C.10) in [C.3 ISO 13790]
        # h_ve = h_ve_adj and t_supply = t_out [9.3.2 ISO 13790]
        """

        t_supply = t_out  # ASSUMPTION: Supply air comes straight from the outside air

        self.t_s = (self.h_tr_ms * self.t_m + self.phi_st + self.h_tr_w * t_out + self.h_tr_1 * \
            (t_supply + self.phi_ia / self.h_ve_adj)) / \
            (self.h_tr_ms + self.h_tr_w + self.h_tr_1)

    def calc_t_air(self, t_out):
        """
        Calculate the temperature of the air node
        # (C.11) in [C.3 ISO 13790]
        # h_ve = h_ve_adj and t_supply = t_out [9.3.2 ISO 13790]
        """

        t_supply = t_out

        # Calculate the temperature of the inside air
        self.t_air = (self.h_tr_is * self.t_s + self.h_ve_adj *
                      t_supply + self.phi_ia) / (self.h_tr_is + self.h_ve_adj)

    def calc_t_opperative(self):
        """
        The opperative temperature is a weighted average of the air and mean radiant temperatures.
        It is not used in any further calculation at this stage
        # (C.12) in [C.3 ISO 13790]
        """
        
        self.t_opperative = 0.3 * self.t_air + 0.7 * self.t_s


class Building(object):
    """
    The original code as found in RC_BuildingSimulator
    """

    def __init__(self,
                 window_area=13.5,
                 external_envelope_area=15.19,
                 room_depth=7,
                 room_width=4.9,
                 room_height=3.1,
                 lighting_load=11.7,
                 lighting_control=300,
                 lighting_utilisation_factor=0.45,
                 lighting_maintenance_factor=0.9,
                 u_walls=0.2,
                 u_windows=1.1,
                 g_windows=0.6,
                 ach_vent=1.5,
                 ach_infl=0.5,
                 ventilation_efficiency=0,
                 thermal_capacitance_per_floor_area=165000,
                 t_set_heating=20,
                 t_set_cooling=26,
                 max_cooling_energy_per_floor_area=-12,
                 max_heating_energy_per_floor_area=12,
                 heating_supply_system=sc.sticky["DirectHeater"],
                 cooling_supply_system=sc.sticky["DirectCooler"],
                 heating_emission_system=sc.sticky["AirConditioning"],
                 cooling_emission_system=sc.sticky["AirConditioning"],
                 ):

        # Building Dimensions
        self.window_area = window_area  # [m2] Window Area
        self.room_depth = room_depth  # [m] Room Depth
        self.room_width = room_width  # [m] Room Width
        self.room_height = room_height  # [m] Room Height

        # Fenestration and Lighting Properties
        self.g_windows = g_windows
        self.lighting_load = lighting_load  # [kW/m2] lighting load
        self.lighting_control = lighting_control  # [lux] Lighting set point
        # How the light entering the window is transmitted to the working plane
        self.lighting_utilisation_factor = lighting_utilisation_factor
        # How dirty the window is. Section 2.2.3.1 Environmental Science
        # Handbook
        self.lighting_maintenance_factor = lighting_maintenance_factor

        # Calculated Properties
        self.floor_area = room_depth * room_width  # [m2] Floor Area
        # [m2] Effective Mass Area assuming a medium weight building #12.3.1.2
        self.mass_area = self.floor_area * 2.5
        self.room_vol = room_width * room_depth * \
            room_height  # [m3] Room Volume
        self.total_internal_area = self.floor_area * 2 + \
            room_width * room_height * 2 + room_depth * room_height * 2
        # TODO: Standard doesn't explain what A_t is. Needs to be checked
        self.A_t = self.total_internal_area

        # Single Capacitance  5 conductance Model Parameters
        # [kWh/K] Room Capacitance. Default based on ISO standard 12.3.1.2 for medium heavy buildings
        self.c_m = thermal_capacitance_per_floor_area * self.floor_area
        # Conductance of opaque surfaces to exterior [W/K]
        self.h_tr_em = u_walls * (external_envelope_area - window_area)
        # Conductance to exterior through glazed surfaces [W/K], based on
        # U-wert of 1W/m2K
        self.h_tr_w = u_windows * window_area

        # Determine the ventilation conductance
        ach_tot = ach_infl + ach_vent  # Total Air Changes Per Hour
        # temperature adjustment factor taking ventilation and infiltration
        # [ISO: E -27]
        b_ek = (1 - (ach_vent / (ach_tot)) * ventilation_efficiency)
        self.h_ve_adj = 1200 * b_ek * self.room_vol * \
            (ach_tot / 3600)  # Conductance through ventilation [W/M]
        # transmittance from the internal air to the thermal mass of the
        # building
        self.h_tr_ms = 9.1 * self.mass_area
        # Conductance from the conditioned air to interior building surface
        self.h_tr_is = self.total_internal_area * 3.45

        # Thermal set points
        self.t_set_heating = t_set_heating
        self.t_set_cooling = t_set_cooling

        # Thermal Properties
        self.has_heating_demand = False  # Boolean for if heating is required
        self.has_cooling_demand = False  # Boolean for if cooling is required
        self.max_cooling_energy = max_cooling_energy_per_floor_area * \
            self.floor_area  # max cooling load (W/m2)
        self.max_heating_energy = max_heating_energy_per_floor_area * \
            self.floor_area  # max heating load (W/m2)

        # Building System Properties
        self.heating_supply_system = heating_supply_system
        self.cooling_supply_system = cooling_supply_system
        self.heating_emission_system = heating_emission_system
        self.cooling_emission_system = cooling_emission_system

    def solve_building_lighting(self, illuminance, occupancy):
        """
        Calculates the lighting demand for a set timestep

        :param illuminance: Illuminance transmitted through the window [Lumens]
        :type illuminance: float
        :param occupancy: Probability of full occupancy
        :type occupancy: float

        :return: self.lighting_demand, Lighting Energy Required for the timestep
        :rtype: float

        """
        # Cite: Environmental Science Handbook, SV Szokolay, Section 2.2.1.3
        # also, this might be sped up by pre-calculating the constants, but idk. first check with profiler...
        lux = (illuminance * self.lighting_utilisation_factor *
               self.lighting_maintenance_factor) / self.floor_area  # [Lux]

        if lux < self.lighting_control and occupancy > 0:
            # Lighting demand for the hour
            self.lighting_demand = self.lighting_load * self.floor_area
        else:
            self.lighting_demand = 0

    def solve_building_energy(self, internal_gains, solar_gains, t_out, t_m_prev):
        """
        Calculates the heating and cooling consumption of a building for a set timestep

        :param internal_gains: internal heat gains from people and appliances [W]
        :type internal_gains: float
        :param solar_gains: solar heat gains [W]
        :type solar_gains: float
        :param t_out: Outdoor air temperature [C]
        :type t_out: float
        :param t_m_prev: Previous air temperature [C]
        :type t_m_prev: float

        :return: self.heating_demand, space heating demand of the building
        :return: self.heating_sys_electricity, heating electricity consumption
        :return: self.heating_sys_fossils, heating fossil fuel consumption 
        :return: self.cooling_demand, space cooling demand of the building
        :return: self.cooling_sys_electricity, electricity consumption from cooling
        :return: self.cooling_sys_fossils, fossil fuel consumption from cooling
        :return: self.electricity_out, electricity produced from combined heat pump systems
        :return: self.sys_total_energy, total exergy consumed (electricity + fossils) for heating and cooling
        :return: self.heating_energy, total exergy consumed (electricity + fossils) for heating 
        :return: self.cooling_energy, total exergy consumed (electricity + fossils) for cooling
        :return: self.cop, Coefficient of Performance of the heating or cooling system
        :rtype: float

        """
        # Main File

        # Calculate the heat transfer definitions for formula simplification
        self.calc_h_tr_1()
        self.calc_h_tr_2()
        self.calc_h_tr_3()

        # check demand, and change state of self.has_heating_demand, and self._has_cooling_demand
        self.has_demand(internal_gains, solar_gains, t_out, t_m_prev)

        if not self.has_heating_demand and not self.has_cooling_demand:

            # no heating or cooling demand
            # calculate temperatures of building R-C-model and exit
            # --> rc_model_function_1(...)
            self.energy_demand = 0

            # y u no pep8 bra?
            self.heating_demand = 0  # Energy required by the zone
            self.cooling_demand = 0  # Energy surplus of the zone
            # Energy (in electricity) required by the supply system to provide
            # HeatingDemand
            self.heating_sys_electricity = 0
            # Energy (in fossil fuel) required by the supply system to provide
            # HeatingDemand
            self.heating_sys_fossils = 0
            # Energy (in electricity) required by the supply system to get rid
            # of CoolingDemand
            self.cooling_sys_electricity = 0
            # Energy (in fossil fuel) required by the supply system to get rid
            # of CoolingDemand
            self.cooling_sys_fossils = 0
            # Electricity produced by the supply system (e.g. CHP)
            self.electricity_out = 0

        else:

            # has heating/cooling demand

            # Calculates energy_demand used below
            self.calc_energy_demand(
                internal_gains, solar_gains, t_out, t_m_prev)

            self.calc_temperatures_crank_nicolson(
                self.energy_demand, internal_gains, solar_gains, t_out, t_m_prev)
            # calculates the actual t_m resulting from the actual heating
            # demand (energy_demand)

            # Calculate the Heating/Cooling Input Energy Required

            supply_director = sc.sticky["SupplyDirector"]()  # Initialise Heating System Manager

            if self.has_heating_demand:
                supply_director.set_builder(self.heating_supply_system(load=self.energy_demand, 
                                                                t_out=t_out, 
                                                                heating_supply_temperature=self.heating_supply_temperature,
                                                                cooling_supply_temperature=self.cooling_supply_temperature, 
                                                                has_heating_demand=self.has_heating_demand, 
                                                                has_cooling_demand=self.has_cooling_demand))
                supplyOut = supply_director.calc_system()
                # All Variables explained underneath line 467
                self.heating_demand = self.energy_demand
                self.heating_sys_electricity = supplyOut.electricity_in
                self.heating_sys_fossils = supplyOut.fossils_in
                self.cooling_demand = 0
                self.cooling_sys_electricity = 0
                self.cooling_sys_fossils = 0
                self.electricity_out = supplyOut.electricity_out

            elif self.has_cooling_demand:
                supply_director.set_builder(self.cooling_supply_system(load=self.energy_demand * (-1), 
                                                                t_out=t_out, 
                                                                heating_supply_temperature=self.heating_supply_temperature,
                                                                cooling_supply_temperature=self.cooling_supply_temperature, 
                                                                has_heating_demand=self.has_heating_demand, 
                                                                has_cooling_demand=self.has_cooling_demand))
                supplyOut = supply_director.calc_system()
                self.heating_demand = 0
                self.heating_sys_electricity = 0
                self.heating_sys_fossils = 0
                self.cooling_demand = self.energy_demand
                self.cooling_sys_electricity = supplyOut.electricity_in
                self.cooling_sys_fossils = supplyOut.fossils_in
                self.electricity_out = supplyOut.electricity_out

            self.cop = supplyOut.cop

        self.sys_total_energy = self.heating_sys_electricity + self.heating_sys_fossils + \
            self.cooling_sys_electricity + self.cooling_sys_fossils
        self.heating_energy = self.heating_sys_electricity + self.heating_sys_fossils
        self.cooling_energy = self.cooling_sys_electricity + self.cooling_sys_fossils

    # TODO: rename. this is expected to return a boolean. instead, it changes state??? you don't want to change state...
    # why not just return has_heating_demand and has_cooling_demand?? then call the function "check_demand"
    # has_heating_demand, has_cooling_demand = self.check_demand(...)
    def has_demand(self, internal_gains, solar_gains, t_out, t_m_prev):
        """
        Determines whether the building requires heating or cooling
        Used in: solve_building_energy()

        # step 1 in section C.4.2 in [C.3 ISO 13790]
        """

        # set energy demand to 0 and see if temperatures are within the comfort
        # range
        energy_demand = 0
        # Solve for the internal temperature t_Air
        self.calc_temperatures_crank_nicolson(
            energy_demand, internal_gains, solar_gains, t_out, t_m_prev)

        # If the air temperature is less or greater than the set temperature,
        # there is a heating/cooling load
        if self.t_air < self.t_set_heating:
            self.has_heating_demand = True
            self.has_cooling_demand = False
        elif self.t_air > self.t_set_cooling:
            self.has_cooling_demand = True
            self.has_heating_demand = False
        else:
            self.has_heating_demand = False
            self.has_cooling_demand = False

    def calc_temperatures_crank_nicolson(self, energy_demand, internal_gains, solar_gains, t_out, t_m_prev):
        """
        Determines node temperatures and computes derivation to determine the new node temperatures
        Used in: has_demand(), solve_building_energy(), calc_energy_demand()
        # section C.3 in [C.3 ISO 13790]
        """

        self.calc_heat_flow(t_out, internal_gains, solar_gains, energy_demand)

        self.calc_phi_m_tot(t_out)

        # calculates the new bulk temperature POINT from the old one
        self.calc_t_m_next(t_m_prev)

        # calculates the AVERAGE bulk temperature used for the remaining
        # calculation
        self.calc_t_m(t_m_prev)

        self.calc_t_s(t_out)

        self.calc_t_air(t_out)

        self.calc_t_opperative()

        return self.t_m, self.t_air, self.t_opperative

    def calc_energy_demand(self, internal_gains, solar_gains, t_out, t_m_prev):
        """
        Calculates the energy demand of the space if heating/cooling is active
        Used in: solve_building_energy()
        # Step 1 - Step 4 in Section C.4.2 in [C.3 ISO 13790]
        """

        # Step 1: Check if heating or cooling is needed 
        #(Not needed, but doing so for readability when comparing with the standard)
        # Set heating/cooling to 0
        energy_demand_0 = 0
        # Calculate the air temperature with no heating/cooling
        t_air_0 = self.calc_temperatures_crank_nicolson(
            energy_demand_0, internal_gains, solar_gains, t_out, t_m_prev)[1]

        # Step 2: Calculate the unrestricted heating/cooling required

        # determine if we need heating or cooling based based on the condition
        # that no heating or cooling is required
        if self.has_heating_demand:
            t_air_set = self.t_set_heating
        elif self.has_cooling_demand:
            t_air_set = self.t_set_cooling
        else:
            raise NameError(
                'heating function has been called even though no heating is required')

        # Set a heating case where the heating load is 10x the floor area (10
        # W/m2)
        energy_floorAx10 = 10 * self.floor_area

        # Calculate the air temperature obtained by having this 10 W/m2
        # setpoint
        t_air_10 = self.calc_temperatures_crank_nicolson(
            energy_floorAx10, internal_gains, solar_gains, t_out, t_m_prev)[1]

        # Determine the unrestricted heating/cooling off the building
        self.calc_energy_demand_unrestricted(
            energy_floorAx10, t_air_set, t_air_0, t_air_10)

        # Step 3: Check if available heating or cooling power is sufficient
        if self.max_cooling_energy <= self.energy_demand_unrestricted <= self.max_heating_energy:

            self.energy_demand = self.energy_demand_unrestricted
            self.t_air_ac = t_air_set  # not sure what this is used for at this stage TODO

        # Step 4: if not sufficient then set the heating/cooling setting to the
        # maximum
        # necessary heating power exceeds maximum available power
        elif self.energy_demand_unrestricted > self.max_heating_energy:

            self.energy_demand = self.max_heating_energy

        # necessary cooling power exceeds maximum available power
        elif self.energy_demand_unrestricted < self.max_cooling_energy:

            self.energy_demand = self.max_cooling_energy

        else:
            self.energy_demand = 0
            raise ValueError('unknown radiative heating/cooling system status')

        # calculate system temperatures for Step 3/Step 4
        self.calc_temperatures_crank_nicolson(
            self.energy_demand, internal_gains, solar_gains, t_out, t_m_prev)

    def calc_energy_demand_unrestricted(self, energy_floorAx10, t_air_set, t_air_0, t_air_10):
        """
        Calculates the energy demand of the system if it has no maximum output restrictions
        # (C.13) in [C.3 ISO 13790]


        Based on the Thales Intercept Theorem. 
        Where we set a heating case that is 10x the floor area and determine the temperature as a result 
        Assuming that the relation is linear, one can draw a right angle triangle. 
        From this we can determine the heating level required to achieve the set point temperature
        This assumes a perfect HVAC control system
        """
        self.energy_demand_unrestricted = energy_floorAx10 * \
            (t_air_set - t_air_0) / (t_air_10 - t_air_0)

    def calc_heat_flow(self, t_out, internal_gains, solar_gains, energy_demand):
        """
        Calculates the heat flow from the solar gains, heating/cooling system, and internal gains into the building

        The input of the building is split into the air node, surface node, and thermal mass node based on
        on the following equations

        #C.1 - C.3 in [C.3 ISO 13790]

        Note that this equation has diverged slightly from the standard 
        as the heating/cooling node can enter any node depending on the
        emission system selected

        """

        # Calculates the heat flows to various points of the building based on the breakdown in section C.2, formulas C.1-C.3
        # Heat flow to the air node
        self.phi_ia = 0.5 * internal_gains
        # Heat flow to the surface node
        self.phi_st = (1 - (self.mass_area / self.A_t) - (self.h_tr_w /
                            (9.1 * self.A_t))) * (0.5 * internal_gains + solar_gains)
        # Heatflow to the thermal mass node
        self.phi_m = (self.mass_area / self.A_t) * \
            (0.5 * internal_gains + solar_gains)

        # We call the EmissionDirector to modify these flows depending on the
        # system and the energy demand
        emDirector = sc.sticky["EmissionDirector"]()
        # Set the emission system to the type specified by the user
        emDirector.set_builder(self.heating_emission_system(
            energy_demand=energy_demand))
        # Calculate the new flows to each node based on the heating system
        flows = emDirector.calc_flows()

        # Set modified flows to building object
        self.phi_ia += flows.phi_ia_plus
        self.phi_st += flows.phi_st_plus
        self.phi_m += flows.phi_m_plus

        # Set supply temperature to building object
        # TODO: This currently is constant for all emission systems, to be
        # modified in the future
        self.heating_supply_temperature = flows.heating_supply_temperature
        self.cooling_supply_temperature = flows.cooling_supply_temperature

    def calc_t_m_next(self, t_m_prev):
        """
        Primary Equation, calculates the temperature of the next time step
        # (C.4) in [C.3 ISO 13790]
        """

        self.t_m_next = ((t_m_prev * ((self.c_m / 3600.0) - 0.5 * (self.h_tr_3 + self.h_tr_em))) +
                         self.phi_m_tot) / ((self.c_m / 3600.0) + 0.5 * (self.h_tr_3 + self.h_tr_em))

    def calc_phi_m_tot(self, t_out):
        """
        Calculates a global heat transfer. This is a definition used to simplify equation
        calc_t_m_next so it's not so long to write out
        # (C.5) in [C.3 ISO 13790]
        # h_ve = h_ve_adj and t_supply = t_out [9.3.2 ISO 13790]
        """

        t_supply = t_out  # ASSUMPTION: Supply air comes straight from the outside air

        self.phi_m_tot = self.phi_m + self.h_tr_em * t_out + \
            self.h_tr_3 * (self.phi_st + self.h_tr_w * t_out + self.h_tr_1 *
                           ((self.phi_ia / self.h_ve_adj) + t_supply)) / self.h_tr_2

    def calc_h_tr_1(self):
        """
        Definition to simplify calc_phi_m_tot
        # (C.6) in [C.3 ISO 13790]

        """
        self.h_tr_1 = 1.0 / (1.0 / self.h_ve_adj + 1.0 / self.h_tr_is)

    def calc_h_tr_2(self):
        """
        Definition to simplify calc_phi_m_tot
        # (C.7) in [C.3 ISO 13790]

        """

        self.h_tr_2 = self.h_tr_1 + self.h_tr_w

    def calc_h_tr_3(self):
        """
        Definition to simplify calc_phi_m_tot
        # (C.8) in [C.3 ISO 13790]

        """

        self.h_tr_3 = 1.0 / (1.0 / self.h_tr_2 + 1.0 / self.h_tr_ms)


    def calc_t_m(self, t_m_prev):
        """
        Temperature used for the calculations, average between newly calculated and previous bulk temperature
        # (C.9) in [C.3 ISO 13790]
        """
        self.t_m = (self.t_m_next + t_m_prev) / 2.0

    def calc_t_s(self, t_out):
        """
        Calculate the temperature of the inside room surfaces
        # (C.10) in [C.3 ISO 13790]
        # h_ve = h_ve_adj and t_supply = t_out [9.3.2 ISO 13790]
        """

        t_supply = t_out  # ASSUMPTION: Supply air comes straight from the outside air

        self.t_s = (self.h_tr_ms * self.t_m + self.phi_st + self.h_tr_w * t_out + self.h_tr_1 * \
            (t_supply + self.phi_ia / self.h_ve_adj)) / \
            (self.h_tr_ms + self.h_tr_w + self.h_tr_1)

    def calc_t_air(self, t_out):
        """
        Calculate the temperature of the air node
        # (C.11) in [C.3 ISO 13790]
        # h_ve = h_ve_adj and t_supply = t_out [9.3.2 ISO 13790]
        """

        t_supply = t_out

        # Calculate the temperature of the inside air
        self.t_air = (self.h_tr_is * self.t_s + self.h_ve_adj *
                      t_supply + self.phi_ia) / (self.h_tr_is + self.h_ve_adj)

    def calc_t_opperative(self):
        """
        The opperative temperature is a weighted average of the air and mean radiant temperatures. 
        It is not used in any further calculation at this stage
        # (C.12) in [C.3 ISO 13790]
        """

        self.t_opperative = 0.3 * self.t_air + 0.7 * self.t_s

error = "Connect emissions_systems and supply_systems components!"
e = ghKernel.GH_RuntimeMessageLevel.Error

if systems == [] or len(systems) != 2:
    ghenv.Component.AddRuntimeMessage(e, error)

if any(['Emission' in s for s in systems]) and any(['Supply' in s for s in systems]):
    sc.sticky["RelativeSun"] = RelativeSun
    sc.sticky["WindowRadiation"] = WindowRadiation
    sc.sticky["Element"] = Element
    sc.sticky["ElementBuilder"] = ElementBuilder
    sc.sticky["ThermalBridge"] = ThermalBridge
    sc.sticky["ThermalZone"] = ThermalZone
    sc.sticky["RCModel"] = ElementBuilding
    sc.sticky["RCModelClassic"] = Building
    sc.sticky["HivePreparation"] = HivePreparation
    sc.sticky['pushback']()
    print 'Modular Building Physics is go!'
# ---------- end hive ----------
one_hour = PythonScript(base_hoy=doy_hoy.HOY, offset=Slider(12, range=0..100))  # -> out, a, b
# ---------- one_hour: Python ----------
a = base_hoy + offset
b = base_hoy + offset + 1
# ---------- end one_hour ----------
subtraction = Subtraction(A=eval, B=doy_hoy.HOY)
pt_2 = Point(<point referenced from the Rhino model>)
brep_2 = Brep(<brep referenced from the Rhino model>)
button = Button()  # disabled

u_value = Panel("0.73")
g_value = Panel("0.2")
glazedelement = Hive_GlazedElement(
    window_name="window_SE",
    window_geometry=rotate_4.Geometry,
    point_in_zone=rotate.Geometry,
    context_geometry=flatten(brep),
    location=getsimulationdata.location,
    irradiation=getsimulationdata.irradiation,
    solar_transmittance=g_value,
    draw_shadows=Toggle(True))  # -> out, glazed_elements, solar_gains, illuminance, port, window_centroid, window_normal, window_area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; inputs point_in_zone: Point3d, context_geometry: list, location: list, irradiation: tree
# ---------- glazedelement: Python ----------
# Glazed element
#
# HIVE: A energy simulation plugin developed by the A/S chair at ETH Zurich
# This component is based on building_physics.py in the RC_BuildingSimulator Github repository
# https://github.com/architecture-building-systems/RC_BuildingSimulator
# Extensive documentation is available on the project wiki.
#
# Author: Justin Zarb <zarbj@student.ethz.ch>
#
# This file is part of HIVE
#
# Licensing/Copyright and liability comments go here.
# <Copyright 2018, Architecture and Building Systems - ETH Zurich>
# <Licence: MIT>

"""
Dual function component which returns a building element and calculates solar gains.
-
Provided by HIVE 0.0.1
    
    Args:
        _window_geometry: a surface or polysurface representing the 
             of the element
        window_name: optional element name
        _u_value: element u-value [W/(m^2.K)]. Typical values for a single glazed window 4.8, good double-glazed window:1-1.2, triple-glazed window: 0.15.
        solar_transmittance: (aka. g-factor) the percentage of radiation that can pass through glazing
        light_transmittance: the percentage of light that passes through glazing
    Returns:
        centers: list of center points to check input
        normals: list of normals to check input
        glazed_elements: list of element objects representing each surface that was inputted.
        solar_gains: hourly solar gains through the glazed element as a list
        illuminance: hourly illuminance through the glazed element as a list
        shadow: surface representing the shadow which corresponds to hour_to_visualise
"""

ghenv.Component.Name = "Hive_GlazedElement"
ghenv.Component.NickName = 'GlazedElement'
ghenv.Component.Message = 'VER 0.0.1\nMAY_11_2018'
ghenv.Component.IconDisplayMode = ghenv.Component.IconDisplayMode.application
ghenv.Component.Category = "Hive"
ghenv.Component.SubCategory = "1 | Zone"
# ComponentExposure=1

import scriptcontext as sc
import rhinoscriptsyntax as rs
import Rhino as rc
import ghpythonlib.components as gh
import Grasshopper.Kernel as ghKernel
import math
import datetime

def build_glazed_element(window_name,_window_geometry,u_value,frame_factor):
    if not sc.sticky.has_key('ElementBuilder'): 
        return "Add the modular RC component to the canvas!"
    
    name = 'Glazed Element' if window_name is None else window_name

    Builder = sc.sticky['ElementBuilder'](name,u_value,frame_factor,False)
    centers,normals,glazed_elements = Builder.add_element(_window_geometry)
    
    for g in glazed_elements:
        print 'element name: ',g.name,'\n U-value:',g.u_value,'W/m2K \n area:',g.area,'m2'
    
    return centers, normals, glazed_elements


def solar_gains_through_element(window_geometry, point_in_zone, context_geometry, location, irradiation,solar_transmittance,light_transmittance, draw_shadows):
    """
    #TODO: Deal with polysurface input for shading
    #TODO: collect points and merge shadows in pyclipper for a faster shading visualisation.
    """
    if not sc.sticky.has_key('WindowRadiation'): return "Add the modular building physics component to the canvas!"
    hive_preparation = sc.sticky["HivePreparation"]()
    
    solar_transmittance = solar_transmittance if solar_transmittance is not None else 0.7
    light_transmittance = light_transmittance if light_transmittance is not None else 0.8
    
    Window = sc.sticky["WindowRadiation"](window_geometry=_window_geometry,
                                          point_in_zone=_point_in_zone,
                                          context_geometry=context_geometry)
    try:
        Sun = sc.sticky["RelativeSun"](location=location,
                          window_azimuth_rad=Window.window_azimuth_rad,
                          window_altitude_rad=Window.window_altitude_rad,
                          normal = Window.window_normal)
    except:
        print 'For solar calculations, connect Location data from the Hive_getSimulationData'
    
    # Results
    dir_irradiation = []
    diff_irradiation = []
    diff_irradiation_simple = []
    ground_ref_irradiation = []
    window_illuminance = []
    window_solar_gains = []
    
    # Diagnostic
    sun_vectors = []
    incidence_angles = []
    unshaded_polys = []
    shading_factor = []
    
    for b in range(irradiation.BranchCount):
        # Initialize results
        incidence = 0
        solar_gains_this_hour = 0
        lighting = 0
        dnirr = 0
        dhirr = 0
        dhirr_simple = 0
        grirr = 0
        sun_vector = None
        unshaded_polys_hour = [None]
        
        # read radiation data
        hoy, normal_irradiation, horizontal_irradiation, normal_illuminance, horizontal_illuminance = list(irradiation.Branch(b))
        
        # Calculate sun
        relative_sun_alt,relative_sun_az = Sun.calc_relative_sun_position(hoy)
        sun_alt,sun_az = Sun.calc_sun_position(hoy)
        # print sun_az, relative_sun_az
        incidence = math.acos(math.cos(math.radians(relative_sun_alt)) * math.cos(math.radians(relative_sun_az)))

        # Calculate shading
        if context_geometry == []:
            # Window is unshaded
            unshaded_area = Window.window_area
            
            if draw_shadows and sun_alt > 0 and abs(relative_sun_az) < 90:
                unshaded_polys_hour = (Window.window_edges)
        else:
            #TODO: add a condition that checks shading geometry
            shadow_dict = Window.calc_gross_shadows(relative_sun_alt,relative_sun_az)
            unshaded_polygons = Window.calc_unshaded_polygons(shadow_dict)
            unshaded_area = Window.calc_unshaded_area(unshaded_polygons)
            if draw_shadows and sun_alt > 0 and abs(relative_sun_az) < 90:
                unshaded_polys_hour = Window.draw_unshaded_polygons(unshaded_polygons)
        
        dnirr, dhirr, dhirr_simple, grirr, lighting = Window.radiation(sun_alt, incidence, normal_irradiation, horizontal_irradiation, normal_illuminance, horizontal_illuminance, unshaded_area)
        solar_gains_this_hour = solar_transmittance * (dnirr + dhirr + grirr)
        shading_factor.append(unshaded_area/Window.window_area)

        if sun_alt > 0 and abs(relative_sun_az) < 90:
            sun_vector = Sun.calc_sun_vector(sun_alt,sun_az)
            incidence = math.degrees(incidence)
        
        # Append results
        dir_irradiation.append(dnirr)
        diff_irradiation.append(dhirr)
        diff_irradiation_simple.append(dhirr_simple)
        sun_vectors.append(sun_vector)
        incidence_angles.append(incidence)
        ground_ref_irradiation.append(grirr)
        window_illuminance.append(lighting)
        window_solar_gains.append(solar_gains_this_hour)
        if draw_shadows and sun_alt>0:
            unshaded_polys.append(unshaded_polys_hour)
    
    unshaded = hive_preparation.list_to_tree(unshaded_polys)
    
    print 'Total solar gains:', round(sum(window_solar_gains),2),'Wh'
    print 'Mean shading factor: ', sum(shading_factor)/len(shading_factor)
    
    test = Window.transform_shade(Window.window_geometry)[1]
    test += Window.transform_shade(context_geometry)[1]
    
    return test, incidence_angles, Window.window_centroid, Window.window_normal, sun_vectors, window_solar_gains, window_illuminance, dir_irradiation, diff_irradiation, diff_irradiation_simple, ground_ref_irradiation, unshaded

""""""""""""""""""""""""""""""""""""""""""""""""""""""""""""""""""""""""""""""

centers, normals, glazed_elements = build_glazed_element(window_name, _window_geometry, u_value, frame_factor)
window_area = [g.area for g in glazed_elements]

if (location and len(irradiation.AllData())>0 and _point_in_zone and  _window_geometry):
    test, incidence_angle, window_centroid, window_normal, sun_vectors, solar_gains, illuminance, dir_irradiation, diff_irradiation, diff_irradiation_simple, ground_ref_irradiation, unshaded = solar_gains_through_element(_window_geometry, _point_in_zone, context_geometry, location, irradiation, solar_transmittance, light_transmittance, draw_shadows)
    
else:
    warning = """Warning: Insufficient inputs for solar calculations"""
    print 'location:',location
    print '_point_in_zone:',_point_in_zone
    print '_window_geometry:',_window_geometry
    print 'irradiation:',irradiation
    w = ghKernel.GH_RuntimeMessageLevel.Warning
    ghenv.Component.AddRuntimeMessage(w, warning)
# ---------- end glazedelement ----------

item_2 = ListItem(List=getsimulationdata.temperature, Index=0, Wrap=True)
glazedelement_2 = Hive_Downsample(hourly_data=glazedelement.solar_gains, start_hoy=doy_hoy.HOY)  # -> out, flatten(daily_values), flatten(monthly_values), annual_value; inputs hourly_data: list
# ---------- glazedelement_2: Python ----------
# Downsample data
#
# HIVE: A energy simulation plugin developed by the A/S chair at ETH Zurich
# This component is based on building_physics.py in the RC_BuildingSimulator Github repository
# https://github.com/architecture-building-systems/RC_BuildingSimulator
# Extensive documentation is available on the project wiki.
#
# Author: Justin Zarb <zarbj@student.ethz.ch>
#
# This file is part of HIVE
#
# Licensing/Copyright and liability comments go here.
# <Copyright 2018, Architecture and Building Systems - ETH Zurich>
# <Licence: MIT>

"""
Define an opaque by adding a surface.
-
Provided by HIVE 0.0.1
    
    Args:
        _hourly_data: a list of hourly values
        _start_hoy: the hour of the year corresponding to the first value.
    Returns:
        daily_values:
        monthly_values:
        annual_value:
"""

ghenv.Component.Name = "Hive_Downsample"
ghenv.Component.NickName = 'GlazedElement'
ghenv.Component.Message = 'VER 0.0.1\nMAY_07_2018'
ghenv.Component.IconDisplayMode = ghenv.Component.IconDisplayMode.application
ghenv.Component.Category = "Hive"
ghenv.Component.SubCategory = "3 | Results"
# ComponentExposure=5

import scriptcontext as sc
import Grasshopper.Kernel as ghKernel

def main(_start_hoy, _hourly_data):
    if not sc.sticky.has_key('HivePreparation'): 
        return "Add the modular RC component to the canvas!"
    hive_preparation = sc.sticky['HivePreparation']()
    data_dict = dict(zip(range(int(_start_hoy),int(_start_hoy+len(_hourly_data))),_hourly_data))
    dates = [hive_preparation.hour2Date(hoy,True) for hoy in data_dict.keys()]
    
    days = max(data_dict.keys())//24+1
    daily = dict(zip(range(0,days), [0]*days))
    monthly = dict(zip(range(0,12),[0]*12))
    annual = sum(_hourly_data)
    
    for hoy,data in data_dict.iteritems():
        date = hive_preparation.hour2Date(hoy,True)
        print date[1]
        monthly[date[1]] += data
        doy = (hoy-1)//24
        daily[doy] += data
    
    dailyTree = hive_preparation.dict_to_tree(daily)
    monthlyTree = hive_preparation.dict_to_tree(monthly)
    
    return dailyTree, monthlyTree, annual


if _start_hoy and _hourly_data:
    daily_values, monthly_values, annual_value = main(_start_hoy,_hourly_data)

elif _hourly_data and _start_hoy is None:
    warning = """Warning: Add a value to _start_hoy!"""
    w = ghKernel.GH_RuntimeMessageLevel.Warning
    ghenv.Component.AddRuntimeMessage(w, warning)
# ---------- end glazedelement_2 ----------

# ----
# Update userObjects and Github folder
panel_2 = Panel("C:\Users\Zghiru\Documents\GitHub\hive\HIVE_RC_simulator")
panel_3 = Panel("*")
exporthive = Hive_exportHive(components=glazedelement_2.out, targetFolder=panel_2, export=Toggle(False))  # -> readMe; inputs components: list
# ---------- exporthive: Python ----------
#
# Hive: An educational plugin developed by the A/S chair at ETH Zurich
# 
# This file is part of Hive.
# 
#TODO: Check terms of GNU modification.
#
# This component is based on the Ladybug_Export Ladybug component. It has been
# slightly modified to work without Ladybug, but it does exactly the same thing.
# 
# Ladybug is a free software registered under a GNU public license.
# 

"""
Based on Ladybug_Export Ladybug. Code Developers of Hive can use this component to export user objects and source code that they create to the Github folder on their computer.
This eases and automates the steps before commiting new components to the Github.
This component was written thanks to Giulio Piacentino a really helpful example.
-
Provided by Hive 0.0.1

    Args:
        _components: Any output from a new Ladybug (or Honeybee) component that you wish to export. Right now, only one component can be connected at a time but you can input a "*" (without quotation marsk) to search all changed Ladybug components on a grasshopper canvas.
        _targetFolder: A file path on your system which you would like to export the user object and source code to.  For most code developers, this file path will lead to their Github folder for Ladybug (or Honeybee), which is usually installed in "My Documents" by default. Exported source code will be saved at .\src and exported userObjects will be saved at .\userObjects in this _targetFolder.
        _export: Set to "True" to export Ladybug (or Honeybee) components to the _targerFolder.
    Returns:
        readMe!: ...
"""
ghenv.Component.Name = "Hive_exportHive"
ghenv.Component.NickName = 'exportHive'
ghenv.Component.Message = 'VER 0.0.1\nMAR_22_2018'
ghenv.Component.Category = "Hive"
ghenv.Component.SubCategory = "4 | Developers"


import Grasshopper.Folders as folders
import Grasshopper.Kernel as gh
import scriptcontext as sc
import shutil
import os
import uuid

UOFolder = folders.UserObjectFolders[0]
cs = gh.GH_ComponentServer()

#gh.GH_ComponentServer

exposureDict = {0 : ghenv.Component.Exposure.dropdown,
                1 : ghenv.Component.Exposure.primary,
                2 : ghenv.Component.Exposure.secondary,
                3 : ghenv.Component.Exposure.tertiary,
                4 : ghenv.Component.Exposure.quarternary,
                5 : ghenv.Component.Exposure.quinary,
                6 : ghenv.Component.Exposure.senary,
                7 : ghenv.Component.Exposure.septenary
                }



def exportToUserObject(component, targetFolder, hive_preparation):
    targetFolder = os.path.join(targetFolder, "userObjects")
    if not os.path.isdir(targetFolder): os.mkdir(targetFolder)
    
    def isNewerVersion(currentUO, component):
        # check if the component has a newer version than the current userObjects
        # version of the connected component
        if component.Message == None: return True
        if len(component.Message.split("\n"))<2: return True

        ghVersion, ghDate = component.Message.split("\n")
        ghCompVersion = map(int, ghVersion.split("VER ")[1].split("."))
        month, day, ghYear  = ghDate.split("_")
        # print version, date
        month = hive_preparation.monthList.index(month.upper()) + 1
        ghCompDate = int(hive_preparation.getJD(month, day))
        
        # in case there was no date for the userobject
        # the file will be considered older and will be overwrittern
        ghComponent = currentUO.InstantiateObject()
        # this is not the best way but works for now!
        # should be a better way to compute the component and get the message
        componentCode = ghComponent.Code.split("\n")
        
        UODate = ghCompDate - 1
        # version of the file
        for lineCount, line in enumerate(componentCode):
            if lineCount > 200: break
            if line.strip().startswith("ghenv.Component.Message"):
                print line
                # print line.split("=")[1].strip().split("\n")
                version, date = line.split("=")[1].strip().split("\\n")
                
                # in case the file doesn't have an standard Ladybug message let it be updated
                try: UOVersion = map(int, version.split("VER ")[1].split("."))
                except: return True
                month, day, UOYear  = date.split("_")
                
                # should find the reason and fix it later
                if month == "SEPT": month = "SEP"
                
                month = hive_preparation.monthList.index(month.upper()) + 1
                UODate = int(hive_preparation.getJD(month, day))
                break
        
        # check if the version of the code is newer
        try:
            if int(ghYear.strip()) > int(UOYear[:-1].strip()):
                    return True
            elif ghCompDate > UODate:
                return True
            elif ghCompDate == UODate:
                for ghVer, UOVer in zip(UOVersion, UOVersion):
                    if ghVer < UOVer: return False
                return True
            else:
                print "\nThere is a newer userObject in Grasshopper folder that will be copied: " + currentUO.Path + "." + \
                      "\nUserObject version is: " +  version + " " + date + \
                      "\nThe component version is: "  +  ghVersion + " " + ghDate + ".\n"
                
                return False
        except:
            return True

    if component.Name.find("Hive")>=0:
        # check if the userObject is already existed in the folder
        try:
            filePath = os.path.join(UOFolder, component.Name + ".ghuser")
            currentUO = gh.GH_UserObject(filePath)
        except:
            # the userobject is not there so just create it
            currentUO = None
    
        if currentUO!=None:
            print isNewerVersion(currentUO,component)
            # if is newer remove
            if isNewerVersion(currentUO, component):
                # it has a newer version so let's remove the old one and creat a new userobject
                
                if not component.Category == "Maths":
                    removeNicely = cs.RemoveCachedObject(filePath)
                    if not removeNicely: os.remove(filePath)
            else:
                # there is already a newer version so just copy that to the folder instead
                # and return
                dstFullPath = os.path.join(targetFolder, component.Name + ".ghuser")
                shutil.copy2(filePath, dstFullPath)
                return
    
        # create the new userObject in Grasshopper folder
        uo = gh.GH_UserObject()
        uo.Icon = component.Icon_24x24
        
    
        try:
            uo.Exposure = exposureDict[int(component.Code.split('ComponentExposure=')[1].split('\n')[0])]
        except:
            uo.Exposure = exposureDict[int(1)]
        
        uo.BaseGuid = component.ComponentGuid
        uo.Description.Name = component.Name
        uo.Description.Description = component.Description
        
        # if user hasn't identified the category then put it into honeybee as an unknown!
        if component.Category == "Maths":
            uo.Description.Category = "Hive"
        else:
            uo.Description.Category = component.Category
            
        if component.SubCategory == "Script":
            uo.Description.SubCategory = "UnknownHiveComponents"
        else:
            uo.Description.SubCategory = component.SubCategory
        
        uo.CreateDefaultPath(True)
        uo.SetDataFromObject(component)
        uo.SaveToFile()
        
        # copy the component over
        dstFullPath = os.path.join(targetFolder, component.Name + ".ghuser")
        shutil.copy2(filePath, dstFullPath)
        
        gh.GH_ComponentServer.UpdateRibbonUI()
        
        print "UserObject successfully added to: "

def exportToFile(component, targetFolder, hive_preparation):
    
    targetFolder = os.path.join(targetFolder, "src")
    if not os.path.isdir(targetFolder): os.mkdir(targetFolder)
    
    def isNewerVersion(componentCode, fileName):
        # check if the component has a newer version of source code
        # version of the connected component
        if component.Message == None: return True
        if len(component.Message.split("\n"))<2: return True
        
        ghVersion, ghDate = component.Message.split("\n")
        ghCompVersion = map(int, ghVersion.split("VER ")[1].split("."))
        month, day, ghYear  = ghDate.split("_")
        # print version, date
        month = hive_preparation.monthList.index(month.upper()) + 1
        ghCompDate = int(hive_preparation.getJD(month, day))
        
        # in case there was no date in the file
        # the file will be considered older and will be overwrittern
        # 
        pyFileDate = ghCompDate - 1
        
        # version of the file
        with open(os.path.join(targetFolder,fileName), "r") as pyFile:
            for lineCount, line in enumerate(pyFile):
                if lineCount > 200: break
                if line.strip().startswith("ghenv.Component.Message"):
                    # print line
                    # print line.split("=")[1].strip().split("\n")
                    version, date = line.split("=")[1].strip().split("\\n")
                    try:
                        pyFileVersion = map(int, version.split("VER ")[1].split("."))
                    except:
                        # in case the file doesn't have an standard Ladybug message
                        return True
                    month, day, pyYear  = date.split("_")
                    month = hive_preparation.monthList.index(month.upper()) + 1
                    pyFileDate = int(hive_preparation.getJD(month, day))
                    break
        
        # check if the version of the code is newer
        try:
            if int(ghYear.strip()) > int(pyYear[:-1].strip()):
                    return True
            elif ghCompDate > pyFileDate:
                return True
            elif ghCompDate == pyFileDate:
                for ghVer, pyVer in zip(ghVersion, pyFileVersion):
                    if ghVer < pyVer: return False
                return True
            else:
                print "\nThere is already a newer version in the folder for: " + fileName + "." + \
                      "\nCurrent file version is: " +  version + " " + date + \
                      "\nThe component version is: "  +  ghVersion + " " + ghDate + ".\n"
                
                return False
        except:
            print "Failed to check version for %s"%fileName
            with open("c:\\ladybug\\failed.txt", "w") as ff:
                ff.write(fileName)
            return True
    
    if component.Name.find("Hive")>=0:
        
        fileName = component.Name + ".py"
        
        # code inside the component
        code = component.Code
        
        # check if the file already exist
        if os.path.isfile(os.path.join(targetFolder, fileName)):
            if not isNewerVersion(code, fileName):
                return False
                
        with open(os.path.join(targetFolder, fileName), "w") as pyoutf:
            if isinstance(code, unicode):
                code = code.encode('ascii','ignore').replace("\r", "")
            pyoutf.write(code)
        
        print "Exported " + fileName + " to: " + os.path.join(targetFolder, fileName)
        return True

def getAllTheComponents(onlyGHPython = True):
    components = []
    
    document = ghenv.Component.OnPingDocument()
    
    for component in document.Objects:
        if onlyGHPython and type(component)!= type(ghenv.Component):
            pass
        else:
            components.append(component)
    
    return components

def getListOfConnectedComponents(componentInputParamIndex = 0, onlyGHPython = True):
    # this function is edited version of Guilio's code from here:
    # [github link]
    components = []
    
    param = ghenv.Component.Params.Input[componentInputParamIndex]
    sources = param.Sources
    if sources.Count == 0: return components
    
    for source in sources:
        attr = source.Attributes
        if (attr is None) or (attr.GetTopLevel is None):
            pass
        else:
            component = attr.GetTopLevel.DocObject
    
    if component == None or (onlyGHPython and type(component) != type(ghenv.Component)):
            #collect only python components
            pass
    else:
        components.append(component)
    
    return components

def main(components, targetFolder):
    if not sc.sticky.has_key('RCModel'): return "Add the modular building physics component to the canvas!"
    hive_preparation = sc.sticky["HivePreparation"]()
    
    if not os.path.isdir(targetFolder): os.mkdir(targetFolder)
        
    if str(components[0]) == "*":
        ghComps = getAllTheComponents()
    else:
        ghComps = getListOfConnectedComponents()
    
    if len(ghComps)== 0: return "Found 0 components!"
    
    for ghComp in ghComps:
        fileExported = exportToFile(ghComp, targetFolder, hive_preparation)
        if fileExported:
            exportToUserObject(ghComp, targetFolder, hive_preparation)

if _export and len(_components)!=0 and _targetFolder!=None:
    msg = main(_components, _targetFolder)
    ghenv.Component.AddRuntimeMessage(gh.GH_RuntimeMessageLevel.Warning, msg)
else:
    print "At the minimum one of the components are missing!"
# ---------- end exporthive ----------

lng_2 = ListLength(List=glazedelement.solar_gains)
vdis = VectorDisplay(Anchor=glazedelement.window_centroid, Vector=glazedelement.window_normal)
dup = DuplicateData(Data="3000", Number=lng_2, Order=True)

# ---- group: DHI component on window. Hive vs ladybug vs ARCY
graph = QuickGraph(glazedelement_2.daily_values)
division = Division(A=glazedelement.diff_irradiation, B=glazedelement.window_area)

# ----
direct_only = BooleanToggle(False)

# ---- group: Solar Gains
# Calculate radiation using ladybug
panel_4 = Panel("24")  # disabled
hour_to_simulate = Slider(3625, range=3625..4344)  # disabled
toggle = BooleanToggle(True)  # disabled
day_month_hour_calculator = Ladybug_Day_Month_Hour(HOY=doy_hoy.HOY)  # -> day, month, hour, date; disabled; plug-in component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
day_month_hour_calculator_2 = Ladybug_Day_Month_Hour(HOY=eval)  # -> day, month, hour, date; disabled; plug-in component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
panel_5 = Panel("hour_to_simulate")  # disabled
gencumulativeskymtx = Ladybug_GenCumulativeSkyMtx(epwFile=open_weather_file, skyDensity=0, useOldRes=True, runIt=toggle)  # -> readMe, cumulativeSkyMtx; disabled; plug-in component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
analysisperiod = Ladybug_AnalysisPeriod(
    fromMonth=day_month_hour_calculator.month,
    fromDay=day_month_hour_calculator.day,
    fromHour=day_month_hour_calculator.hour,
    toMonth=day_month_hour_calculator_2.month,
    toDay=day_month_hour_calculator_2.day,
    toHour=day_month_hour_calculator_2.hour)  # -> readMe, analysisPeriod; disabled; plug-in component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
fly = Ladybug_fly(inputSliders=hour_to_simulate, fly=button)  # -> Vviiiiiiiiiizzz; disabled; plug-in component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
c_script = CSharpScript(name=panel_5, min=doy_hoy.HOY, max=eval, decimals=0)  # -> out, A; inputs name: String, min: Double, max: Double, decimals: Int32; disabled
# ---------- c_script: C# ----------
    foreach (IGH_DocumentObject obj in owner.OnPingDocument().Objects )
    {
      Grasshopper.Kernel.Special.GH_NumberSlider slider = obj as Grasshopper.Kernel.Special.GH_NumberSlider;
      if (slider == null) { continue; }
      if (slider.NickName.Equals(name, StringComparison.OrdinalIgnoreCase))
      {
        double norm = slider.Slider.NormalizedValue;

        slider.Slider.Minimum = (decimal) min;
        slider.Slider.Maximum = (decimal) max;
        if (decimals <= 0)
        {
          slider.Slider.Type = Grasshopper.GUI.Base.GH_SliderAccuracy.Integer;
        }
        else
        {
          slider.Slider.Type = Grasshopper.GUI.Base.GH_SliderAccuracy.Float;
          slider.Slider.DecimalPlaces = decimals;
        }

        //Must disable events since we are modifying this thing during a solution.
        //This is actually illegal.
        slider.Slider.RaiseEvents = false;
        slider.Slider.NormalizedValue = norm;
        slider.Slider.RaiseEvents = true;
      }
    }
# ---------- c_script: C# additional code ----------
///Taken from: http://www.grasshopper3d.com/forum/topics/change-number-slider-parameter-using-python
# ---------- end c_script ----------
not = GateNot(A=direct_only)  # disabled
selectskymtx = Ladybug_selectSkyMtx(
    cumulativeSkyMtx=gencumulativeskymtx.cumulativeSkyMtx,
    analysisPeriod=analysisperiod.analysisPeriod,
    removeDiffuse=direct_only,
    removeDirect=not)  # -> readMe, selectedSkyMtx; disabled; plug-in component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
number_slider = Slider(0.1, range=-0.2..0.2)  # disabled
toggle_2 = BooleanToggle(True)  # disabled
panel_6 = Panel(".1")  # disabled
radiationanalysis = Ladybug_RadiationAnalysis(
    geometry=flatten(rotate_4.Geometry),
    context=flatten(brep),
    gridSize=panel_6,
    disFromBase=number_slider,
    selectedSkyMtx=flatten(selectskymtx.selectedSkyMtx),
    runIt=toggle_2)  # -> readMe, contextMesh, analysisMesh, testPts, testVec, port, radiationResult, radiationMesh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; disabled; plug-in component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
vdis_2 = VectorDisplay()  # disabled
panel_7 = Panel("1000")  # disabled
variable_recorder = PythonScript(array_length=number_of_hours)  # -> out, recorded_result; inputs array_length: Int32; disabled
# ---------- variable_recorder: Python ----------
"""
Data recorder with variable output length.

#TODO: reset recL every time array_length is changed.
"""
if 'recL' in locals() and array_length!=None:
        recL.append(x)
else:
    recL = []

recorded_result = recL[len(recL)-array_length:]
# ---------- end variable_recorder ----------
multiplication = Multiplication(A=radiationanalysis.totalRadiation, B=panel_7)  # disabled

# ---- group: DNI component on window. Hive vs Ladybug (normalised per square m). DNI for comparison
division_2 = Division(A=multiplication, B=glazedelement.window_area)
division_3 = Division(A=glazedelement.dir_irradiation, B=glazedelement.window_area)

# ----
panel_8 = Panel(glazedelement.out)
ma = MassAddition(Input=division_3)  # -> Result, PartialResults
ma_2 = MassAddition(Input=division)  # -> Result, PartialResults
direct = Panel([ma.Result, division_2])
diffuse = Panel([ma_2.Result, division_2])
addition_2 = Addition(A=glazedelement.dir_irradiation, B=glazedelement.diff_irradiation)

division_4 = Division(A=addition_2, B=glazedelement.window_area)
division_5 = Division(A=multiplication, B=glazedelement.window_area)
graph_2 = QuickGraph([division_5, division_4])

panel_9 = Panel(division_5)
panel_10 = Panel(division_4)

# ----
# Ladybug sunpath
importepw = Ladybug_ImportEpw(epwFile=open_weather_file)  # -> readMe, latitude, location, dryBulbTemperature, dewPointTemperature, relativeHumidity, windSpeed, windDirection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; plug-in component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
strnum = Ladybug_SeparateData(inputList=flatten(importepw.directNormalRadiation))  # -> numbers, strings; plug-in component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
strnum_2 = Ladybug_SeparateData(inputList=flatten(importepw.diffuseHorizontalRadiation))  # -> numbers, strings; plug-in component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
day_month_hour_calculator_3 = Ladybug_Day_Month_Hour(HOY=item_2)  # -> day, month, hour, date; plug-in component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
item_3 = ListItem(List=strnum.numbers, Index=one_hour.a, Wrap=True)  # disabled
item_4 = ListItem(List=strnum_2.numbers, Index=one_hour.a, Wrap=True)  # disabled
sunpath = Ladybug_SunPath(
    location=importepw.location,
    hour=day_month_hour_calculator_3.hour,
    day=day_month_hour_calculator_3.day,
    month=day_month_hour_calculator_3.month,
    timeStep=1,
    centerPt=rotate.Geometry,
    sunPathScale=0.05,
    dailyOrAnnualSunPath=True)  # -> readMe, sunVectors, sunAltitudes, graft(sunAzimuths), port, sunSpheresMesh, sunPathCrvs, compassCrvs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; plug-in component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
mesh = Mesh(sunpath.sunSpheresMesh)

strnum_3 = Ladybug_SeparateData(inputList=flatten(importepw.totalSkyCover))  # -> numbers, strings; disabled; plug-in component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
item_5 = ListItem(List=strnum_3.numbers, Index=one_hour.a, Wrap=True)  # disabled
glazedelement_3 = Hive_Downsample(hourly_data=strnum_2.numbers, start_hoy=doy_hoy.HOY)  # -> out, flatten(daily_values), flatten(monthly_values), annual_value; inputs hourly_data: list
# ---------- glazedelement_3: Python ----------
# Downsample data
#
# HIVE: A energy simulation plugin developed by the A/S chair at ETH Zurich
# This component is based on building_physics.py in the RC_BuildingSimulator Github repository
# https://github.com/architecture-building-systems/RC_BuildingSimulator
# Extensive documentation is available on the project wiki.
#
# Author: Justin Zarb <zarbj@student.ethz.ch>
#
# This file is part of HIVE
#
# Licensing/Copyright and liability comments go here.
# <Copyright 2018, Architecture and Building Systems - ETH Zurich>
# <Licence: MIT>

"""
Define an opaque by adding a surface.
-
Provided by HIVE 0.0.1
    
    Args:
        _hourly_data: a list of hourly values
        _start_hoy: the hour of the year corresponding to the first value.
    Returns:
        daily_values:
        monthly_values:
        annual_value:
"""

ghenv.Component.Name = "Hive_Downsample"
ghenv.Component.NickName = 'GlazedElement'
ghenv.Component.Message = 'VER 0.0.1\nMAY_07_2018'
ghenv.Component.IconDisplayMode = ghenv.Component.IconDisplayMode.application
ghenv.Component.Category = "Hive"
ghenv.Component.SubCategory = "5 | Results"
# ComponentExposure=5

import scriptcontext as sc
from Grasshopper import DataTree
from Grasshopper.Kernel.Data import GH_Path

def main(_start_hoy, _hourly_data):
    if not sc.sticky.has_key('HivePreparation'): 
        return "Add the modular RC component to the canvas!"
    hive_preparation = sc.sticky['HivePreparation']()
    data_dict = dict(zip(range(int(_start_hoy),int(_start_hoy+len(_hourly_data))),_hourly_data))
    dates = [hive_preparation.hour2Date(hoy,True) for hoy in data_dict.keys()]
    
    days = max(data_dict.keys())//24+1
    daily = dict(zip(range(0,days), [0]*days))
    monthly = dict(zip(range(0,12),[0]*12))
    annual = sum(_hourly_data)
    
    for hoy,data in data_dict.iteritems():
        date = hive_preparation.hour2Date(hoy,True)
        print date[1]
        monthly[date[1]] += data
        doy = (hoy-1)//24
        daily[doy] += data
    
    dailyTree = hive_preparation.dict_to_tree(daily)
    monthlyTree = hive_preparation.dict_to_tree(monthly)
    
    return dailyTree, monthlyTree, annual

if _start_hoy and _hourly_data:
    daily_values, monthly_values, annual_value = main(_start_hoy,_hourly_data)
# ---------- end glazedelement_3 ----------
glazedelement_4 = Hive_Downsample(hourly_data=strnum.numbers, start_hoy=doy_hoy.HOY)  # -> out, flatten(daily_values), flatten(monthly_values), annual_value; inputs hourly_data: list; same code as glazedelement_3

panel_11 = Panel(item_5)  # disabled

graph_3 = QuickGraph([glazedelement_4.monthly_values, glazedelement_3.monthly_values])
