# Grasshopper definition hive_main_development.gh (Grasshopper 0.9.76)
# plug-ins: Python Interpreter, FalseStartToggle

# Draw a room with windows
panel = Panel("4.9")
# Get temperatures and calculate radiation using ladybug
outward_facing_surfaces = Panel("0")
box = DomainBox(Base=PlaneXY(0, 0, 0), X=panel, Y="7", Z="3.1")
ladybug = Ladybug_Ladybug()  # -> Vviiiiiiiiiizzz; plug-in component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

# ----
# Update userObjects and Github folder
panel_2 = Panel("C:\Users\Zghiru\Documents\GitHub\hive\HIVE_RC_simulator")
exporthive = Hive_exportHive(components="*", targetFolder=panel_2, export=Toggle(False))  # -> readMe; inputs components: list
# ---------- exporthive: Python ----------
#
# Hive: An educational plugin developed by the A/S chair at ETH Zurich
# 
# This file is part of Hive.
# 
#TODO: Check terms of GNU modification.
#
# This component is based on the Ladybug_Export Ladybug component. It has been
# slightly modified to work without Ladybug, but it does exactly the same thing.
# 
# Ladybug is a free software registered under a GNU public license.
# 

"""
Based on Ladybug_Export Ladybug. Code Developers of Hive can use this component to export user objects and source code that they create to the Github folder on their computer.
This eases and automates the steps before commiting new components to the Github.
This component was written thanks to Giulio Piacentino a really helpful example.
-
Provided by Hive 0.0.1

    Args:
        _components: Any output from a new Ladybug (or Honeybee) component that you wish to export. Right now, only one component can be connected at a time but you can input a "*" (without quotation marsk) to search all changed Ladybug components on a grasshopper canvas.
        _targetFolder: A file path on your system which you would like to export the user object and source code to.  For most code developers, this file path will lead to their Github folder for Ladybug (or Honeybee), which is usually installed in "My Documents" by default. Exported source code will be saved at .\src and exported userObjects will be saved at .\userObjects in this _targetFolder.
        _export: Set to "True" to export Ladybug (or Honeybee) components to the _targerFolder.
    Returns:
        readMe!: ...
"""
ghenv.Component.Name = "Hive_exportHive"
ghenv.Component.NickName = 'exportHive'
ghenv.Component.Message = 'VER 0.0.1\nMAR_22_2018'
ghenv.Component.Category = "Hive"
ghenv.Component.SubCategory = "4 | Developers"


import Grasshopper.Folders as folders
import Grasshopper.Kernel as gh
import scriptcontext as sc
import shutil
import os
import uuid

UOFolder = folders.UserObjectFolders[0]
cs = gh.GH_ComponentServer()

#gh.GH_ComponentServer

exposureDict = {0 : ghenv.Component.Exposure.dropdown,
                1 : ghenv.Component.Exposure.primary,
                2 : ghenv.Component.Exposure.secondary,
                3 : ghenv.Component.Exposure.tertiary,
                4 : ghenv.Component.Exposure.quarternary,
                5 : ghenv.Component.Exposure.quinary,
                6 : ghenv.Component.Exposure.senary,
                7 : ghenv.Component.Exposure.septenary
                }



def exportToUserObject(component, targetFolder, hive_preparation):
    targetFolder = os.path.join(targetFolder, "userObjects")
    if not os.path.isdir(targetFolder): os.mkdir(targetFolder)
    
    def isNewerVersion(currentUO, component):
        # check if the component has a newer version than the current userObjects
        # version of the connected component
        if component.Message == None: return True
        if len(component.Message.split("\n"))<2: return True

        ghVersion, ghDate = component.Message.split("\n")
        ghCompVersion = map(int, ghVersion.split("VER ")[1].split("."))
        month, day, ghYear  = ghDate.split("_")
        # print version, date
        month = hive_preparation.monthList.index(month.upper()) + 1
        ghCompDate = int(hive_preparation.getJD(month, day))
        
        # in case there was no date for the userobject
        # the file will be considered older and will be overwrittern
        ghComponent = currentUO.InstantiateObject()
        # this is not the best way but works for now!
        # should be a better way to compute the component and get the message
        componentCode = ghComponent.Code.split("\n")
        
        UODate = ghCompDate - 1
        # version of the file
        for lineCount, line in enumerate(componentCode):
            if lineCount > 200: break
            if line.strip().startswith("ghenv.Component.Message"):
                print line
                # print line.split("=")[1].strip().split("\n")
                version, date = line.split("=")[1].strip().split("\\n")
                
                # in case the file doesn't have an standard Ladybug message let it be updated
                try: UOVersion = map(int, version.split("VER ")[1].split("."))
                except: return True
                month, day, UOYear  = date.split("_")
                
                # should find the reason and fix it later
                if month == "SEPT": month = "SEP"
                
                month = hive_preparation.monthList.index(month.upper()) + 1
                UODate = int(hive_preparation.getJD(month, day))
                break
        
        # check if the version of the code is newer
        try:
            if int(ghYear.strip()) > int(UOYear[:-1].strip()):
                    return True
            elif ghCompDate > UODate:
                return True
            elif ghCompDate == UODate:
                for ghVer, UOVer in zip(UOVersion, UOVersion):
                    if ghVer < UOVer: return False
                return True
            else:
                print "\nThere is a newer userObject in Grasshopper folder that will be copied: " + currentUO.Path + "." + \
                      "\nUserObject version is: " +  version + " " + date + \
                      "\nThe component version is: "  +  ghVersion + " " + ghDate + ".\n"
                
                return False
        except:
            return True

    if component.Name.find("Hive")>=0:
        # check if the userObject is already existed in the folder
        try:
            filePath = os.path.join(UOFolder, component.Name + ".ghuser")
            currentUO = gh.GH_UserObject(filePath)
        except:
            # the userobject is not there so just create it
            currentUO = None
    
        if currentUO!=None:
            print isNewerVersion(currentUO,component)
            # if is newer remove
            if isNewerVersion(currentUO, component):
                # it has a newer version so let's remove the old one and creat a new userobject
                
                if not component.Category == "Maths":
                    removeNicely = cs.RemoveCachedObject(filePath)
                    if not removeNicely: os.remove(filePath)
            else:
                # there is already a newer version so just copy that to the folder instead
                # and return
                dstFullPath = os.path.join(targetFolder, component.Name + ".ghuser")
                shutil.copy2(filePath, dstFullPath)
                return
    
        # create the new userObject in Grasshopper folder
        uo = gh.GH_UserObject()
        uo.Icon = component.Icon_24x24
        
    
        try:
            uo.Exposure = exposureDict[int(component.Code.split('ComponentExposure=')[1].split('\n')[0])]
        except:
            uo.Exposure = exposureDict[int(1)]
        
        uo.BaseGuid = component.ComponentGuid
        uo.Description.Name = component.Name
        uo.Description.Description = component.Description
        
        # if user hasn't identified the category then put it into honeybee as an unknown!
        if component.Category == "Maths":
            uo.Description.Category = "Hive"
        else:
            uo.Description.Category = component.Category
            
        if component.SubCategory == "Script":
            uo.Description.SubCategory = "UnknownHiveComponents"
        else:
            uo.Description.SubCategory = component.SubCategory
        
        uo.CreateDefaultPath(True)
        uo.SetDataFromObject(component)
        uo.SaveToFile()
        
        # copy the component over
        dstFullPath = os.path.join(targetFolder, component.Name + ".ghuser")
        shutil.copy2(filePath, dstFullPath)
        
        gh.GH_ComponentServer.UpdateRibbonUI()
        
        print "UserObject successfully added to: "

def exportToFile(component, targetFolder, hive_preparation):
    
    targetFolder = os.path.join(targetFolder, "src")
    if not os.path.isdir(targetFolder): os.mkdir(targetFolder)
    
    def isNewerVersion(componentCode, fileName):
        # check if the component has a newer version of source code
        # version of the connected component
        if component.Message == None: return True
        if len(component.Message.split("\n"))<2: return True
        
        ghVersion, ghDate = component.Message.split("\n")
        ghCompVersion = map(int, ghVersion.split("VER ")[1].split("."))
        month, day, ghYear  = ghDate.split("_")
        # print version, date
        month = hive_preparation.monthList.index(month.upper()) + 1
        ghCompDate = int(hive_preparation.getJD(month, day))
        
        # in case there was no date in the file
        # the file will be considered older and will be overwrittern
        # 
        pyFileDate = ghCompDate - 1
        
        # version of the file
        with open(os.path.join(targetFolder,fileName), "r") as pyFile:
            for lineCount, line in enumerate(pyFile):
                if lineCount > 200: break
                if line.strip().startswith("ghenv.Component.Message"):
                    # print line
                    # print line.split("=")[1].strip().split("\n")
                    version, date = line.split("=")[1].strip().split("\\n")
                    try:
                        pyFileVersion = map(int, version.split("VER ")[1].split("."))
                    except:
                        # in case the file doesn't have an standard Ladybug message
                        return True
                    month, day, pyYear  = date.split("_")
                    month = hive_preparation.monthList.index(month.upper()) + 1
                    pyFileDate = int(hive_preparation.getJD(month, day))
                    break
        
        # check if the version of the code is newer
        try:
            if int(ghYear.strip()) > int(pyYear[:-1].strip()):
                    return True
            elif ghCompDate > pyFileDate:
                return True
            elif ghCompDate == pyFileDate:
                for ghVer, pyVer in zip(ghVersion, pyFileVersion):
                    if ghVer < pyVer: return False
                return True
            else:
                print "\nThere is already a newer version in the folder for: " + fileName + "." + \
                      "\nCurrent file version is: " +  version + " " + date + \
                      "\nThe component version is: "  +  ghVersion + " " + ghDate + ".\n"
                
                return False
        except:
            print "Failed to check version for %s"%fileName
            with open("c:\\ladybug\\failed.txt", "w") as ff:
                ff.write(fileName)
            return True
    
    if component.Name.find("Hive")>=0:
        
        fileName = component.Name + ".py"
        
        # code inside the component
        code = component.Code
        
        # check if the file already exist
        if os.path.isfile(os.path.join(targetFolder, fileName)):
            if not isNewerVersion(code, fileName):
                return False
                
        with open(os.path.join(targetFolder, fileName), "w") as pyoutf:
            if isinstance(code, unicode):
                code = code.encode('ascii','ignore').replace("\r", "")
            pyoutf.write(code)
        
        print "Exported " + fileName + " to: " + os.path.join(targetFolder, fileName)
        return True

def getAllTheComponents(onlyGHPython = True):
    components = []
    
    document = ghenv.Component.OnPingDocument()
    
    for component in document.Objects:
        if onlyGHPython and type(component)!= type(ghenv.Component):
            pass
        else:
            components.append(component)
    
    return components

def getListOfConnectedComponents(componentInputParamIndex = 0, onlyGHPython = True):
    # this function is edited version of Guilio's code from here:
    # [github link]
    components = []
    
    param = ghenv.Component.Params.Input[componentInputParamIndex]
    sources = param.Sources
    if sources.Count == 0: return components
    
    for source in sources:
        attr = source.Attributes
        if (attr is None) or (attr.GetTopLevel is None):
            pass
        else:
            component = attr.GetTopLevel.DocObject
    
    if component == None or (onlyGHPython and type(component) != type(ghenv.Component)):
            #collect only python components
            pass
    else:
        components.append(component)
    
    return components

def main(components, targetFolder):
    if not sc.sticky.has_key('RadiationWindow'): return "Add the modular building physics component to the canvas!"
    hive_preparation = sc.sticky["HivePreparation"]()
    
    if not os.path.isdir(targetFolder): os.mkdir(targetFolder)
        
    if str(components[0]) == "*":
        ghComps = getAllTheComponents()
    else:
        ghComps = getListOfConnectedComponents()
    
    if len(ghComps)== 0: return "Found 0 components!"
    
    for ghComp in ghComps:
        fileExported = exportToFile(ghComp, targetFolder, hive_preparation)
        if fileExported:
            exportToUserObject(ghComp, targetFolder, hive_preparation)

if _export and len(_components)!=0 and _targetFolder!=None:
    msg = main(_components, _targetFolder)
    ghenv.Component.AddRuntimeMessage(gh.GH_RuntimeMessageLevel.Warning, msg)
else:
    print "At the minimum one of the components are missing!"
# ---------- end exporthive ----------

debrep = DeconstructBrep(Brep=box)  # -> Faces, Edges, Vertices
item = ListItem(List=debrep.Faces, Index=outward_facing_surfaces, Wrap=True)
# Lighting data
title = Panel("indoor_air_temperature")
title_2 = Panel("outdoor_air_temperature")
title_3 = Panel("occupancy")
title_4 = Panel("ill")
# Energy data
title_5 = Panel("HOY")
title_6 = Panel("solar_gains")
title_7 = Panel("heating_demand")
title_8 = Panel("cooling_demand")

# ---- group: display
cull_i = CullIndex(List=debrep.Faces, Indices=outward_facing_surfaces, Wrap=True)
cluster = Cluster(G=debrep.Faces, L=debrep.Faces)  # -> orientedtocam, int_2
tag = TextTag3D(Location=cluster.orientedtocam, Text=cluster.int_2, Size=0.4, Justification=7)

# ----
title_9 = Panel("lighting_demand")
# Temperature data
title_10 = Panel("HOY")
title_11 = Panel("internal_gains")
window_offset = Slider(0.292, range=0..1)
edges = BrepEdges(Brep=item)  # -> simplify(Naked), Interior, NonManifold

# ---- group: sets time steps for simulation
# Simulation Data
start_day = Panel("1")
start_month = Panel("1")
doy_hoy = Ladybug_DOY_HOY(days=start_day, months=start_month, hours=1)  # -> HOY, DOY, date; plug-in component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
number_of_hours = Panel("127")
addition = Addition(A=doy_hoy.HOY, B=number_of_hours)
getsimulationdata = Hive_getSimulationData(open=Toggle(True), start_HOY=doy_hoy.HOY, end_HOY=addition)  # -> out, location, temperature, directRadiation, diffuseRadiation, hour_of_year
# ---------- getsimulationdata: Python ----------
#
# Hive: An educational plugin developed by the A/S chair at ETH Zurich
# 
# This file is part of Hive.
# 
# TODO: Check terms of GNU modification.
#
# This component is a mashup of functions from Ladybug for importing and reading 
# EPW files. Some of 
# 
# 
# 

"""
Extract temperature, location and irradiation data from a weather file. 
-
Provided by Hive 0.0.1

    Args:
        _open: Set Boolean to True to browse for a weather file on your system.
        start_HOY_: optional HOY for the start of the analysis period
        end_HOY_: optional HOY for the end of the analysis period
    Returns:
        out: ...
        location: a list of longitude, latitude, utc offset and year
        temperature: a list of temperatures for the analysis period
        directRadiation: a list of direct radiation for the analysis period
        diffuseRadiation: a list of diffuse radiation for the analysis period
"""

ghenv.Component.Name = "Hive_getSimulationData"
ghenv.Component.NickName = 'getSimulationData'
ghenv.Component.Message = 'VER 0.0.1\nAPR_03_2018'
ghenv.Component.Category = "Hive"
ghenv.Component.SubCategory = "2 | Simulation"
# ComponentExposure=1

import rhinoscriptsyntax as rs
import scriptcontext as sc
from System import Object

def separate_data(inputList,start,end):
    # Based on Ladybug_Separate data, but uses lists instead of DataTree objects
    num = []
    str = []
    lastOne = None
    
    strPath = 0
    numPath = 0
    
    p = []
    numbers = []
    strings = []
    
    for count, item in enumerate(inputList):
        try:
            item = float(item)
            if count == 0: numfirst = True
            if lastOne == None: lastOne = "float"
            if lastOne!= "float":
                lastOne = "float"
                numPath += 1
            if numfirst == False:
                p.append(numPath-1)
                numbers.append(item)
            else:
                p.append(numPath)
                numbers.append(item)
        except:
            if count == 0: numfirst = False
            if lastOne == None: lastOne = "str"
            if lastOne!= "str":
                lastOne = "str"
                strPath += 1
            if numfirst == True:
                p.append(strPath-1)
                strings.append(item)
            else:
                p.append(strPath)
                strings.append(item)
    
    return numbers[start:end]

def open_epw(open):
    #Based on Ladybug_Open EPW Weather File
    if open == True:
        filter = "EPW file (*.epw)|*.epw|All Files (*.*)|*.*||"
        epwFile = rs.OpenFileName("Open .epw Weather File", filter)
        print 'Done!'
        return epwFile
    else:
        print 'Please set open to True'

def set_simulation_period(start_hoy,end_hoy):
    if start_hoy is not None:
        if 0 <= int(start_hoy) < 8760:
            start = start_hoy
        else:
            warningMsg = "start_HOY_ must be an integer between 0 and 8760"
            w = gh.GH_RuntimeMessageLevel.Warning
            GHComponent.AddRuntimeMessage(w, warningMsg)
            return None
    else:
        start = 0
    
    if end_hoy is not None:
        if start <= end_hoy < 8760:
            end = end_hoy
        else:
            warningMsg = "end_HOY_ must be an integer between start_HOY_ and 8760"
            w = gh.GH_RuntimeMessageLevel.Warning
            GHComponent.AddRuntimeMessage(w, warningMsg)
            return None
    else:
        end = 8759
    
    return int(start),int(end)

def main(epw_file,start_HOY_,end_HOY_):
    if not sc.sticky.has_key('HivePreparation'): return "Add the modular RC component to the canvas!"
    #TODO: Set up compatibility checks like in Ladybug.
    
    hive_preparation = sc.sticky["HivePreparation"]()
    start,end = set_simulation_period(start_HOY_,end_HOY_)
    hoy = [i for i in range(start,end)]
    
    if (epw_file is not None):
        locationData = hive_preparation.epwLocation(epw_file)
        weatherData = hive_preparation.epwDataReader(epw_file, locationData[0])

        location = [locationData[1], locationData[2], locationData[3]]
        dryBulbTemperature, dewPointTemperature, relativeHumidity, windSpeed, windDirection, directNormalRadiation, diffuseHorizontalRadiation, globalHorizontalRadiation, directNormalIlluminance, diffuseHorizontalIlluminance, globalHorizontalIlluminance, totalSkyCover, horizontalInfraredRadiation, barometricPressure, modelYear = weatherData
        location.append(modelYear[7])

        temperature = separate_data(dryBulbTemperature, start, end)
        directRadiation = separate_data(directNormalRadiation, start, end)
        diffuseRadiation = separate_data(diffuseHorizontalRadiation, start, end)

    return location,temperature,directRadiation,diffuseRadiation,hoy


if _open:
    epw_file = open_epw(_open)
    location,temperature,directRadiation,diffuseRadiation,hour_of_year = main(epw_file,start_HOY_,end_HOY_)
# ---------- end getsimulationdata ----------

# ----
ins = InsertItems(List=getsimulationdata.hour_of_year, Item=title_5, Indices=0, Wrap=True)  # -> graft(List)
ins_2 = InsertItems(Item=title_6, Indices=0, Wrap=True)  # -> graft(List)
ins_3 = InsertItems(List=getsimulationdata.hour_of_year, Item=title_10, Indices=0, Wrap=True)  # -> graft(List)
ins_4 = InsertItems(List=getsimulationdata.temperature, Item=title_2, Indices=0, Wrap=True)  # -> graft(List)
ins_5 = InsertItems(List=getsimulationdata.hour_of_year, Item=title_10, Indices=0, Wrap=True)  # -> graft(List)
join = JoinCurves(Curves=edges.Naked, Preserve=False)
edges_2 = BrepEdges(Brep=cull_i)  # -> Naked, Interior, NonManifold
ins_6 = InsertItems(Item=title_4, Indices=0, Wrap=True)  # -> graft(List)

# ----
# RC building simulation
supplysystems = Hive_SupplySystems()  # -> out
# ---------- supplysystems: Python ----------
# This comoponent contains a car-builder system of objects which define simple 
# emission systems.
#
# Hive: An educational plugin developed by the A/S chair at ETH Zurich
# This component is based on code in the RC_BuildingSimulator github repository
# https://github.com/architecture-building-systems/RC_BuildingSimulator
#
# Authors: Prageeth Jayathissa <jayathissa@arch.ethz.ch>, Michael Fehr
# Converted into a grasshopper plugin by Justin Zarb <zarbj@student.ethz.ch>
#
# This file is part of Hive
#
# Licensing/Copywrite and liability comments go here.
# Copyright 2018, Architecture and Building Systems - ETH Zurich
# Licence: MIT

"""
Place this component in the grasshopper workspace so that other Hive components can access the supply systems objects.
-
Provided by Hive 0.0.1
"""

ghenv.Component.Name = "Hive_SupplySystems"
ghenv.Component.NickName = 'SupplySystems'
ghenv.Component.Message = 'VER 0.0.1\nFEB_22_2018'
ghenv.Component.IconDisplayMode = ghenv.Component.IconDisplayMode.application
ghenv.Component.Category = "Hive"
ghenv.Component.SubCategory = "0 | Core"
# ComponentExposure=2


import scriptcontext as sc

# This is one layer of abstraction too many, however it is kept for future explansion of the supply system
class SupplyDirector:

    """
    The director sets what Supply system is being used, and runs that set Supply system
    """

    builder = None

    # Sets what building system is used
    def set_builder(self, builder):
        self.builder = builder

    # Calcs the energy load of that system. This is the main() function
    def calc_system(self):

        # Director asks the builder to produce the system body. self.builder
        # is an instance of the class

        body = self.builder.calc_loads()

        return body


class SupplySystemBase:

    """
     The base class in which Supply systems are built from 
    """

    def __init__(self, load, t_out, heating_supply_temperature, cooling_supply_temperature, has_heating_demand, has_cooling_demand):
        self.load = load  # Energy Demand of the building at that time step
        self.t_out = t_out  # Outdoor Air Temperature
        # Temperature required by the emission system
        self.heating_supply_temperature = heating_supply_temperature
        self.cooling_supply_temperature = cooling_supply_temperature
        self.has_heating_demand = has_heating_demand
        self.has_cooling_demand = has_cooling_demand

    def calc_loads(self): pass
    """
    Caculates the electricty / fossil fuel consumption of the set supply system
    If the system also generates electricity, then this is stored as electricity_out
    """


class OilBoilerOld(SupplySystemBase):
    """
    Old oil boiler with fuel efficiency of 63 percent (medium of range in report of semester project M. Fehr)
    No condensation, pilot light
    """

    def calc_loads(self):
        system = SupplyOut()
        system.fossils_in = self.load / 0.63
        system.electricity_in = 0
        system.electricity_out = 0
        return system


class OilBoilerMed(SupplySystemBase):
    """
    Classic oil boiler with fuel efficiency of 82 percent (medium of range in report of semester project M. Fehr)
    No condensation, but better nozzles etc.
    """

    def calc_loads(self):
        system = SupplyOut()
        system.fossils_in = self.load / 0.82
        system.electricity_in = 0
        system.electricity_out = 0
        return system


class OilBoilerNew(SupplySystemBase):
    """
    New oil boiler with fuel efficiency of 98 percent (value from report of semester project M. Fehr)
    Condensation boiler, latest generation
    """

    def calc_loads(self):
        system = SupplyOut()
        system.fossils_in = self.load / 0.98
        system.electricity_in = 0
        system.electricity_out = 0
        return system


class HeatPumpAir(SupplySystemBase):
    """
    BETA Version
    Air-Water heat pump. Outside Temperature as reservoir temperature.
    COP based off regression analysis of manufacturers data
    Source: "A review of domestic heat pumps, Iain Staffell, Dan Brett, Nigel Brandonc and Adam Hawkes"
    http://pubs.rsc.org/en/content/articlepdf/2012/ee/c2ee22653g

    TODO: Validate this methodology
    """

    def calc_loads(self):
        system = SupplyOut()

        if self.has_heating_demand:
            # determine the temperature difference, if negative, set to 0
            deltaT = max(0, self.heating_supply_temperature - self.t_out)
            # Eq (4) in Staggell et al.
            system.cop = 6.81 - 0.121 * deltaT + 0.000630 * deltaT**2
            system.electricity_in = self.load / system.cop

        elif self.has_cooling_demand:
            # determine the temperature difference, if negative, set to 0
            deltaT = max(0, self.t_out - self.cooling_supply_temperature)
            # Eq (4) in Staggell et al.
            system.cop = 6.81 - 0.121 * deltaT + 0.000630 * deltaT**2
            system.electricity_in = self.load / system.cop

        else:
            raise ValueError(
                'HeatPumpAir called although there is no heating/cooling demand')

        system.fossils_in = 0
        system.electricity_out = 0
        return system


class HeatPumpWater(SupplySystemBase):
    """"
    BETA Version
    Reservoir temperatures 7 degC (winter) and 12 degC (summer).
    Ground-Water heat pump. Outside Temperature as reservoir temperature.
    COP based off regression analysis of manufacturers data
    Source: "A review of domestic heat pumps, Iain Staffell, Dan Brett, Nigel Brandonc and Adam Hawkes"
    http://pubs.rsc.org/en/content/articlepdf/2012/ee/c2ee22653g

        # TODO: Validate this methodology
    """


    def calc_loads(self):
        system = SupplyOut()
        if self.has_heating_demand:
            deltaT = max(0, self.heating_supply_temperature - 7.0)
            # Eq (4) in Staggell et al.
            system.cop = 8.77 - 0.150 * deltaT + 0.000734 * deltaT**2
            system.electricity_in = self.load / system.cop

        elif self.has_cooling_demand:
            deltaT = max(0, 12.0 - self.cooling_supply_temperature)
            # Eq (4) in Staggell et al.
            system.cop = 8.77 - 0.150 * deltaT + 0.000734 * deltaT**2
            system.electricity_in = self.load / system.cop

        system.fossils_in = 0
        system.electricity_out = 0
        return system


class ElectricHeating(SupplySystemBase):
    """
    Straight forward electric heating. 100 percent conversion to heat.
    """

    def calc_loads(self):
        system = SupplyOut()
        system.electricity_in = self.load
        system.fossils_in = 0
        system.electricity_out = 0
        return system


class CHP(SupplySystemBase):
    """
    Combined heat and power unit with 60 percent thermal and 33 percent
    electrical fuel conversion. 93 percent overall
    """

    def calc_loads(self):
        system = SupplyOut()
        system.fossils_in = self.load / 0.6
        system.electricity_in = 0
        system.electricity_out = system.fossils_in * 0.33
        return system


class DirectHeater(SupplySystemBase):
    """
    Created by PJ to check accuracy against previous simulation
    """

    def calc_loads(self):
        system = SupplyOut()
        system.electricity_in = self.load
        system.fossils_in = 0
        system.electricity_out = 0
        return system


class DirectCooler(SupplySystemBase):
    """
    Created by PJ to check accuracy against previous simulation
    """

    def calc_loads(self):
        system = SupplyOut()
        system.electricity_in = self.load
        system.fossils_in = 0
        system.electricity_out = 0
        return system


class SupplyOut:
    """
    The System class which is used to output the final results
    """
    fossils_in = float("nan")
    electricity_in = float("nan")
    electricity_out = float("nan")
    cop = float("nan")


def pushback():
    """
    Push RC component to back. 
    The following lines are taken from Ladybug_Ladybug. Their purpose is to 
    initialise the sticky components upon startup. Without them, the components 
    need to be manually refreshed.
    """
    ghenv.Component.OnPingDocument().SelectAll()
    ghenv.Component.Attributes.Selected = False
    ghenv.Component.OnPingDocument().BringSelectionToTop()
    ghenv.Component.OnPingDocument().DeselectAll()

sc.sticky["OilBoilerOld"] = OilBoilerOld
sc.sticky["OilBoilerMed"] = OilBoilerMed
sc.sticky["OilBoilerNew"] = OilBoilerNew
sc.sticky["HeatPumpAir"] = HeatPumpAir
sc.sticky["HeatPumpWater"] = HeatPumpWater
sc.sticky["ElectricHeating"] = ElectricHeating
sc.sticky["CHP"] = CHP
sc.sticky["DirectHeater"] = DirectHeater
sc.sticky["DirectCooler"] = DirectCooler
sc.sticky["SupplyDirector"] = SupplyDirector


sc.sticky["pushback"] = pushback
pushback()
sc.sticky["supply_systems_ok"] = True

print 'Supply systems are go!'
# ---------- end supplysystems ----------
emissionsystems = Hive_EmissionSystems()  # -> out
# ---------- emissionsystems: Python ----------
# This comoponent contains a car-builder system of objects which define simple 
# emission systems.
#
# Hive: An educational plugin developed by the A/S chair at ETH Zurich
# This component is based on emission_system.py in the RC_BuildingSimulator github repository
# https://github.com/architecture-building-systems/RC_BuildingSimulator
#
# Authors: Prageeth Jayathissa <jayathissa@arch.ethz.ch>, Michael Fehr
# Converted into a grasshopper plugin by Justin Zarb <zarbj@student.ethz.ch>
#
# This file is part of Hive
#
# Licensing/Copywrite and liability comments go here.
# Copyright 2018, Architecture and Building Systems - ETH Zurich
# Licence: MIT

"""
Place this component in the grasshopper workspace so that other Hive components can access the emission systems object definitions
-
Provided by Hive 0.0.1
"""

ghenv.Component.Name = "Hive_EmissionSystems"
ghenv.Component.NickName = 'EmissionSystems'
ghenv.Component.Message = 'VER 0.0.1\nFEB_23_2018'
ghenv.Component.IconDisplayMode = ghenv.Component.IconDisplayMode.application
ghenv.Component.Category = "Hive"
ghenv.Component.SubCategory = "0 | Core"
# ComponentExposure=2

import scriptcontext as sc
class EmissionDirector:

    """
    The director sets what Emission system is being used, and runs that set Emission system
    """

    builder = None

    # Sets what Emission system is used
    def set_builder(self, builder):
        #        self.__builder = builder
        self.builder = builder
    # Calcs the energy load of that system. This is the main() fu

    def calc_flows(self):

        # Director asks the builder to produce the system body. self.builder
        # is an instance of the class

        body = self.builder.heat_flows()

        return body


class EmissionSystemBase:

    """ 
    The base class in which systems are built from
    """

    def __init__(self, energy_demand):

        self.energy_demand = energy_demand


    def heat_flows(self): pass
    """
    determines the node where the heating/cooling system is active based on the system used
    Also determines the return and supply temperatures for the heating/cooling system
    """


class OldRadiators(EmissionSystemBase):
    """
    Old building with radiators and high supply temperature
    Heat is emitted to the air node
    """

    def heat_flows(self):
        flows = Flows()
        flows.phi_ia_plus = self.energy_demand
        flows.phi_st_plus = 0
        flows.phi_m_plus = 0

        flows.heating_supply_temperature = 65
        flows.heating_return_temperature = 45
        flows.cooling_supply_temperature = 12
        flows.cooling_return_temperature = 21

        return flows


class NewRadiators(EmissionSystemBase):
    """    
    Newer building with radiators and medium supply temperature
    Heat is emitted to the air node
    """

    def heat_flows(self):
        flows = Flows()
        flows.phi_ia_plus = self.energy_demand
        flows.phi_st_plus = 0
        flows.phi_m_plus = 0

        flows.heating_supply_temperature = 50
        flows.heating_return_temperature = 35
        flows.cooling_supply_temperature = 12
        flows.cooling_return_temperature = 21

        return flows

class ChilledBeams(EmissionSystemBase):
    """
    Chilled beams: identical to newRadiators but used for cooling
    Heat is emitted to the air node
    """

    def heat_flows(self):
        flows = Flows()
        flows.phi_ia_plus = self.energy_demand
        flows.phi_st_plus = 0
        flows.phi_m_plus = 0

        flows.heating_supply_temperature = 50
        flows.heating_return_temperature = 35
        flows.cooling_supply_temperature = 18
        flows.cooling_return_temperature = 21

        return flows


class AirConditioning(EmissionSystemBase):
    """
    All heat is given to the air via an AC-unit. HC input via the air node as in the ISO 13790 Annex C.
    supplyTemperature as with new radiators (assumption)
    Heat is emitted to the air node
    """

    def heat_flows(self):
        flows = Flows()
        flows.phi_ia_plus = self.energy_demand
        flows.phi_st_plus = 0
        flows.phi_m_plus = 0

        flows.heating_supply_temperature = 40
        flows.heating_return_temperature = 20
        flows.cooling_supply_temperature = 6
        flows.cooling_return_temperature = 15

        return flows

class FloorHeating(EmissionSystemBase):
    """
    All HC energy goes into the surface node, supplyTemperature low
    Heat is emitted to the surface node
    """

    def heat_flows(self):
        flows = Flows()
        flows.phi_ia_plus = 0
        flows.phi_st_plus = self.energy_demand
        flows.phi_m_plus = 0

        flows.heating_supply_temperature = 40
        flows.heating_return_temperature = 5
        flows.cooling_supply_temperature = 12
        flows.cooling_return_temperature = 21

        return flows

class TABS(EmissionSystemBase):
    """
    Thermally activated Building systems. HC energy input into bulk node. Supply Temperature low.
    Heat is emitted to the thermal mass node
    """

    def heat_flows(self):
        flows = Flows()
        flows.phi_ia_plus = 0
        flows.phi_st_plus = 0
        flows.phi_m_plus = self.energy_demand

        flows.heating_supply_temperature = 50
        flows.heating_return_temperature = 35
        flows.cooling_supply_temperature = 12
        flows.cooling_return_temperature = 21

        return flows


class Flows:
    """
    A base object to store output variables
    """

    phi_ia_plus = float("nan")
    phi_m_plus = float("nan")
    phi_st_plus = float("nan")

    heating_supply_temperature = float("nan")
    cooling_supply_temperature = float("nan")
    # return temperatures

connected = False

while not connected:
    try:
        sc.sticky["SupplyDirector"]
        connected = True
    except NameError:
        error = "Add the supply_systems component to the canvas!"
        e = gh.GH_RuntimeMessageLevel.error
        ghenv.Component.AddRuntimeMessage(e, error)


if connected:
    sc.sticky["EmissionDirector"] = EmissionDirector
    sc.sticky["OldRadiators"] = OldRadiators
    sc.sticky["AirConditioning"] = AirConditioning
    sc.sticky["NewRadiators"] = NewRadiators
    sc.sticky["ChilledBeams"] = ChilledBeams
    sc.sticky["FloorHeating"] = FloorHeating
    sc.sticky["TABS"] = TABS
    
    sc.sticky["emission_systems_ok"] = True
    sc.sticky["pushback"]()

    print 'Emission systems are go!'
# ---------- end emissionsystems ----------
hive = Hive_Hive(systems=[emissionsystems, supplysystems])  # -> out; inputs systems: list
# ---------- hive: Python ----------
#
# Hive: An educational plugin developed by the A/S chair at ETH Zurich
#
# This comoponent contains an object-oriented adaptation of the RC model 
# referred to as the 'Simple Hourly Method' in ISO 13790, (superceded by 
# EN ISO 52016-1).

# The code contains the version of building_physics.py found in the nested_rc 
# branch. The modifications make it easier to accomodate a more modular zone 
# definiton, made of a zone and elements. 
# See https://github.com/architecture-building-systems/RC_BuildingSimulator for
# extensive documentation is available on the project wiki.

# Authors: Prageeth Jayathissa <jayathissa@arch.ethz.ch>, Justin Zarb 
# <zarbj@student.ethz.ch>
# Adapted for Grasshopper by Justin Zarb
#
# This file is part of Hive
#
#TODO: Licensing/Copyright and liability stuff


"""
Place this component in the grasshopper workspace so that zones can be defined and simulations run.
-
Provided by Hive 0.0.1
"""

ghenv.Component.Name = "Hive_Hive"
ghenv.Component.NickName = 'Hive'
ghenv.Component.Message = 'VER 0.0.1\nAPR_03_2018'
ghenv.Component.IconDisplayMode = ghenv.Component.IconDisplayMode.application
ghenv.Component.Category = "Hive"
ghenv.Component.SubCategory = "0 | Core"
# ComponentExposure=1

import scriptcontext as sc
import rhinoscriptsyntax as rs
import Rhino as rc
import ghpythonlib.components as gh
import Grasshopper.Kernel as ghKernel
import math
import datetime
import time

class HivePreparation(object):
    """ 
    Credits: Ladybug
    This object is a stripped-down version of the Ladybug Preparation component,
    which provides support for other components which have been adapted from
    Ladybug to Hive    
    """

    def __init__(self):
        self.monthList = ['JAN', 'FEB', 'MAR', 'APR', 'MAY', 'JUN', 'JUL', 'AUG', 'SEP', 'OCT', 'NOV', 'DEC']
        self.numOfDays = [0, 31, 59, 90, 120, 151, 181, 212, 243, 273, 304, 334, 365]
        self.numOfDaysEachMonth = [31, 28, 31, 30, 31, 30, 31, 31, 30, 31, 30, 31]
        self.numOfHours = [24 * numOfDay for numOfDay in self.numOfDays]
    
    def getJD(self, month, day):
        numOfDays = [0, 31, 59, 90, 120, 151, 181, 212, 243, 273, 304, 334]
        return numOfDays[int(month)-1] + int(day)
    
    def epwLocation(self, epw_file):
        epwfile = open(epw_file,"r")
        headline = epwfile.readline()
        csheadline = headline.split(',')
        while 1>0: #remove empty cells from the end of the list if any
            try: float(csheadline[-1]); break
            except: csheadline.pop()
        locName = ''
        for hLine in range(1,4):
            if csheadline[hLine] != '-':
                locName = locName + csheadline[hLine] + '_'
        locName = locName[:-1]
        lat = csheadline[-4]
        lngt = csheadline[-3]
        timeZone = csheadline[-2]
        elev = csheadline[-1].strip()
        epwfile.close
        return locName, lat, lngt, timeZone, elev

    strToBeFound = 'key:location/dataType/units/frequency/startsAt/endsAt'
    
    def epwDataReader(self, epw_file, location = 'Somewhere!'):
        # weather data
        modelYear = [self.strToBeFound, location, 'Year', 'Year', 'Hourly', (1, 1, 1), (12, 31, 24)];
        dbTemp = [self.strToBeFound, location, 'Dry Bulb Temperature', 'C', 'Hourly', (1, 1, 1), (12, 31, 24)];
        dewPoint = [self.strToBeFound, location, 'Dew Point Temperature', 'C', 'Hourly', (1, 1, 1), (12, 31, 24)];
        RH = [self.strToBeFound, location, 'Relative Humidity', '%', 'Hourly', (1, 1, 1), (12, 31, 24)];
        windSpeed = [self.strToBeFound, location, 'Wind Speed', 'm/s', 'Hourly', (1, 1, 1), (12, 31, 24)];
        windDir = [self.strToBeFound, location, 'Wind Direction', 'degrees', 'Hourly', (1, 1, 1), (12, 31, 24)];
        dirRad = [self.strToBeFound, location, 'Direct Normal Radiation', 'Wh/m2', 'Hourly', (1, 1, 1), (12, 31, 24)];
        difRad = [self.strToBeFound, location, 'Diffuse Horizontal Radiation', 'Wh/m2', 'Hourly', (1, 1, 1), (12, 31, 24)];
        glbRad = [self.strToBeFound, location, 'Global Horizontal Radiation', 'Wh/m2', 'Hourly', (1, 1, 1), (12, 31, 24)];
        infRad = [self.strToBeFound, location, 'Horizontal Infrared Radiation Intensity', 'Wh/m2', 'Hourly', (1, 1, 1), (12, 31, 24)];
        dirIll = [self.strToBeFound, location, 'Direct Normal Illuminance', 'lux', 'Hourly', (1, 1, 1), (12, 31, 24)];
        difIll = [self.strToBeFound, location, 'Diffuse Horizontal Illuminance', 'lux', 'Hourly', (1, 1, 1), (12, 31, 24)];
        glbIll = [self.strToBeFound, location, 'Global Horizontal Illuminance', 'lux', 'Hourly', (1, 1, 1), (12, 31, 24)];
        cloudCov = [self.strToBeFound, location, 'Total Cloud Cover', 'tenth', 'Hourly', (1, 1, 1), (12, 31, 24)];
        visibility = [self.strToBeFound, location, 'Visibility', 'km', 'Hourly', (1, 1, 1), (12, 31, 24)];
        barPress = [self.strToBeFound, location, 'Barometric Pressure', 'Pa', 'Hourly', (1, 1, 1), (12, 31, 24)];
        epwfile = open(epw_file,"r")
        lnum = 1 # line number
        for line in epwfile:
            if lnum > 8:
                modelYear.append(float(line.split(',')[0]))
                dbTemp.append(float(line.split(',')[6]))
                dewPoint.append(float(line.split(',')[7]))
                RH.append(float(line.split(',')[8]))
                barPress.append(float(line.split(',')[9]))
                windSpeed.append(float(line.split(',')[21]))
                windDir.append(float(line.split(',')[20]))
                dirRad.append(float(line.split(',')[14]))
                difRad.append(float(line.split(',')[15]))
                glbRad.append(float(line.split(',')[13]))
                infRad.append(float(line.split(',')[12]))
                dirIll.append(float(line.split(',')[17]))
                difIll.append(float(line.split(',')[18]))
                glbIll.append(float(line.split(',')[16]))
                cloudCov.append(float(line.split(',')[22]))
            lnum += 1
        epwfile.close()
        return dbTemp, dewPoint, RH, windSpeed, windDir, dirRad, difRad, glbRad, dirIll, difIll, glbIll, cloudCov, infRad, barPress, modelYear


class RadiationWindow(object):
    """
    Adapted from RC-building simulator's Window object in radiation.py
    
    returns solar_gains, illuminance through window as a list
    """

    def __init__(self, window_geometry, context_geometry, location, 
                 glass_solar_transmittance=0.7, glass_light_transmittance=0.8):
        
        self.window_geometry = window_geometry
        self.context_geometry = context_geometry

        # initialize window centroid, vertices, normal and tilt
        self.extract_window_geometry()
        
        # Extract location data
        self.latitude_deg = float(location[0])
        self.longitude_deg = float(location[1])
        self.utc_offset = float(location[2])
        self.year = int(location[3])

        self.glass_solar_transmittance = glass_solar_transmittance
        self.glass_light_transmittance = glass_light_transmittance

    def extract_window_geometry(self):
        """
        This function creates the following attributes during __init__:
        self.window_centroid
        self.window_normal
        self.window_vertices
        self.altitude_tilt_rad
        self.azimuth_tilt_rad
        """
        north = rc.Geometry.Vector3d(0,1,0)
        vertical = rc.Geometry.Vector3d(0,0,1)
        faces_west = False
        self.window_centroid = rs.SurfaceAreaCentroid(self.window_geometry)[0]
        normal = rs.SurfaceNormal(self.window_geometry,[0.5,0.5])
        self.window_normal = normal
        self.window_vertices = rs.SurfaceEditPoints(self.window_geometry)
        
        if normal[0] < 0:
            faces_west = True
        else:
            faces_west = False
        
        normal_xy = rc.Geometry.Vector3d(normal[0],normal[1],0)
        normal_xz = rc.Geometry.Vector3d(normal[0],0,normal[2])

        
        try:
            azimuth = rs.VectorAngle(north,normal_xy)
            if faces_west:
                azimuth = 360-azimuth
        except ValueError:
            azimuth = 0
        
        try: 
            altitude = rs.VectorAngle(vertical,normal_xz)
        except ValueError:
            altitude = 0
        
        self.alititude_tilt_rad = math.radians(altitude)
        self.azimuth_tilt_rad = math.radians(azimuth)

    def calc_sun_position(self, hoy):
        """
        Credits: Prageeth Jayathissa, Joan Domènech Masferrer 
        Calculates the sun position for a specific hour of the year and location,
        according to traditional convention.
        :param latitude_deg: Local Latitude [Degrees]. North+, South-.
        :type latitude_deg: float
        :param longitude_deg: Local Longitude [Degrees]. East+, West-.
        :type longitude_deg: float
        :param year: year
        :type year: int
        :param hoy: Hour of the year from the start. The first hour of January is 1
        :type hoy: int
        :param utc_offset: Time zone offset i.r. to Prime Meridian [hours]
        :type utc_offset: int
        :return: altitude, azimuth, sunvec: Sun altitude and azimuth [Degrees] (Traditional convention) and sun vecto
        :rtype: float,float,Vector3d
        """
        # Source http://www.pveducation.org/pvcdrom/properties-of-sunlight/declination-angle
    
        # Set the date in UTC based off the hour of year and the year itself
        start_of_year = datetime.datetime(self.year, 1, 1, 0, 0, 0, 0);
        utc_datetime = start_of_year + datetime.timedelta(hours = hoy);
    
        # Determine the day of the year
        day_of_year = utc_datetime.timetuple().tm_yday;
    
        # Calculate B parameter (in radians) for equation of time
        b_factor = (day_of_year - 1) * ((2 * math.pi) / 365);
    
        # Equation of time: empirical equation that corrects for the eccentricity of 
        # the Earth's orbit and the Earth's axial tilt        
        equation_of_time = 229.2 * 0.000075 + 229.2 * (0.001868 * math.cos(b_factor) - \
                                                       0.032077 * math.sin(b_factor)) - \
                                                       229.2 * (0.014615 * math.cos(2 * b_factor) + \
                                                                0.04089 * math.sin(2 * b_factor));
    
        # Local Standart Time Meridian (Earth rotation 15 degrees/h)
        standard_time = 15 * self.utc_offset
    
        # Time correction between local standard time and true solar time (in minutes) 
        time_correction = 4 * (self.longitude_deg - standard_time) + equation_of_time 
    
        # Local Solar Time (in hours) = Local Time + TC (in hours)
        solar_time = utc_datetime.hour + (utc_datetime.minute + time_correction) / 60.0;
    
        # Translate Local Solar Time to an angle 
        hour_angle_rad = (math.pi * 2 / 24) * (solar_time - 12);
    
        # Calculate the declination angle: The variation due to the earths tilt
        declination_rad = math.radians(23.45 * math.sin((2 * math.pi / 365.0) * 
                                                        (day_of_year - 81)));
    
        # Convert latitude to to radians
        latitude_rad = math.radians(self.latitude_deg);
    
        # Altitude Position of the sun in radians
        sun_alt_rad = math.asin(math.cos(latitude_rad) * math.cos(declination_rad) * 
                                 math.cos(hour_angle_rad) +
                                 math.sin(latitude_rad) * math.sin(declination_rad));
    
        # Azimuth Position fo the sun in radians
        sun_az_rad = math.acos((math.sin(declination_rad) *
                                    math.cos(latitude_rad) - math.cos(declination_rad) *
                                    math.sin(latitude_rad) * math.cos(hour_angle_rad)) /
                                    math.cos(sun_alt_rad))
    
        # Range azimuth [0, 360) degrees
        if hour_angle_rad > 0 or hour_angle_rad < - math.pi :
            sun_az_rad = math.pi * 2 - sun_az_rad
        
        sunvec_x = -math.sin(sun_az_rad) * math.cos(sun_alt_rad);
        sunvec_y = -math.cos(sun_az_rad) * math.cos(sun_alt_rad);
        sunvec_z = -math.sin(sun_alt_rad)
        sunvec = rc.Geometry.Vector3d(sunvec_x,sunvec_y,sunvec_z)
    
        return math.degrees(sun_alt_rad), math.degrees(sun_az_rad), sunvec

    def is_sunny(self,hoy):
        """
        Checks wether is sunny or not by comparing the sun vector and window normal.
        :rtype: bool
        """

        sun_alt_deg,sun_az_deg,sunvec = self.calc_sun_position(hoy)
        
        x_win = self.window_normal[0] > 0
        x_sun = sunvec[0] > 0
        y_win = self.window_normal[1] > 0
        y_sun = sunvec[1] > 0
        
        x = (x_win and not x_sun) or (x_sun and not x_win)
        y = (y_win and not y_sun) or (y_sun and not y_win)
        z = sunvec[2] < 0
        
        return x and y and z

    def context_to_clockwise_points(self,shade):
        """
        :return sorted_points: list of points sorted clockwise
        :rtype sorted_points: list
        """
        points = rs.SurfacePoints(shade,True)
        centroid, error= rs.SurfaceAreaCentroid(shade)
        
        # Generate plane oriented to world-Z
        plane = rc.Geometry.Plane(centroid,rc.Geometry.Vector3d(0,0,-1))
        
        # calculate vectors from center to points
        vecs = [centroid - point for point in points]
        
        # calculate angles between vectors and plane x-axis
        angles = [rc.Geometry.Vector3d.VectorAngle(plane.XAxis,v,plane) for v in vecs]
        sorted_points = [p[1] for p in sorted(zip(angles,points))] 
        return sorted_points

    def point_in_window(self,point):
        x = []
        y = []
        z = []

        for v in self.window_vertices:
            x.append(v[0])
            y.append(v[1])
            z.append(v[2])
        
        x_range = min(x) <= point[0] <= max(x)
        y_range = min(y) <= point[1] <= max(y)
        z_range = min(z) <= point[2] <= max(z)
        
        return x_range and y_range and z_range

    def unshaded_window_surfaces(self, sun_vector):
        """
        returns a set of surfaces representing the unshaded parts of the window
        """
        
        # Scale window geometry so that all points hit the surface
        window_plane = rs.ScaleObject(self.window_geometry,self.window_centroid,
            (10,10,10),True)
        
        if self.context_geometry is None:
            return [self.window_geometry]
        else:
            # Project shadows to window surface and merge overlapping shadows
            shadow_geometry = []
            for shade in self.context_geometry:
                # Arrange shade vertices clockwise
                shade_points = self.context_to_clockwise_points(shade)
        
                # Draw Shadow
                shadow_points = rs.ProjectPointToSurface(shade_points,window_plane,sun_vector)
                if shadow_points is not None:
                    shadow = rs.AddSrfPt(shadow_points)
                    if shadow is None:
                        shadow = gh.SurfaceFromPoints(shadow_points)
        
                # First shadow
                if shadow_geometry == []:
                    shadow_geometry = [shadow]
                    
                # Subsequent shadows
                else:
                    for existing_shadow in shadow_geometry:
                        # try boolean union
                        union = rs.BooleanUnion(existing_shadow,shadow)
                        
                        if union is not None:
                            # current shadow successfully merged with existing shadow
                            existing_shadow = union
                            
                        else:
                            # No intersection. current shadow is isolated
                            shadow_geometry.append(shadow)
        
        # sequentially subtract each shadow from the window geometry.
        if self.window_geometry is not None and shadow_geometry != []:
    
            # Initialise unshaded fragments
            unshaded_fragments = [self.window_geometry]
            
            for shadow in shadow_geometry:
                for ff in range(0,len(unshaded_fragments)):
                    intersection = rs.BooleanIntersection(unshaded_fragments[ff], shadow, False)
                    
                    # Discard intersections outside window geometry
                    new_fragments = []
                    for i in intersection:
                        intersection_centroid = rs.SurfaceAreaCentroid(i)[0]
                        if self.point_in_window(intersection_centroid):
                            new_fragments.append(i)
                    
                    # replace existing fragment with newly created fragments
                    unshaded_fragments[ff] = new_fragments
    
                # Flatten new list of fragments for the next shadow iteration
                if any(type(f) is list for f in unshaded_fragments):
                    unshaded_fragments = [item for sublist in unshaded_fragments for item in sublist]
            
            return unshaded_fragments
        else:
            return None

    def calc_unshaded_area(self,sun_vector):
        unshaded_fragments = self.unshaded_window_surfaces(sun_vector)
        if unshaded_fragments is not None:
            fragment_areas = [rs.SurfaceArea(f)[0] for f in unshaded_fragments]
            unshaded_area = sum(fragment_areas)
            percent_shaded = unshaded_area / rs.SurfaceArea(self.window_geometry)[0] * 100
            return unshaded_area, percent_shaded
        else:
            return 0, 100

    def calc_solar_gains(self, hoy, direct_normal_irradiation, diffuse_horizontal_irradiation):
        """
        Calculates the Solar Gains in the building zone through the set Window

        :param sun_altitude: Altitude Angle of the Sun in Degrees
        :type sun_altitude: float
        :param sun_azimuth: Azimuth angle of the sun in degrees
        :type sun_azimuth: float
        :param direct_normal_irradiation: Normal Direct Radiation from weather file
        :type direct_normal_irradiation: float
        :param diffuse_horizontal_irradiation: Horizontal Diffuse Radiation from weather file
        :type diffuse_horizontal_irradiation: float
        :return: self.incident_solar, Incident Solar Radiation on window
        :return: self.solar_gains - Solar gains in building after transmitting through the window
        :rtype: float
        """

        sun_altitude,sun_azimuth,sun_vector = self.calc_sun_position(hoy)
        
        direct_factor = self.calc_direct_solar_factor(sun_altitude, sun_azimuth)
        diffuse_factor = self.calc_diffuse_solar_factor()

        direct_solar = direct_factor * direct_normal_irradiation
        diffuse_solar = diffuse_horizontal_irradiation * diffuse_factor
        
        unshaded_area, percent_unshaded = self.calc_unshaded_area(sun_vector)
        
        incident_solar = (direct_solar + diffuse_solar) * unshaded_area
        
        solar_gains = incident_solar * self.glass_solar_transmittance
        
        return solar_gains

    def calc_illuminance(self, hoy, direct_normal_illuminance, diffuse_horizontal_illuminance):
        """
        Calculates the Illuminance in the building zone through the set Window

        :param sun_altitude: Altitude Angle of the Sun in Degrees
        :type sun_altitude: float
        :param sun_azimuth: Azimuth angle of the sun in degrees
        :type sun_azimuth: float
        :param direct_normal_illuminance: Normal Direct Illuminance from weather file [Lx]
        :type direct_normal_illuminance: float
        :param diffuse_horizontal_illuminance: Horizontal Diffuse Illuminance from weather file [Lx]
        :type diffuse_horizontal_illuminance: float
        :return: self.incident_illuminance, Incident Illuminance on window [Lumens]
        :return: self.transmitted_illuminance - Illuminance in building after transmitting through the window [Lumens]
        :rtype: float
        """

        sun_altitude,sun_azimuth,sun_vector = self.calc_sun_position(hoy)
        
        direct_factor = self.calc_direct_solar_factor(sun_altitude, sun_azimuth,)
        diffuse_factor = self.calc_diffuse_solar_factor()

        direct_illuminance = direct_factor * direct_normal_illuminance
        diffuse_illuminance = diffuse_factor * diffuse_horizontal_illuminance

        unshaded_area, percent_unshaded = self.calc_unshaded_area(sun_vector)
        
        incident_illuminance = (
            direct_illuminance + diffuse_illuminance) * unshaded_area
        transmitted_illuminance = incident_illuminance * \
            self.glass_light_transmittance
        
        return transmitted_illuminance

    def calc_direct_solar_factor(self, sun_altitude, sun_azimuth):
        """
        Calculates the cosine of the angle of incidence on the window 
        """
        sun_altitude_rad = math.radians(sun_altitude)
        sun_azimuth_rad = math.radians(sun_azimuth)

        # If the sun is in front of the window surface
        if math.cos(sun_azimuth_rad - self.azimuth_tilt_rad) > 0:
            # Proportion of the radiation incident on the window (cos of the
            # incident ray)
            direct_factor = math.cos(sun_altitude_rad) * math.cos(sun_azimuth_rad - self.azimuth_tilt_rad) + \
                math.sin(sun_altitude_rad) * math.cos(self.alititude_tilt_rad)

        else:
            # If sun is behind the window surface
            direct_factor = 0

        return direct_factor

    def calc_diffuse_solar_factor(self):
        """Calculates the proportion of diffuse radiation"""
        # Proportion of incident light on the window surface
        return (1 + math.cos(self.alititude_tilt_rad)) / 2


class Element(object):
    """
    Element object representing an opaque or transparent element.
    ##OUTLOOK##
    absorptivity, reflectivity: Not yet implemented, but adding these parameters 
    would improve the accuracy of solar gains calculations in opaque and 
    transparent elements.The RC model would need to be adapted for this. Note to 
    future developers: when adding attributes, make sure to upadate the copy 
    method below with the same attributes!
    """
    def __init__(self,
                 name = 'Element', #should contain one of the following: [Wall, Window, Ground slab, Roof]
                 area = 15.0, #Element area, [m2]
                 u_value = 1.0, #Element u_value-value, [W/m2.K]
                 frame_factor=1.0,
                 opaque = True
                 ):

        self.name = name
        self.area = area
        self.u_value = u_value
        self.h_tr = self.u_value * self.area #element conductance [W/K]
        self.frame_factor = frame_factor
        self.opaque = opaque


class ElementBuilder(object):
    def __init__(self,element_name,u_value,frame_factor,opaque):
        self.element_name = element_name if element_name is not None else 'Wall'
        self.opaque = opaque
        if self.opaque:
            self.u_value = 0.2 if u_value is None else u_value
            self.frame_factor = 1
        else:
            self.u_value = 1 if u_value is None else u_value
            self.frame_factor = 1 if frame_factor is None else frame_factor

    def get_data(self,surface):
        centroid = rs.SurfaceAreaCentroid(surface)[0]
        normal = rs.SurfaceNormal(surface,[0.5,0.5])
        area = rs.SurfaceArea(surface)[0]
        return centroid,normal,area

    def add_element(self,geometry):
        centroids = []
        normals = []
        elements = []
        if geometry is not None:
            # Invalid input
            if not (rs.IsSurface(geometry) or rs.IsPolysurface(geometry)):
                error = """geometry is not a surface or polysurface"""
                e = gh.GH_RuntimeMessageLevel.Error
                ghenv.Component.AddRuntimeMessage(e, error)
        
            # Single surface
            elif rs.IsSurface(geometry):
                centroid,normal,area = self.get_data(geometry)
                centroids = centroid
                normals = normal
                elements = [sc.sticky['Element'](
                    name=self.element_name,
                    area=area,
                    u_value=self.u_value, 
                    frame_factor=self.frame_factor,
                    opaque = self.opaque)]

            # Polysurface
            elif rs.IsPolysurface(geometry):
                all_parts = rs.ExplodePolysurfaces(geometry)
                for part in all_parts:
                    centroid,normal,area,azimuth,angle = self.get_data(part)
                    centroids.append(centroid)
                    normals.append(normal)
                    element = sc.sticky['Element'](
                        name=self.element_name,
                        area=area,
                        u_value=self.u_value, 
                        frame_factor=self.frame_factor,
                        opaque = self.opaque)
                    elements.append(element)
        return centroids,normals,elements


class ThermalBridge(object):
    def __init__(self,
                 name,
                 length,
                 linear_conductance):
        self.name = name if name is not None else 'Thermal bridge'
        self.name = name
        self.length = length
        self.linear_conductance = linear_conductance
        self.h_tr = length * linear_conductance


class Zone(object):
    def __init__(self,
                 occupants = 1, 
                 elements = None,
                 thermal_bridges = None,
                 floor_area = 34.3,
                 volume = 106.33,
                 thermal_capacitance_per_floor_area=165000,
                 ach_vent=1.5,
                 ach_infl=0.5,
                 ventilation_efficiency=1,
                 t_set_heating = 20,
                 t_set_cooling = 26,
                 max_heating_energy_per_floor_area = 12,
                 max_cooling_energy_per_floor_area = -12,
                 heating_supply_system=sc.sticky["DirectHeater"],
                 cooling_supply_system=sc.sticky["DirectCooler"],
                 heating_emission_system=sc.sticky["AirConditioning"],
                 cooling_emission_system=sc.sticky["AirConditioning"],
                ):

        # Element objects
        self.elements = elements
        self.elements_added = 0  # for reporting purposes
        self.element_names = []  # for reporting purposes
        
        # Thermal bridges
        self.thermal_bridges = thermal_bridges

        # direct inputs
        self.occupants = occupants
        self.floor_area = floor_area
        self.volume = volume
        self.total_internal_area = floor_area * 4.5 #ISO13790 7.2.2.2
        self.ach_vent = ach_vent
        self.ach_infl = ach_infl
        self.ventilation_efficiency = ventilation_efficiency
        self.thermal_capacitance_per_floor_area=thermal_capacitance_per_floor_area
        self.max_heating_energy_per_floor_area = max_heating_energy_per_floor_area
        self.max_cooling_energy_per_floor_area = max_cooling_energy_per_floor_area
        self.heating_supply_system = heating_supply_system
        self.heating_emission_system = heating_emission_system
        self.cooling_supply_system = cooling_supply_system
        self.cooling_emission_system = cooling_emission_system
        self.t_set_heating = t_set_heating
        self.t_set_cooling = t_set_cooling

        # initialize envelope properties
        self.h_tr_em = 0
        self.h_tr_w = 0
        self.wall_area = 0
        self.window_area = 0
        self.window_wall_ratio = 0

        #if left blank, zone elements will be set to ASF default values
        if self.elements == None:
            Window = Element(name='ASF_window', area=13.5, u_value=1.1)
            Wall = Element(name='ASF_wall', area=1.69, u_value=0.2)
            self.elements = [Window,Wall]

        for element in self.elements:
            self.add_elements(element)

        if self.thermal_bridges is not None:
            for tb in self.thermal_bridges:
                self.add_thermal_bridge(tb)


    def add_elements(self,e):
        self.element_names.append(e.name)
        # add surface conductances to conductance of mass
        if e.opaque:
            self.h_tr_em += e.h_tr
            self.elements_added += 1
            self.wall_area += e.area
        # add window conductance to window conductances
        else:
            self.h_tr_w += e.h_tr
            self.elements_added += 1
            self.window_area += e.area

    def add_thermal_bridge(self,tb):
        self.h_tr_em += tb.h_tr
        self.elements_added += 1

    def summary(self):
        #report the number of elements added to facilitate bug detection
        print 'Zone with %i elements'%len(self.elements)
        print 'Conductance of opaque surfaces to exterior [W/K], h_tr_em:', self.h_tr_em
        print 'Conductance to exterior through glazed surfaces [W/K], h_tr_w', self.h_tr_w
        print 'windows: %f m2, walls: %f m2, total: %f m2'%(self.window_area,self.wall_area,self.window_area+self.wall_area)
        try:
            print 'window to wall ratio: %f %%\n'%(int(round(self.window_area/self.wall_area*100,1)))
        except ZeroDivisionError:
            print '100% glazed'


class Building(object):
    '''Sets the parameters of the building. '''

    def __init__(self,
                 zone=None,
                 lighting_load=11.7,
                 lighting_control=300.0,
                 lighting_utilisation_factor=0.45,
                 lighting_maintenance_factor=0.9,
                 ):

        # Initialise Zone
        self.zone = zone
        if self.zone == None:
            self.zone = Zone()

        # Fenestration and Lighting Properties
        self.lighting_load = lighting_load  # [kW/m2] lighting load
        self.lighting_control = lighting_control  # [lux] Lighting set point
        # How the light entering the window is transmitted to the working plane
        self.lighting_utilisation_factor = lighting_utilisation_factor
        # How dirty the window is. Section 2.2.3.1 Environmental Science
        # Handbook
        self.lighting_maintenance_factor = lighting_maintenance_factor

        # Calculated Properties
        self.floor_area = self.zone.floor_area # [m2] Floor Area
        # [m2] Effective Mass Area assuming a medium weight building #12.3.1.2
        # very light: 2.5 x Af
        # heavy: 3.0 x Af
        # very heavy: 3.5 x Af
        self.mass_area = self.floor_area * 2.5
        self.room_vol = self.zone.volume# [m3] Room Volume
        self.total_internal_area = self.zone.total_internal_area
        # TODO: Standard doesn't explain what A_t is. Needs to be checked
        self.A_t = self.total_internal_area

        # Single Capacitance  5 conductance Model Parameters
        # [kWh/K] Room Capacitance. Default based on ISO standard 12.3.1.2 for medium heavy buildings
        self.c_m = self.zone.thermal_capacitance_per_floor_area * self.floor_area
        # Conductance of opaque surfaces to exterior [W/K]
        self.h_tr_em = self.zone.h_tr_em
        # Conductance to exterior through glazed surfaces [W/K], based on
        # U-wert of 1W/m2K
        self.h_tr_w = self.zone.h_tr_w
        # Determine the ventilation conductance
        ach_tot = self.zone.ach_infl + self.zone.ach_vent  # Total Air Changes Per Hour
        # temperature adjustment factor taking ventilation and infiltration
        # [ISO: E -27]
        if ach_tot > 0:
            b_ek = 1 - (self.zone.ach_vent / ach_tot) * self.zone.ventilation_efficiency
        else:
            b_ek = 1
        # b_ek = (self.zone.ach_vent/ ach_tot) * self.zone.ventilation_efficiency
        self.h_ve_adj = 1200 * b_ek * self.room_vol * \
            (ach_tot / 3600)  # Conductance through ventilation [W/M]
        # transmittance from the internal air to the thermal mass of the
        # building
        self.h_tr_ms = 9.1 * self.mass_area
        # Conductance from the conditioned air to interior building surface
        self.h_tr_is = self.total_internal_area * 3.45

        # Thermal set points
        self.t_set_heating = self.zone.t_set_heating
        self.t_set_cooling = self.zone.t_set_cooling

        # Thermal Properties
        self.has_heating_demand = False  # Boolean for if heating is required
        self.has_cooling_demand = False  # Boolean for if cooling is required
        self.max_cooling_energy = zone.max_cooling_energy_per_floor_area * \
            self.floor_area  # max cooling load (W/m2)
        self.max_heating_energy = zone.max_heating_energy_per_floor_area * \
            self.floor_area  # max heating load (W/m2)
        # Building System Properties
        self.heating_supply_system = zone.heating_supply_system
        self.cooling_supply_system = zone.cooling_supply_system
        self.heating_emission_system = zone.heating_emission_system
        self.cooling_emission_system = zone.cooling_emission_system

    def solve_building_lighting(self, illuminance, occupancy):
        """
        Calculates the lighting demand for a set timestep
        :param illuminance: Illuminance transmitted through the window [Lumens]
        :type illuminance: float
        :param : Probability of full occupancy
        :type occupancy: float
        :return: self.lighting_demand, Lighting Energy Required for the timestep
        :rtype: float
        """
        # Cite: Environmental Science Handbook, SV Szokolay, Section 2.2.1.3
        # also, this might be sped up by pre-calculating the constants, but idk. first check with profiler...
        lux = (illuminance * self.lighting_utilisation_factor *
               self.lighting_maintenance_factor) / self.floor_area  # [Lux]

        if lux < self.lighting_control and occupancy > 0:
            # Lighting demand for the hour
            self.lighting_demand = self.lighting_load * self.floor_area
        else:
            self.lighting_demand = 0

    def solve_building_energy(self, internal_gains, solar_gains, t_out, t_m_prev):
        """
        Calculates the heating and cooling consumption of a building for a set timestep
        :param internal_gains: internal heat gains from people and appliances [W]
        :type internal_gains: float
        :param solar_gains: solar heat gains [W]
        :type solar_gains: float
        :param t_out: Outdoor air temperature [C]
        :type t_out: float
        :param t_m_prev: Previous air temperature [C]
        :type t_m_prev: float
        :return: self.heating_demand, space heating demand of the building
        :return: self.heating_sys_electricity, heating electricity consumption
        :return: self.heating_sys_fossils, heating fossil fuel consumption
        :return: self.cooling_demand, space cooling demand of the building
        :return: self.cooling_sys_electricity, electricity consumption from cooling
        :return: self.cooling_sys_fossils, fossil fuel consumption from cooling
        :return: self.electricity_out, electricity produced from combined heat pump systems
        :return: self.sys_total_energy, total exergy consumed (electricity + fossils) for heating and cooling
        :return: self.heating_energy, total exergy consumed (electricity + fossils) for heating
        :return: self.cooling_energy, total exergy consumed (electricity + fossils) for cooling
        :return: self.cop, Coefficient of Performance of the heating or cooling system
        :rtype: float
        """
        # Main File
        # Calculate the heat transfer definitions for formula simplification
        self.calc_h_tr_1()
        self.calc_h_tr_2()
        self.calc_h_tr_3()

        # check demand, and change state of self.has_heating_demand, and self._has_cooling_demand
        self.has_demand(internal_gains, solar_gains, t_out, t_m_prev)

        if not self.has_heating_demand and not self.has_cooling_demand:
            # no heating or cooling demand
            # calculate temperatures of building R-C-model and exit
            # --> rc_model_function_1(...)
            self.energy_demand = 0

            # y u no pep8 bra?
            self.heating_demand = 0  # Energy required by the Zone
            self.cooling_demand = 0  # Energy surplus of the Zone
            # Energy (in electricity) required by the supply system to provide
            # HeatingDemand
            self.heating_sys_electricity = 0
            # Energy (in fossil fuel) required by the supply system to provide
            # HeatingDemand
            self.heating_sys_fossils = 0
            # Energy (in electricity) required by the supply system to get rid
            # of CoolingDemand
            self.cooling_sys_electricity = 0
            # Energy (in fossil fuel) required by the supply system to get rid
            # of CoolingDemand
            self.cooling_sys_fossils = 0
            # Electricity produced by the supply system (e.g. CHP)
            self.electricity_out = 0

        else:
            # has heating/cooling demand

            # Calculates energy_demand used below
            self.calc_energy_demand(
                internal_gains, solar_gains, t_out, t_m_prev)

            self.calc_temperatures_crank_nicolson(
                self.energy_demand, internal_gains, solar_gains, t_out, t_m_prev)
            # calculates the actual t_m resulting from the actual heating
            # demand (energy_demand)

            # Calculate the Heating/Cooling Input Energy Required

            supply_director = sc.sticky["SupplyDirector"]()  # Initialise Heating System Manager

            if self.has_heating_demand:
                supply_director.set_builder(self.heating_supply_system(load=self.energy_demand,
                                                                t_out=t_out,
                                                                heating_supply_temperature=self.heating_supply_temperature,
                                                                cooling_supply_temperature=self.cooling_supply_temperature,
                                                                has_heating_demand=self.has_heating_demand,
                                                                has_cooling_demand=self.has_cooling_demand))
                supplyOut = supply_director.calc_system()
                # All Variables explained underneath line 467
                self.heating_demand = self.energy_demand
                self.heating_sys_electricity = supplyOut.electricity_in
                self.heating_sys_fossils = supplyOut.fossils_in
                self.cooling_demand = 0
                self.cooling_sys_electricity = 0
                self.cooling_sys_fossils = 0
                self.electricity_out = supplyOut.electricity_out

            elif self.has_cooling_demand:
                supply_director.set_builder(self.cooling_supply_system(load=self.energy_demand * (-1),
                                                                t_out=t_out,
                                                                heating_supply_temperature=self.heating_supply_temperature,
                                                                cooling_supply_temperature=self.cooling_supply_temperature,
                                                                has_heating_demand=self.has_heating_demand,
                                                                has_cooling_demand=self.has_cooling_demand))
                supplyOut = supply_director.calc_system()
                self.heating_demand = 0
                self.heating_sys_electricity = 0
                self.heating_sys_fossils = 0
                self.cooling_demand = self.energy_demand
                self.cooling_sys_electricity = supplyOut.electricity_in
                self.cooling_sys_fossils = supplyOut.fossils_in
                self.electricity_out = supplyOut.electricity_out

            self.cop = supplyOut.cop

        self.sys_total_energy = self.heating_sys_electricity + self.heating_sys_fossils + \
            self.cooling_sys_electricity + self.cooling_sys_fossils
        self.heating_energy = self.heating_sys_electricity + self.heating_sys_fossils
        self.cooling_energy = self.cooling_sys_electricity + self.cooling_sys_fossils

    # TODO: rename. this is expected to return a boolean. instead, it changes state??? you don't want to change state...
    # why not just return has_heating_demand and has_cooling_demand?? then call the function "check_demand"
    # has_heating_demand, has_cooling_demand = self.check_demand(...)
    def has_demand(self, internal_gains, solar_gains, t_out, t_m_prev):
        """
        Determines whether the building requires heating or cooling
        Used in: solve_building_energy()
        # step 1 in section C.4.2 in [C.3 ISO 13790]
        """
        # set energy demand to 0 and see if temperatures are within the comfort
        # range
        energy_demand = 0
        # Solve for the internal temperature t_Air
        self.calc_temperatures_crank_nicolson(
            energy_demand, internal_gains, solar_gains, t_out, t_m_prev)
        # If the air temperature is less or greater than the set temperature,
        # there is a heating/cooling load
        if self.t_air < self.t_set_heating:
            self.has_heating_demand = True
            self.has_cooling_demand = False
        elif self.t_air > self.t_set_cooling:
            self.has_cooling_demand = True
            self.has_heating_demand = False
        else:
            self.has_heating_demand = False
            self.has_cooling_demand = False

    def calc_temperatures_crank_nicolson(self, energy_demand, internal_gains, solar_gains, t_out, t_m_prev):
        """
        Determines node temperatures and computes derivation to determine the new node temperatures
        Used in: has_demand(), solve_building_energy(), calc_energy_demand()
        # section C.3 in [C.3 ISO 13790]
        """
        self.calc_heat_flow(t_out, internal_gains, solar_gains, energy_demand)

        self.calc_phi_m_tot(t_out)

        # calculates the new bulk temperature POINT from the old one
        self.calc_t_m_next(t_m_prev)

        # calculates the AVERAGE bulk temperature used for the remaining
        # calculation
        self.calc_t_m(t_m_prev)

        self.calc_t_s(t_out)

        self.calc_t_air(t_out)

        self.calc_t_opperative()
        return self.t_m, self.t_air, self.t_opperative

    def calc_energy_demand(self, internal_gains, solar_gains, t_out, t_m_prev):
        """
        Calculates the energy demand of the space if heating/cooling is active
        Used in: solve_building_energy()
        # Step 1 - Step 4 in Section C.4.2 in [C.3 ISO 13790]
        """

        # Step 1: Check if heating or cooling is needed
        #(Not needed, but doing so for readability when comparing with the standard)
        # Set heating/cooling to 0
        energy_demand_0 = 0
        # Calculate the air temperature with no heating/cooling
        t_air_0 = self.calc_temperatures_crank_nicolson(
            energy_demand_0, internal_gains, solar_gains, t_out, t_m_prev)[1]

        # Step 2: Calculate the unrestricted heating/cooling required

        # determine if we need heating or cooling based based on the condition
        # that no heating or cooling is required
        if self.has_heating_demand:
            t_air_set = self.t_set_heating
        elif self.has_cooling_demand:
            t_air_set = self.t_set_cooling
        else:
            raise NameError(
                'heating function has been called even though no heating is required')

        # Set a heating case where the heating load is 10x the floor area (10
        # W/m2)
        energy_floorAx10 = 10 * self.floor_area

        # Calculate the air temperature obtained by having this 10 W/m2
        # setpoint
        t_air_10 = self.calc_temperatures_crank_nicolson(
            energy_floorAx10, internal_gains, solar_gains, t_out, t_m_prev)[1]

        # Determine the unrestricted heating/cooling off the building
        self.calc_energy_demand_unrestricted(
            energy_floorAx10, t_air_set, t_air_0, t_air_10)

        # Step 3: Check if available heating or cooling power is sufficient
        if self.max_cooling_energy <= self.energy_demand_unrestricted <= self.max_heating_energy:

            self.energy_demand = self.energy_demand_unrestricted
            self.t_air_ac = t_air_set  # not sure what this is used for at this stage TODO

        # Step 4: if not sufficient then set the heating/cooling setting to the
        # maximum
        # necessary heating power exceeds maximum available power
        elif self.energy_demand_unrestricted > self.max_heating_energy:
            self.energy_demand = self.max_heating_energy

        # necessary cooling power exceeds maximum available power
        elif self.energy_demand_unrestricted < self.max_cooling_energy:

            self.energy_demand = self.max_cooling_energy

        else:
            self.energy_demand = 0
            raise ValueError('unknown radiative heating/cooling system status')

        # calculate system temperatures for Step 3/Step 4
        self.calc_temperatures_crank_nicolson(
            self.energy_demand, internal_gains, solar_gains, t_out, t_m_prev)

    def calc_energy_demand_unrestricted(self, energy_floorAx10, t_air_set, t_air_0, t_air_10):
        """
        Calculates the energy demand of the system if it has no maximum output restrictions
        # (C.13) in [C.3 ISO 13790]
        Based on the Thales Intercept Theorem.
        Where we set a heating case that is 10x the floor area and determine the temperature as a result
        Assuming that the relation is linear, one can draw a right angle triangle.
        From this we can determine the heating level required to achieve the set point temperature
        This assumes a perfect HVAC control system
        """
        self.energy_demand_unrestricted = energy_floorAx10 * \
            (t_air_set - t_air_0) / (t_air_10 - t_air_0)

    def calc_heat_flow(self, t_out, internal_gains, solar_gains, energy_demand):
        """
        Calculates the heat flow from the solar gains, heating/cooling system, and internal gains into the building
        The input of the building is split into the air node, surface node, and thermal mass node based on
        on the following equations
        #C.1 - C.3 in [C.3 ISO 13790]
        Note that this equation has diverged slightly from the standard
        as the heating/cooling node can enter any node depending on the
        emission system selected
        """

        # Calculates the heat flows to various points of the building based on the breakdown in section C.2, formulas C.1-C.3
        # Heat flow to the air node
        self.phi_ia = 0.5 * internal_gains
        # Heat flow to the surface node
        self.phi_st = (1 - (self.mass_area / self.A_t) - (self.h_tr_w /
                            (9.1 * self.A_t))) * (0.5 * internal_gains + solar_gains)
        # Heatflow to the thermal mass node
        self.phi_m = (self.mass_area / self.A_t) * \
            (0.5 * internal_gains + solar_gains)

        # We call the EmissionDirector to modify these flows depending on the
        # system and the energy demand
        emDirector = sc.sticky["EmissionDirector"]()
        # Set the emission system to the type specified by the user

        emDirector.set_builder(self.heating_emission_system(
            energy_demand=energy_demand))
        # Calculate the new flows to each node based on the heating system
        flows = emDirector.calc_flows()

        # Set modified flows to building object
        self.phi_ia += flows.phi_ia_plus
        self.phi_st += flows.phi_st_plus
        self.phi_m += flows.phi_m_plus

        # Set supply temperature to building object
        # TODO: This currently is constant for all emission systems, to be
        # modified in the future
        self.heating_supply_temperature = flows.heating_supply_temperature
        self.cooling_supply_temperature = flows.cooling_supply_temperature

    def calc_t_m_next(self, t_m_prev):
        """
        Primary Equation, calculates the temperature of the next time step
        # (C.4) in [C.3 ISO 13790]
        """

        self.t_m_next = ((t_m_prev * ((self.c_m / 3600.0) - 0.5 * (self.h_tr_3 + self.h_tr_em))) +
                         self.phi_m_tot) / ((self.c_m / 3600.0) + 0.5 * (self.h_tr_3 + self.h_tr_em))

    def calc_phi_m_tot(self, t_out):
        """
        Calculates a global heat transfer. This is a definition used to simplify equation
        calc_t_m_next so it's not so long to write out
        # (C.5) in [C.3 ISO 13790]
        # h_ve = h_ve_adj and t_supply = t_out [9.3.2 ISO 13790]
        """

        t_supply = t_out  # ASSUMPTION: Supply air comes straight from the outside air
        h_tr_3 = False
        for key in self.__dict__:
            if 'h_tr_3' in key:
                h_tr_3 = True
        if not h_tr_3: # This is the case when heating is supplied and crank-nicholson is called directly
            self.calc_h_tr_3()


        self.phi_m_tot = self.phi_m + self.h_tr_em * t_out + \
            self.h_tr_3 * (self.phi_st + self.h_tr_w * t_out + self.h_tr_1 *
                           ((self.phi_ia / self.h_ve_adj) + t_supply)) / self.h_tr_2

    def calc_h_tr_1(self):
        """
        Definition to simplify calc_phi_m_tot
        # (C.6) in [C.3 ISO 13790]
        """
        self.h_tr_1 = 1.0 / (1.0 / self.h_ve_adj + 1.0 / self.h_tr_is)

    def calc_h_tr_2(self):
        """
        Definition to simplify calc_phi_m_tot
        # (C.7) in [C.3 ISO 13790]
        """
        h_tr_1 = False
        for key in self.__dict__:
            if 'h_tr_1' in key:
                h_tr_1 = True
        if not h_tr_1:
            self.calc_h_tr_1 ()

        self.h_tr_2 = self.h_tr_1 + self.h_tr_w

    def calc_h_tr_3(self):
        """
        Definition to simplify calc_phi_m_tot
        # (C.8) in [C.3 ISO 13790]
        """
        h_tr_2 = False
        for key in self.__dict__:
            if 'h_tr_2' in key:
                h_tr_2 = True
        if not h_tr_2:
            self.calc_h_tr_2()

        self.h_tr_3 = 1.0 / (1.0 / self.h_tr_2 + 1.0 / self.h_tr_ms)

    def calc_t_m(self, t_m_prev):
        """
        Temperature used for the calculations, average between newly calculated and previous bulk temperature
        # (C.9) in [C.3 ISO 13790]
        """
        self.t_m = (self.t_m_next + t_m_prev) / 2.0
    def calc_t_s(self, t_out):
        """
        Calculate the temperature of the inside room surfaces
        # (C.10) in [C.3 ISO 13790]
        # h_ve = h_ve_adj and t_supply = t_out [9.3.2 ISO 13790]
        """

        t_supply = t_out  # ASSUMPTION: Supply air comes straight from the outside air

        self.t_s = (self.h_tr_ms * self.t_m + self.phi_st + self.h_tr_w * t_out + self.h_tr_1 * \
            (t_supply + self.phi_ia / self.h_ve_adj)) / \
            (self.h_tr_ms + self.h_tr_w + self.h_tr_1)

    def calc_t_air(self, t_out):
        """
        Calculate the temperature of the air node
        # (C.11) in [C.3 ISO 13790]
        # h_ve = h_ve_adj and t_supply = t_out [9.3.2 ISO 13790]
        """

        t_supply = t_out

        # Calculate the temperature of the inside air
        self.t_air = (self.h_tr_is * self.t_s + self.h_ve_adj *
                      t_supply + self.phi_ia) / (self.h_tr_is + self.h_ve_adj)

    def calc_t_opperative(self):
        """
        The opperative temperature is a weighted average of the air and mean radiant temperatures.
        It is not used in any further calculation at this stage
        # (C.12) in [C.3 ISO 13790]
        """
        
        self.t_opperative = 0.3 * self.t_air + 0.7 * self.t_s


error = "Connect emissions_systems and supply_systems components!"
e = ghKernel.GH_RuntimeMessageLevel.Error

if systems == [] or len(systems) != 2:
    ghenv.Component.AddRuntimeMessage(e, error)

if any(['Emission' in s for s in systems]) and any(['Supply' in s for s in systems]):
    sc.sticky["RadiationWindow"] = RadiationWindow
    sc.sticky["Element"] = Element
    sc.sticky["ElementBuilder"] = ElementBuilder
    sc.sticky["ThermalBridge"] = ThermalBridge
    sc.sticky["Zone"] = Zone
    sc.sticky["ModularRCZone"] = Building
    sc.sticky["HivePreparation"] = HivePreparation
    sc.sticky['pushback']()
    print 'Modular Building Physics is go!'
# ---------- end hive ----------
panel_3 = Panel("C:\Users\Zghiru\Documents\GitHub\RC_BuildingSimulator\rc_simulator\grasshopper_component\tests\grasshopper_result_energy.csv")  # disabled
item_2 = ListItem(List=debrep.Faces, Index=4, Wrap=True)
panel_4 = Panel("C:\Users\Zghiru\Documents\GitHub\RC_BuildingSimulator\rc_simulator\grasshopper_component\tests\grasshopper_result_temperatures.csv")  # disabled
area = Area(Geometry=join)  # -> simplify(Area), Centroid
panel_5 = Panel("C:\Users\Zghiru\Documents\GitHub\RC_BuildingSimulator\rc_simulator\grasshopper_component\tests\grasshopper_result_lighting.csv")  # disabled
offset = Offset(Curve=join, Distance=window_offset, Plane=PlaneXY(0, 0, 0), Corners=1)
boundary = BoundarySurfaces(Edges=flatten([offset, edges.Naked]))
boundary_2 = BoundarySurfaces(Edges=offset)

# ---- group: Solar Gains
run_radiation = FalseStartToggle(False)  # disabled
panel_6 = Panel("hour_to_simulate")  # disabled
hour_to_simulate = Slider(0, range=0..127)  # disabled
open_weather_file = Ladybug_OpenEPWWeatherFile(open=Toggle(False))  # -> epwFile; plug-in component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
c_script = CSharpScript(name=panel_6, min=0, max=number_of_hours, decimals=0)  # -> out, A; inputs name: String, min: Double, max: Double, decimals: Int32; disabled
# ---------- c_script: C# ----------
    foreach (IGH_DocumentObject obj in owner.OnPingDocument().Objects )
    {
      Grasshopper.Kernel.Special.GH_NumberSlider slider = obj as Grasshopper.Kernel.Special.GH_NumberSlider;
      if (slider == null) { continue; }
      if (slider.NickName.Equals(name, StringComparison.OrdinalIgnoreCase))
      {
        double norm = slider.Slider.NormalizedValue;

        slider.Slider.Minimum = (decimal) min;
        slider.Slider.Maximum = (decimal) max;
        if (decimals <= 0)
        {
          slider.Slider.Type = Grasshopper.GUI.Base.GH_SliderAccuracy.Integer;
        }
        else
        {
          slider.Slider.Type = Grasshopper.GUI.Base.GH_SliderAccuracy.Float;
          slider.Slider.DecimalPlaces = decimals;
        }

        //Must disable events since we are modifying this thing during a solution.
        //This is actually illegal.
        slider.Slider.RaiseEvents = false;
        slider.Slider.NormalizedValue = norm;
        slider.Slider.RaiseEvents = true;
      }
    }
# ---------- c_script: C# additional code ----------
///Taken from: http://www.grasshopper3d.com/forum/topics/change-number-slider-parameter-using-python
# ---------- end c_script ----------
toggle = BooleanToggle(True)  # disabled
gencumulativeskymtx = Ladybug_GenCumulativeSkyMtx(epwFile=open_weather_file, skyDensity=0, useOldRes=True, runIt=toggle)  # -> readMe, cumulativeSkyMtx; disabled; plug-in component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
fly = Ladybug_fly(inputSliders=hour_to_simulate, fly=run_radiation)  # -> Vviiiiiiiiiizzz; disabled; plug-in component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
item_3 = ListItem(List=getsimulationdata.hour_of_year, Index=hour_to_simulate, Wrap=True)  # disabled
selectskymtx = Ladybug_selectSkyMtx(cumulativeSkyMtx=gencumulativeskymtx.cumulativeSkyMtx, HOY=item_3, removeDiffuse=False, removeDirect=False)  # -> readMe, selectedSkyMtx; disabled; plug-in component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
toggle_2 = BooleanToggle(True)
panel_7 = Panel("1")  # disabled
panel_8 = Panel(".1")  # disabled
radiationanalysis = Ladybug_RadiationAnalysis(
    geometry=flatten(boundary_2),
    gridSize=panel_7,
    disFromBase=panel_8,
    selectedSkyMtx=flatten(selectskymtx.selectedSkyMtx),
    runIt=toggle_2)  # -> readMe, contextMesh, analysisMesh, testPts, testVec, port, radiationResult, radiationMesh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; disabled; plug-in component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
multiplication = Multiplication(A=radiationanalysis.totalRadiation, B=1000)  # disabled
variable_recorder = PythonScript(x=multiplication, array_length=number_of_hours)  # -> out, recorded_result; inputs array_length: Int32; disabled
# ---------- variable_recorder: Python ----------
"""
Data recorder with variable output length.

#TODO: reset recL every time array_length is changed.
"""
if 'recL' in locals() and array_length!=None:
        recL.append(x)
else:
    recL = []

recorded_result = recL[len(recL)-array_length:]
# ---------- end variable_recorder ----------

# ----
importepw = Ladybug_ImportEpw(epwFile=open_weather_file)  # -> readMe, latitude, location, dryBulbTemperature, dewPointTemperature, relativeHumidity, windSpeed, windDirection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; disabled; plug-in component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
md_slider = MDSlider(
    slider_value=Point(0.15625, 0.3125, 0.5),
    SliderMode=0,
    x_domain=Domain(0, 1),
    y_domain=Domain(0, 1),
    z_domain=Domain(0, 1))
volume = Volume(Geometry=box)  # -> Volume, Centroid
area_2 = Area(Geometry=item_2)  # -> Area, Centroid

# ---- group: Hacky grasshopper way to read schedule from csv
# Internal Gains
occupancy_schedules_csv = Panel("C:\Users\Zghiru\Documents\GitHub\hive\HIVE_RC_simulator\occupancy_schedules.csv")
file = ReadFile(File=occupancy_schedules_csv, PerLineParse=True)
list = ValueList({"Multi Residential": 0, "Single Residential": 1, "Hotel": 2, "Office": 3, "Retail": 4, "Foodstore": 5, "Restaurant": 6, "Industrial": 7, "School": 8, "Hospital": 9, "Gym": 10}, selected="Office")
split = TextSplit(Text=file, Separators=",")  # -> simplify(Result)
item_4 = ListItem(List=split, Index=list, Wrap=True)  # -> flatten(Item)
panel_9 = Panel(split)
cull_i_2 = CullIndex(List=item_4, Indices=0, Wrap=True)
item_5 = ListItem(List=cull_i_2, Index=getsimulationdata.hour_of_year, Wrap=True)
python = PythonScript(area=area_2.Area, max_occupancy="3", occupancy_per_m2=item_5)  # -> out, occupancy, internal_gains; inputs occupancy_per_m2: list
# ---------- python: Python ----------
# This doesn't make sense yet 
#The units for rate should be 
# occupancy = rate * number of occupants * area

gains_per_person = 100 #W
appliance_gains = 14  # W per sqm

occupancy = list(map(lambda x:max_occupancy*x, occupancy_per_m2))

internal_gains = list(map(lambda x: gains_per_person*x + area*appliance_gains, occupancy))
# ---------- end python ----------

# ----
ins_7 = InsertItems(List=python.internal_gains, Item=title_11, Indices=0, Wrap=True)  # -> graft(List)
ins_8 = InsertItems(List=python.occupancy, Item=title_3, Indices=0, Wrap=True)  # -> graft(List)
merge = Merge(Data1=simplify(ins_5), Data2=simplify(ins_6), Data3=simplify(ins_8))  # disabled
join_2 = TextJoin(Text=merge, Join=",")  # -> flatten(Result); disabled
number_slider = Slider(44, range=0..100)
day_month_hour_calculator = Ladybug_Day_Month_Hour(HOY=number_slider)  # -> day, month, hour, date; disabled; plug-in component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
evalsrf = EvaluateSurface(Surface=reparameterize(boundary_2), Point=md_slider)  # -> Point, Normal, Frame
overhang = Slider(1.1, range=0..3)
toggle_3 = BooleanToggle(False)
python_2 = PythonScript(results=join_2, fileAddress=panel_5, export=toggle_3)  # -> out, a; inputs results: list; disabled
# ---------- python_2: Python ----------
import Rhino as rc

if export:
    fileName = open(fileAddress,'w')
    for line in results:
        fileName.write(line + '\n')
    fileName.close()
# ---------- end python_2 ----------
debrep_2 = DeconstructBrep(Brep=boundary_2)  # -> Faces, Edges, Vertices
sdivide = DivideSurface(Surface=reparameterize(boundary_2), UCount=Slider(4, range=0..10), VCount=Slider(3, range=0..10))  # -> Points, Normals, Parameters
panel_10 = Panel("C:\Users\Zghiru\Documents\GitHub\RC_BuildingSimulator\rc_simulator\grasshopper_component\tests\grasshopper_attributes.csv")
panel_11 = Panel("C:\Users\Zghiru\Documents\GitHub\RC_BuildingSimulator\rc_simulator\grasshopper_component\tests\grasshopper_result.csv")
number_slider_2 = Slider(0.7, range=0..1)
walls = ListItem(List=debrep_2.Edges, Index=2, Wrap=True)  # -> flatten(Item)
Y = UnitY(Factor=overhang)
extr = Extrude(Base=walls, Direction=expr("-x", Y))

# ----
# Create Zone
panel_12 = Panel("hour_to_visualise")
addition_2 = Addition(A=doy_hoy.HOY, B=number_of_hours)
hour_to_visualise = Slider(72, range=1..128)
c_script_2 = CSharpScript(name=panel_12, min=doy_hoy.HOY, max=addition_2, decimals=0)  # -> out, A; inputs name: String, min: Double, max: Double, decimals: Int32; same code as c_script
glazedelement = Hive_GlazedElement(
    window_geometry=boundary_2,
    context_geometry=extr,
    u_value=Slider(1.2, range=1..2),
    location=getsimulationdata.location,
    hoy_list=getsimulationdata.hour_of_year,
    dni_list=getsimulationdata.directRadiation,
    dhi_list=getsimulationdata.diffuseRadiation,
    run_solar=Toggle(True),
    hour_to_visualise=hour_to_visualise)  # -> out, glazed_elements, solar_gains, illuminance, shadow; inputs context_geometry: list, location: list, hoy_list: list, dni_list: list, dhi_list: list
# ---------- glazedelement: Python ----------
# Glazed element
#
# HIVE: A energy simulation plugin developed by the A/S chair at ETH Zurich
# This component is based on building_physics.py in the RC_BuildingSimulator Github repository
# https://github.com/architecture-building-systems/RC_BuildingSimulator
# Extensive documentation is available on the project wiki.
#
# Author: Justin Zarb <zarbj@student.ethz.ch>
#
# This file is part of HIVE
#
# Licensing/Copyright and liability comments go here.
# <Copyright 2018, Architecture and Building Systems - ETH Zurich>
# <Licence: MIT>

"""
Define an opaque by adding a surface.
-
Provided by HIVE 0.0.1
    
    Args:
        _window_geometry: a surface or polysurface representing the 
            heat-transfer area of the element
        window_name: optional element name
        _u_value: element u-value [W/(m^2.K)]
        solar_transmittance: (aka. g-factor) the percentage of radiation that can pass through glazing
        light_transmittance: the percentage of light that passes through glazing
    Returns:
        centers: list of center points to check input
        normals: list of normals to check input
        glazed_elements: list of element objects representing each surface that was inputted.
        solar_gains: hourly solar gains through the glazed element as a list
        illuminance: hourly illuminance through the glazed element as a list
        shadow: surface representing the shadow which corresponds to hour_to_visualise
"""

ghenv.Component.Name = "Hive_GlazedElement"
ghenv.Component.NickName = 'GlazedElement'
ghenv.Component.Message = 'VER 0.0.1\nAPR_03_2018'
ghenv.Component.IconDisplayMode = ghenv.Component.IconDisplayMode.application
ghenv.Component.Category = "Hive"
ghenv.Component.SubCategory = "1 | Zone"
# ComponentExposure=1

import scriptcontext as sc
import rhinoscriptsyntax as rs
import Rhino as rc
import ghpythonlib.components as gh
import math
import datetime

def build_glazed_element(window_name,_window_geometry,u_value,frame_factor):
    if not sc.sticky.has_key('ElementBuilder'): return "Add the modular RC component to the canvas!"
    
    name = 'Glazed element' if window_name is None else window_name
    Builder = sc.sticky['ElementBuilder'](name,u_value,frame_factor,False)
    centers,normals,glazed_elements = Builder.add_element(_window_geometry)
    
    for g in glazed_elements:
        print g.name,':',g.u_value,'W/m2K',g.opaque
    
    return centers, normals, glazed_elements


def solar_gains_through_element(solar_transmittance,hoy_list,dni_list,dhi_list,hour_to_visualise):
    if not sc.sticky.has_key('RadiationWindow'): return "Add the modular building physics component to the canvas!"
   
    transmittance = {}
    transmittance['st'] = solar_transmittance if solar_transmittance is not None else 0.7
    transmittance['lt'] = light_transmittance if light_transmittance is not None else 0.8
    
    #TODO: Deal with polysurface input
    Window = sc.sticky['RadiationWindow'](window_geometry=_window_geometry,
                                         context_geometry=context_geometry, 
                                         location=location,
                                         glass_solar_transmittance = transmittance['st'],
                                         glass_light_transmittance = transmittance['lt'])
    
    if hour_to_visualise is not None:
        sun_altitude,sun_azimuth,sun_vector = Window.calc_sun_position(hour_to_visualise)
        shadow = Window.unshaded_window_surfaces(sun_vector)
    
    solar_gains = []
    illuminance = []

    for ii in range(0,len(hoy_list)):
        hoy = hoy_list[ii]
        dni = dni_list[ii]
        dhi = dhi_list[ii]
        
        if Window.is_sunny(hoy):
            solar_gains.append(Window.calc_solar_gains(hoy,dni,dhi))
            illuminance.append(Window.calc_illuminance(hoy,dni,dhi))
        else:
            solar_gains.append(0)
            illuminance.append(0)
    
    return solar_gains, illuminance, shadow


try:
    centers, normals, glazed_elements = build_glazed_element(window_name,
        _window_geometry,u_value,frame_factor)
    
    if run_solar:
        solar_gains, illuminance, shadow = solar_gains_through_element(
            solar_transmittance,hoy_list,dni_list,dhi_list,hour_to_visualise)

except ValueError:
   print build_glazed_element(window_name,_window_geometry,u_value,frame_factor)
# ---------- end glazedelement ----------
opaqueelement = Hive_OpaqueElement(geometry=boundary, u_value=Slider(0.4, range=0..0.6))  # -> out, centers, normals, opaque_element; plug-in component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
number_slider_3 = Slider(1.3, range=1..2)
zone2 = Hive_Zone2(
    glazed_elements=glazedelement.glazed_elements,
    opaque_elements=opaqueelement.opaque_element,
    volume=volume.Volume,
    floor_area=area_2.Area,
    ach_vent=number_slider_3,
    ach_infl=number_slider_3)  # -> readMe, Zone, unique_inputs; inputs glazed_elements: list, opaque_elements: list, thermal_bridges: list
# ---------- zone2: Python ----------
# This comoponent creates a zone made of elements: the user is allowed 
# to override the default attributes and customize it.
#
# Hive: A energy simulation plugin developed by the A/S chair at ETH Zurich
# This component is based on building_physics.py in the RC_BuildingSimulator Github repository
# https://github.com/architecture-building-systems/RC_BuildingSimulator
# Extensive documentation is available on the project wiki.
#
# Author: Justin Zarb <zarbj@student.ethz.ch>
#
# This file is part of Hive
#
# Licensing/Copyright and liability comments go here.
# <Copyright 2018, Architecture and Building Systems - ETH Zurich>
# <Licence: MIT>

"""
Create a customized zone using elements as inputs.
Parameters left blank will be filled with default values.
-
Provided by Hive 0.0.1
    
    Args:
        glazed_elements: Element objects with additional glazing properties
        opaque_elements: Element objects
        thermal_bridges: Linear thermal bridge objects
        floor_area: The conditioned floor area within the zone
        zone_volume: Volume of the zone being simulated [m^2]
        thermal_capacitance_per_floor_area: Thermal capacitance of the room per 
            floor area [J/m2K]
        lighting_load: Lighting Load [W/m2] 
        lighting_control: Lux threshold at which the lights turn on [Lx]
        lighting_utilization_factor: How the light entering the window is 
            transmitted to the working plane []
        lighting_maintenance_factor: How dirty the window is[]
        ach_vent: Air changes per hour through ventilation [Air Changes Per Hour]
        ach_infl: Air changes per hour through infiltration [Air Changes Per Hour]
        ventilation_efficiency: The efficiency of the heat recovery system for ventilation. Set to 0 if there is no heat 
            recovery []
        t_set_heating : Thermal heating set point [C]
        t_set_cooling: Thermal cooling set point [C]
        max_cooling_energy_per_floor_area: Maximum cooling load. Set to -np.inf for unrestricted cooling [C]
        max_heating_energy_per_floor_area: Maximum heating load per floor area. Set to no.inf for unrestricted heating [C]
        heating_supply_system: The type of heating system. Choices are DirectHeater, ResistiveHeater, HeatPumpHeater. 
            Direct heater has no changes to the heating demand load, a resistive heater takes an efficiency into account, 
            HeatPumpHeatercalculates a COP based on the outdoor and system supply temperature 
        cooling_supply_system: The type of cooling system. Choices are DirectCooler HeatPumpCooler. 
            DirectCooler has no changes to the cooling demand load, 
            HeatPumpCooler calculates a COP based on the outdoor and system supply temperature 
        heating_emission_system: How the heat is distributed to the building
        cooling_emission_system: How the cooling energy is distributed to the building
    Returns:
        readMe!: ...
        Zone: ModularRCZone object
        local_and_global_variables: a list of tuples seperated by a colon which 
            can be used to export and quickly reproduce the zone properties in 
            a Python-based testing environment.
        
"""

ghenv.Component.Name = "Hive_Zone2"
ghenv.Component.NickName = 'Zone2'
ghenv.Component.Message = 'VER 0.0.1\nAPR_03_2018'
ghenv.Component.IconDisplayMode = ghenv.Component.IconDisplayMode.application
ghenv.Component.Category = "Hive"
ghenv.Component.SubCategory = "1 | Zone"
# ComponentExposure=2

import scriptcontext as sc
import Grasshopper.Kernel as gh

""""""""""""""""""""""""""""""""""""""""""""""""""""""""""""""""""""""""
#Manage Inputs
""""""""""""""""""""""""""""""""""""""""""""""""""""""""""""""""""""""""

#  Initialize default values if no input is detected
thermal_attributes = {"elements":None,
              "thermal_bridges":None,
              "floor_area":34.3,
              "volume":106.33,
              "thermal_capacitance_per_floor_area":165000,
              "ach_vent":1.5,
              "ach_infl":0.5,
              "ventilation_efficiency":1,
              "t_set_heating":20,
              "t_set_cooling":26,
              "max_heating_energy_per_floor_area":12,
              "max_cooling_energy_per_floor_area":-12,
              "heating_supply_system":sc.sticky["DirectHeater"],
              "cooling_supply_system":sc.sticky["DirectCooler"],
              "heating_emission_system":sc.sticky["AirConditioning"],
              "cooling_emission_system":sc.sticky["AirConditioning"]
              }
lighting_attributes = {'lighting_load':11.7,
                       'lighting_control':300.0,
                       'lighting_utilisation_factor':0.45,
                       'lighting_maintenance_factor':0.9}

def validate_element(element):
    # Check if the element object has the mian three parameters
    if [x in dir(element) for x in ['name','area','u_value']]:
        return True
    else:
        return False

# keep valid element objects and combine them into a single list.
g = [x for x in glazed_elements if validate_element(x)]
o = [x for x in opaque_elements if validate_element(x)]

if len(g) != len(glazed_elements):
    warning = "Invalid glazed element detected"
    w = gh.GH_RuntimeMessageLevel.Warning
    ghenv.Component.AddRuntimeMessage(w, warning)
if len(o) != len(opaque_elements):
    warning = "Invalid opaque element detected"
    w = gh.GH_RuntimeMessageLevel.Warning
    ghenv.Component.AddRuntimeMessage(w, warning)    
elements = g + o
if len(elements) == 0:
    elements = None

# keep valid thermal bridge objects
t = [x for x in thermal_bridges if x is sc.sticky['ThermalBridge']]
if len(t) != len(thermal_bridges):
    warning = "Invalid thermal bridge detected"
    w = gh.GH_RuntimeMessageLevel.Warning
    ghenv.Component.AddRuntimeMessage(w, warning)
if len(t) == 0:
    thermal_bridges = None

# Replace default values with whatever is inputted to the component
unique_inputs = {}
for t in thermal_attributes.keys():
    if locals()[t] is not None:
        thermal_attributes[t] = locals()[t]
        # Add item to unique_inputs
        if 'supply' not in t and 'emission' not in t:
            value = t+':'+str(locals()[t])
        elif 'supply' in t:
            value = t+': supply_system.'+str(locals()[t])[22:-2]
        elif 'emission' in t:
            value = t+': emission_system.'+str(locals()[t])[22:-2]
        unique_inputs[t] = value

# Add lighting attributes
for l in lighting_attributes.keys():
    if locals()[l] is not None:
        lighting_attributes[l] = locals()[l]
        value = l+':'+str(locals()[l])
        unique_inputs[l] = value


""""""""""""""""""""""""""""""""""""""""""""""""""""""""""""""""""""""""""""""
""""""""""""""""""""""""""""""""""""""""""""""""""""""""""""""""""""""""""""""



def main(elements,thermal_bridges,thermal_attributes,lighting_attributes):
    if not sc.sticky.has_key('Zone'): return "Add the modular RC component to the canvas!"
    
    #Declare zone
    ThermalZone = sc.sticky['Zone'](elements = elements,
                             thermal_bridges = thermal_bridges,
                             floor_area = thermal_attributes['floor_area'],
                             volume = thermal_attributes['volume'],
                             thermal_capacitance_per_floor_area=thermal_attributes['thermal_capacitance_per_floor_area'],
                             ach_vent=thermal_attributes['ach_vent'],
                             ach_infl=thermal_attributes['ach_infl'],
                             ventilation_efficiency=thermal_attributes['ventilation_efficiency'],
                             t_set_heating = thermal_attributes['t_set_heating'],
                             t_set_cooling = thermal_attributes['t_set_cooling'],
                             max_heating_energy_per_floor_area = thermal_attributes['max_heating_energy_per_floor_area'],
                             max_cooling_energy_per_floor_area = thermal_attributes['max_cooling_energy_per_floor_area'],
                             heating_supply_system=thermal_attributes['heating_supply_system'],
                             cooling_supply_system=thermal_attributes['cooling_supply_system'],
                             heating_emission_system=thermal_attributes['heating_emission_system'],
                             cooling_emission_system=thermal_attributes['cooling_emission_system'],
                             )
    
    ThermalZone.summary()
    
    # Zone with thermal and lighting attributes
    Zone = sc.sticky['ModularRCZone'](zone=ThermalZone,                 
                  lighting_load=lighting_attributes['lighting_load'],
                  lighting_control=lighting_attributes['lighting_control'],
                  lighting_utilisation_factor=lighting_attributes['lighting_utilisation_factor'],
                  lighting_maintenance_factor=lighting_attributes['lighting_maintenance_factor'])
    
    return Zone


Zone = main(elements,thermal_bridges,thermal_attributes,lighting_attributes)
# ---------- end zone2 ----------

xy = XYPlane(Origin=Point(0, 0, 0))
Y_2 = UnitY(Factor=expr("-x", number_slider_2))
X = UnitX(Factor=expr("-x/2", number_slider_2))
rectangle = Rectangle(Plane=sdivide.Points, XSize=number_slider_2, YSize=number_slider_2, Radius=0)  # -> Rectangle, Length
python_3 = PythonScript(fileAddress=panel_10, export=toggle_3)  # -> out, a; inputs results: list
# ---------- python_3: Python ----------
import Rhino as rc

if export:
    fileName = open(fileAddress,'w+')
    for line in results:
        fileName.write(line + '\n')
    fileName.close()
# ---------- end python_3 ----------
selectskymtx_2 = Ladybug_selectSkyMtx(cumulativeSkyMtx=gencumulativeskymtx.cumulativeSkyMtx, removeDiffuse=False, removeDirect=False)  # -> readMe, selectedSkyMtx; disabled; plug-in component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
addition_3 = Addition(A=Y_2, B=X)
orient = Orient(Source=PlaneXY(0, 0, 0), Target=PlaneXY(0, 0, 0))  # -> Geometry, Transform
panel_13 = Panel("47.377")
panel_14 = Panel("8.549")
move = Move(Geometry=rectangle.Rectangle, Motion=addition_3)  # -> Geometry, Transform
boundary_3 = BoundarySurfaces(Edges=move.Geometry)
radiation_with_clipper = PythonScript(
    test=evalsrf.Point,
    window_geometry=boundary_2,
    context_geometry=flatten(boundary_3),
    location=getsimulationdata.location,
    hoy=number_slider)  # -> out, window_centroid, window_normal, visualise, shadow_points; inputs test: Point3d, context_geometry: list, location: list
# ---------- radiation_with_clipper: Python ----------
"""
Implementation of Joan's code using clipper
"""
import scriptcontext as sc
import rhinoscriptsyntax as rs
import Rhino as rc
import ghpythonlib.components as gh
import Grasshopper.Kernel as ghKernel
import math
import datetime
import time

from operator import itemgetter

import System.Reflection
import os 

clipper_path = os.getcwd() + '\clipper_library.dll'
clipper = System.Reflection.Assembly.LoadFrom(clipper_path)
#print dir(clipper.ClipperLib)

import math


class ShadedWindow(object):
    """
    Adapted from shaded_window.py from the ASF_Control repository by Joan DM
    
    returns window and self shading for an arbitrary set of shading geometry.
    """

    def __init__(self, window_geometry, context_geometry, location, 
                 glass_solar_transmittance=0.7, glass_light_transmittance=0.8):
        
        self.window_geometry = window_geometry
        
        # initialize window centroid, vertices, normal and tilt
        self.extract_window_geometry()
        
        # transform context and arrange in any detectable array form
        #TODO: Explode context into surfaces and sort
        self.transform_context_geometry(context_geometry)
        
        # Extract location data
        self.latitude_deg = float(location[0])
        self.longitude_deg = float(location[1])
        self.utc_offset = float(location[2])
        self.year = int(location[3])
    
        self.glass_solar_transmittance = glass_solar_transmittance
        self.glass_light_transmittance = glass_light_transmittance
    
    def extract_window_geometry(self):
        """
        This function creates the following attributes during __init__:
        self.window_centroid
        self.window_normal
        self.window_vertices
        self.altitude_tilt_rad
        self.azimuth_tilt_rad
        """
        north = rc.Geometry.Vector3d(0,1,0)
        vertical = rc.Geometry.Vector3d(0,0,1)
        faces_west = False
        self.window_centroid = rs.SurfaceAreaCentroid(self.window_geometry)[0]
        self.window_area = rs.Area(self.window_geometry)
        normal = rs.SurfaceNormal(self.window_geometry,[0.5,0.5])
        
        self.window_normal = normal
        self.window_vertices = rs.SurfaceEditPoints(self.window_geometry)
        
        if normal[0] < 0:
            faces_west = True
        else:
            faces_west = False
        
        normal_xy = rc.Geometry.Vector3d(normal[0],normal[1],0)
        normal_xz = rc.Geometry.Vector3d(normal[0],0,normal[2])

        
        try:
            azimuth = rs.VectorAngle(north,normal_xy)
            if faces_west:
                azimuth = 360-azimuth
        except ValueError:
            azimuth = 0
        
        try: 
            altitude = rs.VectorAngle(vertical,normal_xz)
        except ValueError:
            altitude = 0
        
        self.alititude_tilt_rad = math.radians(altitude)
        self.azimuth_tilt_rad = math.radians(azimuth)
    
    def orient_point_2d_window(self,point):
        window_plane = rs.SurfaceFrame(self.window_geometry,[0.5,0.5])
        x,y = rs.PlaneClosestPoint(window_plane,point,return_point=False)
        z = rs.DistanceToPlane(window_plane,point)
        return rc.Geometry.Point3d(x,y,z)
    
    def surface_to_clockwise_points(self,geometry):
        """
        :return sorted_points: list of points sorted clockwise
        :rtype sorted_points: list
        """
        points = rs.SurfacePoints(geometry,True)
        centroid, error= rs.SurfaceAreaCentroid(geometry)
        normal = rs.SurfaceNormal(geometry,[0.5,0.5])

        # Generate plane opposing the dominant direction of the surface
        if normal[0] == 0 and normal[2] == 0:
            if normal[1]>0:
                plane = rc.Geometry.Plane(centroid,rc.Geometry.Vector3d(0,-1,0))
            else:
                plane = rc.Geometry.Plane(centroid,rc.Geometry.Vector3d(0,1,0))
        
        if normal[1] == 0 and normal[2] == 0:
            if normal[0]>0:
                plane = rc.Geometry.Plane(centroid,rc.Geometry.Vector3d(-1,0,0))
            else:
                plane = rc.Geometry.Plane(centroid,rc.Geometry.Vector3d(1,0,0))
        
        if normal[2] != 0:
            plane = rc.Geometry.Plane(centroid,rc.Geometry.Vector3d(0,0,-1))
       
        # calculate vectors from center to points
        vecs = [centroid - point for point in points]
        
        # calculate angles between vectors and plane x-axis
        angles = [rc.Geometry.Vector3d.VectorAngle(plane.XAxis,v,plane) for v in vecs]
        sorted_points = [p[1] for p in sorted(zip(angles,points))] 
        return centroid, sorted_points
    
    def transform_shade(self,shade):
        """
        Return a list of edge points for a shading surface
        """
        centroid, shade_points = self.surface_to_clockwise_points(shade)
        
        transformed_points = []
        for p in shade_points:
            transformed_points.append(self.orient_point_2d_window(p))
        
        return self.orient_point_2d_window(centroid), transformed_points
    
    def transform_context_geometry(self,context_geometry):
        """
        Return a dictionary with
        key: shade centroid
        value: transformed points for each shade
        """
        context = []
        centroids = []
        
        for xg in context_geometry:
            c,p = self.transform_shade(xg) 
            context.append(p)
            centroids.append(c)
        
        def round2(x):
            return int(x*100)/100
        
        unique_x = sorted(list(set([round2(x[0]) for x in centroids])))
        unique_y = sorted(list(set([round2(x[1]) for x in centroids])))
        
        # create indices for each unique value of x and y
        x_dict = {v:k for k,v in enumerate(unique_x)}
        y_dict = {v:k for k,v in enumerate(unique_y)}
        
        self.nrows = len(x_dict)
        self.ncols = len(y_dict)
        
        # create dictionary
        self.context = {}
        for c,x in zip(centroids,context):
            self.context[x_dict[round2(c[0])],y_dict[round2(c[1])]] = x
    
    
    def sort_right_to_left(self,centroid_dict):
        """
        see sort_points_left. In this case, the points are sorted from bottom 
        to top and right to left.
        """
        flipped_centroids = []
        for i,c in centroid_dict.iteritems():
            flipped_centroids.append([-c[0],c[1],i])
        
        flipped_and_sorted_centroids = sorted(flipped_centroids,key=itemgetter(0,1))
        
        sorted_points = []
        for fsc in flipped_and_sorted_centroids:
            sorted_points.append([round(-fsc[0],2),round(fsc[1],2),fsc[2]])
        
        return sorted_points
    
    def sort_left_to_right(self,centroid_dict):
        """
        Sort a set of 3d points on a horizontal plane
        
        This method is used in extract_self_shading. Shadows need to be 
        overlayed with the shadow furthest from the light source at the bottom. 
        The points are sorted from bottom to top and from left to right.

        :param points: points
        :type shades: list
        """
        unsorted_points = centroid_dict.values()
        
        p_dict = {} # {x0:[[y0,i0],[y1,i1],..],x1:...}
        unique_x = sorted(list(set([round(x[0],2) for x in unsorted_points])))
        
        # ugly manual sort
        for x in unique_x:
            this_x = []
            for i,up in zip(centroid_dict.keys(),unsorted_points):
                if round(up[0],2) == x:
                    this_x.append([up[1],i])
            p_dict[x] = sorted(this_x,key=itemgetter(0))
        
        # flatten p_dict
        index_list = []
        for x in unique_x:
            for y in p_dict[x]:
                index_list.append(y[1])
        
        sorted_points = []
        for i in index_list:
            sorted_points.append([centroid_dict[i][0],centroid_dict[i][1],i])
        
        return sorted_points
    
    
    def calc_relative_sun_position(self, hoy):
        """
        Credits: JoanDM
        Calculate sun position in respect to the glazed surface. 
        - Traditional convention:
            Sun azimuth: Clockwise due north. i.e. [0,360) degrees
        - Facade convention:
            Sun azimuth: Zero is coincident with the normal to glazed surface. From there, 
                         it ranges clockwise and counter clockwise till 180, i.e. 
                         [-180, 180) relative degrees.

        :param utc_offset: Time zone offset i.r. to Prime Meridian [hours]
        :type utc_offset: int
        :param latitude_deg: Local Latitude [Degrees]. North+, South-.
        :type latitude_deg: float
        :param longitude_deg: Local Longitude [Degrees]. East+, West-.
        :type longitude_deg: float
        :param asf_normal_az: Azimuth position of normal to ASF plane  [Degrees](Traditional convention)
        :type asf_normal_az: int
        :return: sun_alt, asf_sun_az: Sun altitude and azimuth [Degrees] (Facade convention)
        :rtype: tuple (float, float)
        """
        
        # Calculate sun position following traditional convention
        sun_alt, sun_az = self.calc_sun_position(hoy)
        
        # Redefine azimuth following ASF convention
        relative_sun_az = self.calc_relative_position(sun_az)
        
        return sun_alt, relative_sun_az
    
    def calc_sun_position(self, hoy):
        """
        Credits: Prageeth Jayathissa, Joan Domènech Masferrer 
    
        Calculates the sun position for a specific hour of the year and location,
        according to traditional convention.
        :param latitude_deg: Local Latitude [Degrees]. North+, South-.
        :type latitude_deg: float
        :param longitude_deg: Local Longitude [Degrees]. East+, West-.
        :type longitude_deg: float
        :param year: year
        :type year: int
        :param hoy: Hour of the year from the start. The first hour of January is 1
        :type hoy: int
        :param utc_offset: Time zone offset i.r. to Prime Meridian [hours]
        :type utc_offset: int
        :return: altitude, azimuth: Sun altitude and azimuth [Degrees] (Traditional convention)
        :rtype: tuple
        """
        # Source http://www.pveducation.org/pvcdrom/properties-of-sunlight/declination-angle
    
        # Set the date in UTC based off the hour of year and the year itself
        start_of_year = datetime.datetime(self.year, 1, 1, 0, 0, 0, 0);
        utc_datetime = start_of_year + datetime.timedelta(hours = float(hoy));
    
        # Determine the day of the year
        day_of_year = utc_datetime.timetuple().tm_yday;
    
        # Calculate B parameter (in radians) for equation of time
        b_factor = (day_of_year - 1) * ((2 * math.pi) / 365);
    
        # Equation of time: empirical equation that corrects for the eccentricity of 
        # the Earth's orbit and the Earth's axial tilt        
        equation_of_time = 229.2 * 0.000075 + 229.2 * (0.001868 * math.cos(b_factor) - \
                                                       0.032077 * math.sin(b_factor)) - \
                                                       229.2 * (0.014615 * math.cos(2 * b_factor) + \
                                                                0.04089 * math.sin(2 * b_factor));
    
        # Local Standart Time Meridian (Earth rotation 15 degrees/h)
        standard_time = 15 * self.utc_offset
    
        # Time correction between local standard time and true solar time (in minutes) 
        time_correction = 4 * (self.longitude_deg - standard_time) + equation_of_time 
    
        # Local Solar Time (in hours) = Local Time + TC (in hours)
        solar_time = utc_datetime.hour + (utc_datetime.minute + time_correction) / 60.0;
    
        # Translate Local Solar Time to an angle 
        hour_angle_rad = (math.pi * 2 / 24) * (solar_time - 12);
    
        # Calculate the declination angle: The variation due to the earths tilt
        declination_rad = math.radians(23.45 * math.sin((2 * math.pi / 365.0) * 
                                                        (day_of_year - 81)));
    
        # Convert latitude to to radians
        latitude_rad = math.radians(self.latitude_deg);
    
        # Altitude Position of the sun in radians
        sun_alt_rad = math.asin(math.cos(latitude_rad) * math.cos(declination_rad) * 
                                 math.cos(hour_angle_rad) +
                                 math.sin(latitude_rad) * math.sin(declination_rad));
    
        # Azimuth Position fo the sun in radians
        sun_az_rad = math.acos((math.sin(declination_rad) *
                                    math.cos(latitude_rad) - math.cos(declination_rad) *
                                    math.sin(latitude_rad) * math.cos(hour_angle_rad)) /
                                    math.cos(sun_alt_rad))
    
        # Range azimuth [0, 360) degrees
        if hour_angle_rad > 0 or hour_angle_rad < - math.pi :
            sun_az_rad = math.pi * 2 - sun_az_rad
    
        return math.degrees(sun_alt_rad), math.degrees(sun_az_rad)
    
    def calc_relative_position(self, sun_az):
        """
        Calculates the sun position relative to the facade orientation.
        :param sun_az: Sun azimuth [Degrees] (Traditional convention)
        :type sun_az: float
        :param asf_normal_az: Azimuth position of normal to ASF plane  [Degrees] (Traditional convention)
        :type asf_normal_az: int
        :return: asf_sun_az: Sun azimuth [Degrees] (Facade convention)
        :rtype: tuple
        """
        relative_sun_az = sun_az - math.degrees(self.azimuth_tilt_rad)
        if relative_sun_az < - 180:
            relative_sun_az = 360 - abs(relative_sun_az)
        return relative_sun_az
    
    def is_sunny(sun_alt, relative_sun_az):
        """
        Checks wether is sunny or not by considering sun relative angle with respect to ASF.
        I.e. the sun must not be below the horizon and has to be in front of the facade.   
        
        :param sun_alt: Sun altitude [Deg].
        :type sun_alt: float
        :param asf_sun_az: Sun azimuth [Deg]. (Facade convention, i.e. sun_position.py output)
        :type asf_sun_az: float
        :rtype: bool
        """
        return sun_alt >= 0.0 and abs(asf_sun_az) < 90.0
    
    
    def calc_shadow(self, shade, sun_alt, relative_sun_az):
        """
        Coordinate system:
        X = Horizontal direction, parallel to glazing surface
        Y = Vertical direction, parallel to glazing surface
        Z = Perpendicular in respect of glazing surface
    
        """
    
        # Align relative_sun_az with window plane, convert angles to radians
        # Note: this procedure is only done when is sunny, hence relative_sun_az in range[-90, 90];
        relative_sun_az_rad, sun_alt_rad = map(math.radians, [relative_sun_az + 90, sun_alt]);
    
        # Create sun vector
        sunvec_x = math.cos(relative_sun_az_rad) * math.cos(sun_alt_rad);
        sunvec_y = math.sin(sun_alt_rad);
        sunvec_z = math.sin(relative_sun_az_rad) * math.cos(sun_alt_rad);
    
        # Initialize shadow, which represents the projection of the shade panel
        shadow = {}
    
        # Calculate the projection on a 2-D surface (x,y)
        for index, point_3d in enumerate(shade):
            
            # Define t paramater from parametric equation. Window plane is placed z=0 
            t = - point_3d[2] / sunvec_z;
    
            # Project points using sun vector
            x_point = point_3d[0] + sunvec_x * t;
            y_point = point_3d[1] + sunvec_y * t;
    
            shadow[index] = [x_point, y_point];
    
        return shadow
    
    def calc_gross_shadow(self,sun_alt,relative_sun_az):
        """
        projects all shading objects onto window coordinate plane
        """
        gross_shadows = {}
        for k in self.context.keys():
            gross_shadows[k] = self.calc_shadow(self.context[k],sun_alt,relative_sun_az)
        print gross_shadows
        return gross_shadows
    
    # Still in the process of converting from ASF to generic:
    def extract_self_shading(self, sun_alt, relative_sun_az):
        """
        Subtract from gross_shadows dictionary the mutual shading between panels.
        
        *** Pyclipper.Area returns a positive or negative value if polygon definition 
        is counterclockwise or clockwise, respectively.
    
        :param gross_shadows: Shadow on generic wall for every ASF panel
        :type: dict{key:identifier(integer), value:np.ndarray(floats)}
        :return net_shadows: Shadow on generic wall without mutual shading
        :rtype: dict{key:integer, value:np.ndarray(floats)}
        
        Pyclipper functionality:
            - We start with a subject polygon. i.e. the gross shadow:
                ndarray -> [[S0],[S1],[S2],[S3]] (2 levels of [] pairing, shape = 2)
            - We select a surrounding shadow potential to perform shading on subject as clip:
                ndarray -> [[S0],[S1],[S2],[S3]] (2 levels of [] pairing, shape = 2)
                
            - We compute the intersection by a clipping boolean operation.
                - Scenario 1: No intersection, or polygon partly intersected:
                    - Clipper output [[[[P1],[P2],...]]] (3 levels of [] pairing, shape = 3)
                    - The longitude of the list output will be 1 since there is only 1 polygon
                - Scenario 2: Severe intersection, polygon is fragmented:
                    - Clipper output [[[[P1],[P2],...]]] (3 levels of [] pairing, shape = 3)
                    - The longitude of the list output will be >1 since there are several polygons
        
        Conclusion:
            To keep track if there is only one subject polygon or several, use subj.shape.
            If Scenario 1 is performed, save output list as np.asarray(outuput[0]), so shape is 2    
        
        """
        net_shadows = {} # Dictionary containing all the shadow geometries with self-shading extracted
        self_shading_param = {} # Dictionary containing self shading area and width
        self_shading_area = 0 # Initialize variable for cases when net_shadow is sliced
    
        if relative_sun_az >= 0: # Shadow direction right (seen from outdoors).
    
            # Check mutual shading between panels and subtract areas
            for row_index in reversed(range(self.nrows)): # From bottom to top (big to low)
                for col_index in reversed(range(self.ncols)): # From right to left
                    if row_index%2 == col_index%2:
                        # Shadow from which extract self-shading is subject
                        subj = gross_shadows[row_index, col_index]
                        gross_shadow_area = abs(float(pyclipper.Area(subj)))
                        if not gross_shadow_area == 0: # Shadow to which extract self-shading is not null
                            for index2, shadow2 in gross_shadows.iteritems(): #check shadow with surrounders
                                if (sun_alt >= 50 and (index2[0] < row_index or index2[0] == row_index and index2[1] < col_index )) or (sun_alt < 50 and ((index2[0] <= row_index and index2[1] < col_index ) or (index2[0] >= row_index and index2[1] < col_index))): 
    
                                    # Check surrounding shadow on top of subj and the ones to the left
                                    # Surrounding shadows are clip (considered individually)
                                    clip = shadow2
                                    pc = pyclipper.Pyclipper()
                                    if not pyclipper.Area(clip) == 0:
                                        pc.AddPath(clip, pyclipper.PT_CLIP, True)
                                        if len(subj.shape) == 2: # Shape is pairs of []
                                            pc.AddPath(subj, pyclipper.PT_SUBJECT, True) # Subject is one polygon 
                                            
                                        else: # Subject consists of several polygons (previously sliced)
                                            pc.AddPaths(subj, pyclipper.PT_SUBJECT, True)
                                        
                                        # Execute the boolean difference between sub and clip
                                        diff = pc.Execute(pyclipper.CT_DIFFERENCE, pyclipper.PFT_EVENODD, pyclipper.PFT_EVENODD)
                                        
                                        if diff: # Boolean operation successful (not null)
                                            if len(np.asarray(diff))  == 1: # diff contains 1 element. has shape 3
                                                subj = np.asarray(diff[0]) # Rebuild the subject shadow
                                            else: # diff contains more than one elment has shape 3
                                                subj = np.asarray(diff)
                            # Extraction of surrounding shadows completed. Store results
                            if len(subj.shape) == 2:  # Net shadow is one polygon (2d matrix)
        
                                # Store % shaded area from mutual shading
                                self_shading_area = abs(pyclipper.Area(subj))
                                self_shading_param[row_index, col_index] = [1 - (self_shading_area / gross_shadow_area)]
        
                                # If % shaded area is significant, store its width
                                if self_shading_param[row_index, col_index][0] >= 0.1:
                                    self_shading_param[row_index, col_index].append(calc_hor_shading(subj, gross_shadows[row_index, col_index]))
                                else:
                                    self_shading_param[row_index, col_index].append(0)
                                    
                            else: # Net shadow consists of several polygons (previously sliced)
                                
                                for shadow_portion in subj:
                                    self_shading_area += abs(pyclipper.Area(shadow_portion))   
                                    
                                # Store % shaded area from mutual shading
                                self_shading_param[row_index, col_index] = [1 - (self_shading_area / gross_shadow_area)]
                                
                                # If % shaded area is significant, store its width
                                if self_shading_param[row_index, col_index][0] >= 0.1:
                                    dist = 0
                                    for shadow_portion in subj:  
                                        param = calc_hor_shading(shadow_portion, gross_shadows[row_index, col_index])
                                        if param > dist:
                                            dist = param
                                    self_shading_param[row_index, col_index].append(dist)
                                else:
                                    self_shading_param[row_index, col_index].append(0)
        
                        net_shadows[row_index, col_index] = np.asarray(subj) # add to the result the shadow o the unified result
                        self_shading_area = 0 # reset variable
                        
        else: # Shadow direction left (seen from outdoors).
        
            # Check mutual shading between panels and subtract areas
            for row_index in reversed(range(nrows)): # From bottom to top (big to low)
                for col_index in range(ncols): # From left to right (low to big)
                    if row_index%2 == col_index%2:
                        
                        # Shadow to which extract self-shading is subject
                        subj = gross_shadows[row_index, col_index]
                        gross_shadow_area = abs(float(pyclipper.Area(subj)))
                        if not gross_shadow_area == 0: # Shadow to which extract self-shading is not null
                            for index2, shadow2 in gross_shadows.iteritems(): # Check shadow with surrounders
                                if (sun_alt >= 50 and (index2[0] < row_index or index2[0] == row_index and index2[1] > col_index )) or (sun_alt < 50 and ((index2[0] <= row_index and index2[1] > col_index ) or (index2[0] >= row_index and index2[1] > col_index))): 
    
                                    # Check surrounding shadow on top of subj and the ones to the left
                                    # Surrounding shadows are clip (considered individually)
                                    clip = shadow2
                                    pc = pyclipper.Pyclipper()
                                    if not pyclipper.Area(clip) == 0:
                                        pc.AddPath(clip, pyclipper.PT_CLIP, True)
                                        if len(subj.shape) == 2: # Shape is pairs of []
                                            pc.AddPath(subj, pyclipper.PT_SUBJECT, True) # Subject is one polygon 
                                            
                                        else: # Subject consists of several polygons (previously sliced)
                                            pc.AddPaths(subj, pyclipper.PT_SUBJECT, True)
                                        
                                        # Execute the boolean difference between sub and clip
                                        diff = pc.Execute(pyclipper.CT_DIFFERENCE, pyclipper.PFT_EVENODD, pyclipper.PFT_EVENODD)
                                        
                                        if diff: # Boolean operation successful (not null)
                                            if len(np.asarray(diff))  == 1: # diff contains 1 element. has shape 3
                                                subj = np.asarray(diff[0]) # Rebuild the subject shadow
                                            else: # diff contains more than one elment has shape 3
                                                subj = np.asarray(diff)
                            # Extraction of surrounding shadows completed. Store results
                            if len(subj.shape) == 2:  # Net shadow is one polygon (2d matrix)
        
                                # Store % shaded area from mutual shading
                                self_shading_area = abs(pyclipper.Area(subj))
                                self_shading_param[row_index, col_index] = [1 - (self_shading_area / gross_shadow_area)]
        
                                # If % shaded area is significant, store its width
                                if self_shading_param[row_index, col_index][0] >= 0.1:
                                    self_shading_param[row_index, col_index].append(calc_hor_shading(subj, gross_shadows[row_index, col_index]))
                                else:
                                    self_shading_param[row_index, col_index].append(0)
                                    
                            else: # Net shadow consists of several polygons (previously sliced)
                                
                                for shadow_portion in subj:
                                    self_shading_area += abs(pyclipper.Area(shadow_portion))   
                                    
                                # Store % shaded area from mutual shading
                                self_shading_param[row_index, col_index] = [1 - (self_shading_area / gross_shadow_area)]
                                
                                # If % shaded area is significant, store its width
                                if self_shading_param[row_index, col_index][0] >= 0.1:
                                    dist = 0
                                    for shadow_portion in subj:  
                                        param = calc_hor_shading(shadow_portion, gross_shadows[row_index, col_index])
                                        if param > dist:
                                            dist = param
                                    self_shading_param[row_index, col_index].append(dist)
                                else:
                                    self_shading_param[row_index, col_index].append(0)
        
                        net_shadows[row_index, col_index] = np.asarray(subj) # add to the result the shadow o the unified result
                        self_shading_area = 0 # reset variable
                        
        return net_shadows, self_shading_param
    
    def calc_shadow_window(net_shadows):
        """
        Subtract from net_shadows dictionary the regions outside the window frame and
        compute the total shadow laying on the window as a % of its area.
    
        :param net_shadows: Shadow on generic wall for every ASF panel with mutual_shading extracted
        :type: dict{key:identifier(tuple), value:np.ndarray(floats)}
        :param window_width: Width of the window behind the ASF [mm].
        :type window_width: float    
        :param window_height: Height of the window behind the ASF [mm].
        :type window_height: float
        :param panel_offset: Cartesian distance between window frame and nearest PV centerpoint [mm].
        :type panel_offset: float
        :return area_shadow_window: Global net ASF shadow laying on window as % of its area
        :rtype: float
        """
        # Construct window frame geometry
        window_frame = np.array([[0, 0], [window_width, 0], [window_width, - window_height], [0, - window_height]])
        window_frame += [ - panel_offset, panel_offset]
        clip = window_frame # Window frame is clip
        
        # Initialize dictionary and result variable
        shadow_window = {}
        area_shadow_window = 0
        
        for index, shadow in net_shadows.iteritems():
            subj = shadow # Shadow is subj
    
            if not (len(shadow.shape) == 2 and pyclipper.Area(shadow) == 0):            
                pc = pyclipper.Pyclipper()
                pc.AddPath(clip, pyclipper.PT_CLIP, True)
                if len(subj.shape) == 2: # Subject is one polygon
                    pc.AddPath(subj, pyclipper.PT_SUBJECT, True)
                else: # Subject consists of several polygons (previously sliced)
                    pc.AddPaths(subj, pyclipper.PT_SUBJECT, True)
        
                # Exectue boolean intersection
                solution = pc.Execute(pyclipper.CT_INTERSECTION, pyclipper.PFT_EVENODD, pyclipper.PFT_EVENODD)
                
                if solution: # Boolean operation successful (not null)
                    if len(np.asarray(solution)) == 1: # diff contains 1 element. has shape 3
                        subj = np.asarray(solution[0]) # Rebuild the subject shadow
                    else: # diff contains more than one element has shape 3
                        subj = np.asarray(solution)
                else: # Intersection not successful (all the shadow is outside window frame)
                    subj *= 0
            else:
                subj *= 0
    
            shadow_window[index] = np.asarray(subj) # Add to the result
    
        for index, shadow in sorted(shadow_window.iteritems(), reverse = True):
            if shadow.any():
                if len(shadow.shape) == 2:  # Shadow is one polygon
                    area_shadow_window += pyclipper.Area(shadow)
                    
                else: # Shadow consists of several polygons (previously sliced)
                    for shadow_portion in shadow:
                        test = np.asarray(shadow_portion)
                        area_shadow_window += pyclipper.Area(test)
        
        return area_shadow_window
    
    def shading_pattern(self, sun_alt, relative_sun_az):
        """    
        credits: JoanDM
        
        For a given sun position, calculate the shaded area on the window 
        [% window_area], and the mutual shading between panels.
        
        Main strategy -> Instead of computing sun-rays and 3D intersections, map 
                        the shadows in 2D space (window and wall). Output 
                        percentual data for applicable results.
    
        Steps:              
            Project every panel on the wall according to sun rays -> Map the shadows on the wall
            Detect and extract mutual shading -> Extract self intersections of the mapped shadows
            Quantify mutual shading area as % panel area -> Divide new shadow and raw shadow areas
            Particularize shading as % panel side -> Divide new shadow width (parallel to S0-S1) by S0-S3 vector
            Detect and extract shadows outside window -> Keep only the resulting shadows inside window frame
            Quantify shadow on window as % area -> Divide total net shadow area by window area
            
        :param panel_angles: Slope and azimuth of each panel [Deg].
        :type panel_angles: dict{(identifier): [panel_tilt, panel_az]} (Facade convention)
    
            :identifier: (row_number, column_number). (0, 0). Top row, left column
            :type identifier: tuple (int, int)
            :panel_tilt range [0,90). 0 = open position.
            :type panel_tilt: int
            panel_az range [-45,45]. Example facade south: -45 = SE, 45 = SW. (Facade convention)
            :type panel_az: int
    
        :param sun_alt: Sun altitude [Deg].
        :type sun_alt: float
        :param relative_sun_az: Sun azimuth [Deg]. (Facade convention, i.e. sun_position.py output)
        :type relative_sun_az: float
    
            relative_sun_az is a relative angle in respect to ASF plane normal. From there, 
            it ranges clockwise and counterclockise, so its range is [-180, 180)

        :return shading_result: Window shaded area [% window_area], mutual shading [% panel_area, % horizontal]
        :rtype: dict{key:string, value:float or np.ndarray(floats)}
        """
        #???
        #shading_result = dict.fromkeys(panel_angles, [0, 0])
    
        if self.is_sunny(sun_alt, asf_sun_az): # Check if sun rays interact with the ASF
        
            # Calculate the shadow on the window for every PV panel of the ASF
            gross_shadows = self.calc_gross_shadow(sun_alt, asf_sun_az)
    
            # Extract mutual shading between panels by checking the intersection of gross_shadows
            net_shadows, self_shading_param = extract_self_shading(gross_shadows, sun_alt, asf_sun_az)
            
            # Calculate the resulting shadow that lies on the window frame as a % area.
            area_shadow_window = calc_shadow_window(net_shadows)
            
            shading_result = self_shading_param
            shading_result["shadow_on_window"] = area_shadow_window/self.window_area
    
        else: # It's dark. No sun direct rays interact with the facade 
    
            shading_result['shadow_on_window'] = 0.0
    
        return shading_result




""""""""""""""""""""""""""""""""""""""""""""""""""""""""""""""""""""""""""""""

Window = ShadedWindow(window_geometry=_window_geometry,
                    context_geometry=context_geometry, 
                    location=location)


window_centroid = Window.window_centroid
window_normal = Window.window_normal

left_right_points = []
right_left_points = []

sun_alt,relative_sun_az = Window.calc_relative_sun_position(hoy)

print Window.calc_gross_shadow(sun_alt,relative_sun_az)
# ---------- end radiation_with_clipper ----------
sunpath = Ladybug_SunPath(
    location=importepw.location,
    hour=day_month_hour_calculator.hour,
    day=day_month_hour_calculator.day,
    month=day_month_hour_calculator.month,
    timeStep=1,
    centerPt=radiation_with_clipper.window_centroid,
    sunPathScale=Slider(0.05, range=0..0.1),
    dailyOrAnnualSunPath=True)  # -> readMe, sunVectors, sunAltitudes, sunAzimuths, port, sunSpheresMesh, sunPathCrvs, compassCrvs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; disabled; plug-in component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
panel_15 = Panel([sunpath.sunAltitudes, sunpath.sunAzimuths])
pt = Point(radiation_with_clipper.shadow_points)
points = PointList(Points=radiation_with_clipper.visualise, Size=0.3)
panel_16 = Panel(radiation_with_clipper.out)
vdis = VectorDisplay(Anchor=radiation_with_clipper.window_centroid, Vector=radiation_with_clipper.window_normal)
radiationanalysis_2 = Ladybug_RadiationAnalysis(
    geometry=flatten(boundary_2),
    context=flatten(extr),
    gridSize=0.3,
    disFromBase=panel_8,
    selectedSkyMtx=flatten(selectskymtx_2.selectedSkyMtx),
    runIt=toggle_2)  # -> readMe, contextMesh, analysisMesh, testPts, testVec, port, radiationResult, radiationMesh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; disabled; plug-in component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

# ---- group: simulate period
# Simulate Period
simulatemultipletimesteps = Hive_simulateMultipleTimeSteps(
    Zone=simplify(zone2.Zone),
    outdoor_air_temperature=simplify(getsimulationdata.temperature),
    internal_gains=simplify(python.internal_gains),
    solar_gains=simplify(glazedelement.solar_gains),
    occupancy=simplify(python.occupancy),
    illuminance=simplify(glazedelement.illuminance))  # -> out, indoor_air_temperature, mass_temperature, lighting_demand, heating_demand, cooling_demand, energy_demand; inputs outdoor_air_temperature: list, internal_gains: list, solar_gains: list, occupancy: list, illuminance: list
# ---------- simulatemultipletimesteps: Python ----------
# This component can be used to simulate indoor temperature, heating, cooling and lighting demand for a series of hourly time steps.
#
# Hive: A energy simulation plugin developed by the A/S chair at ETH Zurich
# This component is adapted from examples\annualSimulation.py in the RC_BuildingSimulator Github repository
# https://github.com/architecture-building-systems/RC_BuildingSimulator
# Extensive documentation about the model is available on the project wiki.
#
# Author: Justin Zarb <zarbj@student.ethz.ch>
#
# This file is part of Hive
#
# Licensing/Copyright and liability comments go here.
# <Copyright 2018, Architecture and Building Systems - ETH Zurich>
# <Licence: MIT>

"""
Use this component to simulate indoor temperature, heating, cooling and lighting for a series of hourly time steps. You may add a custom zone or leave the Zone arg blank for the default zone.
-
Provided by Hive 0.0.1
    
    Args:
        Zone: Input a customized Zone from the Zone component.
        outdoor_air_temperature: List of hourly outdoor air temperatures
        previous_mass_temperature: The temperature of the mass node during the hour prior to the first time step. This temperature represents the average temperature of the building envelope itself.
        internal_gains: List of hourly internal heat gains [Watts].
        solar_irradiation: List of solar irradiation gains [Watts].
        illuminance: Illuminance after transmitting through the window [Lumens]
        occupancy: Occupancy for the timestep [people/hour/square_meter]
    Returns:
        readMe!: Currently shows the list lengths of all the inputs for quick debugging.
        indoor_air_temperature: Profile of the indoor air temperature.
        lighting_demand: Profile of the lighting energy demand.
        heating_demand: Profile of the heating energy demand required to maintain the heating setpoint temperature defined in the Zone.
        cooling_demand: Profile of the cooling energy demand required to maintain the cooling setpoint temperature defined in the Zone.
        energy_demand: Sum of heating, cooling and lighting demand profiles for the given timestep.
        solar_gains: Estimated solar gains, calculated by multiplying the irradiation by a transmission factor.
        ill: hourly illuminance levels
"""

ghenv.Component.Name = "Hive_simulateMultipleTimeSteps"
ghenv.Component.NickName = 'simulateMultipleTimeSteps'
ghenv.Component.Message = 'VER 0.0.1\nFEB_21_2018'
ghenv.Component.IconDisplayMode = ghenv.Component.IconDisplayMode.application
ghenv.Component.Category = "Hive"
ghenv.Component.SubCategory = "2 | Simulation"
# ComponentExposure=2

import Grasshopper.Kernel as gh
import scriptcontext as sc

""""""""""""""""""""""""""""""""""""""""""""""""""""""""""""""""""""""""""""""
loc = locals()
simulation_variables = ['outdoor_air_temperature','internal_gains',
                    'solar_irradiation','occupancy','illuminance']
variable_summary = {}
for s in simulation_variables:
    if s in loc:
        variable_summary[s] = len(loc[s])
        # Raise warning if no value is detected
        if len(loc[s])==0:
            error = "No data for %s"%s
            e = gh.GH_RuntimeMessageLevel.Error
            ghenv.Component.AddRuntimeMessage(e, error)

# Raise error if one of the input streams is of different length
if True in [variable_summary[s] != variable_summary['outdoor_air_temperature'] for s in variable_summary]:
    error = "Input data must all be of equal length"
    e = gh.GH_RuntimeMessageLevel.Error
    ghenv.Component.AddRuntimeMessage(e, error)

previous_mass_temperature = previous_mass_temperature if previous_mass_temperature is not None else 20.0

print 'Variable summary'
for v in variable_summary:
    print v,variable_summary[v]

""""""""""""""""""""""""""""""""""""""""""""""""""""""""""""""""""""""""""""""

connected = False

while not connected:
    try:
        sc.sticky['RadiationWindow']
        connected = True
    except NameError:
        error = "Add modular_building_physics, emissions_systems and supply_systems components to the canvas!"
        e = gh.GH_RuntimeMessageLevel.error
        ghenv.Component.AddRuntimeMessage(e, error)

if connected:
    hours = len(outdoor_air_temperature)
    
    #Initialise zone object
    if Zone is None:
        Zone = sc.sticky["RC_Zone"]()
        warning = """No zone definition has been detected. The default zone will be
        applied."""
        w = gh.GH_RuntimeMessageLevel.Warning
        ghenv.Component.AddRuntimeMessage(w, warning)
    else:
        Zone = Zone
    
    """
    TODO: Check what the difference between this and the illuminance calculated in 
    the window.
    
    Spectral luminous efficacy (108)- can be calculated from the weather file 
    https://en.wikipedia.org/wiki/Luminous_efficacy
    ill = [s * 108 for s in solar_gains]
    """
    
    #Initialise result lists
    indoor_air_temperature = []
    mass_temperature = []
    energy_demand = []
    heating_demand = []
    cooling_demand = []
    lighting_demand = []
    
    #Start simulation
    for hour in range(0,hours):
        il = illuminance[hour]
        ig = internal_gains[hour]
        ta = outdoor_air_temperature[hour]
        sg = solar_gains[hour]
        oc = occupancy[hour]
    
        #Solve
        Zone.solve_building_energy(ig, sg, ta, previous_mass_temperature)    
        Zone.solve_building_lighting(il, oc)
        
        #Set T_m as t_m_prev for next timestep
        t_m_prev = Zone.t_m
    
        #Record Results
        indoor_air_temperature.append(Zone.t_air)
        mass_temperature.append(Zone.t_m)  # Printing Room Temperature of the medium
        lighting_demand.append(Zone.lighting_demand)  # Print Lighting Demand
        energy_demand.append(Zone.energy_demand)  # Print heating/cooling loads
        heating_demand.append(Zone.heating_demand)
        cooling_demand.append(Zone.cooling_demand)
# ---------- end simulatemultipletimesteps ----------
cooling_demand_w = Panel(simulatemultipletimesteps.cooling_demand)
outdoor_temperature = Panel(getsimulationdata.temperature)
heating_demand_w = Panel(simulatemultipletimesteps.heating_demand)
indoor_temperature = Panel(simulatemultipletimesteps.indoor_air_temperature)
lighting_demand_w = Panel(simulatemultipletimesteps.lighting_demand)
mass_temperature = Panel(simulatemultipletimesteps.mass_temperature)

# ----
ins_9 = InsertItems(List=simulatemultipletimesteps.cooling_demand, Item=title_8, Indices=0, Wrap=True)  # -> graft(List)
ins_10 = InsertItems(List=simulatemultipletimesteps.heating_demand, Item=title_7, Indices=0, Wrap=True)  # -> graft(List)
ins_11 = InsertItems(List=simulatemultipletimesteps.lighting_demand, Item=title_9, Indices=0, Wrap=True)  # -> graft(List)
ins_12 = InsertItems(List=simulatemultipletimesteps.indoor_air_temperature, Item=title, Indices=0, Wrap=True)  # -> graft(List)
merge_2 = Merge(
    Data1=simplify(ins),
    Data2=simplify(ins_2),
    Data3=simplify(ins_10),
    Data4=simplify(ins_9),
    Data5=simplify(ins_11),
    Data6=simplify(ins_7))  # disabled
merge_3 = Merge(Data1=simplify(ins_3), Data2=simplify(ins_4), Data3=simplify(ins_12))  # disabled
# Export Attributes and Results
join_3 = TextJoin(Text=merge_2, Join=",")  # -> flatten(Result); disabled
join_4 = TextJoin(Text=merge_3, Join=",")  # -> flatten(Result); disabled
python_4 = PythonScript(results=join_3, fileAddress=panel_3, export=toggle_3)  # -> out, a; inputs results: list; disabled; same code as python_2
python_5 = PythonScript(results=join_4, fileAddress=panel_4, export=toggle_3)  # -> out, a; inputs results: list; disabled; same code as python_2
merge_4 = Merge(
    Data1=simplify(ins),
    Data2=simplify(ins_2),
    Data3=simplify(ins_10),
    Data4=simplify(ins_9),
    Data5=simplify(ins_11),
    Data6=simplify(ins_7),
    Data7=simplify(ins_3),
    Data8=simplify(ins_4),
    Data9=simplify(ins_12),
    Data10=simplify(ins_5),
    Data11=simplify(ins_6),
    Data12=simplify(ins_8))
join_5 = TextJoin(Text=merge_4, Join=",")  # -> flatten(Result)
python_6 = PythonScript(results=join_5, fileAddress=panel_11, export=toggle_3)  # -> out, a; inputs results: list; same code as python_3

radiation = Panel("hoy")  # disabled
radiation_2 = Panel("radiation")  # disabled
radiation_3 = Panel("internal_gains")
day_month_hour_calculator_2 = Ladybug_Day_Month_Hour(HOY=getsimulationdata.hour_of_year)  # -> day, month, hour, date; disabled; plug-in component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
ins_13 = InsertItems(List=variable_recorder.recorded_result, Item=radiation_2, Indices=0, Wrap=True)  # -> graft(List); disabled
ins_14 = InsertItems(List=python.internal_gains, Item=radiation_3, Indices=0, Wrap=True)  # -> graft(List); disabled
ins_15 = InsertItems(List=day_month_hour_calculator_2.date, Item=radiation, Indices=0, Wrap=True)  # -> graft(List); disabled
merge_5 = Merge(Data1=simplify(ins_15), Data2=simplify(ins_13), Data3=simplify(ins_14))  # disabled
join_6 = TextJoin(Text=merge_5, Join=",")  # -> flatten(Result); disabled
inputs = Panel(join_6)  # disabled

ma = MassAddition(Input=flatten(simulatemultipletimesteps.cooling_demand))  # -> Result, PartialResults
ma_2 = MassAddition(Input=flatten(simulatemultipletimesteps.heating_demand))  # -> Result, PartialResults
ma_3 = MassAddition(Input=flatten(simulatemultipletimesteps.lighting_demand))  # -> Result, PartialResults
multiplication_2 = Multiplication(A=ma.Result, B="-1")
panel_17 = Panel("""Cooling
Heating
Lighting""")
merge_6 = Merge(Data1=multiplication_2, Data2=ma_2.Result, Data3=ma_3.Result)  # -> simplify(graft(Result))
panel_18 = Panel(merge_6)
repeat = RepeatData(Data=graft(panel_17), Length=merge_6)  # -> flatten(Data)
pie = PieChart(repeat)

# ----
# Unit Tests (just like python version)
panel_19 = Panel("test")
buildingphysics = Hive_BuildingPhysics(systems=[emissionsystems, supplysystems])  # -> out; inputs systems: list
# ---------- buildingphysics: Python ----------
# This comoponent contains an object-oriented adaptation of the RC model referred to as the 'Simple Hourly Method' in ISO 13790, (superceded by EN ISO 52016-1).
#
# Hive: An educational plugin developed by the A/S chair at ETH Zurich
# This component is based on building_physics.py in the RC_BuildingSimulator github repository
# https://github.com/architecture-building-systems/RC_BuildingSimulator
# Extensive documentation is available on the project wiki.
#
# Authors: Prageeth Jayathissa <jayathissa@arch.ethz.ch>, Justin Zarb <zarbj@student.ethz.ch>
# Credits: Gabriel Happle, Justin Zarb, Michael Fehr
# Adapted for Grasshopper by Justin Zarb
#
# This file is part of Hive
#
# Licensing/Copywrite and liability comments go here.
# Copyright 2018, Architecture and Building Systems - ETH Zurich
# Licence: MIT

"""
Place this component in the grasshopper workspace so that zones can be defined and simulations run.
-
Provided by Hive 0.0.1
"""

ghenv.Component.Name = "Hive_BuildingPhysics"
ghenv.Component.NickName = 'BuildingPhysics'
ghenv.Component.Message = 'VER 0.0.1\nFEB_26_2018'
ghenv.Component.IconDisplayMode = ghenv.Component.IconDisplayMode.application
ghenv.Component.Category = "Hive"
ghenv.Component.SubCategory = "0 | Core"
# ComponentExposure=1

import scriptcontext as sc
import Grasshopper.Kernel as ghKernel

class Building(object):
    '''Sets the parameters of the building. '''

    def __init__(self,
                 window_area=13.5,
                 external_envelope_area=15.19,
                 room_depth=7,
                 room_width=4.9,
                 room_height=3.1,
                 lighting_load=11.7,
                 lighting_control=300,
                 lighting_utilisation_factor=0.45,
                 lighting_maintenance_factor=0.9,
                 u_walls=0.2,
                 u_windows=1.1,
                 g_windows=0.6,
                 ach_vent=1.5,
                 ach_infl=0.5,
                 ventilation_efficiency=0,
                 thermal_capacitance_per_floor_area=165000,
                 t_set_heating=20,
                 t_set_cooling=26,
                 max_cooling_energy_per_floor_area=-12,
                 max_heating_energy_per_floor_area=12,
                 heating_supply_system=sc.sticky["DirectHeater"],
                 cooling_supply_system=sc.sticky["DirectCooler"],
                 heating_emission_system=sc.sticky["AirConditioning"],
                 cooling_emission_system=sc.sticky["AirConditioning"],
                 ):

        # Building Dimensions
        self.window_area = window_area  # [m2] Window Area
        self.room_depth = room_depth  # [m] Room Depth
        self.room_width = room_width  # [m] Room Width
        self.room_height = room_height  # [m] Room Height

        # Fenestration and Lighting Properties
        self.g_windows = g_windows
        self.lighting_load = lighting_load  # [kW/m2] lighting load
        self.lighting_control = lighting_control  # [lux] Lighting set point
        # How the light entering the window is transmitted to the working plane
        self.lighting_utilisation_factor = lighting_utilisation_factor
        # How dirty the window is. Section 2.2.3.1 Environmental Science
        # Handbook
        self.lighting_maintenance_factor = lighting_maintenance_factor

        # Calculated Properties
        self.floor_area = room_depth * room_width  # [m2] Floor Area
        # [m2] Effective Mass Area assuming a medium weight building #12.3.1.2
        self.mass_area = self.floor_area * 2.5
        self.room_vol = room_width * room_depth * \
            room_height  # [m3] Room Volume
        self.total_internal_area = self.floor_area * 2 + \
            room_width * room_height * 2 + room_depth * room_height * 2
        # TODO: Standard doesn't explain what A_t is. Needs to be checked
        self.A_t = self.total_internal_area

        # Single Capacitance  5 conductance Model Parameters
        # [kWh/K] Room Capacitance. Default based on ISO standard 12.3.1.2 for medium heavy buildings
        self.c_m = thermal_capacitance_per_floor_area * self.floor_area
        # Conductance of opaque surfaces to exterior [W/K]
        self.h_tr_em = u_walls * (external_envelope_area - window_area)
        # Conductance to exterior through glazed surfaces [W/K], based on
        # U-wert of 1W/m2K
        self.h_tr_w = u_windows * window_area

        # Determine the ventilation conductance
        ach_tot = ach_infl + ach_vent  # Total Air Changes Per Hour
        # temperature adjustment factor taking ventilation and infiltration
        # [ISO: E -27]
        b_ek = (1 - (ach_vent / (ach_tot)) * ventilation_efficiency)
        self.h_ve_adj = 1200 * b_ek * self.room_vol * \
            (ach_tot / 3600)  # Conductance through ventilation [W/M]
        # transmittance from the internal air to the thermal mass of the
        # building
        self.h_tr_ms = 9.1 * self.mass_area
        # Conductance from the conditioned air to interior building surface
        self.h_tr_is = self.total_internal_area * 3.45

        # Thermal set points
        self.t_set_heating = t_set_heating
        self.t_set_cooling = t_set_cooling

        # Thermal Properties
        self.has_heating_demand = False  # Boolean for if heating is required
        self.has_cooling_demand = False  # Boolean for if cooling is required
        self.max_cooling_energy = max_cooling_energy_per_floor_area * \
            self.floor_area  # max cooling load (W/m2)
        self.max_heating_energy = max_heating_energy_per_floor_area * \
            self.floor_area  # max heating load (W/m2)

        # Building System Properties
        self.heating_supply_system = heating_supply_system
        self.cooling_supply_system = cooling_supply_system
        self.heating_emission_system = heating_emission_system
        self.cooling_emission_system = cooling_emission_system

    def solve_building_lighting(self, illuminance, occupancy):
        """
        Calculates the lighting demand for a set timestep

        :param illuminance: Illuminance transmitted through the window [Lumens]
        :type illuminance: float
        :param occupancy: Probability of full occupancy
        :type occupancy: float

        :return: self.lighting_demand, Lighting Energy Required for the timestep
        :rtype: float

        """
        # Cite: Environmental Science Handbook, SV Szokolay, Section 2.2.1.3
        # also, this might be sped up by pre-calculating the constants, but idk. first check with profiler...
        lux = (illuminance * self.lighting_utilisation_factor *
               self.lighting_maintenance_factor) / self.floor_area  # [Lux]

        if lux < self.lighting_control and occupancy > 0:
            # Lighting demand for the hour
            self.lighting_demand = self.lighting_load * self.floor_area
        else:
            self.lighting_demand = 0

    def solve_building_energy(self, internal_gains, solar_gains, t_out, t_m_prev):
        """
        Calculates the heating and cooling consumption of a building for a set timestep

        :param internal_gains: internal heat gains from people and appliances [W]
        :type internal_gains: float
        :param solar_gains: solar heat gains [W]
        :type solar_gains: float
        :param t_out: Outdoor air temperature [C]
        :type t_out: float
        :param t_m_prev: Previous air temperature [C]
        :type t_m_prev: float

        :return: self.heating_demand, space heating demand of the building
        :return: self.heating_sys_electricity, heating electricity consumption
        :return: self.heating_sys_fossils, heating fossil fuel consumption 
        :return: self.cooling_demand, space cooling demand of the building
        :return: self.cooling_sys_electricity, electricity consumption from cooling
        :return: self.cooling_sys_fossils, fossil fuel consumption from cooling
        :return: self.electricity_out, electricity produced from combined heat pump systems
        :return: self.sys_total_energy, total exergy consumed (electricity + fossils) for heating and cooling
        :return: self.heating_energy, total exergy consumed (electricity + fossils) for heating 
        :return: self.cooling_energy, total exergy consumed (electricity + fossils) for cooling
        :return: self.cop, Coefficient of Performance of the heating or cooling system
        :rtype: float

        """
        # Main File

        # Calculate the heat transfer definitions for formula simplification
        self.calc_h_tr_1()
        self.calc_h_tr_2()
        self.calc_h_tr_3()

        # check demand, and change state of self.has_heating_demand, and self._has_cooling_demand
        self.has_demand(internal_gains, solar_gains, t_out, t_m_prev)

        if not self.has_heating_demand and not self.has_cooling_demand:

            # no heating or cooling demand
            # calculate temperatures of building R-C-model and exit
            # --> rc_model_function_1(...)
            self.energy_demand = 0

            # y u no pep8 bra?
            self.heating_demand = 0  # Energy required by the zone
            self.cooling_demand = 0  # Energy surplus of the zone
            # Energy (in electricity) required by the supply system to provide
            # HeatingDemand
            self.heating_sys_electricity = 0
            # Energy (in fossil fuel) required by the supply system to provide
            # HeatingDemand
            self.heating_sys_fossils = 0
            # Energy (in electricity) required by the supply system to get rid
            # of CoolingDemand
            self.cooling_sys_electricity = 0
            # Energy (in fossil fuel) required by the supply system to get rid
            # of CoolingDemand
            self.cooling_sys_fossils = 0
            # Electricity produced by the supply system (e.g. CHP)
            self.electricity_out = 0

        else:

            # has heating/cooling demand

            # Calculates energy_demand used below
            self.calc_energy_demand(
                internal_gains, solar_gains, t_out, t_m_prev)

            self.calc_temperatures_crank_nicolson(
                self.energy_demand, internal_gains, solar_gains, t_out, t_m_prev)
            # calculates the actual t_m resulting from the actual heating
            # demand (energy_demand)

            # Calculate the Heating/Cooling Input Energy Required

            supply_director = sc.sticky["SupplyDirector"]()  # Initialise Heating System Manager

            if self.has_heating_demand:
                supply_director.set_builder(self.heating_supply_system(load=self.energy_demand, 
                                                                t_out=t_out, 
                                                                heating_supply_temperature=self.heating_supply_temperature,
                                                                cooling_supply_temperature=self.cooling_supply_temperature, 
                                                                has_heating_demand=self.has_heating_demand, 
                                                                has_cooling_demand=self.has_cooling_demand))
                supplyOut = supply_director.calc_system()
                # All Variables explained underneath line 467
                self.heating_demand = self.energy_demand
                self.heating_sys_electricity = supplyOut.electricity_in
                self.heating_sys_fossils = supplyOut.fossils_in
                self.cooling_demand = 0
                self.cooling_sys_electricity = 0
                self.cooling_sys_fossils = 0
                self.electricity_out = supplyOut.electricity_out

            elif self.has_cooling_demand:
                supply_director.set_builder(self.cooling_supply_system(load=self.energy_demand * (-1), 
                                                                t_out=t_out, 
                                                                heating_supply_temperature=self.heating_supply_temperature,
                                                                cooling_supply_temperature=self.cooling_supply_temperature, 
                                                                has_heating_demand=self.has_heating_demand, 
                                                                has_cooling_demand=self.has_cooling_demand))
                supplyOut = supply_director.calc_system()
                self.heating_demand = 0
                self.heating_sys_electricity = 0
                self.heating_sys_fossils = 0
                self.cooling_demand = self.energy_demand
                self.cooling_sys_electricity = supplyOut.electricity_in
                self.cooling_sys_fossils = supplyOut.fossils_in
                self.electricity_out = supplyOut.electricity_out

            self.cop = supplyOut.cop

        self.sys_total_energy = self.heating_sys_electricity + self.heating_sys_fossils + \
            self.cooling_sys_electricity + self.cooling_sys_fossils
        self.heating_energy = self.heating_sys_electricity + self.heating_sys_fossils
        self.cooling_energy = self.cooling_sys_electricity + self.cooling_sys_fossils

    # TODO: rename. this is expected to return a boolean. instead, it changes state??? you don't want to change state...
    # why not just return has_heating_demand and has_cooling_demand?? then call the function "check_demand"
    # has_heating_demand, has_cooling_demand = self.check_demand(...)
    def has_demand(self, internal_gains, solar_gains, t_out, t_m_prev):
        """
        Determines whether the building requires heating or cooling
        Used in: solve_building_energy()

        # step 1 in section C.4.2 in [C.3 ISO 13790]
        """

        # set energy demand to 0 and see if temperatures are within the comfort
        # range
        energy_demand = 0
        # Solve for the internal temperature t_Air
        self.calc_temperatures_crank_nicolson(
            energy_demand, internal_gains, solar_gains, t_out, t_m_prev)

        # If the air temperature is less or greater than the set temperature,
        # there is a heating/cooling load
        if self.t_air < self.t_set_heating:
            self.has_heating_demand = True
            self.has_cooling_demand = False
        elif self.t_air > self.t_set_cooling:
            self.has_cooling_demand = True
            self.has_heating_demand = False
        else:
            self.has_heating_demand = False
            self.has_cooling_demand = False

    def calc_temperatures_crank_nicolson(self, energy_demand, internal_gains, solar_gains, t_out, t_m_prev):
        """
        Determines node temperatures and computes derivation to determine the new node temperatures
        Used in: has_demand(), solve_building_energy(), calc_energy_demand()
        # section C.3 in [C.3 ISO 13790]
        """

        self.calc_heat_flow(t_out, internal_gains, solar_gains, energy_demand)

        self.calc_phi_m_tot(t_out)

        # calculates the new bulk temperature POINT from the old one
        self.calc_t_m_next(t_m_prev)

        # calculates the AVERAGE bulk temperature used for the remaining
        # calculation
        self.calc_t_m(t_m_prev)

        self.calc_t_s(t_out)

        self.calc_t_air(t_out)

        self.calc_t_opperative()

        return self.t_m, self.t_air, self.t_opperative

    def calc_energy_demand(self, internal_gains, solar_gains, t_out, t_m_prev):
        """
        Calculates the energy demand of the space if heating/cooling is active
        Used in: solve_building_energy()
        # Step 1 - Step 4 in Section C.4.2 in [C.3 ISO 13790]
        """

        # Step 1: Check if heating or cooling is needed 
        #(Not needed, but doing so for readability when comparing with the standard)
        # Set heating/cooling to 0
        energy_demand_0 = 0
        # Calculate the air temperature with no heating/cooling
        t_air_0 = self.calc_temperatures_crank_nicolson(
            energy_demand_0, internal_gains, solar_gains, t_out, t_m_prev)[1]

        # Step 2: Calculate the unrestricted heating/cooling required

        # determine if we need heating or cooling based based on the condition
        # that no heating or cooling is required
        if self.has_heating_demand:
            t_air_set = self.t_set_heating
        elif self.has_cooling_demand:
            t_air_set = self.t_set_cooling
        else:
            raise NameError(
                'heating function has been called even though no heating is required')

        # Set a heating case where the heating load is 10x the floor area (10
        # W/m2)
        energy_floorAx10 = 10 * self.floor_area

        # Calculate the air temperature obtained by having this 10 W/m2
        # setpoint
        t_air_10 = self.calc_temperatures_crank_nicolson(
            energy_floorAx10, internal_gains, solar_gains, t_out, t_m_prev)[1]

        # Determine the unrestricted heating/cooling off the building
        self.calc_energy_demand_unrestricted(
            energy_floorAx10, t_air_set, t_air_0, t_air_10)

        # Step 3: Check if available heating or cooling power is sufficient
        if self.max_cooling_energy <= self.energy_demand_unrestricted <= self.max_heating_energy:

            self.energy_demand = self.energy_demand_unrestricted
            self.t_air_ac = t_air_set  # not sure what this is used for at this stage TODO

        # Step 4: if not sufficient then set the heating/cooling setting to the
        # maximum
        # necessary heating power exceeds maximum available power
        elif self.energy_demand_unrestricted > self.max_heating_energy:

            self.energy_demand = self.max_heating_energy

        # necessary cooling power exceeds maximum available power
        elif self.energy_demand_unrestricted < self.max_cooling_energy:

            self.energy_demand = self.max_cooling_energy

        else:
            self.energy_demand = 0
            raise ValueError('unknown radiative heating/cooling system status')

        # calculate system temperatures for Step 3/Step 4
        self.calc_temperatures_crank_nicolson(
            self.energy_demand, internal_gains, solar_gains, t_out, t_m_prev)

    def calc_energy_demand_unrestricted(self, energy_floorAx10, t_air_set, t_air_0, t_air_10):
        """
        Calculates the energy demand of the system if it has no maximum output restrictions
        # (C.13) in [C.3 ISO 13790]


        Based on the Thales Intercept Theorem. 
        Where we set a heating case that is 10x the floor area and determine the temperature as a result 
        Assuming that the relation is linear, one can draw a right angle triangle. 
        From this we can determine the heating level required to achieve the set point temperature
        This assumes a perfect HVAC control system
        """
        self.energy_demand_unrestricted = energy_floorAx10 * \
            (t_air_set - t_air_0) / (t_air_10 - t_air_0)

    def calc_heat_flow(self, t_out, internal_gains, solar_gains, energy_demand):
        """
        Calculates the heat flow from the solar gains, heating/cooling system, and internal gains into the building

        The input of the building is split into the air node, surface node, and thermal mass node based on
        on the following equations

        #C.1 - C.3 in [C.3 ISO 13790]

        Note that this equation has diverged slightly from the standard 
        as the heating/cooling node can enter any node depending on the
        emission system selected

        """

        # Calculates the heat flows to various points of the building based on the breakdown in section C.2, formulas C.1-C.3
        # Heat flow to the air node
        self.phi_ia = 0.5 * internal_gains
        # Heat flow to the surface node
        self.phi_st = (1 - (self.mass_area / self.A_t) - (self.h_tr_w /
                            (9.1 * self.A_t))) * (0.5 * internal_gains + solar_gains)
        # Heatflow to the thermal mass node
        self.phi_m = (self.mass_area / self.A_t) * \
            (0.5 * internal_gains + solar_gains)

        # We call the EmissionDirector to modify these flows depending on the
        # system and the energy demand
        emDirector = sc.sticky["EmissionDirector"]()
        # Set the emission system to the type specified by the user
        emDirector.set_builder(self.heating_emission_system(
            energy_demand=energy_demand))
        # Calculate the new flows to each node based on the heating system
        flows = emDirector.calc_flows()

        # Set modified flows to building object
        self.phi_ia += flows.phi_ia_plus
        self.phi_st += flows.phi_st_plus
        self.phi_m += flows.phi_m_plus

        # Set supply temperature to building object
        # TODO: This currently is constant for all emission systems, to be
        # modified in the future
        self.heating_supply_temperature = flows.heating_supply_temperature
        self.cooling_supply_temperature = flows.cooling_supply_temperature

    def calc_t_m_next(self, t_m_prev):
        """
        Primary Equation, calculates the temperature of the next time step
        # (C.4) in [C.3 ISO 13790]
        """

        self.t_m_next = ((t_m_prev * ((self.c_m / 3600.0) - 0.5 * (self.h_tr_3 + self.h_tr_em))) +
                         self.phi_m_tot) / ((self.c_m / 3600.0) + 0.5 * (self.h_tr_3 + self.h_tr_em))

    def calc_phi_m_tot(self, t_out):
        """
        Calculates a global heat transfer. This is a definition used to simplify equation
        calc_t_m_next so it's not so long to write out
        # (C.5) in [C.3 ISO 13790]
        # h_ve = h_ve_adj and t_supply = t_out [9.3.2 ISO 13790]
        """

        t_supply = t_out  # ASSUMPTION: Supply air comes straight from the outside air

        self.phi_m_tot = self.phi_m + self.h_tr_em * t_out + \
            self.h_tr_3 * (self.phi_st + self.h_tr_w * t_out + self.h_tr_1 *
                           ((self.phi_ia / self.h_ve_adj) + t_supply)) / self.h_tr_2

    def calc_h_tr_1(self):
        """
        Definition to simplify calc_phi_m_tot
        # (C.6) in [C.3 ISO 13790]

        """
        self.h_tr_1 = 1.0 / (1.0 / self.h_ve_adj + 1.0 / self.h_tr_is)

    def calc_h_tr_2(self):
        """
        Definition to simplify calc_phi_m_tot
        # (C.7) in [C.3 ISO 13790]

        """

        self.h_tr_2 = self.h_tr_1 + self.h_tr_w

    def calc_h_tr_3(self):
        """
        Definition to simplify calc_phi_m_tot
        # (C.8) in [C.3 ISO 13790]

        """

        self.h_tr_3 = 1.0 / (1.0 / self.h_tr_2 + 1.0 / self.h_tr_ms)


    def calc_t_m(self, t_m_prev):
        """
        Temperature used for the calculations, average between newly calculated and previous bulk temperature
        # (C.9) in [C.3 ISO 13790]
        """
        self.t_m = (self.t_m_next + t_m_prev) / 2.0

    def calc_t_s(self, t_out):
        """
        Calculate the temperature of the inside room surfaces
        # (C.10) in [C.3 ISO 13790]
        # h_ve = h_ve_adj and t_supply = t_out [9.3.2 ISO 13790]
        """

        t_supply = t_out  # ASSUMPTION: Supply air comes straight from the outside air

        self.t_s = (self.h_tr_ms * self.t_m + self.phi_st + self.h_tr_w * t_out + self.h_tr_1 * \
            (t_supply + self.phi_ia / self.h_ve_adj)) / \
            (self.h_tr_ms + self.h_tr_w + self.h_tr_1)

    def calc_t_air(self, t_out):
        """
        Calculate the temperature of the air node
        # (C.11) in [C.3 ISO 13790]
        # h_ve = h_ve_adj and t_supply = t_out [9.3.2 ISO 13790]
        """

        t_supply = t_out

        # Calculate the temperature of the inside air
        self.t_air = (self.h_tr_is * self.t_s + self.h_ve_adj *
                      t_supply + self.phi_ia) / (self.h_tr_is + self.h_ve_adj)

    def calc_t_opperative(self):
        """
        The opperative temperature is a weighted average of the air and mean radiant temperatures. 
        It is not used in any further calculation at this stage
        # (C.12) in [C.3 ISO 13790]
        """

        self.t_opperative = 0.3 * self.t_air + 0.7 * self.t_s


error = "Connect emissions_systems and supply_systems components!"
e = ghKernel.GH_RuntimeMessageLevel.Error

if systems == [] or len(systems) != 2:
    ghenv.Component.AddRuntimeMessage(e, error)

if any(['Emission' in s for s in systems]) and any(['Supply' in s for s in systems]):
    sc.sticky["RC_Zone"] = Building
    sc.sticky['pushback']()    
    sc.sticky['pushback']()
    print 'Building Physics is go!'
# ---------- end buildingphysics ----------
test = Slider(0, range=0..16)
unittestmaster = Hive_unitTestMaster(run=test)  # -> out, number_of_tests, Zone, port, outdoor_air_temperature, previous_mass_temperature, internal_gains, solar_gains, illuminance, occupancy; inputs run: Int32
# ---------- unittestmaster: Python ----------
# This component runs unit tests on the RC model
#
# Hive: A energy simulation plugin developed by the A/S chair at ETH Zurich
#
# This component is based on tests\testRCmodel.py (accessed 2/22/2018) 
# in the RC_BuildingSimulator Github repository:
# https://github.com/architecture-building-systems/RC_BuildingSimulator
# Documentation is available on the project wiki.
#
# Author: Prageeth Jayathissa
# Adapted for Grasshopper by Justin Zarb <zarbj@student.ethz.ch>
#
# This file is part of Hive
#
# Licensing/Copyright and liability comments go here.
# <Copyright 2018, Architecture and Building Systems - ETH Zurich>
# <Licence: MIT>

"""
Use this component to run standard tests on the RC model within the GH environment.
This test ensures that the grasshopper component returns the same results as the python model.

As opposed to the python unit tests, where test parameters are defined within
the function for that specific test, all the parameters are declared within 
dictionaries at the beginning of the script.
-
Provided by Hive 0.0.1
    
    Args:
        Run: The index of the test to be run. 
    Returns:
        Zone: Zone to be tested
        outdoor_air_temperature: The outdoor air temperature for the hour being simulated
        previous_mass_temperature: The temperature of the mass node during the previous hour. This temperature represents the average temperature of the building envelope itself.
        internal_gains: internal heat gains for the hour being simulated in [Watts]
        solar_irradiation: Solar irradiation gains for the hour being simulated in [Watts]. Does not account for losses through window!
        illuminance: Illuminance after transmitting through the window [Lumens]
        occupancy: Occupancy for the timestep [people/hour/square_meter]
"""

ghenv.Component.Name = "Hive_unitTestMaster"
ghenv.Component.NickName = 'unitTestMaster'
ghenv.Component.Message = 'VER 0.0.1\nAPR_03_2018'
ghenv.Component.IconDisplayMode = ghenv.Component.IconDisplayMode.application
ghenv.Component.Category = "Hive"
ghenv.Component.SubCategory = "3 | Testing"
# ComponentExposure=1

import scriptcontext as sc
import time

tests = {'t_out':[10,25,10,30,5,10,10,25,10,30,5,10,25,35,35,10,10],
         't_m_prev':[22,24,20,25,19,22,22,24,20,25,19,22,24,24,24,20,20],
         'solar_gains':[2000,4000,2000,5000,2000,2000,2000,4000,2000,5000,2000,
         2000,4000,4000,4000,2000,2000],
         'internal_gains':[10]*17,
         'ill':[44000]*17,
         'occ':[0.1]*17}
#Change illuminance for the two relevant tests
tests['ill'][5] = 4000
tests['ill'][10] = 14000

zones = [None,None,None,None,None,None,
         sc.sticky['RC_Zone'](ventilation_efficiency=0.66),
         sc.sticky['RC_Zone'](ventilation_efficiency=0.6),
         sc.sticky['RC_Zone'](ventilation_efficiency=0.6),
         sc.sticky['RC_Zone'](ventilation_efficiency=0.6),
         sc.sticky['RC_Zone'](ventilation_efficiency=0.6),
         sc.sticky['RC_Zone'](ventilation_efficiency=0.6),
         sc.sticky['RC_Zone'](cooling_supply_system=sc.sticky["HeatPumpAir"]),
         sc.sticky['RC_Zone'](cooling_supply_system=sc.sticky["HeatPumpAir"]),
         sc.sticky['RC_Zone'](cooling_supply_system=sc.sticky["HeatPumpWater"]),
         sc.sticky['RC_Zone'](ventilation_efficiency=0.6, 
                              heating_supply_system=sc.sticky["HeatPumpAir"]),
         sc.sticky['RC_Zone'](ventilation_efficiency=0.6, 
                              heating_supply_system=sc.sticky["HeatPumpWater"]),
         ]

sc.sticky['expected_results'] = {
    'name':['NoHVACNoLight','CoolingRequired','HeatingRequired',
            'MaxCoolingRequired', 'MaxHeatingRequired','lightingrequired',
            'NoHVACNoLight_infl','CoolingRequired_infl',
            'test_HeatingRequired_infl','MaxCoolingRequired_infl',
            'test_MaxHeatingRequired_infl','test_lightingrequired_infl',
            'HeatPumpCoolingRequiredHighCOP',
            'HeatPumpCoolingRequired',
            'WaterHeatPumpCoolingRequired',
            'AirHeatPump_HeatingRequired_infl',
            'WaterHeatPump_HeatingRequired_infl'],
    'mass_temperature':[22.33,25.15,20.46,26.49,19.39,22.33,22.44,25.15,20.46,
    26.48,19.51,22.43,25.15,25.33,25.33,20.46,20.46],    
    'energy_demand':[None,-264.75,328.09,-411.6,411.6,0,0,-296.65,9.1,-411.6,
    411.6,0,-264.75,-411.6,-411.6,9.1,9.1],    
    'lighting_demand':[0,None,0,0,0,401.31,0,0,0,0,401.31,0,None,0,0,0,0],    
    'heating_sys_electricity':[0,0,328.09,0,411.6,0,0,0,9.1,0,411.6,0,0,0,0,
    2.43,1.97],    
    'cooling_sys_electricity':[0,264.75,0,411.6,0,0,0,296.65,0,411.6,0,0,55.87,
    107.44,52.12,0,0],
    'cop':[None,None,None,None,None,None,None,None,None,None,None,None,4.74,
    3.83,7.9,3.75,4.62]
    }

def main(run):
    if not sc.sticky.has_key('RC_Zone'): return "Add the building physics component to the canvas!"
    try:
        Zone = zones[run]
        outdoor_air_temperature = tests['t_out'][run]
        previous_mass_temperature = tests['t_m_prev'][run]
        internal_gains = tests['internal_gains'][run]
        solar_gains = tests['solar_gains'][run]
        illuminance = tests['ill'][run]
        occupancy = tests['occ'][run]
        return Zone, outdoor_air_temperature, previous_mass_temperature, internal_gains, solar_gains, illuminance, occupancy
    except TypeError:
        pass

number_of_tests= len(sc.sticky['expected_results']['name']) -1

try:
    Zone, outdoor_air_temperature, previous_mass_temperature, internal_gains, solar_gains, illuminance, occupancy = main(run)
except ValueError:
    print main(run)
# ---------- end unittestmaster ----------
c_script_3 = CSharpScript(name=panel_19, min=0, max=unittestmaster.number_of_tests, decimals=0)  # -> out, A; inputs name: String, min: Double, max: Double, decimals: Int32; same code as c_script
simulateonetimestep = Hive_simulateOneTimeStep(
    Zone=unittestmaster.Zone,
    outdoor_air_temperature=unittestmaster.outdoor_air_temperature,
    previous_mass_temperature=unittestmaster.previous_mass_temperature,
    internal_gains=unittestmaster.internal_gains,
    solar_gains=unittestmaster.solar_gains,
    illuminance=unittestmaster.illuminance,
    occupancy=unittestmaster.occupancy)  # -> readMe, indoor_air_temperature, mass_temperature, lighting_demand, heating_demand, heating_sys_electricity, cooling_demand, cooling_sys_electricity, energy_demand, cop
# ---------- simulateonetimestep: Python ----------
# This component can be used to simulate a single timestep, which is mostly useful for testing and debugging.
#
# Hive: A energy simulation plugin developed by the A/S chair at ETH Zurich
# This component is based on examples\hourSimulation.py in the RC_BuildingSimulator Github repository
# https://github.com/architecture-building-systems/RC_BuildingSimulator
# Extensive documentation is available on the project wiki.
#
# Author: Justin Zarb <zarbj@student.ethz.ch>
#
# This file is part of Hive
#
# Licensing/Copyright and liability comments go here.
# <Copyright 2018, Architecture and Building Systems - ETH Zurich>
# <Licence: MIT>

"""
Use this component to simulate a single timestep. You may add a custom zone or leave the Zone arg blank for the default zone.
-
Provided by Hive 0.0.1
    
    Args:
        Zone: Input a customized Zone from the Zone component.
        outdoor_air_temperature: The outdoor air temperature for the hour being simulated
        previous_mass_temperature: The temperature of the mass node during the previous hour. This temperature represents the average temperature of the building envelope itself.
        internal_gains: internal heat gains for the hour being simulated in [Watts]
        solar_gains: Solar irradiation gains for the hour being simulated in [Watts]. Does not account for losses through window!
        illuminance: Illuminance after transmitting through the window [Lumens]
        occupancy: Occupancy for the timestep [people/hour/square_meter]
    Returns:
        readMe!: ...
        indoor_air_temperature: Indoor air temperature for the given time step
        mass_temperature: The mass node temperature for the hour simulated
        lighting_demand: lighting energy demand for the given time step
        heating_demand: heating energy demand required to maintain the heating setpoint temperature defined in the Zone.
        heating_sys_electricity: Heating electricity consumption
        cooling_demand: cooling energy demand required to maintain the cooling setpoint temperature defined in the Zone.
        cooling_sys_electricity: Cooling electricity consumption
        energy_demand: Sum of heating, cooling and lighting demand for the given timestep.
        cop: coefficient of performance of the heating/cooling system for this hour
 
"""

ghenv.Component.Name = "Hive_simulateOneTimeStep"
ghenv.Component.NickName = 'simulateOneTimeStep'
ghenv.Component.Message = 'VER 0.0.1\nMAR_23_2018'
ghenv.Component.IconDisplayMode = ghenv.Component.IconDisplayMode.application
ghenv.Component.Category = "Hive"
ghenv.Component.SubCategory = "2 | Simulation"
# ComponentExposure=2

import Grasshopper.Kernel as gh
import scriptcontext as sc

connected = False

while not connected:
    try:
        sc.sticky["SupplyDirector"]
        sc.sticky["EmissionDirector"]
        connected = True
    except NameError:
        error = "Add the building_physics, emissions_systems and supply_systems components to the canvas!"
        e = gh.GH_RuntimeMessageLevel.error
        ghenv.Component.AddRuntimeMessage(e, error)

if connected:
    inputs = {'outdoor_air_temperature':outdoor_air_temperature,
            'previous_mass_temperature':previous_mass_temperature,
            'internal_gains':internal_gains,
            'solar_gains':solar_gains,
            'illuminance':illuminance,
            'occupancy':occupancy,
            'Zone':Zone}
    
    defaults = {'outdoor_air_temperature':10,
            'previous_mass_temperature':20,
            'internal_gains':10,
            'solar_gains':2000,
            'illuminance':44000,
            'occupancy':0.1,
            'Zone':sc.sticky["RC_Zone"]()}
    
    
    # Initialise parameters
    def assign_default_values(input):
        try:
            assert inputs[input] is not None
        except:
            inputs[input] = defaults[input]
        print input,inputs[input]
    
    for i in inputs.keys():
        assign_default_values(i)
    
    Zone = inputs['Zone']
    Zone.solve_building_energy(inputs['internal_gains'], 
                               inputs['solar_gains'],
                               inputs['outdoor_air_temperature'],
                               inputs['previous_mass_temperature'])
    
    Zone.solve_building_lighting(inputs['illuminance'],
                                 inputs['occupancy'])
    
    indoor_air_temperature = Zone.t_air
    mass_temperature = Zone.t_m  # Printing Room Temperature of the medium
    lighting_demand =  Zone.lighting_demand  # Print Lighting Demand
    energy_demand = Zone.energy_demand  # Print heating/cooling loads
    heating_demand = Zone.heating_demand
    heating_sys_electricity = Zone.heating_sys_electricity
    cooling_demand = Zone.cooling_demand
    cooling_sys_electricity = Zone.cooling_sys_electricity
    try:
        cop = Zone.cop
    except AttributeError:
        cop = None
# ---------- end simulateonetimestep ----------
unittestslave = Hive_unitTestSlave(
    mass_temperature=simulateonetimestep.mass_temperature,
    lighting_demand=simulateonetimestep.lighting_demand,
    heating_sys_electricity=simulateonetimestep.heating_sys_electricity,
    cooling_sys_electricity=simulateonetimestep.cooling_sys_electricity,
    energy_demand=simulateonetimestep.energy_demand,
    cop=simulateonetimestep.cop,
    run=test)  # -> out, test_passed; inputs run: Int32
# ---------- unittestslave: Python ----------
# This component confirms that the model outputs match predefined values
#
# Hive: A energy simulation plugin developed by the A/S chair at ETH Zurich
#
# This component is based on tests\testRCmodel.py (accessed 2/22/2018) 
# in the RC_BuildingSimulator Github repository:
# https://github.com/architecture-building-systems/RC_BuildingSimulator
# Documentation is available on the project wiki.
#
# Author: Justin Zarb <zarbj@student.ethz.ch>
#
# This file is part of Hive
#
# Licensing/Copyright and liability comments go here.
# <Copyright 2018, Architecture and Building Systems - ETH Zurich>
# <Licence: MIT>

"""
Use this component to run standard tests on the RC model within the GH environment.
This test ensures that the grasshopper component returns the same results as the python model.
-
Provided by Hive 0.0.1
    
    Args:
        mass_temperature: The mass node temperature for the hour simulated
        lighting_demand: lighting energy demand for the given time step
        heating_demand: heating energy demand required to maintain the heating setpoint temperature defined in the Zone.
        heating_sys_electricity: Heating electricity consumption
        cooling_sys_electricity: Cooling electricity consumption
        cop: coefficient of performance of the heating/cooling system for this hour
        run: index of test to run
    Returns:
        out: Message for whether test is passed or not
        test_passed: True if all tests have been passed.
"""

ghenv.Component.Name = "Hive_unitTestSlave"
ghenv.Component.NickName = 'unitTestSlave'
ghenv.Component.Message = 'VER 0.0.1\nFEB_28_2018'
ghenv.Component.IconDisplayMode = ghenv.Component.IconDisplayMode.application
ghenv.Component.Category = "Hive"
ghenv.Component.SubCategory = "3 | Testing"
# ComponentExposure=2

import scriptcontext as sc

# Initialise results
results = {'mass_temperature':mass_temperature,
           'lighting_demand':lighting_demand,
           'heating_sys_electricity':heating_sys_electricity,
           'cooling_sys_electricity':cooling_sys_electricity,
           'energy_demand':energy_demand,
           'cop':cop}

def is_equal(a,b):
    try:
        assert a==round(b,2)
        return True
    except:
        return False

def run_test(test_number):
    # Create a truth dictionary based on whether each value matches
    test = {}
    for k in sc.sticky['expected_results'].keys():
        try:
            assert sc.sticky['expected_results'][k][test_number] is not None
            test[k] = (is_equal(sc.sticky['expected_results'][k][test_number],results[k]))
        except (KeyError,AssertionError): # there is no 'name' key in the results dictionary
            pass
    
    # if the test passes, just say it passed, otherwise return a breakdown of the test.
    test_passed = reduce(lambda x, y: x * y, test.values(), 1)
    if test_passed:
        return sc.sticky['expected_results']['name'][test_number]+' passed', True
    else: 
        message = [sc.sticky['expected_results']['name'][test_number]+' failed']
        for key in test.keys():
            value = str(round(results[key],2))+'/'+str(sc.sticky['expected_results'][key][test_number])
            token = 'passed' if test[key] else value
            message.append(key+':'+token)
        return message, False

x,test_passed = run_test(run)

# record result
if 'recL' in locals():
    if 'tests_run' in locals():
        if not (run in tests_run):
            tests_run.append(run)
            recL.append(x)
            
        # reset when slider goes to zero
        if run == 0:
            tests_run = [0]
            recL = [run_test(0)[0]]
        else:
            pass
    else:
        tests_run = []
else:
    recL = []


# Print results
for test in recL:
    if type(test) is str:
        print test
    elif type(test) is list:
        print test[0]
        for t in range(1,len(test)):
            print '  ',test[t]
# ---------- end unittestslave ----------
c_script_4 = CSharpScript(toggle=unittestslave.test_passed)  # -> out, A; inputs toggle: Boolean
# ---------- c_script_4: C# ----------
    Color ok = Color.Green;
    Color notOk = Color.Red;

    List<Grasshopper.Kernel.Special.GH_Group> groups = GrasshopperDocument
      .Objects
      .OfType<Grasshopper.Kernel.Special.GH_Group>()
      .Where(gr => gr.ObjectIDs.Contains(Component.InstanceGuid))
      .ToList<Grasshopper.Kernel.Special.GH_Group>();

    Color renderColor = ok;
    if (!toggle)
    {
      renderColor = notOk;
    }

    foreach (Grasshopper.Kernel.Special.GH_Group gr in groups)
    {
      gr.Colour = renderColor;
    }
# ---------- end c_script_4 ----------
panel_20 = Panel(unittestslave.out)

# ----
# y-axis ticks (in progress)
energy = QuickGraph([python.internal_gains, lighting_demand_w, heating_demand_w, cooling_demand_w])
occupancy = QuickGraph(python.occupancy)
eval = Evaluate(F="(y-x)/z+1", x="0", y="30", z="5")
graph_gridlines = PythonScript(start="0", end="30", y_interval="5", x_length=number_of_hours)  # -> out, a; inputs x_length: Int32
# ---------- graph_gridlines: Python ----------
"""
This funtion creates a series of lists which can be used 

list_to_tree was taken from https://gist.github.com/piac/ef91ac83cb5ee92a1294
"""
domain = end - start

def list_to_tree(input, none_and_holes=True, source=[0]):
    """Transforms nestings of lists or tuples to a Grasshopper DataTree"""
    from Grasshopper import DataTree as Tree
    from Grasshopper.Kernel.Data import GH_Path as Path
    from System import Array
    def proc(input,tree,track):
        path = Path(Array[int](track))
        if len(input) == 0 and none_and_holes: tree.EnsurePath(path); return
        for i,item in enumerate(input):
            if hasattr(item, '__iter__'): #if list or tuple
                track.append(i); proc(item,tree,track); track.pop()
            else:
                if none_and_holes: tree.Insert(item,path,i)
                elif item is not None: tree.Add(item,path)
#if input is not None: t=Tree[object]();proc(input,t,source[:]);return t

# create a list of the desired ticks
y_ticks = []
number_of_ticks = int(domain//y_interval)
for ii in range(0,number_of_ticks):
    y_ticks.append(start+ii*y_interval)

# create a list of lists, with each sublist having length x_length
tick_list = []
for tick in y_ticks:
    tick_list.append([tick]*x_length)

a = list_to_tree(tick_list,True,[0])
# ---------- end graph_gridlines ----------
series = Series(Start="0", Step="5", Count=eval)
dup = DuplicateData(Data=graft(series), Number=number_of_hours, Order=True)
panel_21 = Panel(graph_gridlines.out)

# ---- group: Temperature
graph = QuickGraph([outdoor_temperature, indoor_temperature, mass_temperature, dup])

# ==== cluster Cluster
L = ClusterInput()
lng = ListLength(List=L)
G = ClusterInput()
series = Series(Start=0, Step=1, Count=lng)
area = Area(Geometry=G)  # -> Area, Centroid
int = Integer(series)
orient2camera = Ladybug_OrientToCamera(initPosition=area.Centroid)  # -> orientedToCam; plug-in component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
int_2 = ClusterOutput(int)
timer = Timer(TimerInterval=1000, Target=orient2camera)
orientedtocam = ClusterOutput(orient2camera)
