# Grasshopper definition Mothercell_Test_01.gh (Grasshopper 1.0.7)

# ---- group: some inputs
number_slider = Slider(0.467, range=0..1)
number_slider_2 = Slider(0.217, range=0..1)

# ---- group: This cluster will become the Mothercell. Can we customize its image with dynamic graphs?
cluster = Cluster(A=number_slider, B=number_slider_2)

# ---- group: this number should be drawn onto the Cluster component
panel = Panel(cluster)

# ==== cluster Cluster
A = ClusterInput()
B = ClusterInput()
addition = Addition(A=A, B=B)
division = Division(A=addition, B="2")
R = ClusterOutput(division)
