# Grasshopper definition Hive_02_Prototype.gh (Grasshopper 1.0.7)
# plug-ins: HiveIO, solar-tech, sia380Parameters, solar, heatpumps, sia380, GHSolar, epw-reader, TT Toolbox, combustion

rooms_standard = RoomsStandard({"1.1 Wohnen Mehrfamilienhaus": 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, "1.2 Wohnen Einfamilienhaus": {"description": "1.2 Wohnen Einfamilienhaus", "Raumlufttemperatur Auslegung Heizen (Winter)": 21.0, "Nettogeschossflaeche": 20.0, "Thermische Gebaeudehuellflaeche": 38.0, "U-Wert Fenster": 1.2, "Waermeeintragsleistung Personen (bei 24.0 deg C, bzw. 70 W)": 1.3999999999999999, "Jaehrliche Vollaststunden der Geraete": 1780.0, "U-Wert opake Bauteile": 0.20000000000000001, "Jaehrliche Vollaststunden der Raumbeleuchtung": 1450.0, "Vollaststunden pro Jahr (Personen)": 4090.0, "Abminderungsfaktor fuer Fensterrahmen": 0.75, "Aussenluft-Volumenstrom durch Infiltration": 0.14999999999999999, "Raumlufttemperatur Auslegung Kuehlung (Sommer)": 26.0, "Glasanteil": 30.0, "Zeitkonstante": 164.0, "Waermeeintragsleistung der Raumbeleuchtung": 2.7000000000000002, "Waermeeintragsleistung der Geraete": 8.0, "Gesamtenergiedurchlassgrad Verglasung": 0.5, "Temperatur-Aenderungsgrad der Waermerueckgewinnung": 0.69999999999999996, "Aussenluft-Volumenstrom (pro NGF)": 0.59999999999999998}, "2.1 Hotelzimmer": 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, "2.2 Empfang, Lobby": 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, "3.1 Einzel-, Gruppenbuero": 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, "3.2 Grossraumbuero": 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, "3.3 Sitzungszimmer": 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, "3.4 Schalterhalle, Empfang": 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, "4.1 Schulzimmer": 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, "4.2 Lehrerzimmer": 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}, selected="1.2 Wohnen Einfamilienhaus")
rooms_ideal = RoomsIdeal({"1.1 Wohnen Mehrfamilienhaus": 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, "1.2 Wohnen Einfamilienhaus": {"description": "1.2 Wohnen Einfamilienhaus", "Raumlufttemperatur Auslegung Heizen (Winter)": 21.0, "Nettogeschossflaeche": 20.0, "Thermische Gebaeudehuellflaeche": 38.0, "U-Wert Fenster": 0.90000000000000002, "Waermeeintragsleistung Personen (bei 24.0 deg C, bzw. 70 W)": 1.3999999999999999, "Jaehrliche Vollaststunden der Geraete": 1780.0, "U-Wert opake Bauteile": 0.10000000000000001, "Jaehrliche Vollaststunden der Raumbeleuchtung": 1110.0, "Vollaststunden pro Jahr (Personen)": 4090.0, "Abminderungsfaktor fuer Fensterrahmen": 0.75, "Aussenluft-Volumenstrom durch Infiltration": 0.14999999999999999, "Raumlufttemperatur Auslegung Kuehlung (Sommer)": 26.0, "Glasanteil": 30.0, "Zeitkonstante": 238.0, "Waermeeintragsleistung der Raumbeleuchtung": 1.7, "Waermeeintragsleistung der Geraete": 4.0, "Gesamtenergiedurchlassgrad Verglasung": 0.5, "Temperatur-Aenderungsgrad der Waermerueckgewinnung": 0.80000000000000004, "Aussenluft-Volumenstrom (pro NGF)": 0.59999999999999998}, "2.1 Hotelzimmer": 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, "2.2 Empfang, Lobby": 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, "3.1 Einzel-, Gruppenbuero": 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, "3.2 Grossraumbuero": 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, "3.3 Sitzungszimmer": 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, "3.4 Schalterhalle, Empfang": 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, "4.1 Schulzimmer": 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, "4.2 Lehrerzimmer": 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}, selected="1.2 Wohnen Einfamilienhaus")
# Building
# Geometry
rooms_existing = RoomsExisting({"1.1 Wohnen Mehrfamilienhaus": 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, "1.2 Wohnen Einfamilienhaus": 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, "2.1 Hotelzimmer": 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, "2.2 Empfang, Lobby": {"description": "2.2 Empfang, Lobby", "Raumlufttemperatur Auslegung Heizen (Winter)": 21.0, "Nettogeschossflaeche": 144.0, "Thermische Gebaeudehuellflaeche": 113.0, "U-Wert Fenster": 1.5, "Waermeeintragsleistung Personen (bei 24.0 deg C, bzw. 70 W)": 4.7000000000000002, "Jaehrliche Vollaststunden der Geraete": 2990.0, "U-Wert opake Bauteile": 0.80000000000000004, "Jaehrliche Vollaststunden der Raumbeleuchtung": 3900.0, "Vollaststunden pro Jahr (Personen)": 2890.0, "Abminderungsfaktor fuer Fensterrahmen": 0.75, "Aussenluft-Volumenstrom durch Infiltration": 0.29999999999999999, "Raumlufttemperatur Auslegung Kuehlung (Sommer)": 26.0, "Glasanteil": 50.0, "Zeitkonstante": 47.0, "Waermeeintragsleistung der Raumbeleuchtung": 2.7000000000000002, "Waermeeintragsleistung der Geraete": 10.0, "Gesamtenergiedurchlassgrad Verglasung": 0.65000000000000002, "Temperatur-Aenderungsgrad der Waermerueckgewinnung": 0.5, "Aussenluft-Volumenstrom (pro NGF)": 7.2000000000000002}, "3.1 Einzel-, Gruppenbuero": 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, "3.2 Grossraumbuero": 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, "3.3 Sitzungszimmer": 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, "3.4 Schalterhalle, Empfang": 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, "4.1 Schulzimmer": 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, "4.2 Lehrerzimmer": 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}, selected="2.2 Empfang, Lobby")

# ---- group: put a custom path here
# 1. INPUTS
# Environment
panel = Panel("C:\Users\Christoph\AppData\Roaming\Grasshopper\Libraries\hive\Zurich.epw")

# ---- group: ground
mesh = Mesh(<mesh referenced from the Rhino model>)

# ---- group: obstructions
brep = Brep([<brep referenced from the Rhino model> x8])

# ---- group: Zones
brep_2 = Brep(<brep referenced from the Rhino model>)

# ----
mesh_2 = Mesh(brep)

# ---- group: Door
srf = Surface(<surface referenced from the Rhino model>)

# ---- group: Windows
srf_2 = Surface([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])

# ---- group: PVST
# Energy System
# Geometry
srf_3 = Surface([<surface referenced from the Rhino model> x2])

# ---- group: PV
srf_4 = Surface([<surface referenced from the Rhino model> x2])

# ---- group: ST
srf_5 = Surface([<surface referenced from the Rhino model> x2])

# ----
hive_io_bldg = HiveIOBuilding(ZoneBrepGeometries=brep_2, WindowsSurfaces=[srf_2, srf], SIA2024Room=rooms_existing)
hive_io_env = HiveIOEnvironment(EPWPath=panel, ObstaclesGeometry=[mesh_2, mesh])

# ---- group: PV efficiency
panel_2 = Panel("0.2")

# ----
hiveiosolar = HiveIOSolarTech(Mesh=srf_4)
hiveiosolar_2 = HiveIOSolarTech(Mesh=srf_3)
hiveiosolar_3 = HiveIOSolarTech(Mesh=srf_5)

# ----
# Hive.IO Distributor
hiveiodistr = HiveIODistributor(HiveInputObjects=[hive_io_env, hive_io_bldg, hiveiosolar, hiveiosolar_2, hiveiosolar_3])  # -> HiveIOBuilding, HiveIOEnergySystemPV, HiveIOEnergySystemST, HiveIOEnergySystemPVT, HiveIOEnvironment
distributorsia = DistributorSIA(BuildingObj=hiveiodistr.HiveIOBuilding)  # -> ZoneAreas, WindowsAreas, ExtSrfAreas, SIA2024json
distributorepw = DistributorEPW(EnvironmentObj=hiveiodistr.HiveIOEnvironment)
distributorsolar = DistributorSolar(
    BuildingObj=hiveiodistr.HiveIOBuilding,
    EnvironmentObj=hiveiodistr.HiveIOEnvironment,
    PVObj=hiveiodistr.HiveIOEnergySystemPV,
    PVTObj=hiveiodistr.HiveIOEnergySystemPVT,
    STObj=hiveiodistr.HiveIOEnergySystemST)  # -> EnvironmentMesh, BldCentroid, ExtSrfs, PVMesh, PVTMesh, STMesh
distributorsupplysystem = DistributorSupplySystem(PVObj=hiveiodistr.HiveIOEnergySystemPV, STObj=hiveiodistr.HiveIOEnergySystemST, PVTObj=hiveiodistr.HiveIOEnergySystemPVT)  # -> Eta_PV, PVAreas, Eta_ST, STAreas, Eta_PVT_el, Eta_PVT_th, PVTAreas

# ---- group: unobstructed surfaces for PV studies
number_slider = Slider(180, range=0..360)
number_slider_2 = Slider(32.368, range=0..90)

# ----
# max min for solar mesh
panel_3 = Panel("1200")

panel_4 = Panel("""0
1
2
3
5""")
panel_5 = Panel("""0;0;0
0;0;1
0;0;2
0;0;3
0;0;4
0;0;5""")
item = ListItem(List=simplify(panel_5), Index=panel_4, Wrap=True)

# ---- group: optional. connect to CHP component, "str"
panel_6 = Panel("elec_in")

# ----
data = Data([0, 0, 0, 0, 0, 0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])

# ----
# Weather Data
epw_reader = EPWReader(Path=distributorepw)  # -> Latitude, Longitude, CityCountry, DNI, DHI, DryBulb, DewPoint, RH
panel_7 = Panel([epw_reader.Latitude, epw_reader.Longitude, epw_reader.CityCountry])
simplepanel = SimplePanel(
    Tilt=0,
    Azimuth=180,
    DHI=epw_reader.DHI,
    DNI=epw_reader.DNI,
    Latitude=epw_reader.Latitude,
    Longitude=epw_reader.Longitude)
# 2. SIMULATION / CALCULATION
panel_8 = Panel("month")
sum_yield = SumYield(Sum_mode=panel_8, Elec=simplepanel)

panel_9 = Panel([epw_reader.Longitude, epw_reader.Latitude])
skydome = GHSkydome(
    RecursionLevel=Slider(5, range=0..5),
    Viewfactors=Toggle(True),
    CumSkyMatrix=Toggle(False),
    SunPath=Toggle(True),
    SolarVec=Toggle(False),
    HOY=Slider(4212, range=0..8759),
    Location=panel_9,
    DNI=epw_reader.DNI,
    DHI=epw_reader.DHI,
    Size=Slider(0.181, range=0..2),
    Context=distributorsolar.EnvironmentMesh,
    Sp=distributorsolar.BldCentroid)  # -> Mesh, Vectors, Sunpaths, SunGeo

# ---- group: average irradiance on obstructed surface
# Solar Potentials Roof Panels
number_slider_3 = Slider(2, range=0..100)
panel_10 = Panel("""0
1
2
3
4
5""")
item_2 = ListItem(List=[srf_4, srf_3, srf_5], Index=panel_10, Wrap=True)
panel_11 = Panel("""PV left
PV right
PVT left
PVT right
ST left
ST right""")
panel_12 = Panel("""0;0;0
0;0;1
0;0;2
0;0;3
0;0;4
0;0;5""")
srf_6 = Surface(item_2)
mesh_uv = MeshSurface(Surface=srf_6, UCount=number_slider_3, VCount=Slider(2, range=0..100), Overhang=True, Equalize=False)
mesh_3 = Mesh(mesh_uv)
obstructedpanel = ObstructedPanel(
    Mesh_analysis=mesh_3,
    Obstructions=distributorsolar.EnvironmentMesh,
    DHI=epw_reader.DHI,
    DNI=epw_reader.DNI,
    Latitude=epw_reader.Latitude,
    Longitude=epw_reader.Longitude,
    Max=panel_3,
    Min="500")  # -> AnnualPotential, Mesh_visu
number_slider_4 = Slider(0, range=0..5)
item_3 = ListItem(List=panel_11, Index=number_slider_4, Wrap=True)
item_4 = ListItem(List=simplify(panel_12), Index=number_slider_4, Wrap=True)
branch = TreeBranch(Tree=obstructedpanel.AnnualPotential, Path=item_4, MaintainPaths=True)
item_5 = ListItem(List=mesh_3, Index=number_slider_4, Wrap=True)
panel_13 = Panel(item_3)
area = Area(Geometry=item_5)  # -> Area, Centroid
division = Division(A=branch, B=area.Area)
graph = QuickGraph(division, SortOrder=0)

# Solar Potentials Building
number_slider_5 = Slider(6, range=0..100)
srf_7 = Surface(distributorsolar.ExtSrfs)
mesh_uv_2 = MeshSurface(Surface=srf_7, UCount=number_slider_5, VCount=Slider(3, range=0..100), Overhang=True, Equalize=False)
panel_14 = Panel("""0;0;0
0;0;1
0;0;2
0;0;3
0;0;4""")
mesh_4 = Mesh(mesh_uv_2)
obstructedpanel_2 = ObstructedPanel(
    Mesh_analysis=mesh_4,
    Obstructions=[distributorsolar.EnvironmentMesh, distributorsolar.PVMesh, distributorsolar.PVTMesh, distributorsolar.STMesh],
    DHI=epw_reader.DHI,
    DNI=epw_reader.DNI,
    Latitude=epw_reader.Latitude,
    Longitude=epw_reader.Longitude,
    Max=panel_3,
    Min="500")  # -> AnnualPotential, Mesh_visu
panel_15 = Panel("""South
East
North
West
Roof""")
number_slider_6 = Slider(4, range=0..4)
item_6 = ListItem(List=simplify(panel_14), Index=number_slider_6, Wrap=True)
item_7 = ListItem(List=panel_15, Index=number_slider_6, Wrap=True)
item_8 = ListItem(List=mesh_4, Index=number_slider_6, Wrap=True)
branch_2 = TreeBranch(Tree=obstructedpanel_2.AnnualPotential, Path=item_6, MaintainPaths=True)
area_2 = Area(Geometry=item_8)  # -> Area, Centroid
division_2 = Division(A=branch_2, B=area_2.Area)
graph_2 = QuickGraph(division_2, SortOrder=0)
panel_16 = Panel(item_7)

# ----
branch_3 = TreeBranch(Tree=obstructedpanel.AnnualPotential, Path=item, MaintainPaths=True)

# ----
# Solar Potentials
# unobstructed
simplepanel_2 = SimplePanel(
    Tilt=number_slider_2,
    Azimuth=number_slider,
    DHI=epw_reader.DHI,
    DNI=epw_reader.DNI,
    Latitude=epw_reader.Latitude,
    Longitude=epw_reader.Longitude)

# ----
# SIA2024 and 380
panel_17 = Panel("""1
2
3
4
5
6
7
8
9
10
11
12""")
data_2 = Data(panel_17)
python = GhPythonScript(month=data_2)  # -> out, season; inputs month: Int32
# ---------- python: Python ----------
__author__ = "chwaibel"
__version__ = "2019.11.06"

import rhinoscriptsyntax as rs

summerstart = 3 # summer starts in march
summerend = 9  # summer ends in end of September

if month >= summerstart and month <= summerend:
    season = "summer"
else:
    season = "winter"
# ---------- end python ----------
sia2024 = SIA2024(Use_case=distributorsia.SIA2024json, Area=distributorsia.ZoneAreas, Month=data_2, Season="winter")  # -> Τ_h, Θ_i_C, T_h, A_op_m2, A_w_m2, U_op_W_m2K, U_w_W_m2K, V_e_m3_h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
division_3 = Division(A=sia2024.Φ_L_W, B=distributorsia.ZoneAreas)
division_4 = Division(A=sia2024.Φ_G_W, B=distributorsia.ZoneAreas)
sia380_4 = SIA3804Elec(NFA_total=distributorsia.ZoneAreas, t_L=division_3, t_A=division_4, t_V="0", L=sia2024.Φ_L_W, E=sia2024.Φ_G_W, V="0")
python_2 = GhPythonScript()  # -> out, a
# ---------- python_2: Python ----------
__author__ = "chwaibel"
__version__ = "2020.02.25"

import rhinoscriptsyntax as rs

a = list(range(12,72))
# ---------- end python_2 ----------

subtraction = Subtraction(A=data_2, B="1")
python_3 = GhPythonScript(x=epw_reader.DryBulb, month=subtraction)  # -> out, a; inputs x: list, month: Int32
# ---------- python_3: Python ----------
__author__ = "chwaibel"
__version__ = "2020.02.25"

import rhinoscriptsyntax as rs

# 8760 time series
# get monthly average...
# how to know how many days a month? somewhere, I have typical year.
# in some honey-badger script

dayspermonth = [31.0, 28.0, 31.0, 30.0, 31.0, 30.0, 31.0, 31.0, 30.0, 31.0, 30.0, 31.0]

hour_per_day = 24
start_hour = int(hour_per_day * sum(dayspermonth[0:month])) 
end_hour = int(hour_per_day * sum(dayspermonth[0:month+1]))

cumulative_data = sum(x[start_hour:end_hour])
hours_per_month = (dayspermonth[month] * hour_per_day)

a = cumulative_data / hours_per_month
# ---------- end python_3 ----------
item_9 = ListItem(List=sum_yield, Index=subtraction, Wrap=True)

sia380 = SIA3801(
    Tau=sia2024.Τ_h,
    Theta_e=python_3.a,
    Theta_i=sia2024.Θ_i_C,
    T=sia2024.T_h,
    A_op=distributorsia.ExtSrfAreas,
    A_w=distributorsia.WindowsAreas,
    U_op=sia2024.U_op_W_m2K,
    U_w=sia2024.U_w_W_m2K,
    Vdot_e=sia2024.V_e_m3_h,
    Vdot_inf=sia2024.V_inf_m3_h,
    Eta_rec=sia2024.Η_rec_,
    Phi_P=sia2024.Φ_P_W,
    Phi_B=sia2024.Φ_L_W,
    Phi_G=sia2024.Φ_G_W,
    T_P=sia2024.T_P_h,
    T_B=sia2024.T_L_h,
    T_G=sia2024.T_A_h,
    G=sia2024.G_,
    F_sh=sia2024.F_sh_,
    I=item_9)  # -> Q_H, Q_T, Q_V, Eta_g, Q_i, Q_s
panel_18 = Panel([sia380.Q_H, sia380.Q_T, sia380.Q_V, sia380.Eta_g, sia380.Q_i, sia380.Q_s])
cull_i = CullIndex(List=panel_18, Indices=python_2.a, Wrap=True)
panel_19 = Panel(cull_i)

# ----
# 3. DEMAND RESULTS
# Visualize Demand
# heating demand kWh/m2
# elec demand kWh/m2
panel_20 = Panel("1000")
multiplication = Multiplication(A=panel_20, B=distributorsia.ZoneAreas)
panel_21 = Panel("""1
2
3
4
5
6
7
8
9
10
11
12""")
panel_22 = Panel("""1
2
3
4
5
6
7
8
9
10
11
12""")
multiplication_2 = Multiplication(A="1000", B=distributorsia.ZoneAreas)
python_4 = GhPythonScript(x=graft(panel_21), y="30,5,0")  # -> out, flatten(a); inputs y: Point3d
# ---------- python_4: Python ----------
__author__ = "chwaibel"
__version__ = "2019.12.11"

import rhinoscriptsyntax as rs
a = rs.AddPoint(x+ y.X, y.Y, y.Z)
# ---------- end python_4 ----------
python_5 = GhPythonScript(x=graft(panel_22), y="30,7,0")  # -> out, flatten(a); inputs y: Point3d; same code as python_4
division_5 = Division(A=panel_19, B=multiplication)
division_6 = Division(A=sia380_4, B=multiplication_2)
panel_23 = Panel(python_4.a)
python_6 = GhPythonScript(x="1", y="1", z=division_5)  # -> out, a
# ---------- python_6: Python ----------
__author__ = "chwaibel"
__version__ = "2019.12.11"

import rhinoscriptsyntax as rs

a = rs.AddPoint(x,y,z)
# ---------- end python_6 ----------
panel_24 = Panel(python_5.a)
python_7 = GhPythonScript(x="1", y="1", z=division_6)  # -> out, a; same code as python_6
python_8 = GhPythonScript(x="0,0,0", y=panel_23)  # -> out, a; inputs x: Point3d, y: Vector3d
# ---------- python_8: Python ----------
__author__ = "chwaibel"
__version__ = "2019.12.11"

import rhinoscriptsyntax as rs

a = rs.AddPoint(x.X + y.X, x.Y + y.Y, x.Z + y.Z)
# ---------- end python_8 ----------
python_9 = GhPythonScript(x=python_6.a, y=panel_23)  # -> out, a; inputs x: Point3d, y: Vector3d; same code as python_8
xy = XYPlane(Origin=panel_23)
python_10 = GhPythonScript(x="0,0,0", y=panel_24)  # -> out, a; inputs x: Point3d, y: Vector3d; same code as python_8
python_11 = GhPythonScript(x=python_7.a, y=panel_24)  # -> out, a; inputs x: Point3d, y: Vector3d; same code as python_8
xy_2 = XYPlane(Origin=panel_24)
panel_25 = Panel(division_5)
panel_26 = Panel(division_6)
box = Box2Pt(PointA=python_8.a, PointB=python_9.a, Plane=xy)  # disabled
box_2 = Box2Pt(PointA=python_10.a, PointB=python_11.a, Plane=xy_2)  # disabled

# ---- group: tot. heating demand in kWh
multiplication_3 = Multiplication(A=panel_25, B=distributorsia.ZoneAreas)
# 4. SUPPLY RESULTS
ma = MassAddition(Input=multiplication_3)  # -> Result, PartialResults

# ---- group: cost and emissions using a boiler
boiler = Boiler(Heating_loads=ma.Result, Carrier_cost="0.09", Carrier_emissions="0.28", Efficiency="0.9")  # -> Cost, Carbon
panel_27 = Panel([boiler.Cost, boiler.Carbon])

# ---- group: using CHP
chp = Chp(Loads=ma.Result, Eta="0.33", Htp="1.57", Fuelcost="0.09", Fuelemissions="0.237")  # -> Total_cost, Total_emissions, Heating_gen, Elec_gen
panel_28 = Panel([chp.Total_cost, chp.Total_emissions, chp.Heating_gen, chp.Elec_gen])

# ---- group: HP
hp_cop = SimpleHpCop(Eta="0.8", T_1="28", T_2="20")
simple_hp = SimpleHp(Q_th=ma.Result, COP=hp_cop)
panel_29 = Panel(simple_hp)

# ----
# PV Yield
noct_pv = NOCTPV(A=distributorsupplysystem.PVAreas, Eta_PVref=distributorsupplysystem.Eta_PV, T_amb=epw_reader.DryBulb, I=division)  # -> Elec, Effic

data_3 = Data(simplify(noct_pv.Elec))

# ----
# PV Yield unobstructed
noct_pv_2 = NOCTPV(A=distributorsupplysystem.PVAreas, Eta_PVref=distributorsupplysystem.Eta_PV, T_amb=epw_reader.DryBulb, I=branch)  # -> Elec, Effic

# ----
# PV and Solar
# PV Yield unobstructed 1sqm
# Values in kWh
# PV Yield obstructed
# real geometry
# Values in kWh
# PV coloured mesh
list = ValueList({"day", "month", "year"}, selected="month")
list_2 = ValueList({"day", "month", "year"}, selected="month")
graph_3 = QuickGraph(noct_pv_2.Elec, SortOrder=0)
graph_4 = QuickGraph(noct_pv.Elec, SortOrder=0)
mesh_5 = Mesh([obstructedpanel.Mesh_visu, obstructedpanel_2.Mesh_visu])

sum_yield_2 = SumYield(Sum_mode=list_2, Elec=noct_pv.Elec)
division_7 = Division(A=sum_yield_2, B="1000")

sum_yield_3 = SumYield(Sum_mode=list, Elec=noct_pv_2.Elec)
division_8 = Division(A=sum_yield_3, B="1000")

data_4 = Data(simplify(division_7))

panel_30 = Panel(division_8)
panel_31 = Panel(division_7)
graph_5 = QuickGraph(panel_30, SortOrder=0)
graph_6 = QuickGraph(panel_31, SortOrder=0)

# ----
# Hive.IO Results
panel_32 = Panel("0")
tbi = TreeBranchIndex(DataTree=data_4, BranchIndex=panel_32)  # -> flatten(Branch)
panel_33 = Panel(tbi)
tbi_2 = TreeBranchIndex(DataTree=data_3, BranchIndex="0")
panel_34 = Panel("""11
10
9
8
7
6
5
4
6
7
10
10""")
c_script = CSharpScript(x=panel_33, y=panel_34)  # -> out, A; inputs x: list of Double, y: list of Double, z: list of Double
# ---------- c_script: C# ----------
    DataTree<GH_Number> tree = new DataTree<GH_Number>();

    GH_Path path0 = new GH_Path(0);
    GH_Path path1 = new GH_Path(1);
    GH_Path path2 = new GH_Path(2);
    
    foreach(double xin in x)
    {
      tree.Add(new GH_Number(xin), path0);
    }

    foreach(double yin in y)
    {
      tree.Add(new GH_Number(yin), path1);
    }

    foreach(double zin in z)
    {
      tree.Add(new GH_Number(zin), path2);
    }
    
    A = tree;

    //    DataTree<Sphere> sphereTree = new DataTree<Sphere>();
    //
    //    foreach (GH_Path path in pointTree.Paths)
    //    {
    //      List<Point3d> points = pointTree.Branch(path);
    //      List<Sphere> spheres = new List<Sphere>();
    //
    //      foreach (Point3d point in points)
    //        spheres.Add(new Sphere(point, 1.0));
    //
    //      sphereTree.AddRange(spheres, path);
    //    }
    //
    //    spheresOutput = sphereTree;
# ---------- end c_script ----------
panel_35 = Panel("""True
False
False""")
panel_36 = Panel("""True
True
False""")
item_10 = ListItem(List=distributorsupplysystem.PVAreas, Index="0", Wrap=True)
c_script_2 = CSharpScript(x=panel_35, y=panel_36)  # -> out, A; inputs x: list of Boolean, y: list of Boolean, z: list of Boolean
# ---------- c_script_2: C# ----------
    DataTree<GH_Boolean> tree = new DataTree<GH_Boolean>();

    GH_Path path0 = new GH_Path(0);
    GH_Path path1 = new GH_Path(1);
    GH_Path path2 = new GH_Path(2);

    foreach(bool xin in x)
    {
      tree.Add(new GH_Boolean(xin), path0);
    }

    foreach(bool yin in y)
    {
      tree.Add(new GH_Boolean(yin), path1);
    }

    foreach(bool zin in z)
    {
      tree.Add(new GH_Boolean(zin), path2);
    }

    A = tree;
# ---------- end c_script_2 ----------
panel_37 = Panel("""sqm
kWh""")
panel_38 = Panel([item_10, "50"])
panel_39 = Panel("""pv
chp""")
panel_40 = Panel("""0
0
0
0
0
0
0
0
0
0
0
0""")
data_5 = Data(["18.620682", "23.470852", "13.74333", "25.323491", "23.543408", "16.632889"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])
data_6 = Data(["0", "0", "0", "0", "0", "0"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])
data_7 = Data(["15.5526", "13.107481", "9.895936", "6.578947", "9.188861", "7.651882"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])
data_8 = Data([3.255889473, 8.3191166, 0.099843616, 11.07257698, 2.324666989, 0.501059679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])
hiveioresults = HiveIOResults(
    CoolingMonthly=panel_40,
    HeatingMonthly=panel_25,
    ElectricityMonthly=panel_26,
    CoolingHourly=data_6,
    HeatingHourly=data_5,
    ElectricityHourly=data_7,
    DomesticHotWaterHourly=data_8,
    SupplySystemCapacities=panel_38,
    SupplySystemNames=panel_39,
    OperationMonthly=c_script.A,
    OperationHourly=tbi_2,
    SupplySystemSuitability=c_script_2.A,
    SupplySystemUnits=panel_37,
    SkyViewFactor=skydome.Mesh,
    SunpathDiagram=skydome.Sunpaths)

# ----
# 5. Results
hive_io_visualizer = HiveIOVisualizer(hiveioresults)
