# Grasshopper definition Hive_Results_Test.gh (Grasshopper 1.0.7)
# plug-ins: HiveIO

# ----
# Hive.IO Results
panel = Panel("""11
4
3
2
1
0
5
6
12
14
11
15""")
panel_2 = Panel("""0
0
0
0
0
1
3
6
3
0
0
0""")
panel_3 = Panel("""0
0
0
0
0
1
3
6
3
0
0
0""")
c_script = CSharpScript(x=panel, y=panel_2, z=panel_3)  # -> out, A; inputs x: list of Double, y: list of Double, z: list of Double
# ---------- c_script: C# ----------
    DataTree<GH_Number> tree = new DataTree<GH_Number>();

    GH_Path path0 = new GH_Path(0);
    GH_Path path1 = new GH_Path(1);
    GH_Path path2 = new GH_Path(2);
    
    foreach(double xin in x)
    {
      tree.Add(new GH_Number(xin), path0);
    }

    foreach(double yin in y)
    {
      tree.Add(new GH_Number(yin), path1);
    }

    foreach(double zin in z)
    {
      tree.Add(new GH_Number(zin), path2);
    }
    
    A = tree;

    //    DataTree<Sphere> sphereTree = new DataTree<Sphere>();
    //
    //    foreach (GH_Path path in pointTree.Paths)
    //    {
    //      List<Point3d> points = pointTree.Branch(path);
    //      List<Sphere> spheres = new List<Sphere>();
    //
    //      foreach (Point3d point in points)
    //        spheres.Add(new Sphere(point, 1.0));
    //
    //      sphereTree.AddRange(spheres, path);
    //    }
    //
    //    spheresOutput = sphereTree;
# ---------- end c_script ----------

panel_4 = Panel("""200
123.6
50.0""")

panel_5 = Panel("""False
True
False""")
panel_6 = Panel("""True
True
False""")
panel_7 = Panel("""True
False
False""")
c_script_2 = CSharpScript(x=panel_6, y=panel_5, z=panel_7)  # -> out, A; inputs x: list of Boolean, y: list of Boolean, z: list of Boolean
# ---------- c_script_2: C# ----------
    DataTree<GH_Boolean> tree = new DataTree<GH_Boolean>();

    GH_Path path0 = new GH_Path(0);
    GH_Path path1 = new GH_Path(1);
    GH_Path path2 = new GH_Path(2);

    foreach(bool xin in x)
    {
      tree.Add(new GH_Boolean(xin), path0);
    }

    foreach(bool yin in y)
    {
      tree.Add(new GH_Boolean(yin), path1);
    }

    foreach(bool xin in x)
    {
      tree.Add(new GH_Boolean(xin), path2);
    }

    A = tree;
# ---------- end c_script_2 ----------

panel_8 = Panel("""chp
hp
pv""")
panel_9 = Panel("""kWh
kWh
sqm""")
panel_10 = Panel("""0
0
0
0
0
0
0
0
0
0
0
0""")
data = Data(["53.833452", "40.62361", "27.53208", "9.093143", "0.752296", "0.007861", "0.000669", "0.002482", "2.353706", "17.218301", "38.493977", "52.055572"])
data_2 = Data(["2.806142", "2.806142", "2.806142", "2.806142", "2.806142", "2.806142", "2.806142", "2.806142", "2.806142", "2.806142", "2.806142", "2.806142"])
mesh = Mesh([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])
mesh_2 = Mesh(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)
crv = Curve([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])
hiveioresults = HiveIOResults(
    CoolingMonthly=panel_10,
    HeatingMonthly=data,
    ElectricityMonthly=data_2,
    SupplySystemCapacities=panel_4,
    SupplySystemNames=panel_8,
    OperationMonthly=c_script.A,
    SupplySystemSuitability=c_script_2.A,
    SupplySystemUnits=panel_9,
    SolarIrradiatedSurfaces=mesh,
    SkyViewFactor=mesh_2,
    SunpathDiagram=crv)
panel_11 = Panel(hiveioresults)
