# Grasshopper definition Hive_Results_Visualizer_Test.gh (Grasshopper 1.0.7)
# plug-ins: HiveIO

panel = Panel("""11
4
3
2
1
0
5
6
12
14
11
15""")
panel_2 = Panel("""0
0
0
0
0
1
3
6
3
0
0
0""")
panel_3 = Panel("""0
0
0
0
0
1
3
6
3
0
0
0""")
c_script = CSharpScript(x=panel, y=panel_2, z=panel_3)  # -> out, A; inputs x: list of Double, y: list of Double, z: list of Double
# ---------- c_script: C# ----------
    DataTree<GH_Number> tree = new DataTree<GH_Number>();

    GH_Path path0 = new GH_Path(0);
    GH_Path path1 = new GH_Path(1);
    GH_Path path2 = new GH_Path(2);
    
    foreach(double xin in x)
    {
      tree.Add(new GH_Number(xin), path0);
    }

    foreach(double yin in y)
    {
      tree.Add(new GH_Number(yin), path1);
    }

    foreach(double zin in z)
    {
      tree.Add(new GH_Number(zin), path2);
    }
    
    A = tree;

    //    DataTree<Sphere> sphereTree = new DataTree<Sphere>();
    //
    //    foreach (GH_Path path in pointTree.Paths)
    //    {
    //      List<Point3d> points = pointTree.Branch(path);
    //      List<Sphere> spheres = new List<Sphere>();
    //
    //      foreach (Point3d point in points)
    //        spheres.Add(new Sphere(point, 1.0));
    //
    //      sphereTree.AddRange(spheres, path);
    //    }
    //
    //    spheresOutput = sphereTree;
# ---------- end c_script ----------

panel_4 = Panel("""False
True
False""")
panel_5 = Panel("""True
True
False""")
panel_6 = Panel("""True
False
False""")
c_script_2 = CSharpScript(x=panel_5, y=panel_4, z=panel_6)  # -> out, A; inputs x: list of Boolean, y: list of Boolean, z: list of Boolean
# ---------- c_script_2: C# ----------
    DataTree<GH_Boolean> tree = new DataTree<GH_Boolean>();

    GH_Path path0 = new GH_Path(0);
    GH_Path path1 = new GH_Path(1);
    GH_Path path2 = new GH_Path(2);

    foreach(bool xin in x)
    {
      tree.Add(new GH_Boolean(xin), path0);
    }

    foreach(bool yin in y)
    {
      tree.Add(new GH_Boolean(yin), path1);
    }

    foreach(bool xin in x)
    {
      tree.Add(new GH_Boolean(xin), path2);
    }

    A = tree;
# ---------- end c_script_2 ----------

panel_7 = Panel("""200
123.6
50.0""")

data = Data([0, 0, 0, 0, 0, 0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])
data_2 = Data([0, 0, 0, 0, 0, 0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])
data_3 = Data([0, 0, 0, 0, 0, 0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])
c_script_3 = CSharpScript(x=data, y=data_2, z=data_3)  # -> out, A; inputs x: list of Double, y: list of Double, z: list of Double; same code as c_script

panel_8 = Panel("""chp
hp
pv""")
panel_9 = Panel("""kWh
kWh
sqm""")
mesh = Mesh([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])
mesh_2 = Mesh(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)
crv = Curve([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])
data_4 = Data(["50.029929", "37.862895", "25.837209", "8.7003", "0.741364", "0.007886", "0.000672", "0.002471", "2.258486", "16.063257", "35.74919", "48.328382"])
data_5 = Data(["3.852624", "3.852624", "3.852624", "3.852624", "3.852624", "3.852624", "3.852624", "3.852624", "3.852624", "3.852624", "3.852624", "3.852624"])
data_6 = Data(["18.620682", "23.470852", "13.74333", "25.323491", "23.543408", "16.632889"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])
data_7 = Data(["0", "0", "0", "0", "0", "0"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])
data_8 = Data(["15.5526", "13.107481", "9.895936", "6.578947", "9.188861", "7.651882"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])
data_9 = Data([3.255889473, 8.3191166, 0.099843616, 11.07257698, 2.324666989, 0.501059679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])
data_10 = Data(["50.029929", "37.862895", "25.837209", "8.7003", "0.741364", "0.007886", "0.000672", "0.002471", "2.258486", "16.063257", "35.74919", "48.328382"])
hiveioresults = HiveIOResults(
    CoolingMonthly=data_10,
    HeatingMonthly=data_4,
    ElectricityMonthly=data_5,
    CoolingHourly=data_7,
    HeatingHourly=data_6,
    ElectricityHourly=data_8,
    DomesticHotWaterHourly=data_9,
    SupplySystemCapacities=panel_7,
    SupplySystemNames=panel_8,
    OperationMonthly=c_script.A,
    OperationHourly=c_script_3.A,
    SupplySystemSuitability=c_script_2.A,
    SupplySystemUnits=panel_9,
    SolarIrradiatedSurfaces=mesh,
    SkyViewFactor=mesh_2,
    SunpathDiagram=crv)
hive_io_visualizer = HiveIOVisualizer(hiveioresults)
