# Grasshopper definition Hive_Shoebox_01.gh (Grasshopper 1.0.7)
# plug-ins: HiveIO, solar-tech, solar-techParameters

# ---- group: PV - SHOULD BECOME 1 WINDOWS.FORM COMPONENT
# Energy System
# Geometry
pveffl = PVEfficiency({"Silicone": {"PV tech": "Silicone", "efficiency": 0.10000000000000001}, "Monocrystalline": {"PV tech": "Monocrystalline", "efficiency": 0.14999999999999999}, "Polycrystalline": {"PV tech": "Polycrystalline", "efficiency": 0.20000000000000001}, "Super-duper-tech": {"PV tech": "Super-duper-tech", "efficiency": 0.25}}, selected="Silicone")
srf = Surface([<surface referenced from the Rhino model> x2])
pveff = PVEfficiency(PV_tech=pveffl)
io_pv = HiveIOPV(Mesh=srf, Refefficiency=pveff)

# ---- group: PVST
srf_2 = Surface([<surface referenced from the Rhino model> x2])

# ---- group: ST
srf_3 = Surface([<surface referenced from the Rhino model> x2])

# ---- group: Zones
# Building
# Geometry
brep = Brep(<brep referenced from the Rhino model>)

# ---- group: Windows
srf_4 = Surface([<surface referenced from the Rhino model> x4])

# ---- group: Door
srf_5 = Surface(<surface referenced from the Rhino model>)

# ----
io_groundcoll = HiveIOGroundCollector()
io_st = HiveIOST()

# ---- group: obstructions
brep_2 = Brep([<brep referenced from the Rhino model> x8])

# ---- group: ground
mesh = Mesh(<mesh referenced from the Rhino model>)

# ----
# set this
# by rightclicking
# mothercell
number_slider = Slider(180, range=0..360)
list = ValueList({"mfh", "efh", "office", "school"}, selected="efh")
list_2 = ValueList({"standard", "ideal", "existing"}, selected="standard")

list_3 = ValueList({"day", "month", "year"}, selected="month")
list_4 = ValueList({"day", "month", "year"}, selected="month")

# ----
# MOTHERCELL
cluster = Cluster(
    use=list,
    bldgtype=list_2,
    mesh=brep_2,
    G=srf_4,
    mesh_2=[srf_2, srf_3, srf],
    B=brep,
    eta_pvref_2="0.2",
    sum_mode_2=list_3,
    tilt=Slider(32.368, range=0..90),
    azimuth=number_slider,
    eta_pvref="0.2",
    obstructions=mesh,
    sum_mode=list_4,
    L=[srf, srf_2, srf_3],
    obstructions_2=mesh)  # -> a, a_2, P, elec_2, R_2, elec, R, mesh_visu, mesh_visu_2
box = Box2Pt(PointA=cluster.a, PointB=cluster.a_2, Plane=cluster.P)
mesh_2 = Mesh([cluster.mesh_visu, cluster.mesh_visu_2])

panel = Panel(cluster.R_2)
panel_2 = Panel(cluster.R)
graph = QuickGraph(panel, SortOrder=0)
# PV Yield unobstructed 1sqm
# Values in kWh
graph_2 = QuickGraph(cluster.elec_2, SortOrder=0)
graph_3 = QuickGraph(panel_2, SortOrder=0)
# PV Yield obstructed
# real geometry
# Values in kWh
graph_4 = QuickGraph(cluster.elec, SortOrder=0)

# ==== cluster Cluster
mesh = ClusterInput()
B = ClusterInput()
mesh_2 = ClusterInput()
G = ClusterInput()

# ----
# Hive.IO
mesh_3 = Mesh(mesh)
debrep = DeconstructBrep(Brep=B)  # -> Faces, Edges, Vertices
mesh_4 = Mesh(mesh_2)
area = Area(Geometry=G)  # -> Area, Centroid
item = ListItem(List=debrep.Faces, Index="4", Wrap=True)
ma = MassAddition(Input=area.Area)  # -> Result, PartialResults
area_2 = Area(Geometry=item)  # -> Area, Centroid

obstructions = ClusterInput()
obstructions_2 = ClusterInput()

# ---- group: average irradiance on obstructed surface
# Solar Potentials Building
number_slider = Slider(6, range=0..100)
data = Data([0, 0, 0, 0, 0, 0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])
data_2 = Data([0, 0, 0, 0, 0, 0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])
data_3 = Data([8.415567703, 33.69912388, 56.58914543, 72.99109311, 85.75265625, 96.74276768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])
data_4 = Data([-65.34878984, -62.13426796, -54.95901857, -45.81747693, -35.88714072, -25.78253978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])
panel = Panel("""0
1
2
3
5""")
item_2 = ListItem(List=debrep.Faces, Index=panel, Wrap=True)
srf = Surface(item_2)
mesh_uv = MeshSurface(Surface=srf, UCount=number_slider, VCount=Slider(3, range=0..100), Overhang=True, Equalize=False)
panel_2 = Panel("""0;0;0
0;0;1
0;0;2
0;0;3
0;0;4""")
mesh_5 = Mesh(mesh_uv)
obstructedpanel = ObstructedPanel(
    Mesh_analysis=mesh_5,
    Obstructions=[mesh_3, mesh_4, obstructions_2],
    DHI=data,
    DNI=data_2,
    Solarazi=data_3,
    Solaralti=data_4)  # -> AnnualPotential, Mesh_visu
panel_3 = Panel("""South
East
North
West
Roof""")
number_slider_2 = Slider(4, range=0..4)
item_3 = ListItem(List=simplify(panel_2), Index=number_slider_2, Wrap=True)
item_4 = ListItem(List=panel_3, Index=number_slider_2, Wrap=True)
item_5 = ListItem(List=mesh_5, Index=number_slider_2, Wrap=True)
area_3 = Area(Geometry=item_5)  # -> Area, Centroid
branch = TreeBranch(Tree=obstructedpanel.AnnualPotential, Path=item_3, MaintainPaths=True)
division = Division(A=branch, B=area_3.Area)
graph = QuickGraph(division, SortOrder=0)
panel_4 = Panel(item_4)

# ----
L = ClusterInput()

# ---- group: average irradiance on obstructed surface
# Solar Potentials Roof Panels
number_slider_3 = Slider(2, range=0..100)
data_5 = Data([0, 0, 0, 0, 0, 0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])
data_6 = Data([0, 0, 0, 0, 0, 0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])
data_7 = Data([8.415567703, 33.69912388, 56.58914543, 72.99109311, 85.75265625, 96.74276768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])
data_8 = Data([-65.34878984, -62.13426796, -54.95901857, -45.81747693, -35.88714072, -25.78253978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])
panel_5 = Panel("""0
1
2
3
4
5""")
item_6 = ListItem(List=L, Index=panel_5, Wrap=True)
panel_6 = Panel("""PV left
PV right
PVT left
PVT right
ST left
ST right""")
srf_2 = Surface(item_6)
mesh_uv_2 = MeshSurface(Surface=srf_2, UCount=number_slider_3, VCount=Slider(2, range=0..100), Overhang=True, Equalize=False)
panel_7 = Panel("""0;0;0
0;0;1
0;0;2
0;0;3
0;0;4
0;0;5""")
mesh_6 = Mesh(mesh_uv_2)
obstructedpanel_2 = ObstructedPanel(Mesh_analysis=mesh_6, Obstructions=[mesh_3, obstructions], DHI=data_5, DNI=data_6, Solarazi=data_7, Solaralti=data_8)  # -> AnnualPotential, Mesh_visu
number_slider_4 = Slider(0, range=0..5)
item_7 = ListItem(List=simplify(panel_7), Index=number_slider_4, Wrap=True)
item_8 = ListItem(List=mesh_6, Index=number_slider_4, Wrap=True)
area_4 = Area(Geometry=item_8)  # -> Area, Centroid
item_9 = ListItem(List=panel_6, Index=number_slider_4, Wrap=True)
branch_2 = TreeBranch(Tree=obstructedpanel_2.AnnualPotential, Path=item_7, MaintainPaths=True)
division_2 = Division(A=branch_2, B=area_4.Area)
graph_2 = QuickGraph(division_2, SortOrder=0)
panel_8 = Panel(item_9)

# ----
use = ClusterInput()
bldgtype = ClusterInput()

# ----
# Demand
# SIA380.1
# SIA2028
# SIA2024
panel_9 = Panel("""1
2
3
4
5
6
7
8
9
10
11
12""")
python = GhPythonScript(month=panel_9)  # -> out, season; inputs month: Int32
# ---------- python: Python ----------
__author__ = "chwaibel"
__version__ = "2019.11.06"

import rhinoscriptsyntax as rs

summerstart = 3 # summer starts in march
summerend = 9  # summer ends in end of September

if month >= summerstart and month <= summerend:
    season = "summer"
else:
    season = "winter"
# ---------- end python ----------
sia2024 = SIA2024(Use_case=use, Bldgtype=bldgtype, Area=area_2.Area, Month=graft(panel_9), Season=graft(python.season))  # -> Τ_h, Θ_i_C, T_h, A_op_m2, A_w_m2, U_op_W_m2K, U_w_W_m2K, V_e_m3_h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
sia2028 = SIA2028(Month=graft(panel_9))  # -> IHor_Wh_m2, IE_Wh_m2, IS_Wh_m2, IW_Wh_m2, IN_Wh_m2, Θ_e_C
sia380 = SIA3801(
    Tau=sia2024.Τ_h,
    Theta_e=sia2028.Θ_e_C,
    Theta_i=sia2024.Θ_i_C,
    T=sia2024.T_h,
    A_op=sia2024.A_op_m2,
    A_w=ma.Result,
    U_op=sia2024.U_op_W_m2K,
    U_w=sia2024.U_w_W_m2K,
    Vdot_e=sia2024.V_e_m3_h,
    Vdot_inf=sia2024.V_inf_m3_h,
    Eta_rec=sia2024.Η_rec_,
    Phi_P=sia2024.Φ_P_W,
    Phi_B=sia2024.Φ_L_W,
    Phi_G=sia2024.Φ_G_W,
    T_P=sia2024.T_P_h,
    T_B=sia2024.T_L_h,
    T_G=sia2024.T_A_h,
    G=sia2024.G_,
    F_sh=sia2024.F_sh_,
    I=sia2028.IHor_Wh_m2)  # -> Q_H, Q_T, Q_V, Eta_g, Q_i, Q_s
panel_10 = Panel([sia380.Q_H, sia380.Q_T, sia380.Q_V, sia380.Eta_g, sia380.Q_i, sia380.Q_s])

mesh_visu = ClusterOutput(obstructedpanel_2.Mesh_visu)
mesh_visu_2 = ClusterOutput(obstructedpanel.Mesh_visu)
tilt = ClusterInput()
azimuth = ClusterInput()

# ----
# Solar Potentials
# unobstructed
simplepanel = SimplePanel(Tilt=tilt, Azimuth=azimuth, DHI=data_5, DNI=data_6)

# ----
# Visualize Demand
panel_11 = Panel("0")
panel_12 = Panel("""1
2
3
4
5
6
7
8
9
10
11
12""")
item_10 = ListItem(List=panel_10, Index=panel_11, Wrap=True)
python_2 = GhPythonScript(x=graft(panel_12), y="30,5,0")  # -> out, a; inputs y: Point3d
# ---------- python_2: Python ----------
__author__ = "chwaibel"
__version__ = "2019.12.11"

import rhinoscriptsyntax as rs
a = rs.AddPoint(x+ y.X, y.Y, y.Z)
# ---------- end python_2 ----------
division_3 = Division(A=item_10, B="10000")
panel_13 = Panel(python_2.a)
python_3 = GhPythonScript(x="1", y="1", z=division_3)  # -> out, a
# ---------- python_3: Python ----------
__author__ = "chwaibel"
__version__ = "2019.12.11"

import rhinoscriptsyntax as rs

a = rs.AddPoint(x,y,z)
# ---------- end python_3 ----------
python_4 = GhPythonScript(x="0,0,0", y=panel_13)  # -> out, a; inputs x: Point3d, y: Vector3d
# ---------- python_4: Python ----------
__author__ = "chwaibel"
__version__ = "2019.12.11"

import rhinoscriptsyntax as rs

a = rs.AddPoint(x.X + y.X, x.Y + y.Y, x.Z + y.Z)
# ---------- end python_4 ----------
python_5 = GhPythonScript(x=python_3.a, y=panel_13)  # -> out, a; inputs x: Point3d, y: Vector3d; same code as python_4
xy = XYPlane(Origin=panel_13)

a = ClusterOutput(python_4.a)
a_2 = ClusterOutput(python_5.a)
P = ClusterOutput(xy)
eta_pvref = ClusterInput()
eta_pvref_2 = ClusterInput()
sum_mode = ClusterInput()
sum_mode_2 = ClusterInput()

# ----
# PV Yield unobstructed
panel_14 = Panel("1")
data_9 = Data([8.8, 8.6, 8.4, 8.3, 8.2, 8.1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])
noct_pv = NOCTPV(A=panel_14, Eta_PVref=eta_pvref_2, T_amb=data_9, I=simplepanel)  # -> Elec, Effic
sum_yield = SumYield(Sum_mode=sum_mode_2, Elec=noct_pv.Elec)
division_4 = Division(A=sum_yield, B="1000")

# ----
# PV Yield
data_10 = Data([8.8, 8.6, 8.4, 8.3, 8.2, 8.1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])
noct_pv_2 = NOCTPV(A=area_4.Area, Eta_PVref=eta_pvref, T_amb=data_10, I=division_2)  # -> Elec, Effic
sum_yield_2 = SumYield(Sum_mode=sum_mode, Elec=noct_pv_2.Elec)
division_5 = Division(A=sum_yield_2, B="1000")

elec = ClusterOutput(noct_pv_2.Elec)
elec_2 = ClusterOutput(noct_pv.Elec)
R = ClusterOutput(division_5)
R_2 = ClusterOutput(division_4)
