# Grasshopper definition Hive_Visualizer_Test.gh (Grasshopper 1.0.7)
# plug-ins: HiveIO

python = GhPythonScript()  # -> out, a
# ---------- python: Python ----------
__author__ = "chwaibel"
__version__ = "2020.02.25"
 
import rhinoscriptsyntax as rs
import math
from random import seed
from random import random
 
seed(42)
 
# could you make your component read the length of the time series
# and auto-detect whether it's a monthly plot (12 elements),
# or a yearly hourly (8760)?
 
# default could be to expect 8760 time series and plot yearly,
# but the user could, with a button or so, change the resolution
 
short_len = 12
full_len = 8760
 
pv_eff = 0.2
 
max_heat = 23.0 # kWh/m2
max_clg = 4.0   # kWh/m2
max_elec = 6.5  # kWh/m2
max_dhw = 3.0   # kWh/m2
max_solar = 1100.0 * pv_eff # W/m2
max_fluct = 4.0
 
curve_segment = (2* math.pi) / (short_len - 1)
curve_full = (2* math.pi) / (full_len - 1)
 
htg_list = [1.0] * short_len    # kWh/m2   
clg_list = [1.0] * short_len    # kWh/m2
elec_list = [1.0] * short_len   # kWh/m2
dhw_list = [1.0] * short_len    # kWh/m2
for i in range(short_len):
    htg_list[i] = (math.sin(((i) * curve_segment) + (0.5*math.pi)) + 1.0 ) / 2.0 * max_heat + (random() * (max_heat / max_fluct))
    clg_list[i] = (math.sin(((i) * curve_segment) - (0.5*math.pi)) + 1.0) / 2.0 * max_clg + (random() * (max_clg / max_fluct))
    elec_list[i] = max_elec + (random() * (max_elec / max_fluct))
    dhw_list[i] = max_dhw + (random() * (max_dhw / max_fluct))
 
solar_list = [1.0] * full_len
 
# not really sensible, as irradiance never goes to 0. but should be ok as an example
for i in range(full_len):
    solar_list[i] = (math.sin(((i) * curve_full) - (0.5*math.pi)) + 1.0) / 2.0 * max_solar + (random() * (max_solar / max_fluct))
 
cost_operation = 10000.0    # CHF
emissions_operation = 100.0 # kgCO2eq./m2
area_pv = 100.0             # m2
area_st = 30.0              # m2
area_pvt = 24.0             # m2
cap_hp = 123.0              # kW
cap_chp = 30.0              # kW
cap_boiler = 10.0           # kW
cap_bat = 300.0             # kWh
cap_tes = 120.0             # kWh
 
results = {
    "demand_htg" : htg_list,
    "demand_clg" : clg_list,
    "demand_elec" : elec_list,
    "demand_dhw" : dhw_list,
    "solar_gen" : solar_list,
    "cost_operation" : cost_operation,
    "emissions_operation" : emissions_operation,
    "area_pv" : area_pv,
    "area_st" : area_st,
    "area_pvt" : area_pvt,
    "capacity_hp" : cap_hp,
    "capacity_chp" : cap_chp,
    "capacity_boiler" : cap_boiler,
    "capacity_battery" : cap_bat,
    "capacity_tes" : cap_tes
}
 
import json
a = json.dumps(results)
# ---------- end python ----------
hive_io_visualizer = HiveIOVisualizer(python.a)
