# Grasshopper definition noct_pv.gh (Grasshopper 1.0.7)
# plug-ins: noct-pv

data = Data([0, 0, 0, 0, 0, 0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])
data_2 = Data([8.8, 8.6, 8.4, 8.3, 8.2, 8.1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])
noct_pv = NOCTPV(A="1", T_amb=data_2, I=data)  # -> Elec, Effic
panel = Panel(noct_pv.Elec)
panel_2 = Panel(data)
