# Grasshopper definition normal_pv.gh (Grasshopper 1.0.7)
# plug-ins: pv

panel = Panel("""20
20
20
2
2
2""")
panel_2 = Panel("""1000
1000
1000
1000
1000
1000""")
normal_pv = NormalPV(T_amb=panel, I=panel_2)  # -> Elec, Effic
panel_3 = Panel(normal_pv.Elec)
panel_4 = Panel(normal_pv.Effic)
