# Grasshopper definition sia380_sia2024.gh (Grasshopper 1.0.7)
# plug-ins: sia380, sia2024

panel = Panel("school")
panel_2 = Panel("office")
panel_3 = Panel("efh")
sia2024 = SIA2024(Use_case="mfh", Type="standard", Area="500", Month=Slider(4, range=1..12))  # -> TauTimeConstant_h, Theta_e, Theta_i, T, A_op, A_w, U_opUValueOpaqueWalls_W_m2K, U_wUValueWindows_W_m2K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
sia380 = SIA3801(
    Tau=sia2024.TauTimeConstant_h,
    Theta_e=sia2024.Theta_e,
    Theta_i=sia2024.Theta_i,
    T=sia2024.T,
    A_op=sia2024.A_op,
    A_w=sia2024.A_w,
    U_op=sia2024.U_opUValueOpaqueWalls_W_m2K,
    U_w=sia2024.U_wUValueWindows_W_m2K,
    Vdot_e=sia2024.V_eExteriorAirVolumeFlow,
    Vdot_inf=sia2024.V_infInfiltrationAirVolumeFlow,
    Eta_rec=sia2024.Eta_rec,
    Phi_P=sia2024.Φ_PHeatReleasePeople_W,
    Phi_B=sia2024.Φ_LHeatReleaseLightning_W,
    Phi_G=sia2024.Φ_GHeatReleaseAppliances_W,
    T_P=sia2024.T_PFullLoadHoursPeople_h,
    T_B=sia2024.T_BFullLoadHoursLightning_h,
    T_G=sia2024.T_GFullLoadHoursAppliances_h,
    G=sia2024.GGValueWindows_,
    F_sh=sia2024.F_sh,
    I=sia2024.I)  # -> Q_H, Q_T, Q_V, Eta_g, Q_i, Q_s
panel_4 = Panel([sia380.Q_H, sia380.Q_T, sia380.Q_V, sia380.Eta_g, sia380.Q_i, sia380.Q_s])
