# Grasshopper definition ladybug_shadowanalysis.gh (Grasshopper 1.0.7)

ladybug = Ladybug_Ladybug()  # -> Vviiiiiiiiiizzz; plug-in component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
open_weather_file = Ladybug_OpenEPWWeatherFile(open=Toggle(True))  # -> epwFile; plug-in component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
importlocation = Ladybug_ImportLocation(epwFile=open_weather_file)  # -> location; plug-in component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
sunpath = Ladybug_SunPath(location=importlocation, hour=Slider(10, range=0..12), day=21, month=12, timeStep=1, dailyOrAnnualSunPath=True)  # -> readMe, sunVectors, sunAltitudes, sunAzimuths, port, sunSpheresMesh, sunPathCrvs, compassCrvs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; plug-in component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
brep = Brep([<brep referenced from the Rhino model> x2])
shadowrange = Ladybug_ShadowStudy(geometry=brep, sunVector=sunpath.sunVectors)  # -> readMe, shadow, shade; plug-in component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
mesh = Mesh(shadowrange.shadow)
