# Grasshopper definition obstructed_panel.gh (Grasshopper 1.0.7)
# plug-ins: solar, GHSolar

# ---- group: analysis surface
srf = Surface(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)
mesh_uv = MeshSurface(Surface=srf, UCount=Slider(10, range=0..100), VCount=Slider(10, range=0..100), Overhang=True, Equalize=False)
mesh = Mesh(mesh_uv)

# ---- group: Multi-threading?
toggle = BooleanToggle(True)

# ----
mesh_2 = Mesh(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)

# ---- group: ground
mesh_3 = Mesh(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)

# ---- group: obstacles diffuse
data = Data([0.8, 0.8, 0.8, 0.8, 0.8, 0.8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])
panel = Panel(data)
mesh_4 = Mesh([mesh_3, mesh_2])
obstobj = ObstacleObject(Mesh=mesh_4, Albedo=panel, SpecCoeff=panel, ReflType="0", Tolerance="0.01", Name="stuff", MT=toggle)

# ---- group: Analysis surface object
data_2 = Data([0.8, 0.8, 0.8, 0.8, 0.8, 0.8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])
panel_2 = Panel(data_2)
obstobj_2 = ObstacleObject(Mesh=mesh, Albedo=panel_2, SpecCoeff=[panel, panel_2], ReflType="0", Tolerance="0.01", Name="analysis", MT=toggle)

# ----
item = ListItem(List=mesh, Index="0", Wrap=True)

# ---- group: ANNUAL SIMULATION
data_3 = Data([0, 0, 0, 0, 0, 0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])
data_4 = Data([0, 0, 0, 0, 0, 0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])
data_5 = Data([-65.34878984, -62.13426796, -54.95901857, -45.81747693, -35.88714072, -25.78253978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])
data_6 = Data([8.415567703, 33.69912388, 56.58914543, 72.99109311, 85.75265625, 96.74276768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])
irrmshy = IrradiationMeshYear(
    AnalysisObjects=obstobj_2,
    ObstacleObjects=obstobj,
    Latitude=47.479,
    Longitude=8.53,
    Year=2013,
    DNI=data_3,
    DHI=data_4,
    Azimuth=data_6,
    Altitude=data_5,
    MainSkyRes="1",
    MainInterpMode="0",
    SpecBounces="0",
    SpecInterpMode=0,
    DiffIReflSkyRes="0",
    DiffIReflSkyRes2nd="0",
    DiffIReflMode="0",
    MT=toggle)  # disabled
number_slider = Slider(4, range=0..7)
visumshsol = VisualizeMeshSolar(
    Mesh=mesh,
    I=irrmshy,
    Value=number_slider,
    Hour=Slider(1382, range=0..8759),
    Min="0",
    Max="800",
    Clr=Slider(1, range=0..2))
readresults = ReadResults(Mesh=mesh, I=irrmshy, Value=number_slider, SP=Slider(40, range=0..100))  # -> Results, SP

# ----
item_2 = ListItem(List=irrmshy, Index="0", Wrap=True)
python = GhPythonScript(results=irrmshy, mshin=mesh, unit=Slider(0, range=0..3), max="1100", min="800")  # -> out, mshcol; inputs mshin: Mesh, unit: Int32; disabled
# ---------- python: Python ----------
"""
Provides a scripting component.
    Inputs:
        results: CResults object from GHSolar.gha
        mshin: analysis mesh
        unit: Unit of analysis 0: [kWh/m2a], yearly specific irradiation per vertex; 1: [kWh] yearly irradiation on entire mesh
    Output:
        clrmesh: mesh colored according to solar irradiance

Temporary working file until honey-badger supports more input/output types
and lists

Script for visualizing solar mesh of GHSolar.gha in python

Translated from C# from GHResultsVisualize.cs in
    github.com/christophwaibel/GH_Solar_V2
"""

__author__ = "chwaibel"
__version__ = "2019.10.16"

import Grasshopper.Kernel as ghk
import Rhino.Geometry as rg
import GHSolar as ghs
import System.Collections.Generic.List as List
import System.Drawing.Color

valin = []
#if unit == 0 or unit == 1:
#    for i in range(0, results.I_total.Count):
#        valin.append(results.I_total[i])
#elif unit == 2 or unit == 3:
#    for i in range(0, results.I_hourly.RowCount):
#        valin.append(results.I_hourly[i, HOUR]
for i in range(0, results.I_total.Count):
    valin.append(results.I_total[i] * 0.001)

mshcol = rg.Mesh()
count = 0

if unit != 1:
    for i in range(mshin.Faces.Count):
        c = ghs.CMisc.GetRGB(1, valin[mshin.Faces[i].A], max, min)
        mshcol.Vertices.Add(mshin.Vertices[mshin.Faces[i].A])
        mshcol.VertexColors.SetColor(count, c)
        
        c = ghs.CMisc.GetRGB(1, valin[mshin.Faces[i].B], max, min)
        mshcol.Vertices.Add(mshin.Vertices[mshin.Faces[i].B])
        mshcol.VertexColors.SetColor(count + 1, c)
        
        c = ghs.CMisc.GetRGB(1, valin[mshin.Faces[i].C], max, min)
        mshcol.Vertices.Add(mshin.Vertices[mshin.Faces[i].C])
        mshcol.VertexColors.SetColor(count + 2, c)
        
        if mshin.Faces[i].IsQuad:
            c = ghs.CMisc.GetRGB(1, valin[mshin.Faces[i].D], max, min)
            mshcol.Vertices.Add(mshin.Vertices[mshin.Faces[i].D])
            mshcol.VertexColors.SetColor(count + 3, c)
            mshcol.Faces.AddFace(count, count + 1, count + 2, count + 3)
            count = count + 4
        else:
            mshcol.Faces.AddFace(count, count + 1, count + 2)
            count = count + 3
else:
    mshFaceAreas = [0.0] * mshin.Faces.Count
    totVal = 0.0
    for i in range(0, mshin.Faces.Count):
        mshFaceAreas[i] = ghs.CMisc.getMeshFaceArea(i, mshin)
        FaceVal = 0.0
        valVertex1 = valin[mshin.Faces[i].A]
        valVertex2 = valin[mshin.Faces[i].B]
        valVertex3 = valin[mshin.Faces[i].C]
        if mshin.Faces[i].IsQuad:
            valVertex4 = valin[mshin.Faces[i].D]
            FaceVal = ((valVertex1 + valVertex2 + valVertex3 + valVertex4) / 4) * ghs.CMisc.getMeshFaceArea(i, mshin)
        else:
            FaceVal = ((valVertex1 + valVertex2 + valVertex3) / 3) * ghs.CMisc.getMeshFaceArea(i, mshin)
        totVal = totVal + FaceVal
    count = 0
    for i in range(0, mshin.Faces.Count):
        c = ghs.CMisc.GetRGB(1, totVal, max, min)
        mshcol.Vertices.Add(mshin.Vertices[mshin.Faces[i].A])
        mshcol.VertexColors.SetColor(count, c)
        mshcol.Vertices.Add(mshin.Vertices[mshin.Faces[i].B])
        mshcol.VertexColors.SetColor(count + 1, c)
        mshcol.Vertices.Add(mshin.Vertices[mshin.Faces[i].C])
        mshcol.VertexColors.SetColor(count + 2, c)
        
        if mshin.Faces[i].IsQuad:
            mshcol.Vertices.Add(mshin.Vertices[mshin.Faces[i].D])
            mshcol.VertexColors.SetColor(count + 3, c)
            mshcol.Faces.AddFace(count, count + 1, count + 2, count + 3)
            count = count + 4
        else:
            mshcol.Faces.AddFace(count, count + 1, count + 2)
            count = count + 3
# ---------- end python ----------
obstructedpanel = ObstructedPanel(Mesh_analysis=mesh, Obstructions=[mesh_3, mesh_2], DHI=data_4, DNI=data_3)  # -> AnnualPotential, Mesh_visu
readresultsavg = ReadResultsAvg(Mesh=item, I=item_2, Value="3")  # -> AvgI, Area
graph = QuickGraph(obstructedpanel.AnnualPotential, SortOrder=0)
panel_3 = Panel(readresults.Results)

# ---- group: ANNUAL SIMULATION (continued)
panel_4 = Panel(readresultsavg.AvgI)
