# Grasshopper definition 180525_Plan_to_building.gh (Grasshopper 0.9.76)

# ---- group: Wall_Lines
wall_center_line = Geometry(<curve referenced from the Rhino model>)

# ---- group: Create_Windows
standard_windows_plan = Button()
import_windows = BooleanToggle(False)

# ---- group: Settings
wall_height = Slider(3.5, range=0..4)
wall_thickness = Slider(0.32, range=0..1)
window_to_wall_ratio = Slider(0.56, range=0.01..1)
preffered_sill_height = Slider(0.42, range=0..1)
preffered_window_height = Slider(2.24, range=0..3)
preffered_window_width = Slider(2.08, range=0..3)
minimum_side_clearance = Slider(0.71, range=0..2)
window_position_in_wall = Slider(-0.1, range=-1..1)

# ----
plan_to_3d_floor = Plan_to_3D_Floor(
    wallcenterline=wall_center_line,
    wallheight=wall_height,
    wallthickness=wall_thickness,
    w2wratio=window_to_wall_ratio,
    prefsillheight=preffered_sill_height,
    prefwindheight=preffered_window_height,
    prefwindwidth=preffered_window_width,
    minsideclearance=minimum_side_clearance,
    window_position=window_position_in_wall,
    importwindows=import_windows,
    drawstandardwindows=standard_windows_plan)  # -> wallstopview_2, wallline_windplane, wallframes, _3d_wall_surfaces, windowframes, windowlines, windowstopview_2, windowsheights_2, sillheights_2
bndry = BoundarySurfaces(Edges=plan_to_3d_floor.windowframes)
preview = CustomPreview(Geometry=plan_to_3d_floor._3d_wall_surfaces, Shader=ColourSwatch(SwatchColor=RGBA(115, 115, 115, 98)))
preview_2 = CustomPreview(Geometry=bndry, Shader=ColourSwatch(SwatchColor=RGBA(0, 124, 232, 98)))

Z = UnitZ(Factor=plan_to_3d_floor.sillheights_2)  # disabled
move = Move(Geometry=plan_to_3d_floor.windowstopview_2, Motion=Z)  # -> Geometry, Transform; disabled
rectangle = Rectangle(Plane=PlaneXY(0, 0, 0), XSize=Domain(-1, 1), YSize=Domain(-2, 2), Radius=0)  # -> Rectangle, Length; disabled
flip = FlipCurve(Curve=move.Geometry, Guide=rectangle.Rectangle)  # -> Curve, Flag; disabled
boxrec = BoxRectangle(Rectangle=flip.Curve, Height=plan_to_3d_floor.windowsheights_2)  # disabled

swatch = ColourSwatch(SwatchColor=RGBA(115, 115, 115, 98))  # disabled

# ---- group: Walls / Slab
Z_2 = UnitZ(Factor=wall_height)  # disabled
item = ListItem(List=flatten(plan_to_3d_floor.wallstopview_2), Index=0, Wrap=True)  # disabled
boundary = BoundarySurfaces(Edges=plan_to_3d_floor.wallstopview_2)  # disabled
geo = Geometry(item)  # disabled
extr = Extrude(Base=boundary, Direction=Z_2)  # disabled
Z_3 = UnitZ(Factor=-0.2)  # disabled

# ----
boundary_2 = BoundarySurfaces(Edges=geo)  # disabled

# ---- group: Walls / Slab (continued)
extr_2 = Extrude(Base=boundary_2, Direction=Z_3)  # disabled

# ----
sdiff = SolidDifference(BrepsA=extr, BrepsB=boxrec)  # disabled
geo_2 = Geometry(sdiff)  # disabled
preview_3 = CustomPreview(Geometry=geo_2, Shader=swatch)  # disabled

# ==== cluster Plan_to_3D_Floor
wallheight = ClusterInput()
wallcenterline = ClusterInput()
wallthickness = ClusterInput()
drawstandardwindows = ClusterInput()
minsideclearance = ClusterInput()
prefsillheight = ClusterInput()
prefwindheight = ClusterInput()
window_position = ClusterInput()  # Position of the window in the wall: -1: outside 1: inside
w2wratio = ClusterInput()
prefwindwidth = ClusterInput()
importwindows = ClusterInput()
wallcenterline_2 = Geometry(wallcenterline)
wallheight_2 = Data(wallheight)
wallthickness_2 = Data(wallthickness)
minsideclearance_2 = Data(minsideclearance)
prefsillheight_2 = Data(prefsillheight)
prefwindheight_2 = Data(prefwindheight)
w2wratio_2 = Data(w2wratio)
prefwindwidth_2 = Data(prefwindwidth)
drawstandardwindows_2 = Data(drawstandardwindows)
join = JoinCurves(Curves=wallcenterline_2, Preserve=False)
importwindows_2 = Data(importwindows)
sort_segments = PythonScript(curves=flatten(join))  # -> sorted_segments, mid_points, b; inputs curves: list
# ---------- sort_segments: Python ----------
# Stefan Caranovic, 18.01.2018, ETHZ 
""" Sorts the segments of a list of curves or polilines in clockwise order, 
starting form the most left one (judged by the position of its middle point.
"""

import ghpythonlib as ghp
import rhinoscriptsyntax as rs
from collections import deque

planLines = []
mid_points = []


for c in curves:
    print(type(c))
    if rs.IsLine(c):
        planLines.append(c)
    #elif rs.IsCurve(c):
    else:
        print("else")
        #aux = rs.ExplodeCurves(c)
        aux = ghp.components.Explode(c, True)
        print(type(aux))
        for pl in aux[0]:
            print(type(pl))
            planLines.append(rs.coercecurve(pl))

b = aux

midPointsX = []

for pl in planLines:
    midPointsX.append(rs.CurveMidPoint(pl)[0])
    
ind = midPointsX.index(min(midPointsX))

#print min(midPoints)
#print ind


sPlanLines = deque(planLines)
sPlanLines.rotate(-ind)

sorted_segments = sPlanLines
for pl in planLines:
    mid_points.append(rs.CurveMidPoint(pl))
# ---------- end sort_segments ----------
get_windows = PythonScript(run=importwindows_2, wallSegments=sort_segments.sorted_segments)  # -> rhobjs, windows, tDots, aCentroid, line1, line2, w, myPoints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; inputs wallSegments: list
# ---------- get_windows: Python ----------
import rhinoscriptsyntax as rs
import scriptcontext as sc
import Rhino
import ghpythonlib.components as gh
from collections import deque
import math

windows = []
tDots = []
dotLocation = []

if run:
    sc.doc = Rhino.RhinoDoc.ActiveDoc
    rhobjs = sc.doc.Objects.FindByLayer("2D_Windows")
    for o in rhobjs:
        if (rs.IsCurve(o)):
            #windows.append(o)
            windows.append(rs.coercegeometry(o))
        elif (rs.IsTextDot(o)):
            tDots.append(o)
            
    
    
    aCentroid = []
    aCentroidX = []

    for pl in windows:
        centr = rs.CurveAreaCentroid(pl)
        aCentroid.append(centr[0])
    
    myPoints = []
    myWindows = []
    for w in wallSegments:
        for u in aCentroid:

            u1 = Rhino.Geometry.Point(u)
            if (gh.CurveClosestPoint(u1,w)[2] < 0.0001):
                myPoints.append(u1)
                ind = aCentroid.index(u)
                myWindows.append(windows[ind])
                
    t = [];
    for w in myWindows:
        vertices = rs.PolylineVertices(w)
        vertices = rs.CullDuplicatePoints(vertices)
        for p in vertices:
            t.append(p)
    myProperties = []           
    for i in t:
        for p in tDots:
            if (rs.Distance(rs.TextDotPoint(p), i)<0.001):
                myProperties.append(rs.TextDotText(p))
            
                
                
                
                
    """
    aCentroid = rs.SortPointList(aCentroid)

    ind = aCentroid.index(min(aCentroid))

    aCentroid = deque(aCentroid)
    aCentroid.rotate(-ind)

    # check direction of list and reverse if counter-clockwise
    line1 = gh.Vector2Pt(aCentroid[0],aCentroid[1])
    line2 = gh.Vector2Pt(aCentroid[0], aCentroid[len(aCentroid)-1])
    lineH = gh.Vector2Pt(aCentroid[0], Rhino.Geometry.Point3d(aCentroid[0][0]+1,aCentroid[0][1],0))
    ang = gh.Angle(lineH,line1)[0]-gh.Angle(lineH,line2)[0]
    ang = math.degrees(ang)
    if (ang<0):
       aCentroid = list(reversed(aCentroid))
       """
# ---------- end get_windows ----------
python = PythonScript(
    wall_height=wallheight_2,
    segments=sort_segments.sorted_segments,
    w2w_ratio=w2wratio_2,
    wall_thickness=wallthickness_2,
    pref_sill_height=prefsillheight_2,
    pref_wind_height=prefwindheight_2,
    pref_wind_width=prefwindwidth_2,
    min_side_clearance=minsideclearance_2,
    window_position=window_position)  # -> Error, windowTopView, windowHeight, sillHeight, windowPlanes, points, windowLines, vectors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; inputs segments: list
# ---------- python: Python ----------
import rhinoscriptsyntax as rs
import Rhino
import math
import ghpythonlib as ghp

import Grasshopper.Kernel.Data.GH_Path as ghpath
import Grasshopper.DataTree as datatree
import System

windowTopView = datatree[System.Object]()
myPlane = []
windowHeight = []
sillHeight = []
windowPlanes = []
points = []
windowLines = datatree[System.Object]()
vectors = []

windowDrawingDepth = wall_thickness/2
widthFactor = math.sqrt(float(w2w_ratio))


if (w2w_ratio > ((wall_height - pref_sill_height) / wall_height)):
    # if the w2w_ratio is bigger that what is possible with the preffered sill height
    realSillHeight = wall_height * (1 - w2w_ratio) 
else:
    realSillHeight = pref_sill_height
print("real sill height: " , realSillHeight)


if (pref_wind_height >= (wall_height-realSillHeight)):
    # if the pref_wind_heigt is bigger than what is possible 
    realWindowHeight = (wall_height-realSillHeight)
elif (w2w_ratio >= pref_wind_height / wall_height):
    realWindowHeight = w2w_ratio * wall_height
else:
    realWindowHeight = pref_wind_height
print("real window height: " , realWindowHeight)

pathInd = 0

for s in segments:
    path = ghpath(pathInd)
    
    segmentLength = rs.CurveLength(s)
    print(segmentLength)
    wallArea = (segmentLength-wall_thickness) * wall_height
    windowArea = wallArea * w2w_ratio
    reqWindowWidth = windowArea / realWindowHeight
    print("required window width: ", reqWindowWidth)
    
    n = round(reqWindowWidth / pref_wind_width)
    if (n == 0):
        n += 1
    #n = int(segmentLength / (pref_side_clearance + pref_wind_width))
    
    while ((segmentLength-reqWindowWidth) < ( n * min_side_clearance)) and (n>1):
        n -= 1
    """
    if ((pref_wind_width + min_side_clearance)*n <= segmentLength):
        realWindowWidth = pref_wind_width
    else:
        realWindowWidth = reqWindowWidth / n
        """
    print("n=", n)
    realWindowWidth = reqWindowWidth / n
    realSideClearance = (segmentLength - n*realWindowWidth) / n
    
    
    # create a XY plane aligned to the current segment, with the origin in the middle
    print("real side clearance: ",realSideClearance)
    t = (realSideClearance + realWindowWidth) / 2
    ps = rs.CurveStartPoint(s)
    myWidth = Rhino.Geometry.Interval(-realWindowWidth/2,realWindowWidth/2)
    myDepth = Rhino.Geometry.Interval(-windowDrawingDepth,windowDrawingDepth)
    
    for i in range(0,int(n)):
        p = ghp.components.EvaluateCurve(s,t)[0]
        pst = ghp.components.EvaluateCurve(s,t-realWindowWidth/2)[0]
        points.append(p)
        #create the X component of the plane along the current segment
        vx = rs.VectorCreate(p,ps)
        vectors.append(vx)
        #create the Y component of the plane perpendicular to the current segment
        vy = rs.VectorCrossProduct(vx,[0,0,1])
        vy = ghp.components.UnitVector(vy)
        #create the plane 
        pst = ghp.components.Move(pst,vy * wall_thickness/2 * window_position)
        
        plane = rs.PlaneFromPoints(p, (p[0]+vx[0],p[1]+vx[1],p[2]+vx[2]), (p[0]+vy[0],p[1]+vy[1],p[2]+vy[2]))
        windowPlanes.append(plane)
        windowTopView.Add(Rhino.Geometry.Rectangle3d(plane, myWidth ,myDepth), path)
        
        windowLines.Add(ghp.components.LineSDL(pst, vx, realWindowWidth), path)
        
        t = t + realSideClearance + realWindowWidth

    print ("----------------------------------")
    pathInd += 1

offsetVector = vy * wall_thickness/2 * window_position
auxSum = offsetVector[0]+offsetVector[1]+offsetVector[2]
if (ghp.components.VectorLength(offsetVector) <> 0): 
    offsetDistance = auxSum / abs(auxSum) * ghp.components.VectorLength(offsetVector)
else:
    offsetDistance = 0

windowHeight = realWindowHeight
sillHeight = realSillHeight
# ---------- end python ----------
join_2 = JoinCurves(Curves=sort_segments.sorted_segments, Preserve=False)
split = TextSplit(Text=get_windows.myProperties, Separators="/")
panel = Panel("""-0.5
0.5""")
item = ListItem(List=split, Index=0, Wrap=True)  # -> flatten(Item), flatten(Item1)
xy = XYPlane(Origin=Point(0, 0, 0))
multiplication = Multiplication(A=panel, B=wallthickness_2)
offset_l = OffsetLoose(Curve=join_2, Distance=graft(python.offsetDistance), Plane=xy)
windows_bake = PythonScript(
    run=drawstandardwindows_2,
    layer_color=ColourSwatch(SwatchColor=RGB(214, 64, 64)),
    windows_layer="2D_Windows",
    window_curves=python.windowTopView,
    wHeight=python.windowHeight,
    sHeight=python.sillHeight)  # inputs window_curves: list
# ---------- windows_bake: Python ----------
import rhinoscriptsyntax as rs
import scriptcontext as sc
import Rhino

if run:
    sc.doc = Rhino.RhinoDoc.ActiveDoc
    try:
        rs.PurgeLayer(windows_layer)
    except:
        print ("exception")
    rs.AddLayer(name=windows_layer, color=layer_color, visible=True, locked=False, parent=None)
    
    #create rhino object
    for g in window_curves:
        print(g)
        ind = window_curves.index(g)
        sc.doc = ghdoc
        obj_id = g
        doc_object = rs.coercerhinoobject(obj_id)
        attributes = doc_object.Attributes
        geom = doc_object.Geometry
        #select layer to bake and add to the attributes
        sc.doc = Rhino.RhinoDoc.ActiveDoc
        layertable = sc.doc.Layers
        layerindex = layertable.Find(windows_layer,True)
        attributes.LayerIndex = layerindex
        
        dotPos = rs.CurveStartPoint(geom)
        text = str(round(wHeight,2))+"/" + str(round(sHeight,2))
        myDot = rs.AddTextDot(text, dotPos)
        rs.ObjectLayer(myDot, windows_layer)
        rs.TextDotHeight(myDot,8)

        #bake object
        rhino_obj = sc.doc.Objects.Add(geom, attributes)

        
    sc.doc = ghdoc
# ---------- end windows_bake ----------
filter = StreamFilter(Gate=importwindows_2, Stream0=python.sillHeight, Stream1=item.Item1)
filter_2 = StreamFilter(Gate=importwindows_2, Stream0=python.windowHeight, Stream1=item.Item)
filter_3 = StreamFilter(Gate=importwindows_2, Stream0=python.windowTopView, Stream1=get_windows.myWindows)
offset = Offset(Curve=join_2, Distance=graft(multiplication), Plane=PlaneXY(0, 0, 0), Corners=1)  # -> flatten(Curve)
explode = Explode(Curve=offset_l, Recursive=True)  # -> graft(Segments), Vertices
windowsheights = Data(filter_2)
windowstopview = Geometry(filter_3)
sillheights = Data(filter)

Z = UnitZ(Factor=python.sillHeight)
Z_2 = UnitZ(Factor=python.windowHeight)
move = Move(Geometry=python.windowLines, Motion=Z)  # -> Geometry, Transform
end = EndPoints(Curve=move.Geometry)  # -> Start, End
move_2 = Move(Geometry=end.Start, Motion=Z_2)  # -> Geometry, Transform
rec_3pt = Rectangle3Pt(PointA=end.Start, PointB=end.End, PointC=move_2.Geometry)  # -> Rectangle, Length

wallstopview = Geometry(offset)

Z_3 = UnitZ(Factor=wallheight_2)
end_2 = EndPoints(Curve=explode.Segments)  # -> Start, End
move_3 = Move(Geometry=end_2.Start, Motion=Z_3)  # -> Geometry, Transform
rec_3pt_2 = Rectangle3Pt(PointA=end_2.Start, PointB=end_2.End, PointC=move_3.Geometry)  # -> simplify(Rectangle), Length

data = Data([rec_3pt_2.Rectangle, rec_3pt.Rectangle])
boundary = BoundarySurfaces(Edges=data)
wallline_windplane = ClusterOutput(explode.Segments)
wallstopview_2 = ClusterOutput(wallstopview)
_3d_wall_surfaces = ClusterOutput(boundary)  # 3D wall surface according to the window positioning
wallframes = ClusterOutput(rec_3pt_2.Rectangle)  # Wall rectangles according to the window position
windowframes = ClusterOutput(rec_3pt.Rectangle)  # window rectangles according to the window position
sillheights_2 = ClusterOutput(sillheights)
windowsheights_2 = ClusterOutput(windowsheights)
windowlines = ClusterOutput(python.windowLines)
windowstopview_2 = ClusterOutput(windowstopview)
