# Grasshopper definition boiler_timeresolved.gh (Grasshopper 1.0.7)
# plug-ins: combustion

panel = Panel("""0.2
0.2
0.2
0.2
0.2
0.2""")
panel_2 = Panel("""0.25
0.26
0.23
0.1
0.02
0.0""")
panel_3 = Panel("""0.9
0.9
0.9
0.9
0.9
0.9""")
panel_4 = Panel("""12
14
16
17
13
2""")
boiler_tr = BoilerTr(Heating_loads=panel_4, Carrier_cost=panel, Carrier_emissions=panel_2, Efficiency=panel_3)  # -> Cost, Carbon
graph = QuickGraph(boiler_tr.Carbon, SortOrder=0)
graph_2 = QuickGraph(boiler_tr.Cost, SortOrder=0)
