# Grasshopper definition chp_timeresolved.gh (Grasshopper 1.0.7)
# plug-ins: combustion

panel = Panel("""12
14
16
17
13
2""")
panel_2 = Panel("""0.09
0.09
0.09
0.09
0.09
0.09""")
panel_3 = Panel("""0.237
0.237
0.237
0.237
0.237
0.237""")

# ---- group: optional. connect to "str" in CHP component
panel_4 = Panel("elec_in")

# ----
chp_tr = ChpTr(Loads=panel, Eta="0.33", Htp="1.57", Fuelcost=panel_2, Fuelemissions=panel_3)  # -> Total_cost, Total_emissions, Heating_gen, Elec_gen
panel_5 = Panel(chp_tr.Elec_gen)
panel_6 = Panel(chp_tr.Heating_gen)
panel_7 = Panel(chp_tr.Total_cost)
panel_8 = Panel(chp_tr.Total_emissions)
