# Grasshopper definition chiller.gh (Grasshopper 1.0.7)
# plug-ins: cooling

chiller = Chiller(Cooling_loads="250", Elec_cost="0.15", Elec_emissions="0.28", COP="3.5")  # -> Elec, Cost, Carbon
panel = Panel([chiller.Elec, chiller.Cost, chiller.Carbon])
