# Grasshopper definition chiller_timeresolved.gh (Grasshopper 1.0.7)
# plug-ins: cooling

panel = Panel("""0.15
0.15
0.15
0.25
0.25
0.25""")
panel_2 = Panel("""20
25
23
20
10
5""")
panel_3 = Panel("""0.28
0.28
0.28
0.28
0.28
0.28""")
panel_4 = Panel("""30
32
32
38
45
45""")
chiller_tr = ChillerTr(Cooling_loads=panel_2, Elec_cost=panel, Elec_emissions=panel_3, Temperature=panel_4)  # -> Elec, Cost, Carbon, COP
panel_5 = Panel(chiller_tr.Elec)
panel_6 = Panel(chiller_tr.COP)
panel_7 = Panel(chiller_tr.Cost)
panel_8 = Panel(chiller_tr.Carbon)
