# Grasshopper definition ashp_timeresolved.gh (Grasshopper 1.0.7)
# plug-ins: heatpumps

panel = Panel("""-5
-10
-3
0
2""")
panel_2 = Panel("""20
23
25
62
25""")

# ---- group: parameters from Ashouri et al 2013
panel_3 = Panel("0.012")
panel_4 = Panel("1.109")
panel_5 = Panel("-0.047")
panel_6 = Panel("13.39")

# ----
ashp_t = ASHPT(Q_th=panel_2, T_supply="65", T_ambT=panel, PI_HP1=panel_6, PI_HP2=panel_5, PI_HP3=panel_4, PI_HP4=panel_3)  # -> X_el, COP
panel_7 = Panel(ashp_t.COP)
panel_8 = Panel(ashp_t.X_el)
