# Grasshopper definition simple_hp.gh (Grasshopper 1.0.7)
# plug-ins: heatpumps

hp_cop = SimpleHpCop(Eta="0.3", T_1="35", T_2="-10")
panel = Panel(hp_cop)
simple_hp = SimpleHp(Q_th="100", COP=hp_cop)
panel_2 = Panel(simple_hp)
