# Grasshopper definition simple_panel.gh (Grasshopper 1.0.7)
# plug-ins: solar, GHSolar, epw-reader

panel = Panel("C:\EnergyPlusV9-3-0\WeatherData\USA_CA_San.Francisco.Intl.AP.724940_TMY3.epw")
panel_2 = Panel("C:\Users\Christoph\Documents\GitHub\hive\GrasshopperExamples\LectureExercises\HIVE_Geneva.epw")
epw_reader = EPWReader(Path=panel)  # -> Latitude, Longitude, CityCountry, GHI, DNI, DHI, DryBulb, DewPoint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
panel_3 = Panel([Slider(74.91, range=-180..180), epw_reader.Latitude])

# ---- group: replace with grasshopper component that reads a surface of a building
number_slider = Slider(180, range=0..360)
# Do this for each surface of a building and the average all for simplified SIA 380 component
number_slider_2 = Slider(90, range=0..90)

# ----
panel_4 = Panel([epw_reader.Longitude, epw_reader.Latitude])
data = Data([0, 0, 0, 0, 0, 0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])
data_2 = Data([0, 0, 0, 0, 0, 0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])
python = GhPythonScript()  # -> out, a
# ---------- python: Python ----------
__author__ = "Christoph"
__version__ = "2020.10.12"

import rhinoscriptsyntax as rs
a = [1] * 8760
# ---------- end python ----------
panel_5 = Panel("-50")
ladybug = Ladybug_Ladybug()  # -> Vviiiiiiiiiizzz; plug-in component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
simplepanel = SimplePanel(
    Tilt=number_slider_2,
    Azimuth=number_slider,
    DHI=python.a,
    DNI=python.a,
    Latitude=Slider(8.4, range=-90..90),
    Longitude=Slider(6.353, range=-180..180),
    Timezone="0")
panel_6 = Panel(simplepanel)
importepw = Ladybug_ImportEpw(epwFile=panel)  # -> readMe, latitude, location, dryBulbTemperature, dewPointTemperature, relativeHumidity, windSpeed, windDirection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; plug-in component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
graph = QuickGraph(simplepanel, SortOrder=0)
data_3 = Data("""Site:Location,
San Francisco Intl Ap_CA_USA,
37.62,      !Latitude
-122.40,     !Longitude
-8.0,     !Time Zone
2.0;       !Elevation""")
panel_7 = Panel("""Site:Location,
San Francisco Intl Ap_CA_USA,
37.62,      !Latitude
-100.40,     !Longitude
-8.0,     !Time Zone
2.0;       !Elevation""")
panel_8 = Panel(data_3)
analysisperiod = Ladybug_AnalysisPeriod(fromMonth="1", fromDay="1", fromHour="1", toMonth="12", toDay="365", toHour="24")  # -> readMe, analysisPeriod; plug-in component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
number_slider_3 = Slider(0.05, range=0..1)
skydome = GHSkydome(
    RecursionLevel="0",
    SunPath="true",
    SolarVec=True,
    HOY=Slider(0, range=0..1),
    Location=panel_3,
    DNI=python.a,
    DHI=python.a,
    Size=Slider(5.778, range=0..7),
    Sp="0,0,0")  # -> Mesh, Vectors, Sunpaths, SunGeo
crv = Curve(skydome.Sunpaths)
sunpath = Ladybug_SunPath(
    location=panel_7,
    hour=12,
    day=21,
    month=12,
    timeStep=1,
    analysisPeriod=analysisperiod.analysisPeriod,
    centerPt="0,0,0",
    sunPathScale=number_slider_3,
    sunScale=number_slider_3,
    dailyOrAnnualSunPath=True)  # -> readMe, sunVectors, sunAltitudes, sunAzimuths, port, sunSpheresMesh, sunPathCrvs, compassCrvs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; disabled; plug-in component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
preview = CustomPreview(Geometry=[sunpath.sunPathCrvs, sunpath.compassCrvs], Shader=ColourSwatch(SwatchColor=RGB(0, 0, 0)))
panel_9 = Panel(sunpath.sunAltitudes)
