# Grasshopper definition noct_pv.gh (Grasshopper 1.0.7)
# plug-ins: pv-sum, noct-pv

data = Data([0, 0, 0, 0, 0, 0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])
data_2 = Data([8.8, 8.6, 8.4, 8.3, 8.2, 8.1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])
noct_pv = NOCTPV(A="1", T_amb=data_2, I=data)  # -> Elec, Effic
list = ValueList({"day", "month", "year"}, selected="month")
panel = Panel(noct_pv.Elec)
sum_yield = SumYield(Sum_mode=list, Elec=noct_pv.Elec)
panel_2 = Panel(data)
division = Division(A=sum_yield, B="1000")
panel_3 = Panel(division)
graph = QuickGraph(panel_3, SortOrder=0)
graph_2 = QuickGraph(noct_pv.Elec, SortOrder=0)
