# Grasshopper definition simple_pv.gh (Grasshopper 1.0.7)
# plug-ins: HiveIO, Hive.Core.solar_tech, Hive.Core.solar, Hive.Core.solar_techParameters

# ---- group: replace with grasshopper component that reads a surface of a building
number_slider = Slider(99.53, range=0..360)
number_slider_2 = Slider(34.366, range=0..90)

# ----
number_slider_3 = Slider(180, range=0..360)
number_slider_4 = Slider(0, range=0..90)
data = Data([0, 0, 0, 0, 0, 0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])
data_2 = Data([0, 0, 0, 0, 0, 0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])
solarpotentialsunobstructed = SolarPotentialsUnobstructedCSharp(
    Tilt=[number_slider_4, number_slider_2],
    Azimuth=[number_slider_3, number_slider],
    DHI=data,
    DNI=data_2,
    Latitude=47.36667,
    Longitude=8.55,
    Aw=1,
    Timezone=0)
simplepanel = SimplePanel(Tilt=[number_slider_4, number_slider_2], Azimuth=[number_slider_3, number_slider], DHI=data, DNI=data_2)
sumpvyield = SummarizePVElectricityYieldCSharp(Sum_mode="year", Elec=solarpotentialsunobstructed)
sum_yield = SumYield(Sum_mode="year", Elec=simplepanel)  # -> flatten(Yield)
item = ListItem(List=sum_yield, Index="1", Wrap=True)
item_2 = ListItem(List=sum_yield, Index="0", Wrap=True)
item_3 = TreeItem(Tree=sumpvyield, Path="{0;0;1;0}", Index="0", Wrap=True)
item_4 = TreeItem(Tree=sumpvyield, Path="{0;0;0;0}", Index="0", Wrap=True)
graph = QuickGraph(simplepanel, SortOrder=0)
prl = PerformanceRatio({"Roof perfect": {"Scenario": "Roof perfect", "performance ratio": 0.84999999999999998}, "Roof normal": {"Scenario": "Roof normal", "performance ratio": 0.75}, "Roof dirty": {"Scenario": "Roof dirty", "performance ratio": 0.69999999999999996}, "Facade perfect": {"Scenario": "Facade perfect", "performance ratio": 0.75}, "Facade normal": {"Scenario": "Facade normal", "performance ratio": 0.69999999999999996}, "Facade shaded": {"Scenario": "Facade shaded", "performance ratio": 0.59999999999999998}}, selected="Roof perfect")
panel = Panel(item_3)
orfac = OrientationFactor(G_flat=item_2, G_angled=item)
panel_2 = Panel(item_4)
panel_3 = Panel(item_2)
panel_4 = Panel(item)
perfrat = PerformanceRatio(Performance_scenario=prl)
panel_5 = Panel(orfac)
orientationfactor = SolarOrientationFactorCSharp(G_flat=item_4, G_angled=item_3)
division = Division(A=item_2, B="1000")
performanceratio = SolarPerformanceRatio({"Roof perfect": 0.85, "Roof normal": 0.75, "Roof dirty": 0.7, "Facade perfect": 0.75, "Facade normal": 0.7, "Facade shaded": 0.6}, selected="Roof perfect")
panel_6 = Panel(orientationfactor)
simplepv = SimplePV(Global_Irradiation=division, FormFactor=panel_5, SurfaceArea="10", PerformanceRatio=perfrat)
division_2 = Division(A=item_4, B="1000")

# ---- group: Total PV electricity generation
panel_7 = Panel(simplepv)

# ----
pvsimple = PhotovoltaicEnergySystemCSharp(
    Global_Irradiation=division_2,
    FormFactor=panel_6,
    SurfaceArea="10",
    PVEfficiency=0.15,
    PerformanceRatio=performanceratio)
panel_8 = Panel(pvsimple)
panel_9 = Panel(sum_yield)
panel_10 = Panel(sumpvyield)
flatten = FlattenTree(Tree=panel_10, Path="{0}")
viewer = ParamViewer(panel_9)
viewer_2 = ParamViewer(panel_10)
panel_11 = Panel(flatten)
viewer_3 = ParamViewer(panel_11)
