# Grasshopper definition simple_solar_thermal.gh (Grasshopper 1.0.7)
# plug-ins: solar-tech, solar-techParameters, solar

# ---- group: replace with grasshopper component that reads a surface of a building
number_slider = Slider(99.53, range=0..360)
number_slider_2 = Slider(34.366, range=0..90)

# ----
data = Data([0, 0, 0, 0, 0, 0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])
data_2 = Data([0, 0, 0, 0, 0, 0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])
simplepanel = SimplePanel(Tilt=[Slider(0, range=0..90), number_slider_2], Azimuth=[Slider(180, range=0..360), number_slider], DHI=data, DNI=data_2)
sum_yield = SumYield(Sum_mode="year", Elec=simplepanel)  # -> flatten(Yield)
steffl = STEfficiency({"DIY from youtube tutorial": {"ST tech": "DIY from youtube tutorial", "efficiency": 0.10000000000000001}, "normal ST": {"ST tech": "normal ST", "efficiency": 0.14999999999999999}, "cutting edge Fraunhofer ISE collector": {"ST tech": "cutting edge Fraunhofer ISE collector", "efficiency": 0.20000000000000001}, "Alien tech": {"ST tech": "Alien tech", "efficiency": 0.25}}, selected="DIY from youtube tutorial")
item = ListItem(List=sum_yield, Index="1", Wrap=True)
item_2 = ListItem(List=sum_yield, Index="0", Wrap=True)
graph = QuickGraph(simplepanel, SortOrder=0)
orfac = OrientationFactor(G_flat=item_2, G_angled=item)
steff = STEfficiency(ST_tech=steffl)
panel = Panel(orfac)
division = Division(A=item_2, B="1000")
simplest = SimpleST(Global_Irradiation=division, FormFactor=panel, SurfaceArea="10", STEfficiency=steff)

# ---- group: Total thermal energy generation
panel_2 = Panel(simplest)
