# Grasshopper definition solar_thermal_timeresolved.gh (Grasshopper 1.0.7)
# plug-ins: solar-tech

panel = Panel("""-5
-3
0
5
10""")
panel_2 = Panel("""15
15
15
15
15""")
panel_3 = Panel("""300.0
500.0
600.0
800.0
500.0""")
st_tr = STTr(T_in=panel_2, T_amb=panel, OpticEff="0.68", HeatLoss="4.9", Irrad=panel_3, Area="2")  # -> Heating, Eta
panel_4 = Panel(st_tr.Heating)
panel_5 = Panel(st_tr.Eta)
