# Grasshopper definition Validation & Comparison.gh (Grasshopper 1.0.7)
# Copyright: CC by Martin Dembski
# plug-ins: GHSolar, HiveIO, ProvingGround.Conduit, Bombyx 2

# - Bombyx also deducts windows
# 
# - Why is Hive floor area less?
# 
# - Floor surface can't be manually added to Hive.
# 
# - Thermal resistivity type in Bombyx?
brep = Brep(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)
srf = Surface(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)
epw_filepath = FilePath("E:\ETH Zurich\HIWI - SC\Weather File_Zurich.epw")

# ---- group: Hive_FullTemplate / refine windows discretisation
panel = Panel("2")
panel_2 = Panel("8")

# ----
# Geometry layer
layer = Panel("""Exterior walls above ground
Exterior walls under ground
Windows
Interior walls
Partition walls
Columns
Ceilings
Slabs
Pitched roofs
Flat roofs
Balconies""")
factor_nfa = Slider(1, range=0.7..1)
update_layers = Button()
create_layers = Button()
area_take_off = AreaTakeOff(L=layer, create=create_layers, U=update_layers, factor=factor_nfa)  # -> exterior_walls_above_ground_2, aussenwand_unter_t_2, fenster_2, srf_12, innenwand_2, trennwand_2, decke_2, boden_2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

# ---- group: Hive_FullTemplate / PV Fläche
srf_2 = Surface(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)

# ---- group: Hive_FullTemplate / static shading
mesh = Mesh(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)

# ---- group: Hive_FullTemplate / Ground
mesh_2 = Mesh(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)

# ---- group: Hive_FullTemplate / Context (City, obstacles, etc.)
mesh_3 = Mesh([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])

# ---- group: Hive_FullTemplate / Windows
srf_3 = Surface([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])

# ---- group: Hive_FullTemplate / Building volume
brep_2 = Brep(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)

# ---- group: CompECD_L07_Sensitivity_Energy (1) / Aussenluftvolumenstrom in m^3/h pro m^2
panel_3 = Panel(Slider(1, range=0.1..1.5))

# ---- group: CompECD_L07_Sensitivity_Energy (1) / Infiltration in m^3/h pro m^2
panel_4 = Panel(Slider(0.15, range=0.05..0.5))

# ---- group: CompECD_L07_Sensitivity_Energy (1) / Wärmerückgewinnung (Wert zwischen 0 - 1)
panel_5 = Panel(Slider(0.334, range=0..0.9))

# ---- group: CompECD_L07_Sensitivity_Energy (1) / Zeitkonstante tau des Gebäudes in h
panel_6 = Panel(Slider(160, range=50..800))

# ---- group: CompECD_L07_Sensitivity_Energy (1) / Raumlufttemperatur (Heizperiode) in °C
panel_7 = Panel(Slider(21.03, range=17..25))

# ---- group: CompECD_L07_Sensitivity_Energy (1) / Reduktionsfaktor externe Verschattung (0 - 1)
panel_8 = Panel(Slider(0.702, range=0..1))

# ----
bombyx_zone_area = Panel(area_take_off.boden_2)

# ---- group: Hive_FullTemplate / shading mask rec level
toggle = BooleanToggle(False)
number_slider = Slider(3, range=0..5)
number_slider_2 = Slider(0.113, range=0..2)

# ---- group: CompECD_L07_Sensitivity_Energy (1) / hourly drybulb (°C) from .epw
drybulb = Data([1.1, 2, 1, 1, 1, 0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])

# ---- group: CompECD_L07_Sensitivity_Energy (1) / GHI (Wh) from .epw
ghi = Data([0, 0, 0, 0, 0, 0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])

# ---- group: Hive_FullTemplate / sun vector HOY
toggle_2 = BooleanToggle(False)
number_slider_3 = Slider(2680, range=0..8759)

# ---- group: CompECD_L07_Sensitivity_Energy (1) / Formfaktor (Wert zwischen 0 - 1) (Hier: Südschrägdach)
panel_9 = Panel("""0.84
0.78
0.69
0.6
0.63
0.62
0.59
0.63
0.67
0.66
0.75
0.75""")

# ---- group: Hive_FullTemplate / show sunpath
toggle_3 = BooleanToggle(False)

# ---- group: Hive_FullTemplate / min (blue) to max (yellow) irradiation (kWh/m^2)
number_slider_4 = Slider(0, range=0..1000)
number_slider_5 = Slider(1000, range=0..2000)

# ---- group: Hive_FullTemplate / Simulate solar?
toggle_4 = BooleanToggle(False)

# ---- group: Hive_FullTemplate / show HUD
toggle_5 = BooleanToggle(False)

# ---- group: Hive_FullTemplate / HUD for PV (true) or Windows (false)
toggle_6 = BooleanToggle(False)

# ----
hiveparainroom = ParametricInputSIARoomHive()

# ---- group: Hive_FullTemplate / Simple efficiency calculations?
toggle_7 = BooleanToggle(False)

# ---- group: CompECD_L07_Sensitivity_Energy (1)
# Calculation scripts
# Energie- und Klimasysteme (EK)
# Heizwärmebedarf
# Berechnungen zur Abschätzung des Wärmebedarfs.
# Basiert auf der Excel Tabelle "Interaktion Struktur, Klima und Wärmebedarf.xlsx"
# 
# https://moodle-app2.let.ethz.ch/mod/glossary/showentry.php?eid=42209
# CompECD
window_a = Data(area_take_off.fenster_2)
python = GhPythonScript(x=drybulb, month=[0, 1, 2, 3, 4, 5, 6, 7, 8, 9, 10, 11])  # -> out, a; inputs x: list, month: Int32
# ---------- python: Python ----------
__author__ = "chwaibel"
__version__ = "2020.02.25"

import rhinoscriptsyntax as rs

# 8760 time series
# get monthly average...
# how to know how many days a month? somewhere, I have typical year.
# in some honey-badger script

dayspermonth = [31.0, 28.0, 31.0, 30.0, 31.0, 30.0, 31.0, 31.0, 30.0, 31.0, 30.0, 31.0]

hour_per_day = 24
start_hour = int(hour_per_day * sum(dayspermonth[0:month])) 
end_hour = int(hour_per_day * sum(dayspermonth[0:month+1]))

cumulative_data = sum(x[start_hour:end_hour])
hours_per_month = (dayspermonth[month] * hour_per_day)

a = cumulative_data / hours_per_month
# ---------- end python ----------
python_2 = GhPythonScript(x=ghi, month=[0, 1, 2, 3, 4, 5, 6, 7, 8, 9, 10, 11])  # -> out, a; inputs x: list, month: Int32
# ---------- python_2: Python ----------
__author__ = "chwaibel"
__version__ = "2020.02.25"

import rhinoscriptsyntax as rs

# 8760 time series
# get monthly average...
# how to know how many days a month? somewhere, I have typical year.
# in some honey-badger script

dayspermonth = [31.0, 28.0, 31.0, 30.0, 31.0, 30.0, 31.0, 31.0, 30.0, 31.0, 30.0, 31.0]

hour_per_day = 24
start_hour = int(hour_per_day * sum(dayspermonth[0:month])) 
end_hour = int(hour_per_day * sum(dayspermonth[0:month+1]))

cumulative_data = sum(x[start_hour:end_hour])

a = cumulative_data / 1000
# ---------- end python_2 ----------

# ---- group: CompECD_L07_Sensitivity_Energy (1) / Fensterfläche in m^2
number_slider_6 = Slider(11.4, range=1..200)
panel_10 = Panel(window_a)

# ---- group: Hive_FullTemplate
# HIVE
building_volume = Geometry(brep)
mesh_uv = MeshSurface(Surface=srf_2, UCount="4", VCount="4", Overhang=True, Equalize=False)
debrep = DeconstructBrep(Brep=building_volume)  # -> Faces, Edges, Vertices
item = ListItem(List=debrep.Faces, Index=4, Wrap=True)
run_hive = BooleanToggle(True)
hiveresultstype = HiveResultsType({"Cost - Lifetime Embodied": TotalCostEmbodied, "Cost - Lifetime Embodied Construction": TotalCostEmbodiedConstruction, "Cost - Lifetime Embodied Systems": TotalCostEmbodiedSystems, "Cost - Lifetime Operational": TotalCostOperational, "Cost - Lifetime Operational Construction": TotalCostOperationalConstruction, "Cost - Lifetime Operational Systems": TotalCostOperationalSystems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}, selected="Cost - Lifetime Embodied Systems")

# ----
area = Area(Geometry=item)  # -> Area, Centroid

# ---- group: Hive_FullTemplate / Hive model description
hiveinputenergysystems = InputEnergySystemsHive(
    MeshSolarTechnologyProperties=mesh_uv,
    conversions="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",
    emitters="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",
    meshConnections="""{
  "$type": "System.Collections.Generic.Dictionary`2[[System.Int32, mscorlib],[System.Int32, mscorlib]], mscorlib"
}""",
    meshes="""{
  "$type": "Hive.IO.Forms.SurfaceViewModel[], Hive.IO",
  "$values": [
    {
      "$type": "Hive.IO.Forms.SurfaceViewModel, Hive.IO",
      "Name": "srf0",
      "Area": 41.190415189675221
    }
  ]
}""")  # -> flatten(HiveEnergySystems)
hiveinputenvironment = InputEnvironmentHive(EpwPath=epw_filepath, ObstacleGeometries=mesh_2)
hiveinputbuilding = InputBuildingHive(ZoneGeometry=building_volume, WindowsSurfaces=srf, SiaRoom="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")

# ----
panel_11 = Panel(area.Area)

# ---- group: CompECD_L07_Sensitivity_Energy (1) / Klimatisierte Grundfläche in m^2
number_slider_7 = Slider(20, range=20..500)

# ---- group: CompECD_L07_Sensitivity_Energy (1) / Opake Hüllfläche in m2
number_slider_8 = Slider(26.6, range=20..800)

# ----
# ROOF
material_groups = ValueList({"01: Concrete", "02: Brick", "03: Other massive building materials", "04: Mortar and plaster", "05: Windows, solar shading and facade cladding", "06: Metal building materials", "07: Wood and wooden materials", "08: Adhesives and joint sealants", "09: Geomembranes and protective films", "10: Thermal insulation", "11: Flooring", "12: Doors", "13: Pipes", "14: Paints, coatings", "15: Plastics", "21: Kitchen fixtures and furniture", "00: Preparatory works"}, selected="01: Concrete")
material_groups_2 = ValueList({"01: Concrete", "02: Brick", "03: Other massive building materials", "04: Mortar and plaster", "05: Windows, solar shading and facade cladding", "06: Metal building materials", "07: Wood and wooden materials", "08: Adhesives and joint sealants", "09: Geomembranes and protective films", "10: Thermal insulation", "11: Flooring", "12: Doors", "13: Pipes", "14: Paints, coatings", "15: Plastics", "21: Kitchen fixtures and furniture", "00: Preparatory works"}, selected="10: Thermal insulation")
material_groups_3 = ValueList({"01: Concrete", "02: Brick", "03: Other massive building materials", "04: Mortar and plaster", "05: Windows, solar shading and facade cladding", "06: Metal building materials", "07: Wood and wooden materials", "08: Adhesives and joint sealants", "09: Geomembranes and protective films", "10: Thermal insulation", "11: Flooring", "12: Doors", "13: Pipes", "14: Paints, coatings", "15: Plastics", "21: Kitchen fixtures and furniture", "00: Preparatory works"}, selected="04: Mortar and plaster")
material_groups_4 = _1MaterialGroups(ActivateButton=Button(), MaterialGroups=material_groups)
x = Object(material_groups_4)
material = _2Material(SelectedMaterial=x)  # -> MaterialPropertiesText, MaterialPropertiesValues
layer_impact = _1LayerImpact(MaterialProperties=material.MaterialPropertiesValues, ThicknessMeters=Slider(0.2, range=0..1))  # -> LayerPropertiesText, LayerPropertiesValues
material_groups_5 = _1MaterialGroups(ActivateButton=Button(), MaterialGroups=material_groups_2)
x_2 = Object(material_groups_5)
material_2 = _2Material(SelectedMaterial=x_2)  # -> MaterialPropertiesText, MaterialPropertiesValues
layer_impact_2 = _1LayerImpact(MaterialProperties=material_2.MaterialPropertiesValues, ThicknessMeters=Slider(0.2, range=0..1))  # -> LayerPropertiesText, LayerPropertiesValues
material_groups_6 = _1MaterialGroups(ActivateButton=Button(), MaterialGroups=material_groups_3)
x_3 = Object(material_groups_6)
material_3 = _2Material(SelectedMaterial=x_3)  # -> MaterialPropertiesText, MaterialPropertiesValues
layer_impact_3 = _1LayerImpact(MaterialProperties=material_3.MaterialPropertiesValues, ThicknessMeters=Slider(0.02, range=0..1))  # -> LayerPropertiesText, LayerPropertiesValues
thermal_resistivity = ValueList({"External wall", "Internal wall", "Floor", "Ceiling", "Roof", "Other"}, selected="Roof")

# ----
# WALL
material_groups_7 = ValueList({"01: Concrete", "02: Brick", "03: Other massive building materials", "04: Mortar and plaster", "05: Windows, solar shading and facade cladding", "06: Metal building materials", "07: Wood and wooden materials", "08: Adhesives and joint sealants", "09: Geomembranes and protective films", "10: Thermal insulation", "11: Flooring", "12: Doors", "13: Pipes", "14: Paints, coatings", "15: Plastics", "21: Kitchen fixtures and furniture", "00: Preparatory works"}, selected="01: Concrete")
material_groups_8 = ValueList({"01: Concrete", "02: Brick", "03: Other massive building materials", "04: Mortar and plaster", "05: Windows, solar shading and facade cladding", "06: Metal building materials", "07: Wood and wooden materials", "08: Adhesives and joint sealants", "09: Geomembranes and protective films", "10: Thermal insulation", "11: Flooring", "12: Doors", "13: Pipes", "14: Paints, coatings", "15: Plastics", "21: Kitchen fixtures and furniture", "00: Preparatory works"}, selected="10: Thermal insulation")
material_groups_9 = ValueList({"01: Concrete", "02: Brick", "03: Other massive building materials", "04: Mortar and plaster", "05: Windows, solar shading and facade cladding", "06: Metal building materials", "07: Wood and wooden materials", "08: Adhesives and joint sealants", "09: Geomembranes and protective films", "10: Thermal insulation", "11: Flooring", "12: Doors", "13: Pipes", "14: Paints, coatings", "15: Plastics", "21: Kitchen fixtures and furniture", "00: Preparatory works"}, selected="04: Mortar and plaster")
material_groups_10 = _1MaterialGroups(ActivateButton=Button(), MaterialGroups=material_groups_7)
x_4 = Object(material_groups_10)
material_4 = _2Material(SelectedMaterial=x_4)  # -> MaterialPropertiesText, MaterialPropertiesValues
layer_impact_4 = _1LayerImpact(MaterialProperties=material_4.MaterialPropertiesValues, ThicknessMeters=Slider(0.2, range=0..1))  # -> LayerPropertiesText, LayerPropertiesValues
material_groups_11 = _1MaterialGroups(ActivateButton=Button(), MaterialGroups=material_groups_8)
x_5 = Object(material_groups_11)
material_5 = _2Material(SelectedMaterial=x_5)  # -> MaterialPropertiesText, MaterialPropertiesValues
layer_impact_5 = _1LayerImpact(MaterialProperties=material_5.MaterialPropertiesValues, ThicknessMeters=Slider(0.2, range=0..1))  # -> LayerPropertiesText, LayerPropertiesValues
material_groups_12 = _1MaterialGroups(ActivateButton=Button(), MaterialGroups=material_groups_9)
material_6 = _2Material(SelectedMaterial=x_3)  # -> MaterialPropertiesText, MaterialPropertiesValues
layer_impact_6 = _1LayerImpact(MaterialProperties=material_6.MaterialPropertiesValues, ThicknessMeters=Slider(0.02, range=0..1))  # -> LayerPropertiesText, LayerPropertiesValues
thermal_resistivity_2 = ValueList({"External wall", "Internal wall", "Floor", "Ceiling", "Roof", "Other"}, selected="External wall")

# ----
# BOMBYX
item_selector = ItemSelector(material_groups_12)
number_slider_9 = Slider(60, range=0..100)
type = ValueList({"Mechanical excavations, average", "Mechanical excavations, with PF", "Mechanical excavations, without PF", "Cargo cargo, inland navigation", "Air transportation, average", "Air transport , Europe", "Air transport, intercontinental", "Freight train", "Helicopter", "Deep-sea ship", "Deep-sea oil tanker", "Transport vehicle, up to 3.5 t": "Transport vehicle, up to 3.5 t ", "Trucks, average", "Truck 3,5-7,5 t", "Truck 7.5-16 t", "Truck 16-32 t", "Truck 32-40 t"}, selected="Freight train")
type_2 = ValueList({"Bus", "Swiss long-distance train", "Long-distance train Germany, ICE", "Passenger aircraft, medium", "Passenger aircraft, Europe", "Passenger aircraft, intercontinental", "Car, average", "Car, petrol", "Car, biogas", "Car, gasoil", "Car, electrical", "Car, natural gas", "Regional train", "Autocar", "Scooter, petrol", "Tram", "Trolleybus"}, selected="Car, average")
transport_people = TransportPeople(
    NoOfPeople=Slider(20, range=0..100),
    AvgDistanceKm=Slider(50, range=0..100),
    TransportType=type_2,
    NoOfTrips=Slider(10, range=0..10))  # -> TransportText, TransportValues
transport_material = TransportMaterial(
    DistanceKm=Slider(100, range=0..100),
    MassT=Slider(100, range=0..100),
    TransportType=type,
    TruckPercentage=Slider(20, range=0..100))  # -> TransportText, TransportValues
window_glazing = ValueList({"05.001:Double glazing, Ug-value 1.1 W / m2K, thickness 24 mm", "05.009:Double glazing, Ug 1.1 W / m2K, thickness 18 mm", "05.010:Double glazing, ESG, Ug 1.1 W / m2K", "05.002:Double glazing, laminated safety glass, Ug value 1.1 W / m2K", "05.011:Double glazing, ESG / VSG, Ug value 1.1 W / m2K", "05.003:Insulating glazing 3-fold, Ug-value 0.5 W / m2K, thickness 36 mm", "05.012:Insulating glazing triple, Ug value 0.6 W / m2K, thickness 40 mm", "05.013:Insulating glazing triple, tempered safety glass, Ug value 0.6 W / m2K", "05.014:Insulating glazing 3-fold, ESG / ESG / ESG, Ug value 0.6 W / m2K", "05.015:Insulating glazing triple, VSG, Ug value 0.6 W / m2K", "05.016:Insulating glazing triple, TSG / VSG, Ug value 0.6 W / m2K"}, selected="05.001:Double glazing, Ug-value 1.1 W / m2K, thickness 24 mm")
window_frame = ValueList({"05.004:Aluminum window frame", "05.004.01:Aluminum window frame, WICLINE 75evo", "05.005:Window frame wood", "05.006:Window frame wood-aluminum", "05.007:Window frame plastic / PVC"}, selected="05.005:Window frame wood")
window_impact = _4WindowImpact(
    ActivateButton=Button(),
    FrameMaterial=window_frame,
    GlazingMaterial=window_glazing,
    FramePercentage=Slider(0, range=0..100),
    ReferenceStudyPeriod=number_slider_9,
    ReferenceServiceLife=Slider(30, range=0..100),
    SurfaceAreaM²=area_take_off.fenster_2)  # -> LCAFactorsText, LCAFactorsValues, UValueWM2K, LCAFrameText, LCAFillingText
window_u_value = Data(window_impact.UValueWM2K)
number_slider_10 = Slider(0.8, range=0..1)
transparent = GhPythonScript(
    Uvalue=window_u_value,
    Area=area_take_off.fenster_2,
    g_value=number_slider_10,
    Glazing_percentage=Slider(1, range=0..1),
    Horizontwinkel=Slider(37, range=0..70),
    Überhangwinkel=Slider(2, range=0..10),
    Seitenblende_winkel1=Slider(9, range=0..10),
    Seitenblende_winkel2=Slider(0, range=0..10),
    Orientation="W")  # -> flatten(Glazed_elements1); inputs Horizontwinkel: Int32, Überhangwinkel: Int32, Seitenblende_winkel1: Int32, Seitenblende_winkel2: Int32
# ---------- transparent: Python ----------
"""Transparent elements
    Input:
       U-value: Insert the U-value for the wall
       Area: Insert the area
       g_value: Insert the g-value
       Glazing_percentage: Proportion of glazing in the surface
       Orientation: Orientation
"""

__author__ = "gaalina"
__version__ = "2019.02.07"

import rhinoscriptsyntax as rs






transparent = []

def output():
    transparent.append(Uvalue*Area)
    transparent.append(Orientation)
    transparent.append(Horizontwinkel)
    transparent.append(Überhangwinkel)
    transparent.append(Seitenblende_winkel1)
    transparent.append(Seitenblende_winkel2)
    transparent.append(Area*g_value*Glazing_percentage)

output()

Glazed_elements1=transparent

    
#tmp = Uvalue*Area*g_value*Glazing_percentage
#tmp = 5
#orient = Orientation

#Glazed_elements1 = (tmp, orient)
#Glazed_elements1 = (555, 777)

#Glazed_elements1.append(float(tmp))
#Glazed_elements1.append(orient)

#Glazed_elements1.append(11)
#Glazed_elements1.append(22)
# ---------- end transparent ----------
u_value_area = Multiplication(A=area_take_off.fenster_2, B=window_impact.UValueWM2K)
addition = Addition(A=area_take_off.exterior_walls_above_ground_2, B=area_take_off.boden_2, C=area_take_off.steildach_2)
energy_selection = ValueList({"41.001: Fuel oil EL", "41.002: Natural gas", "41.003: Propane/butane", "41.004: Coal coke", "41.005: Coal brick", "41.006: Chunks of wood", "41.01: Wood logs with particle filter", "41.007: Wood particles", "41.011: Wood particles with particle filter", "41.008: Pellets"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}, selected="41.001: Fuel oil EL")

component_impact = _2ComponentImpact(
    LayerProperties=layer_impact.LayerPropertiesValues,
    ReferenceStudyPeriod=number_slider_9,
    ReferenceServiceLife=Slider(30, range=0..100))  # -> ComponentPropertiesText, ComponentPropertiesValues
component_impact_2 = _2ComponentImpact(
    LayerProperties=layer_impact_2.LayerPropertiesValues,
    ReferenceStudyPeriod=number_slider_9,
    ReferenceServiceLife=Slider(30, range=0..100))  # -> ComponentPropertiesText, ComponentPropertiesValues
component_impact_3 = _2ComponentImpact(
    LayerProperties=layer_impact_3.LayerPropertiesValues,
    ReferenceStudyPeriod=number_slider_9,
    ReferenceServiceLife=Slider(30, range=0..100))  # -> ComponentPropertiesText, ComponentPropertiesValues
merge = Merge(
    Data1=component_impact.ComponentPropertiesValues,
    Data2=component_impact_2.ComponentPropertiesValues,
    Data3=component_impact_3.ComponentPropertiesValues)
element_impact = _3ElementImpact(
    ComponentProperties=merge,
    ThermalResistivity=thermal_resistivity,
    SurfaceAreaSquareMeters=area_take_off.exterior_walls_above_ground_2)  # -> LCAFactorsText, LCAFactorsValues, UValueWM2K, UAValueWK

component_impact_4 = _2ComponentImpact(
    LayerProperties=layer_impact_4.LayerPropertiesValues,
    ReferenceStudyPeriod=number_slider_9,
    ReferenceServiceLife=Slider(30, range=0..100))  # -> ComponentPropertiesText, ComponentPropertiesValues
component_impact_5 = _2ComponentImpact(
    LayerProperties=layer_impact_5.LayerPropertiesValues,
    ReferenceStudyPeriod=number_slider_9,
    ReferenceServiceLife=Slider(30, range=0..100))  # -> ComponentPropertiesText, ComponentPropertiesValues
component_impact_6 = _2ComponentImpact(
    LayerProperties=layer_impact_6.LayerPropertiesValues,
    ReferenceStudyPeriod=number_slider_9,
    ReferenceServiceLife=Slider(30, range=0..100))  # -> ComponentPropertiesText, ComponentPropertiesValues
merge_2 = Merge(
    Data1=component_impact_4.ComponentPropertiesValues,
    Data2=component_impact_5.ComponentPropertiesValues,
    Data3=component_impact_6.ComponentPropertiesValues)
element_impact_2 = _3ElementImpact(
    ComponentProperties=merge_2,
    ThermalResistivity=thermal_resistivity_2,
    SurfaceAreaSquareMeters=area_take_off.exterior_walls_above_ground_2)  # -> LCAFactorsText, LCAFactorsValues, UValueWM2K, UAValueWK

# ---- group: CompECD_L07_Sensitivity_Energy (1) (continued)
opaque_a = Data(addition)
window_u = Data(window_u_value)
window_g = Data(number_slider_10)

# ---- group: CompECD_L07_Sensitivity_Energy (1) / Opake Hüllfläche in m2 (continued)
panel_12 = Panel(opaque_a)

# ---- group: CompECD_L07_Sensitivity_Energy (1) / U-Wert Fenster in W/m^2K
number_slider_11 = Slider(1.529, range=0.1..4)
panel_13 = Panel(window_u)

# ---- group: CompECD_L07_Sensitivity_Energy (1) / g-Wert der Verglasung
number_slider_12 = Slider(0.594, range=0.05..0.95)
panel_14 = Panel(window_g)

# ----
# FLOOR
material_groups_13 = ValueList({"01: Concrete", "02: Brick", "03: Other massive building materials", "04: Mortar and plaster", "05: Windows, solar shading and facade cladding", "06: Metal building materials", "07: Wood and wooden materials", "08: Adhesives and joint sealants", "09: Geomembranes and protective films", "10: Thermal insulation", "11: Flooring", "12: Doors", "13: Pipes", "14: Paints, coatings", "15: Plastics", "21: Kitchen fixtures and furniture", "00: Preparatory works"}, selected="01: Concrete")
material_groups_14 = ValueList({"01: Concrete", "02: Brick", "03: Other massive building materials", "04: Mortar and plaster", "05: Windows, solar shading and facade cladding", "06: Metal building materials", "07: Wood and wooden materials", "08: Adhesives and joint sealants", "09: Geomembranes and protective films", "10: Thermal insulation", "11: Flooring", "12: Doors", "13: Pipes", "14: Paints, coatings", "15: Plastics", "21: Kitchen fixtures and furniture", "00: Preparatory works"}, selected="10: Thermal insulation")
material_groups_15 = ValueList({"01: Concrete", "02: Brick", "03: Other massive building materials", "04: Mortar and plaster", "05: Windows, solar shading and facade cladding", "06: Metal building materials", "07: Wood and wooden materials", "08: Adhesives and joint sealants", "09: Geomembranes and protective films", "10: Thermal insulation", "11: Flooring", "12: Doors", "13: Pipes", "14: Paints, coatings", "15: Plastics", "21: Kitchen fixtures and furniture", "00: Preparatory works"}, selected="04: Mortar and plaster")
material_groups_16 = _1MaterialGroups(ActivateButton=Button(), MaterialGroups=material_groups_13)
x_6 = Object(material_groups_16)
material_7 = _2Material(SelectedMaterial=x_6)  # -> MaterialPropertiesText, MaterialPropertiesValues
layer_impact_7 = _1LayerImpact(MaterialProperties=material_7.MaterialPropertiesValues, ThicknessMeters=Slider(0.2, range=0..1))  # -> LayerPropertiesText, LayerPropertiesValues
material_groups_17 = _1MaterialGroups(ActivateButton=Button(), MaterialGroups=material_groups_14)
x_7 = Object(material_groups_17)
material_8 = _2Material(SelectedMaterial=x_7)  # -> MaterialPropertiesText, MaterialPropertiesValues
layer_impact_8 = _1LayerImpact(MaterialProperties=material_8.MaterialPropertiesValues, ThicknessMeters=Slider(0.2, range=0..1))  # -> LayerPropertiesText, LayerPropertiesValues
material_groups_18 = _1MaterialGroups(ActivateButton=Button(), MaterialGroups=material_groups_15)
component_impact_7 = _2ComponentImpact(
    LayerProperties=layer_impact_7.LayerPropertiesValues,
    ReferenceStudyPeriod=number_slider_9,
    ReferenceServiceLife=Slider(30, range=0..100))  # -> ComponentPropertiesText, ComponentPropertiesValues
component_impact_8 = _2ComponentImpact(
    LayerProperties=layer_impact_8.LayerPropertiesValues,
    ReferenceStudyPeriod=number_slider_9,
    ReferenceServiceLife=Slider(30, range=0..100))  # -> ComponentPropertiesText, ComponentPropertiesValues
thermal_resistivity_3 = ValueList({"External wall", "Internal wall", "Floor", "Ceiling", "Roof", "Other"}, selected="Floor")

item_selector_2 = ItemSelector(material_groups_18)
wall_u_value = Data(element_impact_2.UValueWM2K)
wall_ua = Data(element_impact_2.UAValueWK)
roof_u_value = Data(element_impact.UValueWM2K)
roof_ua = Data(element_impact.UAValueWK)

material_9 = _2Material(SelectedMaterial=item_selector_2)  # -> MaterialPropertiesText, MaterialPropertiesValues
layer_impact_9 = _1LayerImpact(MaterialProperties=material_9.MaterialPropertiesValues, ThicknessMeters=Slider(0.02, range=0..1))  # -> LayerPropertiesText, LayerPropertiesValues
component_impact_9 = _2ComponentImpact(
    LayerProperties=layer_impact_9.LayerPropertiesValues,
    ReferenceStudyPeriod=number_slider_9,
    ReferenceServiceLife=Slider(30, range=0..100))  # -> ComponentPropertiesText, ComponentPropertiesValues
merge_3 = Merge(
    Data1=component_impact_7.ComponentPropertiesValues,
    Data2=component_impact_8.ComponentPropertiesValues,
    Data3=component_impact_9.ComponentPropertiesValues)
element_impact_3 = _3ElementImpact(
    ComponentProperties=merge_3,
    ThermalResistivity=thermal_resistivity_3,
    SurfaceAreaSquareMeters=area_take_off.exterior_walls_above_ground_2)  # -> LCAFactorsText, LCAFactorsValues, UValueWM2K, UAValueWK

# ---- group: LCA Params
merge_4 = Merge(Data1=element_impact.LCAFactorsValues, Data2=element_impact_2.LCAFactorsValues, Data3=element_impact_3.LCAFactorsValues)

# ---- group: CompECD_L07_Sensitivity_Energy (1) (continued)
wall_u = Data(wall_u_value)

# ---- group: CompECD_L07_Sensitivity_Energy (1) / U-Wert opake Flächen in W/m^2K
number_slider_13 = Slider(0.877, range=0.05..2)
panel_15 = Panel(wall_u)

# ---- group: CompECD_L07_Sensitivity_Energy (1)
# Transmissions-Wärmetransferkoeffizient
# H_T = A_op * U_op + A_w * U_w
# [H_T] = W/K
# [A_op] = m^2
# [A_w] = m^2
# [U_op] = W/(m^2K)
# [U_w] = W/(m^2K)
python_3 = GhPythonScript(A_op=panel_12, U_op=panel_15, A_w=panel_10, U_w=panel_13)  # -> H_T
# ---------- python_3: Python ----------
"""Transmissions-Wärmetransferkoeffizient in W/K.
    Inputs:
        A_op:   Aussenwandfläche (opak) in m^2
        U_op:   Wärmedurchgangskoeffizient Aussenwand (opak) in W/m^2K
        A_w:    Aussenwandläche (transparent) in m^2
        U_w:    Wärmedurchgangskoeffizient Aussenwand (transparent) in W/m^2K
    Output:
        H_T:    Transmissions-Wärmetransferkoeffizient in W/K"""

__author__ = "A/S ETH"
__version__ = "2020.04.18"

import rhinoscriptsyntax as rs

H_T = A_op * U_op + A_w * U_w
# ---------- end python_3 ----------
panel_16 = Panel(python_3)

# ---- group: Make Hive zone area equal to Bombyx
bombyx_zone_area_2 = Panel(area_take_off.boden_2)

# ---- group: Hive_FullTemplate (continued)
hivedistributor = MainDistributorHive(HiveInputs=flatten([hiveinputenvironment, hiveinputbuilding, hiveinputenergysystems, run_hive]))  # -> HiveBuilding, HiveEnvironment, HiveEnergySystemsSurfaceBasedTech, HiveEnergySystemsConversionTech, HiveEnergySystemsEmitter

# Distributor
hivedistsolarsimu = DistributorSolarSimulationHive(
    HiveBuilding=hivedistributor.HiveBuilding,
    HiveSolarTechnologies=hivedistributor.HiveEnergySystemsSurfaceBasedTech,
    HiveEnvironment=hivedistributor.HiveEnvironment)  # -> EnvironmentMesh, BuildingCentroid, ExternalSurfaces, WindowGeometries, WindowTilt, WindowAzimuth, WindowAreas, SolarTechMesh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
hivedistconversiontech = DistributorConversionTechHive(ConversionTechnologies=hivedistributor.HiveEnergySystemsConversionTech)  # -> AirSourceHeatPump, Chiller, Boiler, CombinedHeatAndPower, HeatExchanger, ColdExchanger, DirectElectricity
hivedistemitter = DistributorEmitterHive(Emitters=hivedistributor.HiveEnergySystemsEmitter)  # -> HourlyHtgSupTemp, HourlyHtgRetTemp, HourlyClgSupTemp, HourlyClgRetTemp
hivedistenvironment = DistributorEnvironmentHive(HiveEnvironment=hivedistributor.HiveEnvironment)  # -> EPW, NaturalGas, BioGas, WoodPellets, DistrictHeating, DistrictCooling, GridElectricity, AmbientAirTemp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
hivedistsiaroom = DistributorSIARoomHive(HiveBuilding=hivedistributor.HiveBuilding)  # -> ZoneAreas, WindowsAreas, ExternalSurfacesAreas, SIA2024Room, AllExternalSurfaceAreas, SurfaceType, SUA2024Schedules, UseAdaptiveComfort, UseNaturalVentilation, UseFixedTimeConstant
bool = Boolean(toggle_4)
python_4 = GhPythonScript(x=hivedistsolarsimu.WindowGeometries, y=bool)  # -> out, a
# ---------- python_4: Python ----------
__author__ = "chwaibel"
__version__ = "2020.09.09"

import rhinoscriptsyntax as rs

if y:
    a = x
# ---------- end python_4 ----------
python_5 = GhPythonScript(x=hivedistsolarsimu.SolarTechMesh, y=toggle_4)  # -> out, a; same code as python_4
hivedistepw = DistributorEPW(EPW=hivedistenvironment.EPW, WriteGHNumbers=Toggle(True))  # -> EPW, Latitude, Longitude, CityCountry, GHI, DNI, DHI, DryBulb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
sia2024reader = SIA2024RoomReader(RoomJson=hivedistsiaroom.SIA2024Room, RoomArea=hivedistsiaroom.ZoneAreas, Month=1)  # -> TimeConstant, TemperatureSetpoint, CalculationPeriod, OpaqueEnvelopeArea, WindowArea, U_op_W_m_2K, UValueWindow, VolumetricAirFlowRate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
adaptivecomfort = AdaptiveComfort(AirTemperature=hivedistepw.DryBulb)  # -> ThermalComfort, Comfort80UpperBound, Comfort80LowerBound, Comfort90UpperBound, Comfort90LowerBound

# ---- group: Make Hive zone area equal to Bombyx (continued)
hive_zone_area = Panel(hivedistsiaroom.ZoneAreas)

# ---- group: Hive_FullTemplate / Upper temperature setpoint (°C)
panel_17 = Panel(adaptivecomfort.Comfort80UpperBound)

# ---- group: Hive_FullTemplate / Lower temperature setpoint (°C)
panel_18 = Panel(adaptivecomfort.Comfort80LowerBound)

# ---- group: Hive_FullTemplate / Monthly average dry bulb temperature (°C)
panel_19 = Panel(hivedistepw.DryBulbMonthly)

# ---- group: Hive_FullTemplate / checking windows order
item_2 = ListItem(List=hivedistsolarsimu.WindowGeometries, Index=Slider(0, range=0..5), Wrap=True)
offset = OffsetSurface(Surface=item_2, Distance=0.5, Retrim=True)
preview = CustomPreview(Geometry=offset, Shader=ColourSwatch(SwatchColor=RGB(74, 207, 255)))

# ---- group: Hive_FullTemplate / DHI
data = Data(hivedistepw.DHI)

# ---- group: Hive_FullTemplate
# Shading Mask
dni = Data(hivedistepw.DNI)
panel_20 = Panel([hivedistepw.Longitude, hivedistepw.Latitude])
pt = Point(hivedistsolarsimu.BuildingCentroid)
skydome = GHSkydome(
    RecursionLevel=number_slider,
    Viewfactors=toggle,
    CumSkyMatrix=Toggle(False),
    SunPath=toggle_3,
    SolarVec=toggle_2,
    HOY=number_slider_3,
    Location=panel_20,
    DNI=dni,
    DHI=data,
    Size=number_slider_2,
    Context=hivedistsolarsimu.EnvironmentMesh,
    Sp=pt,
    Timezone=hivedistepw.Timezone)  # -> Mesh, Vectors, Sunpaths, SunGeo
preview_2 = CustomPreview(Geometry=skydome.Sunpaths, Shader=ColourSwatch(SwatchColor=RGB(0, 0, 0)))
mesh_4 = Mesh(skydome.Mesh)

# SOLAR SIMULATION
num = Number(number_slider_5)
num_2 = Number(number_slider_4)
mesh_5 = Mesh(hivedistsolarsimu.ExternalSurfaces)
data_2 = Data([0.8, 0.8, 0.8, 0.8, 0.8, 0.8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])
obstobj = ObstacleObject(
    Mesh=[hivedistsolarsimu.EnvironmentMesh, mesh_5],
    Albedo=data_2,
    SpecCoeff=data_2,
    ReflType=0,
    Tolerance=0.01,
    Name="PV",
    MT=True)

# Solare Wärmeeinträge (shaded)
mesh_uv_2 = MeshSurface(Surface=python_4.a, UCount=panel, VCount=panel_2, Overhang=True, Equalize=False)  # -> flatten(Mesh)
mesh_6 = Mesh(mesh_uv_2)
obstobj_2 = ObstacleObject(Mesh=mesh_6, Albedo=data_2, SpecCoeff=data_2, ReflType=0, Tolerance=0.01, Name="PV", MT=True)
irrmshy = IrradiationMeshYear(
    AnalysisObjects=obstobj_2,
    ObstacleObjects=obstobj,
    Latitude=hivedistepw.Latitude,
    Longitude=hivedistepw.Longitude,
    Year=2017,
    DNI=hivedistepw.DNI,
    DHI=hivedistepw.DHI,
    MainSkyRes=1,
    SpecBounces=0,
    DiffIReflSkyRes=0,
    DiffIReflMode=2,
    MT=True,
    Timezone=hivedistepw.Timezone)
readresults = ReadResults(Mesh=mesh_6, I=irrmshy, Value=7)  # -> Results, SP
visumshsol = VisualizeMeshSolar(Mesh=mesh_6, I=irrmshy, Value=0, Min=num_2, Max=num, Clr=0)

# ---- group: Hive_FullTemplate / Windows
mesh_7 = Mesh(visumshsol)

# ---- group: Hive_FullTemplate
# Solare Wärmeeinträge (unshaded)
solarpotentialsunobstructed = SolarPotentialsUnobstructedCSharp(
    Tilt=hivedistsolarsimu.WindowTilt,
    Azimuth=hivedistsolarsimu.WindowAzimuth,
    DHI=hivedistepw.DHI,
    DNI=hivedistepw.DNI,
    Latitude=hivedistepw.Latitude,
    Longitude=hivedistepw.Longitude,
    Aw=hivedistsolarsimu.WindowAreas,
    Timezone=hivedistepw.Timezone)

# DEMAND
toggle_8 = BooleanToggle(False)
sia380 = BuildingDemandSIA380(
    RoomProperties=hivedistsiaroom.SIA2024Room,
    RoomSchedules=hivedistsiaroom.SUA2024Schedules,
    FloorArea=hivedistsiaroom.ZoneAreas,
    AirTemperature=hivedistepw.DryBulb,
    SetpointsUpperBounds=adaptivecomfort.Comfort80UpperBound,
    SetpointsLowerBounds=adaptivecomfort.Comfort80LowerBound,
    EnvelopeSurfaceAreas=hivedistsiaroom.AllExternalSurfaceAreas,
    EnvelopeSurfaceTypes=hivedistsiaroom.SurfaceType,
    SurfaceIrradiation=readresults.Results,
    SurfaceIrradiationUnobstructed=solarpotentialsunobstructed,
    GValue=sia2024reader.GValue,
    GValueWithSunscreen=sia2024reader.GValueWithSunscreen,
    SetpointSunscreen=sia2024reader.ShadingSetpoint,
    RunObstructedSolarSimulation=bool,
    RunHourly=toggle_8,
    UseAdaptiveComfort=hivedistsiaroom.UseAdaptiveComfort,
    UseNaturalVentilation=hivedistsiaroom.UseNaturalVentilation,
    UseFixedTimeConstant=hivedistsiaroom.UseFixedTimeConstant)  # -> HeatingDemand, DomesticHotWaterDemand, CoolingDemand, ElectricityDemand, TransmissionHeatLosses, VentilationHeatLosses, InternalGains, SolarGains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
abs = Absolute(Value=sia380.CoolingDemand)

# PV Ertrag (simuliert)
obstobj_3 = ObstacleObject(Mesh=python_5.a, Albedo=data_2, SpecCoeff=data_2, ReflType=0, Tolerance=0.01, Name="PV", MT=True)
irrmshy_2 = IrradiationMeshYear(
    AnalysisObjects=obstobj_3,
    ObstacleObjects=obstobj,
    Latitude=hivedistepw.Latitude,
    Longitude=hivedistepw.Longitude,
    Year=2017,
    DNI=hivedistepw.DNI,
    DHI=hivedistepw.DHI,
    MainSkyRes=1,
    SpecBounces=0,
    DiffIReflSkyRes=0,
    DiffIReflMode=2,
    MT=True,
    Timezone=0)
readresults_2 = ReadResults(Mesh=python_5.a, I=irrmshy_2, Value=7)  # -> Results, SP
visumshsol_2 = VisualizeMeshSolar(Mesh=hivedistsolarsimu.SolarTechMesh, I=irrmshy_2, Value=0, Min=num_2, Max=num, Clr=0)

# ---- group: Hive_FullTemplate / PV Panels
mesh_8 = Mesh(visumshsol_2)

# ---- group: Hive_FullTemplate
# PV Ertrag (unverschattet)
# Q_s = G * F_F * A_w * g
# [Q_s] = kWh
# [G] = kWh/m^2
# [F_F] = -
# [A_w] = m^2
# [g] = -
solarpotentialsunobstructed_2 = SolarPotentialsUnobstructedCSharp(
    Tilt=hivedistsolarsimu.SolarTechTilt,
    Azimuth=hivedistsolarsimu.SolarTechAzimuth,
    DHI=hivedistepw.DHI,
    DNI=hivedistepw.DNI,
    Latitude=hivedistepw.Latitude,
    Longitude=hivedistepw.Longitude,
    Aw=1,
    Timezone=hivedistepw.Timezone)

# Conduit
# Solar Simulation Results Colorbar HUD
python_6 = GhPythonScript(toggle_pv=toggle_6, pv_data=readresults_2.Results, window_data=readresults.Results)  # -> out, plot_data, title_plot1, title_plot2; inputs toggle_pv: Boolean, pv_data: tree, window_data: tree
# ---------- python_6: Python ----------
__author__ = "Christoph"
__version__ = "2022.08.01"

import rhinoscriptsyntax as rs
if toggle_pv:
    plot_data = pv_data
    title_plot1 = "Total PV Irradiance (W)"
    title_plot2 = "PV Irradiance (W)"
else:
    plot_data = window_data
    title_plot1 = "Total Windows Irradiance (W)"
    title_plot2 = "Windows Irradiance (W)"
# ---------- end python_6 ----------
genes = GenePool(Decimals=2, Maximum=100, Minimum=0, Value=[66.69, 50, 58.91])
bounds = GetViewportBoundaryDimensions(Refresh=True, Origin=Point(0, 0, 0), Scale=0.25, xDim=918, yDim=809)
flatten = FlattenTree(Tree=python_6.plot_data, Path="{0}")
range = Range(Domain=number_slider_5, Steps=Slider(10, range=0..10))
nblur = BlurNumbers(Numbers=python_6.plot_data, Strength=0.5, Iterations=Slider(1000, range=0..1000), Lock=True, Wrap=False)
partition = PartitionList(List=flatten, Size=Slider(24, range=0..100))
round = Round(Number=range)  # -> Nearest, Floor, Ceiling
rev = ReverseList(List=round.Nearest)
item_3 = ListItem(List=rev, Index=0, Wrap=True)
vert_tiles = VerticalTiles(
    Boundary=bounds,
    RelativeSizes=genes,
    Width=Slider(0.33, range=0..1),
    WidthPadding=Slider(0.05, range=0..1),
    HeightPadding=Slider(0.2, range=0..1))
format = Format(Format="{0}+", Culture=127, Data0=item_3)
genes_2 = GenePool(Decimals=2, Maximum=100, Minimum=0, Value=[21.49, 50])
replace = ReplaceItems(List=rev, Item=format, Indices=Slider(0, range=0..100), Wrap=False)
item_4 = ListItem(List=vert_tiles, Index=0, Wrap=True)  # -> Item2, Item1, Item
flip = FlipMatrix(Data=nblur)
number_slider_14 = Slider(0, range=0..100)
horz_tiles = HorizontalTiles(
    Boundary=item_4.Item1,
    RelativeSizes=genes_2,
    Height=Slider(1, range=0..1),
    WidthPadding=Slider(0, range=0..1),
    HeightPadding=0.02)
ma = MassAddition(Input=flip)  # -> Result, PartialResults
number_slider_15 = Slider(1, range=0..1)
merge_5 = Merge(
    Data1=ColourSwatch(SwatchColor=RGB(255, 255, 0)),
    Data2=ColourSwatch(SwatchColor=RGB(255, 218, 0)),
    Data3=ColourSwatch(SwatchColor=RGB(255, 179, 0)),
    Data4=ColourSwatch(SwatchColor=RGB(255, 138, 0)),
    Data5=ColourSwatch(SwatchColor=RGB(255, 91, 0)),
    Data6=ColourSwatch(SwatchColor=RGB(255, 0, 0)),
    Data7=ColourSwatch(SwatchColor=RGB(204, 0, 51)),
    Data8=ColourSwatch(SwatchColor=RGB(153, 0, 102)),
    Data9=ColourSwatch(SwatchColor=RGB(102, 0, 153)),
    Data10=ColourSwatch(SwatchColor=RGB(51, 0, 204)),
    Data11=ColourSwatch(SwatchColor=RGB(0, 0, 255)))
item_5 = ListItem(List=horz_tiles, Index=0, Wrap=True)
panel_21 = Panel(python_6.title_plot1)
palette = ConduitColorPalette(Seed=3, HueRange=number_slider_14, SaturationRange=number_slider_14, LuminanceRange=number_slider_14, BaseColors=merge_5)
panel_22 = Panel(python_6.title_plot2)
repeat = RepeatData(Data=number_slider_15, Length=Slider(11, range=0..100))
font = ConduitFont(
    Font="Arial",
    TextHeight=12,
    AdaptiveHeight=True,
    TextSpacing=1.15,
    Alignment=0,
    Bold=False,
    Italic=False,
    Color=ColourSwatch(SwatchColor=RGB(255, 255, 255)))
chart = ConduitChart(Bounds=item_4.Item2, Values=ma.Result, Title=panel_21, ColorPalette=palette, Font=font)  # -> HUDDrawingObjects, ChartSettings
chart_2 = ConduitChart(Bounds=item_4.Item, Values=flip, Title=panel_22, Font=font)  # -> HUDDrawingObjects, ChartSettings
chart_3 = ConduitChart(
    Bounds=item_5,
    Values=repeat,
    Categories=replace,
    Title="Annual Irradiation (kWh/m^2)",
    Range=number_slider_15,
    ColorPalette=palette,
    Font=font)  # -> HUDDrawingObjects, ChartSettings
hud = HeadsUpDisplayHUD(
    ShowHUD=toggle_5,
    DrawingObjects=chart_3.HUDDrawingObjects,
    DrawingBoundary=bounds,
    ConduitStyleSheet="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")
hud_2 = HeadsUpDisplayHUD(
    ShowHUD=toggle_5,
    DrawingObjects=[chart.HUDDrawingObjects, chart_2.HUDDrawingObjects],
    DrawingBoundary=bounds,
    ConduitStyleSheet="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")

# Air Source Heat Pump
panel_23 = Panel("True")
hivemergerashp = MergerAirSourceHeatPumpHive(
    AirCarrier=hivedistenvironment.AmbientAirTemp,
    ElectricityCarrier=hivedistenvironment.GridElectricity,
    HeatingGenerated=sia380.HeatingDemand,
    SupplyTemperature=hivedistemitter.HourlyHtgSupTemp,
    SimpleMode=toggle_7,
    PessimisticCOP=panel_23,
    HiveAirSourceHeatPump=hivedistconversiontech.AirSourceHeatPump)

# Chiller
hivemergerchiller = MergerChillerHive(
    AirCarrier=hivedistenvironment.AmbientAirTemp,
    ElectricityCarrier=hivedistenvironment.GridElectricity,
    CoolingGenerated=abs,
    SupplyTemperature=hivedistemitter.HourlyClgSupTemp,
    SimpleMode=toggle_7,
    HiveChiller=hivedistconversiontech.Chiller)

# PV / ST
python_7 = GhPythonScript(x=irrmshy_2)  # -> out, a
# ---------- python_7: Python ----------
__author__ = "chwaibel"
__version__ = "2020.08.21"

import rhinoscriptsyntax as rs

a = x.I_hourly
# ---------- end python_7 ----------
hivemergersolartech = MergerSolarTechHive(
    I_hourlyM=python_7.a,
    SolarTechnologies=hivedistributor.HiveEnergySystemsSurfaceBasedTech,
    AirCarrier=hivedistenvironment.AmbientAirTemp,
    SupplyTemperature=hivedistemitter.HourlyHtgSupTemp,
    ReturnTemperature=hivedistemitter.HourlyHtgRetTemp,
    SimpleMode=toggle_7,
    I_hourly=solarpotentialsunobstructed_2)
python_8 = GhPythonScript(x=hivemergersolartech)  # -> out, a
# ---------- python_8: Python ----------
__author__ = "chwaibel"
__version__ = "2020.08.24"

import rhinoscriptsyntax as rs
a = x.OutputCarriers[0].EnergyMonthlyCumulative
# ---------- end python_8 ----------
panel_24 = Panel(hivemergersolartech)  # disabled
ma_2 = MassAddition(Input=python_8.a)  # -> Result, PartialResults; disabled
graph = QuickGraph(python_8.a, SortOrder=0)
panel_25 = Panel(ma_2.Result)  # disabled

# ---- group: Hive_FullTemplate / PV electricity generation (kWh/month)
panel_26 = Panel(python_8.a)

# ---- group: Hive_FullTemplate
# Plug-in any conversion tech
python_9 = GhPythonScript(x=hivemergerchiller)  # -> out, description, outEnergy; disabled
# ---------- python_9: Python ----------
__author__ = "chwaibel"
__version__ = "2020.08.18"

import rhinoscriptsyntax as rs

a = ("total investment cost: ", x.SpecificInvestmentCost * x.Capacity)
b = ("capacity: ", x.Capacity)
c = ("cap unit; ", x.CapacityUnit)
d = ("name: ", x.Name)
e = ("opCost CHF/a: ", sum(x.InputCarrier.TotalCost ))
f = ("tot Input Energy kWh/a: ", sum(x.InputCarrier.Energy))
g = ("Tot Output Energy kWh/a: ", sum(x.OutputCarriers[0].EnergyMonthlyCumulative))
h = ("Inp Car PEF: ", x.InputCarrier.PrimaryEnergyFactor)
description = [a, b, c, d, e, f, g, h]

# print(x.InputCarrier.EnergyMonthlyCumulative)
#print(x.OutputCarriers[0].Energy)
print(x.InputCarrier.PrimaryEnergyFactor)
print("Input type: ", type(x.InputCarrier))
print("Output type: ", type(x.OutputCarriers[0]))
outEnergy = x.OutputCarriers[0].EnergyMonthlyCumulative
print(x.IsCooling)
# ---------- end python_9 ----------
panel_27 = Panel(python_9.description)  # disabled

# Purchased Grid Electricity
# & final heating energy
hivemergeraddedelectricity = MergerAdditionalElectricityHive(
    ElectricityCarrier=hivedistenvironment.GridElectricity,
    DirectElectricity=hivedistconversiontech.DirectElectricity,
    Hourly=toggle_8,
    HiveChiller=hivemergerchiller,
    HiveAirSourceHeatPump=hivemergerashp,
    IdealLoadsElectricity=sia380.ElectricityDemand,
    SolarTechnologies=hivemergersolartech,
    IdealLoadsHeating=sia380.HeatingDemand)  # -> DirectElectricity, FinalHeatingDemand, FinalElectricityDemand

# Results
hiveresultscreator = ResultsCreatorHive(
    IdealCoolingLoads=abs,
    IdealSpaceHeatingLoads=hivemergeraddedelectricity.FinalHeatingDemand,
    IdealElectricityLoads=hivemergeraddedelectricity.FinalElectricityDemand,
    IdealDomesticHotWaterLoads=sia380.DomesticHotWaterDemand,
    HiveBuilding=hivedistributor.HiveBuilding,
    HiveConversionTech=flatten([hivemergerchiller, hivemergerashp, hivemergersolartech, hivemergeraddedelectricity.DirectElectricity]),
    Q_T_opaque=sia380.TransmissionHeatLossesOfOpaqueSurfaces,
    Q_T_transparent=sia380.TransmissionHeatLossesOfTransparentSurfaces,
    Q_V=sia380.VentilationHeatLosses,
    Q_i=sia380.InternalGains,
    Q_s=sia380.SolarGains,
    ConsumedElec=sia380.ElectricityDemand,
    ConsumedHeat=sia380.HeatingDemand,
    Q_s_per_win=sia380.SolarGainsPerTransparentSurface)

hiveresultsvisualizer = ResultsVisualizerHive(
    hiveresultscreator,
    PlotProperties="""{
  "$type": "System.Collections.Generic.Dictionary`2[[System.String, mscorlib],[System.String, mscorlib]], mscorlib"
}""")
hivedistresults = DistributorResultsHive(Results=hiveresultscreator, ResultType=hiveresultstype)
graph_2 = QuickGraph([panel_17, panel_18, panel_19], SortOrder=0)
hivedistresultsloads = DistributorResultsLoadsHive(Results=hiveresultscreator)  # -> HeatingLoads, CoolingLoads, ElectricityLoads, WindowSolarGains, GainsAndLosses

# ---- group: Hive_FullTemplate / Zone Gains and Losses
panel_28 = Panel(hivedistresultsloads.GainsAndLosses)

# ---- group: Hive_FullTemplate / Heating Loads
panel_29 = Panel(hivedistresultsloads.HeatingLoads)

# ----
hive_kwh = Panel(panel_29)

# ---- group: Hive_FullTemplate / Cooling Loads
panel_30 = Panel(hivedistresultsloads.CoolingLoads)

# ---- group: Hive_FullTemplate / custom outputs
panel_31 = Panel(hivedistresults)

# ---- group: Hive_FullTemplate / Windows Solar Gains
panel_32 = Panel(hivedistresultsloads.WindowSolarGains)

# ---- group: Hive_FullTemplate / Electricity Loads
panel_33 = Panel(hivedistresultsloads.ElectricityLoads)

# ---- group: Hive_FullTemplate / Hive Results
data_3 = Data(hiveresultscreator)

# ---- group: Hive_FullTemplate / internalise data to store results
hiveresults = HiveResultsParameter(data_3)

# ---- group: CompECD_L07_Sensitivity_Energy (1) (continued)
hive_zone_area_2 = Data(hivedistsiaroom.ZoneAreas)
dbt = Data(hivedistepw.DryBulbMonthly)
ghi_2 = Data(hivedistepw.GHIMonthly)

# ---- group: CompECD_L07_Sensitivity_Energy (1) / Klimatisierte Grundfläche in m^2 (continued)
panel_34 = Panel(hive_zone_area_2)

# ---- group: CompECD_L07_Sensitivity_Energy (1) / Durchschnittliche Aussenlufttemperatur pro Monat in °C
panel_35 = Panel(dbt)

# ---- group: CompECD_L07_Sensitivity_Energy (1) / Monatlich kumulative Globalstrahlung in kWh/m^2
panel_36 = Panel(ghi_2)

# ---- group: CompECD_L07_Sensitivity_Energy (1)
# Interne Wärmeeinträge
# Q_i = Phi_P * t_P + Phi_B * t_B + Phi_G * t_G
# [Q_i] = Wh
# [Phi_P,B,G] = W
# [t_P,B,G] = h
panel_37 = Panel("1.4")
multiplication = Multiplication(A="8", B=panel_34)
multiplication_2 = Multiplication(A=panel_37, B=panel_34)
multiplication_3 = Multiplication(A="2.7", B=panel_34)
python_10 = GhPythonScript(Phi_P=multiplication_2, t_P="420", Phi_B=multiplication_3, t_B="210", Phi_G=multiplication, t_G="183")  # -> Q_i
# ---------- python_10: Python ----------
"""Interne Wärmeeinträge in Wh.
    Inputs:
        Phi_P:      Wärmeagbage Personen in W
        t_P:        Vollaststunden Personen in h
        Phi_B:      Wärmeabgabe Beleuchtung in W
        t_B:        Vollaststunden Beleuchtung in h
        Phi_G:      Wärmeabgabe Geräte in W
        t_G:        Vollaststunden Geräte in h
    Output:
        Q_i:        Interne Wärmeeinträge in Wh"""

__author__ = "A/S ETH"
__version__ = "2020.04.18"

import rhinoscriptsyntax as rs

Q_i = Phi_P*t_P + Phi_B * t_B + Phi_G * t_G
# ---------- end python_10 ----------
panel_38 = Panel(python_10)

# Thermisch wirksamer Aussenluftvolumenstrom
# Vdot_th = Vdot_e * (1 - eta_rec) * Vdot_inf
# [Vdot_th] = m^3/h oder m^3/s
# [Vdot_e] = m^3/h oder m^3/s
# [Vdot_inf] = m^3/h oder m^3/s
# [eta_rec] = -
multiplication_4 = Multiplication(A=panel_34, B=panel_3)
multiplication_5 = Multiplication(A=panel_34, B=panel_4)
python_11 = GhPythonScript(Vdot_e=multiplication_4, Vdot_inf=multiplication_5, eta_rec=panel_5)  # -> Vdot_th
# ---------- python_11: Python ----------
"""Thermisch wirksamer Aussenluftvolumenstrom.
    Inputs:
        Vdot_e:         Aussenluft-Volumenstrom durch Lüftung in m^3/h
        Vdot_inf:       Aussenluft-Volumenstrom durch Infiltration in m^3/h
        eta_rec:        Nutzungsgrad der Wärmerückgewinnung
    Output:
        Vdot_th:        Thermisch wirksamer Aussenluft Volumenstrom in m^3/h"""

__author__ = "A/S ETH"
__version__ = "2020.04.18"

import rhinoscriptsyntax as rs
import math

if math.isnan(eta_rec):
    eta_rec = 0
Vdot_th = Vdot_e * (1-eta_rec) + Vdot_inf
# ---------- end python_11 ----------
panel_39 = Panel(python_11)

# Solare Wärmeeinträge
# Q_s = G * F_F * A_w * g * f_V
# [Q_s] = kWh
# [G] = kWh/m^2
# [F_F] = -
# [A_w] = m^2
# [g] = -
# [f_V] = -
python_12 = GhPythonScript(G=panel_36, F_F=panel_9, A_w=panel_10, g=panel_14, f_V=panel_8)  # -> Q_s
# ---------- python_12: Python ----------
"""Solare Wärmeeinträge.
    Inputs:
        G:      Globalstrahlung (abhängig vom Ort) in kWh/m^2
        F_F:    Faktor für Ausrichtung der Einstrahlungsebene
        A_w:    Aussenwandfläche (transparent) in m^2
        g:      g-Wert
    Output:
        Q_s:    Solare Wärmeeinträge in kWh"""

__author__ = "A/S ETH"
__version__ = "2020.04.18"

import rhinoscriptsyntax as rs

Q_s = G * F_F * A_w * g * f_V
# ---------- end python_12 ----------
panel_40 = Panel(python_12)

# Transmissionswärmeverluste
# Q_T = H_T * (T_i + T_e) * t
# [Q_T] = Wh
# [H_T] = W/K
# [T_i] = K oder °C
# [T_e] = K oder °C
# [t] = h
panel_41 = Panel("24*30")
python_13 = GhPythonScript(H_T=python_3, T_i=panel_7, T_e=panel_35, t=panel_41)  # -> Q_T
# ---------- python_13: Python ----------
"""Transmissionswärmeverluste in Wh.
    Inputs:
        H_T:    Transmissions-Wärmetransferkoeffizient in W/K
        T_i:    Raumlufttemperatur in °C oder K
        T_e:    Aussenlufttemperatur in °C oder K
        t:      Länger der Berechnungsperiode in h
    Output:
        Q_T:    Transmissionswärmeverluste in Wh"""

__author__ = "A/S ETH"
__version__ = "2020.04.18"

import rhinoscriptsyntax as rs

Q_T = H_T * (T_i - T_e) * t
# ---------- end python_13 ----------
panel_42 = Panel(python_13)

# Lüftungs-Wärmetransferkoeffizient
# H_V = Vdot_th * rho * c_p
# [H_V] = W/K
# [Vdot_th] = m^3/s
# [rho] = kg/m^3
# [c_p] = J/(kgK)
panel_43 = Panel("1.2")
python_14 = GhPythonScript(Vdot_th=python_11, rho=panel_43, c_p="1005")  # -> H_V
# ---------- python_14: Python ----------
"""Lüftungs-Wärmetransferkoeffizient.
    Inputs:
        Vdot_th:    Thermisch wirksamer Aussenluft-Volumenstrom in m^3/s
        rho:        Luftdichte in kg/m^3
        c_p:        Spezifische Wärmekapazität Luft in J/kgK
    Output:
        H_V:        Lüftungs-Wärmetransferkoeffizient in W/K"""

__author__ = "A/S ETH"
__version__ = "2020.04.18"

import rhinoscriptsyntax as rs

H_V = Vdot_th/3600 * rho * c_p
# ---------- end python_14 ----------
panel_44 = Panel(python_14)

# Lüftungswärmeverluste
# Q_V = H_V * (T_i - T_e) * t
# [Q_V] = Wh
# [H_V] = W/K
# [T_i] = K oder °C
# [T_e] = K oder °C
# [t] = h
python_15 = GhPythonScript(H_V=python_14, T_i=panel_7, T_e=panel_35, t=panel_41)  # -> Q_V
# ---------- python_15: Python ----------
"""Lüftungswärmeverluste in Wh.
    Inputs:
        H_V:    Lüftungs-Wärmetransferkoeffizient in W/K
        T_i:    Raumlufttemperatur in °C oder K
        T_a:    Aussenlufttemperatur in °C oder K
        t:      Länge der Berechnungsperiode in h
    Output:
        Q_V:    Lüftungswärmeverluste in Wh"""

__author__ = "A/S ETH"
__version__ = "2020.04.18"

import rhinoscriptsyntax as rs

Q_V = H_V * (T_i - T_e) * t
# ---------- end python_15 ----------
panel_45 = Panel(python_15)

# Wärmeeintrag/-verlust-Verhältnis
# gamma = (Q_i + Q_s) / (Q_T + Q_V)
# [gamma] = -
# [Q_T] = Wh
# [Q_V] = Wh
# [Q_i] = Wh
# [Q_s] = Wh (script erfordert kWh!)
python_16 = GhPythonScript(Q_T=python_13, Q_V=python_15, Q_i=python_10, Q_s=python_12)  # -> gamma
# ---------- python_16: Python ----------
"""Wärmeeintrag/-verlust-Verhältnis.
    Inputs:
        Q_T:        Transmissionswärmeverluste in Wh
        Q_V:        Lüftungswärmeverluste in Wh
        Q_i:        Interne Wärmeeinträge in Wh
        Q_s:        Solare Wärmeeinträge in kWh
    Output:
        gamma:      Wärmeeintrag/-verlust-Verhältnis"""

__author__ = "A/S ETH"
__version__ = "2020.04.18"

import rhinoscriptsyntax as rs

gamma = (Q_i + Q_s*1000) / (Q_T + Q_V)
# ---------- end python_16 ----------
panel_46 = Panel(python_16)

# Ausnutzungsgrad für Wärmegewinne/verluste
# (Hier: Heizfall)
panel_47 = Panel("""eta_g = (1 - gamma^a) / (1 - gamma^(a+1))
a = 1 + tau / 15
[eta_g] = -
[gamma] = -
[tau] = h""")
python_17 = GhPythonScript(gamma=python_16, tau=panel_6, Q_T=python_13, Q_V=python_15)  # -> eta_g
# ---------- python_17: Python ----------
"""Ausnutzungsgrad für Wärmegewinne.
    Inputs:
        gamma:      Wärmeeintrag/-verlust-Verhältnis
        tau:        Zeitkonstante des Gebäudes in h
        Q_T:        Transmissionswärmeverluste in Wh
        Q_V:        Lüftungswärmeverluste in Wh   
    Output:
        eta_g:      Ausnutzungsgrad für Wärmegewinne"""

__author__ = "A/S ETH"
__version__ = "2020.04.18"

import rhinoscriptsyntax as rs

if gamma < 1:
    eta_g = 1
elif Q_T + Q_V < 0:
    eta_g = 0
else:
    a = 1 + tau / 15
    eta_g = (1-gamma**a) / (1-gamma**(a+1))
# ---------- end python_17 ----------
panel_48 = Panel(python_17)

# Heizwärmebedarf
# Q_H = Q_T + Q_V - eta_g * (Q_i + Q_s)
# [Q_H] = Wh (script errechnet kWh!)
# [Q_T] = Wh
# [Q_V] = Wh
# [Q_i] = Wh
# [Q_s] = Wh (script erfordert kWh!)
# [eta_g] = -
python_18 = GhPythonScript(Q_T=python_13, Q_V=python_15, Q_i=python_10, Q_s=python_12, eta_g=python_17)  # -> Q_H
# ---------- python_18: Python ----------
"""Heizwärmebedarf.
    Inputs:
        Q_T:    Transmissionswärmeverluste in Wh
        Q_V:    Lüftungswärmeverluste in Wh
        Q_i:    Interne Wärmeeinträge in Wh
        Q_s:    Solare Wärmeeinträge in kWh
        eta_g:  Ausnutzungsgrad für Wärmerückgewinnung
    Output:
        Q_H:    Heiwärmebedarf in kWh"""

__author__ = "A/S ETH"
__version__ = "2020.04.19"

import rhinoscriptsyntax as rs

Q_H = Q_T + Q_V - eta_g * (Q_i + Q_s*1000)
if Q_H < 0:
    Q_H = 0
Q_H /= 1000
# ---------- end python_18 ----------

# ---- group: CompECD_L07_Sensitivity_Energy (1) / Monthly heating demand in kWh
panel_49 = Panel(python_18)
graph_3 = QuickGraph(panel_49, SortOrder=0)

# ----
sia_model = Panel(panel_49)

# ---- group: CompECD_L07_Sensitivity_Energy (1) (continued)
ma_3 = MassAddition(Input=python_18)  # -> Result, PartialResults
division = Division(A=ma_3.Result, B=panel_34)

# ---- group: CompECD_L07_Sensitivity_Energy (1) / Annual heating demand in kWh
panel_50 = Panel(ma_3.Result)

# ---- group: CompECD_L07_Sensitivity_Energy (1) / Annual heating demand in kWh/m^2
panel_51 = Panel(division)

# ----
floor_u_value = Data(element_impact_3.UValueWM2K)
floor_ua = Data(element_impact_3.UAValueWK)
merge_6 = Merge(Data1=merge_4, Data3=window_impact.LCAFactorsValues)
building_impact = _5BuildingImpact(
    LCAFactorsElement=flatten(merge_6),
    ReferenceStudyPeriodYears=number_slider_9,
    NFASquareMeters=area_take_off.reference_surface_area_2)  # -> GlobalWarmingPotential, PETotalKWhOilEqA, PERenewableKWhOilEqA, PENonRenewableKWhOilEqA, UBPPM²A, LCAFactorsText, LCAFactorsValues
panel_52 = Panel(building_impact.PENonRenewableKWhOilEqA)
panel_53 = Panel(building_impact.UBPPM²A)
panel_54 = Panel(building_impact.PETotalKWhOilEqA)
panel_55 = Panel(building_impact.PERenewableKWhOilEqA)
panel_56 = Panel(building_impact.LCAFactorsText)
panel_57 = Panel(building_impact.GlobalWarmingPotential)

# ---- group: UA
merge_7 = Merge(Data1=roof_ua, Data2=wall_ua, Data3=floor_ua)

# ---- group: Uvalue
merge_8 = Merge(Data1=roof_u_value, Data2=wall_u_value, Data3=floor_u_value)

# ----
ma_4 = MassAddition(Input=merge_7)  # -> Result, PartialResults
uvalue = Data(merge_8)
sum_ua = Data(ma_4.Result)
panel_58 = Panel(uvalue)
addition_2 = Addition(A=sum_ua, B=u_value_area)
sia_380_1 = Bombyx_Report(
    UA=addition_2,
    Opaque_elements_A=addition,
    Glazed_elements=transparent,
    category=Slider(1, range=0..1),
    city_climate=Slider(39, range=1..40),
    construction_method=Slider(1, range=0..1),
    thermal_bridges=Slider(0, range=0..0.1),
    A_e=area_take_off.reference_surface_area_2)  # -> transmission_losses, ventilation_losses, heating_demand, occupancy_gains, electricity_gains, solar_gains, utilized_gains; inputs Opaque_elements_A: Int32, Glazed_elements: list, category: Int32, city_climate: Int32, building_case: Int32, construction_method: Int32, regulation_type: Int32, ventilation_type: Int32, heat_recovery: Int32, air_to_earth: Int32, room_num: Int32
# ---------- sia_380_1: Python ----------
"""
Use this component to calculate the energy demand according to SIA 380-1.


    Args:
        UA: A sum of UA of all the components
        Opaque_elements_A: Insert the areas of the components
        Glazed_elements: fgdl
        north: North direction
        category: Building category: (default=1) 1=Multifamily house 2=Singlefamily huuse 3=Administration 4=School 5=Commersial 6=Restaurant 7=Meeting Venue 8=Hospital 9=Industrial 10=Warehouse 11=Sport facility 12=Indoor pool
        city_climate:Select city for climate data: 1=Adelboden 2=Aigle 3=Altdorf 4=Basel-Binningen 5=Bern-Liebefeld 6=Buchs-Aarau 7=Chur 8=Davos 9=Disentis 10=Engelberg 11=Genève-Cointrin 12=Glarus 13=Grand-St-Bernhard 14=Güttingen 15=Interlaken 16=La Chaux-de-Fonds 17=La Frétaz 18=Locarno-Monti 19=Lugano 20=Luzern 21=Magadino 22=Montana 23=Neuchâtel 24=Payerne 25=Piotta 26=Pully 27=Robbia 28=Rünenberg 29=Samedan 30=San Bernardino 31=St. Gallen 32=Schaffhausen 33=Scuol 34=Sion 35=Ulrichen 36=Vaduz 37=Wynau 38=Zermatt 39=Zürich-Kloten 40=Zürich-Meteo-Schweiz
        building_case: (default = 1) New building=1 Renovation=2
        construction_method: Very light=1, Light=2, Medium=3, Heavy=4
        thermal_bridges: Insert percentage of thermal bridges in decimals (example:5%=0.05)
        regulation_type:(default=1) One-room temperature regulation = 1 Refernece room temperature regulation = 2 All Cases = 3 
        ventilation_type: (default=1) Natural=1 Mechanical=2
        air_flow_mech:Number of air flow (mechanical ventilation only) in m3/m2h
        heat_recovery: optional(if mech is on) on=1, off=2 (default)
        heat_exch_efficiency: efficiency of heat exchanger - default = 0.8
        room_num: Optional.Number of living and sleeping rooms (default=1)
        win_percendage: The windows' glass percentage
        b_wall:The b value for underground walls
        b_floor:The b value for underground floors
        A_e: Insert energy reference area (m2)
        Area: Area of the somponents
        orient=Glazed_elements[1]
"""
import rhinoscriptsyntax as rs
import scriptcontext as sc
import uuid
from pprint import pprint
import os
import sys
import System
import Grasshopper.Kernel as gh

ghenv.Component.Name = 'Bombyx_Report'
ghenv.Component.NickName = 'SIA 380/1'
ghenv.Component.Message = 'VER 0.0.63\nJAN_20_2018'
ghenv.Component.IconDisplayMode = ghenv.Component.IconDisplayMode.application
ghenv.Component.Category = "Bombyx"
ghenv.Component.SubCategory = "Impacts"
#compatibleHBVersion = VER 0.0.57\nNOV_04_2016
#compatibleLBVersion = VER 0.0.59\nFEB_01_2015
try: ghenv.Component.AdditionalHelpFromDocStrings = "0"
except: pass
a=1
def main(UA):
    
    cat_data=[('Wohnen MFH I',20,40,70,12,28,0.7,0.7,13,15,3.1,20),('Wohnen EFH II',20,60,70,12,22,0.7,0.7,16,15,2.4,25),('Verwaltung III',20,20,80,6,22,0.9,0.7,13,15,3.3,25),('Schulen IV',20,10,70,4,11,0.9,0.7,14,15,2.3,20),('Verkauf V',20,10,90,4,33,0.8,0.7,7,14,0,0),('Restaurants VI',20,5,100,3,33,0.7,1.2,16,15,0,0),('Versammlungslokale VII',20,5,80,3,17,0.8,1.0,18,15,0,0),('Spitaler VIII',22,30,80,16,28,0.7,1.0,18,17,0,0),('Industrie IX',18,20,100,6,17,0.9,0.7,10,14,0,0),('Lager X',18,100,100,6,6,0.9,0.3,14,14,0,0),('Sportbauten XI',18,20,100,6,6,0.9,0.7,16,14,0,0),('Hallenbader XII',28,20,60,4,56,0.7,0.7,15,18,0,0)]
    
    if category==None:
        building_category=0
    elif category<1 or category>12:
        warningMsg = 'Insert number of Building Category from 1 to 12 '
        ghenv.Component.AddRuntimeMessage(gh.GH_RuntimeMessageLevel.Warning, warningMsg)
        return
    else: 
        building_category= (category-1)
    
    #link to data, depending on building category.
    
    theta_i=cat_data[building_category][1] #room temperature (Celcius)
    area_pers=cat_data[building_category][2] #m2/Person
    Heatinput_pers=cat_data[building_category][3] #W/Person
    presence_time=cat_data[building_category][4] #hours per day
    demand_el_annual=cat_data[building_category][5] #kWh/m2 electricity demand per year
    el_reduction=cat_data[building_category][6] #electricity reduction factor 
    q_thO=cat_data[building_category][7] #m3/m2h Thermally effective outside air volume flow
    Q_H_liO=cat_data[building_category][8] #kWh/m2
    DeltaQ_H__li=cat_data[building_category][9] #kWh/m2
    Heat_input_standard_useage=cat_data[building_category][10]
    Ph_li=cat_data[building_category][11]
    util_param=1.0
    ref_time_const=15.0 #hours
    
    
    #input climate data
    climate=[(1,"Adelboden",1320,-1.2,297,96,134,75,150,-0.9,331,143,169,102,213,1.7,431,271,257,171,364,4.1,293,233,181,101,443,9.2,268,295,198,129,530,11.8,236,311,187,140,537,14.2,265,327,198,139,560,14.4,300,279,187,112,493,10.5,314,197,156,83,371,7.3,359,179,190,123,254,2.0,262,96,122,75,150,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
    
    if city_climate==None:
        warningMsg = 'Insert city for climate data '
        ghenv.Component.AddRuntimeMessage(gh.GH_RuntimeMessageLevel.Warning, warningMsg)
        return
    elif city_climate<1 or city_climate>40:
        warningMsg = 'Insert number of Building Category from 1 to 40 '
        ghenv.Component.AddRuntimeMessage(gh.GH_RuntimeMessageLevel.Warning, warningMsg)
        return
    else: 
        city=(city_climate-1)  #index number in climate  
    
    mean_temp= [0,0,0,0,0,0,0,0,0,0,0,0]
    j=3
    for i in range(12):
        mean_temp[i]=climate[city] [j]
        j=j+6
    
    days = [31,28,31,30,31,30,31,31,30,31,30,31]
    sea_height=float(climate[city][2])
    annual_mean_temp=climate[city][75]
    # irradiance table with each row corresponding respectivly to direction: H, SO, SSO, S, SSW, SW, WSW, W, WNW, NW, NNW, N, NNO, NO, ONO, O, OSO
    irradiance= range (17)
    for i in range (17):
        irradiance[i] = range (12)
    
    #horizontal irradiance for each month
    j=8
    for i in range (12):
        irradiance[0][i]=(climate[city][j])/3.6
        j=j+6
        
    k=4
    for i in range (12):
        #main orientation
        irradiance[3][i]=(climate[city][k])/3.6 #S
        irradiance[7][i]=(climate[city][k+2])/3.6 #W
        irradiance[11][i]=(climate[city][k+3])/3.6 #N
        irradiance[15][i]=(climate[city][k+1])/3.6 #O
        #middle orientations
        irradiance[1][i]=(irradiance[3][i]*irradiance[15][i])**(1.0/2) #SO
        irradiance[5][i]=(irradiance[3][i]*irradiance[7][i])**(1.0/2) #SW
        irradiance[9][i]= (irradiance[11][i]*irradiance[7][i])**(1.0/2)#NW
        irradiance[13][i]=(irradiance[11][i]*irradiance[15][i])**(1.0/2) #NO
        #second middle orientations
        irradiance[2][i]=(irradiance[3][i]*irradiance[1][i])**(1.0/2) #SSO
        irradiance[4][i]=(irradiance[3][i]*irradiance[5][i])**(1.0/2) #SSW
        irradiance[6][i]=(irradiance[7][i]*irradiance[5][i])**(1.0/2) #WSW
        irradiance[8][i]=(irradiance[7][i]*irradiance[9][i])**(1.0/2) #WNW
        irradiance[10][i]=(irradiance[11][i]*irradiance[9][i])**(1.0/2) #NNW
        irradiance[12][i]=(irradiance[11][i]*irradiance[13][i])**(1.0/2) #NNO
        irradiance[14]=(irradiance[15][i]*irradiance[13][i])**(1.0/2) #ONO
        irradiance[16][i]=(irradiance[15][i]*irradiance[1][i])**(1.0/2) #OSO
        
        k=k+6
    
    #new building or renovation

    if building_case==None:
        build_case=1
    elif building_case<1 or building_case>2:
        warningMsg = 'Insert number of Building Case from 1 to 2'
        ghenv.Component.AddRuntimeMessage(gh.GH_RuntimeMessageLevel.Warning, warningMsg)
        return
    else: 
        build_case=building_case
    
    #construction method 
            
    if construction_method<1 or construction_method>4:
        warningMsg = 'Insert number of construction method from 1 to 4'
        ghenv.Component.AddRuntimeMessage(gh.GH_RuntimeMessageLevel.Warning, warningMsg)
        return
    else: 
        constr_method=construction_method
    
    # heat storage capacity C/AE
    if constr_method==1:
        constr_factor=0.01
    elif constr_method==2:
        constr_factor=0.03
    elif constr_method==3:
        constr_factor=0.08
    elif constr_method==4:
        constr_factor=0.15
    
    #th_bridge= int(raw_input("Insert number of addition for thermal bridges:"))
    if thermal_bridges<0 or thermal_bridges>1:
        warningMsg = 'Insert the percendage of thermal bridges in decimal'
        ghenv.Component.AddRuntimeMessage(gh.GH_RuntimeMessageLevel.Warning, warningMsg)
        return
    else: 
        th_brg_add=thermal_bridges
        
    #regulation of room temperature - regelung value
    
    if regulation_type==None:
        regulation=1
    elif regulation_type<1 or regulation_type>3:
        warningMsg = 'Insert number of regulation type from 1 to 3 '
        ghenv.Component.AddRuntimeMessage(gh.GH_RuntimeMessageLevel.Warning, warningMsg)
        return
    else: 
        regulation= regulation_type
    
    #Components_out: Name area and Uvalue -> 3
    #Windows_out_vertical:Orientation,Area,Uvalue,gValue,glasspercentage,horizon fs1, Overhang fs2, Side fs3.1,Side fs3.2--> 9)
    #Windows_out_horizontal:Area,Uvalue,gvalue, glassercentage,horizon S,W,O and N --> 8)
    #Components-in:Type, area, Uvalue and b --> 4)

    #check compatibility and version

    #windows_out_horizontal=range(0) #future alteration
    #Total number of components
    theta_indoor=theta_i
    Q_t_m=[]
    Q_t_monthly=range(12)
    i=0 #counts the number of total components for the Q_t calculation
    for k in range(12):
       Q_t_monthly[k]=((theta_i+regulation-1)+((theta_indoor-theta_i)/4.0)-mean_temp[k])*days[k]*float(UA)*24/(float(A_e)*1000)
    Q_t_m.append(Q_t_monthly)
    
    #for y in range (len(windows_out_horizontal)):
    #    for n in range(12):
    #            Q_t_monthly[i][n]=((theta_i+regulation-1)+((theta_indoor-theta_i)/2.0)-mean_temp[n])*days[n]*float(windows_out_horizontal[y][0])*float(windows_out_horizontal[y][1])*24/(A_e*1000.0)
    #    i=i+1
    Q_t_m_wind=[]
    Q_t_monthly_wind=range(12)
    for m in range(12):
        for i in Glazed_elements:
            Q_t_monthly_wind[m]=((theta_i+regulation-1)+((theta_indoor-theta_i)/2.0)-mean_temp[m])*days[m]*Glazed_elements[0]*24/(A_e*1000.0)
        Q_t_m_wind.append(Q_t_monthly_wind)
    Q_t_mo=[]
    for i, j in zip(Q_t_m[0], Q_t_m_wind[0]):
        Q_t_mo.append(i+j)
#    for x, y in zip(Q_t_m, Q_t_m_wind):
#        Q_t_mo.append(x+y)
    Q_t_month = range (12)
    for i in range (12):
        Q_t_month[i] =0
    
    Q_t=0
    
    for i in range (12):
        Q_t=Q_t+Q_t_month[i]
    """Heating Load"""
    q_th=q_thO
    if ventilation_type==None:
        vent_type=1
    elif ventilation_type<1 or ventilation_type>2:
        warningMsg = 'Insert number of ventilation_type from 1 to 2 '
        ghenv.Component.AddRuntimeMessage(gh.GH_RuntimeMessageLevel.Warning, warningMsg)
        return
    else: 
        vent_type=ventilation_type

    if vent_type==2:
        if air_flow_mech==None:
            warningMsg = 'Insert number of air flow for mechanical ventilation in m3/m2h '
            ghenv.Component.AddRuntimeMessage(gh.GH_RuntimeMessageLevel.Warning, warningMsg)
            return
        else:
            q_th=air_flow_mech
    
    design_temp=climate[city][76]
    H_comp=UA

    # heat capacity of air
    ra_ca=(1220.0-(0.14*sea_height))/3600.0
    H_vent=A_e*q_th*ra_ca
    H_tot=H_comp+H_vent
    
    Ph=(H_tot*(theta_i-design_temp)/A_e)-Heat_input_standard_useage
    
    if design_temp<8:
        Ph_li_corr=Ph_li*(theta_i-design_temp)/(theta_i-(-8))
    else:
        Ph_li_corr=Ph_li
        
    Ph_li=max(Ph_li,Ph_li_corr)
    
    """Comfort Ventilation""" # in Standard heat recovery is not mentioned-values from the excel SIA_380

    if heat_recovery==None:
        heat_rec=2
    elif heat_recovery<1 or heat_recovery>2:
        warningMsg = 'Insert number for heat recovery from 1 to 2 '
        ghenv.Component.AddRuntimeMessage(gh.GH_RuntimeMessageLevel.Warning, warningMsg)
        return
    else:
        heat_rec=heat_recovery
    
    if air_to_earth==None:
        air_earth=2
    elif air_to_earth<1 or air_to_earth>2:
        warningMsg = 'Insert number for air_to_earth from 1 to 2 '
        ghenv.Component.AddRuntimeMessage(gh.GH_RuntimeMessageLevel.Warning, warningMsg)
        return
    else:
        air_earth=air_to_earth

    if room_num==None:
        S_r=1
    else:
        S_r=room_num
    
    #For comfort ventilation, the standard today is: heat exchangers with a temperature change rate of at least 80%.
    h_WRG=0.8
    
    if heat_rec==1:
        if heat_exch_efficiency!=None:
            h_WRG=heat_exch_efficiency
       
    basic_air_exchangerate=0.15 #m3/m2h
    air_exchangerate_step1=S_r*20.0 #m3/h
    air_exchangerate_step2=S_r*30.0 #m3/h
    air_exchangerate_step3=S_r*45.0 #m3/h0.
    operation_timestep1=84 #h/Wo
    operation_timestep2=70 #h/Wo
    operation_timestep3=14 #h/Wo
    
    if air_earth==1:
        thermal_active_airrate_step1=(((1-h_WRG)*(air_exchangerate_step1/A_e))*0.8)+basic_air_exchangerate #m3/m2h
        thermal_active_airrate_step2=(((1-h_WRG)*(air_exchangerate_step2/A_e))*0.8)+basic_air_exchangerate #m3/m2h
        thermal_active_airrate_step3=(((1-h_WRG)*(air_exchangerate_step3/A_e))*0.8)+basic_air_exchangerate #m3/m2h
    else:
        thermal_active_airrate_step1=((1-h_WRG)*(air_exchangerate_step1/A_e))+basic_air_exchangerate
        thermal_active_airrate_step2=((1-h_WRG)*(air_exchangerate_step2/A_e))+basic_air_exchangerate
        thermal_active_airrate_step3=((1-h_WRG)*(air_exchangerate_step3/A_e))+basic_air_exchangerate
    
    V_EBFo=(thermal_active_airrate_step1*operation_timestep1+thermal_active_airrate_step2*operation_timestep2+thermal_active_airrate_step3*operation_timestep3)/168.0
    # 168=84+70+14
    Q_V_without=[0,0,0,0,0,0,0,0,0,0,0,0]
    Q_V_with=[0,0,0,0,0,0,0,0,0,0,0,0]
    if heat_rec==2:
        for i in range(12):
            Q_V_without[i]=((theta_i+regulation-1)-mean_temp[i])*q_thO*days[i]*ra_ca*24.0/1000.0
    for i in range (12):
        Q_V_with [i] = (theta_i+regulation-1-mean_temp[i])*V_EBFo*days[i]*A_e*ra_ca*24/(A_e*1000.0)
        if Q_V_with[i]<0:
            Q_V_with[i]=0
            
    Q_V_with_Annual = 0
    for i in range (12):
        Q_V_with_Annual=Q_V_with_Annual+Q_V_with[i]
    
    if heat_rec==2:   
        Q_V_without_Annual = 0
    for i in range (12):
        Q_V_without_Annual=Q_V_without_Annual+Q_V_without[i]
        
        diff=Q_V_with_Annual-Q_V_without_Annual
    else:
        diff=0.0
    
    # Electricity consumption by air exchange rate
    el_step1=0.3 #Wh/m3
    el_step2=0.35 #Wh/m3
    el_step3=0.5 #Wh/m3
    
    consumption_step1=air_exchangerate_step1*el_step1*operation_timestep1/1000.0
    consumption_step2=air_exchangerate_step2*el_step2*operation_timestep2/1000.0
    consumption_step3=air_exchangerate_step3*el_step3*operation_timestep3/1000.0
    
    consumption_tot=((consumption_step1+consumption_step2+consumption_step3)*52)/A_e
    
    """Gains"""
    #Electricity gains
    #duration of calculation period
    duration_el=365.0
    
    Qi_el=(duration_el*el_reduction*demand_el_annual)/365.0
    Qi_el_monthly=[0,0,0,0,0,0,0,0,0,0,0,0]
    for i in range (12):
        Qi_el_monthly[i]=Qi_el/12.0
    
    #Occupancy gains
    duration_occ=365.0
    Qi_P=(duration_occ*presence_time*Heatinput_pers)/(area_pers*1000.0)
    Qi_P_monthly=[0,0,0,0,0,0,0,0,0,0,0,0]
    for i in range (12):
        Qi_P_monthly[i]=Qi_P/12.0
    
    #Solar gains
    horizon=[("-","SW","SO","SSO","S","SSW","WSW","W","O","WNW","NW","NO","NNW","N","NNO","ONO","OSO"),(0,1,1,1,1,1,1,1,1,1,1,1,1,1,1,1,1),(1,1,1,1,1,1,1,0.99,0.99,1,1,1,1,1,1,1,1),(2,0.99,0.99,0.99,0.99,0.99,0.99,0.99,0.99,1,1,1,1,1,1,1,0.99),(3,0.99,0.99,0.99,0.99,0.99,0.99,0.98,0.98,0.99,0.99,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
    overhang=[("-","SW","SO","SSO","S","SSW","WSW","W","O","WNW","NW","NO","NNW","N","NNO","ONO","OSO"),(0,1,1,1,1,1,1,1,1,1,1,1,1,1,1,1,1),(1,1,1,1,1,1,1,1,1,1,1,1,1,1,1,1,1),(2,0.99,0.99,0.99,0.99,0.99,0.99,0.99,0.99,0.99,0.99,0.99,0.99,0.99,0.99,0.99,0.99),(3,0.99,0.99,0.99,0.99,0.99,0.99,0.99,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
    sideblind=[("-","SW","SO","SSO","S","SSW","WSW","W","O","WNW","NW","NO","NNW","N","NNO","ONO","OSO"),(0,1,1,1,1,1,1,1,1,1,1,1,1,1,1,1,1),(1,1,1,1,1,1,1,1,1,1,1,1,1,1,1,1,1),(2,1,1,1,1,1,1,0.99,0.99,1,1,1,1,1,1,1,1),(3,0.99,0.99,0.99,0.99,0.99,0.99,0.99,0.99,1,1,1,1,1,1,1,0.99),(4,0.99,0.99,0.99,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
    Qi_s_month=[]
    Qi_s_monthly=[]
    Qi_s_monthly= range (12)
    
    for i,j in enumerate(Glazed_elements):
        orient=Glazed_elements[1]
        index_h=horizon[0].index(orient)
        index_o=overhang[0].index(orient)
        index_s=sideblind[0].index(orient)
        hor=Glazed_elements[2]
        over=Glazed_elements[3]
        side1=Glazed_elements[4]
        side2=Glazed_elements[5]
        if hor==0:
            fs1=1
        elif hor<1:
            fs1=hor
        else:
            fs1=horizon[hor+1][index_h]
        fs2=overhang[over+1][index_o]
        fs3_1=sideblind[side1+1][index_s]
        if orient=="SW" or orient=="SO" or orient=="S" or orient=="SSW" or orient=="SSO":
            fs3_2=sideblind[side2+1][index_s]
        else:
            fs3_2=1
        irradiance_orient=[("H","SO","SSO","S","SSW","SW","WSW","W","WNW","NW","NNW","N","NNO","NO","ONO","O","OSO")]
        index_ir=irradiance_orient[0].index(orient)
        
        for j in range(12):
            Qi_s_monthly[j]=(irradiance[index_ir][j])*Glazed_elements[6]*0.9*fs1*fs2*fs3_1*fs3_2/A_e
            Qi_s_month.append(Qi_s_monthly)
#       k=i+1
    #for n in range(len(windows_out_horizontal)):
    #    horS=int(windows_out_horizontal[n][4])
    #    horW=int(windows_out_horizontal[n][5])
    #    horO=int(windows_out_horizontal[n][6])
    #    horN=int(windows_out_horizontal[n][7])
    #    fs1=horizon[horS+1] [4]
    #    fs2=horizon[horW+1] [7]
    #    fs3_1=horizon[horO+1][8]
    #    fs3_2=horizon[horN+1][13]
    #    for j in range(12):
    #        m=k+n
    #        Qi_s_monthly[m][j]=(irradiance[0][j])*float(windows_out_horizontal[n][0])*float(windows_out_horizontal[n][2])*float(windows_out_horizontal[n][3])*0.9*fs1*fs2*fs3_1*fs3_2/A_e
    
#    Qi_s_month = range (12)
#    for i in range (12):
#        Qi_s_month[i] =0
    
#    for i in range (12):
#        Qi_s_month[i]=Qi_s_month[i]+Qi_s_monthly[j]
#    Qi_s=0
    
#    for i in range (12):
#        Qi_s=Qi_s+Qi_s_month[i]
    
    
    """Balance"""
    #transmission losses
    Q_Tr_month=[0,0,0,0,0,0,0,0,0,0,0,0]
    #total loses=transmission +ventilation losses
    Q_tot_month=[0,0,0,0,0,0,0,0,0,0,0,0]
    #total gains
    Q_g_month=[0,0,0,0,0,0,0,0,0,0,0,0]
    #g Heat input/heat loss ratio
    g_month=[0,0,0,0,0,0,0,0,0,0,0,0]
    #t_const time constant
    t_const_month=[0,0,0,0,0,0,0,0,0,0,0,0]
    #heat losses coefficient
    H_coeff_month=[0,0,0,0,0,0,0,0,0,0,0,0]
    #Parameter for utilization
    a_util=[0,0,0,0,0,0,0,0,0,0,0,0]
    #Utilization of heat input
    hg_case1=[0,0,0,0,0,0,0,0,0,0,0,0]
    hg_case2=[0,0,0,0,0,0,0,0,0,0,0,0]
    hg_decision=[0,0,0,0,0,0,0,0,0,0,0,0]
    #Utilized gains
    Q_ug_month=[0,0,0,0,0,0,0,0,0,0,0,0]
    #Heating demand
    Q_Heating_month=[0,0,0,0,0,0,0,0,0,0,0,0]
    
    for i in range(12):
        Q_Tr_month[i]=Q_t_mo[i]+Q_t_mo[i]*th_brg_add
        if heat_rec==2:
            Q_tot_month[i]=Q_Tr_month[i]+Q_V_without[i]
        else:
            Q_tot_month[i]=Q_Tr_month[i]+Q_V_with[i]
        Q_g_month[i]=Qi_P_monthly[i]+Qi_el_monthly[i]+Qi_s_month[0][i]
        g_month[i]=Q_g_month[i]/Q_tot_month[i]   
        t_const_month[i]=constr_factor*A_e*1000.0/(H_comp+q_thO*A_e*ra_ca)
        H_coeff_month[i]=(UA+q_thO*A_e*ra_ca/3600.0)*(1+th_brg_add)
        a_util[i]=util_param+t_const_month[i]/ref_time_const
        if Q_tot_month[i]>0:
            hg_case1[i]=1
        else:
            hg_case1[i]=0
        if g_month[i]==1:
            hg_case2[i]=util_param/(util_param+1)
        else:
            hg_case2[i]=(1-(g_month[i]**a_util[i]))/(1-(g_month[i]**(a_util[i]+1)))
        if hg_case1[i]==0:
            hg_decision[i]=0
        else:
            hg_decision[i]=hg_case2[i]
        Q_ug_month[i]=Q_g_month[i]*hg_decision[i]
        Q_Heating_month[i]=Q_tot_month[i]-Q_ug_month[i]
    
    Q_Heating=0
    for i in range (12):
        Q_Heating=Q_Heating+Q_Heating_month[i]
    
    corr_factor_mean_temp=(1--1*(0.06*(9.4-annual_mean_temp)))
    if build_case==1:
        Q_H_li=corr_factor_mean_temp*(Q_H_liO+DeltaQ_H__li*(Opaque_elements_A/A_e))
        Q_H_ta=Q_H_li*0.6
    else:
        Q_H_li=corr_factor_mean_temp*(Q_H_liO+DeltaQ_H__li*(A_th/A_e))*1.5
        Q_H_ta=Q_H_li/1.5
    
    perc=Q_Heating/Q_H_li

    if heat_rec==2:
            return [Q_Heating_month,Q_Tr_month,Q_V_without,Qi_P_monthly,Qi_el_monthly,Qi_s_month[0],Q_ug_month]
    else:
            return [Q_Heating_month,Q_Tr_month,Q_V_with,Qi_P_monthly,Qi_el_monthly,Qi_s_month[0],Q_ug_month]
    print components_out
main(UA)

results_energy=main(UA)
heating_demand=results_energy[0]
transmission_losses=results_energy[1]
ventilation_losses=results_energy[2]
occupancy_gains=results_energy[3]
electricity_gains=results_energy[4]
solar_gains=results_energy[5]
utilized_gains=results_energy[6]
# ---------- end sia_380_1 ----------
monthly_heating_kwh_m2 = Panel(sia_380_1.heating_demand)
energy_carrier = EnergyCarrier(EnergyDemand=sia_380_1.heating_demand, SelectedEnergyCarrier=energy_selection)  # -> EnergyPropertiesText, EnergyPropertiesValues
panel_59 = Panel(energy_carrier.EnergyPropertiesText)

bombyx_kwh_m2 = Panel(monthly_heating_kwh_m2)
multiplication_6 = Multiplication(A=bombyx_kwh_m2, B=bombyx_zone_area)
bombyx_kwh = Panel(multiplication_6)
graph_4 = QuickGraph([hive_kwh, bombyx_kwh, sia_model], SortOrder=0)

# ==== cluster AreaTakeOff
L = ClusterInput()
U = ClusterInput()
create = ClusterInput()
factor = ClusterInput()

# ---- group: 01 Create Layers
lng = ListLength(Layers=L)
range = Range(Domain=Domain(0, 1), Steps=expr("x-1", lng))
gradient = Gradient(
    LowerLimit=0,
    UpperLimit=1,
    Parameter=flatten(range),
    stops=[0.0545: RGB(18, 178, 90), 0.146: RGB(79, 186, 8), 0.247: RGB(220, 237, 32), 0.348: RGB(247, 159, 20), 0.455: RGB(243, 57, 0), 0.552: RGB(236, 27, 60), 0.645: RGB(210, 0, 118), 0.75: RGB(103, 0, 120), 0.847: RGB(39, 72, 161), 0.947: RGB(1, 192, 229)])
c_script = CSharpScript(L=L, U=U)  # -> out, S; inputs L: String, U: Boolean
# ---------- c_script: C# usings ----------
using System.IO;
using System.Linq;
using System.Data;
using System.Drawing;
using System.Reflection;
using System.Windows.Forms;
using System.Xml;
using System.Xml.Linq;
using System.Runtime.InteropServices;

using Rhino.DocObjects;
using Rhino.Collections;
using GH_IO;
using GH_IO.Serialization;
# ---------- c_script: C# ----------
    if(!U)
    {
      int LayerID = doc.Layers.Find(L, true);
      if (LayerID < 0)
      {
        return;
      }
      else
      {
        Rhino.DocObjects.Layer Layer = doc.Layers[LayerID];
        Rhino.DocObjects.RhinoObject[] Objects = doc.Objects.FindByLayer(Layer);
        if (Objects == null)
        {
          return;
        }
        else
        {
          // Rhino Geometrie in Grasshopper referenzieren
          List<Grasshopper.Kernel.Types.IGH_Goo> Geometry = new List<Grasshopper.Kernel.Types.IGH_Goo>();
          foreach (Rhino.DocObjects.RhinoObject Object in Objects)
          {
            ObjRef Reference = new Rhino.DocObjects.ObjRef(Object);
            Grasshopper.Kernel.Types.IGH_GeometricGoo GOO = Grasshopper.Kernel.GH_Convert.ObjRefToGeometry(Reference);
            Geometry.Add(GOO);
          }
          S = Geometry;
        }
      }
    }
    else
    {
      return;
    }
# ---------- end c_script ----------
create_layer_s = CreateLayerS(layer_name=L, layer_color=gradient, bake=create)
srf = Surface(simplify(c_script.S))

# ---- group: Length
data = Data(c_script.S)

# ---- group: Length / Filter for curves
txt = Text(data)
eval = Evaluate(F="contains(x, \"Curve\")", x=txt)
cull = CullPattern(List=data, CullPattern=eval)

# ---- group: Length (continued)
flip = FlipMatrix(Data=cull)
item = ListItem(List=flip, Index="5", Wrap=True)
len = Length(Curve=item)
ma = MassAddition(Input=flatten(len))  # -> Result, PartialResults
stützen = Number(ma.Result)

# ----
stützen_2 = ClusterOutput(stützen)

# ---- group: Areas
flip_2 = FlipMatrix(Data=srf)
# Geometry import
panel = Panel("0")
item_2 = ListItem(List=flip_2, Index=panel, Wrap=True)
item_3 = ListItem(List=flip_2, Index="1", Wrap=True)
item_4 = ListItem(List=flip_2, Index="2", Wrap=True)
item_5 = ListItem(List=flip_2, Index="3", Wrap=True)
item_6 = ListItem(List=flip_2, Index="4", Wrap=True)
item_7 = ListItem(List=flip_2, Index="6", Wrap=True)
item_8 = ListItem(List=flip_2, Index="7", Wrap=True)
item_9 = ListItem(List=flip_2, Index="8", Wrap=True)
item_10 = ListItem(List=flip_2, Index="10", Wrap=True)
item_11 = ListItem(List=flip_2, Index="9", Wrap=True)
srf_2 = Surface(item_2)
srf_3 = Surface(item_10)
srf_4 = Surface(item_3)
srf_5 = Surface(item_4)
srf_6 = Surface(item_5)
srf_7 = Surface(item_6)
srf_8 = Surface(item_7)
srf_9 = Surface(item_8)
srf_10 = Surface(item_9)
srf_11 = Surface(item_11)
area = Area(Geometry=srf_3)  # -> Area, Centroid
area_2 = Area(Geometry=srf_2)  # -> Area, Centroid
area_3 = Area(Geometry=srf_4)  # -> Area, Centroid
area_4 = Area(Geometry=srf_5)  # -> Area, Centroid
area_5 = Area(Geometry=srf_6)  # -> Area, Centroid
area_6 = Area(Geometry=srf_7)  # -> Area, Centroid
area_7 = Area(Geometry=srf_8)  # -> Area, Centroid
area_8 = Area(Geometry=srf_9)  # -> Area, Centroid
area_9 = Area(Geometry=srf_10)  # -> Area, Centroid
area_10 = Area(Geometry=srf_11)  # -> Area, Centroid

# ----
clean = CleanTree(RemoveNulls=True, RemoveInvalid=True, RemoveEmpty=False, Tree=flatten(area_2.Area))
clean_2 = CleanTree(RemoveNulls=True, RemoveInvalid=True, RemoveEmpty=False, Tree=flatten(area_3.Area))
clean_3 = CleanTree(RemoveNulls=True, RemoveInvalid=True, RemoveEmpty=False, Tree=flatten(area_4.Area))
clean_4 = CleanTree(RemoveNulls=True, RemoveInvalid=True, RemoveEmpty=False, Tree=flatten(area_5.Area))
clean_5 = CleanTree(RemoveNulls=True, RemoveInvalid=True, RemoveEmpty=False, Tree=flatten(area_6.Area))
clean_6 = CleanTree(RemoveNulls=True, RemoveInvalid=True, RemoveEmpty=False, Tree=flatten(area_7.Area))
clean_7 = CleanTree(RemoveNulls=True, RemoveInvalid=True, RemoveEmpty=False, Tree=flatten(area_8.Area))
clean_8 = CleanTree(RemoveNulls=True, RemoveInvalid=True, RemoveEmpty=False, Tree=flatten(area_9.Area))
clean_9 = CleanTree(RemoveNulls=True, RemoveInvalid=True, RemoveEmpty=False, Tree=flatten(area_10.Area))
clean_10 = CleanTree(RemoveNulls=True, RemoveInvalid=True, RemoveEmpty=False, Tree=flatten(area.Area))
srf_12 = ClusterOutput(srf_5)
null = NullItem(Item=srf_5)  # -> NullFlags, InvalidFlags, Description
panel_2 = Panel(srf_9)
cull_2 = CullPattern(List=srf_5, CullPattern=null.NullFlags)
panel_3 = Panel(null.NullFlags)

# ---- group: Areas (continued)
ma_2 = MassAddition(Input=flatten(clean))  # -> Result, PartialResults
ma_3 = MassAddition(Input=clean_6)  # -> Result, PartialResults
ma_4 = MassAddition(Input=clean_7)  # -> Result, PartialResults
ma_5 = MassAddition(Input=clean_8)  # -> Result, PartialResults
ma_6 = MassAddition(Input=clean_9)  # -> Result, PartialResults
ma_7 = MassAddition(Input=clean_10)  # -> Result, PartialResults
ma_8 = MassAddition(Input=clean_2)  # -> Result, PartialResults
ma_9 = MassAddition(Input=clean_3)  # -> Result, PartialResults
ma_10 = MassAddition(Input=clean_4)  # -> Result, PartialResults
ma_11 = MassAddition(Input=clean_5)  # -> Result, PartialResults
aussenwand_unter_t = Number(ma_8.Result)
innenwand = Number(ma_10.Result)
decke = Number(ma_3.Result)
boden = Number(ma_4.Result)
steildach = Number(ma_5.Result)
flachdach = Number(ma_6.Result)
balkon = Number(ma_7.Result)
trennwand = Number(ma_11.Result)
fenster = Number(ma_9.Result)

# ----
addition = Addition(A=decke, B=boden)
gross_floor_area = Panel(addition)
multiplication = Multiplication(A=gross_floor_area, Factor=factor)
subtraction = Subtraction(A=ma_2.Result, B=ma_9.Result)
reference_surface_area = Number(multiplication)

# ---- group: Areas (continued)
exterior_walls_above_ground = Number(subtraction)

# ----
decke_2 = ClusterOutput(decke)
boden_2 = ClusterOutput(boden)
balkon_2 = ClusterOutput(balkon)
fenster_2 = ClusterOutput(fenster)
steildach_2 = ClusterOutput(steildach)
flachdach_2 = ClusterOutput(flachdach)
innenwand_2 = ClusterOutput(innenwand)
trennwand_2 = ClusterOutput(trennwand)
reference_surface_area_2 = ClusterOutput(reference_surface_area)
exterior_walls_above_ground_2 = ClusterOutput(exterior_walls_above_ground)
aussenwand_unter_t_2 = ClusterOutput(aussenwand_unter_t)

# ==== cluster CreateLayerS: Creates Layer(s) in the LayerManager in Rhino from Grasshopper
layer_name = ClusterInput()  # Name of the Layer(s)
layer_color = ClusterInput()  # Color of the Layer(s)
bake = ClusterInput()  # Create Layers?
txt = Text(layer_name)
col = Colour(layer_color)
bool = Boolean(bake)
c_script = CSharpScript(L=txt, C=col, B=bool)  # -> out; inputs L: String, C: Color, B: Boolean
# ---------- c_script: C# ----------
    if (B)
    {
      if (!string.IsNullOrEmpty(L) && Rhino.DocObjects.Layer.IsValidName(L))
      {
        Rhino.DocObjects.Tables.LayerTable LayerList = doc.Layers;
        int LayerID = LayerList.FindByFullPath(L, true);
        if (LayerID < 0)
        {
          Rhino.DocObjects.Layer NewLayer = new Rhino.DocObjects.Layer();
          NewLayer.Name = L;
          NewLayer.Color = C;
          LayerID = LayerList.Add(NewLayer);
          if (LayerID > -1)
          {
            Print("Added new Layer(s) to the document!");
          }
          else
            Print("Layer(s) can't be created, please clean up your Layer(s)!");
        }
      }
    }
    else
      Print("toggle the boolean value inside B to true, to create Layer(s)");
    return;
# ---------- end c_script ----------
panel = Panel(c_script)
