# Grasshopper definition hourly_demand_shoebox_5x5x3.gh (Grasshopper 1.0.7)
# plug-ins: HiveIO, Hive.Core.solar, Hive.Core.sia380, GHSolar, FalseStartToggle, Hive.Core.epw_reader

panel = Panel("tests\Hive.Core\sia380\A-S-SIA380-Data\Zurich-hour_historic.epw")
join = TextJoin(Text=["D:\_Academic\_ETH\_ETH\2_Jobs\_Hive\hive\", panel])

# ---- group: Path to weather file (.epw)
panel_2 = Panel(join)

# ---- group: refine windows discretisation
panel_3 = Panel("4")
panel_4 = Panel("10")

# ---- group: PV Fläche
srf = Surface(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)

# ---- group: static shading
mesh = Mesh(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)

# ---- group: Ground
mesh_2 = Mesh(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)

# ---- group: Context (City, obstacles, etc.)
mesh_3 = Mesh([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])

# ---- group: Windows
srf_2 = Surface([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])

# ---- group: Building volume
brep = Brep(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)

# ----
mesh_uv = MeshSurface(Surface=srf, UCount="6", VCount="6", Overhang=True, Equalize=False)
brep_2 = Brep(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)
srf_3 = Surface(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)

# ---- group: Hive model description
hiveinputenergysystems = InputEnergySystemsHive(
    MeshSolarTechnologyProperties=mesh_uv,
    conversions="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",
    emitters="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",
    meshConnections="""{
  "$type": "System.Collections.Generic.Dictionary`2[[System.Int32, mscorlib],[System.Int32, mscorlib]], mscorlib"
}""",
    meshes="""{
  "$type": "Hive.IO.Forms.SurfaceViewModel[], Hive.IO",
  "$values": [
    {
      "$type": "Hive.IO.Forms.SurfaceViewModel, Hive.IO",
      "Name": "srf0",
      "Area": 41.19041518967525
    }
  ]
}""")  # -> flatten(HiveEnergySystems)
hiveinputbuilding = InputBuildingHive(ZoneGeometry=brep_2, WindowsSurfaces=srf_3, SiaRoom="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")
hiveinputenvironment = InputEnvironmentHive(EpwPath=panel_2, ObstacleGeometries=[mesh_2, mesh_3, mesh])

# ----
hivedistributor = MainDistributorHive(HiveInputs=[hiveinputenvironment, hiveinputbuilding, hiveinputenergysystems])  # -> HiveBuilding, HiveEnvironment, HiveEnergySystemsSurfaceBasedTech, HiveEnergySystemsConversionTech, HiveEnergySystemsEmitter

# ---- group: min (blue) to max (yellow) irradiation (kWh/m^2)
number_slider = Slider(0, range=0..1000)
number_slider_2 = Slider(930.703, range=0..2000)

# ----
# Distributor
hivedistsolarsimu = DistributorSolarSimulationHive(
    HiveBuilding=hivedistributor.HiveBuilding,
    HiveSolarTechnologies=hivedistributor.HiveEnergySystemsSurfaceBasedTech,
    HiveEnvironment=hivedistributor.HiveEnvironment)  # -> EnvironmentMesh, BuildingCentroid, ExternalSurfaces, WindowGeometries, WindowTilt, WindowAzimuth, WindowAreas, SolarTechMesh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
hivedistconversiontech = DistributorConversionTechHive(ConversionTechnologies=hivedistributor.HiveEnergySystemsConversionTech)  # -> AirSourceHeatPump, Chiller, Boiler, CombinedHeatAndPower, HeatExchanger, ColdExchanger, DirectElectricity
hivedistsiaroom = DistributorSIARoomHive(HiveBuilding=hivedistributor.HiveBuilding)  # -> ZoneAreas, WindowsAreas, ExternalSurfacesAreas, SIA2024Room, AllExternalSurfaceAreas, SurfaceType, SUA2024Schedules, UseAdaptiveComfort
hivedistenvironment = DistributorEnvironmentHive(HiveEnvironment=hivedistributor.HiveEnvironment)  # -> Filepath, NaturalGas, BioGas, WoodPellets, DistrictHeating, DistrictCooling, GridElectricity, AmbientAirTemp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
bool = Boolean()
python = GhPythonScript(x=hivedistsolarsimu.WindowGeometries, y=bool)  # -> out, a
# ---------- python: Python ----------
__author__ = "chwaibel"
__version__ = "2020.09.09"

import rhinoscriptsyntax as rs

if y:
    a = x
# ---------- end python ----------
python_2 = GhPythonScript(x=hivedistsolarsimu.SolarTechMesh)  # -> out, a; same code as python
epw_reader = EPWReader(Path=hivedistenvironment.Filepath)  # -> Latitude, Longitude, CityCountry, GHI, DNI, DHI, DryBulb, DewPoint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
sia2024room = SIA2024RoomReader(Room=hivedistsiaroom.SIA2024Room, Area=hivedistsiaroom.ZoneAreas)  # -> Τ_h, Θ_i_C, T_h, A_op_m2, A_w_m2, U_op_W_m2K, U_w_W_m2K, V_e_m3_h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
adaptivecomfort = AdaptiveComfort(AirTemperature=epw_reader.DryBulbMonthly)  # -> ThermalComfort, Comfort80UpperBound, Comfort80LowerBound, Comfort90UpperBound, Comfort90LowerBound

# ---- group: Upper temperature setpoint (°C)
panel_5 = Panel(adaptivecomfort.Comfort90UpperBound)

# ---- group: Lower temperature setpoint (°C)
panel_6 = Panel(adaptivecomfort.Comfort90LowerBound)

# ---- group: Monthly average dry bulb temperature (°C)
panel_7 = Panel(epw_reader.DryBulbMonthly)

# ---- group: checking windows order
item = ListItem(List=hivedistsolarsimu.WindowGeometries, Index=Slider(0, range=0..5), Wrap=True)
offset = OffsetSurface(Surface=item, Distance=0.5, Retrim=True)
preview = CustomPreview(Geometry=offset, Shader=ColourSwatch(SwatchColor=RGB(74, 207, 255)))

# ----
graph = QuickGraph([panel_5, panel_6, panel_7], SortOrder=0)
adaptivecomfort_2 = AdaptiveComfort(AirTemperature=epw_reader.DryBulb)  # -> ThermalComfort, Comfort80UpperBound, Comfort80LowerBound, Comfort90UpperBound, Comfort90LowerBound

# ---- group: DHI
data = Data(epw_reader.DHI)

# ----
# Shading Mask
dni = Data(epw_reader.DNI)
panel_8 = Panel([epw_reader.Longitude, epw_reader.Latitude])
pt = Point(hivedistsolarsimu.BuildingCentroid)
skydome = GHSkydome(
    CumSkyMatrix=Toggle(False),
    Location=panel_8,
    DNI=dni,
    DHI=data,
    Context=hivedistsolarsimu.EnvironmentMesh,
    Sp=pt,
    Timezone=epw_reader.Timezone)  # -> Mesh, Vectors, Sunpaths, SunGeo
preview_2 = CustomPreview(Geometry=skydome.Sunpaths, Shader=ColourSwatch(SwatchColor=RGB(0, 0, 0)))

# ----
# SOLAR SIMULATION
num = Number(number_slider_2)
num_2 = Number(number_slider)
mesh_4 = Mesh(hivedistsolarsimu.ExternalSurfaces)
data_2 = Data([0.8, 0.8, 0.8, 0.8, 0.8, 0.8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])
obstobj = ObstacleObject(
    Mesh=[hivedistsolarsimu.EnvironmentMesh, mesh_4],
    Albedo=data_2,
    SpecCoeff=data_2,
    ReflType=0,
    Tolerance=0.01,
    Name="PV",
    MT=True)

# ----
# Solare Wärmeeinträge (shaded)
mesh_uv_2 = MeshSurface(Surface=python.a, UCount=panel_3, VCount=panel_4, Overhang=True, Equalize=False)  # -> flatten(Mesh)
mesh_5 = Mesh(mesh_uv_2)
obstobj_2 = ObstacleObject(Mesh=mesh_5, Albedo=data_2, SpecCoeff=data_2, ReflType=0, Tolerance=0.01, Name="PV", MT=True)
irrmshy = IrradiationMeshYear(
    AnalysisObjects=obstobj_2,
    ObstacleObjects=obstobj,
    Latitude=epw_reader.Latitude,
    Longitude=epw_reader.Longitude,
    Year=2017,
    DNI=epw_reader.DNI,
    DHI=epw_reader.DHI,
    MainSkyRes=1,
    SpecBounces=0,
    DiffIReflSkyRes=0,
    DiffIReflMode=2,
    MT=True,
    Timezone=epw_reader.Timezone)
readresults = ReadResults(Mesh=mesh_5, I=irrmshy, Value=7)  # -> simplify(Results), SP
visumshsol = VisualizeMeshSolar(Mesh=mesh_5, I=irrmshy, Value=0, Min=num_2, Max=num, Clr=0)

# ---- group: Windows
mesh_6 = Mesh(visumshsol)

# ----
# Solare Wärmeeinträge (unshaded)
simplepanel = SimplePanel(
    Tilt=hivedistsolarsimu.WindowTilt,
    Azimuth=hivedistsolarsimu.WindowAzimuth,
    DHI=epw_reader.DHI,
    DNI=epw_reader.DNI,
    Latitude=epw_reader.Latitude,
    Longitude=epw_reader.Longitude,
    Aw=hivedistsolarsimu.WindowAreas,
    Timezone=epw_reader.Timezone)

toggle = FalseStartToggle(True)
run_e_simulation = RunESimulation(zonemasses=brep_2, childsurfaces=srf_3, epwweatherfile=panel_2, run=toggle)  # -> modelenergybalance, idf_filepath, coolinghourly, heatinghourly, coolingmonthly, heatingmonthly
panel_9 = Panel(run_e_simulation.idf_filepath)

# ----
# PV Ertrag (simuliert)
obstobj_3 = ObstacleObject(Mesh=python_2.a, Albedo=data_2, SpecCoeff=data_2, ReflType=0, Tolerance=0.01, Name="PV", MT=True)
irrmshy_2 = IrradiationMeshYear(
    AnalysisObjects=obstobj_3,
    ObstacleObjects=obstobj,
    Latitude=epw_reader.Latitude,
    Longitude=epw_reader.Longitude,
    Year=2017,
    DNI=epw_reader.DNI,
    DHI=epw_reader.DHI,
    MainSkyRes=1,
    SpecBounces=0,
    DiffIReflSkyRes=0,
    DiffIReflMode=2,
    MT=True,
    Timezone=0)
visumshsol_2 = VisualizeMeshSolar(Mesh=hivedistsolarsimu.SolarTechMesh, I=irrmshy_2, Value=0, Min=num_2, Max=num)

# ---- group: PV Panels
mesh_7 = Mesh(visumshsol_2)

# ----
sia380 = BuildingDemandSIA380(
    RoomProperties=hivedistsiaroom.SIA2024Room,
    RoomSchedules=hivedistsiaroom.SUA2024Schedules,
    FloorArea=hivedistsiaroom.ZoneAreas,
    AirTemperature=epw_reader.DryBulb,
    SetpointsUpperBounds=adaptivecomfort_2.Comfort90UpperBound,
    SetpointsLowerBounds=adaptivecomfort_2.Comfort90LowerBound,
    EnvelopeSurfaceAreas=hivedistsiaroom.AllExternalSurfaceAreas,
    EnvelopeSurfaceTypes=hivedistsiaroom.SurfaceType,
    SurfaceIrradiation=readresults.Results,
    SurfaceIrradiationUnobstructed=simplepanel,
    GValue=sia2024room.G_,
    GValueWithSunscreen=sia2024room.G_total_,
    SetpointSunscreen=sia2024room.G_T_W_m_2,
    RunObstructedSolarSimulation=Toggle(False),
    RunHourly=Toggle(False),
    UseAdaptiveComfort=Toggle(True))  # -> HeatingDemand, CoolingDemand, ElectricityDemand, TransmissionHeatLosses, VentilationHeatLosses, InternalGains, SolarGains, TransmissionHeatLossesOfOpaqueSurfaces, TransmissionHeatLossesOfTransparentSurfaces, SolarGainsPerTransparentSurface
viewer = ParamViewer(simplepanel)
cooling_monthly_honeybee_e = Panel(run_e_simulation.coolingmonthly)
heat_monthly_honeybee_e = Panel(run_e_simulation.heatingmonthly)
q_t = Panel("""2019.188256
1442.144948
674.475524
176.414787
0
0
0
0
5.178783
294.165603
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""")
viewer_2 = ParamViewer(sia380.SolarGainsPerTransparentSurface)

# ----
# PV Ertrag (unverschattet)
# Q_s = G * F_F * A_w * g
# [Q_s] = kWh
# [G] = kWh/m^2
# [F_F] = -
# [A_w] = m^2
# [g] = -
simplepanel_2 = SimplePanel(
    Tilt=hivedistsolarsimu.SolarTechTilt,
    Azimuth=hivedistsolarsimu.SolarTechAzimuth,
    DHI=epw_reader.DHI,
    DNI=epw_reader.DNI,
    Latitude=epw_reader.Latitude,
    Longitude=epw_reader.Longitude)

# ---- group: NEW SIA 380 COMPONENT
# DEMAND
abs = Absolute(Value=sia380.CoolingDemand)

# ----
panel_10 = Panel([sia380.HeatingDemand, sia380.CoolingDemand, sia380.ElectricityDemand, sia380.TransmissionHeatLosses, sia380.VentilationHeatLosses, sia380.InternalGains, sia380.SolarGains, sia380.TransmissionHeatLossesOfOpaqueSurfaces, sia380.TransmissionHeatLossesOfTransparentSurfaces])
panel_11 = Panel(sia380.CoolingDemand)
python_3 = GhPythonScript(x=q_t, y=panel_10)  # -> out, a; inputs x: list, y: list
# ---------- python_3: Python ----------
__author__ = "Maxence"
__version__ = "2021.04.23"

import rhinoscriptsyntax as rs

params = ["Q_Heat", "Q_cool", "Q_Elec", 'Q_T', 'Q_V', 'Q_i',
    'Q_s', 'Q_T_opaque', 'Q_T_transp', 'Q_s_per_windows'
]

for i, t in enumerate(zip(x,y)):
    xi,yi = t
    if i % 12 == 0:
        print
        print params[int(i/12)]
    print float(xi) - float(yi)
# ---------- end python_3 ----------
panel_12 = Panel(python_3.out)
ma = MassAddition(Input=sia380.CoolingDemand)  # -> Result, PartialResults
ma_2 = MassAddition(Input=sia380.HeatingDemand)  # -> Result, PartialResults
cooling_monthly_honeybee_e_2 = Panel("""-0.000449
-0.000846
-0.005091
-9.652978
-41.836662
-111.254533
-117.824645
-131.824099
-16.554089
-3.985156
-0.000292
-0.000111""")
heat_monthly_honeybee_e_2 = Panel("""378.989464
291.962881
227.718448
125.851368
56.743287
25.208463
13.55247
10.452175
38.463652
87.442017
229.354052
350.023371""")

# ---- group: Onlz for testing monthly
cluster = Cluster(first_number=q_t, second_number=panel_10)  # disabled
test_monthly = Panel(cluster)

# ----
total_heating = Panel(ma_2.Result)
total_cooling = Panel(ma.Result)
cooling_monthly_a_s_sia380 = Panel("""0
0
0
-2
-36.75
-92.5
-140.25
-73.25
-2.5
0
0
0""")
heat_monthly_a_s_sia380 = Panel("""295.368948
209.60751
124.237129
17.105863
0.097661
0.000249
3.9626e-6
0.000041
1.247333
68.86778
212.534008
290.937777""")
panel_13 = Panel(sia380.HeatingDemand)
hour_range = Slider(12, range=0..10000)
hour_start = Slider(0, range=0..10000)
hourly_visualiser = HourlyVisualiser(L=heat_monthly_honeybee_e_2, L_2=cooling_monthly_honeybee_e_2, A=hour_start, B=hour_range, L_3=epw_reader.DryBulb)  # -> L_4, L_5, L_6
hourly_visualiser_2 = HourlyVisualiser(L=heat_monthly_a_s_sia380, L_2=cooling_monthly_a_s_sia380, A=hour_start, B=hour_range, L_3=epw_reader.DryBulb)  # -> L_4, L_5, L_6
hourly_visualiser_3 = HourlyVisualiser(L=sia380.HeatingDemand, L_2=sia380.CoolingDemand, A=hour_start, B=hour_range, L_3=epw_reader.DryBulb)  # -> L_4, L_5, L_6

# ---- group: Cooling Monthly
graph_2 = QuickGraph([hourly_visualiser_2.L_5, sia380.CoolingDemand, hourly_visualiser.L_5], SortOrder=0)

# ---- group: Heating Monthly
graph_3 = QuickGraph([hourly_visualiser_2.L_4, sia380.HeatingDemand, hourly_visualiser.L_4], SortOrder=0)

# ----
graph_4 = QuickGraph([hourly_visualiser_3.L_4, hourly_visualiser_3.L_5], SortOrder=0)
graph_5 = QuickGraph(hourly_visualiser_3.L_6, SortOrder=0)
graph_6 = QuickGraph(SortOrder=0)
python_4 = GhPythonScript(emitters=hivedistributor.HiveEnergySystemsEmitter)  # -> out, monthlyHeatingSupTemp, monthlyCoolingSupTemp, heatingCarrier, monthlyHeatingReturnTemp, yearlyHeatingSupTemp, yearlyHeatingReturnTemp, monthlyCoolingReturnTemp; inputs emitters: list
# ---------- python_4: Python ----------
__author__ = "chwaibel"
__version__ = "2020.08.20"

import rhinoscriptsyntax as rs

for e in emitters:
    if e.IsCooling:
        monthlyCoolingSupTemp = e.InletCarrier.MonthlyTemperature
        monthlyCoolingReturnTemp = e.ReturnCarrier.MonthlyTemperature
    else:
        monthlyHeatingSupTemp = e.InletCarrier.MonthlyTemperature
        heatingCarrier = e
        monthlyHeatingReturnTemp = e.ReturnCarrier.MonthlyTemperature
        yearlyHeatingSupTemp = e.InletCarrier.Temperature
        yearlyHeatingReturnTemp = e.ReturnCarrier.Temperature
# ---------- end python_4 ----------

# ---- group: Simple efficiency calculations?
toggle_2 = BooleanToggle(False)

# ----
# Chiller
hivemergerchiller = MergerChillerHive(
    AirCarrier=hivedistenvironment.AmbientAirTemp,
    ElectricityCarrier=hivedistenvironment.GridElectricity,
    CoolingGenerated=abs,
    SupplyTemperature=python_4.monthlyCoolingSupTemp,
    SimpleMode=toggle_2,
    HiveChiller=hivedistconversiontech.Chiller)

# ----
# Air Source Heat Pump
hivemergerashp = MergerAirSourceHeatPumpHive(
    AirCarrier=hivedistenvironment.AmbientAirTemp,
    ElectricityCarrier=hivedistenvironment.GridElectricity,
    HeatingGenerated=sia380.HeatingDemand,
    SupplyTemperature=python_4.monthlyHeatingSupTemp,
    SimpleMode=toggle_2,
    HiveAirSourceHeatPump=hivedistconversiontech.AirSourceHeatPump)

# ----
# PV / ST
python_5 = GhPythonScript(x=irrmshy_2)  # -> out, a
# ---------- python_5: Python ----------
__author__ = "chwaibel"
__version__ = "2020.08.21"

import rhinoscriptsyntax as rs

a = x.I_hourly
# ---------- end python_5 ----------
hivemergersolartech = MergerSolarTechHive(
    I_hourlyM=python_5.a,
    SolarTechnologies=hivedistributor.HiveEnergySystemsSurfaceBasedTech,
    AirCarrier=hivedistenvironment.AmbientAirTemp,
    SupplyTemperature=python_4.yearlyHeatingSupTemp,
    ReturnTemperature=python_4.yearlyHeatingReturnTemp,
    SimpleMode=toggle_2,
    I_hourly=simplepanel_2)
python_6 = GhPythonScript(x=hivemergersolartech)  # -> out, a
# ---------- python_6: Python ----------
__author__ = "chwaibel"
__version__ = "2020.08.24"

import rhinoscriptsyntax as rs
a = x.OutputCarriers[0].MonthlyCumulativeEnergy
# ---------- end python_6 ----------
panel_14 = Panel(hivemergersolartech)
ma_3 = MassAddition(Input=python_6.a)  # -> Result, PartialResults
graph_7 = QuickGraph(python_6.a, SortOrder=0)
panel_15 = Panel(ma_3.Result)

# ---- group: PV electricity generation (kWh/month)
panel_16 = Panel(python_6.a)

# ----
# Plug-in any conversion tech
python_7 = GhPythonScript(x=hivemergerchiller)  # -> out, description, outEnergy
# ---------- python_7: Python ----------
__author__ = "chwaibel"
__version__ = "2020.08.18"

import rhinoscriptsyntax as rs

a = ("total investment cost: ", x.SpecificInvestmentCost * x.Capacity)
b = ("capacity: ", x.Capacity)
c = ("cap unit; ", x.CapacityUnit)
d = ("name: ", x.Name)
e = ("opCost CHF/a: ", sum(x.InputCarrier.TotalEnergyCost))
f = ("tot Input Energy kWh/a: ", sum(x.InputCarrier.Energy))
g = ("Tot Output Energy kWh/a: ", sum(x.OutputCarriers[0].MonthlyCumulativeEnergy))
h = ("Inp Car PEF: ", x.InputCarrier.PrimaryEnergyFactor)
description = [a, b, c, d, e, f, g, h]

# print(x.InputCarrier.MonthlyCumulativeEnergy)
#print(x.OutputCarriers[0].Energy)
print(x.InputCarrier.PrimaryEnergyFactor)
print("Input type: ", type(x.InputCarrier))
print("Output type: ", type(x.OutputCarriers[0]))
outEnergy = x.OutputCarriers[0].MonthlyCumulativeEnergy
print(x.IsCooling)
# ---------- end python_7 ----------
panel_17 = Panel(python_7.description)

# ----
# Purchased Grid Electricity
python_8 = GhPythonScript(chiller=hivemergerchiller, ashp=hivemergerashp, siaElec=sia380.ElectricityDemand)  # -> out, additionalElec; inputs siaElec: list
# ---------- python_8: Python ----------
__author__ = "Christoph"
__version__ = "2020.09.13"

import rhinoscriptsyntax as rs
if chiller != None and ashp != None:
    additionalElec = [a+b+c for a,b,c in zip(chiller.InputCarrier.MonthlyCumulativeEnergy, ashp.InputCarrier.MonthlyCumulativeEnergy, siaElec)]
elif ashp != None and chiller is None:
    additionalElec = [a+b for a,b in zip(ashp.InputCarrier.MonthlyCumulativeEnergy, siaElec)]
elif ashp is None and chiller != None:
    additionalElec = [a+b for a,b in zip(chiller.InputCarrier.MonthlyCumulativeEnergy, siaElec)]
else:
    additionalElec = siaElec
# ---------- end python_8 ----------
python_9 = GhPythonScript(pvOrStList=hivemergersolartech, elecDemandIn=python_8.additionalElec, heatDemandIn=sia380.HeatingDemand)  # -> out, flatten(elecDemandOut), heatDemandOut; inputs pvOrStList: list, elecDemandIn: list, heatDemandIn: list
# ---------- python_9: Python ----------
__author__ = "Christoph"
__version__ = "2020.09.13"

import rhinoscriptsyntax as rs
import Hive.IO.EnergySystems

months = 12
totalRenewableHeat = [0.0] * months
totalRenewableElec = [0.0] * months

for pvOrSt in pvOrStList:
    if(pvOrSt != None):
        energyRenewable = pvOrSt.OutputCarriers[0].MonthlyCumulativeEnergy
    
    if(type(pvOrSt) == Hive.IO.EnergySystems.Photovoltaic):
        totalRenewableElec = [x + y for x, y in zip (totalRenewableElec, energyRenewable)]
    elif(type(pvOrSt) == Hive.IO.EnergySystems.SolarThermal):
        totalRenewableHeat = [x + y for x, y in zip (totalRenewableHeat, energyRenewable)]

elecDemandOut = [x - y for x, y in zip(elecDemandIn, totalRenewableElec)]
heatDemandOut = [x - y for x, y in zip(heatDemandIn, totalRenewableHeat)]
# ---------- end python_9 ----------
hivemergerdirectelectricity = MergerDirectElectricityHive(
    ElectricityCarrier=hivedistenvironment.GridElectricity,
    ElectricityPurchased=python_9.elecDemandOut,
    DirectElectricity=hivedistconversiontech.DirectElectricity)

# ----
# Results
hiveresults = ResultsHive(
    CoolingMonthly=abs,
    HeatingMonthly=python_9.heatDemandOut,
    ElectricityMonthly=python_9.elecDemandOut,
    HiveBuilding=hivedistributor.HiveBuilding,
    HiveConversionTech=flatten([hivemergerdirectelectricity, hivemergerchiller, hivemergerashp, hivemergersolartech]),
    Q_T_opaque=sia380.TransmissionHeatLossesOfOpaqueSurfaces,
    Q_T_transparent=sia380.TransmissionHeatLossesOfTransparentSurfaces,
    Q_V=sia380.VentilationHeatLosses,
    Q_i=sia380.InternalGains,
    Q_s=sia380.SolarGains,
    ConsumedElec=python_8.additionalElec,
    ConsumedHeat=sia380.HeatingDemand,
    Q_s_per_win=sia380.SolarGainsPerTransparentSurface)
python_10 = GhPythonScript(hiveResults=hiveresults)  # -> out, a, heatingLoads, coolingLoads, electricityLoads, windowSolarGains, gainsAndLosses
# ---------- python_10: Python ----------
__author__ = "chwaibel"
__version__ = "2020.09.23"

x = hiveResults

import rhinoscriptsyntax as rs

heatingLoads = x.TotalFinalHeatingMonthly
coolingLoads = x.TotalFinalCoolingMonthly
electricityLoads = x.TotalFinalElectricityMonthly
windowSolarGains = [] 
for j in range(len(x.MonthlySolarGainsPerWindow)):
    window = x.MonthlySolarGainsPerWindow[j]
    for i in range(len(window)):
        if i==0:
            windowSolarGains.append("______")
            windowSolarGains.append("window " + str(j))
        windowSolarGains.append(window[i])
        

gainsAndLosses = []
gainsAndLossesDict = \
{"SolarGains: ": x.TotalSolarGains, \
"InternalGains: ": x.TotalInternalGains, \
"PrimaryEnergy: ": sum(x.TotalPrimaryEnergyMonthlyNonRenewable), \
"VentilationHeatGains: ": x.TotalVentilationHeatGains, \
"EnvelopeHeatGains: ": x.TotalOpaqueTransmissionHeatGains, \
"WindowHeatGains: ": x.TotalWindowTransmissionHeatGains, \
"ElectricityDemand: ": sum(x.TotalConsumedElectricityMonthly), \
"VentilationHeatLosses: ": x.TotalVentilationHeatLosses, \
"EnvelopeHeatLosses: ": x.TotalOpaqueTransmissionHeatLosses, \
"WindowHeatLosses: ": x.TotalWindowTransmissionHeatLosses, \
"SystemConversionLosses: ": x.TotalSystemLosses}

for k, v in gainsAndLossesDict.iteritems():
    gainsAndLosses.append(k + str(v))
# ---------- end python_10 ----------

hive_io_visualizer = HiveIOVisualizer(
    hiveresults,
    PlotProperties="""{
  "$type": "System.Collections.Generic.Dictionary`2[[System.String, mscorlib],[System.String, mscorlib]], mscorlib"
}""")

# ---- group: Zone Gains and Losses
panel_18 = Panel(python_10.gainsAndLosses)

# ---- group: Heating Loads
panel_19 = Panel(python_10.heatingLoads)

# ---- group: Cooling Loads
panel_20 = Panel(python_10.coolingLoads)

# ---- group: Windows Solar Gains
panel_21 = Panel(python_10.windowSolarGains)

# ---- group: Electricity Loads
panel_22 = Panel(python_10.electricityLoads)

# ---- group: Hive Results
data_3 = Data(hiveresults)

# ---- group: internalise data to store results
hiveresults_2 = HiveResultsParameter(data_3)

# ==== cluster Cluster
first_number = ClusterInput()
second_number = ClusterInput()
equality = Equality(FirstNumber=first_number, SecondNumber=second_number)  # -> Equality, Inequality
mass_addition = MassAddition(Input=equality.Equality)  # -> Result, PartialResults
list_length = ListLength(List=equality.Equality)
equality_2 = Equality(FirstNumber=list_length, SecondNumber=mass_addition.Result)  # -> Equality, Inequality
equality_3 = ClusterOutput(equality_2.Equality)

# ==== cluster HourlyVisualiser
A = ClusterInput()
B = ClusterInput()
addition = Addition(A=A, B=B)
L = ClusterInput()
L_2 = ClusterInput()
L_3 = ClusterInput()
dom = ConstructDomain(DomainStart=A, DomainEnd=addition)
subset = SubList(List=L, Domain=dom, Wrap=True)  # -> List, Index
subset_2 = SubList(List=L_2, Domain=dom, Wrap=True)  # -> List, Index
subset_3 = SubList(List=L_3, Domain=dom, Wrap=True)  # -> List, Index
L_4 = ClusterOutput(subset.List)
L_5 = ClusterOutput(subset_2.List)
L_6 = ClusterOutput(subset_3.List)

# ==== cluster RunESimulation

# ----
# HSZ - Let Honeybee Fly
# Let Ladybug Fly
ladybug = Ladybug_Ladybug()  # -> Vviiiiiiiiiizzz; plug-in component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
honeybee = Honeybee_Honeybee()  # -> Vviiiiiiiiiizzz; plug-in component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

epnomassmat = Honeybee_EnergyPlusNoMassOpaqueMaterial(name="Wall", R_Value="4")  # -> EPMaterial; plug-in component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
epnomassmat_2 = Honeybee_EnergyPlusNoMassOpaqueMaterial(name="Floor", R_Value="5")  # -> EPMaterial; plug-in component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
epnomassmat_3 = Honeybee_EnergyPlusNoMassOpaqueMaterial(name="Roof", R_Value="6.67")  # -> EPMaterial; plug-in component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
epwindowmat = Honeybee_EnergyPlusWindowMaterial(name="Window", U_Value="0.9", SHGC="0.50", VT="0.50")  # -> EPMaterial; plug-in component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
epconstruction = Honeybee_EnergyPlusConstruction(name="Wall", layer_1=epnomassmat)  # -> EPConstruction; plug-in component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
epconstruction_2 = Honeybee_EnergyPlusConstruction(name="Window", layer_1=epwindowmat)  # -> EPConstruction; plug-in component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
epconstruction_3 = Honeybee_EnergyPlusConstruction(name="Roof", layer_1=epnomassmat_3)  # -> EPConstruction; plug-in component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
epconstruction_4 = Honeybee_EnergyPlusConstruction(name="Floor", layer_1=epnomassmat_2)  # -> EPConstruction; plug-in component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
zonemasses = ClusterInput()

# ----
# HSZ Step 2. Simulation Setup
# https://www.energyplus.net/weather-download/north_and_central_america_wmo_region_4/USA/CA/USA_CA_Van.Nuys.AP.722886_TMY3/all
panel = Panel("LAHouse")
toggle = BooleanToggle(True)
epoutput = Honeybee_GenerateEPOutput(
    zoneEnergyUse=toggle,
    zoneGainsAndLosses=toggle,
    zoneComfortMetrics="False",
    surfaceTempAnalysis="False",
    surfaceEnergyAnalysis=toggle)  # -> report, flatten(simulationOutputs); plug-in component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
epw_stat = Ladybug_OpenEPWAndSTATWeatherFiles()  # -> epwFile, statFile; plug-in component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

childsurfaces = ClusterInput()
epwweatherfile = ClusterInput()
# Changing this toggle to true
# will cause the simulation to run
# any time that an input is changed.
# This may take a long time!
run = ClusterInput()
toggle_2 = BooleanToggle(True)
addition = Addition(A="7", B="11")
dom = ConstructDomain(DomainStart="7", DomainEnd=addition)

# ----
# HSZ Step 1. Create HBZones
bldgprograms = Honeybee_bldgPrograms({"Office": 0, "Retail": 1, "MidriseApartment": 2, "PrimarySchool": 3, "SecondarySchool": 4, "SmallHotel": 5, "LargeHotel": 6, "Hospital": 7, "Outpatient": 8, "Warehouse": 9, "SuperMarket": 10, "FullServiceRestaurant": 11, "QuickServiceRestaurant": 12}, selected="MidriseApartment")
house_windows = Geometry([<brep referenced from the Rhino model> x8])
house_zone = Geometry(<brep referenced from the Rhino model>)
listzoneprograms = Honeybee_ListZonePrograms(bldgProgram=bldgprograms)  # -> MidriseApartmentZonePrograms; plug-in component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
list = Honeybee_ItemSelector(
    listzoneprograms,
    {"MidriseApartment::Apartment", "MidriseApartment::Office", "MidriseApartment::Corridor"}, selected="MidriseApartment::Apartment")
mass2zone = Honeybee_Masses2Zones(zoneMasses=flatten(zonemasses), zonePrograms=list, isConditioned=True, maxRoofAngle=30, createHBZones=Toggle(True))  # -> readMe, HBZones; plug-in component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

setepzoneschedules = Honeybee_SetEnergyPlusZoneSchedules(HBZones=mass2zone.HBZones)  # -> schedules, simplify(HBZones); disabled; plug-in component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
setepzonethresholds = Honeybee_SetEnergyPlusZoneThresholds(HBZones=mass2zone.HBZones, coolingSetPt="28", heatingSetPt="20")  # -> readMe, HBZones; plug-in component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
setepzoneloads = Honeybee_SetEnergyPlusZoneLoads(
    HBZones=setepzonethresholds.HBZones,
    equipmentLoadPerArea="28",
    infilRatePerArea_Facade="0.001",
    numOfPeoplePerArea="0.025",
    ventilationPerArea="0.0002")  # -> loads, HBZones; plug-in component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
setepzonecnstr = Honeybee_SetEPZoneConstruction(
    HBZones=flatten(setepzoneloads.HBZones),
    wallEPConstruction=epconstruction,
    windowEPConstruction=epconstruction_2,
    roofEPConstruction=epconstruction_3,
    floorEPConstruction=epconstruction_4)  # -> simplify(modifiedHBZones); plug-in component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

addhbglz = Honeybee_addHBGlz(HBObj=setepzonecnstr, childSurfaces=flatten(childsurfaces))  # -> HBObjWGLZ; plug-in component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

# ----
# HSZ Step 3. Run the Energy Simulation
exporttoopenstudio = Honeybee_ExportToOpenStudio(
    epwWeatherFile=epwweatherfile,
    HBZones=flatten(addhbglz),
    simulationOutputs=flatten(epoutput.simulationOutputs),
    writeOSM=run,
    runSimulation=run,
    fileName=panel)  # -> readMe, osmFileAddress, idfFileAddress, resultFileAddress, eioFileAddress, rddFileAddress, htmlReport, studyFolder, model; plug-in component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

idf_filepath = ClusterOutput(exporttoopenstudio.idfFileAddress)

# ----
# HSZ Step 4. Visualize Output
readepresult = Honeybee_ReadEPResult(resultFileAddress=exporttoopenstudio.resultFileAddress)  # -> totalThermalLoad, thermalLoadBalance, cooling, heating, electricLight, electricEquip, port, port_2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; plug-in component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
readepsrfresult = Honeybee_ReadEPSurfaceResult(resultFileAddress=exporttoopenstudio.resultFileAddress)  # -> port, port_2, surfaceEnergyFlow, opaqueEnergyFlow, glazEnergyFlow, port_3, port_4, port_5, port_6, port_7; plug-in component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
energybalance = Honeybee_ConstructEnergyBalance(
    HBZones=flatten(addhbglz),
    cooling=readepresult.cooling,
    heating=readepresult.heating,
    electricLight=readepresult.electricLight,
    electricEquip=readepresult.electricEquip,
    peopleGains=readepresult.peopleGains,
    totalSolarGain=readepresult.totalSolarGain,
    infiltrationEnergy=readepresult.infiltrationEnergy,
    mechVentilationEnergy=readepresult.mechVentilationEnergy,
    surfaceEnergyFlow=readepsrfresult.surfaceEnergyFlow)  # -> readMe, port, flrNormEnergyBal, flrNormBalWStorage, port_2, modelEnergyBalance, energyBalWithStorage; plug-in component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
selectandaveragedata = Ladybug_AverageData(annualHourlyData=energybalance.flrNormBalWStorage)  # -> readMe, selHourlyData, averagedDaily, averagedMonthly, avrMonthlyPerHour, avrMonthlyMinPerHour, avrMonthlyMaxPerHour; disabled; plug-in component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
gradientlibrary = Ladybug_GradientLibrary(gradIndex="19")  # -> customColors; plug-in component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
legendpar = Ladybug_LegendParameters(customColors=flatten(gradientlibrary))  # -> legendPar; disabled; plug-in component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
barchart = Ladybug_MonthlyBarChart(
    inputData=flatten(selectandaveragedata.averagedMonthly),
    stackValues=Toggle(True),
    altYAxisTitle="Energy Intensity (kWh/m2)",
    basePoint="70,0,0",
    legendPar=legendpar)  # -> readMe, dataMesh, dataCurves, dataCrvColors, graphAxes, graphLabels, title, titleBasePt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; disabled; plug-in component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

selectandaveragedata_2 = Ladybug_AverageData(annualHourlyData=readepresult.heating, totalOrAverage=toggle_2)  # -> readMe, selHourlyData, totaledDaily, totaledMonthly, totMonthlyPerHour, totMonthlyMinPerHour, totMonthlyMaxPerHour; plug-in component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
selectandaveragedata_3 = Ladybug_AverageData(annualHourlyData=readepresult.cooling, totalOrAverage=toggle_2)  # -> readMe, selHourlyData, totaledDaily, totaledMonthly, totMonthlyPerHour, totMonthlyMinPerHour, totMonthlyMaxPerHour; plug-in component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
coolinghourly = ClusterOutput(readepresult.cooling)
heatinghourly = ClusterOutput(readepresult.heating)
subset = SubList(List=selectandaveragedata_2.totaledMonthly, Domain=dom, Wrap=True)  # -> List, Index
subset_2 = SubList(List=selectandaveragedata_3.totaledMonthly, Domain=dom, Wrap=True)  # -> List, Index
modelenergybalance = ClusterOutput(energybalance.modelEnergyBalance)
neg = Negative(Value=subset_2.List)
heatingmonthly = ClusterOutput(subset.List)
coolingmonthly = ClusterOutput(neg)
